% Simulink data dictionary px4_param.sldd

TPA_RATE_LOWER_LIMIT = 0.05
MNT_MAN_CONTROL = 0
MPC_MAN_R_MAX = 35
MPC_MAN_P_MAX = 35
SENS_EXT_MAG_ROT = 0
MPC_Z_FF = 0.5
MPC_XY_FF = 0.5
RTL_DELAY_SIGMA = Simulink.Parameter(0.01, DataType="single")
CAL_BOARD_ID = Simulink.Parameter(0)
CAL_GYRO0_ID = Simulink.Parameter(0)
CAL_GYRO0_XOFF = Simulink.Parameter(0)
CAL_GYRO0_YOFF = Simulink.Parameter(0)
CAL_GYRO0_ZOFF = Simulink.Parameter(0)
CAL_GYRO0_XSCALE = Simulink.Parameter(1)
CAL_GYRO0_YSCALE = Simulink.Parameter(1)
CAL_GYRO0_ZSCALE = Simulink.Parameter(1)
CAL_MAG0_ID = Simulink.Parameter(0)
CAL_MAG0_ROT = Simulink.Parameter(-1)
CAL_MAG0_XOFF = Simulink.Parameter(0)
CAL_MAG0_YOFF = Simulink.Parameter(0)
CAL_MAG0_ZOFF = Simulink.Parameter(0)
CAL_MAG0_XSCALE = Simulink.Parameter(1)
CAL_MAG0_YSCALE = Simulink.Parameter(1)
CAL_MAG0_ZSCALE = Simulink.Parameter(1)
CAL_ACC0_ID = Simulink.Parameter(0)
CAL_ACC0_XOFF = Simulink.Parameter(0)
CAL_ACC0_YOFF = Simulink.Parameter(0)
CAL_ACC0_ZOFF = Simulink.Parameter(0)
CAL_ACC0_XSCALE = Simulink.Parameter(1)
CAL_ACC0_YSCALE = Simulink.Parameter(1)
CAL_ACC0_ZSCALE = Simulink.Parameter(1)
CAL_GYRO1_ID = Simulink.Parameter(0)
CAL_GYRO1_XOFF = Simulink.Parameter(0)
CAL_GYRO1_YOFF = Simulink.Parameter(0)
CAL_GYRO1_ZOFF = Simulink.Parameter(0)
CAL_GYRO1_XSCALE = Simulink.Parameter(1)
CAL_GYRO1_YSCALE = Simulink.Parameter(1)
CAL_GYRO1_ZSCALE = Simulink.Parameter(1)
CAL_MAG1_ID = Simulink.Parameter(0)
CAL_MAG1_ROT = Simulink.Parameter(-1)
CAL_MAG1_XOFF = Simulink.Parameter(0)
CAL_MAG1_YOFF = Simulink.Parameter(0)
CAL_MAG1_ZOFF = Simulink.Parameter(0)
CAL_MAG1_XSCALE = Simulink.Parameter(1)
CAL_MAG1_YSCALE = Simulink.Parameter(1)
CAL_MAG1_ZSCALE = Simulink.Parameter(1)
CAL_ACC1_ID = Simulink.Parameter(0)
CAL_ACC1_XOFF = Simulink.Parameter(0)
CAL_ACC1_YOFF = Simulink.Parameter(0)
CAL_ACC1_ZOFF = Simulink.Parameter(0)
CAL_ACC1_XSCALE = Simulink.Parameter(1)
CAL_ACC1_YSCALE = Simulink.Parameter(1)
CAL_ACC1_ZSCALE = Simulink.Parameter(1)
CAL_GYRO2_ID = Simulink.Parameter(0)
CAL_GYRO2_XOFF = Simulink.Parameter(0)
CAL_GYRO2_YOFF = Simulink.Parameter(0)
CAL_GYRO2_ZOFF = Simulink.Parameter(0)
CAL_GYRO2_XSCALE = Simulink.Parameter(1)
CAL_GYRO2_YSCALE = Simulink.Parameter(1)
CAL_GYRO2_ZSCALE = Simulink.Parameter(1)
CAL_MAG2_ID = Simulink.Parameter(0)
CAL_MAG2_ROT = Simulink.Parameter(-1)
CAL_MAG2_XOFF = Simulink.Parameter(0)
CAL_MAG2_YOFF = Simulink.Parameter(0)
CAL_MAG2_ZOFF = Simulink.Parameter(0)
CAL_MAG2_XSCALE = Simulink.Parameter(1)
CAL_MAG2_YSCALE = Simulink.Parameter(1)
CAL_MAG2_ZSCALE = Simulink.Parameter(1)
CAL_ACC2_ID = Simulink.Parameter(0)
CAL_ACC2_XOFF = Simulink.Parameter(0)
CAL_ACC2_YOFF = Simulink.Parameter(0)
CAL_ACC2_ZOFF = Simulink.Parameter(0)
CAL_ACC2_XSCALE = Simulink.Parameter(1)
CAL_ACC2_YSCALE = Simulink.Parameter(1)
CAL_ACC2_ZSCALE = Simulink.Parameter(1)
CAL_MAG3_ID = Simulink.Parameter(0)
CAL_MAG3_ROT = Simulink.Parameter(-1)
CAL_MAG3_XOFF = Simulink.Parameter(0)
CAL_MAG3_YOFF = Simulink.Parameter(0)
CAL_MAG3_ZOFF = Simulink.Parameter(0)
CAL_MAG3_XSCALE = Simulink.Parameter(1)
CAL_MAG3_YSCALE = Simulink.Parameter(1)
CAL_MAG3_ZSCALE = Simulink.Parameter(1)
CAL_ACC_PRIME = Simulink.Parameter(0)
CAL_GYRO_PRIME = Simulink.Parameter(0)
CAL_MAG_PRIME = Simulink.Parameter(0)
CAL_MAG_SIDES = Simulink.Parameter(63)
SENS_EXT_MAG = Simulink.Parameter(0)
ATT_VIBE_THRESH = Simulink.Parameter(0.2)
RC_RL1_DSM_VCC = Simulink.Parameter(0)
RC_DSM_BIND = Simulink.Parameter(-1)
BAT_V_SCALE_IO = Simulink.Parameter(10000)
BAT_CNT_V_VOLT = Simulink.Parameter(-1)
BAT_CNT_V_CURR = Simulink.Parameter(-1)
BAT_V_OFFS_CURR = Simulink.Parameter(0)
BAT_V_DIV = Simulink.Parameter(-1)
BAT_A_PER_V = Simulink.Parameter(-1)
BAT_SOURCE = Simulink.Parameter(0)
RC_TH_USER = Simulink.Parameter(1)
SENS_EN_LL40LS = Simulink.Parameter(0)
SENS_EN_SF0X = Simulink.Parameter(0)
SENS_EN_MB12XX = Simulink.Parameter(0)
SENS_EN_TRONE = Simulink.Parameter(0)
SENS_EN_SF1XX = Simulink.Parameter(0)
EKF2_OF_RMAX = Simulink.Parameter(single(2.5))
MPC_ACC_HOR_FLOW = Simulink.Parameter(single(0.5))
RTL_LAND_TYPE = Simulink.Parameter(int32(0))
SENS_FLOW_ROT = Simulink.Parameter(int32(6))
SENS_FLOW_MINRNG = Simulink.Parameter(single(0.7))
TRIG_INTERFACE = Simulink.Parameter(int32(4))
TRIG_INTERVAL = Simulink.Parameter(single(40))
TRIG_POLARITY = Simulink.Parameter(int32(0))
TRIG_ACT_TIME = Simulink.Parameter(single(40))
TRIG_MODE = Simulink.Parameter(int32(0))
TRIG_PINS = Simulink.Parameter(int32(56))
TRIG_DISTANCE = Simulink.Parameter(single(25))
MKBLCTRL_TEST = Simulink.Parameter(int32(0))
PWM_AUX_REV1 = Simulink.Parameter(int32(0))
PWM_AUX_REV2 = Simulink.Parameter(int32(0))
PWM_AUX_REV3 = Simulink.Parameter(int32(0))
PWM_AUX_REV4 = Simulink.Parameter(int32(0))
PWM_AUX_REV5 = Simulink.Parameter(int32(0))
PWM_AUX_REV6 = Simulink.Parameter(int32(0))
PWM_AUX_TRIM1 = Simulink.Parameter(single(0))
PWM_AUX_TRIM2 = Simulink.Parameter(single(0))
PWM_AUX_TRIM3 = Simulink.Parameter(single(0))
PWM_AUX_TRIM4 = Simulink.Parameter(single(0))
PWM_AUX_TRIM5 = Simulink.Parameter(single(0))
PWM_AUX_TRIM6 = Simulink.Parameter(single(0))
THR_MDL_FAC = Simulink.Parameter(single(0))
MOT_SLEW_MAX = Simulink.Parameter(single(0))
MOT_ORDERING = Simulink.Parameter(int32(0))
SYS_FMU_TASK = Simulink.Parameter(int32(0))
SYS_USE_IO = Simulink.Parameter(int32(1))
PWM_MAIN_REV1 = Simulink.Parameter(int32(0))
PWM_MAIN_REV2 = Simulink.Parameter(int32(0))
PWM_MAIN_REV3 = Simulink.Parameter(int32(0))
PWM_MAIN_REV4 = Simulink.Parameter(int32(0))
PWM_MAIN_REV5 = Simulink.Parameter(int32(0))
PWM_MAIN_REV6 = Simulink.Parameter(int32(0))
PWM_MAIN_REV7 = Simulink.Parameter(int32(0))
PWM_MAIN_REV8 = Simulink.Parameter(int32(0))
PWM_MAIN_TRIM1 = Simulink.Parameter(single(0))
PWM_MAIN_TRIM2 = Simulink.Parameter(single(0))
PWM_MAIN_TRIM3 = Simulink.Parameter(single(0))
PWM_MAIN_TRIM4 = Simulink.Parameter(single(0))
PWM_MAIN_TRIM5 = Simulink.Parameter(single(0))
PWM_MAIN_TRIM6 = Simulink.Parameter(single(0))
PWM_MAIN_TRIM7 = Simulink.Parameter(single(0))
PWM_MAIN_TRIM8 = Simulink.Parameter(single(0))
PWM_SBUS_MODE = Simulink.Parameter(int32(0))
RC_RSSI_PWM_CHAN = Simulink.Parameter(int32(0))
RC_RSSI_PWM_MAX = Simulink.Parameter(int32(1000))
RC_RSSI_PWM_MIN = Simulink.Parameter(int32(2000))
LED_RGB_MAXBRT = Simulink.Parameter(int32(15))
ISBD_READ_INT = Simulink.Parameter(int32(0))
ISBD_SBD_TIMEOUT = Simulink.Parameter(int32(60))
ISBD_STACK_TIME = Simulink.Parameter(int32(0))
MNT_MODE_IN = Simulink.Parameter(int32(-1))
MNT_MODE_OUT = Simulink.Parameter(int32(0))
MNT_MAV_SYSID = Simulink.Parameter(int32(1))
MNT_MAV_COMPID = Simulink.Parameter(int32(154))
MNT_OB_NORM_MODE = Simulink.Parameter(single(-1))
MNT_OB_LOCK_MODE = Simulink.Parameter(single(0))
MNT_MAN_ROLL = Simulink.Parameter(int32(0))
MNT_MAN_PITCH = Simulink.Parameter(int32(0))
MNT_MAN_YAW = Simulink.Parameter(int32(0))
MNT_DO_STAB = Simulink.Parameter(int32(0))
MNT_RANGE_PITCH = Simulink.Parameter(single(360))
MNT_RANGE_ROLL = Simulink.Parameter(single(360))
MNT_RANGE_YAW = Simulink.Parameter(single(360))
MNT_OFF_PITCH = Simulink.Parameter(single(0))
MNT_OFF_ROLL = Simulink.Parameter(single(0))
MNT_OFF_YAW = Simulink.Parameter(single(0))
BD_GPROPERTIES = Simulink.Parameter(single(0.03))
BD_TURNRADIUS = Simulink.Parameter(single(120))
BD_PRECISION = Simulink.Parameter(single(30))
BD_OBJ_CD = Simulink.Parameter(single(0.1))
BD_OBJ_MASS = Simulink.Parameter(single(0.6))
BD_OBJ_SURFACE = Simulink.Parameter(single(0.00311724539))
BAT_V_EMPTY = Simulink.Parameter(single(3.5))
BAT_V_CHARGED = Simulink.Parameter(single(4.05))
BAT_LOW_THR = Simulink.Parameter(single(0.15))
BAT_CRIT_THR = Simulink.Parameter(single(0.07))
BAT_EMERGEN_THR = Simulink.Parameter(single(0.05))
BAT_V_LOAD_DROP = Simulink.Parameter(single(0.3))
BAT_R_INTERNAL = Simulink.Parameter(single(-1))
BAT_N_CELLS = Simulink.Parameter(int32(0))
BAT_CAPACITY = Simulink.Parameter(single(-1))
CBRK_SUPPLY_CHK = Simulink.Parameter(int32(0))
CBRK_RATE_CTRL = Simulink.Parameter(int32(0))
CBRK_IO_SAFETY = Simulink.Parameter(int32(0))
CBRK_AIRSPD_CHK = Simulink.Parameter(int32(0))
CBRK_FLIGHTTERM = Simulink.Parameter(int32(121212))
CBRK_ENGINEFAIL = Simulink.Parameter(int32(284953))
CBRK_GPSFAIL = Simulink.Parameter(int32(0))
CBRK_BUZZER = Simulink.Parameter(int32(0))
CBRK_USB_CHK = Simulink.Parameter(int32(0))
CBRK_VELPOSERR = Simulink.Parameter(int32(0))
TEST_MIN = Simulink.Parameter(single(-1))

TEST_MAX = Simulink.Parameter(single(1))
TEST_TRIM = Simulink.Parameter(single(0.5))
TEST_HP = Simulink.Parameter(single(10))
TEST_LP = Simulink.Parameter(single(10))
TEST_P = Simulink.Parameter(single(0.2))
TEST_I = Simulink.Parameter(single(0.1))
TEST_I_MAX = Simulink.Parameter(single(1))
TEST_D = Simulink.Parameter(single(0.01))
TEST_D_LP = Simulink.Parameter(single(10))
TEST_MEAN = Simulink.Parameter(single(1))
TEST_DEV = Simulink.Parameter(single(2))
ATT_W_ACC = Simulink.Parameter(single(0.2))
ATT_W_MAG = Simulink.Parameter(single(0.1))
ATT_W_EXT_HDG = Simulink.Parameter(single(0.1))
ATT_W_GYRO_BIAS = Simulink.Parameter(single(0.1))
ATT_MAG_DECL = Simulink.Parameter(single(0))
ATT_MAG_DECL_A = Simulink.Parameter(int32(1))
ATT_EXT_HDG_M = Simulink.Parameter(int32(0))
ATT_ACC_COMP = Simulink.Parameter(int32(1))
ATT_BIAS_MAX = Simulink.Parameter(single(0.05))
CAM_FBACK_MODE = Simulink.Parameter(int32(0))
TRIM_ROLL = Simulink.Parameter(single(0))
TRIM_PITCH = Simulink.Parameter(single(0))
TRIM_YAW = Simulink.Parameter(single(0))
COM_DL_LOSS_T = Simulink.Parameter(int32(10))
COM_DL_REG_T = Simulink.Parameter(int32(0))
COM_HLDL_LOSS_T = Simulink.Parameter(int32(120))
COM_HLDL_REG_T = Simulink.Parameter(int32(0))
COM_EF_THROT = Simulink.Parameter(single(0.5))
COM_EF_C2T = Simulink.Parameter(single(5))
COM_EF_TIME = Simulink.Parameter(single(10))
COM_RC_LOSS_T = Simulink.Parameter(single(0.5))
COM_RC_STICK_OV = Simulink.Parameter(single(12))
COM_HOME_H_T = Simulink.Parameter(single(5))
COM_HOME_V_T = Simulink.Parameter(single(10))
COM_RC_IN_MODE = Simulink.Parameter(int32(0))
COM_RC_ARM_HYST = Simulink.Parameter(int32(1000))
COM_DISARM_LAND = Simulink.Parameter(int32(0))
COM_ARM_SWISBTN = Simulink.Parameter(int32(0))
COM_LOW_BAT_ACT = Simulink.Parameter(int32(0))
COM_OF_LOSS_T = Simulink.Parameter(single(0))
COM_OBL_ACT = Simulink.Parameter(int32(0))
COM_OBL_RC_ACT = Simulink.Parameter(int32(0))
COM_FLTMODE1 = Simulink.Parameter(int32(-1))
COM_FLTMODE2 = Simulink.Parameter(int32(-1))
COM_FLTMODE3 = Simulink.Parameter(int32(-1))
COM_FLTMODE4 = Simulink.Parameter(int32(-1))
COM_FLTMODE5 = Simulink.Parameter(int32(-1))
COM_FLTMODE6 = Simulink.Parameter(int32(-1))
COM_ARM_EKF_POS = Simulink.Parameter(single(0.5))
COM_ARM_EKF_VEL = Simulink.Parameter(single(0.5))
COM_ARM_EKF_HGT = Simulink.Parameter(single(1))
COM_ARM_EKF_YAW = Simulink.Parameter(single(0.5))
COM_ARM_EKF_AB = Simulink.Parameter(single(0.0024))
COM_ARM_EKF_GB = Simulink.Parameter(single(0.00087))
COM_ARM_IMU_ACC = Simulink.Parameter(single(0.7))
COM_ARM_IMU_GYR = Simulink.Parameter(single(0.25))
COM_ARM_MAG = Simulink.Parameter(single(0.15))
COM_RC_OVERRIDE = Simulink.Parameter(int32(0))
COM_POSCTL_NAVL = Simulink.Parameter(int32(0))
COM_ARM_AUTH = Simulink.Parameter(int32(256010))
COM_POS_FS_DELAY = Simulink.Parameter(int32(1))
COM_POS_FS_PROB = Simulink.Parameter(int32(30))
COM_POS_FS_GAIN = Simulink.Parameter(int32(10))
COM_POS_FS_EPH = Simulink.Parameter(single(5))
COM_POS_FS_EPV = Simulink.Parameter(single(10))
COM_VEL_FS_EVH = Simulink.Parameter(single(1))
COM_FLIGHT_UUID = Simulink.Parameter(int32(0))
COM_TAKEOFF_ACT = Simulink.Parameter(int32(0))
EKF2_MIN_OBS_DT = Simulink.Parameter(int32(20))
EKF2_MAG_DELAY = Simulink.Parameter(single(0))
EKF2_BARO_DELAY = Simulink.Parameter(single(0))
EKF2_GPS_DELAY = Simulink.Parameter(single(110))
EKF2_OF_DELAY = Simulink.Parameter(single(5))
EKF2_RNG_DELAY = Simulink.Parameter(single(5))
EKF2_ASP_DELAY = Simulink.Parameter(single(100))
EKF2_EV_DELAY = Simulink.Parameter(single(175))
EKF2_AVEL_DELAY = Simulink.Parameter(single(5))
EKF2_GPS_CHECK = Simulink.Parameter(int32(21))
EKF2_REQ_EPH = Simulink.Parameter(single(5))
EKF2_REQ_EPV = Simulink.Parameter(single(8))
EKF2_REQ_SACC = Simulink.Parameter(single(1))
EKF2_REQ_NSATS = Simulink.Parameter(int32(6))
EKF2_REQ_GDOP = Simulink.Parameter(single(2.5))
EKF2_REQ_HDRIFT = Simulink.Parameter(single(0.3))
EKF2_REQ_VDRIFT = Simulink.Parameter(single(0.5))
EKF2_GYR_NOISE = Simulink.Parameter(single(0.015))
EKF2_ACC_NOISE = Simulink.Parameter(single(0.35))
EKF2_GYR_B_NOISE = Simulink.Parameter(single(0.001))
EKF2_ACC_B_NOISE = Simulink.Parameter(single(0.003))
EKF2_MAG_B_NOISE = Simulink.Parameter(single(0.0001))
EKF2_MAG_E_NOISE = Simulink.Parameter(single(0.001))
EKF2_WIND_NOISE = Simulink.Parameter(single(0.1))
EKF2_GPS_V_NOISE = Simulink.Parameter(single(0.5))
EKF2_GPS_P_NOISE = Simulink.Parameter(single(0.5))
EKF2_NOAID_NOISE = Simulink.Parameter(single(10))
EKF2_BARO_NOISE = Simulink.Parameter(single(2))
EKF2_HEAD_NOISE = Simulink.Parameter(single(0.3))
EKF2_MAG_NOISE = Simulink.Parameter(single(0.05))
EKF2_EAS_NOISE = Simulink.Parameter(single(1.4))
EKF2_BETA_GATE = Simulink.Parameter(single(5))
EKF2_BETA_NOISE = Simulink.Parameter(single(0.3))
EKF2_MAG_DECL = Simulink.Parameter(single(0))
EKF2_HDG_GATE = Simulink.Parameter(single(2.6))
EKF2_MAG_GATE = Simulink.Parameter(single(3))
EKF2_DECL_TYPE = Simulink.Parameter(int32(7))
EKF2_MAG_TYPE = Simulink.Parameter(int32(0))
EKF2_MAG_ACCLIM = Simulink.Parameter(single(0.5))
EKF2_MAG_YAWLIM = Simulink.Parameter(single(0.25))
EKF2_BARO_GATE = Simulink.Parameter(single(5))
EKF2_GPS_P_GATE = Simulink.Parameter(single(5))
EKF2_GPS_V_GATE = Simulink.Parameter(single(5))
EKF2_TAS_GATE = Simulink.Parameter(single(3))
EKF2_AID_MASK = Simulink.Parameter(int32(1))
EKF2_HGT_MODE = Simulink.Parameter(int32(0))
EKF2_NOAID_TOUT = Simulink.Parameter(int32(5000000))
EKF2_RNG_NOISE = Simulink.Parameter(single(0.1))
EKF2_RNG_SFE = Simulink.Parameter(single(0.05))
EKF2_RNG_GATE = Simulink.Parameter(single(5))
EKF2_MIN_RNG = Simulink.Parameter(single(0.1))
EKF2_EVP_NOISE = Simulink.Parameter(single(0.05))
EKF2_EVA_NOISE = Simulink.Parameter(single(0.05))
EKF2_EV_GATE = Simulink.Parameter(single(5))
EKF2_OF_N_MIN = Simulink.Parameter(single(0.15))
EKF2_OF_N_MAX = Simulink.Parameter(single(0.5))
EKF2_OF_QMIN = Simulink.Parameter(int32(1))
EKF2_OF_GATE = Simulink.Parameter(single(3))
EKF2_TERR_NOISE = Simulink.Parameter(single(5))
EKF2_TERR_GRAD = Simulink.Parameter(single(0.5))
EKF2_IMU_POS_X = Simulink.Parameter(single(0))
EKF2_IMU_POS_Y = Simulink.Parameter(single(0))
EKF2_IMU_POS_Z = Simulink.Parameter(single(0))
EKF2_GPS_POS_X = Simulink.Parameter(single(0))
EKF2_GPS_POS_Y = Simulink.Parameter(single(0))
EKF2_GPS_POS_Z = Simulink.Parameter(single(0))
EKF2_RNG_POS_X = Simulink.Parameter(single(0))
EKF2_RNG_POS_Y = Simulink.Parameter(single(0))
EKF2_RNG_POS_Z = Simulink.Parameter(single(0))
EKF2_OF_POS_X = Simulink.Parameter(single(0))
EKF2_OF_POS_Y = Simulink.Parameter(single(0))
EKF2_OF_POS_Z = Simulink.Parameter(single(0))
EKF2_EV_POS_X = Simulink.Parameter(single(0))
EKF2_EV_POS_Y = Simulink.Parameter(single(0))
EKF2_EV_POS_Z = Simulink.Parameter(single(0))
EKF2_ARSP_THR = Simulink.Parameter(single(0))
EKF2_FUSE_BETA = Simulink.Parameter(int32(0))
EKF2_TAU_VEL = Simulink.Parameter(single(0.25))
EKF2_TAU_POS = Simulink.Parameter(single(0.25))
EKF2_GBIAS_INIT = Simulink.Parameter(single(0.1))
EKF2_ABIAS_INIT = Simulink.Parameter(single(0.2))
EKF2_ANGERR_INIT = Simulink.Parameter(single(0.1))
EKF2_RNG_PITCH = Simulink.Parameter(single(0))
EKF2_MAGBIAS_X = Simulink.Parameter(single(0))
EKF2_MAGBIAS_Y = Simulink.Parameter(single(0))
EKF2_MAGBIAS_Z = Simulink.Parameter(single(0))
EKF2_MAGBIAS_ID = Simulink.Parameter(int32(0))
EKF2_MAGB_VREF = Simulink.Parameter(single(2.5e-7))
EKF2_MAGB_K = Simulink.Parameter(single(0.2))
EKF2_RNG_AID = Simulink.Parameter(int32(0))
EKF2_RNG_A_VMAX = Simulink.Parameter(single(1))
EKF2_RNG_A_HMAX = Simulink.Parameter(single(5))
EKF2_RNG_A_IGATE = Simulink.Parameter(single(1))
EKF2_DRAG_NOISE = Simulink.Parameter(single(2.5))
EKF2_BCOEF_X = Simulink.Parameter(single(25))
EKF2_BCOEF_Y = Simulink.Parameter(single(25))
EKF2_ASPD_MAX = Simulink.Parameter(single(20))
EKF2_PCOEF_XP = Simulink.Parameter(single(0))
EKF2_PCOEF_XN = Simulink.Parameter(single(0))
EKF2_PCOEF_Y = Simulink.Parameter(single(0))
EKF2_PCOEF_Z = Simulink.Parameter(single(0))
EKF2_ABL_LIM = Simulink.Parameter(single(0.4))
EKF2_ABL_ACCLIM = Simulink.Parameter(single(25))
EKF2_ABL_GYRLIM = Simulink.Parameter(single(3))
EKF2_ABL_TAU = Simulink.Parameter(single(0.5))
FW_R_TC = Simulink.Parameter(single(0.4))
FW_P_TC = Simulink.Parameter(single(0.4))
FW_PR_P = Simulink.Parameter(single(0.08))
FW_PR_I = Simulink.Parameter(single(0.02))
FW_P_RMAX_POS = Simulink.Parameter(single(60))
FW_P_RMAX_NEG = Simulink.Parameter(single(60))
FW_PR_IMAX = Simulink.Parameter(single(0.4))
FW_RR_P = Simulink.Parameter(single(0.05))
FW_RR_I = Simulink.Parameter(single(0.01))
FW_RR_IMAX = Simulink.Parameter(single(0.2))
FW_R_RMAX = Simulink.Parameter(single(70))
FW_YR_P = Simulink.Parameter(single(0.05))
FW_YR_I = Simulink.Parameter(single(0.01))
FW_YR_IMAX = Simulink.Parameter(single(0.2))
FW_Y_RMAX = Simulink.Parameter(single(50))
FW_RLL_TO_YAW_FF = Simulink.Parameter(single(0))
FW_W_EN = Simulink.Parameter(int32(0))
FW_WR_P = Simulink.Parameter(single(0.5))
FW_WR_I = Simulink.Parameter(single(0.1))
FW_WR_IMAX = Simulink.Parameter(single(1))
FW_W_RMAX = Simulink.Parameter(single(30))
FW_RR_FF = Simulink.Parameter(single(0.5))
FW_PR_FF = Simulink.Parameter(single(0.5))
FW_YR_FF = Simulink.Parameter(single(0.3))
FW_WR_FF = Simulink.Parameter(single(0.2))
FW_RSP_OFF = Simulink.Parameter(single(0))

FW_PSP_OFF = Simulink.Parameter(single(0))
FW_MAN_R_MAX = Simulink.Parameter(single(45))
FW_MAN_P_MAX = Simulink.Parameter(single(45))
FW_FLAPS_SCL = Simulink.Parameter(single(1))
FW_FLAPERON_SCL = Simulink.Parameter(single(0))
FW_ARSP_MODE = Simulink.Parameter(int32(0))
FW_MAN_R_SC = Simulink.Parameter(single(1))
FW_MAN_P_SC = Simulink.Parameter(single(1))
FW_MAN_Y_SC = Simulink.Parameter(single(1))
FW_BAT_SCALE_EN = Simulink.Parameter(int32(0))
FW_ACRO_X_MAX = Simulink.Parameter(single(90))
FW_ACRO_Y_MAX = Simulink.Parameter(single(90))
FW_ACRO_Z_MAX = Simulink.Parameter(single(45))
FW_RATT_TH = Simulink.Parameter(single(0.8))
FW_DTRIM_R_VMIN = Simulink.Parameter(single(0))
FW_DTRIM_P_VMIN = Simulink.Parameter(single(0))
FW_DTRIM_Y_VMIN = Simulink.Parameter(single(0))
FW_DTRIM_R_VMAX = Simulink.Parameter(single(0))
FW_DTRIM_P_VMAX = Simulink.Parameter(single(0))
FW_DTRIM_Y_VMAX = Simulink.Parameter(single(0))
FW_DTRIM_R_FLPS = Simulink.Parameter(single(0))
FW_DTRIM_P_FLPS = Simulink.Parameter(single(0))
FW_L1_PERIOD = Simulink.Parameter(single(20))
FW_L1_DAMPING = Simulink.Parameter(single(0.75))
FW_THR_CRUISE = Simulink.Parameter(single(0.6))
FW_THR_ALT_SCL = Simulink.Parameter(single(0))
FW_THR_SLEW_MAX = Simulink.Parameter(single(0))
FW_P_LIM_MIN = Simulink.Parameter(single(-45))
FW_P_LIM_MAX = Simulink.Parameter(single(45))
FW_R_LIM = Simulink.Parameter(single(50))
FW_THR_MAX = Simulink.Parameter(single(1))
FW_THR_MIN = Simulink.Parameter(single(0))
FW_THR_IDLE = Simulink.Parameter(single(0.15))
FW_THR_LND_MAX = Simulink.Parameter(single(1))
FW_LND_ANG = Simulink.Parameter(single(5))
FW_LND_HVIRT = Simulink.Parameter(single(10))
FW_LND_FLALT = Simulink.Parameter(single(8))
FW_LND_TLALT = Simulink.Parameter(single(-1))
FW_LND_HHDIST = Simulink.Parameter(single(15))
FW_LND_USETER = Simulink.Parameter(int32(0))
FW_LND_FL_PMIN = Simulink.Parameter(single(2.5))
FW_LND_FL_PMAX = Simulink.Parameter(single(15))
FW_LND_AIRSPD_SC = Simulink.Parameter(single(1.3))
FW_AIRSPD_MIN = Simulink.Parameter(single(10))
FW_AIRSPD_MAX = Simulink.Parameter(single(20))
FW_AIRSPD_TRIM = Simulink.Parameter(single(15))
FW_T_CLMB_MAX = Simulink.Parameter(single(5))
FW_T_SINK_MIN = Simulink.Parameter(single(2))
FW_T_SINK_MAX = Simulink.Parameter(single(5))
FW_T_TIME_CONST = Simulink.Parameter(single(5))
FW_T_THRO_CONST = Simulink.Parameter(single(8))
FW_T_THR_DAMP = Simulink.Parameter(single(0.5))
FW_T_INTEG_GAIN = Simulink.Parameter(single(0.1))
FW_T_VERT_ACC = Simulink.Parameter(single(7))
FW_T_HGT_OMEGA = Simulink.Parameter(single(3))
FW_T_SPD_OMEGA = Simulink.Parameter(single(2))
FW_T_RLL2THR = Simulink.Parameter(single(15))
FW_T_SPDWEIGHT = Simulink.Parameter(single(1))
FW_T_PTCH_DAMP = Simulink.Parameter(single(0))
FW_T_HRATE_P = Simulink.Parameter(single(0.05))
FW_T_HRATE_FF = Simulink.Parameter(single(0.8))
FW_T_SRATE_P = Simulink.Parameter(single(0.02))
LAUN_ALL_ON = Simulink.Parameter(int32(0))
LAUN_CAT_A = Simulink.Parameter(single(30))
LAUN_CAT_T = Simulink.Parameter(single(0.05))
LAUN_CAT_MDEL = Simulink.Parameter(single(0))
LAUN_CAT_PMAX = Simulink.Parameter(single(30))
RWTO_TKOFF = Simulink.Parameter(int32(0))
RWTO_HDG = Simulink.Parameter(int32(0))
RWTO_NAV_ALT = Simulink.Parameter(single(5))
RWTO_MAX_THR = Simulink.Parameter(single(1))
RWTO_PSP = Simulink.Parameter(single(0))
RWTO_MAX_PITCH = Simulink.Parameter(single(20))
RWTO_MAX_ROLL = Simulink.Parameter(single(25))
RWTO_AIRSPD_SCL = Simulink.Parameter(single(1.3))
GND_WR_TC = Simulink.Parameter(single(0.4))
GND_WR_P = Simulink.Parameter(single(1))
GND_WR_I = Simulink.Parameter(single(0))
GND_WR_D = Simulink.Parameter(single(0))
GND_WR_IMAX = Simulink.Parameter(single(0))
GND_W_RMAX = Simulink.Parameter(single(90))
GND_WR_FF = Simulink.Parameter(single(0))
GND_MAN_Y_SC = Simulink.Parameter(single(1))
GND_GSPD_SP_TRIM = Simulink.Parameter(single(1))
GND_BAT_SCALE_EN = Simulink.Parameter(int32(0))
GND_L1_DIST = Simulink.Parameter(single(5))
GND_L1_PERIOD = Simulink.Parameter(single(10))
GND_L1_DAMPING = Simulink.Parameter(single(0.75))
GND_THR_CRUISE = Simulink.Parameter(single(0.1))
GND_THR_MAX = Simulink.Parameter(single(0.3))
GND_THR_MIN = Simulink.Parameter(single(0))
GND_THR_IDLE = Simulink.Parameter(single(0))
GND_SP_CTRL_MODE = Simulink.Parameter(int32(1))
GND_SPEED_P = Simulink.Parameter(single(2))
GND_SPEED_I = Simulink.Parameter(single(0.1))
GND_SPEED_D = Simulink.Parameter(single(0))
GND_SPEED_IMAX = Simulink.Parameter(single(1))
GND_SPEED_THR_SC = Simulink.Parameter(single(1))
GND_SPEED_TRIM = Simulink.Parameter(single(3))
GND_SPEED_MAX = Simulink.Parameter(single(10))
LTEST_MODE = Simulink.Parameter(int32(0))
LTEST_ACC_UNC = Simulink.Parameter(single(10))
LTEST_MEAS_UNC = Simulink.Parameter(single(0.005))
LTEST_POS_UNC_IN = Simulink.Parameter(single(0.1))
LTEST_VEL_UNC_IN = Simulink.Parameter(single(0.1))
LTEST_SCALE_X = Simulink.Parameter(single(1))
LTEST_SCALE_Y = Simulink.Parameter(single(1))
LND_FLIGHT_T_HI = Simulink.Parameter(int32(0))
LND_FLIGHT_T_LO = Simulink.Parameter(int32(0))
MAV_SYS_ID = Simulink.Parameter(int32(1))
MAV_COMP_ID = Simulink.Parameter(int32(1))
MAV_PROTO_VER = Simulink.Parameter(int32(0))
MAV_RADIO_ID = Simulink.Parameter(int32(0))
MAV_TYPE = Simulink.Parameter(int32(2))
MAV_USEHILGPS = Simulink.Parameter(int32(0))
MAV_FWDEXTSP = Simulink.Parameter(int32(1))
MAV_BROADCAST = Simulink.Parameter(int32(0))
MC_ROLL_P = Simulink.Parameter(single(6.5))
MC_ROLLRATE_P = Simulink.Parameter(single(0.15))
MC_ROLLRATE_I = Simulink.Parameter(single(0.05))
MC_RR_INT_LIM = Simulink.Parameter(single(0.3))
MC_ROLLRATE_D = Simulink.Parameter(single(0.003))
MC_ROLLRATE_FF = Simulink.Parameter(single(0))
MC_PITCH_P = Simulink.Parameter(single(6.5))
MC_PITCHRATE_P = Simulink.Parameter(single(0.15))
MC_PITCHRATE_I = Simulink.Parameter(single(0.05))
MC_PR_INT_LIM = Simulink.Parameter(single(0.3))
MC_PITCHRATE_D = Simulink.Parameter(single(0.003))
MC_PITCHRATE_FF = Simulink.Parameter(single(0))
MC_YAW_P = Simulink.Parameter(single(2.8))
MC_YAWRATE_P = Simulink.Parameter(single(0.2))
MC_YAWRATE_I = Simulink.Parameter(single(0.1))
MC_YR_INT_LIM = Simulink.Parameter(single(0.3))
MC_YAWRATE_D = Simulink.Parameter(single(0))
MC_YAWRATE_FF = Simulink.Parameter(single(0))
MC_YAW_FF = Simulink.Parameter(single(0.5))
MC_ROLLRATE_MAX = Simulink.Parameter(single(220))
MC_PITCHRATE_MAX = Simulink.Parameter(single(220))
MC_YAWRATE_MAX = Simulink.Parameter(single(200))
MC_YAWRAUTO_MAX = Simulink.Parameter(single(45))
MC_ACRO_R_MAX = Simulink.Parameter(single(720))
MC_ACRO_P_MAX = Simulink.Parameter(single(720))
MC_ACRO_Y_MAX = Simulink.Parameter(single(540))
MC_ACRO_EXPO = Simulink.Parameter(single(0.69))
MC_ACRO_EXPO_Y = Simulink.Parameter(single(0.69))
MC_ACRO_SUPEXPO = Simulink.Parameter(single(0.7))
MC_ACRO_SUPEXPOY = Simulink.Parameter(single(0.7))
MC_RATT_TH = Simulink.Parameter(single(0.8))
MC_BAT_SCALE_EN = Simulink.Parameter(int32(0))
MC_TPA_BREAK_P = Simulink.Parameter(single(1))
MC_TPA_BREAK_I = Simulink.Parameter(single(1))
MC_TPA_BREAK_D = Simulink.Parameter(single(1))
MC_TPA_RATE_P = Simulink.Parameter(single(0))
MC_TPA_RATE_I = Simulink.Parameter(single(0))
MC_TPA_RATE_D = Simulink.Parameter(single(0))
MC_DTERM_CUTOFF = Simulink.Parameter(single(30))
MC_AIRMODE = Simulink.Parameter(int32(0))
MPC_THR_MIN = Simulink.Parameter(single(0.12))
MPC_THR_HOVER = Simulink.Parameter(single(0.5))
MPC_THR_MAX = Simulink.Parameter(single(1))
MPC_MANTHR_MIN = Simulink.Parameter(single(0.08))
MPC_MANTHR_MAX = Simulink.Parameter(single(1))
MPC_Z_P = Simulink.Parameter(single(1))
MPC_Z_VEL_P = Simulink.Parameter(single(0.2))
MPC_Z_VEL_I = Simulink.Parameter(single(0.02))
MPC_Z_VEL_D = Simulink.Parameter(single(0))
MPC_Z_VEL_MAX_UP = Simulink.Parameter(single(3))
MPC_Z_VEL_MAX_DN = Simulink.Parameter(single(1))
MPC_XY_P = Simulink.Parameter(single(0.95))
MPC_XY_VEL_P = Simulink.Parameter(single(0.09))
MPC_XY_VEL_I = Simulink.Parameter(single(0.02))
MPC_XY_VEL_D = Simulink.Parameter(single(0.01))
MPC_XY_CRUISE = Simulink.Parameter(single(5))
MPC_CRUISE_90 = Simulink.Parameter(single(3))
MPC_VEL_MANUAL = Simulink.Parameter(single(10))
MPC_XY_VEL_MAX = Simulink.Parameter(single(12))
MPC_TILTMAX_AIR = Simulink.Parameter(single(45))
MPC_TILTMAX_LND = Simulink.Parameter(single(12))
MPC_LAND_SPEED = Simulink.Parameter(single(0.7))
MPC_TKO_SPEED = Simulink.Parameter(single(1.5))
MPC_MAN_TILT_MAX = Simulink.Parameter(single(35))
MPC_MAN_Y_MAX = Simulink.Parameter(single(200))
MPC_HOLD_DZ = Simulink.Parameter(single(0.1))
MPC_HOLD_MAX_XY = Simulink.Parameter(single(0.8))
MPC_HOLD_MAX_Z = Simulink.Parameter(single(0.6))
MPC_VELD_LP = Simulink.Parameter(single(5))
MPC_ACC_HOR_MAX = Simulink.Parameter(single(10))
MPC_ACC_HOR = Simulink.Parameter(single(5))
MPC_DEC_HOR_SLOW = Simulink.Parameter(single(5))
MPC_ACC_HOR_ESTM = Simulink.Parameter(single(0.5))
MPC_ACC_UP_MAX = Simulink.Parameter(single(10))
MPC_ACC_DOWN_MAX = Simulink.Parameter(single(10))
MPC_JERK_MAX = Simulink.Parameter(single(0))
MPC_JERK_MIN = Simulink.Parameter(single(1))
MPC_ALT_MODE = Simulink.Parameter(int32(0))
MPC_XY_MAN_EXPO = Simulink.Parameter(single(0))
MPC_Z_MAN_EXPO = Simulink.Parameter(single(0))
MPC_LAND_ALT1 = Simulink.Parameter(single(10))
MPC_LAND_ALT2 = Simulink.Parameter(single(5))
MPC_TKO_RAMP_T = Simulink.Parameter(single(0.4))

MPC_FLT_TSK = Simulink.Parameter(int32(0))
NAV_DLL_CH_T = Simulink.Parameter(single(120))
NAV_DLL_CH_LAT = Simulink.Parameter(int32(-266072120))
NAV_DLL_CH_LON = Simulink.Parameter(int32(1518453890))
NAV_DLL_CH_ALT = Simulink.Parameter(single(600))
NAV_DLL_AH_T = Simulink.Parameter(single(120))
NAV_DLL_N = Simulink.Parameter(int32(2))
NAV_DLL_CHSK = Simulink.Parameter(int32(0))
NAV_MIN_FT_HT = Simulink.Parameter(single(8))
NAV_FT_DST = Simulink.Parameter(single(8))
NAV_FT_FS = Simulink.Parameter(int32(1))
NAV_FT_RS = Simulink.Parameter(single(0.5))
GF_ACTION = Simulink.Parameter(int32(1))
GF_ALTMODE = Simulink.Parameter(int32(0))
GF_SOURCE = Simulink.Parameter(int32(0))
GF_COUNT = Simulink.Parameter(int32(-1))
GF_MAX_HOR_DIST = Simulink.Parameter(single(0))
GF_MAX_VER_DIST = Simulink.Parameter(single(0))
NAV_GPSF_LT = Simulink.Parameter(single(0))
NAV_GPSF_R = Simulink.Parameter(single(15))
NAV_GPSF_P = Simulink.Parameter(single(0))
NAV_GPSF_TR = Simulink.Parameter(single(0))
MIS_TAKEOFF_ALT = Simulink.Parameter(single(2.5))
MIS_LTRMIN_ALT = Simulink.Parameter(single(-1))
MIS_DIST_1WP = Simulink.Parameter(single(900))
MIS_DIST_WPS = Simulink.Parameter(single(900))
MIS_ALTMODE = Simulink.Parameter(int32(1))
MIS_YAWMODE = Simulink.Parameter(int32(1))
MIS_MNT_YAW_CTL = Simulink.Parameter(int32(0))
MIS_YAW_TMT = Simulink.Parameter(single(-1))
MIS_YAW_ERR = Simulink.Parameter(single(12))
NAV_LOITER_RAD = Simulink.Parameter(single(50))
NAV_ACC_RAD = Simulink.Parameter(single(10))
NAV_FW_ALT_RAD = Simulink.Parameter(single(10))
NAV_MC_ALT_RAD = Simulink.Parameter(single(0.8))
NAV_DLL_ACT = Simulink.Parameter(int32(0))
NAV_RCL_ACT = Simulink.Parameter(int32(2))
NAV_TRAFF_AVOID = Simulink.Parameter(int32(1))
NAV_AH_LAT = Simulink.Parameter(int32(-265847810))
NAV_AH_LON = Simulink.Parameter(int32(1518423250))
NAV_AH_ALT = Simulink.Parameter(single(600))
NAV_FORCE_VT = Simulink.Parameter(int32(1))
PLD_BTOUT = Simulink.Parameter(single(5))
PLD_HACC_RAD = Simulink.Parameter(single(0.2))
PLD_FAPPR_ALT = Simulink.Parameter(single(0.1))
PLD_SRCH_ALT = Simulink.Parameter(single(10))
PLD_SRCH_TOUT = Simulink.Parameter(single(10))
PLD_MAX_SRCH = Simulink.Parameter(int32(3))
NAV_RCL_LT = Simulink.Parameter(single(120))
RTL_RETURN_ALT = Simulink.Parameter(single(60))
RTL_DESCEND_ALT = Simulink.Parameter(single(30))
RTL_LAND_DELAY = Simulink.Parameter(single(-1))
RTL_MIN_DIST = Simulink.Parameter(single(5))
RTL_TYPE = Simulink.Parameter(int32(0))
PWM_RATE = Simulink.Parameter(int32(400))
PWM_MIN = Simulink.Parameter(int32(1000))
PWM_MAX = Simulink.Parameter(int32(2000))
PWM_DISARMED = Simulink.Parameter(int32(900))
PWM_MAIN_DIS1 = Simulink.Parameter(int32(-1))
PWM_MAIN_DIS2 = Simulink.Parameter(int32(-1))
PWM_MAIN_DIS3 = Simulink.Parameter(int32(-1))
PWM_MAIN_DIS4 = Simulink.Parameter(int32(-1))
PWM_MAIN_DIS5 = Simulink.Parameter(int32(-1))
PWM_MAIN_DIS6 = Simulink.Parameter(int32(-1))
PWM_MAIN_DIS7 = Simulink.Parameter(int32(-1))
PWM_MAIN_DIS8 = Simulink.Parameter(int32(-1))
PWM_AUX_DIS1 = Simulink.Parameter(int32(-1))
PWM_AUX_DIS2 = Simulink.Parameter(int32(-1))
PWM_AUX_DIS3 = Simulink.Parameter(int32(-1))
PWM_AUX_DIS4 = Simulink.Parameter(int32(-1))
PWM_AUX_DIS5 = Simulink.Parameter(int32(-1))
PWM_AUX_DIS6 = Simulink.Parameter(int32(-1))
PWM_AUX_MIN = Simulink.Parameter(int32(1000))
PWM_AUX_MAX = Simulink.Parameter(int32(2000))
PWM_AUX_DISARMED = Simulink.Parameter(int32(1500))
RC1_MIN = Simulink.Parameter(single(1000))
RC1_TRIM = Simulink.Parameter(single(1500))
RC1_MAX = Simulink.Parameter(single(2000))
RC1_REV = Simulink.Parameter(single(1))
RC1_DZ = Simulink.Parameter(single(10))
RC2_MIN = Simulink.Parameter(single(1000))
RC2_TRIM = Simulink.Parameter(single(1500))
RC2_MAX = Simulink.Parameter(single(2000))
RC2_REV = Simulink.Parameter(single(1))
RC2_DZ = Simulink.Parameter(single(10))
RC3_MIN = Simulink.Parameter(single(1000))
RC3_TRIM = Simulink.Parameter(single(1500))
RC3_MAX = Simulink.Parameter(single(2000))
RC3_REV = Simulink.Parameter(single(1))
RC3_DZ = Simulink.Parameter(single(10))
RC4_MIN = Simulink.Parameter(single(1000))
RC4_TRIM = Simulink.Parameter(single(1500))
RC4_MAX = Simulink.Parameter(single(2000))
RC4_REV = Simulink.Parameter(single(1))
RC4_DZ = Simulink.Parameter(single(10))
RC5_MIN = Simulink.Parameter(single(1000))
RC5_TRIM = Simulink.Parameter(single(1500))
RC5_MAX = Simulink.Parameter(single(2000))
RC5_REV = Simulink.Parameter(single(1))
RC5_DZ = Simulink.Parameter(single(10))
RC6_MIN = Simulink.Parameter(single(1000))
RC6_TRIM = Simulink.Parameter(single(1500))
RC6_MAX = Simulink.Parameter(single(2000))
RC6_REV = Simulink.Parameter(single(1))
RC6_DZ = Simulink.Parameter(single(10))
RC7_MIN = Simulink.Parameter(single(1000))
RC7_TRIM = Simulink.Parameter(single(1500))
RC7_MAX = Simulink.Parameter(single(2000))
RC7_REV = Simulink.Parameter(single(1))
RC7_DZ = Simulink.Parameter(single(10))
RC8_MIN = Simulink.Parameter(single(1000))
RC8_TRIM = Simulink.Parameter(single(1500))
RC8_MAX = Simulink.Parameter(single(2000))
RC8_REV = Simulink.Parameter(single(1))
RC8_DZ = Simulink.Parameter(single(10))
RC9_MIN = Simulink.Parameter(single(1000))
RC9_TRIM = Simulink.Parameter(single(1500))
RC9_MAX = Simulink.Parameter(single(2000))
RC9_REV = Simulink.Parameter(single(1))
RC9_DZ = Simulink.Parameter(single(0))
RC10_MIN = Simulink.Parameter(single(1000))
RC10_TRIM = Simulink.Parameter(single(1500))
RC10_MAX = Simulink.Parameter(single(2000))
RC10_REV = Simulink.Parameter(single(1))
RC10_DZ = Simulink.Parameter(single(0))
RC11_MIN = Simulink.Parameter(single(1000))
RC11_TRIM = Simulink.Parameter(single(1500))
RC11_MAX = Simulink.Parameter(single(2000))
RC11_REV = Simulink.Parameter(single(1))
RC11_DZ = Simulink.Parameter(single(0))
RC12_MIN = Simulink.Parameter(single(1000))
RC12_TRIM = Simulink.Parameter(single(1500))
RC12_MAX = Simulink.Parameter(single(2000))
RC12_REV = Simulink.Parameter(single(1))
RC12_DZ = Simulink.Parameter(single(0))
RC13_MIN = Simulink.Parameter(single(1000))
RC13_TRIM = Simulink.Parameter(single(1500))
RC13_MAX = Simulink.Parameter(single(2000))
RC13_REV = Simulink.Parameter(single(1))
RC13_DZ = Simulink.Parameter(single(0))
RC14_MIN = Simulink.Parameter(single(1000))
RC14_TRIM = Simulink.Parameter(single(1500))
RC14_MAX = Simulink.Parameter(single(2000))
RC14_REV = Simulink.Parameter(single(1))
RC14_DZ = Simulink.Parameter(single(0))
RC15_MIN = Simulink.Parameter(single(1000))
RC15_TRIM = Simulink.Parameter(single(1500))
RC15_MAX = Simulink.Parameter(single(2000))
RC15_REV = Simulink.Parameter(single(1))
RC15_DZ = Simulink.Parameter(single(0))
RC16_MIN = Simulink.Parameter(single(1000))
RC16_TRIM = Simulink.Parameter(single(1500))
RC16_MAX = Simulink.Parameter(single(2000))
RC16_REV = Simulink.Parameter(single(1))
RC16_DZ = Simulink.Parameter(single(0))
RC17_MIN = Simulink.Parameter(single(1000))
RC17_TRIM = Simulink.Parameter(single(1500))
RC17_MAX = Simulink.Parameter(single(2000))
RC17_REV = Simulink.Parameter(single(1))
RC17_DZ = Simulink.Parameter(single(0))
RC18_MIN = Simulink.Parameter(single(1000))
RC18_TRIM = Simulink.Parameter(single(1500))
RC18_MAX = Simulink.Parameter(single(2000))
RC18_REV = Simulink.Parameter(single(1))
RC18_DZ = Simulink.Parameter(single(0))
RC_CHAN_CNT = Simulink.Parameter(int32(0))
RC_MAP_ROLL = Simulink.Parameter(int32(0))
RC_MAP_PITCH = Simulink.Parameter(int32(0))
RC_MAP_FAILSAFE = Simulink.Parameter(int32(0))
RC_MAP_THROTTLE = Simulink.Parameter(int32(0))
RC_MAP_YAW = Simulink.Parameter(int32(0))
RC_MAP_FLTMODE = Simulink.Parameter(int32(0))
RC_MAP_MODE_SW = Simulink.Parameter(int32(0))
RC_MAP_RETURN_SW = Simulink.Parameter(int32(0))
RC_MAP_RATT_SW = Simulink.Parameter(int32(0))
RC_MAP_POSCTL_SW = Simulink.Parameter(int32(0))
RC_MAP_LOITER_SW = Simulink.Parameter(int32(0))
RC_MAP_ACRO_SW = Simulink.Parameter(int32(0))
RC_MAP_OFFB_SW = Simulink.Parameter(int32(0))
RC_MAP_KILL_SW = Simulink.Parameter(int32(0))
RC_MAP_ARM_SW = Simulink.Parameter(int32(0))
RC_MAP_FLAPS = Simulink.Parameter(int32(0))
RC_MAP_TRANS_SW = Simulink.Parameter(int32(0))
RC_MAP_GEAR_SW = Simulink.Parameter(int32(0))
RC_MAP_STAB_SW = Simulink.Parameter(int32(0))
RC_MAP_MAN_SW = Simulink.Parameter(int32(0))
RC_MAP_AUX1 = Simulink.Parameter(int32(0))
RC_MAP_AUX2 = Simulink.Parameter(int32(0))
RC_MAP_AUX3 = Simulink.Parameter(int32(0))
RC_MAP_AUX4 = Simulink.Parameter(int32(0))
RC_MAP_AUX5 = Simulink.Parameter(int32(0))
RC_MAP_PARAM1 = Simulink.Parameter(int32(0))
RC_MAP_PARAM2 = Simulink.Parameter(int32(0))
RC_MAP_PARAM3 = Simulink.Parameter(int32(0))
RC_FAILS_THR = Simulink.Parameter(int32(0))
RC_ASSIST_TH = Simulink.Parameter(single(0.25))
RC_AUTO_TH = Simulink.Parameter(single(0.75))
RC_RATT_TH = Simulink.Parameter(single(0.5))
RC_POSCTL_TH = Simulink.Parameter(single(0.5))
RC_RETURN_TH = Simulink.Parameter(single(0.5))

RC_LOITER_TH = Simulink.Parameter(single(0.5))
RC_ACRO_TH = Simulink.Parameter(single(0.5))
RC_OFFB_TH = Simulink.Parameter(single(0.5))
RC_KILLSWITCH_TH = Simulink.Parameter(single(0.25))
RC_ARMSWITCH_TH = Simulink.Parameter(single(0.25))
RC_TRANS_TH = Simulink.Parameter(single(0.25))
RC_GEAR_TH = Simulink.Parameter(single(0.25))
RC_STAB_TH = Simulink.Parameter(single(0.5))
RC_MAN_TH = Simulink.Parameter(single(0.5))
RC_FLT_SMP_RATE = Simulink.Parameter(single(50))
RC_FLT_CUTOFF = Simulink.Parameter(single(10))
CAL_BARO_PRIME = Simulink.Parameter(int32(0))
CAL_AIR_CMODEL = Simulink.Parameter(int32(0))
CAL_AIR_TUBELEN = Simulink.Parameter(single(0.2))
CAL_AIR_TUBED_MM = Simulink.Parameter(single(1.5))
SENS_DPRES_OFF = Simulink.Parameter(single(0))
SENS_DPRES_ANSC = Simulink.Parameter(single(0))
SENS_BARO_QNH = Simulink.Parameter(single(1013.25))
SENS_BOARD_ROT = Simulink.Parameter(int32(0))
SENS_BOARD_Y_OFF = Simulink.Parameter(single(0))
SENS_BOARD_X_OFF = Simulink.Parameter(single(0))
SENS_BOARD_Z_OFF = Simulink.Parameter(single(0))
SENS_EN_THERMAL = Simulink.Parameter(int32(-1))
IMU_GYRO_CUTOFF = Simulink.Parameter(single(80))
IMU_ACCEL_CUTOFF = Simulink.Parameter(single(30))
SITL_UDP_PRT = Simulink.Parameter(int32(14560))
SIM_BAT_DRAIN = Simulink.Parameter(single(60))
SLNK_RADIO_CHAN = Simulink.Parameter(int32(80))
SLNK_RADIO_RATE = Simulink.Parameter(int32(2))
SLNK_RADIO_ADDR1 = Simulink.Parameter(int32(231))
SLNK_RADIO_ADDR2 = Simulink.Parameter(int32(2147483647))
SYS_AUTOSTART = Simulink.Parameter(int32(0))
SYS_AUTOCONFIG = Simulink.Parameter(int32(0))
SYS_HITL = Simulink.Parameter(int32(0))
SYS_RESTART_TYPE = Simulink.Parameter(int32(2))
SYS_MC_EST_GROUP = Simulink.Parameter(int32(2))
SYS_COMPANION = Simulink.Parameter(int32(157600))
SYS_PARAM_VER = Simulink.Parameter(int32(1))
SYS_LOGGER = Simulink.Parameter(int32(1))
SYS_STCK_EN = Simulink.Parameter(int32(1))
SYS_CAL_GYRO = Simulink.Parameter(int32(0))
SYS_CAL_ACCEL = Simulink.Parameter(int32(0))
SYS_CAL_BARO = Simulink.Parameter(int32(0))
SYS_CAL_TDEL = Simulink.Parameter(int32(24))
SYS_CAL_TMIN = Simulink.Parameter(int32(5))
SYS_CAL_TMAX = Simulink.Parameter(int32(10))
SYS_HAS_MAG = Simulink.Parameter(int32(1))
SYS_HAS_BARO = Simulink.Parameter(int32(1))
UAVCAN_ENABLE = Simulink.Parameter(int32(0))
UAVCAN_NODE_ID = Simulink.Parameter(int32(1))
UAVCAN_BITRATE = Simulink.Parameter(int32(1000000))
UAVCAN_ESC_IDLT = Simulink.Parameter(int32(1))
ESC_NODE_ID = Simulink.Parameter(int32(120))
ESC_BITRATE = Simulink.Parameter(int32(1000000))
CANNODE_NODE_ID = Simulink.Parameter(int32(120))
CANNODE_BITRATE = Simulink.Parameter(int32(1000000))
VT_DWN_PITCH_MAX = Simulink.Parameter(single(5))
VT_FWD_THRUST_SC = Simulink.Parameter(single(0))
VT_B_TRANS_RAMP = Simulink.Parameter(single(3))
VT_B_REV_OUT = Simulink.Parameter(single(0))
VT_B_REV_DEL = Simulink.Parameter(single(0))
VT_PSHER_RMP_DT = Simulink.Parameter(single(3))
VT_TRANS_P2_DUR = Simulink.Parameter(single(0.5))
VT_TILT_MC = Simulink.Parameter(single(0))
VT_TILT_TRANS = Simulink.Parameter(single(0.3))
VT_TILT_FW = Simulink.Parameter(single(1))
VT_FW_DIFTHR_EN = Simulink.Parameter(int32(0))
VT_FW_DIFTHR_SC = Simulink.Parameter(single(0.1))
VT_MOT_COUNT = Simulink.Parameter(int32(0))
VT_IDLE_PWM_MC = Simulink.Parameter(int32(900))
VT_FW_PERM_STAB = Simulink.Parameter(int32(0))
VT_TYPE = Simulink.Parameter(int32(0))
VT_ELEV_MC_LOCK = Simulink.Parameter(int32(1))
VT_F_TRANS_DUR = Simulink.Parameter(single(5))
VT_B_TRANS_DUR = Simulink.Parameter(single(4))
VT_F_TRANS_THR = Simulink.Parameter(single(1))
VT_B_TRANS_THR = Simulink.Parameter(single(0))
VT_B_DEC_MSS = Simulink.Parameter(single(2))
VT_ARSP_BLEND = Simulink.Parameter(single(8))
VT_ARSP_TRANS = Simulink.Parameter(single(10))
VT_TRANS_TIMEOUT = Simulink.Parameter(single(15))
VT_TRANS_MIN_TM = Simulink.Parameter(single(2))
VT_FW_MIN_ALT = Simulink.Parameter(single(0))
VT_FW_ALT_ERR = Simulink.Parameter(single(0))
VT_FW_QC_P = Simulink.Parameter(int32(0))
VT_FW_QC_R = Simulink.Parameter(int32(0))
VT_F_TR_OL_TM = Simulink.Parameter(single(6))
VT_WV_YAWR_SCL = Simulink.Parameter(single(0.15))
VT_WV_TKO_EN = Simulink.Parameter(int32(0))
VT_WV_LTR_EN = Simulink.Parameter(int32(0))
VT_WV_LND_EN = Simulink.Parameter(int32(0))
VT_FW_MOT_OFFID = Simulink.Parameter(int32(0))
WEST_W_P_NOISE = Simulink.Parameter(single(0.1))
WEST_SC_P_NOISE = Simulink.Parameter(single(0.0001))
WEST_TAS_NOISE = Simulink.Parameter(single(1.4))
WEST_BETA_NOISE = Simulink.Parameter(single(0.3))
WEST_TAS_GATE = Simulink.Parameter(int32(3))
WEST_BETA_GATE = Simulink.Parameter(int32(1))
MPU_GYRO_LPF_ENM = Simulink.Parameter(int32(4))
MPU_ACC_LPF_ENM = Simulink.Parameter(int32(4))
MPU_SAMPLE_R_ENM = Simulink.Parameter(int32(2))
RC_RECEIVER_TYPE = Simulink.Parameter(int32(1))
UART_ESC_MODEL = Simulink.Parameter(int32(2))
UART_ESC_BAUD = Simulink.Parameter(int32(250000))
UART_ESC_MOTOR1 = Simulink.Parameter(int32(4))
UART_ESC_MOTOR2 = Simulink.Parameter(int32(2))
UART_ESC_MOTOR3 = Simulink.Parameter(int32(1))
UART_ESC_MOTOR4 = Simulink.Parameter(int32(3))
MC_MAN_TILT_TAU = single(0)
MC_YAWRATE_K = single(1)
MC_PITCHRATE_K = single(1)
MC_ROLLRATE_K = single(1)
MPC_THR_CURVE = int32(0)
MC_YAW_WEIGHT = single(0.4)
VEHICLE_TYPE_ROTARY_WING = int32(1)
roll_pitch_yaw = int32(2)
FW_AIRSPD_STALL = single(7)
FW_FLAPS_LND_SCL = single(1)
FW_Y_TC = single(0.1)
HDG_HOLD_DIST_NEXT = single(3000)
FW_CLMBOUT_DIFF = single(10)
FW_LND_EARLYCFG = single(0)
FW_T_ALT_TC = single(5)
FW_LND_THRTC_SC = single(1)
FW_L1_R_SLEW_MAX = single(90)
FW_GND_SPD_MIN = single(5)
GRAVITY = single(9.80665)
FW_T_TAS_TC = single(5)
FW_T_CLMB_R_SP = single(3)
FW_T_SINK_R_SP = single(2)
FW_T_I_GAIN_THR = single(0.3)
FW_T_SEB_R_FF = single(1)
FW_T_I_GAIN_PIT = single(0.1)
DT_DEFAULT = single(0.02)
FW_T_STE_R_TC = single(0.4)
FW_T_TAS_R_TC = single(0.2)
RWTO_RAMP_TIME = single(2)
FW_TKO_PITCH_MIN = single(10)
FW_POSCTL_INV_ST = single(0)
LNDMC_Z_VEL_MAX = single(0.4)
LNDMC_XY_VEL_MAX = single(1.5)
LNDMC_ALT_GND = single(-1)
LNDMC_ROT_MAX = single(20)
LNDFW_AIRSPD_MAX = single(6)
LNDFW_VEL_XY_MAX = single(5)
LNDFW_VEL_Z_MAX = single(3)
LNDFW_XYACC_MAX = single(8)
VT_MOT_ID = Simulink.Parameter(int32(0))
VT_B_DEC_I = Simulink.Parameter(single(0.1))
VT_B_DEC_FF = Simulink.Parameter(single(0.12))
MPC_YAWRAUTO_MAX = Simulink.Parameter(single(45), Min=0, Max=360)
MPC_Z_VEL_D_ACC = Simulink.Parameter(single(0), Min=0, Max=2)
MPC_SPOOLUP_TIME = Simulink.Parameter(single(1), Min=0, Max=10)
MPC_YAW_EXPO = Simulink.Parameter(single(0.6), Min=0, Max=1)
MPC_YAW_MODE = Simulink.Parameter(int32(0))
WV_EN = Simulink.Parameter(false, DataType="boolean")
WV_GAIN = Simulink.Parameter(single(1), Min=0, Max=3)
WV_ROLL_MIN = Simulink.Parameter(single(1), Min=0, Max=5)
WV_YRATE_MAX = Simulink.Parameter(single(90), Min=0, Max=120)
MPC_Z_VEL_P_ACC = Simulink.Parameter(single(4), Min=2, Max=15)
MPC_XY_VEL_P_ACC = Simulink.Parameter(single(1.8), Min=1.2, Max=5)
MPC_XY_VEL_I_ACC = Simulink.Parameter(single(0.4), Min=0, Max=60)
MPC_Z_VEL_I_ACC = Simulink.Parameter(single(2), Min=0.2, Max=3)
NAV_FW_ALTL_RAD = Simulink.Parameter(single(5), Min=0.05, Max=200)
RTL_CONE_ANG = Simulink.Parameter(45, DataType="int32", Min=0, Max=120)
RTL_LOITER_RAD = Simulink.Parameter(single(50), Min=25, Max=1000)
RTL_PLD_MD = Simulink.Parameter(0, DataType="int32", Min=0, Max=120)
COM_ARM_AUTH_TO = Simulink.Parameter(single(1))
COM_ARM_AUTH_MET = Simulink.Parameter(int32(0))
COM_ARM_AUTH_ID = Simulink.Parameter(int32(10))
COM_OBS_AVOID = Simulink.Parameter(false, DataType="boolean")
COM_ARM_AUTH_REQ = Simulink.Parameter(false, DataType="boolean")
COM_ARM_WO_GPS = Simulink.Parameter(true, DataType="boolean")
COM_ARM_CHK_ESCS = Simulink.Parameter(false, DataType="boolean")
COM_ARM_MIS_REQ = Simulink.Parameter(false, DataType="boolean")
COM_HOME_IN_AIR = Simulink.Parameter(false, DataType="boolean")
CONSTANTS_RADIUS_OF_EARTH = Simulink.Parameter(single(6.371e+6))