% Simulink data dictionary px4_dict.sldd
% references px4_param.sldd
% references mav_dtype.sldd
% references px4_topic.sldd

PX4_CUSTOM_MAIN_MODE = enum(DefaultValue="MANUAL", AddClassNameToEnumNames=true)
  MANUAL = 1
  ALTCTL = 2
  POSCTL = 3
  AUTO = 4
  ACRO = 5
  OFFBOARD = 6
  STABILIZED = 7
  RATTITUDE_LEGACY = 8
  SIMPLE = 9

PX4_CUSTOM_SUB_MODE_AUTO = enum(DefaultValue="READY", AddClassNameToEnumNames=true)
  READY = 1
  TAKEOFF = 2
  LOITER = 3
  MISSION = 4
  RTL = 5
  LAND = 6
  RESERVED_DO_NOT_USE = 7
  FOLLOW_TARGET = 8
  PRECLAND = 9

PX4_LINK_LOSS_ACTIONS = enum(DefaultValue="DISABLED", AddClassNameToEnumNames=true)
  DISABLED = 0
  AUTO_LOITER = 1  % # Hold mode
  AUTO_RTL = 2  % # Return mode
  AUTO_LAND = 3  % # Land mode
  TERMINATE = 5  % # Terminate flight (set actuator outputs to failsafe values, and stop controllers)
  LOCKDOWN = 6  % # Lock actuators (set actuator outputs to disarmed values)

PX4_OFFBOARD_LOSS_ACTIONS = enum(DefaultValue="DISABLED", AddClassNameToEnumNames=true)
  DISABLED = -1
  AUTO_LAND = 0  % # Land mode
  AUTO_LOITER = 1  % # Hold mode
  AUTO_RTL = 2  % # Return mode
  TERMINATE = 3  % # Terminate flight (set actuator outputs to failsafe values, and stop controllers)
  LOCKDOWN = 4  % # Lock actuators (set actuator outputs to disarmed values)

PX4_OFFBOARD_LOSS_RC_ACTIONS = enum(DefaultValue="DISABLED", AddClassNameToEnumNames=true)
  DISABLED = -1  % # Disabled
  MANUAL_POSITION = 0  % # Position mode
  MANUAL_ALTITUDE = 1  % # Altitude mode
  MANUAL_ATTITUDE = 2  % # Manual
  AUTO_RTL = 3  % # Return mode
  AUTO_LAND = 4  % # Land mode
  AUTO_LOITER = 6  % # Hold mode
  TERMINATE = 7  % # Terminate flight (set actuator outputs to failsafe values, and stop controllers)
  LOCKDOWN = 8  % # Lock actuators (set actuator outputs to disarmed values)

PX4_POSITION_NAV_LOSS_ACTIONS = enum(DefaultValue="ALTITUDE_MANUAL", AddClassNameToEnumNames=true)
  ALTITUDE_MANUAL = 0  % # Altitude/Manual. Assume use of remote control after fallback. Switch to Altitude mode if a height estimate is available, else switch to MANUAL.
  LAND_TERMINATE = 1  % # Land/Terminate.  Assume no use of remote control after fallback. Switch to Land mode if a height estimate is available, else switch to TERMINATION.

PX4_PREARMED_MODE = enum(DefaultValue="DISABLED", AddClassNameToEnumNames=true)
  DISABLED = 0
  SAFETY_BUTTON = 1
  ALWAYS = 2