% Simulink data dictionary L400_datadict.sldd

action_request_s = Simulink.Bus()
  timestamp: uint64  % # time since system start (microseconds)
  action: uint8  % # what action is requested
  source: uint8  % # how the request was triggered
  mode: uint8  % # for ACTION_SWITCH_MODE what mode is requested according to vehicle_status_s::NAVIGATION_STATE_*

actuator_controls_status_0_s = Simulink.Bus()
  timestamp: uint64  % # time since system start (microseconds)
  control_power: single[3]

actuator_controls_status_1_s = Simulink.Bus()
  timestamp: uint64  % # time since system start (microseconds)
  control_power: single[3]

actuator_motors_s = Simulink.Bus()
  timestamp: uint64  % # time since system start (microseconds)
  timestamp_sample: uint64  % # the timestamp the data this control response is based on was sampled
  reversible_flags: uint16  % # bitset which motors are configured to be reversible
  control: single[12]  % # range: [-1, 1], where 1 means maximum positive thrust,

actuator_outputs_sim_s = Simulink.Bus()
  timestamp: uint64  % # time since system start (microseconds)
  noutputs: uint32  % # valid outputs
  output: single[16]  % # output data, in natural output units

actuator_outputs_debug_s = Simulink.Bus()
  timestamp: uint64  % # time since system start (microseconds)
  noutputs: uint32  % # valid outputs
  output: single[16]  % # output data, in natural output units

actuator_servos_s = Simulink.Bus()
  timestamp: uint64  % # time since system start (microseconds)
  timestamp_sample: uint64  % # the timestamp the data this control response is based on was sampled
  control: single[8]  % # range: [-1, 1], where 1 means maximum positive position,

actuator_servos_trim_s = Simulink.Bus()
  timestamp: uint64  % # time since system start (microseconds)
  trim: single[8]  % # range: [-1, 1]

actuator_test_s = Simulink.Bus()
  timestamp: uint64  % # time since system start (microseconds)
  action: uint8  % # one of ACTION_*
  function: uint16  % # actuator output function
  value: single  % # range: [-1, 1], where 1 means maximum positive output,
  timeout_ms: uint32  % # timeout in ms after which to exit test mode (if 0, do not time out)

autotune_attitude_control_status_s = Simulink.Bus()
  timestamp: uint64  % # time since system start (microseconds)
  coeff: single[5]  % # coefficients of the identified discrete-time model
  coeff_var: single[5]  % # coefficients' variance of the identified discrete-time model
  fitness: single  % # fitness of the parameter estimate
  innov: single
  dt_model: single
  kc: single
  ki: single
  kd: single
  kff: single
  att_p: single
  rate_sp: single[3]
  u_filt: single
  y_filt: single
  state: uint8

button_event_s = Simulink.Bus()
  timestamp: uint64  % # time since system start (microseconds)
  triggered: boolean  % # Set to true if the event is triggered

safety_button_s = Simulink.Bus()
  timestamp: uint64  % # time since system start (microseconds)
  triggered: boolean  % # Set to true if the event is triggered

camera_status_s = Simulink.Bus()
  timestamp: uint64  % # time since system start (microseconds)
  active_sys_id: uint8  % # mavlink system id of the currently active camera
  active_comp_id: uint8  % # mavlink component id of currently active camera

estimator_aid_src_mag_heading_s = Simulink.Bus()
  timestamp: uint64  % # time since system start (microseconds)
  timestamp_sample: uint64  % # the timestamp of the raw data (microseconds)
  estimator_instance: uint8
  device_id: uint32
  time_last_fuse: uint64
  observation: single
  observation_variance: single
  innovation: single
  innovation_variance: single
  test_ratio: single
  fusion_enabled: boolean  % # true when measurements are being fused
  innovation_rejected: boolean  % # true if the observation has been rejected
  fused: boolean  % # true if the sample was successfully fused

estimator_aid_src_gnss_yaw_s = Simulink.Bus()
  timestamp: uint64  % # time since system start (microseconds)
  timestamp_sample: uint64  % # the timestamp of the raw data (microseconds)
  estimator_instance: uint8
  device_id: uint32
  time_last_fuse: uint64
  observation: single
  observation_variance: single
  innovation: single
  innovation_variance: single
  test_ratio: single
  fusion_enabled: boolean  % # true when measurements are being fused
  innovation_rejected: boolean  % # true if the observation has been rejected
  fused: boolean  % # true if the sample was successfully fused

estimator_aid_src_ev_yaw_s = Simulink.Bus()
  timestamp: uint64  % # time since system start (microseconds)
  timestamp_sample: uint64  % # the timestamp of the raw data (microseconds)
  estimator_instance: uint8
  device_id: uint32
  time_last_fuse: uint64
  observation: single
  observation_variance: single
  innovation: single
  innovation_variance: single
  test_ratio: single
  fusion_enabled: boolean  % # true when measurements are being fused
  innovation_rejected: boolean  % # true if the observation has been rejected
  fused: boolean  % # true if the sample was successfully fused

estimator_aid_src_aux_vel_s = Simulink.Bus()
  timestamp: uint64  % # time since system start (microseconds)
  timestamp_sample: uint64  % # the timestamp of the raw data (microseconds)
  estimator_instance: uint8
  device_id: uint32
  time_last_fuse: uint64
  observation: single[2]
  observation_variance: single[2]
  innovation: single[2]
  innovation_variance: single[2]
  test_ratio: single[2]
  fusion_enabled: boolean  % # true when measurements are being fused
  innovation_rejected: boolean  % # true if the observation has been rejected
  fused: boolean  % # true if the sample was successfully fused

estimator_aid_src_optical_flow_s = Simulink.Bus()
  timestamp: uint64  % # time since system start (microseconds)
  timestamp_sample: uint64  % # the timestamp of the raw data (microseconds)
  estimator_instance: uint8
  device_id: uint32
  time_last_fuse: uint64
  observation: single[2]
  observation_variance: single[2]
  innovation: single[2]
  innovation_variance: single[2]
  test_ratio: single[2]
  fusion_enabled: boolean  % # true when measurements are being fused
  innovation_rejected: boolean  % # true if the observation has been rejected
  fused: boolean  % # true if the sample was successfully fused

estimator_aid_src_terrain_optical_flow_s = Simulink.Bus()
  timestamp: uint64  % # time since system start (microseconds)
  timestamp_sample: uint64  % # the timestamp of the raw data (microseconds)
  estimator_instance: uint8
  device_id: uint32
  time_last_fuse: uint64
  observation: single[2]
  observation_variance: single[2]
  innovation: single[2]
  innovation_variance: single[2]
  test_ratio: single[2]
  fusion_enabled: boolean  % # true when measurements are being fused
  innovation_rejected: boolean  % # true if the observation has been rejected
  fused: boolean  % # true if the sample was successfully fused

estimator_aid_src_ev_vel_s = Simulink.Bus()
  timestamp: uint64  % # time since system start (microseconds)
  timestamp_sample: uint64  % # the timestamp of the raw data (microseconds)
  estimator_instance: uint8
  device_id: uint32
  time_last_fuse: uint64
  observation: single[3]
  observation_variance: single[3]
  innovation: single[3]
  innovation_variance: single[3]
  test_ratio: single[3]
  fusion_enabled: boolean  % # true when measurements are being fused
  innovation_rejected: boolean  % # true if the observation has been rejected
  fused: boolean  % # true if the sample was successfully fused

estimator_aid_src_gnss_vel_s = Simulink.Bus()
  timestamp: uint64  % # time since system start (microseconds)
  timestamp_sample: uint64  % # the timestamp of the raw data (microseconds)
  estimator_instance: uint8
  device_id: uint32
  time_last_fuse: uint64
  observation: single[3]
  observation_variance: single[3]
  innovation: single[3]
  innovation_variance: single[3]
  test_ratio: single[3]
  fusion_enabled: boolean  % # true when measurements are being fused
  innovation_rejected: boolean  % # true if the observation has been rejected
  fused: boolean  % # true if the sample was successfully fused

estimator_aid_src_gravity_s = Simulink.Bus()
  timestamp: uint64  % # time since system start (microseconds)
  timestamp_sample: uint64  % # the timestamp of the raw data (microseconds)
  estimator_instance: uint8
  device_id: uint32
  time_last_fuse: uint64
  observation: single[3]
  observation_variance: single[3]
  innovation: single[3]
  innovation_variance: single[3]
  test_ratio: single[3]
  fusion_enabled: boolean  % # true when measurements are being fused
  innovation_rejected: boolean  % # true if the observation has been rejected
  fused: boolean  % # true if the sample was successfully fused

estimator_aid_src_mag_s = Simulink.Bus()
  timestamp: uint64  % # time since system start (microseconds)
  timestamp_sample: uint64  % # the timestamp of the raw data (microseconds)
  estimator_instance: uint8
  device_id: uint32
  time_last_fuse: uint64
  observation: single[3]
  observation_variance: single[3]
  innovation: single[3]
  innovation_variance: single[3]
  test_ratio: single[3]
  fusion_enabled: boolean  % # true when measurements are being fused
  innovation_rejected: boolean  % # true if the observation has been rejected
  fused: boolean  % # true if the sample was successfully fused

estimator_baro_bias_s = Simulink.Bus()
  timestamp: uint64  % # time since system start (microseconds)
  timestamp_sample: uint64  % # the timestamp of the raw data (microseconds)
  device_id: uint32  % # unique device ID for the sensor that does not change between power cycles
  bias: single  % # estimated barometric altitude bias (m)
  bias_var: single  % # estimated barometric altitude bias variance (m^2)
  innov: single  % # innovation of the last measurement fusion (m)
  innov_var: single  % # innovation variance of the last measurement fusion (m^2)
  innov_test_ratio: single  % # normalized innovation squared test ratio

estimator_gnss_hgt_bias_s = Simulink.Bus()
  timestamp: uint64  % # time since system start (microseconds)
  timestamp_sample: uint64  % # the timestamp of the raw data (microseconds)
  device_id: uint32  % # unique device ID for the sensor that does not change between power cycles
  bias: single  % # estimated barometric altitude bias (m)
  bias_var: single  % # estimated barometric altitude bias variance (m^2)
  innov: single  % # innovation of the last measurement fusion (m)
  innov_var: single  % # innovation variance of the last measurement fusion (m^2)
  innov_test_ratio: single  % # normalized innovation squared test ratio

estimator_rng_hgt_bias_s = Simulink.Bus()
  timestamp: uint64  % # time since system start (microseconds)
  timestamp_sample: uint64  % # the timestamp of the raw data (microseconds)
  device_id: uint32  % # unique device ID for the sensor that does not change between power cycles
  bias: single  % # estimated barometric altitude bias (m)
  bias_var: single  % # estimated barometric altitude bias variance (m^2)
  innov: single  % # innovation of the last measurement fusion (m)
  innov_var: single  % # innovation variance of the last measurement fusion (m^2)
  innov_test_ratio: single  % # normalized innovation squared test ratio

estimator_ev_pos_bias_s = Simulink.Bus()
  timestamp: uint64  % # time since system start (microseconds)
  timestamp_sample: uint64  % # the timestamp of the raw data (microseconds)
  device_id: uint32  % # unique device ID for the sensor that does not change between power cycles
  bias: single[3]  % # estimated barometric altitude bias (m)
  bias_var: single[3]  % # estimated barometric altitude bias variance (m^2)
  innov: single[3]  % # innovation of the last measurement fusion (m)
  innov_var: single[3]  % # innovation variance of the last measurement fusion (m^2)
  innov_test_ratio: single[3]  % # normalized innovation squared test ratio

estimator_gps_status_s = Simulink.Bus()
  timestamp: uint64  % # time since system start (microseconds)
  timestamp_sample: uint64  % # the timestamp of the raw data (microseconds)
  checks_passed: boolean
  check_fail_gps_fix: boolean  % # 0 : insufficient fix type (no 3D solution)
  check_fail_min_sat_count: boolean  % # 1 : minimum required sat count fail
  check_fail_max_pdop: boolean  % # 2 : maximum allowed PDOP fail
  check_fail_max_horz_err: boolean  % # 3 : maximum allowed horizontal position error fail
  check_fail_max_vert_err: boolean  % # 4 : maximum allowed vertical position error fail
  check_fail_max_spd_err: boolean  % # 5 : maximum allowed speed error fail
  check_fail_max_horz_drift: boolean  % # 6 : maximum allowed horizontal position drift fail - requires stationary vehicle
  check_fail_max_vert_drift: boolean  % # 7 : maximum allowed vertical position drift fail - requires stationary vehicle
  check_fail_max_horz_spd_err: boolean  % # 8 : maximum allowed horizontal speed fail - requires stationary vehicle
  check_fail_max_vert_spd_err: boolean  % # 9 : maximum allowed vertical velocity discrepancy fail
  position_drift_rate_horizontal_m_s: single  % # Horizontal position rate magnitude (m/s)
  position_drift_rate_vertical_m_s: single  % # Vertical position rate magnitude (m/s)
  filtered_horizontal_speed_m_s: single  % # Filtered horizontal velocity magnitude (m/s)

event_s = Simulink.Bus()
  timestamp: uint64  % # time since system start (microseconds)
  id: uint32  % # Event ID
  event_sequence: uint16  % # Event sequence number
  arguments: uint8[25]  % # (optional) arguments, depend on event id
  log_levels: uint8  % # Log levels: 4 bits MSB: internal, 4 bits LSB: external

failsafe_flags_s = Simulink.Bus()
  timestamp: uint64  % # time since system start (microseconds)
  mode_req_angular_velocity: uint32
  mode_req_attitude: uint32
  mode_req_local_alt: uint32
  mode_req_local_position: uint32
  mode_req_local_position_relaxed: uint32
  mode_req_global_position: uint32
  mode_req_mission: uint32
  mode_req_offboard_signal: uint32
  mode_req_home_position: uint32
  mode_req_wind_and_flight_time_compliance: uint32  % # if set, mode cannot be entered if wind or flight time limit exceeded
  mode_req_prevent_arming: uint32  % # if set, cannot arm while in this mode
  mode_req_manual_control: uint32
  mode_req_other: uint32  % # other requirements, not covered above (for external modes)
  angular_velocity_invalid: boolean  % # Angular velocity invalid
  attitude_invalid: boolean  % # Attitude invalid
  local_altitude_invalid: boolean  % # Local altitude invalid
  local_position_invalid: boolean  % # Local position estimate invalid
  local_position_invalid_relaxed: boolean  % # Local position with reduced accuracy requirements invalid (e.g. flying with optical flow)
  local_velocity_invalid: boolean  % # Local velocity estimate invalid
  global_position_invalid: boolean  % # Global position estimate invalid
  auto_mission_missing: boolean  % # No mission available
  offboard_control_signal_lost: boolean  % # Offboard signal lost
  home_position_invalid: boolean  % # No home position available
  manual_control_signal_lost: boolean  % # Manual control (RC) signal lost
  gcs_connection_lost: boolean  % # GCS connection lost
  battery_warning: uint8  % # Battery warning level
  battery_low_remaining_time: boolean  % # Low battery based on remaining flight time
  battery_unhealthy: boolean  % # Battery unhealthy
  primary_geofence_breached: boolean  % # Primary Geofence breached
  mission_failure: boolean  % # Mission failure
  vtol_fixed_wing_system_failure: boolean  % # vehicle in fixed-wing system failure failsafe mode (after quad-chute)
  wind_limit_exceeded: boolean  % # Wind limit exceeded
  flight_time_limit_exceeded: boolean  % # Maximum flight time exceeded
  local_position_accuracy_low: boolean  % # Local position estimate has dropped below threshold, but is currently still declared valid
  fd_critical_failure: boolean  % # Critical failure (attitude/altitude limit exceeded, or external ATS)
  fd_esc_arming_failure: boolean  % # ESC failed to arm
  fd_imbalanced_prop: boolean  % # Imbalanced propeller detected
  fd_motor_failure: boolean  % # Motor failure

failure_detector_status_s = Simulink.Bus()
  timestamp: uint64  % # time since system start (microseconds)
  fd_roll: boolean
  fd_pitch: boolean
  fd_alt: boolean
  fd_ext: boolean
  fd_arm_escs: boolean
  fd_battery: boolean
  fd_imbalanced_prop: boolean
  fd_motor: boolean
  imbalanced_prop_metric: single  % # Metric of the imbalanced propeller check (low-passed)
  motor_failure_mask: uint16  % # Bit-mask with motor indices, indicating critical motor failures

follow_target_estimator_s = Simulink.Bus()
  timestamp: uint64  % # time since system start (microseconds)
  last_filter_reset_timestamp: uint64  % # time of last filter reset (microseconds)
  valid: boolean  % # True if estimator states are okay to be used
  stale: boolean  % # True if estimator stopped receiving follow_target messages for some time. The estimate can still be valid, though it might be inaccurate.
  lat_est: double  % # Estimated target latitude
  lon_est: double  % # Estimated target longitude
  alt_est: single  % # Estimated target altitude
  pos_est: single[3]  % # Estimated target NED position (m)
  vel_est: single[3]  % # Estimated target NED velocity (m/s)
  acc_est: single[3]  % # Estimated target NED acceleration (m^2/s)
  prediction_count: uint64
  fusion_count: uint64

follow_target_status_s = Simulink.Bus()
  timestamp: uint64  % # [microseconds] time since system start
  tracked_target_course: single  % # [rad] Tracked target course in NED local frame (North is course zero)
  follow_angle: single  % # [rad] Current follow angle setting
  orbit_angle_setpoint: single  % # [rad] Current orbit angle setpoint from the smooth trajectory generator
  angular_rate_setpoint: single  % # [rad/s] Angular rate commanded from Jerk-limited Orbit Angle trajectory for Orbit Angle
  desired_position_raw: single[3]  % # [m] Raw 'idealistic' desired drone position if a drone could teleport from place to places
  in_emergency_ascent: boolean  % # [bool] True when doing emergency ascent (when distance to ground is below safety altitude)
  gimbal_pitch: single  % # [rad] Gimbal pitch commanded to track target in the center of the frame

gimbal_controls_s = Simulink.Bus()
  timestamp: uint64  % # time since system start (microseconds)
  timestamp_sample: uint64  % # the timestamp the data this control response is based on was sampled
  control: single[3]

gripper_s = Simulink.Bus()
  timestamp: uint64
  command: int8  % # Commanded state for the gripper

health_report_s = Simulink.Bus()
  timestamp: uint64  % # time since system start (microseconds)
  can_arm_mode_flags: uint64  % # bitfield for each flight mode (NAVIGATION_STATE_*) if arming is possible
  can_run_mode_flags: uint64  % # bitfield for each flight mode if it can run
  health_is_present_flags: uint64  % # flags for each health_component_t
  health_warning_flags: uint64
  health_error_flags: uint64
  arming_check_warning_flags: uint64
  arming_check_error_flags: uint64

internal_combustion_engine_status_s = Simulink.Bus()
  timestamp: uint64  % # time since system start (microseconds)
  state: uint8
  flags: uint32
  engine_load_percent: uint8  % # Engine load estimate, percent, [0, 127]
  engine_speed_rpm: uint32  % # Engine speed, revolutions per minute
  spark_dwell_time_ms: single  % # Spark dwell time, millisecond
  atmospheric_pressure_kpa: single  % # Atmospheric (barometric) pressure, kilopascal
  intake_manifold_pressure_kpa: single  % # Engine intake manifold pressure, kilopascal
  intake_manifold_temperature: single  % # Engine intake manifold temperature, kelvin
  coolant_temperature: single  % # Engine coolant temperature, kelvin
  oil_pressure: single  % # Oil pressure, kilopascal
  oil_temperature: single  % # Oil temperature, kelvin
  fuel_pressure: single  % # Fuel pressure, kilopascal
  fuel_consumption_rate_cm3pm: single  % # Instant fuel consumption estimate, (centimeter^3)/minute
  estimated_consumed_fuel_volume_cm3: single  % # Estimate of the consumed fuel since the start of the engine, centimeter^3
  throttle_position_percent: uint8  % # Throttle position, percent
  ecu_index: uint8  % # The index of the publishing ECU
  spark_plug_usage: uint8  % # Spark plug activity report.
  ignition_timing_deg: single  % # Cylinder ignition timing, angular degrees of the crankshaft
  injection_time_ms: single  % # Fuel injection time, millisecond
  cylinder_head_temperature: single  % # Cylinder head temperature (CHT), kelvin
  exhaust_gas_temperature: single  % # Exhaust gas temperature (EGT), kelvin
  lambda_coefficient: single  % # Estimated lambda coefficient, dimensionless ratio

landing_gear_wheel_s = Simulink.Bus()
  timestamp: uint64  % # time since system start (microseconds)
  normalized_wheel_setpoint: single  % # negative is turning left, positive turning right [-1, 1]

launch_detection_status_s = Simulink.Bus()
  timestamp: uint64  % # time since system start (microseconds)
  launch_detection_state: uint8

magnetometer_bias_estimate_s = Simulink.Bus()
  timestamp: uint64  % # time since system start (microseconds)
  bias_x: single[4]  % # estimated X-bias of all the sensors
  bias_y: single[4]  % # estimated Y-bias of all the sensors
  bias_z: single[4]  % # estimated Z-bias of all the sensors
  valid: boolean[4]  % # true if the estimator has converged
  stable: boolean[4]

manual_control_input_s = Simulink.Bus()
  timestamp: uint64  % # time since system start (microseconds)
  timestamp_sample: uint64  % # the timestamp of the raw data (microseconds)
  valid: boolean
  data_source: uint8
  roll: single  % # move right,   positive roll rotation,  right side down
  pitch: single  % # move forward, negative pitch rotation, nose down
  yaw: single  % #               positive yaw rotation,   clockwise when seen top down
  throttle: single  % # move up,      positive thrust,         -1 is minimum available 0% or -100% +1 is 100% thrust
  flaps: single  % # position of flaps switch/knob/lever [-1, 1]
  aux1: single
  aux2: single
  aux3: single
  aux4: single
  aux5: single
  aux6: single
  sticks_moving: boolean

mavlink_tunnel_s = Simulink.Bus()
  timestamp: uint64  % # Time since system start (microseconds)
  payload_type: uint16  % # A code that identifies the content of the payload (0 for unknown, which is the default). If this code is less than 32768, it is a 'registered' payload type and the corresponding code should be added to the MAV_TUNNEL_PAYLOAD_TYPE enum. Software creators can register blocks of types as needed. Codes greater than 32767 are considered local experiments and should not be checked in to any widely distributed codebase.
  target_system: uint8  % # System ID (can be 0 for broadcast, but this is discouraged)
  target_component: uint8  % # Component ID (can be 0 for broadcast, but this is discouraged)
  payload_length: uint8  % # Length of the data transported in payload
  payload: uint8[128]  % # Data itself

mode_completed_s = Simulink.Bus()
  timestamp: uint64  % # time since system start (microseconds)
  result: uint8  % # One of RESULT_*
  nav_state: uint8  % # Source mode

flaps_setpoint_s = Simulink.Bus()
  timestamp: uint64  % # time since system start (microseconds)
  normalized_setpoint: single  % # [0, 1]

spoilers_setpoint_s = Simulink.Bus()
  timestamp: uint64  % # time since system start (microseconds)
  normalized_setpoint: single  % # [0, 1]

npfg_status_s = Simulink.Bus()
  timestamp: uint64  % # time since system start (microseconds)
  wind_est_valid: uint8  % # (boolean) true = wind estimate is valid and/or being used by controller (also indicates if wind est usage is disabled despite being valid)
  lat_accel: single  % # resultant lateral acceleration reference [m/s^2]
  lat_accel_ff: single  % # lateral acceleration demand only for maintaining curvature [m/s^2]
  bearing_feas: single  % # bearing feasibility [0,1]
  bearing_feas_on_track: single  % # on-track bearing feasibility [0,1]
  signed_track_error: single  % # signed track error [m]
  track_error_bound: single  % # track error bound [m]
  airspeed_ref: single  % # (true) airspeed reference [m/s]
  bearing: single  % # bearing angle [rad]
  heading_ref: single  % # heading angle reference [rad]
  min_ground_speed_ref: single  % # minimum forward ground speed reference [m/s]
  adapted_period: single  % # adapted period (if auto-tuning enabled) [s]
  p_gain: single  % # controller proportional gain [rad/s]
  time_const: single  % # controller time constant [s]

pps_capture_s = Simulink.Bus()
  timestamp: uint64  % # time since system start (microseconds) at PPS capture event
  rtc_timestamp: uint64  % # Corrected GPS UTC timestamp at PPS capture event
  pps_rate_exceeded_counter: uint8  % # Increments when PPS dt < 50ms

rtl_time_estimate_s = Simulink.Bus()
  timestamp: uint64  % # time since system start (microseconds)
  valid: boolean  % # Flag indicating whether the time estiamtes are valid
  time_estimate: single  % # [s] Estimated time for RTL
  safe_time_estimate: single  % # [s] Same as time_estimate, but with safety factor and safety margin included (factor*t + margin)

sensor_gnss_relative_s = Simulink.Bus()
  timestamp: uint64  % # time since system start (microseconds)
  timestamp_sample: uint64  % # time since system start (microseconds)
  device_id: uint32  % # unique device ID for the sensor that does not change between power cycles
  time_utc_usec: uint64  % # Timestamp (microseconds, UTC), this is the timestamp which comes from the gps module. It might be unavailable right after cold start, indicated by a value of 0
  reference_station_id: uint16  % # Reference Station ID
  position: single[3]  % # GPS NED relative position vector (m)
  position_accuracy: single[3]  % # Accuracy of relative position (m)
  heading: single  % # Heading of the relative position vector (radians)
  heading_accuracy: single  % # Accuracy of heading of the relative position vector (radians)
  position_length: single
  accuracy_length: single
  gnss_fix_ok: boolean  % # GNSS valid fix (i.e within DOP & accuracy masks)
  differential_solution: boolean  % # differential corrections were applied
  relative_position_valid: boolean
  carrier_solution_floating: boolean  % # carrier phase range solution with floating ambiguities
  carrier_solution_fixed: boolean  % # carrier phase range solution with fixed ambiguities
  moving_base_mode: boolean  % # if the receiver is operating in moving base mode
  reference_position_miss: boolean  % # extrapolated reference position was used to compute moving base solution this epoch
  reference_observations_miss: boolean  % # extrapolated reference observations were used to compute moving base solution this epoch
  heading_valid: boolean
  relative_position_normalized: boolean  % # the components of the relative position vector (including the high-precision parts) are normalized

sensor_hygrometer_s = Simulink.Bus()
  timestamp: uint64  % # time since system start (microseconds)
  timestamp_sample: uint64
  device_id: uint32  % # unique device ID for the sensor that does not change between power cycles
  temperature: single  % # Temperature provided by sensor (Celsius)
  humidity: single  % # Humidity provided by sensor

sensor_optical_flow_s = Simulink.Bus()
  timestamp: uint64  % # time since system start (microseconds)
  timestamp_sample: uint64
  device_id: uint32  % # unique device ID for the sensor that does not change between power cycles
  pixel_flow: single[2]  % # (radians) optical flow in radians where a positive value is produced by a RH rotation about the body axis
  delta_angle: single[3]  % # (radians) accumulated gyro radians where a positive value is produced by a RH rotation about the body axis. Set to NaN if flow sensor does not have 3-axis gyro data.
  delta_angle_available: boolean
  distance_m: single  % # (meters) Distance to the center of the flow field
  distance_available: boolean
  integration_timespan_us: uint32  % # (microseconds) accumulation timespan in microseconds
  quality: uint8  % # quality, 0: bad quality, 255: maximum quality
  error_count: uint32
  max_flow_rate: single  % # (radians/s) Magnitude of maximum angular which the optical flow sensor can measure reliably
  min_ground_distance: single  % # (meters) Minimum distance from ground at which the optical flow sensor operates reliably
  max_ground_distance: single  % # (meters) Maximum distance from ground at which the optical flow sensor operates reliably
  mode: uint8

sensor_uwb_s = Simulink.Bus()
  timestamp: uint64  % # time since system start (microseconds)
  sessionid: uint32  % # UWB SessionID
  time_offset: uint32  % # Time between Ranging Rounds in ms
  counter: uint32  % # Number of Ranges since last Start of Ranging
  mac: uint16  % # MAC adress of Initiator (controller)
  mac_dest: uint16  % # MAC adress of Responder (Controlee)
  status: uint16  % # status feedback #
  nlos: uint8  % # None line of site condition y/n
  distance: single  % # distance in m to the UWB receiver
  aoa_azimuth_dev: single  % # Angle of arrival of first incomming RX msg
  aoa_elevation_dev: single  % # Angle of arrival of first incomming RX msg
  aoa_azimuth_resp: single  % # Angle of arrival of first incomming RX msg at the responder
  aoa_elevation_resp: single  % # Angle of arrival of first incomming RX msg at the responder
  aoa_azimuth_fom: uint8  % # AOA Azimuth FOM
  aoa_elevation_fom: uint8  % # AOA Elevation FOM
  aoa_dest_azimuth_fom: uint8  % # AOA Azimuth FOM
  aoa_dest_elevation_fom: uint8  % # AOA Elevation FOM
  orientation: uint8  % # Direction the sensor faces from MAV_SENSOR_ORIENTATION enum
  offset_x: single  % # UWB initiator offset in X axis (NED drone frame)
  offset_y: single  % # UWB initiator offset in Y axis (NED drone frame)
  offset_z: single  % # UWB initiator offset in Z axis (NED drone frame)

sensors_status_baro_s = Simulink.Bus()
  timestamp: uint64  % # time since system start (microseconds)
  device_id_primary: uint32  % # current primary device id for reference
  device_ids: uint32[4]
  inconsistency: single[4]  % # magnitude of difference between sensor instance and mean
  healthy: boolean[4]  % # sensor healthy
  priority: uint8[4]
  enabled: boolean[4]
  external: boolean[4]

sensors_status_mag_s = Simulink.Bus()
  timestamp: uint64  % # time since system start (microseconds)
  device_id_primary: uint32  % # current primary device id for reference
  device_ids: uint32[4]
  inconsistency: single[4]  % # magnitude of difference between sensor instance and mean
  healthy: boolean[4]  % # sensor healthy
  priority: uint8[4]
  enabled: boolean[4]
  external: boolean[4]

tiltrotor_extra_controls_s = Simulink.Bus()
  timestamp: uint64  % # time since system start (microseconds)
  collective_tilt_normalized_setpoint: single  % # Collective tilt angle of motors of tiltrotor, 0: vertical, 1: horizontal [0, 1]
  collective_thrust_normalized_setpoint: single  % # Collective thrust setpoint [0, 1]

gimbal_v1_command_s = Simulink.Bus()
  timestamp: uint64  % # time since system start (microseconds)
  param1: single  % # Parameter 1, as defined by MAVLink uint16 VEHICLE_CMD enum.
  param2: single  % # Parameter 2, as defined by MAVLink uint16 VEHICLE_CMD enum.
  param3: single  % # Parameter 3, as defined by MAVLink uint16 VEHICLE_CMD enum.
  param4: single  % # Parameter 4, as defined by MAVLink uint16 VEHICLE_CMD enum.
  param5: double  % # Parameter 5, as defined by MAVLink uint16 VEHICLE_CMD enum.
  param6: double  % # Parameter 6, as defined by MAVLink uint16 VEHICLE_CMD enum.
  param7: single  % # Parameter 7, as defined by MAVLink uint16 VEHICLE_CMD enum.
  command: uint32  % # Command ID
  target_system: uint8  % # System which should execute the command
  target_component: uint8  % # Component which should execute the command, 0 for all components
  source_system: uint8  % # System sending the command
  source_component: uint8  % # Component sending the command
  confirmation: uint8  % # 0: First transmission of this command. 1-255: Confirmation transmissions (e.g. for kill command)
  from_external: boolean

vehicle_optical_flow_s = Simulink.Bus()
  timestamp: uint64  % # time since system start (microseconds)
  timestamp_sample: uint64
  device_id: uint32  % # unique device ID for the sensor that does not change between power cycles
  pixel_flow: single[2]  % # (radians) accumulated optical flow in radians where a positive value is produced by a RH rotation about the body axis
  delta_angle: single[3]  % # (radians) accumulated gyro radians where a positive value is produced by a RH rotation about the body axis. (NAN if unavailable)
  distance_m: single  % # (meters) Distance to the center of the flow field (NAN if unavailable)
  integration_timespan_us: uint32  % # (microseconds) accumulation timespan in microseconds
  quality: uint8  % # Average of quality of accumulated frames, 0: bad quality, 255: maximum quality
  max_flow_rate: single  % # (radians/s) Magnitude of maximum angular which the optical flow sensor can measure reliably
  min_ground_distance: single  % # (meters) Minimum distance from ground at which the optical flow sensor operates reliably
  max_ground_distance: single  % # (meters) Maximum distance from ground at which the optical flow sensor operates reliably

vehicle_optical_flow_vel_s = Simulink.Bus()
  timestamp: uint64  % # time since system start (microseconds)
  timestamp_sample: uint64  % # the timestamp of the raw data (microseconds)
  vel_body: single[2]  % # velocity obtained from gyro-compensated and distance-scaled optical flow raw measurements in body frame(m/s)
  vel_ne: single[2]  % # same as vel_body but in local frame (m/s)
  flow_uncompensated_integral: single[2]  % # integrated optical flow measurement (rad)
  flow_compensated_integral: single[2]  % # integrated optical flow measurement compensated for angular motion (rad)
  gyro_rate: single[3]  % # gyro measurement synchronized with flow measurements (rad/s)
  gyro_rate_integral: single[3]  % # gyro measurement integrated to flow rate and synchronized with flow measurements (rad)

vehicle_thrust_setpoint_virtual_fw_s = Simulink.Bus()
  timestamp: uint64  % # time since system start (microseconds)
  timestamp_sample: uint64  % # timestamp of the data sample on which this message is based (microseconds)
  xyz: single[3]  % # thrust setpoint along X, Y, Z body axis [-1, 1]

vehicle_thrust_setpoint_virtual_mc_s = Simulink.Bus()
  timestamp: uint64  % # time since system start (microseconds)
  timestamp_sample: uint64  % # timestamp of the data sample on which this message is based (microseconds)
  xyz: single[3]  % # thrust setpoint along X, Y, Z body axis [-1, 1]

vehicle_torque_setpoint_virtual_fw_s = Simulink.Bus()
  timestamp: uint64  % # time since system start (microseconds)
  timestamp_sample: uint64  % # timestamp of the data sample on which this message is based (microseconds)
  xyz: single[3]  % # torque setpoint about X, Y, Z body axis (normalized)

vehicle_torque_setpoint_virtual_mc_s = Simulink.Bus()
  timestamp: uint64  % # time since system start (microseconds)
  timestamp_sample: uint64  % # timestamp of the data sample on which this message is based (microseconds)
  xyz: single[3]  % # torque setpoint about X, Y, Z body axis (normalized)

ACTION_DISARM = Simulink.Parameter(0, StorageClass="Const", DataType="uint8")
ACTION_ARM = Simulink.Parameter(1, StorageClass="Const", DataType="uint8")
ACTION_TOGGLE_ARMING = Simulink.Parameter(2, StorageClass="Const", DataType="uint8")
ACTION_UNKILL = Simulink.Parameter(3, StorageClass="Const", DataType="uint8")
ACTION_KILL = Simulink.Parameter(4, StorageClass="Const", DataType="uint8")
ACTION_SWITCH_MODE = Simulink.Parameter(5, StorageClass="Const", DataType="uint8")
ACTION_VTOL_TRANSITION_TO_MULTICOPTER = Simulink.Parameter(6, StorageClass="Const", DataType="uint8")
ACTION_VTOL_TRANSITION_TO_FIXEDWING = Simulink.Parameter(7, StorageClass="Const", DataType="uint8")
SOURCE_RC_STICK_GESTURE = Simulink.Parameter(0, StorageClass="Const", DataType="uint8")
SOURCE_RC_SWITCH = Simulink.Parameter(1, StorageClass="Const", DataType="uint8")
SOURCE_RC_BUTTON = Simulink.Parameter(2, StorageClass="Const", DataType="uint8")
SOURCE_RC_MODE_SLOT = Simulink.Parameter(3, StorageClass="Const", DataType="uint8")

ACTION_REQUEST = enum(AddClassNameToEnumNames=true)
  ACTION_DISARM = 0
  ACTION_ARM = 1
  ACTION_TOGGLE_ARMING = 2
  ACTION_UNKILL = 3
  ACTION_KILL = 4
  ACTION_SWITCH_MODE = 5
  ACTION_VTOL_TRANSITION_TO_MULTICOPTER = 6
  ACTION_VTOL_TRANSITION_TO_FIXEDWING = 7
  SOURCE_RC_STICK_GESTURE = 0
  SOURCE_RC_SWITCH = 1
  SOURCE_RC_BUTTON = 2
  SOURCE_RC_MODE_SLOT = 3

ACTUATOR_FUNCTION_MOTOR1 = Simulink.Parameter(101, StorageClass="Const", DataType="uint8")
NUM_CONTROLS = Simulink.Parameter(8, StorageClass="Const", DataType="uint8")

ACTUATOR_MOTORS = enum(AddClassNameToEnumNames=true)
  ACTUATOR_FUNCTION_MOTOR1 = 101
  NUM_CONTROLS = 12

ACTUATOR_SERVOS = enum(AddClassNameToEnumNames=true)
  NUM_CONTROLS = 8

ACTUATOR_SERVOS_TRIM = enum(AddClassNameToEnumNames=true)
  NUM_CONTROLS = 8

ACTION_RELEASE_CONTROL = Simulink.Parameter(0, StorageClass="Const", DataType="uint8")  % # exit test mode for the given function
ACTION_DO_CONTROL = Simulink.Parameter(1, StorageClass="Const", DataType="uint8")  % # enable actuator test mode
FUNCTION_MOTOR1 = Simulink.Parameter(101, StorageClass="Const", DataType="uint8")
MAX_NUM_MOTORS = Simulink.Parameter(12, StorageClass="Const", DataType="uint8")
FUNCTION_SERVO1 = Simulink.Parameter(201, StorageClass="Const", DataType="uint8")
MAX_NUM_SERVOS = Simulink.Parameter(8, StorageClass="Const", DataType="uint8")

ACTUATOR_TEST = enum(AddClassNameToEnumNames=true)
  ACTION_RELEASE_CONTROL = 0  % # exit test mode for the given function
  ACTION_DO_CONTROL = 1  % # enable actuator test mode
  FUNCTION_MOTOR1 = 101
  MAX_NUM_MOTORS = 12
  FUNCTION_SERVO1 = 201
  MAX_NUM_SERVOS = 8
  ORB_QUEUE_LENGTH = 12  % # same as MAX_NUM_MOTORS to support code in esc_calibration

STATE_IDLE = Simulink.Parameter(0, StorageClass="Const", DataType="uint8")
STATE_INIT = Simulink.Parameter(1, StorageClass="Const", DataType="uint8")
STATE_ROLL = Simulink.Parameter(2, StorageClass="Const", DataType="uint8")
STATE_ROLL_PAUSE = Simulink.Parameter(3, StorageClass="Const", DataType="uint8")
STATE_PITCH = Simulink.Parameter(4, StorageClass="Const", DataType="uint8")
STATE_PITCH_PAUSE = Simulink.Parameter(5, StorageClass="Const", DataType="uint8")
STATE_YAW = Simulink.Parameter(6, StorageClass="Const", DataType="uint8")
STATE_YAW_PAUSE = Simulink.Parameter(7, StorageClass="Const", DataType="uint8")
STATE_VERIFICATION = Simulink.Parameter(8, StorageClass="Const", DataType="uint8")
STATE_APPLY = Simulink.Parameter(9, StorageClass="Const", DataType="uint8")
STATE_TEST = Simulink.Parameter(10, StorageClass="Const", DataType="uint8")
STATE_COMPLETE = Simulink.Parameter(11, StorageClass="Const", DataType="uint8")
STATE_FAIL = Simulink.Parameter(12, StorageClass="Const", DataType="uint8")
STATE_WAIT_FOR_DISARM = Simulink.Parameter(13, StorageClass="Const", DataType="uint8")

AUTOTUNE_ATTITUDE_CONTROL_STATUS = enum(AddClassNameToEnumNames=true)
  STATE_IDLE = 0
  STATE_INIT = 1
  STATE_ROLL = 2
  STATE_ROLL_PAUSE = 3
  STATE_PITCH = 4
  STATE_PITCH_PAUSE = 5
  STATE_YAW = 6
  STATE_YAW_PAUSE = 7
  STATE_VERIFICATION = 8
  STATE_APPLY = 9
  STATE_TEST = 10
  STATE_COMPLETE = 11
  STATE_FAIL = 12
  STATE_WAIT_FOR_DISARM = 13

BATTERY_STATE_UNHEALTHY = Simulink.Parameter(6, StorageClass="Const", DataType="uint8")  % # Battery is diagnosed to be defective or an error occurred, usage is discouraged / prohibited. Possible causes (faults) are listed in faults field.
BATTERY_STATE_CHARGING = Simulink.Parameter(7, StorageClass="Const", DataType="uint8")  % # Battery is charging
BATTERY_FAULT_DEEP_DISCHARGE = Simulink.Parameter(0, StorageClass="Const", DataType="uint8")  % # Battery has deep discharged
BATTERY_FAULT_SPIKES = Simulink.Parameter(1, StorageClass="Const", DataType="uint8")  % # Voltage spikes
BATTERY_FAULT_CELL_FAIL = Simulink.Parameter(2, StorageClass="Const", DataType="uint8")  % # One or more cells have failed
BATTERY_FAULT_OVER_CURRENT = Simulink.Parameter(3, StorageClass="Const", DataType="uint8")  % # Over-current
BATTERY_FAULT_OVER_TEMPERATURE = Simulink.Parameter(4, StorageClass="Const", DataType="uint8")  % # Over-temperature
BATTERY_FAULT_UNDER_TEMPERATURE = Simulink.Parameter(5, StorageClass="Const", DataType="uint8")  % # Under-temperature fault
BATTERY_FAULT_INCOMPATIBLE_VOLTAGE = Simulink.Parameter(6, StorageClass="Const", DataType="uint8")  % # Vehicle voltage is not compatible with battery one
BATTERY_FAULT_INCOMPATIBLE_FIRMWARE = Simulink.Parameter(7, StorageClass="Const", DataType="uint8")  % # Battery firmware is not compatible with current autopilot firmware
BATTERY_FAULT_INCOMPATIBLE_MODEL = Simulink.Parameter(8, StorageClass="Const", DataType="uint8")  % # Battery model is not supported by the system
BATTERY_FAULT_HARDWARE_FAILURE = Simulink.Parameter(9, StorageClass="Const", DataType="uint8")  % # hardware problem
BATTERY_WARNING_OVER_TEMPERATURE = Simulink.Parameter(10, StorageClass="Const", DataType="uint8")  % # Over-temperature
BATTERY_FAULT_COUNT = Simulink.Parameter(11, StorageClass="Const", DataType="uint8")  % # Counter - keep it as last element!
BATTERY_MODE_UNKNOWN = Simulink.Parameter(0, StorageClass="Const", DataType="uint8")  % # Battery does not support a mode, or if it does, is operational
BATTERY_MODE_AUTO_DISCHARGING = Simulink.Parameter(1, StorageClass="Const", DataType="uint8")  % # Battery is auto discharging (towards storage level)
BATTERY_MODE_HOT_SWAP = Simulink.Parameter(2, StorageClass="Const", DataType="uint8")  % # Battery in hot-swap mode
BATTERY_MODE_COUNT = Simulink.Parameter(3, StorageClass="Const", DataType="uint8")  % # Counter - keep it as last element (once we're fully migrated to events interface we can just comment this)!

BUTTON_EVENT = enum(AddClassNameToEnumNames=true)
  ORB_QUEUE_LENGTH = 2

CAMERA_TRIGGER = enum(AddClassNameToEnumNames=true)
  ORB_QUEUE_LENGTH = 2

FAILURE_OVER_CURRENT = Simulink.Parameter(0, StorageClass="Const", DataType="uint8")  % # (1 << 0)
FAILURE_OVER_VOLTAGE = Simulink.Parameter(1, StorageClass="Const", DataType="uint8")  % # (1 << 1)
FAILURE_MOTOR_OVER_TEMPERATURE = Simulink.Parameter(2, StorageClass="Const", DataType="uint8")  % # (1 << 2)
FAILURE_OVER_RPM = Simulink.Parameter(3, StorageClass="Const", DataType="uint8")  % # (1 << 3)
FAILURE_INCONSISTENT_CMD = Simulink.Parameter(4, StorageClass="Const", DataType="uint8")  % # (1 << 4)  Set if ESC received an inconsistent command (i.e out of boundaries)
FAILURE_MOTOR_STUCK = Simulink.Parameter(5, StorageClass="Const", DataType="uint8")  % # (1 << 5)
FAILURE_GENERIC = Simulink.Parameter(6, StorageClass="Const", DataType="uint8")  % # (1 << 6)
FAILURE_MOTOR_WARN_TEMPERATURE = Simulink.Parameter(7, StorageClass="Const", DataType="uint8")  % # (1 << 7)
FAILURE_WARN_ESC_TEMPERATURE = Simulink.Parameter(8, StorageClass="Const", DataType="uint8")  % # (1 << 8)
FAILURE_OVER_ESC_TEMPERATURE = Simulink.Parameter(9, StorageClass="Const", DataType="uint8")  % # (1 << 9)
ESC_FAILURE_COUNT = Simulink.Parameter(10, StorageClass="Const", DataType="uint8")  % # Counter - keep it as last element!
CS_EV_VEL = Simulink.Parameter(24, StorageClass="Const", DataType="uint8")  % # 24 - true when local frame velocity data fusion from external vision measurements is intended
CS_SYNTHETIC_MAG_Z = Simulink.Parameter(25, StorageClass="Const", DataType="uint8")  % # 25 - true when we are using a synthesized measurement for the magnetometer Z component
CS_VEHICLE_AT_REST = Simulink.Parameter(26, StorageClass="Const", DataType="uint8")  % # 26 - true when the vehicle is at rest
CS_GPS_YAW_FAULT = Simulink.Parameter(27, StorageClass="Const", DataType="uint8")  % # 27 - true when the GNSS heading has been declared faulty and is no longer being used
CS_RNG_FAULT = Simulink.Parameter(28, StorageClass="Const", DataType="uint8")  % # 28 - true when the range finder has been declared faulty and is no longer being used

EVENT = enum(AddClassNameToEnumNames=true)
  ORB_QUEUE_LENGTH = 16

GIMBAL_CONTROLS = enum(AddClassNameToEnumNames=true)
  INDEX_ROLL = 0
  INDEX_PITCH = 1
  INDEX_YAW = 2

COMMAND_GRAB = Simulink.Parameter(0, StorageClass="Const", DataType="int8")
COMMAND_RELEASE = Simulink.Parameter(1, StorageClass="Const", DataType="int8")

GRIPPER = enum(AddClassNameToEnumNames=true)
  COMMAND_GRAB = 0
  COMMAND_RELEASE = 1

RSSI_MAX = Simulink.Parameter(100, StorageClass="Const", DataType="int8")
STATE_STOPPED = Simulink.Parameter(0, StorageClass="Const", DataType="uint8")  % # The engine is not running. This is the default state.
STATE_STARTING = Simulink.Parameter(1, StorageClass="Const", DataType="uint8")  % # The engine is starting. This is a transient state.
STATE_RUNNING = Simulink.Parameter(2, StorageClass="Const", DataType="uint8")  % # The engine is running normally.
STATE_FAULT = Simulink.Parameter(3, StorageClass="Const", DataType="uint8")  % # The engine can no longer function.
FLAG_GENERAL_ERROR = Simulink.Parameter(1, StorageClass="Const", DataType="uint32")  % # General error.
FLAG_CRANKSHAFT_SENSOR_ERROR_SUPPORTED = Simulink.Parameter(2, StorageClass="Const", DataType="uint32")  % # Error of the crankshaft sensor. This flag is optional.
FLAG_CRANKSHAFT_SENSOR_ERROR = Simulink.Parameter(4, StorageClass="Const", DataType="uint32")
FLAG_TEMPERATURE_SUPPORTED = Simulink.Parameter(8, StorageClass="Const", DataType="uint32")  % # Temperature levels. These flags are optional
FLAG_TEMPERATURE_BELOW_NOMINAL = Simulink.Parameter(16, StorageClass="Const", DataType="uint32")  % # Under-temperature warning
FLAG_TEMPERATURE_ABOVE_NOMINAL = Simulink.Parameter(32, StorageClass="Const", DataType="uint32")  % # Over-temperature warning
FLAG_TEMPERATURE_OVERHEATING = Simulink.Parameter(64, StorageClass="Const", DataType="uint32")  % # Critical overheating
FLAG_TEMPERATURE_EGT_ABOVE_NOMINAL = Simulink.Parameter(128, StorageClass="Const", DataType="uint32")  % # Exhaust gas over-temperature warning
FLAG_FUEL_PRESSURE_SUPPORTED = Simulink.Parameter(256, StorageClass="Const", DataType="uint32")  % # Fuel pressure. These flags are optional
FLAG_FUEL_PRESSURE_BELOW_NOMINAL = Simulink.Parameter(512, StorageClass="Const", DataType="uint32")  % # Under-pressure warning
FLAG_FUEL_PRESSURE_ABOVE_NOMINAL = Simulink.Parameter(1024, StorageClass="Const", DataType="uint32")  % # Over-pressure warning
FLAG_DETONATION_SUPPORTED = Simulink.Parameter(2048, StorageClass="Const", DataType="uint32")  % # Detonation warning. This flag is optional.
FLAG_DETONATION_OBSERVED = Simulink.Parameter(4096, StorageClass="Const", DataType="uint32")  % # Detonation condition observed warning
FLAG_MISFIRE_SUPPORTED = Simulink.Parameter(8192, StorageClass="Const", DataType="uint32")  % # Misfire warning. This flag is optional.
FLAG_MISFIRE_OBSERVED = Simulink.Parameter(16384, StorageClass="Const", DataType="uint32")  % # Misfire condition observed warning
FLAG_OIL_PRESSURE_SUPPORTED = Simulink.Parameter(32768, StorageClass="Const", DataType="uint32")  % # Oil pressure. These flags are optional
FLAG_OIL_PRESSURE_BELOW_NOMINAL = Simulink.Parameter(65536, StorageClass="Const", DataType="uint32")  % # Under-pressure warning
FLAG_OIL_PRESSURE_ABOVE_NOMINAL = Simulink.Parameter(131072, StorageClass="Const", DataType="uint32")  % # Over-pressure warning
FLAG_DEBRIS_SUPPORTED = Simulink.Parameter(262144, StorageClass="Const", DataType="uint32")  % # Debris warning. This flag is optional
FLAG_DEBRIS_DETECTED = Simulink.Parameter(524288, StorageClass="Const", DataType="uint32")  % # Detection of debris warning
SPARK_PLUG_SINGLE = Simulink.Parameter(0, StorageClass="Const", DataType="uint8")
SPARK_PLUG_FIRST_ACTIVE = Simulink.Parameter(1, StorageClass="Const", DataType="uint8")
SPARK_PLUG_SECOND_ACTIVE = Simulink.Parameter(2, StorageClass="Const", DataType="uint8")
SPARK_PLUG_BOTH_ACTIVE = Simulink.Parameter(3, StorageClass="Const", DataType="uint8")

INTERNAL_COMBUSTION_ENGINE_STATUS = enum(AddClassNameToEnumNames=true)
  STATE_STOPPED = 0  % # The engine is not running. This is the default state.
  STATE_STARTING = 1  % # The engine is starting. This is a transient state.
  STATE_RUNNING = 2  % # The engine is running normally.
  STATE_FAULT = 3  % # The engine can no longer function.
  FLAG_GENERAL_ERROR = 1  % # General error.
  FLAG_CRANKSHAFT_SENSOR_ERROR_SUPPORTED = 2  % # Error of the crankshaft sensor. This flag is optional.
  FLAG_CRANKSHAFT_SENSOR_ERROR = 4
  FLAG_TEMPERATURE_SUPPORTED = 8  % # Temperature levels. These flags are optional
  FLAG_TEMPERATURE_BELOW_NOMINAL = 16  % # Under-temperature warning
  FLAG_TEMPERATURE_ABOVE_NOMINAL = 32  % # Over-temperature warning
  FLAG_TEMPERATURE_OVERHEATING = 64  % # Critical overheating
  FLAG_TEMPERATURE_EGT_ABOVE_NOMINAL = 128  % # Exhaust gas over-temperature warning
  FLAG_FUEL_PRESSURE_SUPPORTED = 256  % # Fuel pressure. These flags are optional
  FLAG_FUEL_PRESSURE_BELOW_NOMINAL = 512  % # Under-pressure warning
  FLAG_FUEL_PRESSURE_ABOVE_NOMINAL = 1024  % # Over-pressure warning
  FLAG_DETONATION_SUPPORTED = 2048  % # Detonation warning. This flag is optional.
  FLAG_DETONATION_OBSERVED = 4096  % # Detonation condition observed warning
  FLAG_MISFIRE_SUPPORTED = 8192  % # Misfire warning. This flag is optional.
  FLAG_MISFIRE_OBSERVED = 16384  % # Misfire condition observed warning
  FLAG_OIL_PRESSURE_SUPPORTED = 32768  % # Oil pressure. These flags are optional
  FLAG_OIL_PRESSURE_BELOW_NOMINAL = 65536  % # Under-pressure warning
  FLAG_OIL_PRESSURE_ABOVE_NOMINAL = 131072  % # Over-pressure warning
  FLAG_DEBRIS_SUPPORTED = 262144  % # Debris warning. This flag is optional
  FLAG_DEBRIS_DETECTED = 524288  % # Detection of debris warning
  SPARK_PLUG_SINGLE = 0
  SPARK_PLUG_FIRST_ACTIVE = 1
  SPARK_PLUG_SECOND_ACTIVE = 2
  SPARK_PLUG_BOTH_ACTIVE = 3

STATE_WAITING_FOR_LAUNCH = Simulink.Parameter(0, StorageClass="Const", DataType="uint8")  % # waiting for launch
STATE_LAUNCH_DETECTED_DISABLED_MOTOR = Simulink.Parameter(1, StorageClass="Const", DataType="uint8")  % # launch detected, but keep motor(s) disabled (e.g. because it can't spin freely while on catapult)
STATE_FLYING = Simulink.Parameter(2, StorageClass="Const", DataType="uint8")  % # launch detected, use normal takeoff/flying configuration

LAUNCH_DETECTION_STATUS = enum(AddClassNameToEnumNames=true)
  STATE_WAITING_FOR_LAUNCH = 0  % # waiting for launch
  STATE_LAUNCH_DETECTED_DISABLED_MOTOR = 1  % # launch detected, but keep motor(s) disabled (e.g. because it can't spin freely while on catapult)
  STATE_FLYING = 2  % # launch detected, use normal takeoff/flying configuration

SOURCE_UNKNOWN = Simulink.Parameter(0, StorageClass="Const", DataType="uint8")
SOURCE_MAVLINK_4 = Simulink.Parameter(6, StorageClass="Const", DataType="uint8")  % # mavlink instance 4
SOURCE_MAVLINK_5 = Simulink.Parameter(7, StorageClass="Const", DataType="uint8")  % # mavlink instance 5

MAVLINK_TUNNEL = enum(AddClassNameToEnumNames=true)
  MAV_TUNNEL_PAYLOAD_TYPE_UNKNOWN = 0  % # Encoding of payload unknown
  MAV_TUNNEL_PAYLOAD_TYPE_STORM32_RESERVED0 = 200  % # Registered for STorM32 gimbal controller
  MAV_TUNNEL_PAYLOAD_TYPE_STORM32_RESERVED1 = 201  % # Registered for STorM32 gimbal controller
  MAV_TUNNEL_PAYLOAD_TYPE_STORM32_RESERVED2 = 202  % # Registered for STorM32 gimbal controller
  MAV_TUNNEL_PAYLOAD_TYPE_STORM32_RESERVED3 = 203  % # Registered for STorM32 gimbal controller
  MAV_TUNNEL_PAYLOAD_TYPE_STORM32_RESERVED4 = 204  % # Registered for STorM32 gimbal controller
  MAV_TUNNEL_PAYLOAD_TYPE_STORM32_RESERVED5 = 205  % # Registered for STorM32 gimbal controller
  MAV_TUNNEL_PAYLOAD_TYPE_STORM32_RESERVED6 = 206  % # Registered for STorM32 gimbal controller
  MAV_TUNNEL_PAYLOAD_TYPE_STORM32_RESERVED7 = 207  % # Registered for STorM32 gimbal controller
  MAV_TUNNEL_PAYLOAD_TYPE_STORM32_RESERVED8 = 208  % # Registered for STorM32 gimbal controller
  MAV_TUNNEL_PAYLOAD_TYPE_STORM32_RESERVED9 = 209  % # Registered for STorM32 gimbal controller

RESULT_SUCCESS = Simulink.Parameter(0, StorageClass="Const", DataType="uint8")
RESULT_FAILURE_OTHER = Simulink.Parameter(100, StorageClass="Const", DataType="uint8")  % # Mode failed (generic error)

MODE_COMPLETED = enum(AddClassNameToEnumNames=true)
  RESULT_SUCCESS = 0
  RESULT_FAILURE_OTHER = 100  % # Mode failed (generic error)

NOT_ABORTED = Simulink.Parameter(0, StorageClass="Const", DataType="uint8")
ABORTED_BY_OPERATOR = Simulink.Parameter(1, StorageClass="Const", DataType="uint8")
TERRAIN_NOT_FOUND = Simulink.Parameter(2, StorageClass="Const", DataType="uint8")  % # FW_LND_ABORT (1 << 0)
TERRAIN_TIMEOUT = Simulink.Parameter(3, StorageClass="Const", DataType="uint8")  % # FW_LND_ABORT (1 << 1)
UNKNOWN_ABORT_CRITERION = Simulink.Parameter(4, StorageClass="Const", DataType="uint8")

POSITION_CONTROLLER_LANDING_STATUS = enum(AddClassNameToEnumNames=true)
  NOT_ABORTED = 0
  ABORTED_BY_OPERATOR = 1
  TERRAIN_NOT_FOUND = 2  % # FW_LND_ABORT (1 << 0)
  TERRAIN_TIMEOUT = 3  % # FW_LND_ABORT (1 << 1)
  UNKNOWN_ABORT_CRITERION = 4

FUNCTION_FLTBTN_SLOT_1 = Simulink.Parameter(21, StorageClass="Const", DataType="uint8")
FUNCTION_FLTBTN_SLOT_2 = Simulink.Parameter(22, StorageClass="Const", DataType="uint8")
FUNCTION_FLTBTN_SLOT_3 = Simulink.Parameter(23, StorageClass="Const", DataType="uint8")
FUNCTION_FLTBTN_SLOT_4 = Simulink.Parameter(24, StorageClass="Const", DataType="uint8")
FUNCTION_FLTBTN_SLOT_5 = Simulink.Parameter(25, StorageClass="Const", DataType="uint8")
FUNCTION_FLTBTN_SLOT_6 = Simulink.Parameter(26, StorageClass="Const", DataType="uint8")
FUNCTION_ENGAGE_MAIN_MOTOR = Simulink.Parameter(27, StorageClass="Const", DataType="uint8")
FUNCTION_FLTBTN_SLOT_COUNT = Simulink.Parameter(6, StorageClass="Const", DataType="uint8")

SENSOR_BARO = enum(AddClassNameToEnumNames=true)
  ORB_QUEUE_LENGTH = 4

JAMMING_STATE_UNKNOWN = Simulink.Parameter(0, StorageClass="Const", DataType="uint8")
JAMMING_STATE_OK = Simulink.Parameter(1, StorageClass="Const", DataType="uint8")
JAMMING_STATE_WARNING = Simulink.Parameter(2, StorageClass="Const", DataType="uint8")
JAMMING_STATE_CRITICAL = Simulink.Parameter(3, StorageClass="Const", DataType="uint8")
SPOOFING_STATE_UNKNOWN = Simulink.Parameter(0, StorageClass="Const", DataType="uint8")
SPOOFING_STATE_NONE = Simulink.Parameter(1, StorageClass="Const", DataType="uint8")
SPOOFING_STATE_INDICATED = Simulink.Parameter(2, StorageClass="Const", DataType="uint8")
SPOOFING_STATE_MULTIPLE = Simulink.Parameter(3, StorageClass="Const", DataType="uint8")

SENSOR_GPS = enum(AddClassNameToEnumNames=true)
  JAMMING_STATE_UNKNOWN = 0
  JAMMING_STATE_OK = 1
  JAMMING_STATE_WARNING = 2
  JAMMING_STATE_CRITICAL = 3
  SPOOFING_STATE_UNKNOWN = 0
  SPOOFING_STATE_NONE = 1
  SPOOFING_STATE_INDICATED = 2
  SPOOFING_STATE_MULTIPLE = 3

SENSOR_OPTICAL_FLOW = enum(AddClassNameToEnumNames=true)
  MODE_UNKNOWN = 0
  MODE_BRIGHT = 1
  MODE_LOWLIGHT = 2
  MODE_SUPER_LOWLIGHT = 3

SOURCE_PROTOCOL_UNKNOWN = Simulink.Parameter(0, StorageClass="Const", DataType="uint8")
SOURCE_PROTOCOL_MAVLINK = Simulink.Parameter(1, StorageClass="Const", DataType="uint8")
SOURCE_PROTOCOL_DDS = Simulink.Parameter(2, StorageClass="Const", DataType="uint8")

TIMESYNC_STATUS = enum(AddClassNameToEnumNames=true)
  SOURCE_PROTOCOL_UNKNOWN = 0
  SOURCE_PROTOCOL_MAVLINK = 1
  SOURCE_PROTOCOL_DDS = 2

TUNE_ID_POWER_OFF = Simulink.Parameter(19, StorageClass="Const", DataType="uint8")
VEHICLE_CMD_DO_CHANGE_ALTITUDE = Simulink.Parameter(186, StorageClass="Const", DataType="uint16")  % # Set the vehicle to Loiter mode and change the altitude to specified value |Altitude| Frame of new altitude | Empty| Empty| Empty| Empty| Empty|
VEHICLE_CMD_DO_SET_ACTUATOR = Simulink.Parameter(187, StorageClass="Const", DataType="uint16")  % # Sets actuators (e.g. servos) to a desired value. |Actuator 1| Actuator 2| Actuator 3| Actuator 4| Actuator 5| Actuator 6| Index|
VEHICLE_CMD_DO_GRIPPER = Simulink.Parameter(211, StorageClass="Const", DataType="uint16")  % # Command to operate a gripper
VEHICLE_CMD_ACTUATOR_TEST = Simulink.Parameter(310, StorageClass="Const", DataType="uint16")  % # Actuator testing command|value [-1,1]|timeout [s]|Empty|Empty|output function|
VEHICLE_CMD_CONFIGURE_ACTUATOR = Simulink.Parameter(311, StorageClass="Const", DataType="uint16")  % # Actuator configuration command|configuration|Empty|Empty|Empty|output function|
VEHICLE_CMD_RUN_PREARM_CHECKS = Simulink.Parameter(401, StorageClass="Const", DataType="uint16")  % # Instructs a target system to run pre-arm checks.
VEHICLE_CMD_IMAGE_START_CAPTURE = Simulink.Parameter(2000, StorageClass="Const", DataType="uint16")  % # Start image capture sequence.
VEHICLE_CMD_VIDEO_START_CAPTURE = Simulink.Parameter(2500, StorageClass="Const", DataType="uint16")  % # Start a video capture.
VEHICLE_CMD_VIDEO_STOP_CAPTURE = Simulink.Parameter(2501, StorageClass="Const", DataType="uint16")  % # Stop the current video capture.
VEHICLE_CMD_DO_WINCH = Simulink.Parameter(42600, StorageClass="Const", DataType="uint16")  % # Command to operate winch.
SPEED_TYPE_AIRSPEED = Simulink.Parameter(0, StorageClass="Const", DataType="uint8")
SPEED_TYPE_GROUNDSPEED = Simulink.Parameter(1, StorageClass="Const", DataType="uint8")
SPEED_TYPE_CLIMB_SPEED = Simulink.Parameter(2, StorageClass="Const", DataType="uint8")
SPEED_TYPE_DESCEND_SPEED = Simulink.Parameter(3, StorageClass="Const", DataType="uint8")
ARMING_ACTION_DISARM = Simulink.Parameter(0, StorageClass="Const", DataType="int8")
ARMING_ACTION_ARM = Simulink.Parameter(1, StorageClass="Const", DataType="int8")
GRIPPER_ACTION_RELEASE = Simulink.Parameter(0, StorageClass="Const", DataType="uint8")
GRIPPER_ACTION_GRAB = Simulink.Parameter(1, StorageClass="Const", DataType="uint8")
VEHICLE_CMD_RESULT_CANCELLED = Simulink.Parameter(6, StorageClass="Const", DataType="uint8")  % # Command Canceled
POSE_FRAME_UNKNOWN = Simulink.Parameter(0, StorageClass="Const", DataType="uint8")
POSE_FRAME_NED = Simulink.Parameter(1, StorageClass="Const", DataType="uint8")  % # NED earth-fixed frame
POSE_FRAME_FRD = Simulink.Parameter(2, StorageClass="Const", DataType="uint8")  % # FRD world-fixed frame, arbitrary heading reference
VELOCITY_FRAME_UNKNOWN = Simulink.Parameter(0, StorageClass="Const", DataType="uint8")
VELOCITY_FRAME_NED = Simulink.Parameter(1, StorageClass="Const", DataType="uint8")  % # NED earth-fixed frame
VELOCITY_FRAME_FRD = Simulink.Parameter(2, StorageClass="Const", DataType="uint8")  % # FRD world-fixed frame, arbitrary heading reference
VELOCITY_FRAME_BODY_FRD = Simulink.Parameter(3, StorageClass="Const", DataType="uint8")  % # FRD body-fixed frame
NAVIGATION_STATE_UNUSED3 = Simulink.Parameter(8, StorageClass="Const", DataType="uint8")  % # Free slot
NAVIGATION_STATE_UNUSED1 = Simulink.Parameter(11, StorageClass="Const", DataType="uint8")  % # Free slot
NAVIGATION_STATE_AUTO_VTOL_TAKEOFF = Simulink.Parameter(22, StorageClass="Const", DataType="uint8")  % # Takeoff, transition, establish loiter
FAILURE_BATTERY = Simulink.Parameter(32, StorageClass="Const", DataType="uint16")  % # (1 << 5)
FAILURE_IMBALANCED_PROP = Simulink.Parameter(64, StorageClass="Const", DataType="uint16")  % # (1 << 6)
FAILURE_MOTOR = Simulink.Parameter(128, StorageClass="Const", DataType="uint16")  % # (1 << 7)

actuator_armed_s = Simulink.Bus()
  timestamp: uint64  % # time since system start (microseconds)
  armed: boolean  % # Set to true if system is armed
  prearmed: boolean  % # Set to true if the actuator safety is disabled but motors are not armed
  ready_to_arm: boolean  % # Set to true if system is ready to be armed
  lockdown: boolean  % # Set to true if actuators are forced to being disabled (due to emergency or HIL)
  manual_lockdown: boolean  % # Set to true if manual throttle kill switch is engaged
  force_failsafe: boolean  % # Set to true if the actuators are forced to the failsafe position
  in_esc_calibration_mode: boolean  % # IO/FMU should ignore messages from the actuator controls topics
  soft_stop: boolean  % # Set to true if we need to ESCs to remove the idle constraint

actuator_controls_virtual_fw_s = Simulink.Bus()
  timestamp: uint64  % # time since system start (microseconds)
  timestamp_sample: uint64  % # the timestamp the data this control response is based on was sampled
  control: single[8]

actuator_controls_virtual_mc_s = Simulink.Bus()
  timestamp: uint64  % # time since system start (microseconds)
  timestamp_sample: uint64  % # the timestamp the data this control response is based on was sampled
  control: single[8]

NUM_ACTUATOR_CONTROLS = Simulink.Parameter(8, StorageClass="Const", DataType="uint8")
NUM_ACTUATOR_CONTROL_GROUPS = Simulink.Parameter(6, StorageClass="Const", DataType="uint8")
INDEX_ROLL = Simulink.Parameter(0, StorageClass="Const", DataType="uint8")
INDEX_PITCH = Simulink.Parameter(1, StorageClass="Const", DataType="uint8")
INDEX_YAW = Simulink.Parameter(2, StorageClass="Const", DataType="uint8")
INDEX_THROTTLE = Simulink.Parameter(3, StorageClass="Const", DataType="uint8")
INDEX_FLAPS = Simulink.Parameter(4, StorageClass="Const", DataType="uint8")
INDEX_SPOILERS = Simulink.Parameter(5, StorageClass="Const", DataType="uint8")
INDEX_AIRBRAKES = Simulink.Parameter(6, StorageClass="Const", DataType="uint8")
INDEX_LANDING_GEAR = Simulink.Parameter(7, StorageClass="Const", DataType="uint8")
INDEX_GIMBAL_SHUTTER = Simulink.Parameter(3, StorageClass="Const", DataType="uint8")
INDEX_CAMERA_ZOOM = Simulink.Parameter(4, StorageClass="Const", DataType="uint8")
GROUP_INDEX_ATTITUDE = Simulink.Parameter(0, StorageClass="Const", DataType="uint8")
GROUP_INDEX_ATTITUDE_ALTERNATE = Simulink.Parameter(1, StorageClass="Const", DataType="uint8")
GROUP_INDEX_GIMBAL = Simulink.Parameter(2, StorageClass="Const", DataType="uint8")
GROUP_INDEX_MANUAL_PASSTHROUGH = Simulink.Parameter(3, StorageClass="Const", DataType="uint8")
GROUP_INDEX_ALLOCATED_PART1 = Simulink.Parameter(4, StorageClass="Const", DataType="uint8")
GROUP_INDEX_ALLOCATED_PART2 = Simulink.Parameter(5, StorageClass="Const", DataType="uint8")
GROUP_INDEX_PAYLOAD = Simulink.Parameter(6, StorageClass="Const", DataType="uint8")

ACTUATOR_CONTROLS = enum(AddClassNameToEnumNames=true)
  NUM_ACTUATOR_CONTROLS = 8
  NUM_ACTUATOR_CONTROL_GROUPS = 6
  INDEX_ROLL = 0
  INDEX_PITCH = 1
  INDEX_YAW = 2
  INDEX_THROTTLE = 3
  INDEX_FLAPS = 4
  INDEX_SPOILERS = 5
  INDEX_AIRBRAKES = 6
  INDEX_LANDING_GEAR = 7
  INDEX_GIMBAL_SHUTTER = 3
  INDEX_CAMERA_ZOOM = 4
  GROUP_INDEX_ATTITUDE = 0
  GROUP_INDEX_ATTITUDE_ALTERNATE = 1
  GROUP_INDEX_GIMBAL = 2
  GROUP_INDEX_MANUAL_PASSTHROUGH = 3
  GROUP_INDEX_ALLOCATED_PART1 = 4
  GROUP_INDEX_ALLOCATED_PART2 = 5
  GROUP_INDEX_PAYLOAD = 6

actuator_outputs_s = Simulink.Bus()
  timestamp: uint64  % # time since system start (microseconds)
  noutputs: uint32  % # valid outputs
  output: single[16]  % # output data, in natural output units

NUM_ACTUATOR_OUTPUTS = Simulink.Parameter(16, StorageClass="Const", DataType="uint8")
NUM_ACTUATOR_OUTPUT_GROUPS = Simulink.Parameter(4, StorageClass="Const", DataType="uint8")  % # for sanity checking

ACTUATOR_OUTPUTS = enum(AddClassNameToEnumNames=true)
  NUM_ACTUATOR_OUTPUTS = 16
  NUM_ACTUATOR_OUTPUT_GROUPS = 4  % # for sanity checking

adc_report_s = Simulink.Bus()
  timestamp: uint64  % # time since system start (microseconds)
  device_id: uint32  % # unique device ID for the sensor that does not change between power cycles
  channel_id: int16[12]  % # ADC channel IDs, negative for non-existent, TODO: should be kept same as array index
  raw_data: int32[12]  % # ADC channel raw value, accept negative value, valid if channel ID is positive
  resolution: uint32  % # ADC channel resolution
  v_ref: single  % # ADC channel voltage reference, use to calculate LSB voltage(lsb=scale/resolution)

airspeed_s = Simulink.Bus()
  timestamp: uint64  % # time since system start (microseconds)
  indicated_airspeed_m_s: single  % # indicated airspeed in m/s
  true_airspeed_m_s: single  % # true filtered airspeed in m/s
  air_temperature_celsius: single  % # air temperature in degrees celsius, -1000 if unknown
  confidence: single  % # confidence value from 0 to 1 for this sensor

airspeed_validated_s = Simulink.Bus()
  timestamp: uint64  % # time since system start (microseconds)
  indicated_airspeed_m_s: single  % # indicated airspeed in m/s (IAS), set to NAN if invalid
  calibrated_airspeed_m_s: single  % # calibrated airspeed in m/s (CAS, accounts for instrumentation errors), set to NAN if invalid
  true_airspeed_m_s: single  % # true filtered airspeed in m/s (TAS), set to NAN if invalid
  calibrated_ground_minus_wind_m_s: single  % # CAS calculated from groundspeed - windspeed, where windspeed is estimated based on a zero-sideslip assumption, set to NAN if invalid
  true_ground_minus_wind_m_s: single  % # TAS calculated from groundspeed - windspeed, where windspeed is estimated based on a zero-sideslip assumption, set to NAN if invalid
  airspeed_sensor_measurement_valid: boolean  % # True if data from at least one airspeed sensor is declared valid.
  selected_airspeed_index: int8  % # 1-3: airspeed sensor index, 0: groundspeed-windspeed, -1: airspeed invalid

airspeed_wind_s = Simulink.Bus()
  timestamp: uint64  % # time since system start (microseconds)
  timestamp_sample: uint64  % # the timestamp of the raw data (microseconds)
  windspeed_north: single  % # Wind component in north / X direction (m/sec)
  windspeed_east: single  % # Wind component in east / Y direction (m/sec)
  variance_north: single  % # Wind estimate error variance in north / X direction (m/sec)**2 - set to zero (no uncertainty) if not estimated
  variance_east: single  % # Wind estimate error variance in east / Y direction (m/sec)**2 - set to zero (no uncertainty) if not estimated
  tas_innov: single  % # True airspeed innovation
  tas_innov_var: single  % # True airspeed innovation variance
  tas_scale: single  % # Estimated true airspeed scale factor
  beta_innov: single  % # Sideslip measurement innovation
  beta_innov_var: single  % # Sideslip measurement innovation variance
  source: uint8  % # source of wind estimate

SOURCE_AS_BETA_ONLY = Simulink.Parameter(0, StorageClass="Const", DataType="uint8")  % # wind estimate only based on synthetic sideslip fusion
SOURCE_AS_SENSOR_1 = Simulink.Parameter(1, StorageClass="Const", DataType="uint8")  % # combined synthetic sideslip and airspeed fusion (data from first airspeed sensor)
SOURCE_AS_SENSOR_2 = Simulink.Parameter(2, StorageClass="Const", DataType="uint8")  % # combined synthetic sideslip and airspeed fusion (data from second airspeed sensor)
SOURCE_AS_SENSOR_3 = Simulink.Parameter(3, StorageClass="Const", DataType="uint8")  % # combined synthetic sideslip and airspeed fusion (data from third airspeed sensor)

AIRSPEED_WIND = enum(AddClassNameToEnumNames=true)
  SOURCE_AS_BETA_ONLY = 0  % # wind estimate only based on synthetic sideslip fusion
  SOURCE_AS_SENSOR_1 = 1  % # combined synthetic sideslip and airspeed fusion (data from first airspeed sensor)
  SOURCE_AS_SENSOR_2 = 2  % # combined synthetic sideslip and airspeed fusion (data from second airspeed sensor)
  SOURCE_AS_SENSOR_3 = 3  % # combined synthetic sideslip and airspeed fusion (data from third airspeed sensor)

battery_status_s = Simulink.Bus()
  timestamp: uint64  % # time since system start (microseconds)
  connected: boolean  % # Whether or not a battery is connected, based on a voltage threshold
  voltage_v: single  % # Battery voltage in volts, 0 if unknown
  voltage_filtered_v: single  % # Battery voltage in volts, filtered, 0 if unknown
  current_a: single  % # Battery current in amperes, -1 if unknown
  current_filtered_a: single  % # Battery current in amperes, filtered, 0 if unknown
  current_average_a: single  % # Battery current average in amperes, -1 if unknown
  discharged_mah: single  % # Discharged amount in mAh, -1 if unknown
  remaining: single  % # From 1 to 0, -1 if unknown
  scale: single  % # Power scaling factor, >= 1, or -1 if unknown
  temperature: single  % # temperature of the battery. NaN if unknown
  cell_count: int32  % # Number of cells
  source: uint8  % # Battery source
  priority: uint8  % # Zero based priority is the connection on the Power Controller V1..Vn AKA BrickN-1
  capacity: uint16  % # actual capacity of the battery
  cycle_count: uint16  % # number of discharge cycles the battery has experienced
  run_time_to_empty: uint16  % # predicted remaining battery capacity based on the present rate of discharge in min
  average_time_to_empty: uint16  % # predicted remaining battery capacity based on the average rate of discharge in min
  serial_number: uint16  % # serial number of the battery pack
  manufacture_date: uint16  % # manufacture date, part of serial number of the battery pack. formated as: Day + Month×32 + (Year–1980)×512
  state_of_health: uint16  % # state of health. FullChargeCapacity/DesignCapacity.
  max_error: uint16  % # max error, expected margin of error in % in the state-of-charge calculation with a range of 1 to 100%
  id: uint8  % # ID number of a battery. Should be unique and consistent for the lifetime of a vehicle. 1-indexed.
  interface_error: uint16  % # interface error counter
  voltage_cell_v: single[14]  % # Battery individual cell voltages
  max_cell_voltage_delta: single  % # Max difference between individual cell voltages
  is_powering_off: boolean  % # Power off event imminent indication, false if unknown
  warning: uint8  % # current battery warning
  average_power: single  % # The average power of the current discharge
  available_energy: single  % # The predicted charge or energy remaining in the battery
  remaining_capacity: single  % # The compensated battery capacity remaining
  design_capacity: single  % # The design capacity of the battery
  average_time_to_full: uint16  % # The predicted remaining time until the battery reaches full charge, in minutes
  over_discharge_count: uint16  % # Number of battery overdischarge
  nominal_voltage: single  % # Nominal voltage of the battery pack

BATTERY_SOURCE_POWER_MODULE = Simulink.Parameter(0, StorageClass="Const", DataType="uint8")
BATTERY_SOURCE_EXTERNAL = Simulink.Parameter(1, StorageClass="Const", DataType="uint8")
BATTERY_SOURCE_ESCS = Simulink.Parameter(2, StorageClass="Const", DataType="uint8")
BATTERY_WARNING_NONE = Simulink.Parameter(0, StorageClass="Const", DataType="uint8")  % # no battery low voltage warning active
BATTERY_WARNING_LOW = Simulink.Parameter(1, StorageClass="Const", DataType="uint8")  % # warning of low voltage
BATTERY_WARNING_CRITICAL = Simulink.Parameter(2, StorageClass="Const", DataType="uint8")  % # critical voltage, return / abort immediately
BATTERY_WARNING_EMERGENCY = Simulink.Parameter(3, StorageClass="Const", DataType="uint8")  % # immediate landing required
BATTERY_WARNING_FAILED = Simulink.Parameter(4, StorageClass="Const", DataType="uint8")  % # the battery has failed completely
MAX_INSTANCES = Simulink.Parameter(4, StorageClass="Const", DataType="uint8")

BATTERY_STATUS = enum(AddClassNameToEnumNames=true)
  BATTERY_SOURCE_POWER_MODULE = 0
  BATTERY_SOURCE_EXTERNAL = 1
  BATTERY_SOURCE_ESCS = 2
  BATTERY_WARNING_NONE = 0  % # no battery low voltage warning active
  BATTERY_WARNING_LOW = 1  % # warning of low voltage
  BATTERY_WARNING_CRITICAL = 2  % # critical voltage, return / abort immediately
  BATTERY_WARNING_EMERGENCY = 3  % # immediate landing required
  BATTERY_WARNING_FAILED = 4  % # the battery has failed completely
  MAX_INSTANCES = 4

camera_capture_s = Simulink.Bus()
  timestamp: uint64  % # time since system start (microseconds)
  timestamp_utc: uint64  % # Capture time in UTC / GPS time
  seq: uint32  % # Image sequence number
  lat: double  % # Latitude in degrees (WGS84)
  lon: double  % # Longitude in degrees (WGS84)
  alt: single  % # Altitude (AMSL)
  ground_distance: single  % # Altitude above ground (meters)
  q: single[4]  % # Attitude of the camera, zero rotation is facing towards front of vehicle
  result: int8  % # 1 for success, 0 for failure, -1 if camera does not provide feedback

camera_trigger_s = Simulink.Bus()
  timestamp: uint64  % # time since system start (microseconds)
  timestamp_utc: uint64  % # UTC timestamp
  seq: uint32  % # Image sequence number
  feedback: boolean  % # Trigger feedback from camera

camera_trigger_secondary_s = Simulink.Bus()
  timestamp: uint64  % # time since system start (microseconds)
  timestamp_utc: uint64  % # UTC timestamp
  seq: uint32  % # Image sequence number
  feedback: boolean  % # Trigger feedback from camera

cellular_status_s = Simulink.Bus()
  timestamp: uint64  % # time since system start (microseconds)
  status: uint16  % # Status bitmap 1: Roaming is active
  failure_reason: uint8  % #Failure reason when status in in CELLUAR_STATUS_FAILED
  type: uint8  % # Cellular network radio type 0: none 1: gsm 2: cdma 3: wcdma 4: lte
  quality: uint8  % # Cellular network RSSI/RSRP in dBm, absolute value
  mcc: uint16  % # Mobile country code. If unknown, set to: UINT16_MAX
  mnc: uint16  % # Mobile network code. If unknown, set to: UINT16_MAX
  lac: uint16  % # Location area code. If unknown, set to: 0

CELLULAR_STATUS_FLAG_UNKNOWN = Simulink.Parameter(0, StorageClass="Const", DataType="uint8")  % # State unknown or not reportable
CELLULAR_STATUS_FLAG_FAILED = Simulink.Parameter(1, StorageClass="Const", DataType="uint8")  % # velocity setpoint
CELLULAR_STATUS_FLAG_INITIALIZING = Simulink.Parameter(2, StorageClass="Const", DataType="uint8")  % # Modem is being initialized
CELLULAR_STATUS_FLAG_LOCKED = Simulink.Parameter(3, StorageClass="Const", DataType="uint8")  % # Modem is locked
CELLULAR_STATUS_FLAG_DISABLED = Simulink.Parameter(4, StorageClass="Const", DataType="uint8")  % # Modem is not enabled and is powered down
CELLULAR_STATUS_FLAG_DISABLING = Simulink.Parameter(5, StorageClass="Const", DataType="uint8")  % # Modem is currently transitioning to the CELLULAR_STATUS_FLAG_DISABLED state
CELLULAR_STATUS_FLAG_ENABLING = Simulink.Parameter(6, StorageClass="Const", DataType="uint8")  % # Modem is currently transitioning to the CELLULAR_STATUS_FLAG_ENABLED state
CELLULAR_STATUS_FLAG_ENABLED = Simulink.Parameter(7, StorageClass="Const", DataType="uint8")  % # Modem is enabled and powered on but not registered with a network provider and not available for data connections
CELLULAR_STATUS_FLAG_SEARCHING = Simulink.Parameter(8, StorageClass="Const", DataType="uint8")  % # Modem is searching for a network provider to register
CELLULAR_STATUS_FLAG_REGISTERED = Simulink.Parameter(9, StorageClass="Const", DataType="uint8")  % # Modem is registered with a network provider, and data connections and messaging may be available for use
CELLULAR_STATUS_FLAG_DISCONNECTING = Simulink.Parameter(10, StorageClass="Const", DataType="uint8")  % # Modem is disconnecting and deactivating the last active packet data bearer. This state will not be entered if more than one packet data bearer is active and one of the active bearers is deactivated
CELLULAR_STATUS_FLAG_CONNECTING = Simulink.Parameter(11, StorageClass="Const", DataType="uint8")  % # Modem is activating and connecting the first packet data bearer. Subsequent bearer activations when another bearer is already active do not cause this state to be entered
CELLULAR_STATUS_FLAG_CONNECTED = Simulink.Parameter(12, StorageClass="Const", DataType="uint8")  % # One or more packet data bearers is active and connected
CELLULAR_NETWORK_FAILED_REASON_NONE = Simulink.Parameter(0, StorageClass="Const", DataType="uint8")  % # No error
CELLULAR_NETWORK_FAILED_REASON_UNKNOWN = Simulink.Parameter(1, StorageClass="Const", DataType="uint8")  % # Error state is unknown
CELLULAR_NETWORK_FAILED_REASON_SIM_MISSING = Simulink.Parameter(2, StorageClass="Const", DataType="uint8")  % # SIM is required for the modem but missing
CELLULAR_NETWORK_FAILED_REASON_SIM_ERROR = Simulink.Parameter(3, StorageClass="Const", DataType="uint8")  % # SIM is available, but not usuable for connection

CELLULAR_STATUS = enum(AddClassNameToEnumNames=true)
  CELLULAR_STATUS_FLAG_UNKNOWN = 0  % # State unknown or not reportable
  CELLULAR_STATUS_FLAG_FAILED = 1  % # velocity setpoint
  CELLULAR_STATUS_FLAG_INITIALIZING = 2  % # Modem is being initialized
  CELLULAR_STATUS_FLAG_LOCKED = 3  % # Modem is locked
  CELLULAR_STATUS_FLAG_DISABLED = 4  % # Modem is not enabled and is powered down
  CELLULAR_STATUS_FLAG_DISABLING = 5  % # Modem is currently transitioning to the CELLULAR_STATUS_FLAG_DISABLED state
  CELLULAR_STATUS_FLAG_ENABLING = 6  % # Modem is currently transitioning to the CELLULAR_STATUS_FLAG_ENABLED state
  CELLULAR_STATUS_FLAG_ENABLED = 7  % # Modem is enabled and powered on but not registered with a network provider and not available for data connections
  CELLULAR_STATUS_FLAG_SEARCHING = 8  % # Modem is searching for a network provider to register
  CELLULAR_STATUS_FLAG_REGISTERED = 9  % # Modem is registered with a network provider, and data connections and messaging may be available for use
  CELLULAR_STATUS_FLAG_DISCONNECTING = 10  % # Modem is disconnecting and deactivating the last active packet data bearer. This state will not be entered if more than one packet data bearer is active and one of the active bearers is deactivated
  CELLULAR_STATUS_FLAG_CONNECTING = 11  % # Modem is activating and connecting the first packet data bearer. Subsequent bearer activations when another bearer is already active do not cause this state to be entered
  CELLULAR_STATUS_FLAG_CONNECTED = 12  % # One or more packet data bearers is active and connected
  CELLULAR_NETWORK_FAILED_REASON_NONE = 0  % # No error
  CELLULAR_NETWORK_FAILED_REASON_UNKNOWN = 1  % # Error state is unknown
  CELLULAR_NETWORK_FAILED_REASON_SIM_MISSING = 2  % # SIM is required for the modem but missing
  CELLULAR_NETWORK_FAILED_REASON_SIM_ERROR = 3  % # SIM is available, but not usuable for connection

collision_constraints_s = Simulink.Bus()
  timestamp: uint64  % # time since system start (microseconds)
  original_setpoint: single[2]  % # velocities demanded
  adapted_setpoint: single[2]  % # velocities allowed

collision_report_s = Simulink.Bus()
  timestamp: uint64  % # time since system start (microseconds)
  src: uint8
  id: uint32
  action: uint8
  threat_level: uint8
  time_to_minimum_delta: single
  altitude_minimum_delta: single
  horizontal_minimum_delta: single

commander_state_s = Simulink.Bus()
  timestamp: uint64  % # time since system start (microseconds)
  main_state: uint8  % # main state machine
  main_state_changes: uint16

MAIN_STATE_MANUAL = Simulink.Parameter(0, StorageClass="Const", DataType="uint8")
MAIN_STATE_ALTCTL = Simulink.Parameter(1, StorageClass="Const", DataType="uint8")
MAIN_STATE_POSCTL = Simulink.Parameter(2, StorageClass="Const", DataType="uint8")
MAIN_STATE_AUTO_MISSION = Simulink.Parameter(3, StorageClass="Const", DataType="uint8")
MAIN_STATE_AUTO_LOITER = Simulink.Parameter(4, StorageClass="Const", DataType="uint8")
MAIN_STATE_AUTO_RTL = Simulink.Parameter(5, StorageClass="Const", DataType="uint8")
MAIN_STATE_ACRO = Simulink.Parameter(6, StorageClass="Const", DataType="uint8")
MAIN_STATE_OFFBOARD = Simulink.Parameter(7, StorageClass="Const", DataType="uint8")
MAIN_STATE_STAB = Simulink.Parameter(8, StorageClass="Const", DataType="uint8")
MAIN_STATE_AUTO_TAKEOFF = Simulink.Parameter(10, StorageClass="Const", DataType="uint8")
MAIN_STATE_AUTO_LAND = Simulink.Parameter(11, StorageClass="Const", DataType="uint8")
MAIN_STATE_AUTO_FOLLOW_TARGET = Simulink.Parameter(12, StorageClass="Const", DataType="uint8")
MAIN_STATE_AUTO_PRECLAND = Simulink.Parameter(13, StorageClass="Const", DataType="uint8")
MAIN_STATE_ORBIT = Simulink.Parameter(14, StorageClass="Const", DataType="uint8")
MAIN_STATE_MAX = Simulink.Parameter(15, StorageClass="Const", DataType="uint8")

COMMANDER_STATE = enum(AddClassNameToEnumNames=true)
  MAIN_STATE_MANUAL = 0
  MAIN_STATE_ALTCTL = 1
  MAIN_STATE_POSCTL = 2
  MAIN_STATE_AUTO_MISSION = 3
  MAIN_STATE_AUTO_LOITER = 4
  MAIN_STATE_AUTO_RTL = 5
  MAIN_STATE_ACRO = 6
  MAIN_STATE_OFFBOARD = 7
  MAIN_STATE_STAB = 8
  MAIN_STATE_AUTO_TAKEOFF = 10
  MAIN_STATE_AUTO_LAND = 11
  MAIN_STATE_AUTO_FOLLOW_TARGET = 12
  MAIN_STATE_AUTO_PRECLAND = 13
  MAIN_STATE_ORBIT = 14
  MAIN_STATE_MAX = 15

control_allocator_status_s = Simulink.Bus()
  timestamp: uint64  % # time since system start (microseconds)
  torque_setpoint_achieved: boolean  % # Boolean indicating whether the 3D torque setpoint was correctly allocated to actuators. 0 if not achieved, 1 if achieved.
  allocated_torque: single[3]  % # Torque allocated to actuators. Equal to `vehicle_torque_setpoint_s::xyz` if the setpoint was achieved.
  unallocated_torque: single[3]  % # Unallocated torque. Equal to 0 if the setpoint was achieved.
  thrust_setpoint_achieved: boolean  % # Boolean indicating whether the 3D thrust setpoint was correctly allocated to actuators. 0 if not achieved, 1 if achieved.
  allocated_thrust: single[3]  % # Thrust allocated to actuators. Equal to `vehicle_thrust_setpoint_s::xyz` if the setpoint was achieved.
  unallocated_thrust: single[3]  % # Unallocated thrust. Equal to 0 if the setpoint was achieved.
  actuator_saturation: int8[16]  % # Indicates actuator saturation status.

ACTUATOR_SATURATION_OK = Simulink.Parameter(0, StorageClass="Const", DataType="int8")  % # The actuator is not saturated
ACTUATOR_SATURATION_UPPER_DYN = Simulink.Parameter(1, StorageClass="Const", DataType="int8")  % # The actuator is saturated (with a value <= the desired value) because it cannot increase its value faster
ACTUATOR_SATURATION_UPPER = Simulink.Parameter(2, StorageClass="Const", DataType="int8")  % # The actuator is saturated (with a value <= the desired value) because it has reached its maximum value
ACTUATOR_SATURATION_LOWER_DYN = Simulink.Parameter(-1, StorageClass="Const", DataType="int8")  % # The actuator is saturated (with a value >= the desired value) because it cannot decrease its value faster
ACTUATOR_SATURATION_LOWER = Simulink.Parameter(-2, StorageClass="Const", DataType="int8")  % # The actuator is saturated (with a value >= the desired value) because it has reached its minimum value

CONTROL_ALLOCATOR_STATUS = enum(AddClassNameToEnumNames=true)
  ACTUATOR_SATURATION_OK = 0  % # The actuator is not saturated
  ACTUATOR_SATURATION_UPPER_DYN = 1  % # The actuator is saturated (with a value <= the desired value) because it cannot increase its value faster
  ACTUATOR_SATURATION_UPPER = 2  % # The actuator is saturated (with a value <= the desired value) because it has reached its maximum value
  ACTUATOR_SATURATION_LOWER_DYN = -1  % # The actuator is saturated (with a value >= the desired value) because it cannot decrease its value faster
  ACTUATOR_SATURATION_LOWER = -2  % # The actuator is saturated (with a value >= the desired value) because it has reached its minimum value

cpuload_s = Simulink.Bus()
  timestamp: uint64  % # time since system start (microseconds)
  load: single  % # processor load from 0 to 1
  ram_usage: single  % # RAM usage from 0 to 1

debug_array_s = Simulink.Bus()
  timestamp: uint64  % # time since system start (microseconds)
  id: uint16  % # unique ID of debug array, used to discriminate between arrays
  name: int8[10]  % # name of the debug array (max. 10 characters)
  data: single[58]  % # data

ARRAY_SIZE = Simulink.Parameter(58, StorageClass="Const", DataType="uint8")

DEBUG_ARRAY = enum(AddClassNameToEnumNames=true)
  ARRAY_SIZE = 58

debug_key_value_s = Simulink.Bus()
  timestamp: uint64  % # time since system start (microseconds)
  key: int8[10]  % # max. 10 characters as key / name
  value: single  % # the value to send as debug output

debug_value_s = Simulink.Bus()
  timestamp: uint64  % # time since system start (microseconds)
  ind: int8  % # index of debug variable
  value: single  % # the value to send as debug output

debug_vect_s = Simulink.Bus()
  timestamp: uint64  % # time since system start (microseconds)
  name: int8[10]  % # max. 10 characters as key / name
  x: single  % # x value
  y: single  % # y value
  z: single  % # z value

differential_pressure_s = Simulink.Bus()
  timestamp: uint64  % # time since system start (microseconds)
  error_count: uint64  % # Number of errors detected by driver
  differential_pressure_raw_pa: single  % # Raw differential pressure reading (may be negative)
  differential_pressure_filtered_pa: single  % # Low pass filtered differential pressure reading
  temperature: single  % # Temperature provided by sensor, -1000.0f if unknown
  device_id: uint32  % # unique device ID for the sensor that does not change between power cycles

distance_sensor_s = Simulink.Bus()
  timestamp: uint64  % # time since system start (microseconds)
  device_id: uint32  % # unique device ID for the sensor that does not change between power cycles
  min_distance: single  % # Minimum distance the sensor can measure (in m)
  max_distance: single  % # Maximum distance the sensor can measure (in m)
  current_distance: single  % # Current distance reading (in m)
  variance: single  % # Measurement variance (in m^2), 0 for unknown / invalid readings
  signal_quality: int8  % # Signal quality in percent (0...100%), where 0 = invalid signal, 100 = perfect signal, and -1 = unknown signal quality.
  type: uint8  % # Type from MAV_DISTANCE_SENSOR enum
  h_fov: single  % # Sensor horizontal field of view (rad)
  v_fov: single  % # Sensor vertical field of view (rad)
  q: single[4]  % # Quaterion sensor orientation with respect to the vehicle body frame to specify the orientation ROTATION_CUSTOM
  orientation: uint8  % # Direction the sensor faces from MAV_SENSOR_ORIENTATION enum

ROTATION_YAW_0 = Simulink.Parameter(0, StorageClass="Const", DataType="uint8")  % # MAV_SENSOR_ROTATION_NONE
ROTATION_YAW_45 = Simulink.Parameter(1, StorageClass="Const", DataType="uint8")  % # MAV_SENSOR_ROTATION_YAW_45
ROTATION_YAW_90 = Simulink.Parameter(2, StorageClass="Const", DataType="uint8")  % # MAV_SENSOR_ROTATION_YAW_90
ROTATION_YAW_135 = Simulink.Parameter(3, StorageClass="Const", DataType="uint8")  % # MAV_SENSOR_ROTATION_YAW_135
ROTATION_YAW_180 = Simulink.Parameter(4, StorageClass="Const", DataType="uint8")  % # MAV_SENSOR_ROTATION_YAW_180
ROTATION_YAW_225 = Simulink.Parameter(5, StorageClass="Const", DataType="uint8")  % # MAV_SENSOR_ROTATION_YAW_225
ROTATION_YAW_270 = Simulink.Parameter(6, StorageClass="Const", DataType="uint8")  % # MAV_SENSOR_ROTATION_YAW_270
ROTATION_YAW_315 = Simulink.Parameter(7, StorageClass="Const", DataType="uint8")  % # MAV_SENSOR_ROTATION_YAW_315
ROTATION_FORWARD_FACING = Simulink.Parameter(0, StorageClass="Const", DataType="uint8")  % # MAV_SENSOR_ROTATION_NONE
ROTATION_RIGHT_FACING = Simulink.Parameter(2, StorageClass="Const", DataType="uint8")  % # MAV_SENSOR_ROTATION_YAW_90
ROTATION_BACKWARD_FACING = Simulink.Parameter(4, StorageClass="Const", DataType="uint8")  % # MAV_SENSOR_ROTATION_YAW_180
ROTATION_LEFT_FACING = Simulink.Parameter(6, StorageClass="Const", DataType="uint8")  % # MAV_SENSOR_ROTATION_YAW_270
ROTATION_UPWARD_FACING = Simulink.Parameter(24, StorageClass="Const", DataType="uint8")  % # MAV_SENSOR_ROTATION_PITCH_90
ROTATION_DOWNWARD_FACING = Simulink.Parameter(25, StorageClass="Const", DataType="uint8")  % # MAV_SENSOR_ROTATION_PITCH_270
ROTATION_CUSTOM = Simulink.Parameter(100, StorageClass="Const", DataType="uint8")  % # MAV_SENSOR_ROTATION_CUSTOM

DISTANCE_SENSOR = enum(AddClassNameToEnumNames=true)
  MAV_DISTANCE_SENSOR_LASER = 0
  MAV_DISTANCE_SENSOR_ULTRASOUND = 1
  MAV_DISTANCE_SENSOR_INFRARED = 2
  MAV_DISTANCE_SENSOR_RADAR = 3
  ROTATION_YAW_0 = 0  % # MAV_SENSOR_ROTATION_NONE
  ROTATION_YAW_45 = 1  % # MAV_SENSOR_ROTATION_YAW_45
  ROTATION_YAW_90 = 2  % # MAV_SENSOR_ROTATION_YAW_90
  ROTATION_YAW_135 = 3  % # MAV_SENSOR_ROTATION_YAW_135
  ROTATION_YAW_180 = 4  % # MAV_SENSOR_ROTATION_YAW_180
  ROTATION_YAW_225 = 5  % # MAV_SENSOR_ROTATION_YAW_225
  ROTATION_YAW_270 = 6  % # MAV_SENSOR_ROTATION_YAW_270
  ROTATION_YAW_315 = 7  % # MAV_SENSOR_ROTATION_YAW_315
  ROTATION_FORWARD_FACING = 0  % # MAV_SENSOR_ROTATION_NONE
  ROTATION_RIGHT_FACING = 2  % # MAV_SENSOR_ROTATION_YAW_90
  ROTATION_BACKWARD_FACING = 4  % # MAV_SENSOR_ROTATION_YAW_180
  ROTATION_LEFT_FACING = 6  % # MAV_SENSOR_ROTATION_YAW_270
  ROTATION_UPWARD_FACING = 24  % # MAV_SENSOR_ROTATION_PITCH_90
  ROTATION_DOWNWARD_FACING = 25  % # MAV_SENSOR_ROTATION_PITCH_270
  ROTATION_CUSTOM = 100  % # MAV_SENSOR_ROTATION_CUSTOM

ekf2_timestamps_s = Simulink.Bus()
  timestamp: uint64  % # time since system start (microseconds)
  airspeed_timestamp_rel: int16
  distance_sensor_timestamp_rel: int16
  optical_flow_timestamp_rel: int16
  vehicle_air_data_timestamp_rel: int16
  vehicle_magnetometer_timestamp_rel: int16
  visual_odometry_timestamp_rel: int16

RELATIVE_TIMESTAMP_INVALID = Simulink.Parameter(2147483647, StorageClass="Const", DataType="int32")  % # (0x7fffffff) If one of the relative timestamps is set to this value, it means the associated sensor values are invalid

EKF2_TIMESTAMPS = enum(AddClassNameToEnumNames=true)
  RELATIVE_TIMESTAMP_INVALID = 32767  % # (0x7fff) If one of the relative timestamps

ekf_gps_drift_s = Simulink.Bus()
  timestamp: uint64  % # time since system start (microseconds)
  hpos_drift_rate: single  % # Horizontal position rate magnitude checked using EKF2_REQ_HDRIFT (m/s)
  vpos_drift_rate: single  % # Vertical position rate magnitude checked using EKF2_REQ_VDRIFT (m/s)
  hspd: single  % # Filtered horizontal velocity magnitude checked using EKF2_REQ_HDRIFT (m/s)
  blocked: boolean  % # true when drift calculation is blocked due to IMU movement check controlled by EKF2_MOVE_TEST

esc_report_s = Simulink.Bus()
  timestamp: uint64  % # time since system start (microseconds)
  esc_errorcount: uint32  % # Number of reported errors by ESC - if supported
  esc_rpm: int32  % # Motor RPM, negative for reverse rotation [RPM] - if supported
  esc_voltage: single  % # Voltage measured from current ESC [V] - if supported
  esc_current: single  % # Current measured from current ESC [A] - if supported
  esc_temperature: uint8  % # Temperature measured from current ESC [degC] - if supported
  esc_address: uint8  % # Address of current ESC (in most cases 1-8 / must be set by driver)
  esc_state: uint8  % # State of ESC - depend on Vendor
  failures: uint8  % # Bitmask to indicate the internal ESC faults

FAILURE_NONE = Simulink.Parameter(0, StorageClass="Const", DataType="uint8")
FAILURE_OVER_CURRENT_MASK = Simulink.Parameter(1, StorageClass="Const", DataType="uint8")  % # (1 << 0)
FAILURE_OVER_VOLTAGE_MASK = Simulink.Parameter(2, StorageClass="Const", DataType="uint8")  % # (1 << 1)
FAILURE_OVER_TEMPERATURE_MASK = Simulink.Parameter(4, StorageClass="Const", DataType="uint8")  % # (1 << 2)
FAILURE_OVER_RPM_MASK = Simulink.Parameter(8, StorageClass="Const", DataType="uint8")  % # (1 << 3)
FAILURE_INCONSISTENT_CMD_MASK = Simulink.Parameter(16, StorageClass="Const", DataType="uint8")  % # (1 << 4)  Set if ESC received an inconsistent command (i.e out of boundaries)
FAILURE_MOTOR_STUCK_MASK = Simulink.Parameter(32, StorageClass="Const", DataType="uint8")  % # (1 << 5)
FAILURE_GENERIC_MASK = Simulink.Parameter(64, StorageClass="Const", DataType="uint8")  % # (1 << 6)

ESC_REPORT = enum(AddClassNameToEnumNames=true)
  FAILURE_NONE = 0
  FAILURE_OVER_CURRENT_MASK = 1  % # (1 << 0)
  FAILURE_OVER_VOLTAGE_MASK = 2  % # (1 << 1)
  FAILURE_OVER_TEMPERATURE_MASK = 4  % # (1 << 2)
  FAILURE_OVER_RPM_MASK = 8  % # (1 << 3)
  FAILURE_INCONSISTENT_CMD_MASK = 16  % # (1 << 4)  Set if ESC received an inconsistent command (i.e out of boundaries)
  FAILURE_MOTOR_STUCK_MASK = 32  % # (1 << 5)
  FAILURE_GENERIC_MASK = 64  % # (1 << 6)

esc_status_s = Simulink.Bus()
  timestamp: uint64  % # time since system start (microseconds)
  counter: uint16  % # incremented by the writing thread everytime new data is stored
  esc_count: uint8  % # number of connected ESCs
  esc_connectiontype: uint8  % # how ESCs connected to the system
  esc_online_flags: uint8  % # Bitmask indicating which ESC is online/offline
  esc_armed_flags: uint8  % # Bitmask indicating which ESC is armed. For ESC's where the arming state is not known (returned by the ESC), the arming bits should always be set.
  esc: esc_report[8]

CONNECTED_ESC_MAX = Simulink.Parameter(8, StorageClass="Const", DataType="uint8")  % # The number of ESCs supported. Current (Q2/2013) we support 8 ESCs
ESC_CONNECTION_TYPE_PPM = Simulink.Parameter(0, StorageClass="Const", DataType="uint8")  % # Traditional PPM ESC
ESC_CONNECTION_TYPE_SERIAL = Simulink.Parameter(1, StorageClass="Const", DataType="uint8")  % # Serial Bus connected ESC
ESC_CONNECTION_TYPE_ONESHOT = Simulink.Parameter(2, StorageClass="Const", DataType="uint8")  % # One Shot PPM
ESC_CONNECTION_TYPE_I2C = Simulink.Parameter(3, StorageClass="Const", DataType="uint8")  % # I2C
ESC_CONNECTION_TYPE_CAN = Simulink.Parameter(4, StorageClass="Const", DataType="uint8")  % # CAN-Bus
ESC_CONNECTION_TYPE_DSHOT = Simulink.Parameter(5, StorageClass="Const", DataType="uint8")  % # DShot

ESC_STATUS = enum(AddClassNameToEnumNames=true)
  CONNECTED_ESC_MAX = 8  % # The number of ESCs supported. Current (Q2/2013) we support 8 ESCs
  ESC_CONNECTION_TYPE_PPM = 0  % # Traditional PPM ESC
  ESC_CONNECTION_TYPE_SERIAL = 1  % # Serial Bus connected ESC
  ESC_CONNECTION_TYPE_ONESHOT = 2  % # One Shot PPM
  ESC_CONNECTION_TYPE_I2C = 3  % # I2C
  ESC_CONNECTION_TYPE_CAN = 4  % # CAN-Bus
  ESC_CONNECTION_TYPE_DSHOT = 5  % # DShot

estimator_event_flags_s = Simulink.Bus()
  timestamp: uint64  % # time since system start (microseconds)
  timestamp_sample: uint64  % # the timestamp of the raw data (microseconds)
  information_event_changes: uint32  % # number of information event changes
  gps_checks_passed: boolean  % #  0 - true when gps quality checks are passing passed
  reset_vel_to_gps: boolean  % #  1 - true when the velocity states are reset to the gps measurement
  reset_vel_to_flow: boolean  % #  2 - true when the velocity states are reset using the optical flow measurement
  reset_vel_to_vision: boolean  % #  3 - true when the velocity states are reset to the vision system measurement
  reset_vel_to_zero: boolean  % #  4 - true when the velocity states are reset to zero
  reset_pos_to_last_known: boolean  % #  5 - true when the position states are reset to the last known position
  reset_pos_to_gps: boolean  % #  6 - true when the position states are reset to the gps measurement
  reset_pos_to_vision: boolean  % #  7 - true when the position states are reset to the vision system measurement
  starting_gps_fusion: boolean  % #  8 - true when the filter starts using gps measurements to correct the state estimates
  starting_vision_pos_fusion: boolean  % #  9 - true when the filter starts using vision system position measurements to correct the state estimates
  starting_vision_vel_fusion: boolean  % # 10 - true when the filter starts using vision system velocity measurements to correct the state estimates
  starting_vision_yaw_fusion: boolean  % # 11 - true when the filter starts using vision system yaw  measurements to correct the state estimates
  yaw_aligned_to_imu_gps: boolean  % # 12 - true when the filter resets the yaw to an estimate derived from IMU and GPS data
  warning_event_changes: uint32  % # number of warning event changes
  gps_quality_poor: boolean  % #  0 - true when the gps is failing quality checks
  gps_fusion_timout: boolean  % #  1 - true when the gps data has not been used to correct the state estimates for a significant time period
  gps_data_stopped: boolean  % #  2 - true when the gps data has stopped for a significant time period
  gps_data_stopped_using_alternate: boolean  % #  3 - true when the gps data has stopped for a significant time period but the filter is able to use other sources of data to maintain navigation
  height_sensor_timeout: boolean  % #  4 - true when the height sensor has not been used to correct the state estimates for a significant time period
  stopping_navigation: boolean  % #  5 - true when the filter has insufficient data to estimate velocity and position and is falling back to an attitude, height and height rate mode of operation
  invalid_accel_bias_cov_reset: boolean  % #  6 - true when the filter has detected bad acceerometer bias state esitmstes and has reset the corresponding covariance matrix elements
  bad_yaw_using_gps_course: boolean  % #  7 - true when the fiter has detected an invalid yaw esitmate and has reset the yaw angle to the GPS ground course
  stopping_mag_use: boolean  % #  8 - true when the filter has detected bad magnetometer data and is stopping further use of the magnetomer data
  vision_data_stopped: boolean  % #  9 - true when the vision system data has stopped for a significant time period
  emergency_yaw_reset_mag_stopped: boolean  % # 10 - true when the filter has detected bad magnetometer data, has reset the yaw to anothter source of data and has stopped further use of the magnetomer data

estimator_innovations_s = Simulink.Bus()
  timestamp: uint64  % # time since system start (microseconds)
  timestamp_sample: uint64  % # the timestamp of the raw data (microseconds)
  gps_hvel: single[2]  % # horizontal GPS velocity innovation (m/sec) and innovation variance ((m/sec)**2)
  gps_vvel: single  % # vertical GPS velocity innovation (m/sec) and innovation variance ((m/sec)**2)
  gps_hpos: single[2]  % # horizontal GPS position innovation (m) and innovation variance (m**2)
  gps_vpos: single  % # vertical GPS position innovation (m) and innovation variance (m**2)
  ev_hvel: single[2]  % # horizontal external vision velocity innovation (m/sec) and innovation variance ((m/sec)**2)
  ev_vvel: single  % # vertical external vision velocity innovation (m/sec) and innovation variance ((m/sec)**2)
  ev_hpos: single[2]  % # horizontal external vision position innovation (m) and innovation variance (m**2)
  ev_vpos: single  % # vertical external vision position innovation (m) and innovation variance (m**2)
  rng_vpos: single  % # range sensor height innovation (m) and innovation variance (m**2)
  baro_vpos: single  % # barometer height innovation (m) and innovation variance (m**2)
  aux_hvel: single[2]  % # horizontal auxiliar velocity innovation from landing target measurement (m/sec) and innovation variance ((m/sec)**2)
  aux_vvel: single  % # vertical auxiliar velocity innovation from landing target measurement (m/sec) and innovation variance ((m/sec)**2)
  flow: single[2]  % # flow innvoation (rad/sec) and innovation variance ((rad/sec)**2)
  heading: single  % # heading innovation (rad) and innovation variance (rad**2)
  mag_field: single[3]  % # earth magnetic field innovation (Gauss) and innovation variance (Gauss**2)
  drag: single[2]  % # drag specific force innovation (m/sec**2) and innovation variance ((m/sec)**2)
  airspeed: single  % # airspeed innovation (m/sec) and innovation variance ((m/sec)**2)
  beta: single  % # synthetic sideslip innovation (rad) and innovation variance (rad**2)
  hagl: single  % # height of ground innovation (m) and innovation variance (m**2)

estimator_innovation_variances_s = Simulink.Bus()
  timestamp: uint64  % # time since system start (microseconds)
  timestamp_sample: uint64  % # the timestamp of the raw data (microseconds)
  gps_hvel: single[2]  % # horizontal GPS velocity innovation (m/sec) and innovation variance ((m/sec)**2)
  gps_vvel: single  % # vertical GPS velocity innovation (m/sec) and innovation variance ((m/sec)**2)
  gps_hpos: single[2]  % # horizontal GPS position innovation (m) and innovation variance (m**2)
  gps_vpos: single  % # vertical GPS position innovation (m) and innovation variance (m**2)
  ev_hvel: single[2]  % # horizontal external vision velocity innovation (m/sec) and innovation variance ((m/sec)**2)
  ev_vvel: single  % # vertical external vision velocity innovation (m/sec) and innovation variance ((m/sec)**2)
  ev_hpos: single[2]  % # horizontal external vision position innovation (m) and innovation variance (m**2)
  ev_vpos: single  % # vertical external vision position innovation (m) and innovation variance (m**2)
  rng_vpos: single  % # range sensor height innovation (m) and innovation variance (m**2)
  baro_vpos: single  % # barometer height innovation (m) and innovation variance (m**2)
  aux_hvel: single[2]  % # horizontal auxiliar velocity innovation from landing target measurement (m/sec) and innovation variance ((m/sec)**2)
  aux_vvel: single  % # vertical auxiliar velocity innovation from landing target measurement (m/sec) and innovation variance ((m/sec)**2)
  flow: single[2]  % # flow innvoation (rad/sec) and innovation variance ((rad/sec)**2)
  heading: single  % # heading innovation (rad) and innovation variance (rad**2)
  mag_field: single[3]  % # earth magnetic field innovation (Gauss) and innovation variance (Gauss**2)
  drag: single[2]  % # drag specific force innovation (m/sec**2) and innovation variance ((m/sec)**2)
  airspeed: single  % # airspeed innovation (m/sec) and innovation variance ((m/sec)**2)
  beta: single  % # synthetic sideslip innovation (rad) and innovation variance (rad**2)
  hagl: single  % # height of ground innovation (m) and innovation variance (m**2)

estimator_innovation_test_ratios_s = Simulink.Bus()
  timestamp: uint64  % # time since system start (microseconds)
  timestamp_sample: uint64  % # the timestamp of the raw data (microseconds)
  gps_hvel: single[2]  % # horizontal GPS velocity innovation (m/sec) and innovation variance ((m/sec)**2)
  gps_vvel: single  % # vertical GPS velocity innovation (m/sec) and innovation variance ((m/sec)**2)
  gps_hpos: single[2]  % # horizontal GPS position innovation (m) and innovation variance (m**2)
  gps_vpos: single  % # vertical GPS position innovation (m) and innovation variance (m**2)
  ev_hvel: single[2]  % # horizontal external vision velocity innovation (m/sec) and innovation variance ((m/sec)**2)
  ev_vvel: single  % # vertical external vision velocity innovation (m/sec) and innovation variance ((m/sec)**2)
  ev_hpos: single[2]  % # horizontal external vision position innovation (m) and innovation variance (m**2)
  ev_vpos: single  % # vertical external vision position innovation (m) and innovation variance (m**2)
  rng_vpos: single  % # range sensor height innovation (m) and innovation variance (m**2)
  baro_vpos: single  % # barometer height innovation (m) and innovation variance (m**2)
  aux_hvel: single[2]  % # horizontal auxiliar velocity innovation from landing target measurement (m/sec) and innovation variance ((m/sec)**2)
  aux_vvel: single  % # vertical auxiliar velocity innovation from landing target measurement (m/sec) and innovation variance ((m/sec)**2)
  flow: single[2]  % # flow innvoation (rad/sec) and innovation variance ((rad/sec)**2)
  heading: single  % # heading innovation (rad) and innovation variance (rad**2)
  mag_field: single[3]  % # earth magnetic field innovation (Gauss) and innovation variance (Gauss**2)
  drag: single[2]  % # drag specific force innovation (m/sec**2) and innovation variance ((m/sec)**2)
  airspeed: single  % # airspeed innovation (m/sec) and innovation variance ((m/sec)**2)
  beta: single  % # synthetic sideslip innovation (rad) and innovation variance (rad**2)
  hagl: single  % # height of ground innovation (m) and innovation variance (m**2)

estimator_optical_flow_vel_s = Simulink.Bus()
  timestamp: uint64  % # time since system start (microseconds)
  timestamp_sample: uint64  % # the timestamp of the raw data (microseconds)
  vel_body: single[2]  % # velocity obtained from gyro-compensated and distance-scaled optical flow raw measurements in body frame(m/s)
  vel_ne: single[2]  % # same as vel_body but in local frame (m/s)
  flow_uncompensated_integral: single[2]  % # integrated optical flow measurement (rad)
  flow_compensated_integral: single[2]  % # integrated optical flow measurement compensated for angular motion (rad)
  gyro_rate_integral: single[3]  % # gyro measurement integrated to flow rate and synchronized with flow measurements (rad)

estimator_selector_status_s = Simulink.Bus()
  timestamp: uint64  % # time since system start (microseconds)
  primary_instance: uint8
  instances_available: uint8
  instance_changed_count: uint32
  last_instance_change: uint64
  accel_device_id: uint32
  baro_device_id: uint32
  gyro_device_id: uint32
  mag_device_id: uint32
  combined_test_ratio: single[9]
  relative_test_ratio: single[9]
  healthy: boolean[9]
  accumulated_gyro_error: single[4]
  accumulated_accel_error: single[4]
  gyro_fault_detected: boolean
  accel_fault_detected: boolean

estimator_sensor_bias_s = Simulink.Bus()
  timestamp: uint64  % # time since system start (microseconds)
  timestamp_sample: uint64  % # the timestamp of the raw data (microseconds)
  gyro_device_id: uint32  % # unique device ID for the sensor that does not change between power cycles
  gyro_bias: single[3]  % # gyroscope in-run bias in body frame (rad/s)
  gyro_bias_limit: single  % # magnitude of maximum gyroscope in-run bias in body frame (rad/s)
  gyro_bias_variance: single[3]
  gyro_bias_valid: boolean
  accel_device_id: uint32  % # unique device ID for the sensor that does not change between power cycles
  accel_bias: single[3]  % # accelerometer in-run bias in body frame (m/s^2)
  accel_bias_limit: single  % # magnitude of maximum accelerometer in-run bias in body frame (m/s^2)
  accel_bias_variance: single[3]
  accel_bias_valid: boolean
  mag_device_id: uint32  % # unique device ID for the sensor that does not change between power cycles
  mag_bias: single[3]  % # magnetometer in-run bias in body frame (Gauss)
  mag_bias_limit: single  % # magnitude of maximum magnetometer in-run bias in body frame (Gauss)
  mag_bias_variance: single[3]
  mag_bias_valid: boolean

estimator_states_s = Simulink.Bus()
  timestamp: uint64  % # time since system start (microseconds)
  timestamp_sample: uint64  % # the timestamp of the raw data (microseconds)
  states: single[24]  % # Internal filter states
  n_states: uint8  % # Number of states effectively used
  covariances: single[24]  % # Diagonal Elements of Covariance Matrix

estimator_status_s = Simulink.Bus()
  timestamp: uint64  % # time since system start (microseconds)
  timestamp_sample: uint64  % # the timestamp of the raw data (microseconds)
  vibe: single[3]  % # IMU vibration metrics in the following array locations
  output_tracking_error: single[3]  % # return a vector containing the output predictor angular, velocity and position tracking error magnitudes (rad), (m/s), (m)
  gps_check_fail_flags: uint16  % # Bitmask to indicate status of GPS checks - see definition below
  control_mode_flags: uint32  % # Bitmask to indicate EKF logic state
  filter_fault_flags: uint32  % # Bitmask to indicate EKF internal faults
  pos_horiz_accuracy: single  % # 1-Sigma estimated horizontal position accuracy relative to the estimators origin (m)
  pos_vert_accuracy: single  % # 1-Sigma estimated vertical position accuracy relative to the estimators origin (m)
  innovation_check_flags: uint16  % # Bitmask to indicate pass/fail status of innovation consistency checks
  mag_test_ratio: single  % # ratio of the largest magnetometer innovation component to the innovation test limit
  vel_test_ratio: single  % # ratio of the largest velocity innovation component to the innovation test limit
  pos_test_ratio: single  % # ratio of the largest horizontal position innovation component to the innovation test limit
  hgt_test_ratio: single  % # ratio of the vertical position innovation to the innovation test limit
  tas_test_ratio: single  % # ratio of the true airspeed innovation to the innovation test limit
  hagl_test_ratio: single  % # ratio of the height above ground innovation to the innovation test limit
  beta_test_ratio: single  % # ratio of the synthetic sideslip innovation to the innovation test limit
  solution_status_flags: uint16  % # Bitmask indicating which filter kinematic state outputs are valid for flight control use.
  reset_count_vel_ne: uint8  % # number of horizontal position reset events (allow to wrap if count exceeds 255)
  reset_count_vel_d: uint8  % # number of vertical velocity reset events (allow to wrap if count exceeds 255)
  reset_count_pos_ne: uint8  % # number of horizontal position reset events (allow to wrap if count exceeds 255)
  reset_count_pod_d: uint8  % # number of vertical position reset events (allow to wrap if count exceeds 255)
  reset_count_quat: uint8  % # number of quaternion reset events (allow to wrap if count exceeds 255)
  time_slip: single  % # cumulative amount of time in seconds that the EKF inertial calculation has slipped relative to system time
  pre_flt_fail_innov_heading: boolean
  pre_flt_fail_innov_vel_horiz: boolean
  pre_flt_fail_innov_vel_vert: boolean
  pre_flt_fail_innov_height: boolean
  pre_flt_fail_mag_field_disturbed: boolean
  accel_device_id: uint32
  gyro_device_id: uint32
  baro_device_id: uint32
  mag_device_id: uint32
  health_flags: uint8  % # Bitmask to indicate sensor health states (vel, pos, hgt)
  timeout_flags: uint8  % # Bitmask to indicate timeout flags (vel, pos, hgt)

GPS_CHECK_FAIL_GPS_FIX = Simulink.Parameter(0, StorageClass="Const", DataType="uint8")  % # 0 : insufficient fix type (no 3D solution)
GPS_CHECK_FAIL_MIN_SAT_COUNT = Simulink.Parameter(1, StorageClass="Const", DataType="uint8")  % # 1 : minimum required sat count fail
GPS_CHECK_FAIL_MAX_PDOP = Simulink.Parameter(2, StorageClass="Const", DataType="uint8")  % # 2 : maximum allowed PDOP fail
GPS_CHECK_FAIL_MAX_HORZ_ERR = Simulink.Parameter(3, StorageClass="Const", DataType="uint8")  % # 3 : maximum allowed horizontal position error fail
GPS_CHECK_FAIL_MAX_VERT_ERR = Simulink.Parameter(4, StorageClass="Const", DataType="uint8")  % # 4 : maximum allowed vertical position error fail
GPS_CHECK_FAIL_MAX_SPD_ERR = Simulink.Parameter(5, StorageClass="Const", DataType="uint8")  % # 5 : maximum allowed speed error fail
GPS_CHECK_FAIL_MAX_HORZ_DRIFT = Simulink.Parameter(6, StorageClass="Const", DataType="uint8")  % # 6 : maximum allowed horizontal position drift fail - requires stationary vehicle
GPS_CHECK_FAIL_MAX_VERT_DRIFT = Simulink.Parameter(7, StorageClass="Const", DataType="uint8")  % # 7 : maximum allowed vertical position drift fail - requires stationary vehicle
GPS_CHECK_FAIL_MAX_HORZ_SPD_ERR = Simulink.Parameter(8, StorageClass="Const", DataType="uint8")  % # 8 : maximum allowed horizontal speed fail - requires stationary vehicle
GPS_CHECK_FAIL_MAX_VERT_SPD_ERR = Simulink.Parameter(9, StorageClass="Const", DataType="uint8")  % # 9 : maximum allowed vertical velocity discrepancy fail
CS_TILT_ALIGN = Simulink.Parameter(0, StorageClass="Const", DataType="uint8")  % # 0 - true if the filter tilt alignment is complete
CS_YAW_ALIGN = Simulink.Parameter(1, StorageClass="Const", DataType="uint8")  % # 1 - true if the filter yaw alignment is complete
CS_GPS = Simulink.Parameter(2, StorageClass="Const", DataType="uint8")  % # 2 - true if GPS measurements are being fused
CS_OPT_FLOW = Simulink.Parameter(3, StorageClass="Const", DataType="uint8")  % # 3 - true if optical flow measurements are being fused
CS_MAG_HDG = Simulink.Parameter(4, StorageClass="Const", DataType="uint8")  % # 4 - true if a simple magnetic yaw heading is being fused
CS_MAG_3D = Simulink.Parameter(5, StorageClass="Const", DataType="uint8")  % # 5 - true if 3-axis magnetometer measurement are being fused
CS_MAG_DEC = Simulink.Parameter(6, StorageClass="Const", DataType="uint8")  % # 6 - true if synthetic magnetic declination measurements are being fused
CS_IN_AIR = Simulink.Parameter(7, StorageClass="Const", DataType="uint8")  % # 7 - true when thought to be airborne
CS_WIND = Simulink.Parameter(8, StorageClass="Const", DataType="uint8")  % # 8 - true when wind velocity is being estimated
CS_BARO_HGT = Simulink.Parameter(9, StorageClass="Const", DataType="uint8")  % # 9 - true when baro height is being fused as a primary height reference
CS_RNG_HGT = Simulink.Parameter(10, StorageClass="Const", DataType="uint8")  % # 10 - true when range finder height is being fused as a primary height reference
CS_GPS_HGT = Simulink.Parameter(11, StorageClass="Const", DataType="uint8")  % # 11 - true when GPS height is being fused as a primary height reference
CS_EV_POS = Simulink.Parameter(12, StorageClass="Const", DataType="uint8")  % # 12 - true when local position data from external vision is being fused
CS_EV_YAW = Simulink.Parameter(13, StorageClass="Const", DataType="uint8")  % # 13 - true when yaw data from external vision measurements is being fused
CS_EV_HGT = Simulink.Parameter(14, StorageClass="Const", DataType="uint8")  % # 14 - true when height data from external vision measurements is being fused
CS_BETA = Simulink.Parameter(15, StorageClass="Const", DataType="uint8")  % # 15 - true when synthetic sideslip measurements are being fused
CS_MAG_FIELD = Simulink.Parameter(16, StorageClass="Const", DataType="uint8")  % # 16 - true when only the magnetic field states are updated by the magnetometer
CS_FIXED_WING = Simulink.Parameter(17, StorageClass="Const", DataType="uint8")  % # 17 - true when thought to be operating as a fixed wing vehicle with constrained sideslip
CS_MAG_FAULT = Simulink.Parameter(18, StorageClass="Const", DataType="uint8")  % # 18 - true when the magnetomer has been declared faulty and is no longer being used
CS_ASPD = Simulink.Parameter(19, StorageClass="Const", DataType="uint8")  % # 19 - true when airspeed measurements are being fused
CS_GND_EFFECT = Simulink.Parameter(20, StorageClass="Const", DataType="uint8")  % # 20 - true when when protection from ground effect induced static pressure rise is active
CS_RNG_STUCK = Simulink.Parameter(21, StorageClass="Const", DataType="uint8")  % # 21 - true when a stuck range finder sensor has been detected
CS_GPS_YAW = Simulink.Parameter(22, StorageClass="Const", DataType="uint8")  % # 22 - true when yaw (not ground course) data from a GPS receiver is being fused
CS_MAG_ALIGNED = Simulink.Parameter(23, StorageClass="Const", DataType="uint8")  % # 23 - true when the in-flight mag field alignment has been completed

ESTIMATOR_STATUS = enum(AddClassNameToEnumNames=true)
  GPS_CHECK_FAIL_GPS_FIX = 0  % # 0 : insufficient fix type (no 3D solution)
  GPS_CHECK_FAIL_MIN_SAT_COUNT = 1  % # 1 : minimum required sat count fail
  GPS_CHECK_FAIL_MAX_PDOP = 2  % # 2 : maximum allowed PDOP fail
  GPS_CHECK_FAIL_MAX_HORZ_ERR = 3  % # 3 : maximum allowed horizontal position error fail
  GPS_CHECK_FAIL_MAX_VERT_ERR = 4  % # 4 : maximum allowed vertical position error fail
  GPS_CHECK_FAIL_MAX_SPD_ERR = 5  % # 5 : maximum allowed speed error fail
  GPS_CHECK_FAIL_MAX_HORZ_DRIFT = 6  % # 6 : maximum allowed horizontal position drift fail - requires stationary vehicle
  GPS_CHECK_FAIL_MAX_VERT_DRIFT = 7  % # 7 : maximum allowed vertical position drift fail - requires stationary vehicle
  GPS_CHECK_FAIL_MAX_HORZ_SPD_ERR = 8  % # 8 : maximum allowed horizontal speed fail - requires stationary vehicle
  GPS_CHECK_FAIL_MAX_VERT_SPD_ERR = 9  % # 9 : maximum allowed vertical velocity discrepancy fail
  CS_TILT_ALIGN = 0  % # 0 - true if the filter tilt alignment is complete
  CS_YAW_ALIGN = 1  % # 1 - true if the filter yaw alignment is complete
  CS_GPS = 2  % # 2 - true if GPS measurements are being fused
  CS_OPT_FLOW = 3  % # 3 - true if optical flow measurements are being fused
  CS_MAG_HDG = 4  % # 4 - true if a simple magnetic yaw heading is being fused
  CS_MAG_3D = 5  % # 5 - true if 3-axis magnetometer measurement are being fused
  CS_MAG_DEC = 6  % # 6 - true if synthetic magnetic declination measurements are being fused
  CS_IN_AIR = 7  % # 7 - true when thought to be airborne
  CS_WIND = 8  % # 8 - true when wind velocity is being estimated
  CS_BARO_HGT = 9  % # 9 - true when baro height is being fused as a primary height reference
  CS_RNG_HGT = 10  % # 10 - true when range finder height is being fused as a primary height reference
  CS_GPS_HGT = 11  % # 11 - true when GPS height is being fused as a primary height reference
  CS_EV_POS = 12  % # 12 - true when local position data from external vision is being fused
  CS_EV_YAW = 13  % # 13 - true when yaw data from external vision measurements is being fused
  CS_EV_HGT = 14  % # 14 - true when height data from external vision measurements is being fused
  CS_BETA = 15  % # 15 - true when synthetic sideslip measurements are being fused
  CS_MAG_FIELD = 16  % # 16 - true when only the magnetic field states are updated by the magnetometer
  CS_FIXED_WING = 17  % # 17 - true when thought to be operating as a fixed wing vehicle with constrained sideslip
  CS_MAG_FAULT = 18  % # 18 - true when the magnetomer has been declared faulty and is no longer being used
  CS_ASPD = 19  % # 19 - true when airspeed measurements are being fused
  CS_GND_EFFECT = 20  % # 20 - true when when protection from ground effect induced static pressure rise is active
  CS_RNG_STUCK = 21  % # 21 - true when a stuck range finder sensor has been detected
  CS_GPS_YAW = 22  % # 22 - true when yaw (not ground course) data from a GPS receiver is being fused
  CS_MAG_ALIGNED = 23  % # 23 - true when the in-flight mag field alignment has been completed

estimator_status_flags_s = Simulink.Bus()
  timestamp: uint64  % # time since system start (microseconds)
  timestamp_sample: uint64  % # the timestamp of the raw data (microseconds)
  control_status_changes: uint32  % # number of filter control status (cs) changes
  cs_tilt_align: boolean  % #  0 - true if the filter tilt alignment is complete
  cs_yaw_align: boolean  % #  1 - true if the filter yaw alignment is complete
  cs_gps: boolean  % #  2 - true if GPS measurement fusion is intended
  cs_opt_flow: boolean  % #  3 - true if optical flow measurements fusion is intended
  cs_mag_hdg: boolean  % #  4 - true if a simple magnetic yaw heading fusion is intended
  cs_mag_3d: boolean  % #  5 - true if 3-axis magnetometer measurement fusion is inteded
  cs_mag_dec: boolean  % #  6 - true if synthetic magnetic declination measurements fusion is intended
  cs_in_air: boolean  % #  7 - true when the vehicle is airborne
  cs_wind: boolean  % #  8 - true when wind velocity is being estimated
  cs_baro_hgt: boolean  % #  9 - true when baro height is being fused as a primary height reference
  cs_rng_hgt: boolean  % # 10 - true when range finder height is being fused as a primary height reference
  cs_gps_hgt: boolean  % # 11 - true when GPS height is being fused as a primary height reference
  cs_ev_pos: boolean  % # 12 - true when local position data fusion from external vision is intended
  cs_ev_yaw: boolean  % # 13 - true when yaw data from external vision measurements fusion is intended
  cs_ev_hgt: boolean  % # 14 - true when height data from external vision measurements is being fused
  cs_fuse_beta: boolean  % # 15 - true when synthetic sideslip measurements are being fused
  cs_mag_field_disturbed: boolean  % # 16 - true when the mag field does not match the expected strength
  cs_fixed_wing: boolean  % # 17 - true when the vehicle is operating as a fixed wing vehicle
  cs_mag_fault: boolean  % # 18 - true when the magnetometer has been declared faulty and is no longer being used
  cs_fuse_aspd: boolean  % # 19 - true when airspeed measurements are being fused
  cs_gnd_effect: boolean  % # 20 - true when protection from ground effect induced static pressure rise is active
  cs_rng_stuck: boolean  % # 21 - true when rng data wasn't ready for more than 10s and new rng values haven't changed enough
  cs_gps_yaw: boolean  % # 22 - true when yaw (not ground course) data fusion from a GPS receiver is intended
  cs_mag_aligned_in_flight: boolean  % # 23 - true when the in-flight mag field alignment has been completed
  cs_ev_vel: boolean  % # 24 - true when local frame velocity data fusion from external vision measurements is intended
  cs_synthetic_mag_z: boolean  % # 25 - true when we are using a synthesized measurement for the magnetometer Z component
  cs_vehicle_at_rest: boolean  % # 26 - true when the vehicle is at rest
  fault_status_changes: uint32  % # number of filter fault status (fs) changes
  fs_bad_mag_x: boolean  % #  0 - true if the fusion of the magnetometer X-axis has encountered a numerical error
  fs_bad_mag_y: boolean  % #  1 - true if the fusion of the magnetometer Y-axis has encountered a numerical error
  fs_bad_mag_z: boolean  % #  2 - true if the fusion of the magnetometer Z-axis has encountered a numerical error
  fs_bad_hdg: boolean  % #  3 - true if the fusion of the heading angle has encountered a numerical error
  fs_bad_mag_decl: boolean  % #  4 - true if the fusion of the magnetic declination has encountered a numerical error
  fs_bad_airspeed: boolean  % #  5 - true if fusion of the airspeed has encountered a numerical error
  fs_bad_sideslip: boolean  % #  6 - true if fusion of the synthetic sideslip constraint has encountered a numerical error
  fs_bad_optflow_x: boolean  % #  7 - true if fusion of the optical flow X axis has encountered a numerical error
  fs_bad_optflow_y: boolean  % #  8 - true if fusion of the optical flow Y axis has encountered a numerical error
  fs_bad_vel_n: boolean  % #  9 - true if fusion of the North velocity has encountered a numerical error
  fs_bad_vel_e: boolean  % # 10 - true if fusion of the East velocity has encountered a numerical error
  fs_bad_vel_d: boolean  % # 11 - true if fusion of the Down velocity has encountered a numerical error
  fs_bad_pos_n: boolean  % # 12 - true if fusion of the North position has encountered a numerical error
  fs_bad_pos_e: boolean  % # 13 - true if fusion of the East position has encountered a numerical error
  fs_bad_pos_d: boolean  % # 14 - true if fusion of the Down position has encountered a numerical error
  fs_bad_acc_bias: boolean  % # 15 - true if bad delta velocity bias estimates have been detected
  fs_bad_acc_vertical: boolean  % # 16 - true if bad vertical accelerometer data has been detected
  fs_bad_acc_clipping: boolean  % # 17 - true if delta velocity data contains clipping (asymmetric railing)
  innovation_fault_status_changes: uint32  % # number of innovation fault status (reject) changes
  reject_hor_vel: boolean  % #  0 - true if horizontal velocity observations have been rejected
  reject_ver_vel: boolean  % #  1 - true if vertical velocity observations have been rejected
  reject_hor_pos: boolean  % #  2 - true if horizontal position observations have been rejected
  reject_ver_pos: boolean  % #  3 - true if vertical position observations have been rejected
  reject_mag_x: boolean  % #  4 - true if the X magnetometer observation has been rejected
  reject_mag_y: boolean  % #  5 - true if the Y magnetometer observation has been rejected
  reject_mag_z: boolean  % #  6 - true if the Z magnetometer observation has been rejected
  reject_yaw: boolean  % #  7 - true if the yaw observation has been rejected
  reject_airspeed: boolean  % #  8 - true if the airspeed observation has been rejected
  reject_sideslip: boolean  % #  9 - true if the synthetic sideslip observation has been rejected
  reject_hagl: boolean  % # 10 - true if the height above ground observation has been rejected
  reject_optflow_x: boolean  % # 11 - true if the X optical flow observation has been rejected
  reject_optflow_y: boolean  % # 12 - true if the Y optical flow observation has been rejected

follow_target_s = Simulink.Bus()
  timestamp: uint64  % # time since system start (microseconds)
  lat: double  % # target position (deg * 1e7)
  lon: double  % # target position (deg * 1e7)
  alt: single  % # target position
  vy: single  % # target vel in y
  vx: single  % # target vel in x
  vz: single  % # target vel in z
  est_cap: uint8  % # target reporting capabilities

generator_status_s = Simulink.Bus()
  timestamp: uint64  % # time since system start (microseconds)
  status: uint64  % # Status flags
  battery_current: single  % # [A] Current into/out of battery. Positive for out. Negative for in. NaN: field not provided.
  load_current: single  % # [A] Current going to the UAV. If battery current not available this is the DC current from the generator. Positive for out. Negative for in. NaN: field not provided
  power_generated: single  % # [W] The power being generated. NaN: field not provided
  bus_voltage: single  % # [V] Voltage of the bus seen at the generator, or battery bus if battery bus is controlled by generator and at a different voltage to main bus.
  bat_current_setpoint: single  % # [A] The target battery current. Positive for out. Negative for in. NaN: field not provided
  runtime: uint32  % # [s] Seconds this generator has run since it was rebooted. UINT32_MAX: field not provided.
  time_until_maintenance: int32  % # [s] Seconds until this generator requires maintenance.  A negative value indicates maintenance is past-due. INT32_MAX: field not provided.
  generator_speed: uint16  % # [rpm] Speed of electrical generator or alternator. UINT16_MAX: field not provided.
  rectifier_temperature: int16  % # [degC] The temperature of the rectifier or power converter. INT16_MAX: field not provided.
  generator_temperature: int16  % # [degC] The temperature of the mechanical motor, fuel cell core or generator. INT16_MAX: field not provided.

STATUS_FLAG_OFF = Simulink.Parameter(1, StorageClass="Const", DataType="uint64")  % # Generator is off.
STATUS_FLAG_READY = Simulink.Parameter(2, StorageClass="Const", DataType="uint64")  % # Generator is ready to start generating power.
STATUS_FLAG_GENERATING = Simulink.Parameter(4, StorageClass="Const", DataType="uint64")  % # Generator is generating power.
STATUS_FLAG_CHARGING = Simulink.Parameter(8, StorageClass="Const", DataType="uint64")  % # Generator is charging the batteries (generating enough power to charge and provide the load).
STATUS_FLAG_REDUCED_POWER = Simulink.Parameter(16, StorageClass="Const", DataType="uint64")  % # Generator is operating at a reduced maximum power.
STATUS_FLAG_MAXPOWER = Simulink.Parameter(32, StorageClass="Const", DataType="uint64")  % # Generator is providing the maximum output.
STATUS_FLAG_OVERTEMP_WARNING = Simulink.Parameter(64, StorageClass="Const", DataType="uint64")  % # Generator is near the maximum operating temperature, cooling is insufficient.
STATUS_FLAG_OVERTEMP_FAULT = Simulink.Parameter(128, StorageClass="Const", DataType="uint64")  % # Generator hit the maximum operating temperature and shutdown.
STATUS_FLAG_ELECTRONICS_OVERTEMP_WARNING = Simulink.Parameter(256, StorageClass="Const", DataType="uint64")  % # Power electronics are near the maximum operating temperature, cooling is insufficient.
STATUS_FLAG_ELECTRONICS_OVERTEMP_FAULT = Simulink.Parameter(512, StorageClass="Const", DataType="uint64")  % # Power electronics hit the maximum operating temperature and shutdown.
STATUS_FLAG_ELECTRONICS_FAULT = Simulink.Parameter(1024, StorageClass="Const", DataType="uint64")  % # Power electronics experienced a fault and shutdown.
STATUS_FLAG_POWERSOURCE_FAULT = Simulink.Parameter(2048, StorageClass="Const", DataType="uint64")  % # The power source supplying the generator failed e.g. mechanical generator stopped, tether is no longer providing power, solar cell is in shade, hydrogen reaction no longer happening.
STATUS_FLAG_COMMUNICATION_WARNING = Simulink.Parameter(4096, StorageClass="Const", DataType="uint64")  % # Generator controller having communication problems.
STATUS_FLAG_COOLING_WARNING = Simulink.Parameter(8192, StorageClass="Const", DataType="uint64")  % # Power electronic or generator cooling system error.
STATUS_FLAG_POWER_RAIL_FAULT = Simulink.Parameter(16384, StorageClass="Const", DataType="uint64")  % # Generator controller power rail experienced a fault.
STATUS_FLAG_OVERCURRENT_FAULT = Simulink.Parameter(32768, StorageClass="Const", DataType="uint64")  % # Generator controller exceeded the overcurrent threshold and shutdown to prevent damage.
STATUS_FLAG_BATTERY_OVERCHARGE_CURRENT_FAULT = Simulink.Parameter(65536, StorageClass="Const", DataType="uint64")  % # Generator controller detected a high current going into the batteries and shutdown to prevent battery damage. |
STATUS_FLAG_OVERVOLTAGE_FAULT = Simulink.Parameter(131072, StorageClass="Const", DataType="uint64")  % # Generator controller exceeded it's overvoltage threshold and shutdown to prevent it exceeding the voltage rating.
STATUS_FLAG_BATTERY_UNDERVOLT_FAULT = Simulink.Parameter(262144, StorageClass="Const", DataType="uint64")  % # Batteries are under voltage (generator will not start).
STATUS_FLAG_START_INHIBITED = Simulink.Parameter(524288, StorageClass="Const", DataType="uint64")  % # Generator start is inhibited by e.g. a safety switch.
STATUS_FLAG_MAINTENANCE_REQUIRED = Simulink.Parameter(1048576, StorageClass="Const", DataType="uint64")  % # Generator requires maintenance.
STATUS_FLAG_WARMING_UP = Simulink.Parameter(2097152, StorageClass="Const", DataType="uint64")  % # Generator is not ready to generate yet.
STATUS_FLAG_IDLE = Simulink.Parameter(4194304, StorageClass="Const", DataType="uint64")  % # Generator is idle.

GENERATOR_STATUS = enum(AddClassNameToEnumNames=true)
  STATUS_FLAG_OFF = 1  % # Generator is off.
  STATUS_FLAG_READY = 2  % # Generator is ready to start generating power.
  STATUS_FLAG_GENERATING = 4  % # Generator is generating power.
  STATUS_FLAG_CHARGING = 8  % # Generator is charging the batteries (generating enough power to charge and provide the load).
  STATUS_FLAG_REDUCED_POWER = 16  % # Generator is operating at a reduced maximum power.
  STATUS_FLAG_MAXPOWER = 32  % # Generator is providing the maximum output.
  STATUS_FLAG_OVERTEMP_WARNING = 64  % # Generator is near the maximum operating temperature, cooling is insufficient.
  STATUS_FLAG_OVERTEMP_FAULT = 128  % # Generator hit the maximum operating temperature and shutdown.
  STATUS_FLAG_ELECTRONICS_OVERTEMP_WARNING = 256  % # Power electronics are near the maximum operating temperature, cooling is insufficient.
  STATUS_FLAG_ELECTRONICS_OVERTEMP_FAULT = 512  % # Power electronics hit the maximum operating temperature and shutdown.
  STATUS_FLAG_ELECTRONICS_FAULT = 1024  % # Power electronics experienced a fault and shutdown.
  STATUS_FLAG_POWERSOURCE_FAULT = 2048  % # The power source supplying the generator failed e.g. mechanical generator stopped, tether is no longer providing power, solar cell is in shade, hydrogen reaction no longer happening.
  STATUS_FLAG_COMMUNICATION_WARNING = 4096  % # Generator controller having communication problems.
  STATUS_FLAG_COOLING_WARNING = 8192  % # Power electronic or generator cooling system error.
  STATUS_FLAG_POWER_RAIL_FAULT = 16384  % # Generator controller power rail experienced a fault.
  STATUS_FLAG_OVERCURRENT_FAULT = 32768  % # Generator controller exceeded the overcurrent threshold and shutdown to prevent damage.
  STATUS_FLAG_BATTERY_OVERCHARGE_CURRENT_FAULT = 65536  % # Generator controller detected a high current going into the batteries and shutdown to prevent battery damage. |
  STATUS_FLAG_OVERVOLTAGE_FAULT = 131072  % # Generator controller exceeded it's overvoltage threshold and shutdown to prevent it exceeding the voltage rating.
  STATUS_FLAG_BATTERY_UNDERVOLT_FAULT = 262144  % # Batteries are under voltage (generator will not start).
  STATUS_FLAG_START_INHIBITED = 524288  % # Generator start is inhibited by e.g. a safety switch.
  STATUS_FLAG_MAINTENANCE_REQUIRED = 1048576  % # Generator requires maintenance.
  STATUS_FLAG_WARMING_UP = 2097152  % # Generator is not ready to generate yet.
  STATUS_FLAG_IDLE = 4194304  % # Generator is idle.

geofence_result_s = Simulink.Bus()
  timestamp: uint64  % # time since system start (microseconds)
  geofence_violated: boolean  % # true if the geofence is violated
  geofence_action: uint8  % # action to take when geofence is violated
  home_required: boolean  % # true if the geofence requires a valid home position

GF_ACTION_NONE = Simulink.Parameter(0, StorageClass="Const", DataType="uint8")  % # no action on geofence violation
GF_ACTION_WARN = Simulink.Parameter(1, StorageClass="Const", DataType="uint8")  % # critical mavlink message
GF_ACTION_LOITER = Simulink.Parameter(2, StorageClass="Const", DataType="uint8")  % # switch to AUTO|LOITER
GF_ACTION_RTL = Simulink.Parameter(3, StorageClass="Const", DataType="uint8")  % # switch to AUTO|RTL
GF_ACTION_TERMINATE = Simulink.Parameter(4, StorageClass="Const", DataType="uint8")  % # flight termination
GF_ACTION_LAND = Simulink.Parameter(5, StorageClass="Const", DataType="uint8")  % # switch to AUTO|LAND

GEOFENCE_RESULT = enum(AddClassNameToEnumNames=true)
  GF_ACTION_NONE = 0  % # no action on geofence violation
  GF_ACTION_WARN = 1  % # critical mavlink message
  GF_ACTION_LOITER = 2  % # switch to AUTO|LOITER
  GF_ACTION_RTL = 3  % # switch to AUTO|RTL
  GF_ACTION_TERMINATE = 4  % # flight termination
  GF_ACTION_LAND = 5  % # switch to AUTO|LAND

gimbal_device_attitude_status_s = Simulink.Bus()
  timestamp: uint64  % # time since system start (microseconds)
  target_system: uint8
  target_component: uint8
  device_flags: uint16
  q: single[4]
  angular_velocity_x: single
  angular_velocity_y: single
  angular_velocity_z: single
  failure_flags: uint32

DEVICE_FLAGS_RETRACT = Simulink.Parameter(1, StorageClass="Const", DataType="uint16")
DEVICE_FLAGS_NEUTRAL = Simulink.Parameter(2, StorageClass="Const", DataType="uint16")
DEVICE_FLAGS_ROLL_LOCK = Simulink.Parameter(4, StorageClass="Const", DataType="uint16")
DEVICE_FLAGS_PITCH_LOCK = Simulink.Parameter(8, StorageClass="Const", DataType="uint16")
DEVICE_FLAGS_YAW_LOCK = Simulink.Parameter(16, StorageClass="Const", DataType="uint16")

GIMBAL_DEVICE_ATTITUDE_STATUS = enum(AddClassNameToEnumNames=true)
  DEVICE_FLAGS_RETRACT = 1
  DEVICE_FLAGS_NEUTRAL = 2
  DEVICE_FLAGS_ROLL_LOCK = 4
  DEVICE_FLAGS_PITCH_LOCK = 8
  DEVICE_FLAGS_YAW_LOCK = 16

gimbal_device_information_s = Simulink.Bus()
  timestamp: uint64  % # time since system start (microseconds)
  vendor_name: uint8[32]
  model_name: uint8[32]
  custom_name: uint8[32]
  firmware_version: uint32
  hardware_version: uint32
  uid: uint64
  cap_flags: uint16
  custom_cap_flags: uint16
  roll_min: single  % # [rad]
  roll_max: single  % # [rad]
  pitch_min: single  % # [rad]
  pitch_max: single  % # [rad]
  yaw_min: single  % # [rad]
  yaw_max: single  % # [rad]
  gimbal_device_compid: uint8

GIMBAL_DEVICE_CAP_FLAGS_HAS_RETRACT = Simulink.Parameter(1, StorageClass="Const", DataType="uint32")
GIMBAL_DEVICE_CAP_FLAGS_HAS_NEUTRAL = Simulink.Parameter(2, StorageClass="Const", DataType="uint32")
GIMBAL_DEVICE_CAP_FLAGS_HAS_ROLL_AXIS = Simulink.Parameter(4, StorageClass="Const", DataType="uint32")
GIMBAL_DEVICE_CAP_FLAGS_HAS_ROLL_FOLLOW = Simulink.Parameter(8, StorageClass="Const", DataType="uint32")
GIMBAL_DEVICE_CAP_FLAGS_HAS_ROLL_LOCK = Simulink.Parameter(16, StorageClass="Const", DataType="uint32")
GIMBAL_DEVICE_CAP_FLAGS_HAS_PITCH_AXIS = Simulink.Parameter(32, StorageClass="Const", DataType="uint32")
GIMBAL_DEVICE_CAP_FLAGS_HAS_PITCH_FOLLOW = Simulink.Parameter(64, StorageClass="Const", DataType="uint32")
GIMBAL_DEVICE_CAP_FLAGS_HAS_PITCH_LOCK = Simulink.Parameter(128, StorageClass="Const", DataType="uint32")
GIMBAL_DEVICE_CAP_FLAGS_HAS_YAW_AXIS = Simulink.Parameter(256, StorageClass="Const", DataType="uint32")
GIMBAL_DEVICE_CAP_FLAGS_HAS_YAW_FOLLOW = Simulink.Parameter(512, StorageClass="Const", DataType="uint32")
GIMBAL_DEVICE_CAP_FLAGS_HAS_YAW_LOCK = Simulink.Parameter(1024, StorageClass="Const", DataType="uint32")
GIMBAL_DEVICE_CAP_FLAGS_SUPPORTS_INFINITE_YAW = Simulink.Parameter(2048, StorageClass="Const", DataType="uint32")

GIMBAL_DEVICE_INFORMATION = enum(AddClassNameToEnumNames=true)
  GIMBAL_DEVICE_CAP_FLAGS_HAS_RETRACT = 1
  GIMBAL_DEVICE_CAP_FLAGS_HAS_NEUTRAL = 2
  GIMBAL_DEVICE_CAP_FLAGS_HAS_ROLL_AXIS = 4
  GIMBAL_DEVICE_CAP_FLAGS_HAS_ROLL_FOLLOW = 8
  GIMBAL_DEVICE_CAP_FLAGS_HAS_ROLL_LOCK = 16
  GIMBAL_DEVICE_CAP_FLAGS_HAS_PITCH_AXIS = 32
  GIMBAL_DEVICE_CAP_FLAGS_HAS_PITCH_FOLLOW = 64
  GIMBAL_DEVICE_CAP_FLAGS_HAS_PITCH_LOCK = 128
  GIMBAL_DEVICE_CAP_FLAGS_HAS_YAW_AXIS = 256
  GIMBAL_DEVICE_CAP_FLAGS_HAS_YAW_FOLLOW = 512
  GIMBAL_DEVICE_CAP_FLAGS_HAS_YAW_LOCK = 1024
  GIMBAL_DEVICE_CAP_FLAGS_SUPPORTS_INFINITE_YAW = 2048

gimbal_device_set_attitude_s = Simulink.Bus()
  timestamp: uint64  % # time since system start (microseconds)
  target_system: uint8
  target_component: uint8
  flags: uint16
  q: single[4]
  angular_velocity_x: single
  angular_velocity_y: single
  angular_velocity_z: single

GIMBAL_DEVICE_FLAGS_RETRACT = Simulink.Parameter(1, StorageClass="Const", DataType="uint32")
GIMBAL_DEVICE_FLAGS_NEUTRAL = Simulink.Parameter(2, StorageClass="Const", DataType="uint32")
GIMBAL_DEVICE_FLAGS_ROLL_LOCK = Simulink.Parameter(4, StorageClass="Const", DataType="uint32")
GIMBAL_DEVICE_FLAGS_PITCH_LOCK = Simulink.Parameter(8, StorageClass="Const", DataType="uint32")
GIMBAL_DEVICE_FLAGS_YAW_LOCK = Simulink.Parameter(16, StorageClass="Const", DataType="uint32")

GIMBAL_DEVICE_SET_ATTITUDE = enum(AddClassNameToEnumNames=true)
  GIMBAL_DEVICE_FLAGS_RETRACT = 1
  GIMBAL_DEVICE_FLAGS_NEUTRAL = 2
  GIMBAL_DEVICE_FLAGS_ROLL_LOCK = 4
  GIMBAL_DEVICE_FLAGS_PITCH_LOCK = 8
  GIMBAL_DEVICE_FLAGS_YAW_LOCK = 16

gimbal_manager_information_s = Simulink.Bus()
  timestamp: uint64  % # time since system start (microseconds)
  cap_flags: uint32
  gimbal_device_id: uint8
  roll_min: single  % # [rad]
  roll_max: single  % # [rad]
  pitch_min: single  % # [rad]
  pitch_max: single  % # [rad]
  yaw_min: single  % # [rad]
  yaw_max: single  % # [rad]

GIMBAL_MANAGER_CAP_FLAGS_HAS_RETRACT = Simulink.Parameter(1, StorageClass="Const", DataType="uint32")
GIMBAL_MANAGER_CAP_FLAGS_HAS_NEUTRAL = Simulink.Parameter(2, StorageClass="Const", DataType="uint32")
GIMBAL_MANAGER_CAP_FLAGS_HAS_ROLL_AXIS = Simulink.Parameter(4, StorageClass="Const", DataType="uint32")
GIMBAL_MANAGER_CAP_FLAGS_HAS_ROLL_FOLLOW = Simulink.Parameter(8, StorageClass="Const", DataType="uint32")
GIMBAL_MANAGER_CAP_FLAGS_HAS_ROLL_LOCK = Simulink.Parameter(16, StorageClass="Const", DataType="uint32")
GIMBAL_MANAGER_CAP_FLAGS_HAS_PITCH_AXIS = Simulink.Parameter(32, StorageClass="Const", DataType="uint32")
GIMBAL_MANAGER_CAP_FLAGS_HAS_PITCH_FOLLOW = Simulink.Parameter(64, StorageClass="Const", DataType="uint32")
GIMBAL_MANAGER_CAP_FLAGS_HAS_PITCH_LOCK = Simulink.Parameter(128, StorageClass="Const", DataType="uint32")
GIMBAL_MANAGER_CAP_FLAGS_HAS_YAW_AXIS = Simulink.Parameter(256, StorageClass="Const", DataType="uint32")
GIMBAL_MANAGER_CAP_FLAGS_HAS_YAW_FOLLOW = Simulink.Parameter(512, StorageClass="Const", DataType="uint32")
GIMBAL_MANAGER_CAP_FLAGS_HAS_YAW_LOCK = Simulink.Parameter(1024, StorageClass="Const", DataType="uint32")
GIMBAL_MANAGER_CAP_FLAGS_SUPPORTS_INFINITE_YAW = Simulink.Parameter(2048, StorageClass="Const", DataType="uint32")
GIMBAL_MANAGER_CAP_FLAGS_CAN_POINT_LOCATION_LOCAL = Simulink.Parameter(65536, StorageClass="Const", DataType="uint32")
GIMBAL_MANAGER_CAP_FLAGS_CAN_POINT_LOCATION_GLOBAL = Simulink.Parameter(131072, StorageClass="Const", DataType="uint32")

GIMBAL_MANAGER_INFORMATION = enum(AddClassNameToEnumNames=true)
  GIMBAL_MANAGER_CAP_FLAGS_HAS_RETRACT = 1
  GIMBAL_MANAGER_CAP_FLAGS_HAS_NEUTRAL = 2
  GIMBAL_MANAGER_CAP_FLAGS_HAS_ROLL_AXIS = 4
  GIMBAL_MANAGER_CAP_FLAGS_HAS_ROLL_FOLLOW = 8
  GIMBAL_MANAGER_CAP_FLAGS_HAS_ROLL_LOCK = 16
  GIMBAL_MANAGER_CAP_FLAGS_HAS_PITCH_AXIS = 32
  GIMBAL_MANAGER_CAP_FLAGS_HAS_PITCH_FOLLOW = 64
  GIMBAL_MANAGER_CAP_FLAGS_HAS_PITCH_LOCK = 128
  GIMBAL_MANAGER_CAP_FLAGS_HAS_YAW_AXIS = 256
  GIMBAL_MANAGER_CAP_FLAGS_HAS_YAW_FOLLOW = 512
  GIMBAL_MANAGER_CAP_FLAGS_HAS_YAW_LOCK = 1024
  GIMBAL_MANAGER_CAP_FLAGS_SUPPORTS_INFINITE_YAW = 2048
  GIMBAL_MANAGER_CAP_FLAGS_CAN_POINT_LOCATION_LOCAL = 65536
  GIMBAL_MANAGER_CAP_FLAGS_CAN_POINT_LOCATION_GLOBAL = 131072

gimbal_manager_set_attitude_s = Simulink.Bus()
  timestamp: uint64  % # time since system start (microseconds)
  origin_sysid: uint8
  origin_compid: uint8
  target_system: uint8
  target_component: uint8
  flags: uint32
  gimbal_device_id: uint8
  q: single[4]
  angular_velocity_x: single
  angular_velocity_y: single
  angular_velocity_z: single

GIMBAL_MANAGER_FLAGS_RETRACT = Simulink.Parameter(1, StorageClass="Const", DataType="uint32")
GIMBAL_MANAGER_FLAGS_NEUTRAL = Simulink.Parameter(2, StorageClass="Const", DataType="uint32")
GIMBAL_MANAGER_FLAGS_ROLL_LOCK = Simulink.Parameter(4, StorageClass="Const", DataType="uint32")
GIMBAL_MANAGER_FLAGS_PITCH_LOCK = Simulink.Parameter(8, StorageClass="Const", DataType="uint32")
GIMBAL_MANAGER_FLAGS_YAW_LOCK = Simulink.Parameter(16, StorageClass="Const", DataType="uint32")

GIMBAL_MANAGER_SET_ATTITUDE = enum(AddClassNameToEnumNames=true)
  GIMBAL_MANAGER_FLAGS_RETRACT = 1
  GIMBAL_MANAGER_FLAGS_NEUTRAL = 2
  GIMBAL_MANAGER_FLAGS_ROLL_LOCK = 4
  GIMBAL_MANAGER_FLAGS_PITCH_LOCK = 8
  GIMBAL_MANAGER_FLAGS_YAW_LOCK = 16

gimbal_manager_set_manual_control_s = Simulink.Bus()
  timestamp: uint64  % # time since system start (microseconds)
  origin_sysid: uint8
  origin_compid: uint8
  target_system: uint8
  target_component: uint8
  flags: uint32
  gimbal_device_id: uint8
  pitch: single  % # unitless -1..1, can be NAN
  yaw: single  % # unitless -1..1, can be NAN
  pitch_rate: single  % # unitless -1..1, can be NAN
  yaw_rate: single  % # unitless -1..1, can be NAN

GIMBAL_MANAGER_SET_MANUAL_CONTROL = enum(AddClassNameToEnumNames=true)
  GIMBAL_MANAGER_FLAGS_RETRACT = 1
  GIMBAL_MANAGER_FLAGS_NEUTRAL = 2
  GIMBAL_MANAGER_FLAGS_ROLL_LOCK = 4
  GIMBAL_MANAGER_FLAGS_PITCH_LOCK = 8
  GIMBAL_MANAGER_FLAGS_YAW_LOCK = 16

gimbal_manager_status_s = Simulink.Bus()
  timestamp: uint64  % # time since system start (microseconds)
  flags: uint32
  gimbal_device_id: uint8
  primary_control_sysid: uint8
  primary_control_compid: uint8
  secondary_control_sysid: uint8
  secondary_control_compid: uint8

gps_dump_s = Simulink.Bus()
  timestamp: uint64  % # time since system start (microseconds)
  instance: uint8  % # Instance of GNSS reciever
  len: uint8  % # length of data, MSB bit set = message to the gps device,
  data: uint8[79]  % # data to write to the log

ORB_QUEUE_LENGTH = Simulink.Parameter(4, StorageClass="Const", DataType="uint8")

GPS_DUMP = enum(AddClassNameToEnumNames=true)
  ORB_QUEUE_LENGTH = 8

gps_inject_data_s = Simulink.Bus()
  timestamp: uint64  % # time since system start (microseconds)
  len: uint8  % # length of data
  flags: uint8  % # LSB: 1=fragmented
  data: uint8[182]  % # data to write to GPS device (RTCM message)

GPS_INJECT_DATA = enum(AddClassNameToEnumNames=true)
  ORB_QUEUE_LENGTH = 8

heater_status_s = Simulink.Bus()
  timestamp: uint64  % # time since system start (microseconds)
  device_id: uint32
  heater_on: boolean
  temperature_target_met: boolean
  temperature_sensor: single
  temperature_target: single
  controller_period_usec: uint32
  controller_time_on_usec: uint32
  proportional_value: single
  integrator_value: single
  feed_forward_value: single
  mode: uint8

MODE_GPIO = Simulink.Parameter(1, StorageClass="Const", DataType="uint8")
MODE_PX4IO = Simulink.Parameter(2, StorageClass="Const", DataType="uint8")

HEATER_STATUS = enum(AddClassNameToEnumNames=true)
  MODE_GPIO = 1
  MODE_PX4IO = 2

home_position_s = Simulink.Bus()
  timestamp: uint64  % # time since system start (microseconds)
  lat: double  % # Latitude in degrees
  lon: double  % # Longitude in degrees
  alt: single  % # Altitude in meters (AMSL)
  x: single  % # X coordinate in meters
  y: single  % # Y coordinate in meters
  z: single  % # Z coordinate in meters
  yaw: single  % # Yaw angle in radians
  valid_alt: boolean  % # true when the altitude has been set
  valid_hpos: boolean  % # true when the latitude and longitude have been set
  valid_lpos: boolean  % # true when the local position (xyz) has been set
  manual_home: boolean  % # true when home position was set manually

hover_thrust_estimate_s = Simulink.Bus()
  timestamp: uint64  % # time since system start (microseconds)
  timestamp_sample: uint64  % # time of corresponding sensor data last used for this estimate
  hover_thrust: single  % # estimated hover thrust [0.1, 0.9]
  hover_thrust_var: single  % # estimated hover thrust variance
  accel_innov: single  % # innovation of the last acceleration fusion
  accel_innov_var: single  % # innovation variance of the last acceleration fusion
  accel_innov_test_ratio: single  % # normalized innovation squared test ratio
  accel_noise_var: single  % # vertical acceleration noise variance estimated form innovation residual
  valid: boolean

input_rc_s = Simulink.Bus()
  timestamp: uint64  % # time since system start (microseconds)
  timestamp_last_signal: uint64  % # last valid reception time
  channel_count: uint8  % # number of channels actually being seen
  rssi: int32  % # receive signal strength indicator (RSSI): < 0: Undefined, 0: no signal, 100: full reception
  rc_failsafe: boolean  % # explicit failsafe flag: true on TX failure or TX out of range , false otherwise. Only the true state is reliable, as there are some (PPM) receivers on the market going into failsafe without telling us explicitly.
  rc_lost: boolean  % # RC receiver connection status: True,if no frame has arrived in the expected time, false otherwise. True usually means that the receiver has been disconnected, but can also indicate a radio link loss on "stupid" systems. Will remain false, if a RX with failsafe option continues to transmit frames after a link loss.
  rc_lost_frame_count: uint16  % # Number of lost RC frames. Note: intended purpose: observe the radio link quality if RSSI is not available. This value must not be used to trigger any failsafe-alike funtionality.
  rc_total_frame_count: uint16  % # Number of total RC frames. Note: intended purpose: observe the radio link quality if RSSI is not available. This value must not be used to trigger any failsafe-alike funtionality.
  rc_ppm_frame_length: uint16  % # Length of a single PPM frame. Zero for non-PPM systems
  input_source: uint8  % # Input source
  values: uint16[18]  % # measured pulse widths for each of the supported channels

RC_INPUT_SOURCE_UNKNOWN = Simulink.Parameter(0, StorageClass="Const", DataType="uint8")
RC_INPUT_SOURCE_PX4FMU_PPM = Simulink.Parameter(1, StorageClass="Const", DataType="uint8")
RC_INPUT_SOURCE_PX4IO_PPM = Simulink.Parameter(2, StorageClass="Const", DataType="uint8")
RC_INPUT_SOURCE_PX4IO_SPEKTRUM = Simulink.Parameter(3, StorageClass="Const", DataType="uint8")
RC_INPUT_SOURCE_PX4IO_SBUS = Simulink.Parameter(4, StorageClass="Const", DataType="uint8")
RC_INPUT_SOURCE_PX4IO_ST24 = Simulink.Parameter(5, StorageClass="Const", DataType="uint8")
RC_INPUT_SOURCE_MAVLINK = Simulink.Parameter(6, StorageClass="Const", DataType="uint8")
RC_INPUT_SOURCE_QURT = Simulink.Parameter(7, StorageClass="Const", DataType="uint8")
RC_INPUT_SOURCE_PX4FMU_SPEKTRUM = Simulink.Parameter(8, StorageClass="Const", DataType="uint8")
RC_INPUT_SOURCE_PX4FMU_SBUS = Simulink.Parameter(9, StorageClass="Const", DataType="uint8")
RC_INPUT_SOURCE_PX4FMU_ST24 = Simulink.Parameter(10, StorageClass="Const", DataType="uint8")
RC_INPUT_SOURCE_PX4FMU_SUMD = Simulink.Parameter(11, StorageClass="Const", DataType="uint8")
RC_INPUT_SOURCE_PX4FMU_DSM = Simulink.Parameter(12, StorageClass="Const", DataType="uint8")
RC_INPUT_SOURCE_PX4IO_SUMD = Simulink.Parameter(13, StorageClass="Const", DataType="uint8")
RC_INPUT_SOURCE_PX4FMU_CRSF = Simulink.Parameter(14, StorageClass="Const", DataType="uint8")
RC_INPUT_SOURCE_PX4FMU_GHST = Simulink.Parameter(15, StorageClass="Const", DataType="uint8")
RC_INPUT_MAX_CHANNELS = Simulink.Parameter(18, StorageClass="Const", DataType="uint8")  % # Maximum number of R/C input channels in the system. S.Bus has up to 18 channels.

INPUT_RC = enum(AddClassNameToEnumNames=true)
  RC_INPUT_SOURCE_UNKNOWN = 0
  RC_INPUT_SOURCE_PX4FMU_PPM = 1
  RC_INPUT_SOURCE_PX4IO_PPM = 2
  RC_INPUT_SOURCE_PX4IO_SPEKTRUM = 3
  RC_INPUT_SOURCE_PX4IO_SBUS = 4
  RC_INPUT_SOURCE_PX4IO_ST24 = 5
  RC_INPUT_SOURCE_MAVLINK = 6
  RC_INPUT_SOURCE_QURT = 7
  RC_INPUT_SOURCE_PX4FMU_SPEKTRUM = 8
  RC_INPUT_SOURCE_PX4FMU_SBUS = 9
  RC_INPUT_SOURCE_PX4FMU_ST24 = 10
  RC_INPUT_SOURCE_PX4FMU_SUMD = 11
  RC_INPUT_SOURCE_PX4FMU_DSM = 12
  RC_INPUT_SOURCE_PX4IO_SUMD = 13
  RC_INPUT_SOURCE_PX4FMU_CRSF = 14
  RC_INPUT_SOURCE_PX4FMU_GHST = 15
  RC_INPUT_MAX_CHANNELS = 18  % # Maximum number of R/C input channels in the system. S.Bus has up to 18 channels.

iridiumsbd_status_s = Simulink.Bus()
  timestamp: uint64  % # time since system start (microseconds)
  last_heartbeat: uint64  % # timestamp of the last successful sbd session
  tx_buf_write_index: uint16  % # current size of the tx buffer
  rx_buf_read_index: uint16  % # the rx buffer is parsed up to that index
  rx_buf_end_index: uint16  % # current size of the rx buffer
  failed_sbd_sessions: uint16  % # number of failed sbd sessions
  successful_sbd_sessions: uint16  % # number of successfull sbd sessions
  num_tx_buf_reset: uint16  % # number of times the tx buffer was reset
  signal_quality: uint8  % # current signal quality, 0 is no signal, 5 the best
  state: uint8  % # current state of the driver, see the satcom_state of IridiumSBD.h for the definition
  ring_pending: boolean  % # indicates if a ring call is pending
  tx_buf_write_pending: boolean  % # indicates if a tx buffer write is pending
  tx_session_pending: boolean  % # indicates if a tx session is pending
  rx_read_pending: boolean  % # indicates if a rx read is pending
  rx_session_pending: boolean  % # indicates if a rx session is pending

irlock_report_s = Simulink.Bus()
  timestamp: uint64  % # time since system start (microseconds)
  signature: uint16
  pos_x: single  % # tan(theta), where theta is the angle between the target and the camera center of projection in camera x-axis
  pos_y: single  % # tan(theta), where theta is the angle between the target and the camera center of projection in camera y-axis
  size_x: single  % #/** size of target along camera x-axis in units of tan(theta) **/
  size_y: single  % #/** size of target along camera y-axis in units of tan(theta) **/

landing_gear_s = Simulink.Bus()
  timestamp: uint64  % # time since system start (microseconds)
  landing_gear: int8

GEAR_UP = Simulink.Parameter(1, StorageClass="Const", DataType="int8")  % # landing gear up
GEAR_DOWN = Simulink.Parameter(-1, StorageClass="Const", DataType="int8")  % # landing gear down
GEAR_KEEP = Simulink.Parameter(0, StorageClass="Const", DataType="int8")  % # keep the current state

LANDING_GEAR = enum(AddClassNameToEnumNames=true)
  GEAR_UP = 1  % # landing gear up
  GEAR_DOWN = -1  % # landing gear down
  GEAR_KEEP = 0  % # keep the current state

landing_target_innovations_s = Simulink.Bus()
  timestamp: uint64  % # time since system start (microseconds)
  innov_x: single
  innov_y: single
  innov_cov_x: single
  innov_cov_y: single

landing_target_pose_s = Simulink.Bus()
  timestamp: uint64  % # time since system start (microseconds)
  is_static: boolean  % # Flag indicating whether the landing target is static or moving with respect to the ground
  rel_pos_valid: boolean  % # Flag showing whether relative position is valid
  rel_vel_valid: boolean  % # Flag showing whether relative velocity is valid
  x_rel: single  % # X/north position of target, relative to vehicle (navigation frame) [meters]
  y_rel: single  % # Y/east position of target, relative to vehicle (navigation frame) [meters]
  z_rel: single  % # Z/down position of target, relative to vehicle (navigation frame) [meters]
  vx_rel: single  % # X/north velocity  of target, relative to vehicle (navigation frame) [meters/second]
  vy_rel: single  % # Y/east velocity of target, relative to vehicle (navigation frame) [meters/second]
  cov_x_rel: single  % # X/north position variance [meters^2]
  cov_y_rel: single  % # Y/east position variance [meters^2]
  cov_vx_rel: single  % # X/north velocity variance [(meters/second)^2]
  cov_vy_rel: single  % # Y/east velocity variance [(meters/second)^2]
  abs_pos_valid: boolean  % # Flag showing whether absolute position is valid
  x_abs: single  % # X/north position of target, relative to origin (navigation frame) [meters]
  y_abs: single  % # Y/east position of target, relative to origin (navigation frame) [meters]
  z_abs: single  % # Z/down position of target, relative to origin (navigation frame) [meters]

led_control_s = Simulink.Bus()
  timestamp: uint64  % # time since system start (microseconds)
  led_mask: uint8  % # bitmask which LED(s) to control, set to 0xff for all
  color: uint8  % # see COLOR_*
  mode: uint8  % # see MODE_*
  num_blinks: uint8  % # how many times to blink (number of on-off cycles if mode is one of MODE_BLINK_*) . Set to 0 for infinite
  priority: uint8  % # priority: higher priority events will override current lower priority events (see MAX_PRIORITY)

COLOR_OFF = Simulink.Parameter(0, StorageClass="Const", DataType="uint8")  % # this is only used in the drivers
COLOR_RED = Simulink.Parameter(1, StorageClass="Const", DataType="uint8")
COLOR_GREEN = Simulink.Parameter(2, StorageClass="Const", DataType="uint8")
COLOR_BLUE = Simulink.Parameter(3, StorageClass="Const", DataType="uint8")
COLOR_YELLOW = Simulink.Parameter(4, StorageClass="Const", DataType="uint8")
COLOR_PURPLE = Simulink.Parameter(5, StorageClass="Const", DataType="uint8")
COLOR_AMBER = Simulink.Parameter(6, StorageClass="Const", DataType="uint8")
COLOR_CYAN = Simulink.Parameter(7, StorageClass="Const", DataType="uint8")
COLOR_WHITE = Simulink.Parameter(8, StorageClass="Const", DataType="uint8")
MODE_OFF = Simulink.Parameter(0, StorageClass="Const", DataType="uint8")  % # turn LED off
MODE_ON = Simulink.Parameter(1, StorageClass="Const", DataType="uint8")  % # turn LED on
MODE_DISABLED = Simulink.Parameter(2, StorageClass="Const", DataType="uint8")  % # disable this priority (switch to lower priority setting)
MODE_BLINK_SLOW = Simulink.Parameter(3, StorageClass="Const", DataType="uint8")
MODE_BLINK_NORMAL = Simulink.Parameter(4, StorageClass="Const", DataType="uint8")
MODE_BLINK_FAST = Simulink.Parameter(5, StorageClass="Const", DataType="uint8")
MODE_BREATHE = Simulink.Parameter(6, StorageClass="Const", DataType="uint8")  % # continuously increase & decrease brightness (solid color if driver does not support it)
MODE_FLASH = Simulink.Parameter(7, StorageClass="Const", DataType="uint8")  % # two fast blinks (on/off) with timing as in MODE_BLINK_FAST and then off for a while
MAX_PRIORITY = Simulink.Parameter(2, StorageClass="Const", DataType="uint8")  % # maxium priority (minimum is 0)

LED_CONTROL = enum(AddClassNameToEnumNames=true)
  COLOR_OFF = 0  % # this is only used in the drivers
  COLOR_RED = 1
  COLOR_GREEN = 2
  COLOR_BLUE = 3
  COLOR_YELLOW = 4
  COLOR_PURPLE = 5
  COLOR_AMBER = 6
  COLOR_CYAN = 7
  COLOR_WHITE = 8
  MODE_OFF = 0  % # turn LED off
  MODE_ON = 1  % # turn LED on
  MODE_DISABLED = 2  % # disable this priority (switch to lower priority setting)
  MODE_BLINK_SLOW = 3
  MODE_BLINK_NORMAL = 4
  MODE_BLINK_FAST = 5
  MODE_BREATHE = 6  % # continuously increase & decrease brightness (solid color if driver does not support it)
  MODE_FLASH = 7  % # two fast blinks (on/off) with timing as in MODE_BLINK_FAST and then off for a while
  MAX_PRIORITY = 2  % # maxium priority (minimum is 0)
  ORB_QUEUE_LENGTH = 8  % # needs to match BOARD_MAX_LEDS

log_message_s = Simulink.Bus()
  timestamp: uint64  % # time since system start (microseconds)
  severity: uint8  % # log level (same as in the linux kernel, starting with 0)
  text: int8[127]

LOG_MESSAGE = enum(AddClassNameToEnumNames=true)
  ORB_QUEUE_LENGTH = 4

logger_status_s = Simulink.Bus()
  timestamp: uint64  % # time since system start (microseconds)
  type: uint8
  backend: uint8
  total_written_kb: single  % # total written to log in kiloBytes
  write_rate_kb_s: single  % # write rate in kiloBytes/s
  dropouts: uint32  % # number of failed buffer writes due to buffer overflow
  message_gaps: uint32  % # messages misssed
  buffer_used_bytes: uint32  % # current buffer fill in Bytes
  buffer_size_bytes: uint32  % # total buffer size in Bytes
  num_messages: uint8

LOGGER_TYPE_FULL = Simulink.Parameter(0, StorageClass="Const", DataType="uint8")  % # Normal, full size log
LOGGER_TYPE_MISSION = Simulink.Parameter(1, StorageClass="Const", DataType="uint8")  % # reduced mission log (e.g. for geotagging)
BACKEND_FILE = Simulink.Parameter(1, StorageClass="Const", DataType="uint8")
BACKEND_MAVLINK = Simulink.Parameter(2, StorageClass="Const", DataType="uint8")
BACKEND_ALL = Simulink.Parameter(3, StorageClass="Const", DataType="uint8")

LOGGER_STATUS = enum(AddClassNameToEnumNames=true)
  LOGGER_TYPE_FULL = 0  % # Normal, full size log
  LOGGER_TYPE_MISSION = 1  % # reduced mission log (e.g. for geotagging)
  BACKEND_FILE = 1
  BACKEND_MAVLINK = 2
  BACKEND_ALL = 3

mag_worker_data_s = Simulink.Bus()
  timestamp: uint64  % # time since system start (microseconds)
  timestamp_sample: uint64
  done_count: uint32
  calibration_points_perside: uint32
  calibration_interval_perside_us: uint64
  calibration_counter_total: uint32[4]
  side_data_collected: boolean[4]
  x: single[4]
  y: single[4]
  z: single[4]

MAX_MAGS = Simulink.Parameter(4, StorageClass="Const", DataType="uint8")

MAG_WORKER_DATA = enum(AddClassNameToEnumNames=true)
  MAX_MAGS = 4

manual_control_setpoint_s = Simulink.Bus()
  timestamp: uint64  % # time since system start (microseconds)
  timestamp_sample: uint64  % # the timestamp of the raw data (microseconds)
  data_source: uint8  % # where this input is coming from
  x: single  % # stick position in x direction -1..1
  y: single  % # stick position in y direction -1..1
  z: single  % # throttle stick position 0..1
  r: single  % # yaw stick/twist position, -1..1
  flaps: single  % # flap position
  aux1: single  % # default function: camera yaw / azimuth
  aux2: single  % # default function: camera pitch / tilt
  aux3: single  % # default function: camera trigger
  aux4: single  % # default function: camera roll
  aux5: single  % # default function: payload drop
  aux6: single

SOURCE_RC = Simulink.Parameter(1, StorageClass="Const", DataType="uint8")  % # radio control
SOURCE_MAVLINK_0 = Simulink.Parameter(2, StorageClass="Const", DataType="uint8")  % # mavlink instance 0
SOURCE_MAVLINK_1 = Simulink.Parameter(3, StorageClass="Const", DataType="uint8")  % # mavlink instance 1
SOURCE_MAVLINK_2 = Simulink.Parameter(4, StorageClass="Const", DataType="uint8")  % # mavlink instance 2
SOURCE_MAVLINK_3 = Simulink.Parameter(5, StorageClass="Const", DataType="uint8")  % # mavlink instance 4

MANUAL_CONTROL_SETPOINT = enum(AddClassNameToEnumNames=true)
  SOURCE_RC = 1  % # radio control
  SOURCE_MAVLINK_0 = 2  % # mavlink instance 0
  SOURCE_MAVLINK_1 = 3  % # mavlink instance 1
  SOURCE_MAVLINK_2 = 4  % # mavlink instance 2
  SOURCE_MAVLINK_3 = 5  % # mavlink instance 4

manual_control_switches_s = Simulink.Bus()
  timestamp: uint64  % # time since system start (microseconds)
  timestamp_sample: uint64  % # the timestamp of the raw data (microseconds)
  mode_slot: uint8  % # the slot a specific model selector is in
  arm_switch: uint8  % # arm/disarm switch: _DISARMED_, ARMED
  return_switch: uint8  % # return to launch 2 position switch (mandatory): _NORMAL_, RTL
  loiter_switch: uint8  % # loiter 2 position switch (optional): _MISSION_, LOITER
  offboard_switch: uint8  % # offboard 2 position switch (optional): _NORMAL_, OFFBOARD
  kill_switch: uint8  % # throttle kill: _NORMAL_, KILL
  gear_switch: uint8  % # landing gear switch: _DOWN_, UP
  transition_switch: uint8  % # VTOL transition switch: _HOVER, FORWARD_FLIGHT
  mode_switch: uint8  % # main mode 3 position switch (mandatory): _MANUAL_, ASSIST, AUTO
  man_switch: uint8  % # manual switch (only relevant for fixed wings, optional): _STABILIZED_, MANUAL
  acro_switch: uint8  % # acro 2 position switch (optional): _MANUAL_, ACRO
  stab_switch: uint8  % # stabilize switch (only relevant for fixed wings, optional): _MANUAL, STABILIZED
  posctl_switch: uint8  % # position control 2 position switch (optional): _ALTCTL_, POSCTL
  switch_changes: uint32  % # number of switch changes

SWITCH_POS_NONE = Simulink.Parameter(0, StorageClass="Const", DataType="uint8")  % # switch is not mapped
SWITCH_POS_ON = Simulink.Parameter(1, StorageClass="Const", DataType="uint8")  % # switch activated (value = 1)
SWITCH_POS_MIDDLE = Simulink.Parameter(2, StorageClass="Const", DataType="uint8")  % # middle position (value = 0)
SWITCH_POS_OFF = Simulink.Parameter(3, StorageClass="Const", DataType="uint8")  % # switch not activated (value = -1)
MODE_SLOT_NONE = Simulink.Parameter(0, StorageClass="Const", DataType="uint8")  % # no mode slot assigned
MODE_SLOT_1 = Simulink.Parameter(1, StorageClass="Const", DataType="uint8")  % # mode slot 1 selected
MODE_SLOT_2 = Simulink.Parameter(2, StorageClass="Const", DataType="uint8")  % # mode slot 2 selected
MODE_SLOT_3 = Simulink.Parameter(3, StorageClass="Const", DataType="uint8")  % # mode slot 3 selected
MODE_SLOT_4 = Simulink.Parameter(4, StorageClass="Const", DataType="uint8")  % # mode slot 4 selected
MODE_SLOT_5 = Simulink.Parameter(5, StorageClass="Const", DataType="uint8")  % # mode slot 5 selected
MODE_SLOT_6 = Simulink.Parameter(6, StorageClass="Const", DataType="uint8")  % # mode slot 6 selected
MODE_SLOT_NUM = Simulink.Parameter(6, StorageClass="Const", DataType="uint8")  % # number of slots

MANUAL_CONTROL_SWITCHES = enum(AddClassNameToEnumNames=true)
  SWITCH_POS_NONE = 0  % # switch is not mapped
  SWITCH_POS_ON = 1  % # switch activated (value = 1)
  SWITCH_POS_MIDDLE = 2  % # middle position (value = 0)
  SWITCH_POS_OFF = 3  % # switch not activated (value = -1)
  MODE_SLOT_NONE = 0  % # no mode slot assigned
  MODE_SLOT_1 = 1  % # mode slot 1 selected
  MODE_SLOT_2 = 2  % # mode slot 2 selected
  MODE_SLOT_3 = 3  % # mode slot 3 selected
  MODE_SLOT_4 = 4  % # mode slot 4 selected
  MODE_SLOT_5 = 5  % # mode slot 5 selected
  MODE_SLOT_6 = 6  % # mode slot 6 selected
  MODE_SLOT_NUM = 6  % # number of slots

mavlink_log_s = Simulink.Bus()
  timestamp: uint64  % # time since system start (microseconds)
  text: int8[127]
  severity: uint8  % # log level (same as in the linux kernel, starting with 0)

MAVLINK_LOG = enum(AddClassNameToEnumNames=true)
  ORB_QUEUE_LENGTH = 8

mission_s = Simulink.Bus()
  timestamp: uint64  % # time since system start (microseconds)
  dataman_id: uint8  % # default 0, there are two offboard storage places in the dataman: 0 or 1
  count: uint16  % # count of the missions stored in the dataman
  current_seq: int32  % # default -1, start at the one changed latest

mission_result_s = Simulink.Bus()
  timestamp: uint64  % # time since system start (microseconds)
  instance_count: uint32  % # Instance count of this mission. Increments monotonically whenever the mission is modified
  seq_reached: int32  % # Sequence of the mission item which has been reached, default -1
  seq_current: uint16  % # Sequence of the current mission item
  seq_total: uint16  % # Total number of mission items
  valid: boolean  % # true if mission is valid
  warning: boolean  % # true if mission is valid, but has potentially problematic items leading to safety warnings
  finished: boolean  % # true if mission has been completed
  failure: boolean  % # true if the mission cannot continue or be completed for some reason
  stay_in_failsafe: boolean  % # true if the commander should not switch out of the failsafe mode
  flight_termination: boolean  % # true if the navigator demands a flight termination from the commander app
  item_do_jump_changed: boolean  % # true if the number of do jumps remaining has changed
  item_changed_index: uint16  % # indicate which item has changed
  item_do_jump_remaining: uint16  % # set to the number of do jumps remaining for that item
  execution_mode: uint8  % # indicates the mode in which the mission is executed

MISSION_EXECUTION_MODE_NORMAL = Simulink.Parameter(0, StorageClass="Const", DataType="uint8")  % # Execute the mission according to the planned items
MISSION_EXECUTION_MODE_REVERSE = Simulink.Parameter(1, StorageClass="Const", DataType="uint8")  % # Execute the mission in reverse order, ignoring commands and converting all waypoints to normal ones
MISSION_EXECUTION_MODE_FAST_FORWARD = Simulink.Parameter(2, StorageClass="Const", DataType="uint8")  % # Execute the mission as fast as possible, for example converting loiter waypoints to normal ones

MISSION_RESULT = enum(AddClassNameToEnumNames=true)
  MISSION_EXECUTION_MODE_NORMAL = 0  % # Execute the mission according to the planned items
  MISSION_EXECUTION_MODE_REVERSE = 1  % # Execute the mission in reverse order, ignoring commands and converting all waypoints to normal ones
  MISSION_EXECUTION_MODE_FAST_FORWARD = 2  % # Execute the mission as fast as possible, for example converting loiter waypoints to normal ones

mount_orientation_s = Simulink.Bus()
  timestamp: uint64  % # time since system start (microseconds)
  attitude_euler_angle: single[3]  % # Attitude/direction of the mount as euler angles in rad

multirotor_motor_limits_s = Simulink.Bus()
  timestamp: uint64  % # time since system start (microseconds)
  saturation_status: uint16  % # Integer bit mask indicating which axes in the control mixer are saturated

navigator_mission_item_s = Simulink.Bus()
  timestamp: uint64  % # time since system start (microseconds)
  instance_count: uint32  % # Instance count of this mission. Increments monotonically whenever the mission is modified
  sequence_current: uint16  % # Sequence of the current mission item
  nav_cmd: uint16
  latitude: single
  longitude: single
  time_inside: single  % # time that the MAV should stay inside the radius before advancing in seconds
  acceptance_radius: single  % # default radius in which the mission is accepted as reached in meters
  loiter_radius: single  % # loiter radius in meters, 0 for a VTOL to hover, negative for counter-clockwise
  yaw: single  % # in radians NED -PI..+PI, NAN means don't change yaw
  altitude: single  % # altitude in meters (AMSL)
  frame: uint8  % # mission frame
  origin: uint8  % # mission item origin (onboard or mavlink)
  loiter_exit_xtrack: boolean  % # exit xtrack location: 0 for center of loiter wp, 1 for exit location
  force_heading: boolean  % # heading needs to be reached
  altitude_is_relative: boolean  % # true if altitude is relative from start point
  autocontinue: boolean  % # true if next waypoint should follow after this one
  vtol_back_transition: boolean  % # part of the vtol back transition sequence

obstacle_distance_s = Simulink.Bus()
  timestamp: uint64  % # time since system start (microseconds)
  frame: uint8  % #Coordinate frame of reference for the yaw rotation and offset of the sensor data. Defaults to MAV_FRAME_GLOBAL, which is North aligned. For body-mounted sensors use MAV_FRAME_BODY_FRD, which is vehicle front aligned.
  sensor_type: uint8  % # Type from MAV_DISTANCE_SENSOR enum.
  distances: uint16[72]  % # Distance of obstacles around the UAV with index 0 corresponding to local North. A value of 0 means that the obstacle is right in front of the sensor. A value of max_distance +1 means no obstacle is present. A value of UINT16_MAX for unknown/not used. In a array element, one unit corresponds to 1cm.
  increment: single  % # Angular width in degrees of each array element.
  min_distance: uint16  % # Minimum distance the sensor can measure in centimeters.
  max_distance: uint16  % # Maximum distance the sensor can measure in centimeters.
  angle_offset: single  % # Relative angle offset of the 0-index element in the distances array. Value of 0 corresponds to forward. Positive values are offsets to the right.

obstacle_distance_fused_s = Simulink.Bus()
  timestamp: uint64  % # time since system start (microseconds)
  frame: uint8  % #Coordinate frame of reference for the yaw rotation and offset of the sensor data. Defaults to MAV_FRAME_GLOBAL, which is North aligned. For body-mounted sensors use MAV_FRAME_BODY_FRD, which is vehicle front aligned.
  sensor_type: uint8  % # Type from MAV_DISTANCE_SENSOR enum.
  distances: uint16[72]  % # Distance of obstacles around the UAV with index 0 corresponding to local North. A value of 0 means that the obstacle is right in front of the sensor. A value of max_distance +1 means no obstacle is present. A value of UINT16_MAX for unknown/not used. In a array element, one unit corresponds to 1cm.
  increment: single  % # Angular width in degrees of each array element.
  min_distance: uint16  % # Minimum distance the sensor can measure in centimeters.
  max_distance: uint16  % # Maximum distance the sensor can measure in centimeters.
  angle_offset: single  % # Relative angle offset of the 0-index element in the distances array. Value of 0 corresponds to forward. Positive values are offsets to the right.

OBSTACLE_DISTANCE = enum(AddClassNameToEnumNames=true)
  MAV_FRAME_GLOBAL = 0
  MAV_FRAME_LOCAL_NED = 1
  MAV_FRAME_BODY_FRD = 12
  MAV_DISTANCE_SENSOR_LASER = 0
  MAV_DISTANCE_SENSOR_ULTRASOUND = 1
  MAV_DISTANCE_SENSOR_INFRARED = 2
  MAV_DISTANCE_SENSOR_RADAR = 3

offboard_control_mode_s = Simulink.Bus()
  timestamp: uint64  % # time since system start (microseconds)
  position: boolean
  velocity: boolean
  acceleration: boolean
  attitude: boolean
  body_rate: boolean

onboard_computer_status_s = Simulink.Bus()
  timestamp: uint64  % # [us] time since system start (microseconds)
  uptime: uint32  % # [ms] time since system boot of the companion (milliseconds)
  type: uint8  % # type of onboard computer 0: Mission computer primary, 1: Mission computer backup 1, 2: Mission computer backup 2, 3: Compute node, 4-5: Compute spares, 6-9: Payload computers.
  cpu_cores: uint8[8]  % # CPU usage on the component in percent
  cpu_combined: uint8[10]  % # Combined CPU usage as the last 10 slices of 100 MS
  gpu_cores: uint8[4]  % # GPU usage on the component in percent
  gpu_combined: uint8[10]  % # Combined GPU usage as the last 10 slices of 100 MS
  temperature_board: int8  % # [degC] Temperature of the board
  temperature_core: int8[8]  % # [degC] Temperature of the CPU core
  fan_speed: int16[4]  % # [rpm] Fan speeds
  ram_usage: uint32  % # [MB] Amount of used RAM on the component system
  ram_total: uint32  % # [MB] Total amount of RAM on the component system
  storage_type: uint32[4]  % # Storage type: 0: HDD, 1: SSD, 2: EMMC, 3: SD card (non-removable), 4: SD card (removable)
  storage_usage: uint32[4]  % # [MB] Amount of used storage space on the component system
  storage_total: uint32[4]  % # [MB] Total amount of storage space on the component system
  link_type: uint32[6]  % # [Kb/s] Link type: 0-9: UART, 10-19: Wired network, 20-29: Wifi, 30-39: Point-to-point proprietary, 40-49: Mesh proprietary
  link_tx_rate: uint32[6]  % # [Kb/s] Network traffic from the component system
  link_rx_rate: uint32[6]  % # [Kb/s] Network traffic to the component system
  link_tx_max: uint32[6]  % # [Kb/s] Network capacity from the component system
  link_rx_max: uint32[6]  % # [Kb/s] Network capacity to the component system

optical_flow_s = Simulink.Bus()
  timestamp: uint64  % # time since system start (microseconds)
  sensor_id: uint8  % # id of the sensor emitting the flow value
  pixel_flow_x_integral: single  % # accumulated optical flow in radians where a positive value is produced by a RH rotation about the X body axis
  pixel_flow_y_integral: single  % # accumulated optical flow in radians where a positive value is produced by a RH rotation about the Y body axis
  gyro_x_rate_integral: single  % # accumulated gyro value in radians where a positive value is produced by a RH rotation about the X body axis. Set to NaN if flow sensor does not have 3-axis gyro data.
  gyro_y_rate_integral: single  % # accumulated gyro value in radians where a positive value is produced by a RH rotation about the Y body axis. Set to NaN if flow sensor does not have 3-axis gyro data.
  gyro_z_rate_integral: single  % # accumulated gyro value in radians where a positive value is produced by a RH rotation about the Z body axis. Set to NaN if flow sensor does not have 3-axis gyro data.
  ground_distance_m: single  % # Altitude / distance to ground in meters
  integration_timespan: uint32  % # accumulation timespan in microseconds
  time_since_last_sonar_update: uint32  % # time since last sonar update in microseconds
  frame_count_since_last_readout: uint16  % # number of accumulated frames in timespan
  gyro_temperature: int16  % # Temperature * 100 in centi-degrees Celsius
  quality: uint8  % # Average of quality of accumulated frames, 0: bad quality, 255: maximum quality
  max_flow_rate: single  % # Magnitude of maximum angular which the optical flow sensor can measure reliably
  min_ground_distance: single  % # Minimum distance from ground at which the optical flow sensor operates reliably
  max_ground_distance: single  % # Maximum distance from ground at which the optical flow sensor operates reliably
  mode: uint8

MODE_UNKNOWN = Simulink.Parameter(0, StorageClass="Const", DataType="uint8")
MODE_BRIGHT = Simulink.Parameter(1, StorageClass="Const", DataType="uint8")
MODE_LOWLIGHT = Simulink.Parameter(2, StorageClass="Const", DataType="uint8")
MODE_SUPER_LOWLIGHT = Simulink.Parameter(3, StorageClass="Const", DataType="uint8")

OPTICAL_FLOW = enum(AddClassNameToEnumNames=true)
  MODE_UNKNOWN = 0
  MODE_BRIGHT = 1
  MODE_LOWLIGHT = 2
  MODE_SUPER_LOWLIGHT = 3

orb_test_s = Simulink.Bus()
  timestamp: uint64  % # time since system start (microseconds)
  val: int32

orb_multitest_s = Simulink.Bus()
  timestamp: uint64  % # time since system start (microseconds)
  val: int32

orb_test_large_s = Simulink.Bus()
  timestamp: uint64  % # time since system start (microseconds)
  val: int32
  junk: uint8[512]

orb_test_medium_s = Simulink.Bus()
  timestamp: uint64  % # time since system start (microseconds)
  val: int32
  junk: uint8[64]

orb_test_medium_multi_s = Simulink.Bus()
  timestamp: uint64  % # time since system start (microseconds)
  val: int32
  junk: uint8[64]

orb_test_medium_wrap_around_s = Simulink.Bus()
  timestamp: uint64  % # time since system start (microseconds)
  val: int32
  junk: uint8[64]

orb_test_medium_queue_s = Simulink.Bus()
  timestamp: uint64  % # time since system start (microseconds)
  val: int32
  junk: uint8[64]

orb_test_medium_queue_poll_s = Simulink.Bus()
  timestamp: uint64  % # time since system start (microseconds)
  val: int32
  junk: uint8[64]

orbit_status_s = Simulink.Bus()
  timestamp: uint64  % # time since system start (microseconds)
  radius: single  % # Radius of the orbit circle. Positive values orbit clockwise, negative values orbit counter-clockwise. [m]
  frame: uint8  % # The coordinate system of the fields: x, y, z.
  x: double  % # X coordinate of center point. Coordinate system depends on frame field: local = x position in meters * 1e4, global = latitude in degrees * 1e7.
  y: double  % # Y coordinate of center point. Coordinate system depends on frame field: local = y position in meters * 1e4, global = latitude in degrees * 1e7.
  z: single  % # Altitude of center point. Coordinate system depends on frame field.
  yaw_behaviour: uint8

ORBIT_YAW_BEHAVIOUR_HOLD_FRONT_TO_CIRCLE_CENTER = Simulink.Parameter(0, StorageClass="Const", DataType="uint8")
ORBIT_YAW_BEHAVIOUR_HOLD_INITIAL_HEADING = Simulink.Parameter(1, StorageClass="Const", DataType="uint8")
ORBIT_YAW_BEHAVIOUR_UNCONTROLLED = Simulink.Parameter(2, StorageClass="Const", DataType="uint8")
ORBIT_YAW_BEHAVIOUR_HOLD_FRONT_TANGENT_TO_CIRCLE = Simulink.Parameter(3, StorageClass="Const", DataType="uint8")
ORBIT_YAW_BEHAVIOUR_RC_CONTROLLED = Simulink.Parameter(4, StorageClass="Const", DataType="uint8")

ORBIT_STATUS = enum(AddClassNameToEnumNames=true)
  ORBIT_YAW_BEHAVIOUR_HOLD_FRONT_TO_CIRCLE_CENTER = 0
  ORBIT_YAW_BEHAVIOUR_HOLD_INITIAL_HEADING = 1
  ORBIT_YAW_BEHAVIOUR_UNCONTROLLED = 2
  ORBIT_YAW_BEHAVIOUR_HOLD_FRONT_TANGENT_TO_CIRCLE = 3
  ORBIT_YAW_BEHAVIOUR_RC_CONTROLLED = 4

parameter_update_s = Simulink.Bus()
  timestamp: uint64  % # time since system start (microseconds)
  instance: uint32  % # Instance count - constantly incrementing
  get_count: uint32
  set_count: uint32
  find_count: uint32
  export_count: uint32
  active: uint16
  changed: uint16
  custom_default: uint16

ping_s = Simulink.Bus()
  timestamp: uint64  % # time since system start (microseconds)
  ping_time: uint64  % # Timestamp of the ping packet
  ping_sequence: uint32  % # Sequence number of the ping packet
  dropped_packets: uint32  % # Number of dropped ping packets
  rtt_ms: single  % # Round trip time (in ms)
  system_id: uint8  % # System ID of the remote system
  component_id: uint8  % # Component ID of the remote system

position_controller_landing_status_s = Simulink.Bus()
  timestamp: uint64  % # time since system start (microseconds)
  horizontal_slope_displacement: single
  slope_angle_rad: single
  flare_length: single
  abort_landing: boolean  % # true if landing should be aborted

position_controller_status_s = Simulink.Bus()
  timestamp: uint64  % # time since system start (microseconds)
  nav_roll: single
  nav_pitch: single
  nav_bearing: single  % # set to NAN if not valid
  target_bearing: single  % # set to NAN if not valid
  xtrack_error: single  % # set to NAN if not valid
  wp_dist: single
  acceptance_radius: single  % # the optimal distance to a waypoint to switch to the next
  yaw_acceptance: single  % # NaN if not set
  altitude_acceptance: single  % # the optimal vertical distance to a waypoint to switch to the next
  type: uint8

position_setpoint_s = Simulink.Bus()
  timestamp: uint64  % # time since system start (microseconds)
  valid: boolean  % # true if setpoint is valid
  type: uint8  % # setpoint type to adjust behavior of position controller
  vx: single  % # local velocity setpoint in m/s in NED
  vy: single  % # local velocity setpoint in m/s in NED
  vz: single  % # local velocity setpoint in m/s in NED
  velocity_valid: boolean  % # true if local velocity setpoint valid
  velocity_frame: uint8  % # to set velocity setpoints in NED or body
  alt_valid: boolean  % # do not set for 3D position control. Set to true if you want z-position control while doing vx,vy velocity control.
  lat: double  % # latitude, in deg
  lon: double  % # longitude, in deg
  alt: single  % # altitude AMSL, in m
  yaw: single  % # yaw (only for multirotors), in rad [-PI..PI), NaN = hold current yaw
  yaw_valid: boolean  % # true if yaw setpoint valid
  yawspeed: single  % # yawspeed (only for multirotors, in rad/s)
  yawspeed_valid: boolean  % # true if yawspeed setpoint valid
  landing_gear: int8  % # landing gear: see definition of the states in landing_gear.msg
  loiter_radius: single  % # loiter radius (only for fixed wing), in m
  loiter_direction: int8  % # loiter direction: 1 = CW, -1 = CCW
  acceptance_radius: single  % # navigation acceptance_radius if we're doing waypoint navigation
  cruising_speed: single  % # the generally desired cruising speed (not a hard constraint)
  cruising_throttle: single  % # the generally desired cruising throttle (not a hard constraint)
  disable_weather_vane: boolean  % # VTOL: disable (in auto mode) the weather vane feature that turns the nose into the wind

SETPOINT_TYPE_POSITION = Simulink.Parameter(0, StorageClass="Const", DataType="uint8")  % # position setpoint
SETPOINT_TYPE_VELOCITY = Simulink.Parameter(1, StorageClass="Const", DataType="uint8")  % # velocity setpoint
SETPOINT_TYPE_LOITER = Simulink.Parameter(2, StorageClass="Const", DataType="uint8")  % # loiter setpoint
SETPOINT_TYPE_TAKEOFF = Simulink.Parameter(3, StorageClass="Const", DataType="uint8")  % # takeoff setpoint
SETPOINT_TYPE_LAND = Simulink.Parameter(4, StorageClass="Const", DataType="uint8")  % # land setpoint, altitude must be ignored, descend until landing
SETPOINT_TYPE_IDLE = Simulink.Parameter(5, StorageClass="Const", DataType="uint8")  % # do nothing, switch off motors or keep at idle speed (MC)
SETPOINT_TYPE_FOLLOW_TARGET = Simulink.Parameter(6, StorageClass="Const", DataType="uint8")  % # setpoint in NED frame (x, y, z, vx, vy, vz) set by follow target
VELOCITY_FRAME_LOCAL_NED = Simulink.Parameter(1, StorageClass="Const", DataType="uint8")  % # MAV_FRAME_LOCAL_NED
VELOCITY_FRAME_BODY_NED = Simulink.Parameter(8, StorageClass="Const", DataType="uint8")  % # MAV_FRAME_BODY_NED

POSITION_SETPOINT = enum(AddClassNameToEnumNames=true)
  SETPOINT_TYPE_POSITION = 0  % # position setpoint
  SETPOINT_TYPE_VELOCITY = 1  % # velocity setpoint
  SETPOINT_TYPE_LOITER = 2  % # loiter setpoint
  SETPOINT_TYPE_TAKEOFF = 3  % # takeoff setpoint
  SETPOINT_TYPE_LAND = 4  % # land setpoint, altitude must be ignored, descend until landing
  SETPOINT_TYPE_IDLE = 5  % # do nothing, switch off motors or keep at idle speed (MC)
  SETPOINT_TYPE_FOLLOW_TARGET = 6  % # setpoint in NED frame (x, y, z, vx, vy, vz) set by follow target
  VELOCITY_FRAME_LOCAL_NED = 1  % # MAV_FRAME_LOCAL_NED
  VELOCITY_FRAME_BODY_NED = 8  % # MAV_FRAME_BODY_NED

position_setpoint_triplet_s = Simulink.Bus()
  timestamp: uint64  % # time since system start (microseconds)
  previous: position_setpoint
  current: position_setpoint
  next: position_setpoint

power_button_state_s = Simulink.Bus()
  timestamp: uint64  % # time since system start (microseconds)
  event: uint8  % # one of PWR_BUTTON_STATE_*

PWR_BUTTON_STATE_IDEL = Simulink.Parameter(0, StorageClass="Const", DataType="uint8")  % # Button went up without meeting shutdown button down time (delete event)
PWR_BUTTON_STATE_DOWN = Simulink.Parameter(1, StorageClass="Const", DataType="uint8")  % # Button went Down
PWR_BUTTON_STATE_UP = Simulink.Parameter(2, StorageClass="Const", DataType="uint8")  % # Button went Up
PWR_BUTTON_STATE_REQUEST_SHUTDOWN = Simulink.Parameter(3, StorageClass="Const", DataType="uint8")  % # Button went Up after meeting shutdown button down time

POWER_BUTTON_STATE = enum(AddClassNameToEnumNames=true)
  PWR_BUTTON_STATE_IDEL = 0  % # Button went up without meeting shutdown button down time (delete event)
  PWR_BUTTON_STATE_DOWN = 1  % # Button went Down
  PWR_BUTTON_STATE_UP = 2  % # Button went Up
  PWR_BUTTON_STATE_REQUEST_SHUTDOWN = 3  % # Button went Up after meeting shutdown button down time

power_monitor_s = Simulink.Bus()
  timestamp: uint64  % # Time since system start (microseconds)
  voltage_v: single  % # Voltage in volts, 0 if unknown
  current_a: single  % # Current in amperes, -1 if unknown
  power_w: single  % # power in watts, -1 if unknown
  rconf: int16
  rsv: int16
  rbv: int16
  rp: int16
  rc: int16
  rcal: int16
  me: int16
  al: int16

pwm_input_s = Simulink.Bus()
  timestamp: uint64  % # Time since system start (microseconds)
  error_count: uint64  % # Timer overcapture error flag (AUX5 or MAIN5)
  pulse_width: uint32  % # Pulse width, timer counts
  period: uint32  % # Period, timer counts

px4io_status_s = Simulink.Bus()
  timestamp: uint64  % # time since system start (microseconds)
  free_memory_bytes: uint16
  voltage_v: single  % # Servo rail voltage in volts
  rssi_v: single  % # RSSI pin voltage in volts
  status_outputs_armed: boolean
  status_override: boolean
  status_rc_ok: boolean
  status_rc_ppm: boolean
  status_rc_dsm: boolean
  status_rc_sbus: boolean
  status_fmu_ok: boolean
  status_raw_pwm: boolean
  status_mixer_ok: boolean
  status_arm_sync: boolean
  status_init_ok: boolean
  status_failsafe: boolean
  status_safety_off: boolean
  status_fmu_initialized: boolean
  status_rc_st24: boolean
  status_rc_sumd: boolean
  alarm_vbatt_low: boolean
  alarm_temperature: boolean
  alarm_servo_current: boolean
  alarm_acc_current: boolean
  alarm_fmu_lost: boolean
  alarm_rc_lost: boolean
  alarm_pwm_error: boolean
  alarm_vservo_fault: boolean
  arming_io_arm_ok: boolean
  arming_fmu_armed: boolean
  arming_fmu_prearmed: boolean
  arming_manual_override_ok: boolean
  arming_failsafe_custom: boolean
  arming_inair_restart_ok: boolean
  arming_always_pwm_enable: boolean
  arming_rc_handling_disabled: boolean
  arming_lockdown: boolean
  arming_force_failsafe: boolean
  arming_termination_failsafe: boolean
  arming_override_immediate: boolean
  actuators: int16[8]
  servos: uint16[8]
  raw_inputs: uint16[18]

qshell_req_s = Simulink.Bus()
  timestamp: uint64  % # time since system start (microseconds)
  cmd: int8[100]
  strlen: uint32
  request_sequence: uint32

MAX_STRLEN = Simulink.Parameter(100, StorageClass="Const", DataType="uint32")

QSHELL_REQ = enum(AddClassNameToEnumNames=true)
  MAX_STRLEN = 100

qshell_retval_s = Simulink.Bus()
  timestamp: uint64  % # time since system start (microseconds)
  return_value: int32
  return_sequence: uint32

radio_status_s = Simulink.Bus()
  timestamp: uint64  % # time since system start (microseconds)
  rssi: uint8  % # local signal strength
  remote_rssi: uint8  % # remote signal strength
  txbuf: uint8  % # how full the tx buffer is as a percentage
  noise: uint8  % # background noise level
  remote_noise: uint8  % # remote background noise level
  rxerrors: uint16  % # receive errors
  fix: uint16  % # count of error corrected packets

rate_ctrl_status_s = Simulink.Bus()
  timestamp: uint64  % # time since system start (microseconds)
  rollspeed_integ: single
  pitchspeed_integ: single
  yawspeed_integ: single
  additional_integ1: single  % # FW: wheel rate integrator (optional)

rc_channels_s = Simulink.Bus()
  timestamp: uint64  % # time since system start (microseconds)
  timestamp_last_valid: uint64  % # Timestamp of last valid RC signal
  channels: single[18]  % # Scaled to -1..1 (throttle: 0..1)
  channel_count: uint8  % # Number of valid channels
  function: int8[26]  % # Functions mapping
  rssi: uint8  % # Receive signal strength index
  signal_lost: boolean  % # Control signal lost, should be checked together with topic timeout
  frame_drop_count: uint32  % # Number of dropped frames

FUNCTION_THROTTLE = Simulink.Parameter(0, StorageClass="Const", DataType="uint8")
FUNCTION_ROLL = Simulink.Parameter(1, StorageClass="Const", DataType="uint8")
FUNCTION_PITCH = Simulink.Parameter(2, StorageClass="Const", DataType="uint8")
FUNCTION_YAW = Simulink.Parameter(3, StorageClass="Const", DataType="uint8")
FUNCTION_MODE = Simulink.Parameter(4, StorageClass="Const", DataType="uint8")
FUNCTION_RETURN = Simulink.Parameter(5, StorageClass="Const", DataType="uint8")
FUNCTION_POSCTL = Simulink.Parameter(6, StorageClass="Const", DataType="uint8")
FUNCTION_LOITER = Simulink.Parameter(7, StorageClass="Const", DataType="uint8")
FUNCTION_OFFBOARD = Simulink.Parameter(8, StorageClass="Const", DataType="uint8")
FUNCTION_ACRO = Simulink.Parameter(9, StorageClass="Const", DataType="uint8")
FUNCTION_FLAPS = Simulink.Parameter(10, StorageClass="Const", DataType="uint8")
FUNCTION_AUX_1 = Simulink.Parameter(11, StorageClass="Const", DataType="uint8")
FUNCTION_AUX_2 = Simulink.Parameter(12, StorageClass="Const", DataType="uint8")
FUNCTION_AUX_3 = Simulink.Parameter(13, StorageClass="Const", DataType="uint8")
FUNCTION_AUX_4 = Simulink.Parameter(14, StorageClass="Const", DataType="uint8")
FUNCTION_AUX_5 = Simulink.Parameter(15, StorageClass="Const", DataType="uint8")
FUNCTION_PARAM_1 = Simulink.Parameter(16, StorageClass="Const", DataType="uint8")
FUNCTION_PARAM_2 = Simulink.Parameter(17, StorageClass="Const", DataType="uint8")
FUNCTION_PARAM_3_5 = Simulink.Parameter(18, StorageClass="Const", DataType="uint8")
FUNCTION_KILLSWITCH = Simulink.Parameter(19, StorageClass="Const", DataType="uint8")
FUNCTION_TRANSITION = Simulink.Parameter(20, StorageClass="Const", DataType="uint8")
FUNCTION_GEAR = Simulink.Parameter(21, StorageClass="Const", DataType="uint8")
FUNCTION_ARMSWITCH = Simulink.Parameter(22, StorageClass="Const", DataType="uint8")
FUNCTION_STAB = Simulink.Parameter(23, StorageClass="Const", DataType="uint8")
FUNCTION_AUX_6 = Simulink.Parameter(24, StorageClass="Const", DataType="uint8")
FUNCTION_MAN = Simulink.Parameter(25, StorageClass="Const", DataType="uint8")

RC_CHANNELS = enum(AddClassNameToEnumNames=true)
  FUNCTION_THROTTLE = 0
  FUNCTION_ROLL = 1
  FUNCTION_PITCH = 2
  FUNCTION_YAW = 3
  FUNCTION_MODE = 4
  FUNCTION_RETURN = 5
  FUNCTION_POSCTL = 6
  FUNCTION_LOITER = 7
  FUNCTION_OFFBOARD = 8
  FUNCTION_ACRO = 9
  FUNCTION_FLAPS = 10
  FUNCTION_AUX_1 = 11
  FUNCTION_AUX_2 = 12
  FUNCTION_AUX_3 = 13
  FUNCTION_AUX_4 = 14
  FUNCTION_AUX_5 = 15
  FUNCTION_PARAM_1 = 16
  FUNCTION_PARAM_2 = 17
  FUNCTION_PARAM_3_5 = 18
  FUNCTION_KILLSWITCH = 19
  FUNCTION_TRANSITION = 20
  FUNCTION_GEAR = 21
  FUNCTION_ARMSWITCH = 22
  FUNCTION_STAB = 23
  FUNCTION_AUX_6 = 24
  FUNCTION_MAN = 25

rc_parameter_map_s = Simulink.Bus()
  timestamp: uint64  % # time since system start (microseconds)
  valid: boolean[3]  % #true for RC-Param channels which are mapped to a param
  param_index: int32[3]  % # corresponding param index, this field is ignored if set to -1, in this case param_id will be used
  param_id: int8[51]  % # MAP_NCHAN * (ID_LEN + 1) chars, corresponding param id, null terminated
  scale: single[3]  % # scale to map the RC input [-1, 1] to a parameter value
  value0: single[3]  % # initial value around which the parameter value is changed
  value_min: single[3]  % # minimal parameter value
  value_max: single[3]  % # minimal parameter value

RC_PARAM_MAP_NCHAN = Simulink.Parameter(3, StorageClass="Const", DataType="uint8")  % # This limit is also hardcoded in the enum RC_CHANNELS_FUNCTION in rc_channels.h
PARAM_ID_LEN = Simulink.Parameter(16, StorageClass="Const", DataType="uint8")  % # corresponds to MAVLINK_MSG_PARAM_VALUE_FIELD_PARAM_ID_LEN

RC_PARAMETER_MAP = enum(AddClassNameToEnumNames=true)
  RC_PARAM_MAP_NCHAN = 3  % # This limit is also hardcoded in the enum RC_CHANNELS_FUNCTION in rc_channels.h
  PARAM_ID_LEN = 16  % # corresponds to MAVLINK_MSG_PARAM_VALUE_FIELD_PARAM_ID_LEN

rpm_s = Simulink.Bus()
  timestamp: uint64  % # time since system start (microseconds)
  indicated_frequency_rpm: single  % # indicated rotor Frequency in Revolution per minute
  estimated_accurancy_rpm: single  % # estimated accurancy in Revolution per minute

rtl_flight_time_s = Simulink.Bus()
  timestamp: uint64  % # time since system start (microseconds)
  rtl_time_s: single  % # how long in seconds will the RTL take
  rtl_limit_fraction: single  % # what fraction of the allowable RTL time would be taken

safety_s = Simulink.Bus()
  timestamp: uint64  % # time since system start (microseconds)
  safety_switch_available: boolean  % # Set to true if a safety switch is connected
  safety_off: boolean  % # Set to true if safety is off
  override_available: boolean  % # Set to true if external override system is connected
  override_enabled: boolean  % # Set to true if override is engaged

satellite_info_s = Simulink.Bus()
  timestamp: uint64  % # time since system start (microseconds)
  count: uint8  % # Number of satellites visible to the receiver
  svid: uint8[20]  % # Space vehicle ID [1..255], see scheme below
  used: uint8[20]  % # 0: Satellite not used, 1: used for navigation
  elevation: uint8[20]  % # Elevation (0: right on top of receiver, 90: on the horizon) of satellite
  azimuth: uint8[20]  % # Direction of satellite, 0: 0 deg, 255: 360 deg.
  snr: uint8[20]  % # dBHz, Signal to noise ratio of satellite C/N0, range 0..99, zero when not tracking this satellite.
  prn: uint8[20]  % # Satellite PRN code assignment, (psuedorandom number SBAS, valid codes are 120-144)

SAT_INFO_MAX_SATELLITES = Simulink.Parameter(20, StorageClass="Const", DataType="uint8")

SATELLITE_INFO = enum(AddClassNameToEnumNames=true)
  SAT_INFO_MAX_SATELLITES = 20

sensor_accel_s = Simulink.Bus()
  timestamp: uint64  % # time since system start (microseconds)
  timestamp_sample: uint64
  device_id: uint32  % # unique device ID for the sensor that does not change between power cycles
  x: single  % # acceleration in the FRD board frame X-axis in m/s^2
  y: single  % # acceleration in the FRD board frame Y-axis in m/s^2
  z: single  % # acceleration in the FRD board frame Z-axis in m/s^2
  temperature: single  % # temperature in degrees Celsius
  error_count: uint32
  clip_counter: uint8[3]  % # clip count per axis in the sample period
  samples: uint8  % # number of raw samples that went into this message

SENSOR_ACCEL = enum(AddClassNameToEnumNames=true)
  ORB_QUEUE_LENGTH = 8

sensor_accel_fifo_s = Simulink.Bus()
  timestamp: uint64  % # time since system start (microseconds)
  timestamp_sample: uint64
  device_id: uint32  % # unique device ID for the sensor that does not change between power cycles
  dt: single  % # delta time between samples (microseconds)
  scale: single
  samples: uint8  % # number of valid samples
  x: int16[32]  % # acceleration in the FRD board frame X-axis in m/s^2
  y: int16[32]  % # acceleration in the FRD board frame Y-axis in m/s^2
  z: int16[32]  % # acceleration in the FRD board frame Z-axis in m/s^2

sensor_baro_s = Simulink.Bus()
  timestamp: uint64  % # time since system start (microseconds)
  timestamp_sample: uint64
  device_id: uint32  % # unique device ID for the sensor that does not change between power cycles
  error_count: uint32
  pressure: single  % # static pressure measurement in millibar
  temperature: single  % # static temperature measurement in deg Celsius

sensor_combined_s = Simulink.Bus()
  timestamp: uint64  % # time since system start (microseconds)
  gyro_rad: single[3]  % # average angular rate measured in the FRD body frame XYZ-axis in rad/s over the last gyro sampling period
  gyro_integral_dt: uint32  % # gyro measurement sampling period in microseconds
  accelerometer_timestamp_relative: int32  % # timestamp + accelerometer_timestamp_relative = Accelerometer timestamp
  accelerometer_m_s2: single[3]  % # average value acceleration measured in the FRD body frame XYZ-axis in m/s^2 over the last accelerometer sampling period
  accelerometer_integral_dt: uint32  % # accelerometer measurement sampling period in microseconds
  accelerometer_clipping: uint8  % # bitfield indicating if there was any accelerometer clipping (per axis) during the sampling period

CLIPPING_X = Simulink.Parameter(1, StorageClass="Const", DataType="uint8")
CLIPPING_Y = Simulink.Parameter(2, StorageClass="Const", DataType="uint8")
CLIPPING_Z = Simulink.Parameter(4, StorageClass="Const", DataType="uint8")

SENSOR_COMBINED = enum(AddClassNameToEnumNames=true)
  RELATIVE_TIMESTAMP_INVALID = 2147483647  % # (0x7fffffff) If one of the relative timestamps is set to this value, it means the associated sensor values are invalid
  CLIPPING_X = 1
  CLIPPING_Y = 2
  CLIPPING_Z = 4

sensor_correction_s = Simulink.Bus()
  timestamp: uint64  % # time since system start (microseconds)
  gyro_device_ids: uint32[4]
  gyro_offset_0: single[3]  % # gyro 0 XYZ offsets in the sensor frame in rad/s
  gyro_offset_1: single[3]  % # gyro 1 XYZ offsets in the sensor frame in rad/s
  gyro_offset_2: single[3]  % # gyro 2 XYZ offsets in the sensor frame in rad/s
  gyro_offset_3: single[3]  % # gyro 3 XYZ offsets in the sensor frame in rad/s
  accel_device_ids: uint32[4]
  accel_offset_0: single[3]  % # accelerometer 0 offsets in the FRD board frame XYZ-axis in m/s^s
  accel_offset_1: single[3]  % # accelerometer 1 offsets in the FRD board frame XYZ-axis in m/s^s
  accel_offset_2: single[3]  % # accelerometer 2 offsets in the FRD board frame XYZ-axis in m/s^s
  accel_offset_3: single[3]  % # accelerometer 3 offsets in the FRD board frame XYZ-axis in m/s^s
  baro_device_ids: uint32[4]
  baro_offset_0: single  % # barometric pressure 0 offsets in the sensor frame in Pascals
  baro_offset_1: single  % # barometric pressure 1 offsets in the sensor frame in Pascals
  baro_offset_2: single  % # barometric pressure 2 offsets in the sensor frame in Pascals
  baro_offset_3: single  % # barometric pressure 3 offsets in the sensor frame in Pascals

sensor_gps_s = Simulink.Bus()
  timestamp: uint64  % # time since system start (microseconds)
  device_id: uint32  % # unique device ID for the sensor that does not change between power cycles
  lat: int32  % # Latitude in 1E-7 degrees
  lon: int32  % # Longitude in 1E-7 degrees
  alt: int32  % # Altitude in 1E-3 meters above MSL, (millimetres)
  alt_ellipsoid: int32  % # Altitude in 1E-3 meters bove Ellipsoid, (millimetres)
  s_variance_m_s: single  % # GPS speed accuracy estimate, (metres/sec)
  c_variance_rad: single  % # GPS course accuracy estimate, (radians)
  fix_type: uint8  % # 0-1: no fix, 2: 2D fix, 3: 3D fix, 4: RTCM code differential, 5: Real-Time Kinematic, float, 6: Real-Time Kinematic, fixed, 8: Extrapolated. Some applications will not use the value of this field unless it is at least two, so always correctly fill in the fix.
  eph: single  % # GPS horizontal position accuracy (metres)
  epv: single  % # GPS vertical position accuracy (metres)
  hdop: single  % # Horizontal dilution of precision
  vdop: single  % # Vertical dilution of precision
  noise_per_ms: int32  % # GPS noise per millisecond
  automatic_gain_control: uint16  % # Automatic gain control monitor
  jamming_indicator: int32  % # indicates jamming is occurring
  jamming_state: uint8  % # indicates whether jamming has been detected or suspected by the receivers. O: Unknown, 1: OK, 2: Warning, 3: Critical
  vel_m_s: single  % # GPS ground speed, (metres/sec)
  vel_n_m_s: single  % # GPS North velocity, (metres/sec)
  vel_e_m_s: single  % # GPS East velocity, (metres/sec)
  vel_d_m_s: single  % # GPS Down velocity, (metres/sec)
  cog_rad: single  % # Course over ground (NOT heading, but direction of movement), -PI..PI, (radians)
  vel_ned_valid: boolean  % # True if NED velocity is valid
  timestamp_time_relative: int32  % # timestamp + timestamp_time_relative = Time of the UTC timestamp since system start, (microseconds)
  time_utc_usec: uint64  % # Timestamp (microseconds, UTC), this is the timestamp which comes from the gps module. It might be unavailable right after cold start, indicated by a value of 0
  satellites_used: uint8  % # Number of satellites used
  heading: single  % # heading angle of XYZ body frame rel to NED. Set to NaN if not available and updated (used for dual antenna GPS), (rad, [-PI, PI])
  heading_offset: single  % # heading offset of dual antenna array in body frame. Set to NaN if not applicable. (rad, [-PI, PI])

sensor_gyro_s = Simulink.Bus()
  timestamp: uint64  % # time since system start (microseconds)
  timestamp_sample: uint64
  device_id: uint32  % # unique device ID for the sensor that does not change between power cycles
  x: single  % # angular velocity in the FRD board frame X-axis in rad/s
  y: single  % # angular velocity in the FRD board frame Y-axis in rad/s
  z: single  % # angular velocity in the FRD board frame Z-axis in rad/s
  temperature: single  % # temperature in degrees Celsius
  error_count: uint32
  samples: uint8  % # number of raw samples that went into this message

SENSOR_GYRO = enum(AddClassNameToEnumNames=true)
  ORB_QUEUE_LENGTH = 8

sensor_gyro_fft_s = Simulink.Bus()
  timestamp: uint64  % # time since system start (microseconds)
  timestamp_sample: uint64
  device_id: uint32  % # unique device ID for the sensor that does not change between power cycles
  sensor_sample_rate_hz: single
  resolution_hz: single
  peak_frequencies_x: single[4]  % # x axis peak frequencies
  peak_frequencies_y: single[4]  % # y axis peak frequencies
  peak_frequencies_z: single[4]  % # z axis peak frequencies
  peak_magnitude_x: single[4]  % # x axis peak frequencies magnitude
  peak_magnitude_y: single[4]  % # y axis peak frequencies magnitude
  peak_magnitude_z: single[4]  % # z axis peak frequencies magnitude
  total_energy: single[3]

sensor_gyro_fifo_s = Simulink.Bus()
  timestamp: uint64  % # time since system start (microseconds)
  timestamp_sample: uint64
  device_id: uint32  % # unique device ID for the sensor that does not change between power cycles
  dt: single  % # delta time between samples (microseconds)
  scale: single
  samples: uint8  % # number of valid samples
  x: int16[32]  % # angular velocity in the FRD board frame X-axis in rad/s
  y: int16[32]  % # angular velocity in the FRD board frame Y-axis in rad/s
  z: int16[32]  % # angular velocity in the FRD board frame Z-axis in rad/s

SENSOR_GYRO_FIFO = enum(AddClassNameToEnumNames=true)
  ORB_QUEUE_LENGTH = 4

sensor_mag_s = Simulink.Bus()
  timestamp: uint64  % # time since system start (microseconds)
  timestamp_sample: uint64
  device_id: uint32  % # unique device ID for the sensor that does not change between power cycles
  x: single  % # magnetic field in the FRD board frame X-axis in Gauss
  y: single  % # magnetic field in the FRD board frame Y-axis in Gauss
  z: single  % # magnetic field in the FRD board frame Z-axis in Gauss
  temperature: single  % # temperature in degrees Celsius
  error_count: uint32
  is_external: boolean  % # if true the mag is external (i.e. not built into the board)

SENSOR_MAG = enum(AddClassNameToEnumNames=true)
  ORB_QUEUE_LENGTH = 4

sensor_preflight_mag_s = Simulink.Bus()
  timestamp: uint64  % # time since system start (microseconds)
  mag_inconsistency_angle: single  % # maximum angle between magnetometer instance field vectors in radians.

sensor_selection_s = Simulink.Bus()
  timestamp: uint64  % # time since system start (microseconds)
  accel_device_id: uint32  % # unique device ID for the selected accelerometers
  gyro_device_id: uint32  % # unique device ID for the selected rate gyros

sensors_status_imu_s = Simulink.Bus()
  timestamp: uint64  % # time since system start (microseconds)
  accel_device_id_primary: uint32  % # current primary accel device id for reference
  accel_device_ids: uint32[4]
  accel_inconsistency_m_s_s: single[4]  % # magnitude of acceleration difference between IMU instance and mean in m/s^2.
  accel_healthy: boolean[4]
  gyro_device_id_primary: uint32  % # current primary gyro device id for reference
  gyro_device_ids: uint32[4]
  gyro_inconsistency_rad_s: single[4]  % # magnitude of angular rate difference between IMU instance and mean in (rad/s).
  gyro_healthy: boolean[4]

system_power_s = Simulink.Bus()
  timestamp: uint64  % # time since system start (microseconds)
  voltage5v_v: single  % # peripheral 5V rail voltage
  sensors3v3: single[4]  % # Sensors 3V3 rail voltage
  sensors3v3_valid: uint8  % # Sensors 3V3 rail voltage was read (bitfield).
  usb_connected: uint8  % # USB is connected when 1
  brick_valid: uint8  % # brick bits power is good when bit 1
  usb_valid: uint8  % # USB is valid when 1
  servo_valid: uint8  % # servo power is good when 1
  periph_5v_oc: uint8  % # peripheral overcurrent when 1
  hipower_5v_oc: uint8  % # high power peripheral overcurrent when 1
  comp_5v_valid: uint8  % # 5V to companion valid
  can1_gps1_5v_valid: uint8  % # 5V for CAN1/GPS1 valid

BRICK1_VALID_SHIFTS = Simulink.Parameter(0, StorageClass="Const", DataType="uint8")
BRICK1_VALID_MASK = Simulink.Parameter(1, StorageClass="Const", DataType="uint8")
BRICK2_VALID_SHIFTS = Simulink.Parameter(1, StorageClass="Const", DataType="uint8")
BRICK2_VALID_MASK = Simulink.Parameter(2, StorageClass="Const", DataType="uint8")
BRICK3_VALID_SHIFTS = Simulink.Parameter(2, StorageClass="Const", DataType="uint8")
BRICK3_VALID_MASK = Simulink.Parameter(4, StorageClass="Const", DataType="uint8")
BRICK4_VALID_SHIFTS = Simulink.Parameter(3, StorageClass="Const", DataType="uint8")
BRICK4_VALID_MASK = Simulink.Parameter(8, StorageClass="Const", DataType="uint8")

SYSTEM_POWER = enum(AddClassNameToEnumNames=true)
  BRICK1_VALID_SHIFTS = 0
  BRICK1_VALID_MASK = 1
  BRICK2_VALID_SHIFTS = 1
  BRICK2_VALID_MASK = 2
  BRICK3_VALID_SHIFTS = 2
  BRICK3_VALID_MASK = 4
  BRICK4_VALID_SHIFTS = 3
  BRICK4_VALID_MASK = 8

takeoff_status_s = Simulink.Bus()
  timestamp: uint64  % # time since system start (microseconds)
  takeoff_state: uint8
  tilt_limit: single  % # limited tilt feasability during takeoff, contains maximum tilt otherwise

TAKEOFF_STATE_UNINITIALIZED = Simulink.Parameter(0, StorageClass="Const", DataType="uint8")
TAKEOFF_STATE_DISARMED = Simulink.Parameter(1, StorageClass="Const", DataType="uint8")
TAKEOFF_STATE_SPOOLUP = Simulink.Parameter(2, StorageClass="Const", DataType="uint8")
TAKEOFF_STATE_READY_FOR_TAKEOFF = Simulink.Parameter(3, StorageClass="Const", DataType="uint8")
TAKEOFF_STATE_RAMPUP = Simulink.Parameter(4, StorageClass="Const", DataType="uint8")
TAKEOFF_STATE_FLIGHT = Simulink.Parameter(5, StorageClass="Const", DataType="uint8")

TAKEOFF_STATUS = enum(AddClassNameToEnumNames=true)
  TAKEOFF_STATE_UNINITIALIZED = 0
  TAKEOFF_STATE_DISARMED = 1
  TAKEOFF_STATE_SPOOLUP = 2
  TAKEOFF_STATE_READY_FOR_TAKEOFF = 3
  TAKEOFF_STATE_RAMPUP = 4
  TAKEOFF_STATE_FLIGHT = 5

task_stack_info_s = Simulink.Bus()
  timestamp: uint64  % # time since system start (microseconds)
  stack_free: uint16
  task_name: int8[24]

TASK_STACK_INFO = enum(AddClassNameToEnumNames=true)
  ORB_QUEUE_LENGTH = 2

tecs_status_s = Simulink.Bus()
  timestamp: uint64  % # time since system start (microseconds)
  altitude_sp: single
  altitude_filtered: single
  height_rate_setpoint: single
  height_rate: single
  equivalent_airspeed_sp: single
  true_airspeed_sp: single
  true_airspeed_filtered: single
  true_airspeed_derivative_sp: single
  true_airspeed_derivative: single
  true_airspeed_derivative_raw: single
  true_airspeed_innovation: single
  total_energy_error: single
  energy_distribution_error: single
  total_energy_rate_error: single
  energy_distribution_rate_error: single
  total_energy: single
  total_energy_rate: single
  total_energy_balance: single
  total_energy_balance_rate: single
  total_energy_sp: single
  total_energy_rate_sp: single
  total_energy_balance_sp: single
  total_energy_balance_rate_sp: single
  throttle_integ: single
  pitch_integ: single
  throttle_sp: single
  pitch_sp_rad: single
  mode: uint8

TECS_MODE_NORMAL = Simulink.Parameter(0, StorageClass="Const", DataType="uint8")
TECS_MODE_UNDERSPEED = Simulink.Parameter(1, StorageClass="Const", DataType="uint8")
TECS_MODE_TAKEOFF = Simulink.Parameter(2, StorageClass="Const", DataType="uint8")
TECS_MODE_LAND = Simulink.Parameter(3, StorageClass="Const", DataType="uint8")
TECS_MODE_LAND_THROTTLELIM = Simulink.Parameter(4, StorageClass="Const", DataType="uint8")
TECS_MODE_BAD_DESCENT = Simulink.Parameter(5, StorageClass="Const", DataType="uint8")
TECS_MODE_CLIMBOUT = Simulink.Parameter(6, StorageClass="Const", DataType="uint8")

TECS_STATUS = enum(AddClassNameToEnumNames=true)
  TECS_MODE_NORMAL = 0
  TECS_MODE_UNDERSPEED = 1
  TECS_MODE_TAKEOFF = 2
  TECS_MODE_LAND = 3
  TECS_MODE_LAND_THROTTLELIM = 4
  TECS_MODE_BAD_DESCENT = 5
  TECS_MODE_CLIMBOUT = 6

telemetry_status_s = Simulink.Bus()
  timestamp: uint64  % # time since system start (microseconds)
  type: uint8  % #  type of the radio hardware (LINK_TYPE_*)
  mode: uint8
  flow_control: boolean
  forwarding: boolean
  mavlink_v2: boolean
  ftp: boolean
  streams: uint8
  data_rate: single  % # configured maximum data rate (Bytes/s)
  rate_multiplier: single
  tx_rate_avg: single  % # transmit rate average (Bytes/s)
  tx_error_rate_avg: single  % # transmit error rate average (Bytes/s)
  tx_message_count: uint32  % # total message sent count
  tx_buffer_overruns: uint32  % # number of TX buffer overruns
  rx_rate_avg: single  % # transmit rate average (Bytes/s)
  rx_message_count: uint32  % # count of total messages received
  rx_message_lost_count: uint32
  rx_buffer_overruns: uint32  % # number of RX buffer overruns
  rx_parse_errors: uint32  % # number of parse errors
  rx_packet_drop_count: uint32  % # number of packet drops
  rx_message_lost_rate: single
  heartbeat_type_antenna_tracker: boolean  % # MAV_TYPE_ANTENNA_TRACKER
  heartbeat_type_gcs: boolean  % # MAV_TYPE_GCS
  heartbeat_type_onboard_controller: boolean  % # MAV_TYPE_ONBOARD_CONTROLLER
  heartbeat_type_gimbal: boolean  % # MAV_TYPE_GIMBAL
  heartbeat_type_adsb: boolean  % # MAV_TYPE_ADSB
  heartbeat_type_camera: boolean  % # MAV_TYPE_CAMERA
  heartbeat_component_telemetry_radio: boolean  % # MAV_COMP_ID_TELEMETRY_RADIO
  heartbeat_component_log: boolean  % # MAV_COMP_ID_LOG
  heartbeat_component_osd: boolean  % # MAV_COMP_ID_OSD
  heartbeat_component_obstacle_avoidance: boolean  % # MAV_COMP_ID_OBSTACLE_AVOIDANCE
  heartbeat_component_vio: boolean  % # MAV_COMP_ID_VISUAL_INERTIAL_ODOMETRY
  heartbeat_component_pairing_manager: boolean  % # MAV_COMP_ID_PAIRING_MANAGER
  heartbeat_component_udp_bridge: boolean  % # MAV_COMP_ID_UDP_BRIDGE
  heartbeat_component_uart_bridge: boolean  % # MAV_COMP_ID_UART_BRIDGE
  avoidance_system_healthy: boolean

LINK_TYPE_GENERIC = Simulink.Parameter(0, StorageClass="Const", DataType="uint8")
LINK_TYPE_UBIQUITY_BULLET = Simulink.Parameter(1, StorageClass="Const", DataType="uint8")
LINK_TYPE_WIRE = Simulink.Parameter(2, StorageClass="Const", DataType="uint8")
LINK_TYPE_USB = Simulink.Parameter(3, StorageClass="Const", DataType="uint8")
LINK_TYPE_IRIDIUM = Simulink.Parameter(4, StorageClass="Const", DataType="uint8")
HEARTBEAT_TIMEOUT_US = Simulink.Parameter(1500000, StorageClass="Const", DataType="uint64")  % # Heartbeat timeout 1.5 seconds

TELEMETRY_STATUS = enum(AddClassNameToEnumNames=true)
  LINK_TYPE_GENERIC = 0
  LINK_TYPE_UBIQUITY_BULLET = 1
  LINK_TYPE_WIRE = 2
  LINK_TYPE_USB = 3
  LINK_TYPE_IRIDIUM = 4
  HEARTBEAT_TIMEOUT_US = 1500000  % # Heartbeat timeout 1.5 seconds

test_motor_s = Simulink.Bus()
  timestamp: uint64  % # time since system start (microseconds)
  action: uint8  % # one of ACTION_* (applies to all motors)
  motor_number: uint32  % # number of motor to spin [0..N-1]
  value: single  % # output power, range [0..1], -1 to stop individual motor
  timeout_ms: uint32  % # timeout in ms after which to exit test mode (if 0, do not time out)
  driver_instance: uint8  % # select output driver (for boards with multiple outputs, like IO+FMU)

NUM_MOTOR_OUTPUTS = Simulink.Parameter(8, StorageClass="Const", DataType="uint8")
ACTION_STOP = Simulink.Parameter(0, StorageClass="Const", DataType="uint8")  % # stop all motors (disable motor test mode)
ACTION_RUN = Simulink.Parameter(1, StorageClass="Const", DataType="uint8")  % # run motor(s) (enable motor test mode)

TEST_MOTOR = enum(AddClassNameToEnumNames=true)
  NUM_MOTOR_OUTPUTS = 8
  ACTION_STOP = 0  % # stop all motors (disable motor test mode)
  ACTION_RUN = 1  % # run motor(s) (enable motor test mode)
  ORB_QUEUE_LENGTH = 4

timesync_s = Simulink.Bus()
  timestamp: uint64  % # time since system start (microseconds)
  sys_id: uint8  % # id of the origin system
  seq: uint8  % # timesync msg sequence
  tc1: int64  % # time sync timestamp 1
  ts1: int64  % # time sync timestamp 2

timesync_status_s = Simulink.Bus()
  timestamp: uint64  % # time since system start (microseconds)
  remote_timestamp: uint64  % # remote system timestamp (microseconds)
  observed_offset: int64  % # raw time offset directly observed from this timesync packet (microseconds)
  estimated_offset: int64  % # smoothed time offset between companion system and PX4 (microseconds)
  round_trip_time: uint32  % # round trip time of this timesync packet (microseconds)

trajectory_bezier_s = Simulink.Bus()
  timestamp: uint64  % # time since system start (microseconds)
  position: single[3]  % # local position x,y,z (metres)
  yaw: single  % # yaw angle (rad)
  delta: single  % # time it should take to get to this waypoint, if this is the final waypoint (seconds)

trajectory_waypoint_s = Simulink.Bus()
  timestamp: uint64  % # time since system start (microseconds)
  position: single[3]
  velocity: single[3]
  acceleration: single[3]
  yaw: single
  yaw_speed: single
  point_valid: boolean
  type: uint8

transponder_report_s = Simulink.Bus()
  timestamp: uint64  % # time since system start (microseconds)
  icao_address: uint32  % # ICAO address
  lat: double  % # Latitude, expressed as degrees
  lon: double  % # Longitude, expressed as degrees
  altitude_type: uint8  % # Type from ADSB_ALTITUDE_TYPE enum
  altitude: single  % # Altitude(ASL) in meters
  heading: single  % # Course over ground in radians, -pi to +pi, 0 is north
  hor_velocity: single  % # The horizontal velocity in m/s
  ver_velocity: single  % # The vertical velocity in m/s, positive is up
  callsign: int8[9]  % # The callsign, 8+null
  emitter_type: uint8  % # Type from ADSB_EMITTER_TYPE enum
  tslc: uint8  % # Time since last communication in seconds
  flags: uint16  % # Flags to indicate various statuses including valid data fields
  squawk: uint16  % # Squawk code
  uas_id: uint8[18]  % # Unique UAS ID

PX4_ADSB_FLAGS_VALID_COORDS = Simulink.Parameter(1, StorageClass="Const", DataType="uint16")
PX4_ADSB_FLAGS_VALID_ALTITUDE = Simulink.Parameter(2, StorageClass="Const", DataType="uint16")
PX4_ADSB_FLAGS_VALID_HEADING = Simulink.Parameter(4, StorageClass="Const", DataType="uint16")
PX4_ADSB_FLAGS_VALID_VELOCITY = Simulink.Parameter(8, StorageClass="Const", DataType="uint16")
PX4_ADSB_FLAGS_VALID_CALLSIGN = Simulink.Parameter(16, StorageClass="Const", DataType="uint16")
PX4_ADSB_FLAGS_VALID_SQUAWK = Simulink.Parameter(32, StorageClass="Const", DataType="uint16")
PX4_ADSB_FLAGS_RETRANSLATE = Simulink.Parameter(256, StorageClass="Const", DataType="uint16")
ADSB_EMITTER_TYPE_NO_INFO = Simulink.Parameter(0, StorageClass="Const", DataType="uint16")
ADSB_EMITTER_TYPE_LIGHT = Simulink.Parameter(1, StorageClass="Const", DataType="uint16")
ADSB_EMITTER_TYPE_SMALL = Simulink.Parameter(2, StorageClass="Const", DataType="uint16")
ADSB_EMITTER_TYPE_LARGE = Simulink.Parameter(3, StorageClass="Const", DataType="uint16")
ADSB_EMITTER_TYPE_HIGH_VORTEX_LARGE = Simulink.Parameter(4, StorageClass="Const", DataType="uint16")
ADSB_EMITTER_TYPE_HEAVY = Simulink.Parameter(5, StorageClass="Const", DataType="uint16")
ADSB_EMITTER_TYPE_HIGHLY_MANUV = Simulink.Parameter(6, StorageClass="Const", DataType="uint16")
ADSB_EMITTER_TYPE_ROTOCRAFT = Simulink.Parameter(7, StorageClass="Const", DataType="uint16")
ADSB_EMITTER_TYPE_UNASSIGNED = Simulink.Parameter(8, StorageClass="Const", DataType="uint16")
ADSB_EMITTER_TYPE_GLIDER = Simulink.Parameter(9, StorageClass="Const", DataType="uint16")
ADSB_EMITTER_TYPE_LIGHTER_AIR = Simulink.Parameter(10, StorageClass="Const", DataType="uint16")
ADSB_EMITTER_TYPE_PARACHUTE = Simulink.Parameter(11, StorageClass="Const", DataType="uint16")
ADSB_EMITTER_TYPE_ULTRA_LIGHT = Simulink.Parameter(12, StorageClass="Const", DataType="uint16")
ADSB_EMITTER_TYPE_UNASSIGNED2 = Simulink.Parameter(13, StorageClass="Const", DataType="uint16")
ADSB_EMITTER_TYPE_UAV = Simulink.Parameter(14, StorageClass="Const", DataType="uint16")
ADSB_EMITTER_TYPE_SPACE = Simulink.Parameter(15, StorageClass="Const", DataType="uint16")
ADSB_EMITTER_TYPE_UNASSGINED3 = Simulink.Parameter(16, StorageClass="Const", DataType="uint16")
ADSB_EMITTER_TYPE_EMERGENCY_SURFACE = Simulink.Parameter(17, StorageClass="Const", DataType="uint16")
ADSB_EMITTER_TYPE_SERVICE_SURFACE = Simulink.Parameter(18, StorageClass="Const", DataType="uint16")
ADSB_EMITTER_TYPE_POINT_OBSTACLE = Simulink.Parameter(19, StorageClass="Const", DataType="uint16")
ADSB_EMITTER_TYPE_ENUM_END = Simulink.Parameter(20, StorageClass="Const", DataType="uint16")

TRANSPONDER_REPORT = enum(AddClassNameToEnumNames=true)
  PX4_ADSB_FLAGS_VALID_COORDS = 1
  PX4_ADSB_FLAGS_VALID_ALTITUDE = 2
  PX4_ADSB_FLAGS_VALID_HEADING = 4
  PX4_ADSB_FLAGS_VALID_VELOCITY = 8
  PX4_ADSB_FLAGS_VALID_CALLSIGN = 16
  PX4_ADSB_FLAGS_VALID_SQUAWK = 32
  PX4_ADSB_FLAGS_RETRANSLATE = 256
  ADSB_EMITTER_TYPE_NO_INFO = 0
  ADSB_EMITTER_TYPE_LIGHT = 1
  ADSB_EMITTER_TYPE_SMALL = 2
  ADSB_EMITTER_TYPE_LARGE = 3
  ADSB_EMITTER_TYPE_HIGH_VORTEX_LARGE = 4
  ADSB_EMITTER_TYPE_HEAVY = 5
  ADSB_EMITTER_TYPE_HIGHLY_MANUV = 6
  ADSB_EMITTER_TYPE_ROTOCRAFT = 7
  ADSB_EMITTER_TYPE_UNASSIGNED = 8
  ADSB_EMITTER_TYPE_GLIDER = 9
  ADSB_EMITTER_TYPE_LIGHTER_AIR = 10
  ADSB_EMITTER_TYPE_PARACHUTE = 11
  ADSB_EMITTER_TYPE_ULTRA_LIGHT = 12
  ADSB_EMITTER_TYPE_UNASSIGNED2 = 13
  ADSB_EMITTER_TYPE_UAV = 14
  ADSB_EMITTER_TYPE_SPACE = 15
  ADSB_EMITTER_TYPE_UNASSGINED3 = 16
  ADSB_EMITTER_TYPE_EMERGENCY_SURFACE = 17
  ADSB_EMITTER_TYPE_SERVICE_SURFACE = 18
  ADSB_EMITTER_TYPE_POINT_OBSTACLE = 19
  ADSB_EMITTER_TYPE_ENUM_END = 20
  ORB_QUEUE_LENGTH = 8

tune_control_s = Simulink.Bus()
  timestamp: uint64  % # time since system start (microseconds)
  tune_id: uint8  % # tune_id corresponding to TuneID::* from the tune_defaults.h in the tunes library
  tune_override: boolean  % # if true the tune which is playing will be stopped and the new started
  frequency: uint16  % # in Hz
  duration: uint32  % # in us
  silence: uint32  % # in us
  volume: uint8  % # value between 0-100 if supported by backend

TUNE_ID_STOP = Simulink.Parameter(0, StorageClass="Const", DataType="uint8")
TUNE_ID_STARTUP = Simulink.Parameter(1, StorageClass="Const", DataType="uint8")
TUNE_ID_ERROR = Simulink.Parameter(2, StorageClass="Const", DataType="uint8")
TUNE_ID_NOTIFY_POSITIVE = Simulink.Parameter(3, StorageClass="Const", DataType="uint8")
TUNE_ID_NOTIFY_NEUTRAL = Simulink.Parameter(4, StorageClass="Const", DataType="uint8")
TUNE_ID_NOTIFY_NEGATIVE = Simulink.Parameter(5, StorageClass="Const", DataType="uint8")
TUNE_ID_ARMING_WARNING = Simulink.Parameter(6, StorageClass="Const", DataType="uint8")
TUNE_ID_BATTERY_WARNING_SLOW = Simulink.Parameter(7, StorageClass="Const", DataType="uint8")
TUNE_ID_BATTERY_WARNING_FAST = Simulink.Parameter(8, StorageClass="Const", DataType="uint8")
TUNE_ID_GPS_WARNING = Simulink.Parameter(9, StorageClass="Const", DataType="uint8")
TUNE_ID_ARMING_FAILURE = Simulink.Parameter(10, StorageClass="Const", DataType="uint8")
TUNE_ID_PARACHUTE_RELEASE = Simulink.Parameter(11, StorageClass="Const", DataType="uint8")
TUNE_ID_SINGLE_BEEP = Simulink.Parameter(12, StorageClass="Const", DataType="uint8")
TUNE_ID_HOME_SET = Simulink.Parameter(13, StorageClass="Const", DataType="uint8")
TUNE_ID_SD_INIT = Simulink.Parameter(14, StorageClass="Const", DataType="uint8")
TUNE_ID_SD_ERROR = Simulink.Parameter(15, StorageClass="Const", DataType="uint8")
TUNE_ID_PROG_PX4IO = Simulink.Parameter(16, StorageClass="Const", DataType="uint8")
TUNE_ID_PROG_PX4IO_OK = Simulink.Parameter(17, StorageClass="Const", DataType="uint8")
TUNE_ID_PROG_PX4IO_ERR = Simulink.Parameter(18, StorageClass="Const", DataType="uint8")
NUMBER_OF_TUNES = Simulink.Parameter(19, StorageClass="Const", DataType="uint8")
VOLUME_LEVEL_MIN = Simulink.Parameter(0, StorageClass="Const", DataType="uint8")
VOLUME_LEVEL_DEFAULT = Simulink.Parameter(40, StorageClass="Const", DataType="uint8")
VOLUME_LEVEL_MAX = Simulink.Parameter(100, StorageClass="Const", DataType="uint8")

TUNE_CONTROL = enum(AddClassNameToEnumNames=true)
  TUNE_ID_STOP = 0
  TUNE_ID_STARTUP = 1
  TUNE_ID_ERROR = 2
  TUNE_ID_NOTIFY_POSITIVE = 3
  TUNE_ID_NOTIFY_NEUTRAL = 4
  TUNE_ID_NOTIFY_NEGATIVE = 5
  TUNE_ID_ARMING_WARNING = 6
  TUNE_ID_BATTERY_WARNING_SLOW = 7
  TUNE_ID_BATTERY_WARNING_FAST = 8
  TUNE_ID_GPS_WARNING = 9
  TUNE_ID_ARMING_FAILURE = 10
  TUNE_ID_PARACHUTE_RELEASE = 11
  TUNE_ID_SINGLE_BEEP = 12
  TUNE_ID_HOME_SET = 13
  TUNE_ID_SD_INIT = 14
  TUNE_ID_SD_ERROR = 15
  TUNE_ID_PROG_PX4IO = 16
  TUNE_ID_PROG_PX4IO_OK = 17
  TUNE_ID_PROG_PX4IO_ERR = 18
  NUMBER_OF_TUNES = 19
  VOLUME_LEVEL_MIN = 0
  VOLUME_LEVEL_DEFAULT = 40
  VOLUME_LEVEL_MAX = 100
  ORB_QUEUE_LENGTH = 4

uavcan_parameter_request_s = Simulink.Bus()
  timestamp: uint64  % # time since system start (microseconds)
  message_type: uint8  % # MAVLink message type: PARAM_REQUEST_READ, PARAM_REQUEST_LIST, PARAM_SET
  node_id: uint8  % # UAVCAN node ID mapped from MAVLink component ID
  param_id: int8[17]  % # MAVLink/UAVCAN parameter name
  param_index: int16  % # -1 if the param_id field should be used as identifier
  param_type: uint8  % # MAVLink parameter type
  int_value: int64  % # current value if param_type is int-like
  real_value: single  % # current value if param_type is float-like

MESSAGE_TYPE_PARAM_REQUEST_READ = Simulink.Parameter(20, StorageClass="Const", DataType="uint8")  % # MAVLINK_MSG_ID_PARAM_REQUEST_READ
MESSAGE_TYPE_PARAM_REQUEST_LIST = Simulink.Parameter(21, StorageClass="Const", DataType="uint8")  % # MAVLINK_MSG_ID_PARAM_REQUEST_LIST
MESSAGE_TYPE_PARAM_SET = Simulink.Parameter(23, StorageClass="Const", DataType="uint8")  % # MAVLINK_MSG_ID_PARAM_SET
NODE_ID_ALL = Simulink.Parameter(0, StorageClass="Const", DataType="uint8")  % # MAV_COMP_ID_ALL
PARAM_TYPE_UINT8 = Simulink.Parameter(1, StorageClass="Const", DataType="uint8")  % # MAV_PARAM_TYPE_UINT8
PARAM_TYPE_INT64 = Simulink.Parameter(8, StorageClass="Const", DataType="uint8")  % # MAV_PARAM_TYPE_INT64
PARAM_TYPE_REAL32 = Simulink.Parameter(9, StorageClass="Const", DataType="uint8")  % # MAV_PARAM_TYPE_REAL32

UAVCAN_PARAMETER_REQUEST = enum(AddClassNameToEnumNames=true)
  MESSAGE_TYPE_PARAM_REQUEST_READ = 20  % # MAVLINK_MSG_ID_PARAM_REQUEST_READ
  MESSAGE_TYPE_PARAM_REQUEST_LIST = 21  % # MAVLINK_MSG_ID_PARAM_REQUEST_LIST
  MESSAGE_TYPE_PARAM_SET = 23  % # MAVLINK_MSG_ID_PARAM_SET
  NODE_ID_ALL = 0  % # MAV_COMP_ID_ALL
  PARAM_TYPE_UINT8 = 1  % # MAV_PARAM_TYPE_UINT8
  PARAM_TYPE_INT64 = 8  % # MAV_PARAM_TYPE_INT64
  PARAM_TYPE_REAL32 = 9  % # MAV_PARAM_TYPE_REAL32
  ORB_QUEUE_LENGTH = 4

uavcan_parameter_value_s = Simulink.Bus()
  timestamp: uint64  % # time since system start (microseconds)
  node_id: uint8  % # UAVCAN node ID mapped from MAVLink component ID
  param_id: int8[17]  % # MAVLink/UAVCAN parameter name
  param_index: int16  % # parameter index, if known
  param_count: uint16  % # number of parameters exposed by the node
  param_type: uint8  % # MAVLink parameter type
  int_value: int64  % # current value if param_type is int-like
  real_value: single  % # current value if param_type is float-like

ulog_stream_s = Simulink.Bus()
  timestamp: uint64  % # time since system start (microseconds)
  length: uint8  % # length of data
  first_message_offset: uint8  % # offset into data where first message starts. This
  msg_sequence: uint16  % # allows determine drops
  flags: uint8  % # see FLAGS_*
  data: uint8[249]  % # ulog data

FLAGS_NEED_ACK = Simulink.Parameter(1, StorageClass="Const", DataType="uint8")  % # if set, this message requires to be acked.

ULOG_STREAM = enum(AddClassNameToEnumNames=true)
  FLAGS_NEED_ACK = 1  % # if set, this message requires to be acked.
  ORB_QUEUE_LENGTH = 16  % # TODO: we might be able to reduce this if mavlink polled on the topic

ulog_stream_ack_s = Simulink.Bus()
  timestamp: uint64  % # time since system start (microseconds)
  msg_sequence: uint16

ACK_TIMEOUT = Simulink.Parameter(50, StorageClass="Const", DataType="int32")  % # timeout waiting for an ack until we retry to send the message [ms]
ACK_MAX_TRIES = Simulink.Parameter(50, StorageClass="Const", DataType="int32")  % # maximum amount of tries to (re-)send a message, each time waiting ACK_TIMEOUT ms

ULOG_STREAM_ACK = enum(AddClassNameToEnumNames=true)
  ACK_TIMEOUT = 50  % # timeout waiting for an ack until we retry to send the message [ms]
  ACK_MAX_TRIES = 50  % # maximum amount of tries to (re-)send a message, each time waiting ACK_TIMEOUT ms

vehicle_acceleration_s = Simulink.Bus()
  timestamp: uint64  % # time since system start (microseconds)
  timestamp_sample: uint64  % # the timestamp of the raw data (microseconds)
  xyz: single[3]  % # Bias corrected acceleration (including gravity) in the FRD body frame XYZ-axis in m/s^2

vehicle_actuator_setpoint_s = Simulink.Bus()
  timestamp: uint64  % # time since system start (microseconds)
  timestamp_sample: uint64  % # the timestamp the data this control response is based on was sampled
  actuator: single[16]

NUM_ACTUATOR_SETPOINT = Simulink.Parameter(16, StorageClass="Const", DataType="uint8")

VEHICLE_ACTUATOR_SETPOINT = enum(AddClassNameToEnumNames=true)
  NUM_ACTUATOR_SETPOINT = 16

vehicle_air_data_s = Simulink.Bus()
  timestamp: uint64  % # time since system start (microseconds)
  timestamp_sample: uint64  % # the timestamp of the raw data (microseconds)
  baro_device_id: uint32  % # unique device ID for the selected barometer
  baro_alt_meter: single  % # Altitude above MSL calculated from temperature compensated baro sensor data using an ISA corrected for sea level pressure SENS_BARO_QNH.
  baro_temp_celcius: single  % # Temperature in degrees Celsius
  baro_pressure_pa: single  % # Absolute pressure in Pascals
  rho: single  % # air density

vehicle_angular_acceleration_s = Simulink.Bus()
  timestamp: uint64  % # time since system start (microseconds)
  timestamp_sample: uint64  % # timestamp of the data sample on which this message is based (microseconds)
  xyz: single[3]  % # angular acceleration about the FRD body frame XYZ-axis in rad/s^2

vehicle_angular_acceleration_setpoint_s = Simulink.Bus()
  timestamp: uint64  % # time since system start (microseconds)
  timestamp_sample: uint64  % # timestamp of the data sample on which this message is based (microseconds)
  xyz: single[3]  % # angular acceleration about X, Y, Z body axis in rad/s^2

vehicle_angular_velocity_s = Simulink.Bus()
  timestamp: uint64  % # time since system start (microseconds)
  timestamp_sample: uint64  % # timestamp of the data sample on which this message is based (microseconds)
  xyz: single[3]  % # Bias corrected angular velocity about the FRD body frame XYZ-axis in rad/s

vehicle_angular_velocity_groundtruth_s = Simulink.Bus()
  timestamp: uint64  % # time since system start (microseconds)
  timestamp_sample: uint64  % # timestamp of the data sample on which this message is based (microseconds)
  xyz: single[3]  % # Bias corrected angular velocity about the FRD body frame XYZ-axis in rad/s

estimator_attitude_s = Simulink.Bus()
  timestamp: uint64  % # time since system start (microseconds)
  timestamp_sample: uint64  % # the timestamp of the raw data (microseconds)
  q: single[4]  % # Quaternion rotation from the FRD body frame to the NED earth frame
  delta_q_reset: single[4]  % # Amount by which quaternion has changed during last reset
  quat_reset_counter: uint8  % # Quaternion reset counter

vehicle_attitude_setpoint_s = Simulink.Bus()
  timestamp: uint64  % # time since system start (microseconds)
  roll_body: single  % # body angle in NED frame (can be NaN for FW)
  pitch_body: single  % # body angle in NED frame (can be NaN for FW)
  yaw_body: single  % # body angle in NED frame (can be NaN for FW)
  yaw_sp_move_rate: single  % # rad/s (commanded by user)
  q_d: single[4]  % # Desired quaternion for quaternion control
  thrust_body: single[3]  % # Normalized thrust command in body NED frame [-1,1]
  roll_reset_integral: boolean  % # Reset roll integral part (navigation logic change)
  pitch_reset_integral: boolean  % # Reset pitch integral part (navigation logic change)
  yaw_reset_integral: boolean  % # Reset yaw integral part (navigation logic change)
  fw_control_yaw: boolean  % # control heading with rudder (used for auto takeoff on runway)
  apply_flaps: uint8  % # flap config specifier

mc_virtual_attitude_setpoint_s = Simulink.Bus()
  timestamp: uint64  % # time since system start (microseconds)
  roll_body: single  % # body angle in NED frame (can be NaN for FW)
  pitch_body: single  % # body angle in NED frame (can be NaN for FW)
  yaw_body: single  % # body angle in NED frame (can be NaN for FW)
  yaw_sp_move_rate: single  % # rad/s (commanded by user)
  q_d: single[4]  % # Desired quaternion for quaternion control
  thrust_body: single[3]  % # Normalized thrust command in body NED frame [-1,1]
  roll_reset_integral: boolean  % # Reset roll integral part (navigation logic change)
  pitch_reset_integral: boolean  % # Reset pitch integral part (navigation logic change)
  yaw_reset_integral: boolean  % # Reset yaw integral part (navigation logic change)
  fw_control_yaw: boolean  % # control heading with rudder (used for auto takeoff on runway)
  apply_flaps: uint8  % # flap config specifier

fw_virtual_attitude_setpoint_s = Simulink.Bus()
  timestamp: uint64  % # time since system start (microseconds)
  roll_body: single  % # body angle in NED frame (can be NaN for FW)
  pitch_body: single  % # body angle in NED frame (can be NaN for FW)
  yaw_body: single  % # body angle in NED frame (can be NaN for FW)
  yaw_sp_move_rate: single  % # rad/s (commanded by user)
  q_d: single[4]  % # Desired quaternion for quaternion control
  thrust_body: single[3]  % # Normalized thrust command in body NED frame [-1,1]
  roll_reset_integral: boolean  % # Reset roll integral part (navigation logic change)
  pitch_reset_integral: boolean  % # Reset pitch integral part (navigation logic change)
  yaw_reset_integral: boolean  % # Reset yaw integral part (navigation logic change)
  fw_control_yaw: boolean  % # control heading with rudder (used for auto takeoff on runway)
  apply_flaps: uint8  % # flap config specifier

FLAPS_OFF = Simulink.Parameter(0, StorageClass="Const", DataType="uint8")  % # no flaps
FLAPS_LAND = Simulink.Parameter(1, StorageClass="Const", DataType="uint8")  % # landing config flaps
FLAPS_TAKEOFF = Simulink.Parameter(2, StorageClass="Const", DataType="uint8")  % # take-off config flaps

VEHICLE_ATTITUDE_SETPOINT = enum(AddClassNameToEnumNames=true)
  FLAPS_OFF = 0  % # no flaps
  FLAPS_LAND = 1  % # landing config flaps
  FLAPS_TAKEOFF = 2  % # take-off config flaps

vehicle_command_s = Simulink.Bus()
  timestamp: uint64  % # time since system start (microseconds)
  param1: single  % # Parameter 1, as defined by MAVLink uint16 VEHICLE_CMD enum.
  param2: single  % # Parameter 2, as defined by MAVLink uint16 VEHICLE_CMD enum.
  param3: single  % # Parameter 3, as defined by MAVLink uint16 VEHICLE_CMD enum.
  param4: single  % # Parameter 4, as defined by MAVLink uint16 VEHICLE_CMD enum.
  param5: double  % # Parameter 5, as defined by MAVLink uint16 VEHICLE_CMD enum.
  param6: double  % # Parameter 6, as defined by MAVLink uint16 VEHICLE_CMD enum.
  param7: single  % # Parameter 7, as defined by MAVLink uint16 VEHICLE_CMD enum.
  command: uint32  % # Command ID
  target_system: uint8  % # System which should execute the command
  target_component: uint8  % # Component which should execute the command, 0 for all components
  source_system: uint8  % # System sending the command
  source_component: uint8  % # Component sending the command
  confirmation: uint8  % # 0: First transmission of this command. 1-255: Confirmation transmissions (e.g. for kill command)
  from_external: boolean

VEHICLE_CMD_CUSTOM_0 = Simulink.Parameter(0, StorageClass="Const", DataType="uint16")  % # test command
VEHICLE_CMD_CUSTOM_1 = Simulink.Parameter(1, StorageClass="Const", DataType="uint16")  % # test command
VEHICLE_CMD_CUSTOM_2 = Simulink.Parameter(2, StorageClass="Const", DataType="uint16")  % # test command
VEHICLE_CMD_NAV_WAYPOINT = Simulink.Parameter(16, StorageClass="Const", DataType="uint16")  % # Navigate to MISSION. |Hold time in decimal seconds. (ignored by fixed wing, time to stay at MISSION for rotary wing)| Acceptance radius in meters (if the sphere with this radius is hit, the MISSION counts as reached)| 0 to pass through the WP, if > 0 radius in meters to pass by WP. Positive value for clockwise orbit, negative value for counter-clockwise orbit. Allows trajectory control.| Desired yaw angle at MISSION (rotary wing)| Latitude| Longitude| Altitude|
VEHICLE_CMD_NAV_LOITER_UNLIM = Simulink.Parameter(17, StorageClass="Const", DataType="uint16")  % # Loiter around this MISSION an unlimited amount of time |Empty| Empty| Radius around MISSION, in meters. If positive loiter clockwise, else counter-clockwise| Desired yaw angle.| Latitude| Longitude| Altitude|
VEHICLE_CMD_NAV_LOITER_TURNS = Simulink.Parameter(18, StorageClass="Const", DataType="uint16")  % # Loiter around this MISSION for X turns |Turns| Empty| Radius around MISSION, in meters. If positive loiter clockwise, else counter-clockwise| Desired yaw angle.| Latitude| Longitude| Altitude|
VEHICLE_CMD_NAV_LOITER_TIME = Simulink.Parameter(19, StorageClass="Const", DataType="uint16")  % # Loiter around this MISSION for X seconds |Seconds (decimal)| Empty| Radius around MISSION, in meters. If positive loiter clockwise, else counter-clockwise| Desired yaw angle.| Latitude| Longitude| Altitude|
VEHICLE_CMD_NAV_RETURN_TO_LAUNCH = Simulink.Parameter(20, StorageClass="Const", DataType="uint16")  % # Return to launch location |Empty| Empty| Empty| Empty| Empty| Empty| Empty|
VEHICLE_CMD_NAV_LAND = Simulink.Parameter(21, StorageClass="Const", DataType="uint16")  % # Land at location |Empty| Empty| Empty| Desired yaw angle.| Latitude| Longitude| Altitude|
VEHICLE_CMD_NAV_TAKEOFF = Simulink.Parameter(22, StorageClass="Const", DataType="uint16")  % # Takeoff from ground / hand |Minimum pitch (if airspeed sensor present), desired pitch without sensor| Empty| Empty| Yaw angle (if magnetometer present), ignored without magnetometer| Latitude| Longitude| Altitude|
VEHICLE_CMD_NAV_PRECLAND = Simulink.Parameter(23, StorageClass="Const", DataType="uint16")  % # Attempt a precision landing
VEHICLE_CMD_DO_ORBIT = Simulink.Parameter(34, StorageClass="Const", DataType="uint16")  % # Start orbiting on the circumference of a circle defined by the parameters. |Radius [m] |Velocity [m/s] |Yaw behaviour |Empty |Latitude/X |Longitude/Y |Altitude/Z |
VEHICLE_CMD_NAV_ROI = Simulink.Parameter(80, StorageClass="Const", DataType="uint16")  % # Sets the region of interest (ROI) for a sensor set or the vehicle itself. This can then be used by the vehicles control system to control the vehicle attitude and the attitude of various sensors such as cameras. |Region of interest mode. (see MAV_ROI enum)| MISSION index/ target ID. (see MAV_ROI enum)| ROI index (allows a vehicle to manage multiple ROI's)| Empty| x the location of the fixed ROI (see MAV_FRAME)| y| z|
VEHICLE_CMD_NAV_PATHPLANNING = Simulink.Parameter(81, StorageClass="Const", DataType="uint16")  % # Control autonomous path planning on the MAV. |0: Disable local obstacle avoidance / local path planning (without resetting map), 1: Enable local path planning, 2: Enable and reset local path planning| 0: Disable full path planning (without resetting map), 1: Enable, 2: Enable and reset map/occupancy grid, 3: Enable and reset planned route, but not occupancy grid| Empty| Yaw angle at goal, in compass degrees, [0..360]| Latitude/X of goal| Longitude/Y of goal| Altitude/Z of goal|
VEHICLE_CMD_NAV_VTOL_TAKEOFF = Simulink.Parameter(84, StorageClass="Const", DataType="uint16")  % # Takeoff from ground / hand and transition to fixed wing |Minimum pitch (if airspeed sensor present), desired pitch without sensor| Empty| Empty| Yaw angle (if magnetometer present), ignored without magnetometer| Latitude| Longitude| Altitude|
VEHICLE_CMD_NAV_VTOL_LAND = Simulink.Parameter(85, StorageClass="Const", DataType="uint16")  % # Transition to MC and land at location |Empty| Empty| Empty| Desired yaw angle.| Latitude| Longitude| Altitude|
VEHICLE_CMD_NAV_GUIDED_LIMITS = Simulink.Parameter(90, StorageClass="Const", DataType="uint16")  % # set limits for external control |timeout - maximum time (in seconds) that external controller will be allowed to control vehicle. 0 means no timeout| absolute altitude min (in meters, AMSL) - if vehicle moves below this alt, the command will be aborted and the mission will continue.  0 means no lower altitude limit| absolute altitude max (in meters)- if vehicle moves above this alt, the command will be aborted and the mission will continue.  0 means no upper altitude limit| horizontal move limit (in meters, AMSL) - if vehicle moves more than this distance from it's location at the moment the command was executed, the command will be aborted and the mission will continue. 0 means no horizontal altitude limit| Empty| Empty| Empty|
VEHICLE_CMD_NAV_GUIDED_MASTER = Simulink.Parameter(91, StorageClass="Const", DataType="uint16")  % # set id of master controller |System ID| Component ID| Empty| Empty| Empty| Empty| Empty|
VEHICLE_CMD_NAV_DELAY = Simulink.Parameter(93, StorageClass="Const", DataType="uint16")  % # Delay the next navigation command a number of seconds or until a specified time |Delay in seconds (decimal, -1 to enable time-of-day fields)| hour (24h format, UTC, -1 to ignore)| minute (24h format, UTC, -1 to ignore)| second (24h format, UTC)| Empty| Empty| Empty|
VEHICLE_CMD_NAV_LAST = Simulink.Parameter(95, StorageClass="Const", DataType="uint16")  % # NOP - This command is only used to mark the upper limit of the NAV/ACTION commands in the enumeration |Empty| Empty| Empty| Empty| Empty| Empty| Empty|
VEHICLE_CMD_CONDITION_DELAY = Simulink.Parameter(112, StorageClass="Const", DataType="uint16")  % # Delay mission state machine. |Delay in seconds (decimal)| Empty| Empty| Empty| Empty| Empty| Empty|
VEHICLE_CMD_CONDITION_CHANGE_ALT = Simulink.Parameter(113, StorageClass="Const", DataType="uint16")  % # Ascend/descend at rate.  Delay mission state machine until desired altitude reached. |Descent / Ascend rate (m/s)| Empty| Empty| Empty| Empty| Empty| Finish Altitude|
VEHICLE_CMD_CONDITION_DISTANCE = Simulink.Parameter(114, StorageClass="Const", DataType="uint16")  % # Delay mission state machine until within desired distance of next NAV point. |Distance (meters)| Empty| Empty| Empty| Empty| Empty| Empty|
VEHICLE_CMD_CONDITION_YAW = Simulink.Parameter(115, StorageClass="Const", DataType="uint16")  % # Reach a certain target angle. |target angle: [0-360], 0 is north| speed during yaw change:[deg per second]| direction: negative: counter clockwise, positive: clockwise [-1,1]| relative offset or absolute angle: [ 1,0]| Empty| Empty| Empty|
VEHICLE_CMD_CONDITION_LAST = Simulink.Parameter(159, StorageClass="Const", DataType="uint16")  % # NOP - This command is only used to mark the upper limit of the CONDITION commands in the enumeration |Empty| Empty| Empty| Empty| Empty| Empty| Empty|
VEHICLE_CMD_CONDITION_GATE = Simulink.Parameter(4501, StorageClass="Const", DataType="uint16")  % # Wait until passing a threshold |2D coord mode: 0: Orthogonal to planned route | Altitude mode: 0: Ignore altitude| Empty| Empty| Lat| Lon| Alt|
VEHICLE_CMD_DO_SET_MODE = Simulink.Parameter(176, StorageClass="Const", DataType="uint16")  % # Set system mode. |Mode, as defined by ENUM MAV_MODE| Empty| Empty| Empty| Empty| Empty| Empty|
VEHICLE_CMD_DO_JUMP = Simulink.Parameter(177, StorageClass="Const", DataType="uint16")  % # Jump to the desired command in the mission list.  Repeat this action only the specified number of times |Sequence number| Repeat count| Empty| Empty| Empty| Empty| Empty|
VEHICLE_CMD_DO_CHANGE_SPEED = Simulink.Parameter(178, StorageClass="Const", DataType="uint16")  % # Change speed and/or throttle set points. |Speed type (0=Airspeed, 1=Ground Speed)| Speed  (m/s, -1 indicates no change)| Throttle  ( Percent, -1 indicates no change)| Empty| Empty| Empty| Empty|
VEHICLE_CMD_DO_SET_HOME = Simulink.Parameter(179, StorageClass="Const", DataType="uint16")  % # Changes the home location either to the current location or a specified location. |Use current (1=use current location, 0=use specified location)| Empty| Empty| Empty| Latitude| Longitude| Altitude|
VEHICLE_CMD_DO_SET_PARAMETER = Simulink.Parameter(180, StorageClass="Const", DataType="uint16")  % # Set a system parameter.  Caution!  Use of this command requires knowledge of the numeric enumeration value of the parameter. |Parameter number| Parameter value| Empty| Empty| Empty| Empty| Empty|
VEHICLE_CMD_DO_SET_RELAY = Simulink.Parameter(181, StorageClass="Const", DataType="uint16")  % # Set a relay to a condition. |Relay number| Setting (1=on, 0=off, others possible depending on system hardware)| Empty| Empty| Empty| Empty| Empty|
VEHICLE_CMD_DO_REPEAT_RELAY = Simulink.Parameter(182, StorageClass="Const", DataType="uint16")  % # Cycle a relay on and off for a desired number of cyles with a desired period. |Relay number| Cycle count| Cycle time (seconds, decimal)| Empty| Empty| Empty| Empty|
VEHICLE_CMD_DO_SET_SERVO = Simulink.Parameter(183, StorageClass="Const", DataType="uint16")  % # Set a servo to a desired PWM value. |Servo number| PWM (microseconds, 1000 to 2000 typical)| Empty| Empty| Empty| Empty| Empty|
VEHICLE_CMD_DO_REPEAT_SERVO = Simulink.Parameter(184, StorageClass="Const", DataType="uint16")  % # Cycle a between its nominal setting and a desired PWM for a desired number of cycles with a desired period. |Servo number| PWM (microseconds, 1000 to 2000 typical)| Cycle count| Cycle time (seconds)| Empty| Empty| Empty|
VEHICLE_CMD_DO_FLIGHTTERMINATION = Simulink.Parameter(185, StorageClass="Const", DataType="uint16")  % # Terminate flight immediately |Flight termination activated if > 0.5| Empty| Empty| Empty| Empty| Empty| Empty|
VEHICLE_CMD_DO_LAND_START = Simulink.Parameter(189, StorageClass="Const", DataType="uint16")  % # Mission command to perform a landing. This is used as a marker in a mission to tell the autopilot where a sequence of mission items that represents a landing starts. It may also be sent via a COMMAND_LONG to trigger a landing, in which case the nearest (geographically) landing sequence in the mission will be used. The Latitude/Longitude is optional, and may be set to 0/0 if not needed. If specified then it will be used to help find the closest landing sequence. |Empty| Empty| Empty| Empty| Latitude| Longitude| Empty|  */
VEHICLE_CMD_DO_GO_AROUND = Simulink.Parameter(191, StorageClass="Const", DataType="uint16")  % # Mission command to safely abort an autonmous landing. |Altitude (meters)| Empty| Empty| Empty| Empty| Empty| Empty|  */
VEHICLE_CMD_DO_REPOSITION = Simulink.Parameter(192, StorageClass="Const", DataType="uint16")
VEHICLE_CMD_DO_PAUSE_CONTINUE = Simulink.Parameter(193, StorageClass="Const", DataType="uint16")
VEHICLE_CMD_DO_SET_ROI_LOCATION = Simulink.Parameter(195, StorageClass="Const", DataType="uint16")  % # Sets the region of interest (ROI) to a location. This can then be used by the vehicles control system to control the vehicle attitude and the attitude of various sensors such as cameras. |Empty| Empty| Empty| Empty| Latitude| Longitude| Altitude|
VEHICLE_CMD_DO_SET_ROI_WPNEXT_OFFSET = Simulink.Parameter(196, StorageClass="Const", DataType="uint16")  % # Sets the region of interest (ROI) to be toward next waypoint, with optional pitch/roll/yaw offset. This can then be used by the vehicles control system to control the vehicle attitude and the attitude of various sensors such as cameras. |Empty| Empty| Empty| Empty| pitch offset from next waypoint| roll offset from next waypoint| yaw offset from next waypoint|
VEHICLE_CMD_DO_SET_ROI_NONE = Simulink.Parameter(197, StorageClass="Const", DataType="uint16")  % # Cancels any previous ROI command returning the vehicle/sensors to default flight characteristics. This can then be used by the vehicles control system to control the vehicle attitude and the attitude of various sensors such as cameras. |Empty| Empty| Empty| Empty| Empty| Empty| Empty|
VEHICLE_CMD_DO_CONTROL_VIDEO = Simulink.Parameter(200, StorageClass="Const", DataType="uint16")  % # Control onboard camera system. |Camera ID (-1 for all)| Transmission: 0: disabled, 1: enabled compressed, 2: enabled raw| Transmission mode: 0: video stream, >0: single images every n seconds (decimal)| Recording: 0: disabled, 1: enabled compressed, 2: enabled raw| Empty| Empty| Empty|
VEHICLE_CMD_DO_SET_ROI = Simulink.Parameter(201, StorageClass="Const", DataType="uint16")  % # Sets the region of interest (ROI) for a sensor set or the vehicle itself. This can then be used by the vehicles control system to control the vehicle attitude and the attitude of various sensors such as cameras. |Region of interest mode. (see MAV_ROI enum)| MISSION index/ target ID. (see MAV_ROI enum)| ROI index (allows a vehicle to manage multiple ROI's)| Empty| x the location of the fixed ROI (see MAV_FRAME)| y| z|
VEHICLE_CMD_DO_DIGICAM_CONTROL = Simulink.Parameter(203, StorageClass="Const", DataType="uint16")
VEHICLE_CMD_DO_MOUNT_CONFIGURE = Simulink.Parameter(204, StorageClass="Const", DataType="uint16")  % # Mission command to configure a camera or antenna mount |Mount operation mode (see MAV_MOUNT_MODE enum)| stabilize roll? (1 = yes, 0 = no)| stabilize pitch? (1 = yes, 0 = no)| stabilize yaw? (1 = yes, 0 = no)| Empty| Empty| Empty|
VEHICLE_CMD_DO_MOUNT_CONTROL = Simulink.Parameter(205, StorageClass="Const", DataType="uint16")  % # Mission command to control a camera or antenna mount |pitch or lat in degrees, depending on mount mode.| roll or lon in degrees depending on mount mode| yaw or alt (in meters) depending on mount mode| reserved| reserved| reserved| MAV_MOUNT_MODE enum value|
VEHICLE_CMD_DO_SET_CAM_TRIGG_DIST = Simulink.Parameter(206, StorageClass="Const", DataType="uint16")  % # Mission command to set TRIG_DIST for this flight |Camera trigger distance (meters)| Shutter integration time (ms)| Empty| Empty| Empty| Empty| Empty|
VEHICLE_CMD_DO_FENCE_ENABLE = Simulink.Parameter(207, StorageClass="Const", DataType="uint16")  % # Mission command to enable the geofence |enable? (0=disable, 1=enable)| Empty| Empty| Empty| Empty| Empty| Empty|
VEHICLE_CMD_DO_PARACHUTE = Simulink.Parameter(208, StorageClass="Const", DataType="uint16")  % # Mission command to trigger a parachute |action (0=disable, 1=enable, 2=release, for some systems see PARACHUTE_ACTION enum, not in general message set.)| Empty| Empty| Empty| Empty| Empty| Empty|
VEHICLE_CMD_DO_MOTOR_TEST = Simulink.Parameter(209, StorageClass="Const", DataType="uint16")  % # motor test command |Instance (1, ...)| throttle type| throttle| timeout [s]| Motor count | Test order| Empty|
VEHICLE_CMD_DO_INVERTED_FLIGHT = Simulink.Parameter(210, StorageClass="Const", DataType="uint16")  % # Change to/from inverted flight |inverted (0=normal, 1=inverted)| Empty| Empty| Empty| Empty| Empty| Empty|
VEHICLE_CMD_DO_SET_CAM_TRIGG_INTERVAL = Simulink.Parameter(214, StorageClass="Const", DataType="uint16")  % # Mission command to set TRIG_INTERVAL for this flight |Camera trigger distance (meters)| Shutter integration time (ms)| Empty| Empty| Empty| Empty| Empty|
VEHICLE_CMD_DO_MOUNT_CONTROL_QUAT = Simulink.Parameter(220, StorageClass="Const", DataType="uint16")  % # Mission command to control a camera or antenna mount, using a quaternion as reference. |q1 - quaternion param #1, w (1 in null-rotation)| q2 - quaternion param #2, x (0 in null-rotation)| q3 - quaternion param #3, y (0 in null-rotation)| q4 - quaternion param #4, z (0 in null-rotation)| Empty| Empty| Empty|
VEHICLE_CMD_DO_GUIDED_MASTER = Simulink.Parameter(221, StorageClass="Const", DataType="uint16")  % # set id of master controller |System ID| Component ID| Empty| Empty| Empty| Empty| Empty|
VEHICLE_CMD_DO_GUIDED_LIMITS = Simulink.Parameter(222, StorageClass="Const", DataType="uint16")  % # set limits for external control |timeout - maximum time (in seconds) that external controller will be allowed to control vehicle. 0 means no timeout| absolute altitude min (in meters, AMSL) - if vehicle moves below this alt, the command will be aborted and the mission will continue.  0 means no lower altitude limit| absolute altitude max (in meters)- if vehicle moves above this alt, the command will be aborted and the mission will continue.  0 means no upper altitude limit| horizontal move limit (in meters, AMSL) - if vehicle moves more than this distance from it's location at the moment the command was executed, the command will be aborted and the mission will continue. 0 means no horizontal altitude limit| Empty| Empty| Empty|
VEHICLE_CMD_DO_LAST = Simulink.Parameter(240, StorageClass="Const", DataType="uint16")  % # NOP - This command is only used to mark the upper limit of the DO commands in the enumeration |Empty| Empty| Empty| Empty| Empty| Empty| Empty|
VEHICLE_CMD_PREFLIGHT_CALIBRATION = Simulink.Parameter(241, StorageClass="Const", DataType="uint16")  % # Trigger calibration. This command will be only accepted if in pre-flight mode. See mavlink spec MAV_CMD_PREFLIGHT_CALIBRATION
PREFLIGHT_CALIBRATION_TEMPERATURE_CALIBRATION = Simulink.Parameter(3, StorageClass="Const", DataType="uint16")  % # param value for VEHICLE_CMD_PREFLIGHT_CALIBRATION to start temperature calibration
VEHICLE_CMD_PREFLIGHT_SET_SENSOR_OFFSETS = Simulink.Parameter(242, StorageClass="Const", DataType="uint16")  % # Set sensor offsets. This command will be only accepted if in pre-flight mode. |Sensor to adjust the offsets for: 0: gyros, 1: accelerometer, 2: magnetometer, 3: barometer, 4: optical flow| X axis offset (or generic dimension 1), in the sensor's raw units| Y axis offset (or generic dimension 2), in the sensor's raw units| Z axis offset (or generic dimension 3), in the sensor's raw units| Generic dimension 4, in the sensor's raw units| Generic dimension 5, in the sensor's raw units| Generic dimension 6, in the sensor's raw units|
VEHICLE_CMD_PREFLIGHT_UAVCAN = Simulink.Parameter(243, StorageClass="Const", DataType="uint16")  % # UAVCAN configuration. If param 1 == 1 actuator mapping and direction assignment should be started
VEHICLE_CMD_PREFLIGHT_STORAGE = Simulink.Parameter(245, StorageClass="Const", DataType="uint16")  % # Request storage of different parameter values and logs. This command will be only accepted if in pre-flight mode. |Parameter storage: 0: READ FROM FLASH/EEPROM, 1: WRITE CURRENT TO FLASH/EEPROM| Mission storage: 0: READ FROM FLASH/EEPROM, 1: WRITE CURRENT TO FLASH/EEPROM| Reserved| Reserved| Empty| Empty| Empty|
VEHICLE_CMD_PREFLIGHT_REBOOT_SHUTDOWN = Simulink.Parameter(246, StorageClass="Const", DataType="uint16")  % # Request the reboot or shutdown of system components. |0: Do nothing for autopilot, 1: Reboot autopilot, 2: Shutdown autopilot.| 0: Do nothing for onboard computer, 1: Reboot onboard computer, 2: Shutdown onboard computer.| Reserved| Reserved| Empty| Empty| Empty|
VEHICLE_CMD_OBLIQUE_SURVEY = Simulink.Parameter(260, StorageClass="Const", DataType="uint16")  % # Mission command to set a Camera Auto Mount Pivoting Oblique Survey for this flight|Camera trigger distance (meters)| Shutter integration time (ms)| Camera minimum trigger interval| Number of positions| Roll| Pitch| Empty|
VEHICLE_CMD_GIMBAL_DEVICE_INFORMATION = Simulink.Parameter(283, StorageClass="Const", DataType="uint16")  % # Command to ask information about a low level gimbal
VEHICLE_CMD_MISSION_START = Simulink.Parameter(300, StorageClass="Const", DataType="uint16")  % # start running a mission |first_item: the first mission item to run| last_item:  the last mission item to run (after this item is run, the mission ends)|
VEHICLE_CMD_COMPONENT_ARM_DISARM = Simulink.Parameter(400, StorageClass="Const", DataType="uint16")  % # Arms / Disarms a component |1 to arm, 0 to disarm|
VEHICLE_CMD_INJECT_FAILURE = Simulink.Parameter(420, StorageClass="Const", DataType="uint16")  % # Inject artificial failure for testing purposes
VEHICLE_CMD_START_RX_PAIR = Simulink.Parameter(500, StorageClass="Const", DataType="uint16")  % # Starts receiver pairing |0:Spektrum| 0:Spektrum DSM2, 1:Spektrum DSMX|
VEHICLE_CMD_REQUEST_MESSAGE = Simulink.Parameter(512, StorageClass="Const", DataType="uint16")  % # Request to send a single instance of the specified message
VEHICLE_CMD_SET_CAMERA_MODE = Simulink.Parameter(530, StorageClass="Const", DataType="uint16")  % # Set camera capture mode (photo, video, etc.)
VEHICLE_CMD_SET_CAMERA_ZOOM = Simulink.Parameter(531, StorageClass="Const", DataType="uint16")  % # Set camera zoom
VEHICLE_CMD_SET_CAMERA_FOCUS = Simulink.Parameter(532, StorageClass="Const", DataType="uint16")
VEHICLE_CMD_DO_GIMBAL_MANAGER_PITCHYAW = Simulink.Parameter(1000, StorageClass="Const", DataType="uint16")  % # Setpoint to be sent to a gimbal manager to set a gimbal pitch and yaw
VEHICLE_CMD_DO_GIMBAL_MANAGER_CONFIGURE = Simulink.Parameter(1001, StorageClass="Const", DataType="uint16")  % # Gimbal configuration to set which sysid/compid is in primary and secondary control
VEHICLE_CMD_DO_TRIGGER_CONTROL = Simulink.Parameter(2003, StorageClass="Const", DataType="uint16")  % # Enable or disable on-board camera triggering system
VEHICLE_CMD_LOGGING_START = Simulink.Parameter(2510, StorageClass="Const", DataType="uint16")  % # start streaming ULog data
VEHICLE_CMD_LOGGING_STOP = Simulink.Parameter(2511, StorageClass="Const", DataType="uint16")  % # stop streaming ULog data
VEHICLE_CMD_CONTROL_HIGH_LATENCY = Simulink.Parameter(2600, StorageClass="Const", DataType="uint16")  % # control starting/stopping transmitting data over the high latency link
VEHICLE_CMD_DO_VTOL_TRANSITION = Simulink.Parameter(3000, StorageClass="Const", DataType="uint16")  % # Command VTOL transition
VEHICLE_CMD_ARM_AUTHORIZATION_REQUEST = Simulink.Parameter(3001, StorageClass="Const", DataType="uint16")  % # Request arm authorization
VEHICLE_CMD_PAYLOAD_PREPARE_DEPLOY = Simulink.Parameter(30001, StorageClass="Const", DataType="uint16")  % # Prepare a payload deployment in the flight plan
VEHICLE_CMD_PAYLOAD_CONTROL_DEPLOY = Simulink.Parameter(30002, StorageClass="Const", DataType="uint16")  % # Control a pre-programmed payload deployment
VEHICLE_CMD_FIXED_MAG_CAL_YAW = Simulink.Parameter(42006, StorageClass="Const", DataType="uint16")  % # Magnetometer calibration based on provided known yaw. This allows for fast calibration using WMM field tables in the vehicle, given only the known yaw of the vehicle. If Latitude and longitude are both zero then use the current vehicle location.
VEHICLE_CMD_PX4_INTERNAL_START = Simulink.Parameter(65537, StorageClass="Const", DataType="uint32")  % # start of PX4 internal only vehicle commands (> UINT16_MAX)
VEHICLE_CMD_SET_GPS_GLOBAL_ORIGIN = Simulink.Parameter(100000, StorageClass="Const", DataType="uint32")  % # Sets the GPS co-ordinates of the vehicle local origin (0,0,0) position. |Empty|Empty|Empty|Empty|Latitude|Longitude|Altitude|
VEHICLE_CMD_RESULT_ACCEPTED = Simulink.Parameter(0, StorageClass="Const", DataType="uint8")  % # Command ACCEPTED and EXECUTED |
VEHICLE_CMD_RESULT_TEMPORARILY_REJECTED = Simulink.Parameter(1, StorageClass="Const", DataType="uint8")  % # Command TEMPORARY REJECTED/DENIED |
VEHICLE_CMD_RESULT_DENIED = Simulink.Parameter(2, StorageClass="Const", DataType="uint8")  % # Command PERMANENTLY DENIED |
VEHICLE_CMD_RESULT_UNSUPPORTED = Simulink.Parameter(3, StorageClass="Const", DataType="uint8")  % # Command UNKNOWN/UNSUPPORTED |
VEHICLE_CMD_RESULT_FAILED = Simulink.Parameter(4, StorageClass="Const", DataType="uint8")  % # Command executed, but failed |
VEHICLE_CMD_RESULT_IN_PROGRESS = Simulink.Parameter(5, StorageClass="Const", DataType="uint8")  % # Command being executed |
VEHICLE_CMD_RESULT_ENUM_END = Simulink.Parameter(6, StorageClass="Const", DataType="uint8")  % #
VEHICLE_MOUNT_MODE_RETRACT = Simulink.Parameter(0, StorageClass="Const", DataType="uint8")  % # Load and keep safe position (Roll,Pitch,Yaw) from permanent memory and stop stabilization |
VEHICLE_MOUNT_MODE_NEUTRAL = Simulink.Parameter(1, StorageClass="Const", DataType="uint8")  % # Load and keep neutral position (Roll,Pitch,Yaw) from permanent memory. |
VEHICLE_MOUNT_MODE_MAVLINK_TARGETING = Simulink.Parameter(2, StorageClass="Const", DataType="uint8")  % # Load neutral position and start MAVLink Roll,Pitch,Yaw control with stabilization |
VEHICLE_MOUNT_MODE_RC_TARGETING = Simulink.Parameter(3, StorageClass="Const", DataType="uint8")  % # Load neutral position and start RC Roll,Pitch,Yaw control with stabilization |
VEHICLE_MOUNT_MODE_GPS_POINT = Simulink.Parameter(4, StorageClass="Const", DataType="uint8")  % # Load neutral position and start to point to Lat,Lon,Alt |
VEHICLE_MOUNT_MODE_ENUM_END = Simulink.Parameter(5, StorageClass="Const", DataType="uint8")  % #
VEHICLE_ROI_NONE = Simulink.Parameter(0, StorageClass="Const", DataType="uint8")  % # No region of interest |
VEHICLE_ROI_WPNEXT = Simulink.Parameter(1, StorageClass="Const", DataType="uint8")  % # Point toward next MISSION |
VEHICLE_ROI_WPINDEX = Simulink.Parameter(2, StorageClass="Const", DataType="uint8")  % # Point toward given MISSION |
VEHICLE_ROI_LOCATION = Simulink.Parameter(3, StorageClass="Const", DataType="uint8")  % # Point toward fixed location |
VEHICLE_ROI_TARGET = Simulink.Parameter(4, StorageClass="Const", DataType="uint8")  % # Point toward target
VEHICLE_ROI_ENUM_END = Simulink.Parameter(5, StorageClass="Const", DataType="uint8")
VEHICLE_CAMERA_ZOOM_TYPE_STEP = Simulink.Parameter(0, StorageClass="Const", DataType="uint8")  % # Zoom one step increment
VEHICLE_CAMERA_ZOOM_TYPE_CONTINUOUS = Simulink.Parameter(1, StorageClass="Const", DataType="uint8")  % # Continuous zoom up/down until stopped
VEHICLE_CAMERA_ZOOM_TYPE_RANGE = Simulink.Parameter(2, StorageClass="Const", DataType="uint8")  % # Zoom value as proportion of full camera range
VEHICLE_CAMERA_ZOOM_TYPE_FOCAL_LENGTH = Simulink.Parameter(3, StorageClass="Const", DataType="uint8")  % # Zoom to a focal length
PARACHUTE_ACTION_DISABLE = Simulink.Parameter(0, StorageClass="Const", DataType="uint8")
PARACHUTE_ACTION_ENABLE = Simulink.Parameter(1, StorageClass="Const", DataType="uint8")
PARACHUTE_ACTION_RELEASE = Simulink.Parameter(2, StorageClass="Const", DataType="uint8")
FAILURE_UNIT_SENSOR_GYRO = Simulink.Parameter(0, StorageClass="Const", DataType="uint8")
FAILURE_UNIT_SENSOR_ACCEL = Simulink.Parameter(1, StorageClass="Const", DataType="uint8")
FAILURE_UNIT_SENSOR_MAG = Simulink.Parameter(2, StorageClass="Const", DataType="uint8")
FAILURE_UNIT_SENSOR_BARO = Simulink.Parameter(3, StorageClass="Const", DataType="uint8")
FAILURE_UNIT_SENSOR_GPS = Simulink.Parameter(4, StorageClass="Const", DataType="uint8")
FAILURE_UNIT_SENSOR_OPTICAL_FLOW = Simulink.Parameter(5, StorageClass="Const", DataType="uint8")
FAILURE_UNIT_SENSOR_VIO = Simulink.Parameter(6, StorageClass="Const", DataType="uint8")
FAILURE_UNIT_SENSOR_DISTANCE_SENSOR = Simulink.Parameter(7, StorageClass="Const", DataType="uint8")
FAILURE_UNIT_SENSOR_AIRSPEED = Simulink.Parameter(8, StorageClass="Const", DataType="uint8")
FAILURE_UNIT_SYSTEM_BATTERY = Simulink.Parameter(100, StorageClass="Const", DataType="uint8")
FAILURE_UNIT_SYSTEM_MOTOR = Simulink.Parameter(101, StorageClass="Const", DataType="uint8")
FAILURE_UNIT_SYSTEM_SERVO = Simulink.Parameter(102, StorageClass="Const", DataType="uint8")
FAILURE_UNIT_SYSTEM_AVOIDANCE = Simulink.Parameter(103, StorageClass="Const", DataType="uint8")
FAILURE_UNIT_SYSTEM_RC_SIGNAL = Simulink.Parameter(104, StorageClass="Const", DataType="uint8")
FAILURE_UNIT_SYSTEM_MAVLINK_SIGNAL = Simulink.Parameter(105, StorageClass="Const", DataType="uint8")
FAILURE_TYPE_OK = Simulink.Parameter(0, StorageClass="Const", DataType="uint8")
FAILURE_TYPE_OFF = Simulink.Parameter(1, StorageClass="Const", DataType="uint8")
FAILURE_TYPE_STUCK = Simulink.Parameter(2, StorageClass="Const", DataType="uint8")
FAILURE_TYPE_GARBAGE = Simulink.Parameter(3, StorageClass="Const", DataType="uint8")
FAILURE_TYPE_WRONG = Simulink.Parameter(4, StorageClass="Const", DataType="uint8")
FAILURE_TYPE_SLOW = Simulink.Parameter(5, StorageClass="Const", DataType="uint8")
FAILURE_TYPE_DELAYED = Simulink.Parameter(6, StorageClass="Const", DataType="uint8")
FAILURE_TYPE_INTERMITTENT = Simulink.Parameter(7, StorageClass="Const", DataType="uint8")

VEHICLE_COMMAND = enum(AddClassNameToEnumNames=true)
  VEHICLE_CMD_CUSTOM_0 = 0  % # test command
  VEHICLE_CMD_CUSTOM_1 = 1  % # test command
  VEHICLE_CMD_CUSTOM_2 = 2  % # test command
  VEHICLE_CMD_NAV_WAYPOINT = 16  % # Navigate to MISSION. |Hold time in decimal seconds. (ignored by fixed wing, time to stay at MISSION for rotary wing)| Acceptance radius in meters (if the sphere with this radius is hit, the MISSION counts as reached)| 0 to pass through the WP, if > 0 radius in meters to pass by WP. Positive value for clockwise orbit, negative value for counter-clockwise orbit. Allows trajectory control.| Desired yaw angle at MISSION (rotary wing)| Latitude| Longitude| Altitude|
  VEHICLE_CMD_NAV_LOITER_UNLIM = 17  % # Loiter around this MISSION an unlimited amount of time |Empty| Empty| Radius around MISSION, in meters. If positive loiter clockwise, else counter-clockwise| Desired yaw angle.| Latitude| Longitude| Altitude|
  VEHICLE_CMD_NAV_LOITER_TURNS = 18  % # Loiter around this MISSION for X turns |Turns| Empty| Radius around MISSION, in meters. If positive loiter clockwise, else counter-clockwise| Desired yaw angle.| Latitude| Longitude| Altitude|
  VEHICLE_CMD_NAV_LOITER_TIME = 19  % # Loiter around this MISSION for X seconds |Seconds (decimal)| Empty| Radius around MISSION, in meters. If positive loiter clockwise, else counter-clockwise| Desired yaw angle.| Latitude| Longitude| Altitude|
  VEHICLE_CMD_NAV_RETURN_TO_LAUNCH = 20  % # Return to launch location |Empty| Empty| Empty| Empty| Empty| Empty| Empty|
  VEHICLE_CMD_NAV_LAND = 21  % # Land at location |Empty| Empty| Empty| Desired yaw angle.| Latitude| Longitude| Altitude|
  VEHICLE_CMD_NAV_TAKEOFF = 22  % # Takeoff from ground / hand |Minimum pitch (if airspeed sensor present), desired pitch without sensor| Empty| Empty| Yaw angle (if magnetometer present), ignored without magnetometer| Latitude| Longitude| Altitude|
  VEHICLE_CMD_NAV_PRECLAND = 23  % # Attempt a precision landing
  VEHICLE_CMD_DO_ORBIT = 34  % # Start orbiting on the circumference of a circle defined by the parameters. |Radius [m] |Velocity [m/s] |Yaw behaviour |Empty |Latitude/X |Longitude/Y |Altitude/Z |
  VEHICLE_CMD_NAV_ROI = 80  % # Sets the region of interest (ROI) for a sensor set or the vehicle itself. This can then be used by the vehicles control system to control the vehicle attitude and the attitude of various sensors such as cameras. |Region of interest mode. (see MAV_ROI enum)| MISSION index/ target ID. (see MAV_ROI enum)| ROI index (allows a vehicle to manage multiple ROI's)| Empty| x the location of the fixed ROI (see MAV_FRAME)| y| z|
  VEHICLE_CMD_NAV_PATHPLANNING = 81  % # Control autonomous path planning on the MAV. |0: Disable local obstacle avoidance / local path planning (without resetting map), 1: Enable local path planning, 2: Enable and reset local path planning| 0: Disable full path planning (without resetting map), 1: Enable, 2: Enable and reset map/occupancy grid, 3: Enable and reset planned route, but not occupancy grid| Empty| Yaw angle at goal, in compass degrees, [0..360]| Latitude/X of goal| Longitude/Y of goal| Altitude/Z of goal|
  VEHICLE_CMD_NAV_VTOL_TAKEOFF = 84  % # Takeoff from ground / hand and transition to fixed wing |Minimum pitch (if airspeed sensor present), desired pitch without sensor| Empty| Empty| Yaw angle (if magnetometer present), ignored without magnetometer| Latitude| Longitude| Altitude|
  VEHICLE_CMD_NAV_VTOL_LAND = 85  % # Transition to MC and land at location |Empty| Empty| Empty| Desired yaw angle.| Latitude| Longitude| Altitude|
  VEHICLE_CMD_NAV_GUIDED_LIMITS = 90  % # set limits for external control |timeout - maximum time (in seconds) that external controller will be allowed to control vehicle. 0 means no timeout| absolute altitude min (in meters, AMSL) - if vehicle moves below this alt, the command will be aborted and the mission will continue.  0 means no lower altitude limit| absolute altitude max (in meters)- if vehicle moves above this alt, the command will be aborted and the mission will continue.  0 means no upper altitude limit| horizontal move limit (in meters, AMSL) - if vehicle moves more than this distance from it's location at the moment the command was executed, the command will be aborted and the mission will continue. 0 means no horizontal altitude limit| Empty| Empty| Empty|
  VEHICLE_CMD_NAV_GUIDED_MASTER = 91  % # set id of master controller |System ID| Component ID| Empty| Empty| Empty| Empty| Empty|
  VEHICLE_CMD_NAV_DELAY = 93  % # Delay the next navigation command a number of seconds or until a specified time |Delay in seconds (decimal, -1 to enable time-of-day fields)| hour (24h format, UTC, -1 to ignore)| minute (24h format, UTC, -1 to ignore)| second (24h format, UTC)| Empty| Empty| Empty|
  VEHICLE_CMD_NAV_LAST = 95  % # NOP - This command is only used to mark the upper limit of the NAV/ACTION commands in the enumeration |Empty| Empty| Empty| Empty| Empty| Empty| Empty|
  VEHICLE_CMD_CONDITION_DELAY = 112  % # Delay mission state machine. |Delay in seconds (decimal)| Empty| Empty| Empty| Empty| Empty| Empty|
  VEHICLE_CMD_CONDITION_CHANGE_ALT = 113  % # Ascend/descend at rate.  Delay mission state machine until desired altitude reached. |Descent / Ascend rate (m/s)| Empty| Empty| Empty| Empty| Empty| Finish Altitude|
  VEHICLE_CMD_CONDITION_DISTANCE = 114  % # Delay mission state machine until within desired distance of next NAV point. |Distance (meters)| Empty| Empty| Empty| Empty| Empty| Empty|
  VEHICLE_CMD_CONDITION_YAW = 115  % # Reach a certain target angle. |target angle: [0-360], 0 is north| speed during yaw change:[deg per second]| direction: negative: counter clockwise, positive: clockwise [-1,1]| relative offset or absolute angle: [ 1,0]| Empty| Empty| Empty|
  VEHICLE_CMD_CONDITION_LAST = 159  % # NOP - This command is only used to mark the upper limit of the CONDITION commands in the enumeration |Empty| Empty| Empty| Empty| Empty| Empty| Empty|
  VEHICLE_CMD_CONDITION_GATE = 4501  % # Wait until passing a threshold |2D coord mode: 0: Orthogonal to planned route | Altitude mode: 0: Ignore altitude| Empty| Empty| Lat| Lon| Alt|
  VEHICLE_CMD_DO_SET_MODE = 176  % # Set system mode. |Mode, as defined by ENUM MAV_MODE| Empty| Empty| Empty| Empty| Empty| Empty|
  VEHICLE_CMD_DO_JUMP = 177  % # Jump to the desired command in the mission list.  Repeat this action only the specified number of times |Sequence number| Repeat count| Empty| Empty| Empty| Empty| Empty|
  VEHICLE_CMD_DO_CHANGE_SPEED = 178  % # Change speed and/or throttle set points. |Speed type (0=Airspeed, 1=Ground Speed)| Speed  (m/s, -1 indicates no change)| Throttle  ( Percent, -1 indicates no change)| Empty| Empty| Empty| Empty|
  VEHICLE_CMD_DO_SET_HOME = 179  % # Changes the home location either to the current location or a specified location. |Use current (1=use current location, 0=use specified location)| Empty| Empty| Empty| Latitude| Longitude| Altitude|
  VEHICLE_CMD_DO_SET_PARAMETER = 180  % # Set a system parameter.  Caution!  Use of this command requires knowledge of the numeric enumeration value of the parameter. |Parameter number| Parameter value| Empty| Empty| Empty| Empty| Empty|
  VEHICLE_CMD_DO_SET_RELAY = 181  % # Set a relay to a condition. |Relay number| Setting (1=on, 0=off, others possible depending on system hardware)| Empty| Empty| Empty| Empty| Empty|
  VEHICLE_CMD_DO_REPEAT_RELAY = 182  % # Cycle a relay on and off for a desired number of cyles with a desired period. |Relay number| Cycle count| Cycle time (seconds, decimal)| Empty| Empty| Empty| Empty|
  VEHICLE_CMD_DO_SET_SERVO = 183  % # Set a servo to a desired PWM value. |Servo number| PWM (microseconds, 1000 to 2000 typical)| Empty| Empty| Empty| Empty| Empty|
  VEHICLE_CMD_DO_REPEAT_SERVO = 184  % # Cycle a between its nominal setting and a desired PWM for a desired number of cycles with a desired period. |Servo number| PWM (microseconds, 1000 to 2000 typical)| Cycle count| Cycle time (seconds)| Empty| Empty| Empty|
  VEHICLE_CMD_DO_FLIGHTTERMINATION = 185  % # Terminate flight immediately |Flight termination activated if > 0.5| Empty| Empty| Empty| Empty| Empty| Empty|
  VEHICLE_CMD_DO_LAND_START = 189  % # Mission command to perform a landing. This is used as a marker in a mission to tell the autopilot where a sequence of mission items that represents a landing starts. It may also be sent via a COMMAND_LONG to trigger a landing, in which case the nearest (geographically) landing sequence in the mission will be used. The Latitude/Longitude is optional, and may be set to 0/0 if not needed. If specified then it will be used to help find the closest landing sequence. |Empty| Empty| Empty| Empty| Latitude| Longitude| Empty|  */
  VEHICLE_CMD_DO_GO_AROUND = 191  % # Mission command to safely abort an autonmous landing. |Altitude (meters)| Empty| Empty| Empty| Empty| Empty| Empty|  */
  VEHICLE_CMD_DO_REPOSITION = 192
  VEHICLE_CMD_DO_PAUSE_CONTINUE = 193
  VEHICLE_CMD_DO_SET_ROI_LOCATION = 195  % # Sets the region of interest (ROI) to a location. This can then be used by the vehicles control system to control the vehicle attitude and the attitude of various sensors such as cameras. |Empty| Empty| Empty| Empty| Latitude| Longitude| Altitude|
  VEHICLE_CMD_DO_SET_ROI_WPNEXT_OFFSET = 196  % # Sets the region of interest (ROI) to be toward next waypoint, with optional pitch/roll/yaw offset. This can then be used by the vehicles control system to control the vehicle attitude and the attitude of various sensors such as cameras. |Empty| Empty| Empty| Empty| pitch offset from next waypoint| roll offset from next waypoint| yaw offset from next waypoint|
  VEHICLE_CMD_DO_SET_ROI_NONE = 197  % # Cancels any previous ROI command returning the vehicle/sensors to default flight characteristics. This can then be used by the vehicles control system to control the vehicle attitude and the attitude of various sensors such as cameras. |Empty| Empty| Empty| Empty| Empty| Empty| Empty|
  VEHICLE_CMD_DO_CONTROL_VIDEO = 200  % # Control onboard camera system. |Camera ID (-1 for all)| Transmission: 0: disabled, 1: enabled compressed, 2: enabled raw| Transmission mode: 0: video stream, >0: single images every n seconds (decimal)| Recording: 0: disabled, 1: enabled compressed, 2: enabled raw| Empty| Empty| Empty|
  VEHICLE_CMD_DO_SET_ROI = 201  % # Sets the region of interest (ROI) for a sensor set or the vehicle itself. This can then be used by the vehicles control system to control the vehicle attitude and the attitude of various sensors such as cameras. |Region of interest mode. (see MAV_ROI enum)| MISSION index/ target ID. (see MAV_ROI enum)| ROI index (allows a vehicle to manage multiple ROI's)| Empty| x the location of the fixed ROI (see MAV_FRAME)| y| z|
  VEHICLE_CMD_DO_DIGICAM_CONTROL = 203
  VEHICLE_CMD_DO_MOUNT_CONFIGURE = 204  % # Mission command to configure a camera or antenna mount |Mount operation mode (see MAV_MOUNT_MODE enum)| stabilize roll? (1 = yes, 0 = no)| stabilize pitch? (1 = yes, 0 = no)| stabilize yaw? (1 = yes, 0 = no)| Empty| Empty| Empty|
  VEHICLE_CMD_DO_MOUNT_CONTROL = 205  % # Mission command to control a camera or antenna mount |pitch or lat in degrees, depending on mount mode.| roll or lon in degrees depending on mount mode| yaw or alt (in meters) depending on mount mode| reserved| reserved| reserved| MAV_MOUNT_MODE enum value|
  VEHICLE_CMD_DO_SET_CAM_TRIGG_DIST = 206  % # Mission command to set TRIG_DIST for this flight |Camera trigger distance (meters)| Shutter integration time (ms)| Empty| Empty| Empty| Empty| Empty|
  VEHICLE_CMD_DO_FENCE_ENABLE = 207  % # Mission command to enable the geofence |enable? (0=disable, 1=enable)| Empty| Empty| Empty| Empty| Empty| Empty|
  VEHICLE_CMD_DO_PARACHUTE = 208  % # Mission command to trigger a parachute |action (0=disable, 1=enable, 2=release, for some systems see PARACHUTE_ACTION enum, not in general message set.)| Empty| Empty| Empty| Empty| Empty| Empty|
  VEHICLE_CMD_DO_MOTOR_TEST = 209  % # motor test command |Instance (1, ...)| throttle type| throttle| timeout [s]| Motor count | Test order| Empty|
  VEHICLE_CMD_DO_INVERTED_FLIGHT = 210  % # Change to/from inverted flight |inverted (0=normal, 1=inverted)| Empty| Empty| Empty| Empty| Empty| Empty|
  VEHICLE_CMD_DO_SET_CAM_TRIGG_INTERVAL = 214  % # Mission command to set TRIG_INTERVAL for this flight |Camera trigger distance (meters)| Shutter integration time (ms)| Empty| Empty| Empty| Empty| Empty|
  VEHICLE_CMD_DO_MOUNT_CONTROL_QUAT = 220  % # Mission command to control a camera or antenna mount, using a quaternion as reference. |q1 - quaternion param #1, w (1 in null-rotation)| q2 - quaternion param #2, x (0 in null-rotation)| q3 - quaternion param #3, y (0 in null-rotation)| q4 - quaternion param #4, z (0 in null-rotation)| Empty| Empty| Empty|
  VEHICLE_CMD_DO_GUIDED_MASTER = 221  % # set id of master controller |System ID| Component ID| Empty| Empty| Empty| Empty| Empty|
  VEHICLE_CMD_DO_GUIDED_LIMITS = 222  % # set limits for external control |timeout - maximum time (in seconds) that external controller will be allowed to control vehicle. 0 means no timeout| absolute altitude min (in meters, AMSL) - if vehicle moves below this alt, the command will be aborted and the mission will continue.  0 means no lower altitude limit| absolute altitude max (in meters)- if vehicle moves above this alt, the command will be aborted and the mission will continue.  0 means no upper altitude limit| horizontal move limit (in meters, AMSL) - if vehicle moves more than this distance from it's location at the moment the command was executed, the command will be aborted and the mission will continue. 0 means no horizontal altitude limit| Empty| Empty| Empty|
  VEHICLE_CMD_DO_LAST = 240  % # NOP - This command is only used to mark the upper limit of the DO commands in the enumeration |Empty| Empty| Empty| Empty| Empty| Empty| Empty|
  VEHICLE_CMD_PREFLIGHT_CALIBRATION = 241  % # Trigger calibration. This command will be only accepted if in pre-flight mode. See mavlink spec MAV_CMD_PREFLIGHT_CALIBRATION
  PREFLIGHT_CALIBRATION_TEMPERATURE_CALIBRATION = 3  % # param value for VEHICLE_CMD_PREFLIGHT_CALIBRATION to start temperature calibration
  VEHICLE_CMD_PREFLIGHT_SET_SENSOR_OFFSETS = 242  % # Set sensor offsets. This command will be only accepted if in pre-flight mode. |Sensor to adjust the offsets for: 0: gyros, 1: accelerometer, 2: magnetometer, 3: barometer, 4: optical flow| X axis offset (or generic dimension 1), in the sensor's raw units| Y axis offset (or generic dimension 2), in the sensor's raw units| Z axis offset (or generic dimension 3), in the sensor's raw units| Generic dimension 4, in the sensor's raw units| Generic dimension 5, in the sensor's raw units| Generic dimension 6, in the sensor's raw units|
  VEHICLE_CMD_PREFLIGHT_UAVCAN = 243  % # UAVCAN configuration. If param 1 == 1 actuator mapping and direction assignment should be started
  VEHICLE_CMD_PREFLIGHT_STORAGE = 245  % # Request storage of different parameter values and logs. This command will be only accepted if in pre-flight mode. |Parameter storage: 0: READ FROM FLASH/EEPROM, 1: WRITE CURRENT TO FLASH/EEPROM| Mission storage: 0: READ FROM FLASH/EEPROM, 1: WRITE CURRENT TO FLASH/EEPROM| Reserved| Reserved| Empty| Empty| Empty|
  VEHICLE_CMD_PREFLIGHT_REBOOT_SHUTDOWN = 246  % # Request the reboot or shutdown of system components. |0: Do nothing for autopilot, 1: Reboot autopilot, 2: Shutdown autopilot.| 0: Do nothing for onboard computer, 1: Reboot onboard computer, 2: Shutdown onboard computer.| Reserved| Reserved| Empty| Empty| Empty|
  VEHICLE_CMD_OBLIQUE_SURVEY = 260  % # Mission command to set a Camera Auto Mount Pivoting Oblique Survey for this flight|Camera trigger distance (meters)| Shutter integration time (ms)| Camera minimum trigger interval| Number of positions| Roll| Pitch| Empty|
  VEHICLE_CMD_GIMBAL_DEVICE_INFORMATION = 283  % # Command to ask information about a low level gimbal
  VEHICLE_CMD_MISSION_START = 300  % # start running a mission |first_item: the first mission item to run| last_item:  the last mission item to run (after this item is run, the mission ends)|
  VEHICLE_CMD_COMPONENT_ARM_DISARM = 400  % # Arms / Disarms a component |1 to arm, 0 to disarm|
  VEHICLE_CMD_INJECT_FAILURE = 420  % # Inject artificial failure for testing purposes
  VEHICLE_CMD_START_RX_PAIR = 500  % # Starts receiver pairing |0:Spektrum| 0:Spektrum DSM2, 1:Spektrum DSMX|
  VEHICLE_CMD_REQUEST_MESSAGE = 512  % # Request to send a single instance of the specified message
  VEHICLE_CMD_SET_CAMERA_MODE = 530  % # Set camera capture mode (photo, video, etc.)
  VEHICLE_CMD_SET_CAMERA_ZOOM = 531  % # Set camera zoom
  VEHICLE_CMD_SET_CAMERA_FOCUS = 532
  VEHICLE_CMD_DO_GIMBAL_MANAGER_PITCHYAW = 1000  % # Setpoint to be sent to a gimbal manager to set a gimbal pitch and yaw
  VEHICLE_CMD_DO_GIMBAL_MANAGER_CONFIGURE = 1001  % # Gimbal configuration to set which sysid/compid is in primary and secondary control
  VEHICLE_CMD_DO_TRIGGER_CONTROL = 2003  % # Enable or disable on-board camera triggering system
  VEHICLE_CMD_LOGGING_START = 2510  % # start streaming ULog data
  VEHICLE_CMD_LOGGING_STOP = 2511  % # stop streaming ULog data
  VEHICLE_CMD_CONTROL_HIGH_LATENCY = 2600  % # control starting/stopping transmitting data over the high latency link
  VEHICLE_CMD_DO_VTOL_TRANSITION = 3000  % # Command VTOL transition
  VEHICLE_CMD_ARM_AUTHORIZATION_REQUEST = 3001  % # Request arm authorization
  VEHICLE_CMD_PAYLOAD_PREPARE_DEPLOY = 30001  % # Prepare a payload deployment in the flight plan
  VEHICLE_CMD_PAYLOAD_CONTROL_DEPLOY = 30002  % # Control a pre-programmed payload deployment
  VEHICLE_CMD_FIXED_MAG_CAL_YAW = 42006  % # Magnetometer calibration based on provided known yaw. This allows for fast calibration using WMM field tables in the vehicle, given only the known yaw of the vehicle. If Latitude and longitude are both zero then use the current vehicle location.
  VEHICLE_CMD_PX4_INTERNAL_START = 65537  % # start of PX4 internal only vehicle commands (> UINT16_MAX)
  VEHICLE_CMD_SET_GPS_GLOBAL_ORIGIN = 100000  % # Sets the GPS co-ordinates of the vehicle local origin (0,0,0) position. |Empty|Empty|Empty|Empty|Latitude|Longitude|Altitude|
  VEHICLE_CMD_RESULT_ACCEPTED = 0  % # Command ACCEPTED and EXECUTED |
  VEHICLE_CMD_RESULT_TEMPORARILY_REJECTED = 1  % # Command TEMPORARY REJECTED/DENIED |
  VEHICLE_CMD_RESULT_DENIED = 2  % # Command PERMANENTLY DENIED |
  VEHICLE_CMD_RESULT_UNSUPPORTED = 3  % # Command UNKNOWN/UNSUPPORTED |
  VEHICLE_CMD_RESULT_FAILED = 4  % # Command executed, but failed |
  VEHICLE_CMD_RESULT_IN_PROGRESS = 5  % # Command being executed |
  VEHICLE_CMD_RESULT_ENUM_END = 6  % #
  VEHICLE_MOUNT_MODE_RETRACT = 0  % # Load and keep safe position (Roll,Pitch,Yaw) from permanent memory and stop stabilization |
  VEHICLE_MOUNT_MODE_NEUTRAL = 1  % # Load and keep neutral position (Roll,Pitch,Yaw) from permanent memory. |
  VEHICLE_MOUNT_MODE_MAVLINK_TARGETING = 2  % # Load neutral position and start MAVLink Roll,Pitch,Yaw control with stabilization |
  VEHICLE_MOUNT_MODE_RC_TARGETING = 3  % # Load neutral position and start RC Roll,Pitch,Yaw control with stabilization |
  VEHICLE_MOUNT_MODE_GPS_POINT = 4  % # Load neutral position and start to point to Lat,Lon,Alt |
  VEHICLE_MOUNT_MODE_ENUM_END = 5  % #
  VEHICLE_ROI_NONE = 0  % # No region of interest |
  VEHICLE_ROI_WPNEXT = 1  % # Point toward next MISSION |
  VEHICLE_ROI_WPINDEX = 2  % # Point toward given MISSION |
  VEHICLE_ROI_LOCATION = 3  % # Point toward fixed location |
  VEHICLE_ROI_TARGET = 4  % # Point toward target
  VEHICLE_ROI_ENUM_END = 5
  VEHICLE_CAMERA_ZOOM_TYPE_STEP = 0  % # Zoom one step increment
  VEHICLE_CAMERA_ZOOM_TYPE_CONTINUOUS = 1  % # Continuous zoom up/down until stopped
  VEHICLE_CAMERA_ZOOM_TYPE_RANGE = 2  % # Zoom value as proportion of full camera range
  VEHICLE_CAMERA_ZOOM_TYPE_FOCAL_LENGTH = 3  % # Zoom to a focal length
  PARACHUTE_ACTION_DISABLE = 0
  PARACHUTE_ACTION_ENABLE = 1
  PARACHUTE_ACTION_RELEASE = 2
  FAILURE_UNIT_SENSOR_GYRO = 0
  FAILURE_UNIT_SENSOR_ACCEL = 1
  FAILURE_UNIT_SENSOR_MAG = 2
  FAILURE_UNIT_SENSOR_BARO = 3
  FAILURE_UNIT_SENSOR_GPS = 4
  FAILURE_UNIT_SENSOR_OPTICAL_FLOW = 5
  FAILURE_UNIT_SENSOR_VIO = 6
  FAILURE_UNIT_SENSOR_DISTANCE_SENSOR = 7
  FAILURE_UNIT_SENSOR_AIRSPEED = 8
  FAILURE_UNIT_SYSTEM_BATTERY = 100
  FAILURE_UNIT_SYSTEM_MOTOR = 101
  FAILURE_UNIT_SYSTEM_SERVO = 102
  FAILURE_UNIT_SYSTEM_AVOIDANCE = 103
  FAILURE_UNIT_SYSTEM_RC_SIGNAL = 104
  FAILURE_UNIT_SYSTEM_MAVLINK_SIGNAL = 105
  FAILURE_TYPE_OK = 0
  FAILURE_TYPE_OFF = 1
  FAILURE_TYPE_STUCK = 2
  FAILURE_TYPE_GARBAGE = 3
  FAILURE_TYPE_WRONG = 4
  FAILURE_TYPE_SLOW = 5
  FAILURE_TYPE_DELAYED = 6
  FAILURE_TYPE_INTERMITTENT = 7
  ORB_QUEUE_LENGTH = 8

vehicle_command_ack_s = Simulink.Bus()
  timestamp: uint64  % # time since system start (microseconds)
  command: uint32
  result: uint8
  from_external: boolean
  result_param1: uint8
  result_param2: int32
  target_system: uint8
  target_component: uint8

VEHICLE_RESULT_ACCEPTED = Simulink.Parameter(0, StorageClass="Const", DataType="uint8")
VEHICLE_RESULT_TEMPORARILY_REJECTED = Simulink.Parameter(1, StorageClass="Const", DataType="uint8")
VEHICLE_RESULT_DENIED = Simulink.Parameter(2, StorageClass="Const", DataType="uint8")
VEHICLE_RESULT_UNSUPPORTED = Simulink.Parameter(3, StorageClass="Const", DataType="uint8")
VEHICLE_RESULT_FAILED = Simulink.Parameter(4, StorageClass="Const", DataType="uint8")
VEHICLE_RESULT_IN_PROGRESS = Simulink.Parameter(5, StorageClass="Const", DataType="uint8")
ARM_AUTH_DENIED_REASON_GENERIC = Simulink.Parameter(0, StorageClass="Const", DataType="uint16")
ARM_AUTH_DENIED_REASON_NONE = Simulink.Parameter(1, StorageClass="Const", DataType="uint16")
ARM_AUTH_DENIED_REASON_INVALID_WAYPOINT = Simulink.Parameter(2, StorageClass="Const", DataType="uint16")
ARM_AUTH_DENIED_REASON_TIMEOUT = Simulink.Parameter(3, StorageClass="Const", DataType="uint16")
ARM_AUTH_DENIED_REASON_AIRSPACE_IN_USE = Simulink.Parameter(4, StorageClass="Const", DataType="uint16")
ARM_AUTH_DENIED_REASON_BAD_WEATHER = Simulink.Parameter(5, StorageClass="Const", DataType="uint16")

VEHICLE_COMMAND_ACK = enum(AddClassNameToEnumNames=true)
  VEHICLE_RESULT_ACCEPTED = 0
  VEHICLE_RESULT_TEMPORARILY_REJECTED = 1
  VEHICLE_RESULT_DENIED = 2
  VEHICLE_RESULT_UNSUPPORTED = 3
  VEHICLE_RESULT_FAILED = 4
  VEHICLE_RESULT_IN_PROGRESS = 5
  ARM_AUTH_DENIED_REASON_GENERIC = 0
  ARM_AUTH_DENIED_REASON_NONE = 1
  ARM_AUTH_DENIED_REASON_INVALID_WAYPOINT = 2
  ARM_AUTH_DENIED_REASON_TIMEOUT = 3
  ARM_AUTH_DENIED_REASON_AIRSPACE_IN_USE = 4
  ARM_AUTH_DENIED_REASON_BAD_WEATHER = 5
  ORB_QUEUE_LENGTH = 4

vehicle_constraints_s = Simulink.Bus()
  timestamp: uint64  % # time since system start (microseconds)
  speed_xy: single  % # in meters/sec
  speed_up: single  % # in meters/sec
  speed_down: single  % # in meters/sec
  want_takeoff: boolean  % # tell the controller to initiate takeoff when idling (ignored during flight)

vehicle_control_mode_s = Simulink.Bus()
  timestamp: uint64  % # time since system start (microseconds)
  flag_armed: boolean  % # synonym for actuator_armed.armed
  flag_external_manual_override_ok: boolean  % # external override non-fatal for system. Only true for fixed wing
  flag_multicopter_position_control_enabled: boolean
  flag_control_manual_enabled: boolean  % # true if manual input is mixed in
  flag_control_auto_enabled: boolean  % # true if onboard autopilot should act
  flag_control_offboard_enabled: boolean  % # true if offboard control should be used
  flag_control_rates_enabled: boolean  % # true if rates are stabilized
  flag_control_attitude_enabled: boolean  % # true if attitude stabilization is mixed in
  flag_control_acceleration_enabled: boolean  % # true if acceleration is controlled
  flag_control_velocity_enabled: boolean  % # true if horizontal velocity (implies direction) is controlled
  flag_control_position_enabled: boolean  % # true if position is controlled
  flag_control_altitude_enabled: boolean  % # true if altitude is controlled
  flag_control_climb_rate_enabled: boolean  % # true if climb rate is controlled
  flag_control_termination_enabled: boolean  % # true if flighttermination is enabled

estimator_global_position_s = Simulink.Bus()
  timestamp: uint64  % # time since system start (microseconds)
  timestamp_sample: uint64  % # the timestamp of the raw data (microseconds)
  lat: double  % # Latitude, (degrees)
  lon: double  % # Longitude, (degrees)
  alt: single  % # Altitude AMSL, (meters)
  alt_ellipsoid: single  % # Altitude above ellipsoid, (meters)
  delta_alt: single  % # Reset delta for altitude
  lat_lon_reset_counter: uint8  % # Counter for reset events on horizontal position coordinates
  alt_reset_counter: uint8  % # Counter for reset events on altitude
  eph: single  % # Standard deviation of horizontal position error, (metres)
  epv: single  % # Standard deviation of vertical position error, (metres)
  terrain_alt: single  % # Terrain altitude WGS84, (metres)
  terrain_alt_valid: boolean  % # Terrain altitude estimate is valid
  dead_reckoning: boolean  % # True if this position is estimated through dead-reckoning

vehicle_gps_position_s = Simulink.Bus()
  timestamp: uint64  % # time since system start (microseconds)
  lat: int32  % # Latitude in 1E-7 degrees
  lon: int32  % # Longitude in 1E-7 degrees
  alt: int32  % # Altitude in 1E-3 meters above MSL, (millimetres)
  alt_ellipsoid: int32  % # Altitude in 1E-3 meters bove Ellipsoid, (millimetres)
  s_variance_m_s: single  % # GPS speed accuracy estimate, (metres/sec)
  c_variance_rad: single  % # GPS course accuracy estimate, (radians)
  fix_type: uint8  % # 0-1: no fix, 2: 2D fix, 3: 3D fix, 4: RTCM code differential, 5: Real-Time Kinematic, float, 6: Real-Time Kinematic, fixed, 8: Extrapolated. Some applications will not use the value of this field unless it is at least two, so always correctly fill in the fix.
  eph: single  % # GPS horizontal position accuracy (metres)
  epv: single  % # GPS vertical position accuracy (metres)
  hdop: single  % # Horizontal dilution of precision
  vdop: single  % # Vertical dilution of precision
  noise_per_ms: int32  % # GPS noise per millisecond
  jamming_indicator: int32  % # indicates jamming is occurring
  jamming_state: uint8  % # indicates whether jamming has been detected or suspected by the receivers. O: Unknown, 1: OK, 2: Warning, 3: Critical
  vel_m_s: single  % # GPS ground speed, (metres/sec)
  vel_n_m_s: single  % # GPS North velocity, (metres/sec)
  vel_e_m_s: single  % # GPS East velocity, (metres/sec)
  vel_d_m_s: single  % # GPS Down velocity, (metres/sec)
  cog_rad: single  % # Course over ground (NOT heading, but direction of movement), -PI..PI, (radians)
  vel_ned_valid: boolean  % # True if NED velocity is valid
  timestamp_time_relative: int32  % # timestamp + timestamp_time_relative = Time of the UTC timestamp since system start, (microseconds)
  time_utc_usec: uint64  % # Timestamp (microseconds, UTC), this is the timestamp which comes from the gps module. It might be unavailable right after cold start, indicated by a value of 0
  satellites_used: uint8  % # Number of satellites used
  heading: single  % # heading angle of XYZ body frame rel to NED. Set to NaN if not available and updated (used for dual antenna GPS), (rad, [-PI, PI])
  heading_offset: single  % # heading offset of dual antenna array in body frame. Set to NaN if not applicable. (rad, [-PI, PI])
  selected: uint8  % # GPS selection: 0: GPS1, 1: GPS2. 2: GPS3. 3. Blending multiple receivers

vehicle_imu_s = Simulink.Bus()
  timestamp: uint64  % # time since system start (microseconds)
  timestamp_sample: uint64
  accel_device_id: uint32  % # Accelerometer unique device ID for the sensor that does not change between power cycles
  gyro_device_id: uint32  % # Gyroscope unique device ID for the sensor that does not change between power cycles
  delta_angle: single[3]  % # delta angle about the FRD body frame XYZ-axis in rad over the integration time frame (delta_angle_dt)
  delta_velocity: single[3]  % # delta velocity in the FRD body frame XYZ-axis in m/s over the integration time frame (delta_velocity_dt)
  delta_angle_dt: uint16  % # integration period in microseconds
  delta_velocity_dt: uint16  % # integration period in microseconds
  delta_velocity_clipping: uint8  % # bitfield indicating if there was any accelerometer clipping (per axis) during the integration time frame
  calibration_count: uint8  % # Calibration changed counter. Monotonically increases whenever calibration changes.

VEHICLE_IMU = enum(AddClassNameToEnumNames=true)
  CLIPPING_X = 1
  CLIPPING_Y = 2
  CLIPPING_Z = 4

vehicle_imu_status_s = Simulink.Bus()
  timestamp: uint64  % # time since system start (microseconds)
  accel_device_id: uint32  % # unique device ID for the sensor that does not change between power cycles
  gyro_device_id: uint32  % # unique device ID for the sensor that does not change between power cycles
  accel_clipping: uint32[3]  % # total clipping per axis
  accel_error_count: uint32
  gyro_error_count: uint32
  accel_rate_hz: single
  gyro_rate_hz: single
  accel_raw_rate_hz: single  % # full raw sensor sample rate (Hz)
  gyro_raw_rate_hz: single  % # full raw sensor sample rate (Hz)
  accel_vibration_metric: single  % # high frequency vibration level in the IMU delta velocity data (m/s)
  gyro_vibration_metric: single  % # high frequency vibration level in the IMU delta velocity data (m/s)
  gyro_coning_vibration: single  % # Level of coning vibration in the IMU delta angles (rad^2)
  mean_accel: single[3]  % # average accelerometer readings since last publication
  mean_gyro: single[3]  % # average gyroscope readings since last publication
  temperature_accel: single
  temperature_gyro: single

vehicle_land_detected_s = Simulink.Bus()
  timestamp: uint64  % # time since system start (microseconds)
  alt_max: single  % # maximum altitude in [m] that can be reached
  freefall: boolean  % # true if vehicle is currently in free-fall
  ground_contact: boolean  % # true if vehicle has ground contact but is not landed (1. stage)
  maybe_landed: boolean  % # true if the vehicle might have landed (2. stage)
  landed: boolean  % # true if vehicle is currently landed on the ground (3. stage)
  in_ground_effect: boolean  % # indicates if from the perspective of the landing detector the vehicle might be in ground effect (baro). This flag will become true if the vehicle is not moving horizontally and is descending (crude assumption that user is landing).
  in_descend: boolean
  has_low_throttle: boolean
  vertical_movement: boolean
  horizontal_movement: boolean
  close_to_ground_or_skipped_check: boolean

estimator_local_position_s = Simulink.Bus()
  timestamp: uint64  % # time since system start (microseconds)
  timestamp_sample: uint64  % # the timestamp of the raw data (microseconds)
  xy_valid: boolean  % # true if x and y are valid
  z_valid: boolean  % # true if z is valid
  v_xy_valid: boolean  % # true if vy and vy are valid
  v_z_valid: boolean  % # true if vz is valid
  x: single  % # North position in NED earth-fixed frame, (metres)
  y: single  % # East position in NED earth-fixed frame, (metres)
  z: single  % # Down position (negative altitude) in NED earth-fixed frame, (metres)
  delta_xy: single[2]
  xy_reset_counter: uint8
  delta_z: single
  z_reset_counter: uint8
  vx: single  % # North velocity in NED earth-fixed frame, (metres/sec)
  vy: single  % # East velocity in NED earth-fixed frame, (metres/sec)
  vz: single  % # Down velocity in NED earth-fixed frame, (metres/sec)
  z_deriv: single  % # Down position time derivative in NED earth-fixed frame, (metres/sec)
  delta_vxy: single[2]
  vxy_reset_counter: uint8
  delta_vz: single
  vz_reset_counter: uint8
  ax: single  % # North velocity derivative in NED earth-fixed frame, (metres/sec^2)
  ay: single  % # East velocity derivative in NED earth-fixed frame, (metres/sec^2)
  az: single  % # Down velocity derivative in NED earth-fixed frame, (metres/sec^2)
  heading: single  % # Euler yaw angle transforming the tangent plane relative to NED earth-fixed frame, -PI..+PI,  (radians)
  delta_heading: single
  heading_reset_counter: uint8
  xy_global: boolean  % # true if position (x, y) has a valid global reference (ref_lat, ref_lon)
  z_global: boolean  % # true if z has a valid global reference (ref_alt)
  ref_timestamp: uint64  % # Time when reference position was set since system start, (microseconds)
  ref_lat: double  % # Reference point latitude, (degrees)
  ref_lon: double  % # Reference point longitude, (degrees)
  ref_alt: single  % # Reference altitude AMSL, (metres)
  dist_bottom: single  % # Distance from from bottom surface to ground, (metres)
  dist_bottom_valid: boolean  % # true if distance to bottom surface is valid
  dist_bottom_sensor_bitfield: uint8  % # bitfield indicating what type of sensor is used to estimate dist_bottom
  eph: single  % # Standard deviation of horizontal position error, (metres)
  epv: single  % # Standard deviation of vertical position error, (metres)
  evh: single  % # Standard deviation of horizontal velocity error, (metres/sec)
  evv: single  % # Standard deviation of horizontal velocity error, (metres/sec)
  vxy_max: single  % # maximum horizontal speed - set to 0 when limiting not required (meters/sec)
  vz_max: single  % # maximum vertical speed - set to 0 when limiting not required (meters/sec)
  hagl_min: single  % # minimum height above ground level - set to 0 when limiting not required (meters)
  hagl_max: single  % # maximum height above ground level - set to 0 when limiting not required (meters)

DIST_BOTTOM_SENSOR_NONE = Simulink.Parameter(0, StorageClass="Const", DataType="uint8")
DIST_BOTTOM_SENSOR_RANGE = Simulink.Parameter(1, StorageClass="Const", DataType="uint8")  % # (1 << 0) a range sensor is used to estimate dist_bottom field
DIST_BOTTOM_SENSOR_FLOW = Simulink.Parameter(2, StorageClass="Const", DataType="uint8")  % # (1 << 1) a flow sensor is used to estimate dist_bottom field (mostly fixed-wing use case)

VEHICLE_LOCAL_POSITION = enum(AddClassNameToEnumNames=true)
  DIST_BOTTOM_SENSOR_NONE = 0
  DIST_BOTTOM_SENSOR_RANGE = 1  % # (1 << 0) a range sensor is used to estimate dist_bottom field
  DIST_BOTTOM_SENSOR_FLOW = 2  % # (1 << 1) a flow sensor is used to estimate dist_bottom field (mostly fixed-wing use case)

vehicle_local_position_setpoint_s = Simulink.Bus()
  timestamp: uint64  % # time since system start (microseconds)
  x: single  % # in meters NED
  y: single  % # in meters NED
  z: single  % # in meters NED
  yaw: single  % # in radians NED -PI..+PI
  yawspeed: single  % # in radians/sec
  vx: single  % # in meters/sec
  vy: single  % # in meters/sec
  vz: single  % # in meters/sec
  acceleration: single[3]  % # in meters/sec^2
  jerk: single[3]  % # in meters/sec^3
  thrust: single[3]  % # normalized thrust vector in NED

trajectory_setpoint_s = Simulink.Bus()
  timestamp: uint64  % # time since system start (microseconds)
  x: single  % # in meters NED
  y: single  % # in meters NED
  z: single  % # in meters NED
  yaw: single  % # in radians NED -PI..+PI
  yawspeed: single  % # in radians/sec
  vx: single  % # in meters/sec
  vy: single  % # in meters/sec
  vz: single  % # in meters/sec
  acceleration: single[3]  % # in meters/sec^2
  jerk: single[3]  % # in meters/sec^3
  thrust: single[3]  % # normalized thrust vector in NED

vehicle_magnetometer_s = Simulink.Bus()
  timestamp: uint64  % # time since system start (microseconds)
  timestamp_sample: uint64  % # the timestamp of the raw data (microseconds)
  device_id: uint32  % # unique device ID for the selected magnetometer
  magnetometer_ga: single[3]  % # Magnetic field in the FRD body frame XYZ-axis in Gauss
  calibration_count: uint8  % # Calibration changed counter. Monotonically increases whenever calibration changes.

estimator_odometry_s = Simulink.Bus()
  timestamp: uint64  % # time since system start (microseconds)
  timestamp_sample: uint64
  local_frame: uint8
  x: single  % # North position
  y: single  % # East position
  z: single  % # Down position
  q: single[4]  % # Quaternion rotation from FRD body frame to refernce frame
  q_offset: single[4]  % # Quaternion rotation from odometry reference frame to navigation frame
  pose_covariance: single[21]
  velocity_frame: uint8
  vx: single  % # North velocity
  vy: single  % # East velocity
  vz: single  % # Down velocity
  rollspeed: single  % # Angular velocity about X body axis
  pitchspeed: single  % # Angular velocity about Y body axis
  yawspeed: single  % # Angular velocity about Z body axis
  velocity_covariance: single[21]

estimator_visual_odometry_aligned_s = Simulink.Bus()
  timestamp: uint64  % # time since system start (microseconds)
  timestamp_sample: uint64
  local_frame: uint8
  x: single  % # North position
  y: single  % # East position
  z: single  % # Down position
  q: single[4]  % # Quaternion rotation from FRD body frame to refernce frame
  q_offset: single[4]  % # Quaternion rotation from odometry reference frame to navigation frame
  pose_covariance: single[21]
  velocity_frame: uint8
  vx: single  % # North velocity
  vy: single  % # East velocity
  vz: single  % # Down velocity
  rollspeed: single  % # Angular velocity about X body axis
  pitchspeed: single  % # Angular velocity about Y body axis
  yawspeed: single  % # Angular velocity about Z body axis
  velocity_covariance: single[21]

COVARIANCE_MATRIX_X_VARIANCE = Simulink.Parameter(0, StorageClass="Const", DataType="uint8")
COVARIANCE_MATRIX_Y_VARIANCE = Simulink.Parameter(6, StorageClass="Const", DataType="uint8")
COVARIANCE_MATRIX_Z_VARIANCE = Simulink.Parameter(11, StorageClass="Const", DataType="uint8")
COVARIANCE_MATRIX_ROLL_VARIANCE = Simulink.Parameter(15, StorageClass="Const", DataType="uint8")
COVARIANCE_MATRIX_PITCH_VARIANCE = Simulink.Parameter(18, StorageClass="Const", DataType="uint8")
COVARIANCE_MATRIX_YAW_VARIANCE = Simulink.Parameter(20, StorageClass="Const", DataType="uint8")
COVARIANCE_MATRIX_VX_VARIANCE = Simulink.Parameter(0, StorageClass="Const", DataType="uint8")
COVARIANCE_MATRIX_VY_VARIANCE = Simulink.Parameter(6, StorageClass="Const", DataType="uint8")
COVARIANCE_MATRIX_VZ_VARIANCE = Simulink.Parameter(11, StorageClass="Const", DataType="uint8")
COVARIANCE_MATRIX_ROLLRATE_VARIANCE = Simulink.Parameter(15, StorageClass="Const", DataType="uint8")
COVARIANCE_MATRIX_PITCHRATE_VARIANCE = Simulink.Parameter(18, StorageClass="Const", DataType="uint8")
COVARIANCE_MATRIX_YAWRATE_VARIANCE = Simulink.Parameter(20, StorageClass="Const", DataType="uint8")
LOCAL_FRAME_NED = Simulink.Parameter(0, StorageClass="Const", DataType="uint8")  % # NED earth-fixed frame
LOCAL_FRAME_FRD = Simulink.Parameter(1, StorageClass="Const", DataType="uint8")  % # FRD earth-fixed frame, arbitrary heading reference
LOCAL_FRAME_OTHER = Simulink.Parameter(2, StorageClass="Const", DataType="uint8")  % # Not aligned with the std frames of reference
BODY_FRAME_FRD = Simulink.Parameter(3, StorageClass="Const", DataType="uint8")  % # FRD body-fixed frame

VEHICLE_ODOMETRY = enum(AddClassNameToEnumNames=true)
  COVARIANCE_MATRIX_X_VARIANCE = 0
  COVARIANCE_MATRIX_Y_VARIANCE = 6
  COVARIANCE_MATRIX_Z_VARIANCE = 11
  COVARIANCE_MATRIX_ROLL_VARIANCE = 15
  COVARIANCE_MATRIX_PITCH_VARIANCE = 18
  COVARIANCE_MATRIX_YAW_VARIANCE = 20
  COVARIANCE_MATRIX_VX_VARIANCE = 0
  COVARIANCE_MATRIX_VY_VARIANCE = 6
  COVARIANCE_MATRIX_VZ_VARIANCE = 11
  COVARIANCE_MATRIX_ROLLRATE_VARIANCE = 15
  COVARIANCE_MATRIX_PITCHRATE_VARIANCE = 18
  COVARIANCE_MATRIX_YAWRATE_VARIANCE = 20
  LOCAL_FRAME_NED = 0  % # NED earth-fixed frame
  LOCAL_FRAME_FRD = 1  % # FRD earth-fixed frame, arbitrary heading reference
  LOCAL_FRAME_OTHER = 2  % # Not aligned with the std frames of reference
  BODY_FRAME_FRD = 3  % # FRD body-fixed frame

vehicle_rates_setpoint_s = Simulink.Bus()
  timestamp: uint64  % # time since system start (microseconds)
  roll: single  % # body angular rates in NED frame
  pitch: single  % # body angular rates in NED frame
  yaw: single  % # body angular rates in NED frame
  thrust_body: single[3]  % # Normalized thrust command in body NED frame [-1,1]

vehicle_roi_s = Simulink.Bus()
  timestamp: uint64  % # time since system start (microseconds)
  mode: uint8  % # ROI mode (see above)
  lat: double  % # Latitude to point to
  lon: double  % # Longitude to point to
  alt: single  % # Altitude to point to
  roll_offset: single  % # angle offset in rad
  pitch_offset: single  % # angle offset in rad
  yaw_offset: single  % # angle offset in rad

ROI_NONE = Simulink.Parameter(0, StorageClass="Const", DataType="uint8")  % # No region of interest
ROI_WPNEXT = Simulink.Parameter(1, StorageClass="Const", DataType="uint8")  % # Point toward next MISSION with optional offset
ROI_WPINDEX = Simulink.Parameter(2, StorageClass="Const", DataType="uint8")  % # Point toward given MISSION
ROI_LOCATION = Simulink.Parameter(3, StorageClass="Const", DataType="uint8")  % # Point toward fixed location
ROI_TARGET = Simulink.Parameter(4, StorageClass="Const", DataType="uint8")  % # Point toward target
ROI_ENUM_END = Simulink.Parameter(5, StorageClass="Const", DataType="uint8")

VEHICLE_ROI = enum(AddClassNameToEnumNames=true)
  ROI_NONE = 0  % # No region of interest
  ROI_WPNEXT = 1  % # Point toward next MISSION with optional offset
  ROI_WPINDEX = 2  % # Point toward given MISSION
  ROI_LOCATION = 3  % # Point toward fixed location
  ROI_TARGET = 4  % # Point toward target
  ROI_ENUM_END = 5

vehicle_status_s = Simulink.Bus()
  timestamp: uint64  % # time since system start (microseconds)
  nav_state: uint8  % # set navigation state machine to specified value
  nav_state_timestamp: uint64  % # time when current nav_state activated
  arming_state: uint8  % # current arming state
  hil_state: uint8  % # current hil state
  failsafe: boolean  % # true if system is in failsafe state (e.g.:RTL, Hover, Terminate, ...)
  failsafe_timestamp: uint64  % # time when failsafe was activated
  system_type: uint8  % # system type, contains mavlink MAV_TYPE
  system_id: uint8  % # system id, contains MAVLink's system ID field
  component_id: uint8  % # subsystem / component id, contains MAVLink's component ID field
  vehicle_type: uint8  % # Type of vehicle (fixed-wing, rotary wing, ground)
  is_vtol: boolean  % # True if the system is VTOL capable
  is_vtol_tailsitter: boolean  % # True if the system performs a 90° pitch down rotation during transition from MC to FW
  vtol_fw_permanent_stab: boolean  % # True if VTOL should stabilize attitude for fw in manual mode
  in_transition_mode: boolean  % # True if VTOL is doing a transition
  in_transition_to_fw: boolean  % # True if VTOL is doing a transition from MC to FW
  rc_signal_lost: boolean  % # true if RC reception lost
  rc_input_mode: uint8  % # set to 1 to disable the RC input, 2 to enable manual control to RC in mapping.
  data_link_lost: boolean  % # datalink to GCS lost
  data_link_lost_counter: uint8  % # counts unique data link lost events
  high_latency_data_link_lost: boolean  % # Set to true if the high latency data link (eg. RockBlock Iridium 9603 telemetry module) is lost
  engine_failure: boolean  % # Set to true if an engine failure is detected
  mission_failure: boolean  % # Set to true if mission could not continue/finish
  geofence_violated: boolean
  failure_detector_status: uint8  % # Bitmask containing FailureDetector status [0, 0, 0, 0, 0, FAILURE_ALT, FAILURE_PITCH, FAILURE_ROLL]
  onboard_control_sensors_present: uint32
  onboard_control_sensors_enabled: uint32
  onboard_control_sensors_health: uint32
  latest_arming_reason: uint8
  latest_disarming_reason: uint8
  armed_time: uint64  % # Arming timestamp (microseconds)
  takeoff_time: uint64  % # Takeoff timestamp (microseconds)

ARMING_STATE_INIT = Simulink.Parameter(0, StorageClass="Const", DataType="uint8")
ARMING_STATE_STANDBY = Simulink.Parameter(1, StorageClass="Const", DataType="uint8")
ARMING_STATE_ARMED = Simulink.Parameter(2, StorageClass="Const", DataType="uint8")
ARMING_STATE_STANDBY_ERROR = Simulink.Parameter(3, StorageClass="Const", DataType="uint8")
ARMING_STATE_SHUTDOWN = Simulink.Parameter(4, StorageClass="Const", DataType="uint8")
ARMING_STATE_IN_AIR_RESTORE = Simulink.Parameter(5, StorageClass="Const", DataType="uint8")
ARMING_STATE_MAX = Simulink.Parameter(6, StorageClass="Const", DataType="uint8")
FAILURE_ROLL = Simulink.Parameter(1, StorageClass="Const", DataType="uint8")  % # (1 << 0)
FAILURE_PITCH = Simulink.Parameter(2, StorageClass="Const", DataType="uint8")  % # (1 << 1)
FAILURE_ALT = Simulink.Parameter(4, StorageClass="Const", DataType="uint8")  % # (1 << 2)
FAILURE_EXT = Simulink.Parameter(8, StorageClass="Const", DataType="uint8")  % # (1 << 3)
FAILURE_ARM_ESC = Simulink.Parameter(16, StorageClass="Const", DataType="uint8")  % # (1 << 4)
HIL_STATE_OFF = Simulink.Parameter(0, StorageClass="Const", DataType="uint8")
HIL_STATE_ON = Simulink.Parameter(1, StorageClass="Const", DataType="uint8")
NAVIGATION_STATE_MANUAL = Simulink.Parameter(0, StorageClass="Const", DataType="uint8")  % # Manual mode
NAVIGATION_STATE_ALTCTL = Simulink.Parameter(1, StorageClass="Const", DataType="uint8")  % # Altitude control mode
NAVIGATION_STATE_POSCTL = Simulink.Parameter(2, StorageClass="Const", DataType="uint8")  % # Position control mode
NAVIGATION_STATE_AUTO_MISSION = Simulink.Parameter(3, StorageClass="Const", DataType="uint8")  % # Auto mission mode
NAVIGATION_STATE_AUTO_LOITER = Simulink.Parameter(4, StorageClass="Const", DataType="uint8")  % # Auto loiter mode
NAVIGATION_STATE_AUTO_RTL = Simulink.Parameter(5, StorageClass="Const", DataType="uint8")  % # Auto return to launch mode
NAVIGATION_STATE_AUTO_LANDENGFAIL = Simulink.Parameter(8, StorageClass="Const", DataType="uint8")  % # Auto land on engine failure
NAVIGATION_STATE_AUTO_LANDGPSFAIL = Simulink.Parameter(9, StorageClass="Const", DataType="uint8")  % # Auto land on gps failure (e.g. open loop loiter down)
NAVIGATION_STATE_ACRO = Simulink.Parameter(10, StorageClass="Const", DataType="uint8")  % # Acro mode
NAVIGATION_STATE_UNUSED = Simulink.Parameter(11, StorageClass="Const", DataType="uint8")  % # Free slot
NAVIGATION_STATE_DESCEND = Simulink.Parameter(12, StorageClass="Const", DataType="uint8")  % # Descend mode (no position control)
NAVIGATION_STATE_TERMINATION = Simulink.Parameter(13, StorageClass="Const", DataType="uint8")  % # Termination mode
NAVIGATION_STATE_OFFBOARD = Simulink.Parameter(14, StorageClass="Const", DataType="uint8")
NAVIGATION_STATE_STAB = Simulink.Parameter(15, StorageClass="Const", DataType="uint8")  % # Stabilized mode
NAVIGATION_STATE_UNUSED2 = Simulink.Parameter(16, StorageClass="Const", DataType="uint8")  % # Free slot
NAVIGATION_STATE_AUTO_TAKEOFF = Simulink.Parameter(17, StorageClass="Const", DataType="uint8")  % # Takeoff
NAVIGATION_STATE_AUTO_LAND = Simulink.Parameter(18, StorageClass="Const", DataType="uint8")  % # Land
NAVIGATION_STATE_AUTO_FOLLOW_TARGET = Simulink.Parameter(19, StorageClass="Const", DataType="uint8")  % # Auto Follow
NAVIGATION_STATE_AUTO_PRECLAND = Simulink.Parameter(20, StorageClass="Const", DataType="uint8")  % # Precision land with landing target
NAVIGATION_STATE_ORBIT = Simulink.Parameter(21, StorageClass="Const", DataType="uint8")  % # Orbit in a circle
NAVIGATION_STATE_MAX = Simulink.Parameter(22, StorageClass="Const", DataType="uint8")
RC_IN_MODE_DEFAULT = Simulink.Parameter(0, StorageClass="Const", DataType="uint8")
RC_IN_MODE_OFF = Simulink.Parameter(1, StorageClass="Const", DataType="uint8")
RC_IN_MODE_GENERATED = Simulink.Parameter(2, StorageClass="Const", DataType="uint8")
VEHICLE_TYPE_UNKNOWN = Simulink.Parameter(0, StorageClass="Const", DataType="uint8")
VEHICLE_TYPE_ROTARY_WING = Simulink.Parameter(1, StorageClass="Const", DataType="uint8")
VEHICLE_TYPE_FIXED_WING = Simulink.Parameter(2, StorageClass="Const", DataType="uint8")
VEHICLE_TYPE_ROVER = Simulink.Parameter(3, StorageClass="Const", DataType="uint8")
VEHICLE_TYPE_AIRSHIP = Simulink.Parameter(4, StorageClass="Const", DataType="uint8")
ARM_DISARM_REASON_TRANSITION_TO_STANDBY = Simulink.Parameter(0, StorageClass="Const", DataType="uint8")
ARM_DISARM_REASON_RC_STICK = Simulink.Parameter(1, StorageClass="Const", DataType="uint8")
ARM_DISARM_REASON_RC_SWITCH = Simulink.Parameter(2, StorageClass="Const", DataType="uint8")
ARM_DISARM_REASON_COMMAND_INTERNAL = Simulink.Parameter(3, StorageClass="Const", DataType="uint8")
ARM_DISARM_REASON_COMMAND_EXTERNAL = Simulink.Parameter(4, StorageClass="Const", DataType="uint8")
ARM_DISARM_REASON_MISSION_START = Simulink.Parameter(5, StorageClass="Const", DataType="uint8")
ARM_DISARM_REASON_SAFETY_BUTTON = Simulink.Parameter(6, StorageClass="Const", DataType="uint8")
ARM_DISARM_REASON_AUTO_DISARM_LAND = Simulink.Parameter(7, StorageClass="Const", DataType="uint8")
ARM_DISARM_REASON_AUTO_DISARM_PREFLIGHT = Simulink.Parameter(8, StorageClass="Const", DataType="uint8")
ARM_DISARM_REASON_KILL_SWITCH = Simulink.Parameter(9, StorageClass="Const", DataType="uint8")
ARM_DISARM_REASON_LOCKDOWN = Simulink.Parameter(10, StorageClass="Const", DataType="uint8")
ARM_DISARM_REASON_FAILURE_DETECTOR = Simulink.Parameter(11, StorageClass="Const", DataType="uint8")
ARM_DISARM_REASON_SHUTDOWN = Simulink.Parameter(12, StorageClass="Const", DataType="uint8")
ARM_DISARM_REASON_UNIT_TEST = Simulink.Parameter(13, StorageClass="Const", DataType="uint8")

VEHICLE_STATUS = enum(AddClassNameToEnumNames=true)
  ARMING_STATE_INIT = 0
  ARMING_STATE_STANDBY = 1
  ARMING_STATE_ARMED = 2
  ARMING_STATE_STANDBY_ERROR = 3
  ARMING_STATE_SHUTDOWN = 4
  ARMING_STATE_IN_AIR_RESTORE = 5
  ARMING_STATE_MAX = 6
  FAILURE_NONE = 0
  FAILURE_ROLL = 1  % # (1 << 0)
  FAILURE_PITCH = 2  % # (1 << 1)
  FAILURE_ALT = 4  % # (1 << 2)
  FAILURE_EXT = 8  % # (1 << 3)
  FAILURE_ARM_ESC = 16  % # (1 << 4)
  HIL_STATE_OFF = 0
  HIL_STATE_ON = 1
  NAVIGATION_STATE_MANUAL = 0  % # Manual mode
  NAVIGATION_STATE_ALTCTL = 1  % # Altitude control mode
  NAVIGATION_STATE_POSCTL = 2  % # Position control mode
  NAVIGATION_STATE_AUTO_MISSION = 3  % # Auto mission mode
  NAVIGATION_STATE_AUTO_LOITER = 4  % # Auto loiter mode
  NAVIGATION_STATE_AUTO_RTL = 5  % # Auto return to launch mode
  NAVIGATION_STATE_AUTO_LANDENGFAIL = 8  % # Auto land on engine failure
  NAVIGATION_STATE_AUTO_LANDGPSFAIL = 9  % # Auto land on gps failure (e.g. open loop loiter down)
  NAVIGATION_STATE_ACRO = 10  % # Acro mode
  NAVIGATION_STATE_UNUSED = 11  % # Free slot
  NAVIGATION_STATE_DESCEND = 12  % # Descend mode (no position control)
  NAVIGATION_STATE_TERMINATION = 13  % # Termination mode
  NAVIGATION_STATE_OFFBOARD = 14
  NAVIGATION_STATE_STAB = 15  % # Stabilized mode
  NAVIGATION_STATE_UNUSED2 = 16  % # Free slot
  NAVIGATION_STATE_AUTO_TAKEOFF = 17  % # Takeoff
  NAVIGATION_STATE_AUTO_LAND = 18  % # Land
  NAVIGATION_STATE_AUTO_FOLLOW_TARGET = 19  % # Auto Follow
  NAVIGATION_STATE_AUTO_PRECLAND = 20  % # Precision land with landing target
  NAVIGATION_STATE_ORBIT = 21  % # Orbit in a circle
  NAVIGATION_STATE_MAX = 22
  RC_IN_MODE_DEFAULT = 0
  RC_IN_MODE_OFF = 1
  RC_IN_MODE_GENERATED = 2
  VEHICLE_TYPE_UNKNOWN = 0
  VEHICLE_TYPE_ROTARY_WING = 1
  VEHICLE_TYPE_FIXED_WING = 2
  VEHICLE_TYPE_ROVER = 3
  VEHICLE_TYPE_AIRSHIP = 4
  ARM_DISARM_REASON_TRANSITION_TO_STANDBY = 0
  ARM_DISARM_REASON_RC_STICK = 1
  ARM_DISARM_REASON_RC_SWITCH = 2
  ARM_DISARM_REASON_COMMAND_INTERNAL = 3
  ARM_DISARM_REASON_COMMAND_EXTERNAL = 4
  ARM_DISARM_REASON_MISSION_START = 5
  ARM_DISARM_REASON_SAFETY_BUTTON = 6
  ARM_DISARM_REASON_AUTO_DISARM_LAND = 7
  ARM_DISARM_REASON_AUTO_DISARM_PREFLIGHT = 8
  ARM_DISARM_REASON_KILL_SWITCH = 9
  ARM_DISARM_REASON_LOCKDOWN = 10
  ARM_DISARM_REASON_FAILURE_DETECTOR = 11
  ARM_DISARM_REASON_SHUTDOWN = 12
  ARM_DISARM_REASON_UNIT_TEST = 13

vehicle_status_flags_s = Simulink.Bus()
  timestamp: uint64  % # time since system start (microseconds)
  condition_calibration_enabled: boolean
  condition_system_sensors_initialized: boolean
  condition_system_hotplug_timeout: boolean  % # true if the hotplug sensor search is over
  condition_system_returned_to_home: boolean
  condition_auto_mission_available: boolean
  condition_angular_velocity_valid: boolean
  condition_attitude_valid: boolean
  condition_local_altitude_valid: boolean
  condition_local_position_valid: boolean  % # set to true by the commander app if the quality of the local position estimate is good enough to use for navigation
  condition_local_velocity_valid: boolean  % # set to true by the commander app if the quality of the local horizontal velocity data is good enough to use for navigation
  condition_global_position_valid: boolean  % # set to true by the commander app if the quality of the global position estimate is good enough to use for navigation
  condition_home_position_valid: boolean  % # indicates a valid home position (a valid home position is not always a valid launch)
  condition_power_input_valid: boolean  % # set if input power is valid
  condition_battery_healthy: boolean  % # set if battery is available and not low
  condition_escs_error: boolean  % # set to true if one or more ESCs reporting esc_status are offline
  condition_escs_failure: boolean  % # set to true if one or more ESCs reporting esc_status has a failure
  circuit_breaker_engaged_power_check: boolean
  circuit_breaker_engaged_airspd_check: boolean
  circuit_breaker_engaged_enginefailure_check: boolean
  circuit_breaker_flight_termination_disabled: boolean
  circuit_breaker_engaged_usb_check: boolean
  circuit_breaker_engaged_posfailure_check: boolean  % # set to true when the position valid checks have been disabled
  circuit_breaker_vtol_fw_arming_check: boolean  % # set to true if for VTOLs arming in fixed-wing mode should be allowed
  offboard_control_signal_found_once: boolean
  offboard_control_signal_lost: boolean
  rc_signal_found_once: boolean
  rc_input_blocked: boolean  % # set if RC input should be ignored temporarily
  rc_calibration_valid: boolean  % # set if RC calibration is valid
  vtol_transition_failure: boolean  % # Set to true if vtol transition failed
  usb_connected: boolean  % # status of the USB power supply
  sd_card_detected_once: boolean  % # set to true if the SD card was detected
  avoidance_system_required: boolean  % # Set to true if avoidance system is enabled via COM_OBS_AVOID parameter
  avoidance_system_valid: boolean  % # Status of the obstacle avoidance system

vehicle_thrust_setpoint_s = Simulink.Bus()
  timestamp: uint64  % # time since system start (microseconds)
  timestamp_sample: uint64  % # timestamp of the data sample on which this message is based (microseconds)
  xyz: single[3]  % # thrust setpoint along X, Y, Z body axis (in N)

vehicle_torque_setpoint_s = Simulink.Bus()
  timestamp: uint64  % # time since system start (microseconds)
  timestamp_sample: uint64  % # timestamp of the data sample on which this message is based (microseconds)
  xyz: single[3]  % # torque setpoint about X, Y, Z body axis (in N.m)

vehicle_trajectory_bezier_s = Simulink.Bus()
  timestamp: uint64  % # time since system start (microseconds)
  control_points: trajectory_bezier[5]
  bezier_order: uint8

POINT_0 = Simulink.Parameter(0, StorageClass="Const", DataType="uint8")
POINT_1 = Simulink.Parameter(1, StorageClass="Const", DataType="uint8")
POINT_2 = Simulink.Parameter(2, StorageClass="Const", DataType="uint8")
POINT_3 = Simulink.Parameter(3, StorageClass="Const", DataType="uint8")
POINT_4 = Simulink.Parameter(4, StorageClass="Const", DataType="uint8")
NUMBER_POINTS = Simulink.Parameter(5, StorageClass="Const", DataType="uint8")

VEHICLE_TRAJECTORY_BEZIER = enum(AddClassNameToEnumNames=true)
  POINT_0 = 0
  POINT_1 = 1
  POINT_2 = 2
  POINT_3 = 3
  POINT_4 = 4
  NUMBER_POINTS = 5

vehicle_trajectory_waypoint_s = Simulink.Bus()
  timestamp: uint64  % # time since system start (microseconds)
  type: uint8  % # Type from MAV_TRAJECTORY_REPRESENTATION enum.
  waypoints: trajectory_waypoint[5]

vehicle_trajectory_waypoint_desired_s = Simulink.Bus()
  timestamp: uint64  % # time since system start (microseconds)
  type: uint8  % # Type from MAV_TRAJECTORY_REPRESENTATION enum.
  waypoints: trajectory_waypoint[5]

MAV_TRAJECTORY_REPRESENTATION_WAYPOINTS = Simulink.Parameter(0, StorageClass="Const", DataType="uint8")

VEHICLE_TRAJECTORY_WAYPOINT = enum(AddClassNameToEnumNames=true)
  MAV_TRAJECTORY_REPRESENTATION_WAYPOINTS = 0
  POINT_0 = 0
  POINT_1 = 1
  POINT_2 = 2
  POINT_3 = 3
  POINT_4 = 4
  NUMBER_POINTS = 5

vtol_vehicle_status_s = Simulink.Bus()
  timestamp: uint64  % # time since system start (microseconds)
  vtol_in_rw_mode: boolean  % # true: vtol vehicle is in rotating wing mode
  vtol_in_trans_mode: boolean
  in_transition_to_fw: boolean  % # True if VTOL is doing a transition from MC to FW
  vtol_transition_failsafe: boolean  % # vtol in transition failsafe mode
  fw_permanent_stab: boolean  % # In fw mode stabilize attitude even if in manual mode

VEHICLE_VTOL_STATE_UNDEFINED = Simulink.Parameter(0, StorageClass="Const", DataType="uint8")
VEHICLE_VTOL_STATE_TRANSITION_TO_FW = Simulink.Parameter(1, StorageClass="Const", DataType="uint8")
VEHICLE_VTOL_STATE_TRANSITION_TO_MC = Simulink.Parameter(2, StorageClass="Const", DataType="uint8")
VEHICLE_VTOL_STATE_MC = Simulink.Parameter(3, StorageClass="Const", DataType="uint8")
VEHICLE_VTOL_STATE_FW = Simulink.Parameter(4, StorageClass="Const", DataType="uint8")

VTOL_VEHICLE_STATUS = enum(AddClassNameToEnumNames=true)
  VEHICLE_VTOL_STATE_UNDEFINED = 0
  VEHICLE_VTOL_STATE_TRANSITION_TO_FW = 1
  VEHICLE_VTOL_STATE_TRANSITION_TO_MC = 2
  VEHICLE_VTOL_STATE_MC = 3
  VEHICLE_VTOL_STATE_FW = 4

wheel_encoders_s = Simulink.Bus()
  timestamp: uint64  % # time since system start (microseconds)
  encoder_position: int64  % # The wheel position, in encoder counts since boot. Positive is forward rotation, negative is reverse rotation
  speed: int32  % # Speed of each wheel, in encoder counts per second. Positive is forward, negative is reverse
  pulses_per_rev: uint32  % # Number of pulses per revolution for each wheel

wind_s = Simulink.Bus()
  timestamp: uint64  % # time since system start (microseconds)
  timestamp_sample: uint64  % # the timestamp of the raw data (microseconds)
  windspeed_north: single  % # Wind component in north / X direction (m/sec)
  windspeed_east: single  % # Wind component in east / Y direction (m/sec)
  variance_north: single  % # Wind estimate error variance in north / X direction (m/sec)**2 - set to zero (no uncertainty) if not estimated
  variance_east: single  % # Wind estimate error variance in east / Y direction (m/sec)**2 - set to zero (no uncertainty) if not estimated
  tas_innov: single  % # True airspeed innovation
  tas_innov_var: single  % # True airspeed innovation variance
  beta_innov: single  % # Sideslip measurement innovation
  beta_innov_var: single  % # Sideslip measurement innovation variance

estimator_wind_s = Simulink.Bus()
  timestamp: uint64  % # time since system start (microseconds)
  timestamp_sample: uint64  % # the timestamp of the raw data (microseconds)
  windspeed_north: single  % # Wind component in north / X direction (m/sec)
  windspeed_east: single  % # Wind component in east / Y direction (m/sec)
  variance_north: single  % # Wind estimate error variance in north / X direction (m/sec)**2 - set to zero (no uncertainty) if not estimated
  variance_east: single  % # Wind estimate error variance in east / Y direction (m/sec)**2 - set to zero (no uncertainty) if not estimated
  tas_innov: single  % # True airspeed innovation
  tas_innov_var: single  % # True airspeed innovation variance
  beta_innov: single  % # Sideslip measurement innovation
  beta_innov_var: single  % # Sideslip measurement innovation variance

yaw_estimator_status_s = Simulink.Bus()
  timestamp: uint64  % # time since system start (microseconds)
  timestamp_sample: uint64  % # the timestamp of the raw data (microseconds)
  yaw_composite: single  % # composite yaw from GSF (rad)
  yaw_variance: single  % # composite yaw variance from GSF (rad^2)
  yaw: single[5]  % # yaw estimate for each model in the filter bank (rad)
  innov_vn: single[5]  % # North velocity innovation for each model in the filter bank (m/s)
  innov_ve: single[5]  % # East velocity innovation for each model in the filter bank (m/s)
  weight: single[5]  % # weighting for each model in the filter bank

MAV_AUTOPILOT_GENERIC = Simulink.Parameter(0, StorageClass="Const")  % Generic autopilot, full support for everything
MAV_AUTOPILOT_RESERVED = Simulink.Parameter(1, StorageClass="Const")  % Reserved for future use.
MAV_AUTOPILOT_SLUGS = Simulink.Parameter(2, StorageClass="Const")  % SLUGS autopilot, http://slugsuav.soe.ucsc.edu
MAV_AUTOPILOT_ARDUPILOTMEGA = Simulink.Parameter(3, StorageClass="Const")  % ArduPilot - Plane/Copter/Rover/Sub/Tracker, https://ardupilot.org
MAV_AUTOPILOT_OPENPILOT = Simulink.Parameter(4, StorageClass="Const")  % OpenPilot, http://openpilot.org
MAV_AUTOPILOT_GENERIC_WAYPOINTS_ONLY = Simulink.Parameter(5, StorageClass="Const")  % Generic autopilot only supporting simple waypoints
MAV_AUTOPILOT_GENERIC_WAYPOINTS_AND_SIMPLE_NAVIGATION_ONLY = Simulink.Parameter(6, StorageClass="Const")  % Generic autopilot supporting waypoints and other simple navigation commands
MAV_AUTOPILOT_GENERIC_MISSION_FULL = Simulink.Parameter(7, StorageClass="Const")  % Generic autopilot supporting the full mission command set
MAV_AUTOPILOT_INVALID = Simulink.Parameter(8, StorageClass="Const")  % No valid autopilot, e.g. a GCS or other MAVLink component
MAV_AUTOPILOT_PPZ = Simulink.Parameter(9, StorageClass="Const")  % PPZ UAV - http://nongnu.org/paparazzi
MAV_AUTOPILOT_UDB = Simulink.Parameter(10, StorageClass="Const")  % UAV Dev Board
MAV_AUTOPILOT_FP = Simulink.Parameter(11, StorageClass="Const")  % FlexiPilot
MAV_AUTOPILOT_PX4 = Simulink.Parameter(12, StorageClass="Const")  % PX4 Autopilot - http://px4.io/
MAV_AUTOPILOT_SMACCMPILOT = Simulink.Parameter(13, StorageClass="Const")  % SMACCMPilot - http://smaccmpilot.org
MAV_AUTOPILOT_AUTOQUAD = Simulink.Parameter(14, StorageClass="Const")  % AutoQuad -- http://autoquad.org
MAV_AUTOPILOT_ARMAZILA = Simulink.Parameter(15, StorageClass="Const")  % Armazila -- http://armazila.com
MAV_AUTOPILOT_AEROB = Simulink.Parameter(16, StorageClass="Const")  % Aerob -- http://aerob.ru
MAV_AUTOPILOT_ASLUAV = Simulink.Parameter(17, StorageClass="Const")  % ASLUAV autopilot -- http://www.asl.ethz.ch
MAV_AUTOPILOT_SMARTAP = Simulink.Parameter(18, StorageClass="Const")  % SmartAP Autopilot - http://sky-drones.com
MAV_AUTOPILOT_AIRRAILS = Simulink.Parameter(19, StorageClass="Const")  % AirRails - http://uaventure.com
MAV_AUTOPILOT_REFLEX = Simulink.Parameter(20, StorageClass="Const")  % Fusion Reflex - https://fusion.engineering

MAV_AUTOPILOT = enum(AddClassNameToEnumNames=true)  % Micro air vehicle / autopilot classes. This identifies the individual model.
  GENERIC = 0  % Generic autopilot, full support for everything
  RESERVED = 1  % Reserved for future use.
  SLUGS = 2  % SLUGS autopilot, http://slugsuav.soe.ucsc.edu
  ARDUPILOTMEGA = 3  % ArduPilot - Plane/Copter/Rover/Sub/Tracker, https://ardupilot.org
  OPENPILOT = 4  % OpenPilot, http://openpilot.org
  GENERIC_WAYPOINTS_ONLY = 5  % Generic autopilot only supporting simple waypoints
  GENERIC_WAYPOINTS_AND_SIMPLE_NAVIGATION_ONLY = 6  % Generic autopilot supporting waypoints and other simple navigation commands
  GENERIC_MISSION_FULL = 7  % Generic autopilot supporting the full mission command set
  INVALID = 8  % No valid autopilot, e.g. a GCS or other MAVLink component
  PPZ = 9  % PPZ UAV - http://nongnu.org/paparazzi
  UDB = 10  % UAV Dev Board
  FP = 11  % FlexiPilot
  PX4 = 12  % PX4 Autopilot - http://px4.io/
  SMACCMPILOT = 13  % SMACCMPilot - http://smaccmpilot.org
  AUTOQUAD = 14  % AutoQuad -- http://autoquad.org
  ARMAZILA = 15  % Armazila -- http://armazila.com
  AEROB = 16  % Aerob -- http://aerob.ru
  ASLUAV = 17  % ASLUAV autopilot -- http://www.asl.ethz.ch
  SMARTAP = 18  % SmartAP Autopilot - http://sky-drones.com
  AIRRAILS = 19  % AirRails - http://uaventure.com
  REFLEX = 20  % Fusion Reflex - https://fusion.engineering

MAV_TYPE_GENERIC = Simulink.Parameter(0, StorageClass="Const")  % Generic micro air vehicle
MAV_TYPE_FIXED_WING = Simulink.Parameter(1, StorageClass="Const")  % Fixed wing aircraft.
MAV_TYPE_QUADROTOR = Simulink.Parameter(2, StorageClass="Const")  % Quadrotor
MAV_TYPE_COAXIAL = Simulink.Parameter(3, StorageClass="Const")  % Coaxial helicopter
MAV_TYPE_HELICOPTER = Simulink.Parameter(4, StorageClass="Const")  % Normal helicopter with tail rotor.
MAV_TYPE_ANTENNA_TRACKER = Simulink.Parameter(5, StorageClass="Const")  % Ground installation
MAV_TYPE_GCS = Simulink.Parameter(6, StorageClass="Const")  % Operator control unit / ground control station
MAV_TYPE_AIRSHIP = Simulink.Parameter(7, StorageClass="Const")  % Airship, controlled
MAV_TYPE_FREE_BALLOON = Simulink.Parameter(8, StorageClass="Const")  % Free balloon, uncontrolled
MAV_TYPE_ROCKET = Simulink.Parameter(9, StorageClass="Const")  % Rocket
MAV_TYPE_GROUND_ROVER = Simulink.Parameter(10, StorageClass="Const")  % Ground rover
MAV_TYPE_SURFACE_BOAT = Simulink.Parameter(11, StorageClass="Const")  % Surface vessel, boat, ship
MAV_TYPE_SUBMARINE = Simulink.Parameter(12, StorageClass="Const")  % Submarine
MAV_TYPE_HEXAROTOR = Simulink.Parameter(13, StorageClass="Const")  % Hexarotor
MAV_TYPE_OCTOROTOR = Simulink.Parameter(14, StorageClass="Const")  % Octorotor
MAV_TYPE_TRICOPTER = Simulink.Parameter(15, StorageClass="Const")  % Tricopter
MAV_TYPE_FLAPPING_WING = Simulink.Parameter(16, StorageClass="Const")  % Flapping wing
MAV_TYPE_KITE = Simulink.Parameter(17, StorageClass="Const")  % Kite
MAV_TYPE_ONBOARD_CONTROLLER = Simulink.Parameter(18, StorageClass="Const")  % Onboard companion controller
MAV_TYPE_VTOL_TAILSITTER_DUOROTOR = Simulink.Parameter(19, StorageClass="Const")  % Two-rotor Tailsitter VTOL that additionally uses control surfaces in vertical operation. Note, value previously named MAV_TYPE_VTOL_DUOROTOR.
MAV_TYPE_VTOL_TAILSITTER_QUADROTOR = Simulink.Parameter(20, StorageClass="Const")  % Quad-rotor Tailsitter VTOL using a V-shaped quad config in vertical operation. Note: value previously named MAV_TYPE_VTOL_QUADROTOR.
MAV_TYPE_VTOL_TILTROTOR = Simulink.Parameter(21, StorageClass="Const")  % Tiltrotor VTOL. Fuselage and wings stay (nominally) horizontal in all flight phases. It able to tilt (some) rotors to provide thrust in cruise flight.
MAV_TYPE_VTOL_FIXEDROTOR = Simulink.Parameter(22, StorageClass="Const")  % VTOL with separate fixed rotors for hover and cruise flight. Fuselage and wings stay (nominally) horizontal in all flight phases.
MAV_TYPE_VTOL_TAILSITTER = Simulink.Parameter(23, StorageClass="Const")  % Tailsitter VTOL. Fuselage and wings orientation changes depending on flight phase: vertical for hover, horizontal for cruise. Use more specific VTOL MAV_TYPE_VTOL_TAILSITTER_DUOROTOR or MAV_TYPE_VTOL_TAILSITTER_QUADROTOR if appropriate.
MAV_TYPE_VTOL_TILTWING = Simulink.Parameter(24, StorageClass="Const")  % Tiltwing VTOL. Fuselage stays horizontal in all flight phases. The whole wing, along with any attached engine, can tilt between vertical and horizontal mode.
MAV_TYPE_VTOL_RESERVED5 = Simulink.Parameter(25, StorageClass="Const")  % VTOL reserved 5
MAV_TYPE_GIMBAL = Simulink.Parameter(26, StorageClass="Const")  % Gimbal
MAV_TYPE_ADSB = Simulink.Parameter(27, StorageClass="Const")  % ADSB system
MAV_TYPE_PARAFOIL = Simulink.Parameter(28, StorageClass="Const")  % Steerable, nonrigid airfoil
MAV_TYPE_DODECAROTOR = Simulink.Parameter(29, StorageClass="Const")  % Dodecarotor
MAV_TYPE_CAMERA = Simulink.Parameter(30, StorageClass="Const")  % Camera
MAV_TYPE_CHARGING_STATION = Simulink.Parameter(31, StorageClass="Const")  % Charging station
MAV_TYPE_FLARM = Simulink.Parameter(32, StorageClass="Const")  % FLARM collision avoidance system
MAV_TYPE_SERVO = Simulink.Parameter(33, StorageClass="Const")  % Servo
MAV_TYPE_ODID = Simulink.Parameter(34, StorageClass="Const")  % Open Drone ID. See https://mavlink.io/en/services/opendroneid.html.
MAV_TYPE_DECAROTOR = Simulink.Parameter(35, StorageClass="Const")  % Decarotor
MAV_TYPE_BATTERY = Simulink.Parameter(36, StorageClass="Const")  % Battery
MAV_TYPE_PARACHUTE = Simulink.Parameter(37, StorageClass="Const")  % Parachute
MAV_TYPE_LOG = Simulink.Parameter(38, StorageClass="Const")  % Log
MAV_TYPE_OSD = Simulink.Parameter(39, StorageClass="Const")  % OSD
MAV_TYPE_IMU = Simulink.Parameter(40, StorageClass="Const")  % IMU
MAV_TYPE_GPS = Simulink.Parameter(41, StorageClass="Const")  % GPS
MAV_TYPE_WINCH = Simulink.Parameter(42, StorageClass="Const")  % Winch
MAV_TYPE_GENERIC_MULTIROTOR = Simulink.Parameter(43, StorageClass="Const")  % Generic multirotor that does not fit into a specific type or whose type is unknown

MAV_TYPE = enum(AddClassNameToEnumNames=true)  % MAVLINK component type reported in HEARTBEAT message. Flight controllers must report the type of the vehicle on which they are mounted (e.g. MAV_TYPE_OCTOROTOR). All other components must report a value appropriate for their type (e.g. a camera must use MAV_TYPE_CAMERA).
  GENERIC = 0  % Generic micro air vehicle
  FIXED_WING = 1  % Fixed wing aircraft.
  QUADROTOR = 2  % Quadrotor
  COAXIAL = 3  % Coaxial helicopter
  HELICOPTER = 4  % Normal helicopter with tail rotor.
  ANTENNA_TRACKER = 5  % Ground installation
  GCS = 6  % Operator control unit / ground control station
  AIRSHIP = 7  % Airship, controlled
  FREE_BALLOON = 8  % Free balloon, uncontrolled
  ROCKET = 9  % Rocket
  GROUND_ROVER = 10  % Ground rover
  SURFACE_BOAT = 11  % Surface vessel, boat, ship
  SUBMARINE = 12  % Submarine
  HEXAROTOR = 13  % Hexarotor
  OCTOROTOR = 14  % Octorotor
  TRICOPTER = 15  % Tricopter
  FLAPPING_WING = 16  % Flapping wing
  KITE = 17  % Kite
  ONBOARD_CONTROLLER = 18  % Onboard companion controller
  VTOL_TAILSITTER_DUOROTOR = 19  % Two-rotor Tailsitter VTOL that additionally uses control surfaces in vertical operation. Note, value previously named MAV_TYPE_VTOL_DUOROTOR.
  VTOL_TAILSITTER_QUADROTOR = 20  % Quad-rotor Tailsitter VTOL using a V-shaped quad config in vertical operation. Note: value previously named MAV_TYPE_VTOL_QUADROTOR.
  VTOL_TILTROTOR = 21  % Tiltrotor VTOL. Fuselage and wings stay (nominally) horizontal in all flight phases. It able to tilt (some) rotors to provide thrust in cruise flight.
  VTOL_FIXEDROTOR = 22  % VTOL with separate fixed rotors for hover and cruise flight. Fuselage and wings stay (nominally) horizontal in all flight phases.
  VTOL_TAILSITTER = 23  % Tailsitter VTOL. Fuselage and wings orientation changes depending on flight phase: vertical for hover, horizontal for cruise. Use more specific VTOL MAV_TYPE_VTOL_TAILSITTER_DUOROTOR or MAV_TYPE_VTOL_TAILSITTER_QUADROTOR if appropriate.
  VTOL_TILTWING = 24  % Tiltwing VTOL. Fuselage stays horizontal in all flight phases. The whole wing, along with any attached engine, can tilt between vertical and horizontal mode.
  VTOL_RESERVED5 = 25  % VTOL reserved 5
  GIMBAL = 26  % Gimbal
  ADSB = 27  % ADSB system
  PARAFOIL = 28  % Steerable, nonrigid airfoil
  DODECAROTOR = 29  % Dodecarotor
  CAMERA = 30  % Camera
  CHARGING_STATION = 31  % Charging station
  FLARM = 32  % FLARM collision avoidance system
  SERVO = 33  % Servo
  ODID = 34  % Open Drone ID. See https://mavlink.io/en/services/opendroneid.html.
  DECAROTOR = 35  % Decarotor
  BATTERY = 36  % Battery
  PARACHUTE = 37  % Parachute
  LOG = 38  % Log
  OSD = 39  % OSD
  IMU = 40  % IMU
  GPS = 41  % GPS
  WINCH = 42  % Winch
  GENERIC_MULTIROTOR = 43  % Generic multirotor that does not fit into a specific type or whose type is unknown

MAV_MODE_FLAG_SAFETY_ARMED = Simulink.Parameter(128, StorageClass="Const")  % 0b10000000 MAV safety set to armed. Motors are enabled / running / can start. Ready to fly. Additional note: this flag is to be ignore when sent in the command MAV_CMD_DO_SET_MODE and MAV_CMD_COMPONENT_ARM_DISARM shall be used instead. The flag can still be used to report the armed state.
MAV_MODE_FLAG_MANUAL_INPUT_ENABLED = Simulink.Parameter(64, StorageClass="Const")  % 0b01000000 remote control input is enabled.
MAV_MODE_FLAG_HIL_ENABLED = Simulink.Parameter(32, StorageClass="Const")  % 0b00100000 hardware in the loop simulation. All motors / actuators are blocked, but internal software is full operational.
MAV_MODE_FLAG_STABILIZE_ENABLED = Simulink.Parameter(16, StorageClass="Const")  % 0b00010000 system stabilizes electronically its attitude (and optionally position). It needs however further control inputs to move around.
MAV_MODE_FLAG_GUIDED_ENABLED = Simulink.Parameter(8, StorageClass="Const")  % 0b00001000 guided mode enabled, system flies waypoints / mission items.
MAV_MODE_FLAG_AUTO_ENABLED = Simulink.Parameter(4, StorageClass="Const")  % 0b00000100 autonomous mode enabled, system finds its own goal positions. Guided flag can be set or not, depends on the actual implementation.
MAV_MODE_FLAG_TEST_ENABLED = Simulink.Parameter(2, StorageClass="Const")  % 0b00000010 system has a test mode enabled. This flag is intended for temporary system tests and should not be used for stable implementations.
MAV_MODE_FLAG_CUSTOM_MODE_ENABLED = Simulink.Parameter(1, StorageClass="Const")  % 0b00000001 Reserved for future use.

MAV_MODE_FLAG = enum(AddClassNameToEnumNames=true)  % These flags encode the MAV mode.
  SAFETY_ARMED = 128  % 0b10000000 MAV safety set to armed. Motors are enabled / running / can start. Ready to fly. Additional note: this flag is to be ignore when sent in the command MAV_CMD_DO_SET_MODE and MAV_CMD_COMPONENT_ARM_DISARM shall be used instead. The flag can still be used to report the armed state.
  MANUAL_INPUT_ENABLED = 64  % 0b01000000 remote control input is enabled.
  HIL_ENABLED = 32  % 0b00100000 hardware in the loop simulation. All motors / actuators are blocked, but internal software is full operational.
  STABILIZE_ENABLED = 16  % 0b00010000 system stabilizes electronically its attitude (and optionally position). It needs however further control inputs to move around.
  GUIDED_ENABLED = 8  % 0b00001000 guided mode enabled, system flies waypoints / mission items.
  AUTO_ENABLED = 4  % 0b00000100 autonomous mode enabled, system finds its own goal positions. Guided flag can be set or not, depends on the actual implementation.
  TEST_ENABLED = 2  % 0b00000010 system has a test mode enabled. This flag is intended for temporary system tests and should not be used for stable implementations.
  CUSTOM_MODE_ENABLED = 1  % 0b00000001 Reserved for future use.

MAV_MODE_FLAG_DECODE_POSITION_SAFETY = Simulink.Parameter(128, StorageClass="Const")  % First bit:  10000000
MAV_MODE_FLAG_DECODE_POSITION_MANUAL = Simulink.Parameter(64, StorageClass="Const")  % Second bit: 01000000
MAV_MODE_FLAG_DECODE_POSITION_HIL = Simulink.Parameter(32, StorageClass="Const")  % Third bit:  00100000
MAV_MODE_FLAG_DECODE_POSITION_STABILIZE = Simulink.Parameter(16, StorageClass="Const")  % Fourth bit: 00010000
MAV_MODE_FLAG_DECODE_POSITION_GUIDED = Simulink.Parameter(8, StorageClass="Const")  % Fifth bit:  00001000
MAV_MODE_FLAG_DECODE_POSITION_AUTO = Simulink.Parameter(4, StorageClass="Const")  % Sixth bit:   00000100
MAV_MODE_FLAG_DECODE_POSITION_TEST = Simulink.Parameter(2, StorageClass="Const")  % Seventh bit: 00000010
MAV_MODE_FLAG_DECODE_POSITION_CUSTOM_MODE = Simulink.Parameter(1, StorageClass="Const")  % Eighth bit: 00000001

MAV_MODE_FLAG_DECODE_POSITION = enum(AddClassNameToEnumNames=true)  % These values encode the bit positions of the decode position. These values can be used to read the value of a flag bit by combining the base_mode variable with AND with the flag position value. The result will be either 0 or 1, depending on if the flag is set or not.
  SAFETY = 128  % First bit:  10000000
  MANUAL = 64  % Second bit: 01000000
  HIL = 32  % Third bit:  00100000
  STABILIZE = 16  % Fourth bit: 00010000
  GUIDED = 8  % Fifth bit:  00001000
  AUTO = 4  % Sixth bit:   00000100
  TEST = 2  % Seventh bit: 00000010
  CUSTOM_MODE = 1  % Eighth bit: 00000001

MAV_STATE_UNINIT = Simulink.Parameter(0, StorageClass="Const")  % Uninitialized system, state is unknown.
MAV_STATE_BOOT = Simulink.Parameter(1, StorageClass="Const")  % System is booting up.
MAV_STATE_CALIBRATING = Simulink.Parameter(2, StorageClass="Const")  % System is calibrating and not flight-ready.
MAV_STATE_STANDBY = Simulink.Parameter(3, StorageClass="Const")  % System is grounded and on standby. It can be launched any time.
MAV_STATE_ACTIVE = Simulink.Parameter(4, StorageClass="Const")  % System is active and might be already airborne. Motors are engaged.
MAV_STATE_CRITICAL = Simulink.Parameter(5, StorageClass="Const")  % System is in a non-normal flight mode (failsafe). It can however still navigate.
MAV_STATE_EMERGENCY = Simulink.Parameter(6, StorageClass="Const")  % System is in a non-normal flight mode (failsafe). It lost control over parts or over the whole airframe. It is in mayday and going down.
MAV_STATE_POWEROFF = Simulink.Parameter(7, StorageClass="Const")  % System just initialized its power-down sequence, will shut down now.
MAV_STATE_FLIGHT_TERMINATION = Simulink.Parameter(8, StorageClass="Const")  % System is terminating itself (failsafe or commanded).

MAV_STATE = enum(AddClassNameToEnumNames=true)
  UNINIT = 0  % Uninitialized system, state is unknown.
  BOOT = 1  % System is booting up.
  CALIBRATING = 2  % System is calibrating and not flight-ready.
  STANDBY = 3  % System is grounded and on standby. It can be launched any time.
  ACTIVE = 4  % System is active and might be already airborne. Motors are engaged.
  CRITICAL = 5  % System is in a non-normal flight mode (failsafe). It can however still navigate.
  EMERGENCY = 6  % System is in a non-normal flight mode (failsafe). It lost control over parts or over the whole airframe. It is in mayday and going down.
  POWEROFF = 7  % System just initialized its power-down sequence, will shut down now.
  FLIGHT_TERMINATION = 8  % System is terminating itself (failsafe or commanded).

MAV_COMP_ID_ALL = Simulink.Parameter(0, StorageClass="Const")  % Target id (target_component) used to broadcast messages to all components of the receiving system. Components should attempt to process messages with this component ID and forward to components on any other interfaces. Note: This is not a valid *source* component id for a message.
MAV_COMP_ID_AUTOPILOT1 = Simulink.Parameter(1, StorageClass="Const")  % System flight controller component ("autopilot"). Only one autopilot is expected in a particular system.
MAV_COMP_ID_USER1 = Simulink.Parameter(25, StorageClass="Const")  % Id for a component on privately managed MAVLink network. Can be used for any purpose but may not be published by components outside of the private network.
MAV_COMP_ID_USER2 = Simulink.Parameter(26, StorageClass="Const")  % Id for a component on privately managed MAVLink network. Can be used for any purpose but may not be published by components outside of the private network.
MAV_COMP_ID_USER3 = Simulink.Parameter(27, StorageClass="Const")  % Id for a component on privately managed MAVLink network. Can be used for any purpose but may not be published by components outside of the private network.
MAV_COMP_ID_USER4 = Simulink.Parameter(28, StorageClass="Const")  % Id for a component on privately managed MAVLink network. Can be used for any purpose but may not be published by components outside of the private network.
MAV_COMP_ID_USER5 = Simulink.Parameter(29, StorageClass="Const")  % Id for a component on privately managed MAVLink network. Can be used for any purpose but may not be published by components outside of the private network.
MAV_COMP_ID_USER6 = Simulink.Parameter(30, StorageClass="Const")  % Id for a component on privately managed MAVLink network. Can be used for any purpose but may not be published by components outside of the private network.
MAV_COMP_ID_USER7 = Simulink.Parameter(31, StorageClass="Const")  % Id for a component on privately managed MAVLink network. Can be used for any purpose but may not be published by components outside of the private network.
MAV_COMP_ID_USER8 = Simulink.Parameter(32, StorageClass="Const")  % Id for a component on privately managed MAVLink network. Can be used for any purpose but may not be published by components outside of the private network.
MAV_COMP_ID_USER9 = Simulink.Parameter(33, StorageClass="Const")  % Id for a component on privately managed MAVLink network. Can be used for any purpose but may not be published by components outside of the private network.
MAV_COMP_ID_USER10 = Simulink.Parameter(34, StorageClass="Const")  % Id for a component on privately managed MAVLink network. Can be used for any purpose but may not be published by components outside of the private network.
MAV_COMP_ID_USER11 = Simulink.Parameter(35, StorageClass="Const")  % Id for a component on privately managed MAVLink network. Can be used for any purpose but may not be published by components outside of the private network.
MAV_COMP_ID_USER12 = Simulink.Parameter(36, StorageClass="Const")  % Id for a component on privately managed MAVLink network. Can be used for any purpose but may not be published by components outside of the private network.
MAV_COMP_ID_USER13 = Simulink.Parameter(37, StorageClass="Const")  % Id for a component on privately managed MAVLink network. Can be used for any purpose but may not be published by components outside of the private network.
MAV_COMP_ID_USER14 = Simulink.Parameter(38, StorageClass="Const")  % Id for a component on privately managed MAVLink network. Can be used for any purpose but may not be published by components outside of the private network.
MAV_COMP_ID_USER15 = Simulink.Parameter(39, StorageClass="Const")  % Id for a component on privately managed MAVLink network. Can be used for any purpose but may not be published by components outside of the private network.
MAV_COMP_ID_USER16 = Simulink.Parameter(40, StorageClass="Const")  % Id for a component on privately managed MAVLink network. Can be used for any purpose but may not be published by components outside of the private network.
MAV_COMP_ID_USER17 = Simulink.Parameter(41, StorageClass="Const")  % Id for a component on privately managed MAVLink network. Can be used for any purpose but may not be published by components outside of the private network.
MAV_COMP_ID_USER18 = Simulink.Parameter(42, StorageClass="Const")  % Id for a component on privately managed MAVLink network. Can be used for any purpose but may not be published by components outside of the private network.
MAV_COMP_ID_USER19 = Simulink.Parameter(43, StorageClass="Const")  % Id for a component on privately managed MAVLink network. Can be used for any purpose but may not be published by components outside of the private network.
MAV_COMP_ID_USER20 = Simulink.Parameter(44, StorageClass="Const")  % Id for a component on privately managed MAVLink network. Can be used for any purpose but may not be published by components outside of the private network.
MAV_COMP_ID_USER21 = Simulink.Parameter(45, StorageClass="Const")  % Id for a component on privately managed MAVLink network. Can be used for any purpose but may not be published by components outside of the private network.
MAV_COMP_ID_USER22 = Simulink.Parameter(46, StorageClass="Const")  % Id for a component on privately managed MAVLink network. Can be used for any purpose but may not be published by components outside of the private network.
MAV_COMP_ID_USER23 = Simulink.Parameter(47, StorageClass="Const")  % Id for a component on privately managed MAVLink network. Can be used for any purpose but may not be published by components outside of the private network.
MAV_COMP_ID_USER24 = Simulink.Parameter(48, StorageClass="Const")  % Id for a component on privately managed MAVLink network. Can be used for any purpose but may not be published by components outside of the private network.
MAV_COMP_ID_USER25 = Simulink.Parameter(49, StorageClass="Const")  % Id for a component on privately managed MAVLink network. Can be used for any purpose but may not be published by components outside of the private network.
MAV_COMP_ID_USER26 = Simulink.Parameter(50, StorageClass="Const")  % Id for a component on privately managed MAVLink network. Can be used for any purpose but may not be published by components outside of the private network.
MAV_COMP_ID_USER27 = Simulink.Parameter(51, StorageClass="Const")  % Id for a component on privately managed MAVLink network. Can be used for any purpose but may not be published by components outside of the private network.
MAV_COMP_ID_USER28 = Simulink.Parameter(52, StorageClass="Const")  % Id for a component on privately managed MAVLink network. Can be used for any purpose but may not be published by components outside of the private network.
MAV_COMP_ID_USER29 = Simulink.Parameter(53, StorageClass="Const")  % Id for a component on privately managed MAVLink network. Can be used for any purpose but may not be published by components outside of the private network.
MAV_COMP_ID_USER30 = Simulink.Parameter(54, StorageClass="Const")  % Id for a component on privately managed MAVLink network. Can be used for any purpose but may not be published by components outside of the private network.
MAV_COMP_ID_USER31 = Simulink.Parameter(55, StorageClass="Const")  % Id for a component on privately managed MAVLink network. Can be used for any purpose but may not be published by components outside of the private network.
MAV_COMP_ID_USER32 = Simulink.Parameter(56, StorageClass="Const")  % Id for a component on privately managed MAVLink network. Can be used for any purpose but may not be published by components outside of the private network.
MAV_COMP_ID_USER33 = Simulink.Parameter(57, StorageClass="Const")  % Id for a component on privately managed MAVLink network. Can be used for any purpose but may not be published by components outside of the private network.
MAV_COMP_ID_USER34 = Simulink.Parameter(58, StorageClass="Const")  % Id for a component on privately managed MAVLink network. Can be used for any purpose but may not be published by components outside of the private network.
MAV_COMP_ID_USER35 = Simulink.Parameter(59, StorageClass="Const")  % Id for a component on privately managed MAVLink network. Can be used for any purpose but may not be published by components outside of the private network.
MAV_COMP_ID_USER36 = Simulink.Parameter(60, StorageClass="Const")  % Id for a component on privately managed MAVLink network. Can be used for any purpose but may not be published by components outside of the private network.
MAV_COMP_ID_USER37 = Simulink.Parameter(61, StorageClass="Const")  % Id for a component on privately managed MAVLink network. Can be used for any purpose but may not be published by components outside of the private network.
MAV_COMP_ID_USER38 = Simulink.Parameter(62, StorageClass="Const")  % Id for a component on privately managed MAVLink network. Can be used for any purpose but may not be published by components outside of the private network.
MAV_COMP_ID_USER39 = Simulink.Parameter(63, StorageClass="Const")  % Id for a component on privately managed MAVLink network. Can be used for any purpose but may not be published by components outside of the private network.
MAV_COMP_ID_USER40 = Simulink.Parameter(64, StorageClass="Const")  % Id for a component on privately managed MAVLink network. Can be used for any purpose but may not be published by components outside of the private network.
MAV_COMP_ID_USER41 = Simulink.Parameter(65, StorageClass="Const")  % Id for a component on privately managed MAVLink network. Can be used for any purpose but may not be published by components outside of the private network.
MAV_COMP_ID_USER42 = Simulink.Parameter(66, StorageClass="Const")  % Id for a component on privately managed MAVLink network. Can be used for any purpose but may not be published by components outside of the private network.
MAV_COMP_ID_USER43 = Simulink.Parameter(67, StorageClass="Const")  % Id for a component on privately managed MAVLink network. Can be used for any purpose but may not be published by components outside of the private network.
MAV_COMP_ID_TELEMETRY_RADIO = Simulink.Parameter(68, StorageClass="Const")  % Telemetry radio (e.g. SiK radio, or other component that emits RADIO_STATUS messages).
MAV_COMP_ID_USER45 = Simulink.Parameter(69, StorageClass="Const")  % Id for a component on privately managed MAVLink network. Can be used for any purpose but may not be published by components outside of the private network.
MAV_COMP_ID_USER46 = Simulink.Parameter(70, StorageClass="Const")  % Id for a component on privately managed MAVLink network. Can be used for any purpose but may not be published by components outside of the private network.
MAV_COMP_ID_USER47 = Simulink.Parameter(71, StorageClass="Const")  % Id for a component on privately managed MAVLink network. Can be used for any purpose but may not be published by components outside of the private network.
MAV_COMP_ID_USER48 = Simulink.Parameter(72, StorageClass="Const")  % Id for a component on privately managed MAVLink network. Can be used for any purpose but may not be published by components outside of the private network.
MAV_COMP_ID_USER49 = Simulink.Parameter(73, StorageClass="Const")  % Id for a component on privately managed MAVLink network. Can be used for any purpose but may not be published by components outside of the private network.
MAV_COMP_ID_USER50 = Simulink.Parameter(74, StorageClass="Const")  % Id for a component on privately managed MAVLink network. Can be used for any purpose but may not be published by components outside of the private network.
MAV_COMP_ID_USER51 = Simulink.Parameter(75, StorageClass="Const")  % Id for a component on privately managed MAVLink network. Can be used for any purpose but may not be published by components outside of the private network.
MAV_COMP_ID_USER52 = Simulink.Parameter(76, StorageClass="Const")  % Id for a component on privately managed MAVLink network. Can be used for any purpose but may not be published by components outside of the private network.
MAV_COMP_ID_USER53 = Simulink.Parameter(77, StorageClass="Const")  % Id for a component on privately managed MAVLink network. Can be used for any purpose but may not be published by components outside of the private network.
MAV_COMP_ID_USER54 = Simulink.Parameter(78, StorageClass="Const")  % Id for a component on privately managed MAVLink network. Can be used for any purpose but may not be published by components outside of the private network.
MAV_COMP_ID_USER55 = Simulink.Parameter(79, StorageClass="Const")  % Id for a component on privately managed MAVLink network. Can be used for any purpose but may not be published by components outside of the private network.
MAV_COMP_ID_USER56 = Simulink.Parameter(80, StorageClass="Const")  % Id for a component on privately managed MAVLink network. Can be used for any purpose but may not be published by components outside of the private network.
MAV_COMP_ID_USER57 = Simulink.Parameter(81, StorageClass="Const")  % Id for a component on privately managed MAVLink network. Can be used for any purpose but may not be published by components outside of the private network.
MAV_COMP_ID_USER58 = Simulink.Parameter(82, StorageClass="Const")  % Id for a component on privately managed MAVLink network. Can be used for any purpose but may not be published by components outside of the private network.
MAV_COMP_ID_USER59 = Simulink.Parameter(83, StorageClass="Const")  % Id for a component on privately managed MAVLink network. Can be used for any purpose but may not be published by components outside of the private network.
MAV_COMP_ID_USER60 = Simulink.Parameter(84, StorageClass="Const")  % Id for a component on privately managed MAVLink network. Can be used for any purpose but may not be published by components outside of the private network.
MAV_COMP_ID_USER61 = Simulink.Parameter(85, StorageClass="Const")  % Id for a component on privately managed MAVLink network. Can be used for any purpose but may not be published by components outside of the private network.
MAV_COMP_ID_USER62 = Simulink.Parameter(86, StorageClass="Const")  % Id for a component on privately managed MAVLink network. Can be used for any purpose but may not be published by components outside of the private network.
MAV_COMP_ID_USER63 = Simulink.Parameter(87, StorageClass="Const")  % Id for a component on privately managed MAVLink network. Can be used for any purpose but may not be published by components outside of the private network.
MAV_COMP_ID_USER64 = Simulink.Parameter(88, StorageClass="Const")  % Id for a component on privately managed MAVLink network. Can be used for any purpose but may not be published by components outside of the private network.
MAV_COMP_ID_USER65 = Simulink.Parameter(89, StorageClass="Const")  % Id for a component on privately managed MAVLink network. Can be used for any purpose but may not be published by components outside of the private network.
MAV_COMP_ID_USER66 = Simulink.Parameter(90, StorageClass="Const")  % Id for a component on privately managed MAVLink network. Can be used for any purpose but may not be published by components outside of the private network.
MAV_COMP_ID_USER67 = Simulink.Parameter(91, StorageClass="Const")  % Id for a component on privately managed MAVLink network. Can be used for any purpose but may not be published by components outside of the private network.
MAV_COMP_ID_USER68 = Simulink.Parameter(92, StorageClass="Const")  % Id for a component on privately managed MAVLink network. Can be used for any purpose but may not be published by components outside of the private network.
MAV_COMP_ID_USER69 = Simulink.Parameter(93, StorageClass="Const")  % Id for a component on privately managed MAVLink network. Can be used for any purpose but may not be published by components outside of the private network.
MAV_COMP_ID_USER70 = Simulink.Parameter(94, StorageClass="Const")  % Id for a component on privately managed MAVLink network. Can be used for any purpose but may not be published by components outside of the private network.
MAV_COMP_ID_USER71 = Simulink.Parameter(95, StorageClass="Const")  % Id for a component on privately managed MAVLink network. Can be used for any purpose but may not be published by components outside of the private network.
MAV_COMP_ID_USER72 = Simulink.Parameter(96, StorageClass="Const")  % Id for a component on privately managed MAVLink network. Can be used for any purpose but may not be published by components outside of the private network.
MAV_COMP_ID_USER73 = Simulink.Parameter(97, StorageClass="Const")  % Id for a component on privately managed MAVLink network. Can be used for any purpose but may not be published by components outside of the private network.
MAV_COMP_ID_USER74 = Simulink.Parameter(98, StorageClass="Const")  % Id for a component on privately managed MAVLink network. Can be used for any purpose but may not be published by components outside of the private network.
MAV_COMP_ID_USER75 = Simulink.Parameter(99, StorageClass="Const")  % Id for a component on privately managed MAVLink network. Can be used for any purpose but may not be published by components outside of the private network.
MAV_COMP_ID_CAMERA = Simulink.Parameter(100, StorageClass="Const")  % Camera #1.
MAV_COMP_ID_CAMERA2 = Simulink.Parameter(101, StorageClass="Const")  % Camera #2.
MAV_COMP_ID_CAMERA3 = Simulink.Parameter(102, StorageClass="Const")  % Camera #3.
MAV_COMP_ID_CAMERA4 = Simulink.Parameter(103, StorageClass="Const")  % Camera #4.
MAV_COMP_ID_CAMERA5 = Simulink.Parameter(104, StorageClass="Const")  % Camera #5.
MAV_COMP_ID_CAMERA6 = Simulink.Parameter(105, StorageClass="Const")  % Camera #6.
MAV_COMP_ID_SERVO1 = Simulink.Parameter(140, StorageClass="Const")  % Servo #1.
MAV_COMP_ID_SERVO2 = Simulink.Parameter(141, StorageClass="Const")  % Servo #2.
MAV_COMP_ID_SERVO3 = Simulink.Parameter(142, StorageClass="Const")  % Servo #3.
MAV_COMP_ID_SERVO4 = Simulink.Parameter(143, StorageClass="Const")  % Servo #4.
MAV_COMP_ID_SERVO5 = Simulink.Parameter(144, StorageClass="Const")  % Servo #5.
MAV_COMP_ID_SERVO6 = Simulink.Parameter(145, StorageClass="Const")  % Servo #6.
MAV_COMP_ID_SERVO7 = Simulink.Parameter(146, StorageClass="Const")  % Servo #7.
MAV_COMP_ID_SERVO8 = Simulink.Parameter(147, StorageClass="Const")  % Servo #8.
MAV_COMP_ID_SERVO9 = Simulink.Parameter(148, StorageClass="Const")  % Servo #9.
MAV_COMP_ID_SERVO10 = Simulink.Parameter(149, StorageClass="Const")  % Servo #10.
MAV_COMP_ID_SERVO11 = Simulink.Parameter(150, StorageClass="Const")  % Servo #11.
MAV_COMP_ID_SERVO12 = Simulink.Parameter(151, StorageClass="Const")  % Servo #12.
MAV_COMP_ID_SERVO13 = Simulink.Parameter(152, StorageClass="Const")  % Servo #13.
MAV_COMP_ID_SERVO14 = Simulink.Parameter(153, StorageClass="Const")  % Servo #14.
MAV_COMP_ID_GIMBAL = Simulink.Parameter(154, StorageClass="Const")  % Gimbal #1.
MAV_COMP_ID_LOG = Simulink.Parameter(155, StorageClass="Const")  % Logging component.
MAV_COMP_ID_ADSB = Simulink.Parameter(156, StorageClass="Const")  % Automatic Dependent Surveillance-Broadcast (ADS-B) component.
MAV_COMP_ID_OSD = Simulink.Parameter(157, StorageClass="Const")  % On Screen Display (OSD) devices for video links.
MAV_COMP_ID_PERIPHERAL = Simulink.Parameter(158, StorageClass="Const")  % Generic autopilot peripheral component ID. Meant for devices that do not implement the parameter microservice.
MAV_COMP_ID_QX1_GIMBAL = Simulink.Parameter(159, StorageClass="Const")  % Gimbal ID for QX1.
MAV_COMP_ID_FLARM = Simulink.Parameter(160, StorageClass="Const")  % FLARM collision alert component.
MAV_COMP_ID_PARACHUTE = Simulink.Parameter(161, StorageClass="Const")  % Parachute component.
MAV_COMP_ID_WINCH = Simulink.Parameter(169, StorageClass="Const")  % Winch component.
MAV_COMP_ID_GIMBAL2 = Simulink.Parameter(171, StorageClass="Const")  % Gimbal #2.
MAV_COMP_ID_GIMBAL3 = Simulink.Parameter(172, StorageClass="Const")  % Gimbal #3.
MAV_COMP_ID_GIMBAL4 = Simulink.Parameter(173, StorageClass="Const")  % Gimbal #4
MAV_COMP_ID_GIMBAL5 = Simulink.Parameter(174, StorageClass="Const")  % Gimbal #5.
MAV_COMP_ID_GIMBAL6 = Simulink.Parameter(175, StorageClass="Const")  % Gimbal #6.
MAV_COMP_ID_BATTERY = Simulink.Parameter(180, StorageClass="Const")  % Battery #1.
MAV_COMP_ID_BATTERY2 = Simulink.Parameter(181, StorageClass="Const")  % Battery #2.
MAV_COMP_ID_MAVCAN = Simulink.Parameter(189, StorageClass="Const")  % CAN over MAVLink client.
MAV_COMP_ID_MISSIONPLANNER = Simulink.Parameter(190, StorageClass="Const")  % Component that can generate/supply a mission flight plan (e.g. GCS or developer API).
MAV_COMP_ID_ONBOARD_COMPUTER = Simulink.Parameter(191, StorageClass="Const")  % Component that lives on the onboard computer (companion computer) and has some generic functionalities, such as settings system parameters and monitoring the status of some processes that don't directly speak mavlink and so on.
MAV_COMP_ID_ONBOARD_COMPUTER2 = Simulink.Parameter(192, StorageClass="Const")  % Component that lives on the onboard computer (companion computer) and has some generic functionalities, such as settings system parameters and monitoring the status of some processes that don't directly speak mavlink and so on.
MAV_COMP_ID_ONBOARD_COMPUTER3 = Simulink.Parameter(193, StorageClass="Const")  % Component that lives on the onboard computer (companion computer) and has some generic functionalities, such as settings system parameters and monitoring the status of some processes that don't directly speak mavlink and so on.
MAV_COMP_ID_ONBOARD_COMPUTER4 = Simulink.Parameter(194, StorageClass="Const")  % Component that lives on the onboard computer (companion computer) and has some generic functionalities, such as settings system parameters and monitoring the status of some processes that don't directly speak mavlink and so on.
MAV_COMP_ID_PATHPLANNER = Simulink.Parameter(195, StorageClass="Const")  % Component that finds an optimal path between points based on a certain constraint (e.g. minimum snap, shortest path, cost, etc.).
MAV_COMP_ID_OBSTACLE_AVOIDANCE = Simulink.Parameter(196, StorageClass="Const")  % Component that plans a collision free path between two points.
MAV_COMP_ID_VISUAL_INERTIAL_ODOMETRY = Simulink.Parameter(197, StorageClass="Const")  % Component that provides position estimates using VIO techniques.
MAV_COMP_ID_PAIRING_MANAGER = Simulink.Parameter(198, StorageClass="Const")  % Component that manages pairing of vehicle and GCS.
MAV_COMP_ID_IMU = Simulink.Parameter(200, StorageClass="Const")  % Inertial Measurement Unit (IMU) #1.
MAV_COMP_ID_IMU_2 = Simulink.Parameter(201, StorageClass="Const")  % Inertial Measurement Unit (IMU) #2.
MAV_COMP_ID_IMU_3 = Simulink.Parameter(202, StorageClass="Const")  % Inertial Measurement Unit (IMU) #3.
MAV_COMP_ID_GPS = Simulink.Parameter(220, StorageClass="Const")  % GPS #1.
MAV_COMP_ID_GPS2 = Simulink.Parameter(221, StorageClass="Const")  % GPS #2.
MAV_COMP_ID_ODID_TXRX_1 = Simulink.Parameter(236, StorageClass="Const")  % Open Drone ID transmitter/receiver (Bluetooth/WiFi/Internet).
MAV_COMP_ID_ODID_TXRX_2 = Simulink.Parameter(237, StorageClass="Const")  % Open Drone ID transmitter/receiver (Bluetooth/WiFi/Internet).
MAV_COMP_ID_ODID_TXRX_3 = Simulink.Parameter(238, StorageClass="Const")  % Open Drone ID transmitter/receiver (Bluetooth/WiFi/Internet).
MAV_COMP_ID_UDP_BRIDGE = Simulink.Parameter(240, StorageClass="Const")  % Component to bridge MAVLink to UDP (i.e. from a UART).
MAV_COMP_ID_UART_BRIDGE = Simulink.Parameter(241, StorageClass="Const")  % Component to bridge to UART (i.e. from UDP).
MAV_COMP_ID_TUNNEL_NODE = Simulink.Parameter(242, StorageClass="Const")  % Component handling TUNNEL messages (e.g. vendor specific GUI of a component).
MAV_COMP_ID_SYSTEM_CONTROL = Simulink.Parameter(250, StorageClass="Const")  % Deprecated, don't use. Component for handling system messages (e.g. to ARM, takeoff, etc.).

MAV_COMPONENT = enum(AddClassNameToEnumNames=true)  % Component ids (values) for the different types and instances of onboard hardware/software that might make up a MAVLink system (autopilot, cameras, servos, GPS systems, avoidance systems etc.).
  % Components must use the appropriate ID in their source address when sending messages. Components can also use IDs to determine if they are the intended recipient of an incoming message. The MAV_COMP_ID_ALL value is used to indicate messages that must be processed by all components.
  % When creating new entries, components that can have multiple instances (e.g. cameras, servos etc.) should be allocated sequential values. An appropriate number of values should be left free after these components to allow the number of instances to be expanded.
  MAV_COMP_ID_ALL = 0  % Target id (target_component) used to broadcast messages to all components of the receiving system. Components should attempt to process messages with this component ID and forward to components on any other interfaces. Note: This is not a valid *source* component id for a message.
  MAV_COMP_ID_AUTOPILOT1 = 1  % System flight controller component ("autopilot"). Only one autopilot is expected in a particular system.
  MAV_COMP_ID_USER1 = 25  % Id for a component on privately managed MAVLink network. Can be used for any purpose but may not be published by components outside of the private network.
  MAV_COMP_ID_USER2 = 26  % Id for a component on privately managed MAVLink network. Can be used for any purpose but may not be published by components outside of the private network.
  MAV_COMP_ID_USER3 = 27  % Id for a component on privately managed MAVLink network. Can be used for any purpose but may not be published by components outside of the private network.
  MAV_COMP_ID_USER4 = 28  % Id for a component on privately managed MAVLink network. Can be used for any purpose but may not be published by components outside of the private network.
  MAV_COMP_ID_USER5 = 29  % Id for a component on privately managed MAVLink network. Can be used for any purpose but may not be published by components outside of the private network.
  MAV_COMP_ID_USER6 = 30  % Id for a component on privately managed MAVLink network. Can be used for any purpose but may not be published by components outside of the private network.
  MAV_COMP_ID_USER7 = 31  % Id for a component on privately managed MAVLink network. Can be used for any purpose but may not be published by components outside of the private network.
  MAV_COMP_ID_USER8 = 32  % Id for a component on privately managed MAVLink network. Can be used for any purpose but may not be published by components outside of the private network.
  MAV_COMP_ID_USER9 = 33  % Id for a component on privately managed MAVLink network. Can be used for any purpose but may not be published by components outside of the private network.
  MAV_COMP_ID_USER10 = 34  % Id for a component on privately managed MAVLink network. Can be used for any purpose but may not be published by components outside of the private network.
  MAV_COMP_ID_USER11 = 35  % Id for a component on privately managed MAVLink network. Can be used for any purpose but may not be published by components outside of the private network.
  MAV_COMP_ID_USER12 = 36  % Id for a component on privately managed MAVLink network. Can be used for any purpose but may not be published by components outside of the private network.
  MAV_COMP_ID_USER13 = 37  % Id for a component on privately managed MAVLink network. Can be used for any purpose but may not be published by components outside of the private network.
  MAV_COMP_ID_USER14 = 38  % Id for a component on privately managed MAVLink network. Can be used for any purpose but may not be published by components outside of the private network.
  MAV_COMP_ID_USER15 = 39  % Id for a component on privately managed MAVLink network. Can be used for any purpose but may not be published by components outside of the private network.
  MAV_COMP_ID_USER16 = 40  % Id for a component on privately managed MAVLink network. Can be used for any purpose but may not be published by components outside of the private network.
  MAV_COMP_ID_USER17 = 41  % Id for a component on privately managed MAVLink network. Can be used for any purpose but may not be published by components outside of the private network.
  MAV_COMP_ID_USER18 = 42  % Id for a component on privately managed MAVLink network. Can be used for any purpose but may not be published by components outside of the private network.
  MAV_COMP_ID_USER19 = 43  % Id for a component on privately managed MAVLink network. Can be used for any purpose but may not be published by components outside of the private network.
  MAV_COMP_ID_USER20 = 44  % Id for a component on privately managed MAVLink network. Can be used for any purpose but may not be published by components outside of the private network.
  MAV_COMP_ID_USER21 = 45  % Id for a component on privately managed MAVLink network. Can be used for any purpose but may not be published by components outside of the private network.
  MAV_COMP_ID_USER22 = 46  % Id for a component on privately managed MAVLink network. Can be used for any purpose but may not be published by components outside of the private network.
  MAV_COMP_ID_USER23 = 47  % Id for a component on privately managed MAVLink network. Can be used for any purpose but may not be published by components outside of the private network.
  MAV_COMP_ID_USER24 = 48  % Id for a component on privately managed MAVLink network. Can be used for any purpose but may not be published by components outside of the private network.
  MAV_COMP_ID_USER25 = 49  % Id for a component on privately managed MAVLink network. Can be used for any purpose but may not be published by components outside of the private network.
  MAV_COMP_ID_USER26 = 50  % Id for a component on privately managed MAVLink network. Can be used for any purpose but may not be published by components outside of the private network.
  MAV_COMP_ID_USER27 = 51  % Id for a component on privately managed MAVLink network. Can be used for any purpose but may not be published by components outside of the private network.
  MAV_COMP_ID_USER28 = 52  % Id for a component on privately managed MAVLink network. Can be used for any purpose but may not be published by components outside of the private network.
  MAV_COMP_ID_USER29 = 53  % Id for a component on privately managed MAVLink network. Can be used for any purpose but may not be published by components outside of the private network.
  MAV_COMP_ID_USER30 = 54  % Id for a component on privately managed MAVLink network. Can be used for any purpose but may not be published by components outside of the private network.
  MAV_COMP_ID_USER31 = 55  % Id for a component on privately managed MAVLink network. Can be used for any purpose but may not be published by components outside of the private network.
  MAV_COMP_ID_USER32 = 56  % Id for a component on privately managed MAVLink network. Can be used for any purpose but may not be published by components outside of the private network.
  MAV_COMP_ID_USER33 = 57  % Id for a component on privately managed MAVLink network. Can be used for any purpose but may not be published by components outside of the private network.
  MAV_COMP_ID_USER34 = 58  % Id for a component on privately managed MAVLink network. Can be used for any purpose but may not be published by components outside of the private network.
  MAV_COMP_ID_USER35 = 59  % Id for a component on privately managed MAVLink network. Can be used for any purpose but may not be published by components outside of the private network.
  MAV_COMP_ID_USER36 = 60  % Id for a component on privately managed MAVLink network. Can be used for any purpose but may not be published by components outside of the private network.
  MAV_COMP_ID_USER37 = 61  % Id for a component on privately managed MAVLink network. Can be used for any purpose but may not be published by components outside of the private network.
  MAV_COMP_ID_USER38 = 62  % Id for a component on privately managed MAVLink network. Can be used for any purpose but may not be published by components outside of the private network.
  MAV_COMP_ID_USER39 = 63  % Id for a component on privately managed MAVLink network. Can be used for any purpose but may not be published by components outside of the private network.
  MAV_COMP_ID_USER40 = 64  % Id for a component on privately managed MAVLink network. Can be used for any purpose but may not be published by components outside of the private network.
  MAV_COMP_ID_USER41 = 65  % Id for a component on privately managed MAVLink network. Can be used for any purpose but may not be published by components outside of the private network.
  MAV_COMP_ID_USER42 = 66  % Id for a component on privately managed MAVLink network. Can be used for any purpose but may not be published by components outside of the private network.
  MAV_COMP_ID_USER43 = 67  % Id for a component on privately managed MAVLink network. Can be used for any purpose but may not be published by components outside of the private network.
  MAV_COMP_ID_TELEMETRY_RADIO = 68  % Telemetry radio (e.g. SiK radio, or other component that emits RADIO_STATUS messages).
  MAV_COMP_ID_USER45 = 69  % Id for a component on privately managed MAVLink network. Can be used for any purpose but may not be published by components outside of the private network.
  MAV_COMP_ID_USER46 = 70  % Id for a component on privately managed MAVLink network. Can be used for any purpose but may not be published by components outside of the private network.
  MAV_COMP_ID_USER47 = 71  % Id for a component on privately managed MAVLink network. Can be used for any purpose but may not be published by components outside of the private network.
  MAV_COMP_ID_USER48 = 72  % Id for a component on privately managed MAVLink network. Can be used for any purpose but may not be published by components outside of the private network.
  MAV_COMP_ID_USER49 = 73  % Id for a component on privately managed MAVLink network. Can be used for any purpose but may not be published by components outside of the private network.
  MAV_COMP_ID_USER50 = 74  % Id for a component on privately managed MAVLink network. Can be used for any purpose but may not be published by components outside of the private network.
  MAV_COMP_ID_USER51 = 75  % Id for a component on privately managed MAVLink network. Can be used for any purpose but may not be published by components outside of the private network.
  MAV_COMP_ID_USER52 = 76  % Id for a component on privately managed MAVLink network. Can be used for any purpose but may not be published by components outside of the private network.
  MAV_COMP_ID_USER53 = 77  % Id for a component on privately managed MAVLink network. Can be used for any purpose but may not be published by components outside of the private network.
  MAV_COMP_ID_USER54 = 78  % Id for a component on privately managed MAVLink network. Can be used for any purpose but may not be published by components outside of the private network.
  MAV_COMP_ID_USER55 = 79  % Id for a component on privately managed MAVLink network. Can be used for any purpose but may not be published by components outside of the private network.
  MAV_COMP_ID_USER56 = 80  % Id for a component on privately managed MAVLink network. Can be used for any purpose but may not be published by components outside of the private network.
  MAV_COMP_ID_USER57 = 81  % Id for a component on privately managed MAVLink network. Can be used for any purpose but may not be published by components outside of the private network.
  MAV_COMP_ID_USER58 = 82  % Id for a component on privately managed MAVLink network. Can be used for any purpose but may not be published by components outside of the private network.
  MAV_COMP_ID_USER59 = 83  % Id for a component on privately managed MAVLink network. Can be used for any purpose but may not be published by components outside of the private network.
  MAV_COMP_ID_USER60 = 84  % Id for a component on privately managed MAVLink network. Can be used for any purpose but may not be published by components outside of the private network.
  MAV_COMP_ID_USER61 = 85  % Id for a component on privately managed MAVLink network. Can be used for any purpose but may not be published by components outside of the private network.
  MAV_COMP_ID_USER62 = 86  % Id for a component on privately managed MAVLink network. Can be used for any purpose but may not be published by components outside of the private network.
  MAV_COMP_ID_USER63 = 87  % Id for a component on privately managed MAVLink network. Can be used for any purpose but may not be published by components outside of the private network.
  MAV_COMP_ID_USER64 = 88  % Id for a component on privately managed MAVLink network. Can be used for any purpose but may not be published by components outside of the private network.
  MAV_COMP_ID_USER65 = 89  % Id for a component on privately managed MAVLink network. Can be used for any purpose but may not be published by components outside of the private network.
  MAV_COMP_ID_USER66 = 90  % Id for a component on privately managed MAVLink network. Can be used for any purpose but may not be published by components outside of the private network.
  MAV_COMP_ID_USER67 = 91  % Id for a component on privately managed MAVLink network. Can be used for any purpose but may not be published by components outside of the private network.
  MAV_COMP_ID_USER68 = 92  % Id for a component on privately managed MAVLink network. Can be used for any purpose but may not be published by components outside of the private network.
  MAV_COMP_ID_USER69 = 93  % Id for a component on privately managed MAVLink network. Can be used for any purpose but may not be published by components outside of the private network.
  MAV_COMP_ID_USER70 = 94  % Id for a component on privately managed MAVLink network. Can be used for any purpose but may not be published by components outside of the private network.
  MAV_COMP_ID_USER71 = 95  % Id for a component on privately managed MAVLink network. Can be used for any purpose but may not be published by components outside of the private network.
  MAV_COMP_ID_USER72 = 96  % Id for a component on privately managed MAVLink network. Can be used for any purpose but may not be published by components outside of the private network.
  MAV_COMP_ID_USER73 = 97  % Id for a component on privately managed MAVLink network. Can be used for any purpose but may not be published by components outside of the private network.
  MAV_COMP_ID_USER74 = 98  % Id for a component on privately managed MAVLink network. Can be used for any purpose but may not be published by components outside of the private network.
  MAV_COMP_ID_USER75 = 99  % Id for a component on privately managed MAVLink network. Can be used for any purpose but may not be published by components outside of the private network.
  MAV_COMP_ID_CAMERA = 100  % Camera #1.
  MAV_COMP_ID_CAMERA2 = 101  % Camera #2.
  MAV_COMP_ID_CAMERA3 = 102  % Camera #3.
  MAV_COMP_ID_CAMERA4 = 103  % Camera #4.
  MAV_COMP_ID_CAMERA5 = 104  % Camera #5.
  MAV_COMP_ID_CAMERA6 = 105  % Camera #6.
  MAV_COMP_ID_SERVO1 = 140  % Servo #1.
  MAV_COMP_ID_SERVO2 = 141  % Servo #2.
  MAV_COMP_ID_SERVO3 = 142  % Servo #3.
  MAV_COMP_ID_SERVO4 = 143  % Servo #4.
  MAV_COMP_ID_SERVO5 = 144  % Servo #5.
  MAV_COMP_ID_SERVO6 = 145  % Servo #6.
  MAV_COMP_ID_SERVO7 = 146  % Servo #7.
  MAV_COMP_ID_SERVO8 = 147  % Servo #8.
  MAV_COMP_ID_SERVO9 = 148  % Servo #9.
  MAV_COMP_ID_SERVO10 = 149  % Servo #10.
  MAV_COMP_ID_SERVO11 = 150  % Servo #11.
  MAV_COMP_ID_SERVO12 = 151  % Servo #12.
  MAV_COMP_ID_SERVO13 = 152  % Servo #13.
  MAV_COMP_ID_SERVO14 = 153  % Servo #14.
  MAV_COMP_ID_GIMBAL = 154  % Gimbal #1.
  MAV_COMP_ID_LOG = 155  % Logging component.
  MAV_COMP_ID_ADSB = 156  % Automatic Dependent Surveillance-Broadcast (ADS-B) component.
  MAV_COMP_ID_OSD = 157  % On Screen Display (OSD) devices for video links.
  MAV_COMP_ID_PERIPHERAL = 158  % Generic autopilot peripheral component ID. Meant for devices that do not implement the parameter microservice.
  MAV_COMP_ID_QX1_GIMBAL = 159  % Gimbal ID for QX1.
  MAV_COMP_ID_FLARM = 160  % FLARM collision alert component.
  MAV_COMP_ID_PARACHUTE = 161  % Parachute component.
  MAV_COMP_ID_WINCH = 169  % Winch component.
  MAV_COMP_ID_GIMBAL2 = 171  % Gimbal #2.
  MAV_COMP_ID_GIMBAL3 = 172  % Gimbal #3.
  MAV_COMP_ID_GIMBAL4 = 173  % Gimbal #4
  MAV_COMP_ID_GIMBAL5 = 174  % Gimbal #5.
  MAV_COMP_ID_GIMBAL6 = 175  % Gimbal #6.
  MAV_COMP_ID_BATTERY = 180  % Battery #1.
  MAV_COMP_ID_BATTERY2 = 181  % Battery #2.
  MAV_COMP_ID_MAVCAN = 189  % CAN over MAVLink client.
  MAV_COMP_ID_MISSIONPLANNER = 190  % Component that can generate/supply a mission flight plan (e.g. GCS or developer API).
  MAV_COMP_ID_ONBOARD_COMPUTER = 191  % Component that lives on the onboard computer (companion computer) and has some generic functionalities, such as settings system parameters and monitoring the status of some processes that don't directly speak mavlink and so on.
  MAV_COMP_ID_ONBOARD_COMPUTER2 = 192  % Component that lives on the onboard computer (companion computer) and has some generic functionalities, such as settings system parameters and monitoring the status of some processes that don't directly speak mavlink and so on.
  MAV_COMP_ID_ONBOARD_COMPUTER3 = 193  % Component that lives on the onboard computer (companion computer) and has some generic functionalities, such as settings system parameters and monitoring the status of some processes that don't directly speak mavlink and so on.
  MAV_COMP_ID_ONBOARD_COMPUTER4 = 194  % Component that lives on the onboard computer (companion computer) and has some generic functionalities, such as settings system parameters and monitoring the status of some processes that don't directly speak mavlink and so on.
  MAV_COMP_ID_PATHPLANNER = 195  % Component that finds an optimal path between points based on a certain constraint (e.g. minimum snap, shortest path, cost, etc.).
  MAV_COMP_ID_OBSTACLE_AVOIDANCE = 196  % Component that plans a collision free path between two points.
  MAV_COMP_ID_VISUAL_INERTIAL_ODOMETRY = 197  % Component that provides position estimates using VIO techniques.
  MAV_COMP_ID_PAIRING_MANAGER = 198  % Component that manages pairing of vehicle and GCS.
  MAV_COMP_ID_IMU = 200  % Inertial Measurement Unit (IMU) #1.
  MAV_COMP_ID_IMU_2 = 201  % Inertial Measurement Unit (IMU) #2.
  MAV_COMP_ID_IMU_3 = 202  % Inertial Measurement Unit (IMU) #3.
  MAV_COMP_ID_GPS = 220  % GPS #1.
  MAV_COMP_ID_GPS2 = 221  % GPS #2.
  MAV_COMP_ID_ODID_TXRX_1 = 236  % Open Drone ID transmitter/receiver (Bluetooth/WiFi/Internet).
  MAV_COMP_ID_ODID_TXRX_2 = 237  % Open Drone ID transmitter/receiver (Bluetooth/WiFi/Internet).
  MAV_COMP_ID_ODID_TXRX_3 = 238  % Open Drone ID transmitter/receiver (Bluetooth/WiFi/Internet).
  MAV_COMP_ID_UDP_BRIDGE = 240  % Component to bridge MAVLink to UDP (i.e. from a UART).
  MAV_COMP_ID_UART_BRIDGE = 241  % Component to bridge to UART (i.e. from UDP).
  MAV_COMP_ID_TUNNEL_NODE = 242  % Component handling TUNNEL messages (e.g. vendor specific GUI of a component).
  MAV_COMP_ID_SYSTEM_CONTROL = 250  % Deprecated, don't use. Component for handling system messages (e.g. to ARM, takeoff, etc.).

mav_heartbeat_s = Simulink.Bus()  % The heartbeat message shows that a system or component is present and responding. The type and autopilot fields (along with the message component id), allow the receiving system to treat further messages from this system appropriately (e.g. by laying out the user interface based on the autopilot). This microservice is documented at https://mavlink.io/en/services/heartbeat.html
  type: uint8  % Vehicle or component type. For a flight controller component the vehicle type (quadrotor, helicopter, etc.). For other components the component type (e.g. camera, gimbal, etc.). This should be used in preference to component id for identifying the component type.
  autopilot: uint8  % Autopilot type / class. Use MAV_AUTOPILOT_INVALID for components that are not flight controllers.
  base_mode: uint8  % System mode bitmap.
  custom_mode: uint32  % A bitfield for use for autopilot-specific flags
  system_status: uint8  % System status flag.
  mavlink_version: uint8_t_mavlink_version  % MAVLink version, not writable by user, gets added by protocol because of magic data type: uint8_t_mavlink_version

mav_protocol_version_s = Simulink.Bus()  % Version and capability of protocol version. This message can be requested with MAV_CMD_REQUEST_MESSAGE and is used as part of the handshaking to establish which MAVLink version should be used on the network. Every node should respond to a request for PROTOCOL_VERSION to enable the handshaking. Library implementers should consider adding this into the default decoding state machine to allow the protocol core to respond directly.
  version: uint16  % Currently active MAVLink version number * 100: v1.0 is 100, v2.0 is 200, etc.
  min_version: uint16  % Minimum MAVLink version supported
  max_version: uint16  % Maximum MAVLink version supported (set to the same value as version by default)
  spec_version_hash: uint8[8]  % The first 8 bytes (not characters printed in hex!) of the git hash.
  library_version_hash: uint8[8]  % The first 8 bytes (not characters printed in hex!) of the git hash.

MAV_FIRMWARE_VERSION_TYPE_DEV = Simulink.Parameter(0, StorageClass="Const")  % development release
MAV_FIRMWARE_VERSION_TYPE_ALPHA = Simulink.Parameter(64, StorageClass="Const")  % alpha release
MAV_FIRMWARE_VERSION_TYPE_BETA = Simulink.Parameter(128, StorageClass="Const")  % beta release
MAV_FIRMWARE_VERSION_TYPE_RC = Simulink.Parameter(192, StorageClass="Const")  % release candidate
MAV_FIRMWARE_VERSION_TYPE_OFFICIAL = Simulink.Parameter(255, StorageClass="Const")  % official stable release

MAV_FIRMWARE_VERSION_TYPE = enum(AddClassNameToEnumNames=true)  % These values define the type of firmware release.  These values indicate the first version or release of this type.  For example the first alpha release would be 64, the second would be 65.
  DEV = 0  % development release
  ALPHA = 64  % alpha release
  BETA = 128  % beta release
  RC = 192  % release candidate
  OFFICIAL = 255  % official stable release

MAV_HL_FAILURE_FLAG_GPS = Simulink.Parameter(1, StorageClass="Const")  % GPS failure.
MAV_HL_FAILURE_FLAG_DIFFERENTIAL_PRESSURE = Simulink.Parameter(2, StorageClass="Const")  % Differential pressure sensor failure.
MAV_HL_FAILURE_FLAG_ABSOLUTE_PRESSURE = Simulink.Parameter(4, StorageClass="Const")  % Absolute pressure sensor failure.
MAV_HL_FAILURE_FLAG_3D_ACCEL = Simulink.Parameter(8, StorageClass="Const")  % Accelerometer sensor failure.
MAV_HL_FAILURE_FLAG_3D_GYRO = Simulink.Parameter(16, StorageClass="Const")  % Gyroscope sensor failure.
MAV_HL_FAILURE_FLAG_3D_MAG = Simulink.Parameter(32, StorageClass="Const")  % Magnetometer sensor failure.
MAV_HL_FAILURE_FLAG_TERRAIN = Simulink.Parameter(64, StorageClass="Const")  % Terrain subsystem failure.
MAV_HL_FAILURE_FLAG_BATTERY = Simulink.Parameter(128, StorageClass="Const")  % Battery failure/critical low battery.
MAV_HL_FAILURE_FLAG_RC_RECEIVER = Simulink.Parameter(256, StorageClass="Const")  % RC receiver failure/no RC connection.
MAV_HL_FAILURE_FLAG_OFFBOARD_LINK = Simulink.Parameter(512, StorageClass="Const")  % Offboard link failure.
MAV_HL_FAILURE_FLAG_ENGINE = Simulink.Parameter(1024, StorageClass="Const")  % Engine failure.
MAV_HL_FAILURE_FLAG_GEOFENCE = Simulink.Parameter(2048, StorageClass="Const")  % Geofence violation.
MAV_HL_FAILURE_FLAG_ESTIMATOR = Simulink.Parameter(4096, StorageClass="Const")  % Estimator failure, for example measurement rejection or large variances.
MAV_HL_FAILURE_FLAG_MISSION = Simulink.Parameter(8192, StorageClass="Const")  % Mission failure.

MAV_HL_FAILURE_FLAG = enum(AddClassNameToEnumNames=true)  % Flags to report failure cases over the high latency telemetry.
  GPS = 1  % GPS failure.
  DIFFERENTIAL_PRESSURE = 2  % Differential pressure sensor failure.
  ABSOLUTE_PRESSURE = 4  % Absolute pressure sensor failure.
  x3D_ACCEL = 8  % Accelerometer sensor failure.
  x3D_GYRO = 16  % Gyroscope sensor failure.
  x3D_MAG = 32  % Magnetometer sensor failure.
  TERRAIN = 64  % Terrain subsystem failure.
  BATTERY = 128  % Battery failure/critical low battery.
  RC_RECEIVER = 256  % RC receiver failure/no RC connection.
  OFFBOARD_LINK = 512  % Offboard link failure.
  ENGINE = 1024  % Engine failure.
  GEOFENCE = 2048  % Geofence violation.
  ESTIMATOR = 4096  % Estimator failure, for example measurement rejection or large variances.
  MISSION = 8192  % Mission failure.

MAV_GOTO_DO_HOLD = Simulink.Parameter(0, StorageClass="Const")  % Hold at the current position.
MAV_GOTO_DO_CONTINUE = Simulink.Parameter(1, StorageClass="Const")  % Continue with the next item in mission execution.
MAV_GOTO_HOLD_AT_CURRENT_POSITION = Simulink.Parameter(2, StorageClass="Const")  % Hold at the current position of the system
MAV_GOTO_HOLD_AT_SPECIFIED_POSITION = Simulink.Parameter(3, StorageClass="Const")  % Hold at the position specified in the parameters of the DO_HOLD action

MAV_GOTO = enum(AddClassNameToEnumNames=true)  % Actions that may be specified in MAV_CMD_OVERRIDE_GOTO to override mission execution.
  DO_HOLD = 0  % Hold at the current position.
  DO_CONTINUE = 1  % Continue with the next item in mission execution.
  HOLD_AT_CURRENT_POSITION = 2  % Hold at the current position of the system
  HOLD_AT_SPECIFIED_POSITION = 3  % Hold at the position specified in the parameters of the DO_HOLD action

MAV_MODE_PREFLIGHT = Simulink.Parameter(0, StorageClass="Const")  % System is not ready to fly, booting, calibrating, etc. No flag is set.
MAV_MODE_STABILIZE_DISARMED = Simulink.Parameter(80, StorageClass="Const")  % System is allowed to be active, under assisted RC control.
MAV_MODE_STABILIZE_ARMED = Simulink.Parameter(208, StorageClass="Const")  % System is allowed to be active, under assisted RC control.
MAV_MODE_MANUAL_DISARMED = Simulink.Parameter(64, StorageClass="Const")  % System is allowed to be active, under manual (RC) control, no stabilization
MAV_MODE_MANUAL_ARMED = Simulink.Parameter(192, StorageClass="Const")  % System is allowed to be active, under manual (RC) control, no stabilization
MAV_MODE_GUIDED_DISARMED = Simulink.Parameter(88, StorageClass="Const")  % System is allowed to be active, under autonomous control, manual setpoint
MAV_MODE_GUIDED_ARMED = Simulink.Parameter(216, StorageClass="Const")  % System is allowed to be active, under autonomous control, manual setpoint
MAV_MODE_AUTO_DISARMED = Simulink.Parameter(92, StorageClass="Const")  % System is allowed to be active, under autonomous control and navigation (the trajectory is decided onboard and not pre-programmed by waypoints)
MAV_MODE_AUTO_ARMED = Simulink.Parameter(220, StorageClass="Const")  % System is allowed to be active, under autonomous control and navigation (the trajectory is decided onboard and not pre-programmed by waypoints)
MAV_MODE_TEST_DISARMED = Simulink.Parameter(66, StorageClass="Const")  % UNDEFINED mode. This solely depends on the autopilot - use with caution, intended for developers only.
MAV_MODE_TEST_ARMED = Simulink.Parameter(194, StorageClass="Const")  % UNDEFINED mode. This solely depends on the autopilot - use with caution, intended for developers only.

MAV_MODE = enum(AddClassNameToEnumNames=true)  % These defines are predefined OR-combined mode flags. There is no need to use values from this enum, but it
  % simplifies the use of the mode flags. Note that manual input is enabled in all modes as a safety override.
  PREFLIGHT = 0  % System is not ready to fly, booting, calibrating, etc. No flag is set.
  STABILIZE_DISARMED = 80  % System is allowed to be active, under assisted RC control.
  STABILIZE_ARMED = 208  % System is allowed to be active, under assisted RC control.
  MANUAL_DISARMED = 64  % System is allowed to be active, under manual (RC) control, no stabilization
  MANUAL_ARMED = 192  % System is allowed to be active, under manual (RC) control, no stabilization
  GUIDED_DISARMED = 88  % System is allowed to be active, under autonomous control, manual setpoint
  GUIDED_ARMED = 216  % System is allowed to be active, under autonomous control, manual setpoint
  AUTO_DISARMED = 92  % System is allowed to be active, under autonomous control and navigation (the trajectory is decided onboard and not pre-programmed by waypoints)
  AUTO_ARMED = 220  % System is allowed to be active, under autonomous control and navigation (the trajectory is decided onboard and not pre-programmed by waypoints)
  TEST_DISARMED = 66  % UNDEFINED mode. This solely depends on the autopilot - use with caution, intended for developers only.
  TEST_ARMED = 194  % UNDEFINED mode. This solely depends on the autopilot - use with caution, intended for developers only.

MAV_SYS_STATUS_SENSOR_3D_GYRO = Simulink.Parameter(1, StorageClass="Const")  % 0x01 3D gyro
MAV_SYS_STATUS_SENSOR_3D_ACCEL = Simulink.Parameter(2, StorageClass="Const")  % 0x02 3D accelerometer
MAV_SYS_STATUS_SENSOR_3D_MAG = Simulink.Parameter(4, StorageClass="Const")  % 0x04 3D magnetometer
MAV_SYS_STATUS_SENSOR_ABSOLUTE_PRESSURE = Simulink.Parameter(8, StorageClass="Const")  % 0x08 absolute pressure
MAV_SYS_STATUS_SENSOR_DIFFERENTIAL_PRESSURE = Simulink.Parameter(16, StorageClass="Const")  % 0x10 differential pressure
MAV_SYS_STATUS_SENSOR_GPS = Simulink.Parameter(32, StorageClass="Const")  % 0x20 GPS
MAV_SYS_STATUS_SENSOR_OPTICAL_FLOW = Simulink.Parameter(64, StorageClass="Const")  % 0x40 optical flow
MAV_SYS_STATUS_SENSOR_VISION_POSITION = Simulink.Parameter(128, StorageClass="Const")  % 0x80 computer vision position
MAV_SYS_STATUS_SENSOR_LASER_POSITION = Simulink.Parameter(256, StorageClass="Const")  % 0x100 laser based position
MAV_SYS_STATUS_SENSOR_EXTERNAL_GROUND_TRUTH = Simulink.Parameter(512, StorageClass="Const")  % 0x200 external ground truth (Vicon or Leica)
MAV_SYS_STATUS_SENSOR_ANGULAR_RATE_CONTROL = Simulink.Parameter(1024, StorageClass="Const")  % 0x400 3D angular rate control
MAV_SYS_STATUS_SENSOR_ATTITUDE_STABILIZATION = Simulink.Parameter(2048, StorageClass="Const")  % 0x800 attitude stabilization
MAV_SYS_STATUS_SENSOR_YAW_POSITION = Simulink.Parameter(4096, StorageClass="Const")  % 0x1000 yaw position
MAV_SYS_STATUS_SENSOR_Z_ALTITUDE_CONTROL = Simulink.Parameter(8192, StorageClass="Const")  % 0x2000 z/altitude control
MAV_SYS_STATUS_SENSOR_XY_POSITION_CONTROL = Simulink.Parameter(16384, StorageClass="Const")  % 0x4000 x/y position control
MAV_SYS_STATUS_SENSOR_MOTOR_OUTPUTS = Simulink.Parameter(32768, StorageClass="Const")  % 0x8000 motor outputs / control
MAV_SYS_STATUS_SENSOR_RC_RECEIVER = Simulink.Parameter(65536, StorageClass="Const")  % 0x10000 RC receiver
MAV_SYS_STATUS_SENSOR_3D_GYRO2 = Simulink.Parameter(131072, StorageClass="Const")  % 0x20000 2nd 3D gyro
MAV_SYS_STATUS_SENSOR_3D_ACCEL2 = Simulink.Parameter(262144, StorageClass="Const")  % 0x40000 2nd 3D accelerometer
MAV_SYS_STATUS_SENSOR_3D_MAG2 = Simulink.Parameter(524288, StorageClass="Const")  % 0x80000 2nd 3D magnetometer
MAV_SYS_STATUS_GEOFENCE = Simulink.Parameter(1048576, StorageClass="Const")  % 0x100000 geofence
MAV_SYS_STATUS_AHRS = Simulink.Parameter(2097152, StorageClass="Const")  % 0x200000 AHRS subsystem health
MAV_SYS_STATUS_TERRAIN = Simulink.Parameter(4194304, StorageClass="Const")  % 0x400000 Terrain subsystem health
MAV_SYS_STATUS_REVERSE_MOTOR = Simulink.Parameter(8388608, StorageClass="Const")  % 0x800000 Motors are reversed
MAV_SYS_STATUS_LOGGING = Simulink.Parameter(16777216, StorageClass="Const")  % 0x1000000 Logging
MAV_SYS_STATUS_SENSOR_BATTERY = Simulink.Parameter(33554432, StorageClass="Const")  % 0x2000000 Battery
MAV_SYS_STATUS_SENSOR_PROXIMITY = Simulink.Parameter(67108864, StorageClass="Const")  % 0x4000000 Proximity
MAV_SYS_STATUS_SENSOR_SATCOM = Simulink.Parameter(134217728, StorageClass="Const")  % 0x8000000 Satellite Communication
MAV_SYS_STATUS_PREARM_CHECK = Simulink.Parameter(268435456, StorageClass="Const")  % 0x10000000 pre-arm check status. Always healthy when armed
MAV_SYS_STATUS_OBSTACLE_AVOIDANCE = Simulink.Parameter(536870912, StorageClass="Const")  % 0x20000000 Avoidance/collision prevention
MAV_SYS_STATUS_SENSOR_PROPULSION = Simulink.Parameter(1073741824, StorageClass="Const")  % 0x40000000 propulsion (actuator, esc, motor or propellor)
MAV_SYS_STATUS_EXTENSION_USED = Simulink.Parameter(2147483648, StorageClass="Const")  % 0x80000000 Extended bit-field are used for further sensor status bits (needs to be set in onboard_control_sensors_present only)

MAV_SYS_STATUS_SENSOR = enum(AddClassNameToEnumNames=true)  % These encode the sensors whose status is sent as part of the SYS_STATUS message.
  x3D_GYRO = 1  % 0x01 3D gyro
  x3D_ACCEL = 2  % 0x02 3D accelerometer
  x3D_MAG = 4  % 0x04 3D magnetometer
  ABSOLUTE_PRESSURE = 8  % 0x08 absolute pressure
  DIFFERENTIAL_PRESSURE = 16  % 0x10 differential pressure
  GPS = 32  % 0x20 GPS
  OPTICAL_FLOW = 64  % 0x40 optical flow
  VISION_POSITION = 128  % 0x80 computer vision position
  LASER_POSITION = 256  % 0x100 laser based position
  EXTERNAL_GROUND_TRUTH = 512  % 0x200 external ground truth (Vicon or Leica)
  ANGULAR_RATE_CONTROL = 1024  % 0x400 3D angular rate control
  ATTITUDE_STABILIZATION = 2048  % 0x800 attitude stabilization
  YAW_POSITION = 4096  % 0x1000 yaw position
  Z_ALTITUDE_CONTROL = 8192  % 0x2000 z/altitude control
  XY_POSITION_CONTROL = 16384  % 0x4000 x/y position control
  MOTOR_OUTPUTS = 32768  % 0x8000 motor outputs / control
  RC_RECEIVER = 65536  % 0x10000 RC receiver
  x3D_GYRO2 = 131072  % 0x20000 2nd 3D gyro
  x3D_ACCEL2 = 262144  % 0x40000 2nd 3D accelerometer
  x3D_MAG2 = 524288  % 0x80000 2nd 3D magnetometer
  MAV_SYS_STATUS_GEOFENCE = 1048576  % 0x100000 geofence
  MAV_SYS_STATUS_AHRS = 2097152  % 0x200000 AHRS subsystem health
  MAV_SYS_STATUS_TERRAIN = 4194304  % 0x400000 Terrain subsystem health
  MAV_SYS_STATUS_REVERSE_MOTOR = 8388608  % 0x800000 Motors are reversed
  MAV_SYS_STATUS_LOGGING = 16777216  % 0x1000000 Logging
  BATTERY = 33554432  % 0x2000000 Battery
  PROXIMITY = 67108864  % 0x4000000 Proximity
  SATCOM = 134217728  % 0x8000000 Satellite Communication
  MAV_SYS_STATUS_PREARM_CHECK = 268435456  % 0x10000000 pre-arm check status. Always healthy when armed
  MAV_SYS_STATUS_OBSTACLE_AVOIDANCE = 536870912  % 0x20000000 Avoidance/collision prevention
  PROPULSION = 1073741824  % 0x40000000 propulsion (actuator, esc, motor or propellor)

MAV_SYS_STATUS_RECOVERY_SYSTEM = Simulink.Parameter(1, StorageClass="Const")  % 0x01 Recovery system (parachute, balloon, retracts etc)

MAV_SYS_STATUS_SENSOR_EXTENDED = enum(AddClassNameToEnumNames=true)  % These encode the sensors whose status is sent as part of the SYS_STATUS message in the extended fields.
  MAV_SYS_STATUS_RECOVERY_SYSTEM = 1  % 0x01 Recovery system (parachute, balloon, retracts etc)

MAV_FRAME_GLOBAL = Simulink.Parameter(0, StorageClass="Const")  % Global (WGS84) coordinate frame + MSL altitude. First value / x: latitude, second value / y: longitude, third value / z: positive altitude over mean sea level (MSL).
MAV_FRAME_LOCAL_NED = Simulink.Parameter(1, StorageClass="Const")  % NED local tangent frame (x: North, y: East, z: Down) with origin fixed relative to earth.
MAV_FRAME_MISSION = Simulink.Parameter(2, StorageClass="Const")  % NOT a coordinate frame, indicates a mission command.

MAV_FRAME_GLOBAL_RELATIVE_ALT = Simulink.Parameter(3, StorageClass="Const")  % Global (WGS84) coordinate frame + altitude relative to the home position.
  % First value / x: latitude, second value / y: longitude, third value / z: positive altitude with 0 being at the altitude of the home position.

MAV_FRAME_LOCAL_ENU = Simulink.Parameter(4, StorageClass="Const")  % ENU local tangent frame (x: East, y: North, z: Up) with origin fixed relative to earth.
MAV_FRAME_GLOBAL_INT = Simulink.Parameter(5, StorageClass="Const")  % Global (WGS84) coordinate frame (scaled) + MSL altitude. First value / x: latitude in degrees*1E7, second value / y: longitude in degrees*1E7, third value / z: positive altitude over mean sea level (MSL).

MAV_FRAME_GLOBAL_RELATIVE_ALT_INT = Simulink.Parameter(6, StorageClass="Const")  % Global (WGS84) coordinate frame (scaled) + altitude relative to the home position.
  % First value / x: latitude in degrees*1E7, second value / y: longitude in degrees*1E7, third value / z: positive altitude with 0 being at the altitude of the home position.

MAV_FRAME_LOCAL_OFFSET_NED = Simulink.Parameter(7, StorageClass="Const")  % NED local tangent frame (x: North, y: East, z: Down) with origin that travels with the vehicle.
MAV_FRAME_BODY_NED = Simulink.Parameter(8, StorageClass="Const")  % Same as MAV_FRAME_LOCAL_NED when used to represent position values. Same as MAV_FRAME_BODY_FRD when used with velocity/acceleration values.
MAV_FRAME_BODY_OFFSET_NED = Simulink.Parameter(9, StorageClass="Const")  % This is the same as MAV_FRAME_BODY_FRD.
MAV_FRAME_GLOBAL_TERRAIN_ALT = Simulink.Parameter(10, StorageClass="Const")  % Global (WGS84) coordinate frame with AGL altitude (at the waypoint coordinate). First value / x: latitude in degrees, second value / y: longitude in degrees, third value / z: positive altitude in meters with 0 being at ground level in terrain model.
MAV_FRAME_GLOBAL_TERRAIN_ALT_INT = Simulink.Parameter(11, StorageClass="Const")  % Global (WGS84) coordinate frame (scaled) with AGL altitude (at the waypoint coordinate). First value / x: latitude in degrees*1E7, second value / y: longitude in degrees*1E7, third value / z: positive altitude in meters with 0 being at ground level in terrain model.
MAV_FRAME_BODY_FRD = Simulink.Parameter(12, StorageClass="Const")  % FRD local frame aligned to the vehicle's attitude (x: Forward, y: Right, z: Down) with an origin that travels with vehicle.
MAV_FRAME_RESERVED_13 = Simulink.Parameter(13, StorageClass="Const")  % MAV_FRAME_BODY_FLU - Body fixed frame of reference, Z-up (x: Forward, y: Left, z: Up).
MAV_FRAME_RESERVED_14 = Simulink.Parameter(14, StorageClass="Const")  % MAV_FRAME_MOCAP_NED - Odometry local coordinate frame of data given by a motion capture system, Z-down (x: North, y: East, z: Down).
MAV_FRAME_RESERVED_15 = Simulink.Parameter(15, StorageClass="Const")  % MAV_FRAME_MOCAP_ENU - Odometry local coordinate frame of data given by a motion capture system, Z-up (x: East, y: North, z: Up).
MAV_FRAME_RESERVED_16 = Simulink.Parameter(16, StorageClass="Const")  % MAV_FRAME_VISION_NED - Odometry local coordinate frame of data given by a vision estimation system, Z-down (x: North, y: East, z: Down).
MAV_FRAME_RESERVED_17 = Simulink.Parameter(17, StorageClass="Const")  % MAV_FRAME_VISION_ENU - Odometry local coordinate frame of data given by a vision estimation system, Z-up (x: East, y: North, z: Up).
MAV_FRAME_RESERVED_18 = Simulink.Parameter(18, StorageClass="Const")  % MAV_FRAME_ESTIM_NED - Odometry local coordinate frame of data given by an estimator running onboard the vehicle, Z-down (x: North, y: East, z: Down).
MAV_FRAME_RESERVED_19 = Simulink.Parameter(19, StorageClass="Const")  % MAV_FRAME_ESTIM_ENU - Odometry local coordinate frame of data given by an estimator running onboard the vehicle, Z-up (x: East, y: North, z: Up).
MAV_FRAME_LOCAL_FRD = Simulink.Parameter(20, StorageClass="Const")  % FRD local tangent frame (x: Forward, y: Right, z: Down) with origin fixed relative to earth. The forward axis is aligned to the front of the vehicle in the horizontal plane.
MAV_FRAME_LOCAL_FLU = Simulink.Parameter(21, StorageClass="Const")  % FLU local tangent frame (x: Forward, y: Left, z: Up) with origin fixed relative to earth. The forward axis is aligned to the front of the vehicle in the horizontal plane.

MAV_FRAME = enum(AddClassNameToEnumNames=true)  % Coordinate frames used by MAVLink. Not all frames are supported by all commands, messages, or vehicles.
  % Global frames use the following naming conventions:
  % - "GLOBAL": Global coordinate frame with WGS84 latitude/longitude and altitude positive over mean sea level (MSL) by default.
  % The following modifiers may be used with "GLOBAL":
  % - "RELATIVE_ALT": Altitude is relative to the vehicle home position rather than MSL.
  % - "TERRAIN_ALT": Altitude is relative to ground level rather than MSL.
  % - "INT": Latitude/longitude (in degrees) are scaled by multiplying by 1E7.
  % Local frames use the following naming conventions:
  % - "LOCAL": Origin of local frame is fixed relative to earth. Unless otherwise specified this origin is the origin of the vehicle position-estimator ("EKF").
  % - "BODY": Origin of local frame travels with the vehicle. NOTE, "BODY" does NOT indicate alignment of frame axis with vehicle attitude.
  % - "OFFSET": Deprecated synonym for "BODY" (origin travels with the vehicle). Not to be used for new frames.
  % Some deprecated frames do not follow these conventions (e.g. MAV_FRAME_BODY_NED and MAV_FRAME_BODY_OFFSET_NED).
  GLOBAL = 0  % Global (WGS84) coordinate frame + MSL altitude. First value / x: latitude, second value / y: longitude, third value / z: positive altitude over mean sea level (MSL).
  LOCAL_NED = 1  % NED local tangent frame (x: North, y: East, z: Down) with origin fixed relative to earth.
  MISSION = 2  % NOT a coordinate frame, indicates a mission command.
  GLOBAL_RELATIVE_ALT = 3  % Global (WGS84) coordinate frame + altitude relative to the home position.
    % First value / x: latitude, second value / y: longitude, third value / z: positive altitude with 0 being at the altitude of the home position.
  LOCAL_ENU = 4  % ENU local tangent frame (x: East, y: North, z: Up) with origin fixed relative to earth.
  GLOBAL_INT = 5  % Global (WGS84) coordinate frame (scaled) + MSL altitude. First value / x: latitude in degrees*1E7, second value / y: longitude in degrees*1E7, third value / z: positive altitude over mean sea level (MSL).
  GLOBAL_RELATIVE_ALT_INT = 6  % Global (WGS84) coordinate frame (scaled) + altitude relative to the home position.
    % First value / x: latitude in degrees*1E7, second value / y: longitude in degrees*1E7, third value / z: positive altitude with 0 being at the altitude of the home position.
  LOCAL_OFFSET_NED = 7  % NED local tangent frame (x: North, y: East, z: Down) with origin that travels with the vehicle.
  BODY_NED = 8  % Same as MAV_FRAME_LOCAL_NED when used to represent position values. Same as MAV_FRAME_BODY_FRD when used with velocity/acceleration values.
  BODY_OFFSET_NED = 9  % This is the same as MAV_FRAME_BODY_FRD.
  GLOBAL_TERRAIN_ALT = 10  % Global (WGS84) coordinate frame with AGL altitude (at the waypoint coordinate). First value / x: latitude in degrees, second value / y: longitude in degrees, third value / z: positive altitude in meters with 0 being at ground level in terrain model.
  GLOBAL_TERRAIN_ALT_INT = 11  % Global (WGS84) coordinate frame (scaled) with AGL altitude (at the waypoint coordinate). First value / x: latitude in degrees*1E7, second value / y: longitude in degrees*1E7, third value / z: positive altitude in meters with 0 being at ground level in terrain model.
  BODY_FRD = 12  % FRD local frame aligned to the vehicle's attitude (x: Forward, y: Right, z: Down) with an origin that travels with vehicle.
  RESERVED_13 = 13  % MAV_FRAME_BODY_FLU - Body fixed frame of reference, Z-up (x: Forward, y: Left, z: Up).
  RESERVED_14 = 14  % MAV_FRAME_MOCAP_NED - Odometry local coordinate frame of data given by a motion capture system, Z-down (x: North, y: East, z: Down).
  RESERVED_15 = 15  % MAV_FRAME_MOCAP_ENU - Odometry local coordinate frame of data given by a motion capture system, Z-up (x: East, y: North, z: Up).
  RESERVED_16 = 16  % MAV_FRAME_VISION_NED - Odometry local coordinate frame of data given by a vision estimation system, Z-down (x: North, y: East, z: Down).
  RESERVED_17 = 17  % MAV_FRAME_VISION_ENU - Odometry local coordinate frame of data given by a vision estimation system, Z-up (x: East, y: North, z: Up).
  RESERVED_18 = 18  % MAV_FRAME_ESTIM_NED - Odometry local coordinate frame of data given by an estimator running onboard the vehicle, Z-down (x: North, y: East, z: Down).
  RESERVED_19 = 19  % MAV_FRAME_ESTIM_ENU - Odometry local coordinate frame of data given by an estimator running onboard the vehicle, Z-up (x: East, y: North, z: Up).
  LOCAL_FRD = 20  % FRD local tangent frame (x: Forward, y: Right, z: Down) with origin fixed relative to earth. The forward axis is aligned to the front of the vehicle in the horizontal plane.
  LOCAL_FLU = 21  % FLU local tangent frame (x: Forward, y: Left, z: Up) with origin fixed relative to earth. The forward axis is aligned to the front of the vehicle in the horizontal plane.

MAV_MAVLINK_DATA_STREAM_IMG_JPEG = Simulink.Parameter(0, StorageClass="Const")
MAV_MAVLINK_DATA_STREAM_IMG_BMP = Simulink.Parameter(1, StorageClass="Const")
MAV_MAVLINK_DATA_STREAM_IMG_RAW8U = Simulink.Parameter(2, StorageClass="Const")
MAV_MAVLINK_DATA_STREAM_IMG_RAW32U = Simulink.Parameter(3, StorageClass="Const")
MAV_MAVLINK_DATA_STREAM_IMG_PGM = Simulink.Parameter(4, StorageClass="Const")
MAV_MAVLINK_DATA_STREAM_IMG_PNG = Simulink.Parameter(5, StorageClass="Const")

MAV_MAVLINK_DATA_STREAM_TYPE = enum(AddClassNameToEnumNames=true)
  MAVLINK_DATA_STREAM_IMG_JPEG = 0
  MAVLINK_DATA_STREAM_IMG_BMP = 1
  MAVLINK_DATA_STREAM_IMG_RAW8U = 2
  MAVLINK_DATA_STREAM_IMG_RAW32U = 3
  MAVLINK_DATA_STREAM_IMG_PGM = 4
  MAVLINK_DATA_STREAM_IMG_PNG = 5

MAV_FENCE_ACTION_NONE = Simulink.Parameter(0, StorageClass="Const")  % Disable fenced mode. If used in a plan this would mean the next fence is disabled.
MAV_FENCE_ACTION_GUIDED = Simulink.Parameter(1, StorageClass="Const")  % Fly to geofence MAV_CMD_NAV_FENCE_RETURN_POINT in GUIDED mode. Note: This action is only supported by ArduPlane, and may not be supported in all versions.
MAV_FENCE_ACTION_REPORT = Simulink.Parameter(2, StorageClass="Const")  % Report fence breach, but don't take action
MAV_FENCE_ACTION_GUIDED_THR_PASS = Simulink.Parameter(3, StorageClass="Const")  % Fly to geofence MAV_CMD_NAV_FENCE_RETURN_POINT with manual throttle control in GUIDED mode. Note: This action is only supported by ArduPlane, and may not be supported in all versions.
MAV_FENCE_ACTION_RTL = Simulink.Parameter(4, StorageClass="Const")  % Return/RTL mode.
MAV_FENCE_ACTION_HOLD = Simulink.Parameter(5, StorageClass="Const")  % Hold at current location.
MAV_FENCE_ACTION_TERMINATE = Simulink.Parameter(6, StorageClass="Const")  % Termination failsafe. Motors are shut down (some flight stacks may trigger other failsafe actions).
MAV_FENCE_ACTION_LAND = Simulink.Parameter(7, StorageClass="Const")  % Land at current location.

MAV_FENCE_ACTION = enum(AddClassNameToEnumNames=true)  % Actions following geofence breach.
  NONE = 0  % Disable fenced mode. If used in a plan this would mean the next fence is disabled.
  GUIDED = 1  % Fly to geofence MAV_CMD_NAV_FENCE_RETURN_POINT in GUIDED mode. Note: This action is only supported by ArduPlane, and may not be supported in all versions.
  REPORT = 2  % Report fence breach, but don't take action
  GUIDED_THR_PASS = 3  % Fly to geofence MAV_CMD_NAV_FENCE_RETURN_POINT with manual throttle control in GUIDED mode. Note: This action is only supported by ArduPlane, and may not be supported in all versions.
  RTL = 4  % Return/RTL mode.
  HOLD = 5  % Hold at current location.
  TERMINATE = 6  % Termination failsafe. Motors are shut down (some flight stacks may trigger other failsafe actions).
  LAND = 7  % Land at current location.

MAV_FENCE_BREACH_NONE = Simulink.Parameter(0, StorageClass="Const")  % No last fence breach
MAV_FENCE_BREACH_MINALT = Simulink.Parameter(1, StorageClass="Const")  % Breached minimum altitude
MAV_FENCE_BREACH_MAXALT = Simulink.Parameter(2, StorageClass="Const")  % Breached maximum altitude
MAV_FENCE_BREACH_BOUNDARY = Simulink.Parameter(3, StorageClass="Const")  % Breached fence boundary

MAV_FENCE_BREACH = enum(AddClassNameToEnumNames=true)
  NONE = 0  % No last fence breach
  MINALT = 1  % Breached minimum altitude
  MAXALT = 2  % Breached maximum altitude
  BOUNDARY = 3  % Breached fence boundary

MAV_FENCE_MITIGATE_UNKNOWN = Simulink.Parameter(0, StorageClass="Const")  % Unknown
MAV_FENCE_MITIGATE_NONE = Simulink.Parameter(1, StorageClass="Const")  % No actions being taken
MAV_FENCE_MITIGATE_VEL_LIMIT = Simulink.Parameter(2, StorageClass="Const")  % Velocity limiting active to prevent breach

MAV_FENCE_MITIGATE = enum(AddClassNameToEnumNames=true)  % Actions being taken to mitigate/prevent fence breach
  UNKNOWN = 0  % Unknown
  NONE = 1  % No actions being taken
  VEL_LIMIT = 2  % Velocity limiting active to prevent breach

MAV_MOUNT_MODE_RETRACT = Simulink.Parameter(0, StorageClass="Const")  % Load and keep safe position (Roll,Pitch,Yaw) from permanent memory and stop stabilization
MAV_MOUNT_MODE_NEUTRAL = Simulink.Parameter(1, StorageClass="Const")  % Load and keep neutral position (Roll,Pitch,Yaw) from permanent memory.
MAV_MOUNT_MODE_MAVLINK_TARGETING = Simulink.Parameter(2, StorageClass="Const")  % Load neutral position and start MAVLink Roll,Pitch,Yaw control with stabilization
MAV_MOUNT_MODE_RC_TARGETING = Simulink.Parameter(3, StorageClass="Const")  % Load neutral position and start RC Roll,Pitch,Yaw control with stabilization
MAV_MOUNT_MODE_GPS_POINT = Simulink.Parameter(4, StorageClass="Const")  % Load neutral position and start to point to Lat,Lon,Alt
MAV_MOUNT_MODE_SYSID_TARGET = Simulink.Parameter(5, StorageClass="Const")  % Gimbal tracks system with specified system ID
MAV_MOUNT_MODE_HOME_LOCATION = Simulink.Parameter(6, StorageClass="Const")  % Gimbal tracks home position

MAV_MOUNT_MODE = enum(AddClassNameToEnumNames=true)  % Enumeration of possible mount operation modes. This message is used by obsolete/deprecated gimbal messages.
  RETRACT = 0  % Load and keep safe position (Roll,Pitch,Yaw) from permanent memory and stop stabilization
  NEUTRAL = 1  % Load and keep neutral position (Roll,Pitch,Yaw) from permanent memory.
  MAVLINK_TARGETING = 2  % Load neutral position and start MAVLink Roll,Pitch,Yaw control with stabilization
  RC_TARGETING = 3  % Load neutral position and start RC Roll,Pitch,Yaw control with stabilization
  GPS_POINT = 4  % Load neutral position and start to point to Lat,Lon,Alt
  SYSID_TARGET = 5  % Gimbal tracks system with specified system ID
  HOME_LOCATION = 6  % Gimbal tracks home position

MAV_GIMBAL_DEVICE_CAP_FLAGS_HAS_RETRACT = Simulink.Parameter(1, StorageClass="Const")  % Gimbal device supports a retracted position.
MAV_GIMBAL_DEVICE_CAP_FLAGS_HAS_NEUTRAL = Simulink.Parameter(2, StorageClass="Const")  % Gimbal device supports a horizontal, forward looking position, stabilized.
MAV_GIMBAL_DEVICE_CAP_FLAGS_HAS_ROLL_AXIS = Simulink.Parameter(4, StorageClass="Const")  % Gimbal device supports rotating around roll axis.
MAV_GIMBAL_DEVICE_CAP_FLAGS_HAS_ROLL_FOLLOW = Simulink.Parameter(8, StorageClass="Const")  % Gimbal device supports to follow a roll angle relative to the vehicle.
MAV_GIMBAL_DEVICE_CAP_FLAGS_HAS_ROLL_LOCK = Simulink.Parameter(16, StorageClass="Const")  % Gimbal device supports locking to a roll angle (generally that's the default with roll stabilized).
MAV_GIMBAL_DEVICE_CAP_FLAGS_HAS_PITCH_AXIS = Simulink.Parameter(32, StorageClass="Const")  % Gimbal device supports rotating around pitch axis.
MAV_GIMBAL_DEVICE_CAP_FLAGS_HAS_PITCH_FOLLOW = Simulink.Parameter(64, StorageClass="Const")  % Gimbal device supports to follow a pitch angle relative to the vehicle.
MAV_GIMBAL_DEVICE_CAP_FLAGS_HAS_PITCH_LOCK = Simulink.Parameter(128, StorageClass="Const")  % Gimbal device supports locking to a pitch angle (generally that's the default with pitch stabilized).
MAV_GIMBAL_DEVICE_CAP_FLAGS_HAS_YAW_AXIS = Simulink.Parameter(256, StorageClass="Const")  % Gimbal device supports rotating around yaw axis.
MAV_GIMBAL_DEVICE_CAP_FLAGS_HAS_YAW_FOLLOW = Simulink.Parameter(512, StorageClass="Const")  % Gimbal device supports to follow a yaw angle relative to the vehicle (generally that's the default).
MAV_GIMBAL_DEVICE_CAP_FLAGS_HAS_YAW_LOCK = Simulink.Parameter(1024, StorageClass="Const")  % Gimbal device supports locking to an absolute heading, i.e., yaw angle relative to North (earth frame, often this is an option available).
MAV_GIMBAL_DEVICE_CAP_FLAGS_SUPPORTS_INFINITE_YAW = Simulink.Parameter(2048, StorageClass="Const")  % Gimbal device supports yawing/panning infinitely (e.g. using slip disk).
MAV_GIMBAL_DEVICE_CAP_FLAGS_SUPPORTS_YAW_IN_EARTH_FRAME = Simulink.Parameter(4096, StorageClass="Const")  % Gimbal device supports yaw angles and angular velocities relative to North (earth frame). This usually requires support by an autopilot via AUTOPILOT_STATE_FOR_GIMBAL_DEVICE. Support can go on and off during runtime, which is reported by the flag GIMBAL_DEVICE_FLAGS_CAN_ACCEPT_YAW_IN_EARTH_FRAME.
MAV_GIMBAL_DEVICE_CAP_FLAGS_HAS_RC_INPUTS = Simulink.Parameter(8192, StorageClass="Const")  % Gimbal device supports radio control inputs as an alternative input for controlling the gimbal orientation.

MAV_GIMBAL_DEVICE_CAP_FLAGS = enum(AddClassNameToEnumNames=true)  % Gimbal device (low level) capability flags (bitmap).
  HAS_RETRACT = 1  % Gimbal device supports a retracted position.
  HAS_NEUTRAL = 2  % Gimbal device supports a horizontal, forward looking position, stabilized.
  HAS_ROLL_AXIS = 4  % Gimbal device supports rotating around roll axis.
  HAS_ROLL_FOLLOW = 8  % Gimbal device supports to follow a roll angle relative to the vehicle.
  HAS_ROLL_LOCK = 16  % Gimbal device supports locking to a roll angle (generally that's the default with roll stabilized).
  HAS_PITCH_AXIS = 32  % Gimbal device supports rotating around pitch axis.
  HAS_PITCH_FOLLOW = 64  % Gimbal device supports to follow a pitch angle relative to the vehicle.
  HAS_PITCH_LOCK = 128  % Gimbal device supports locking to a pitch angle (generally that's the default with pitch stabilized).
  HAS_YAW_AXIS = 256  % Gimbal device supports rotating around yaw axis.
  HAS_YAW_FOLLOW = 512  % Gimbal device supports to follow a yaw angle relative to the vehicle (generally that's the default).
  HAS_YAW_LOCK = 1024  % Gimbal device supports locking to an absolute heading, i.e., yaw angle relative to North (earth frame, often this is an option available).
  SUPPORTS_INFINITE_YAW = 2048  % Gimbal device supports yawing/panning infinitely (e.g. using slip disk).
  SUPPORTS_YAW_IN_EARTH_FRAME = 4096  % Gimbal device supports yaw angles and angular velocities relative to North (earth frame). This usually requires support by an autopilot via AUTOPILOT_STATE_FOR_GIMBAL_DEVICE. Support can go on and off during runtime, which is reported by the flag GIMBAL_DEVICE_FLAGS_CAN_ACCEPT_YAW_IN_EARTH_FRAME.
  HAS_RC_INPUTS = 8192  % Gimbal device supports radio control inputs as an alternative input for controlling the gimbal orientation.

MAV_GIMBAL_MANAGER_CAP_FLAGS_HAS_RETRACT = Simulink.Parameter(1, StorageClass="Const")  % Based on GIMBAL_DEVICE_CAP_FLAGS_HAS_RETRACT.
MAV_GIMBAL_MANAGER_CAP_FLAGS_HAS_NEUTRAL = Simulink.Parameter(2, StorageClass="Const")  % Based on GIMBAL_DEVICE_CAP_FLAGS_HAS_NEUTRAL.
MAV_GIMBAL_MANAGER_CAP_FLAGS_HAS_ROLL_AXIS = Simulink.Parameter(4, StorageClass="Const")  % Based on GIMBAL_DEVICE_CAP_FLAGS_HAS_ROLL_AXIS.
MAV_GIMBAL_MANAGER_CAP_FLAGS_HAS_ROLL_FOLLOW = Simulink.Parameter(8, StorageClass="Const")  % Based on GIMBAL_DEVICE_CAP_FLAGS_HAS_ROLL_FOLLOW.
MAV_GIMBAL_MANAGER_CAP_FLAGS_HAS_ROLL_LOCK = Simulink.Parameter(16, StorageClass="Const")  % Based on GIMBAL_DEVICE_CAP_FLAGS_HAS_ROLL_LOCK.
MAV_GIMBAL_MANAGER_CAP_FLAGS_HAS_PITCH_AXIS = Simulink.Parameter(32, StorageClass="Const")  % Based on GIMBAL_DEVICE_CAP_FLAGS_HAS_PITCH_AXIS.
MAV_GIMBAL_MANAGER_CAP_FLAGS_HAS_PITCH_FOLLOW = Simulink.Parameter(64, StorageClass="Const")  % Based on GIMBAL_DEVICE_CAP_FLAGS_HAS_PITCH_FOLLOW.
MAV_GIMBAL_MANAGER_CAP_FLAGS_HAS_PITCH_LOCK = Simulink.Parameter(128, StorageClass="Const")  % Based on GIMBAL_DEVICE_CAP_FLAGS_HAS_PITCH_LOCK.
MAV_GIMBAL_MANAGER_CAP_FLAGS_HAS_YAW_AXIS = Simulink.Parameter(256, StorageClass="Const")  % Based on GIMBAL_DEVICE_CAP_FLAGS_HAS_YAW_AXIS.
MAV_GIMBAL_MANAGER_CAP_FLAGS_HAS_YAW_FOLLOW = Simulink.Parameter(512, StorageClass="Const")  % Based on GIMBAL_DEVICE_CAP_FLAGS_HAS_YAW_FOLLOW.
MAV_GIMBAL_MANAGER_CAP_FLAGS_HAS_YAW_LOCK = Simulink.Parameter(1024, StorageClass="Const")  % Based on GIMBAL_DEVICE_CAP_FLAGS_HAS_YAW_LOCK.
MAV_GIMBAL_MANAGER_CAP_FLAGS_SUPPORTS_INFINITE_YAW = Simulink.Parameter(2048, StorageClass="Const")  % Based on GIMBAL_DEVICE_CAP_FLAGS_SUPPORTS_INFINITE_YAW.
MAV_GIMBAL_MANAGER_CAP_FLAGS_SUPPORTS_YAW_IN_EARTH_FRAME = Simulink.Parameter(4096, StorageClass="Const")  % Based on GIMBAL_DEVICE_CAP_FLAGS_SUPPORTS_YAW_IN_EARTH_FRAME.
MAV_GIMBAL_MANAGER_CAP_FLAGS_HAS_RC_INPUTS = Simulink.Parameter(8192, StorageClass="Const")  % Based on GIMBAL_DEVICE_CAP_FLAGS_HAS_RC_INPUTS.
MAV_GIMBAL_MANAGER_CAP_FLAGS_CAN_POINT_LOCATION_LOCAL = Simulink.Parameter(65536, StorageClass="Const")  % Gimbal manager supports to point to a local position.
MAV_GIMBAL_MANAGER_CAP_FLAGS_CAN_POINT_LOCATION_GLOBAL = Simulink.Parameter(131072, StorageClass="Const")  % Gimbal manager supports to point to a global latitude, longitude, altitude position.

MAV_GIMBAL_MANAGER_CAP_FLAGS = enum(AddClassNameToEnumNames=true)  % Gimbal manager high level capability flags (bitmap). The first 16 bits are identical to the GIMBAL_DEVICE_CAP_FLAGS. However, the gimbal manager does not need to copy the flags from the gimbal but can also enhance the capabilities and thus add flags.
  HAS_RETRACT = 1  % Based on GIMBAL_DEVICE_CAP_FLAGS_HAS_RETRACT.
  HAS_NEUTRAL = 2  % Based on GIMBAL_DEVICE_CAP_FLAGS_HAS_NEUTRAL.
  HAS_ROLL_AXIS = 4  % Based on GIMBAL_DEVICE_CAP_FLAGS_HAS_ROLL_AXIS.
  HAS_ROLL_FOLLOW = 8  % Based on GIMBAL_DEVICE_CAP_FLAGS_HAS_ROLL_FOLLOW.
  HAS_ROLL_LOCK = 16  % Based on GIMBAL_DEVICE_CAP_FLAGS_HAS_ROLL_LOCK.
  HAS_PITCH_AXIS = 32  % Based on GIMBAL_DEVICE_CAP_FLAGS_HAS_PITCH_AXIS.
  HAS_PITCH_FOLLOW = 64  % Based on GIMBAL_DEVICE_CAP_FLAGS_HAS_PITCH_FOLLOW.
  HAS_PITCH_LOCK = 128  % Based on GIMBAL_DEVICE_CAP_FLAGS_HAS_PITCH_LOCK.
  HAS_YAW_AXIS = 256  % Based on GIMBAL_DEVICE_CAP_FLAGS_HAS_YAW_AXIS.
  HAS_YAW_FOLLOW = 512  % Based on GIMBAL_DEVICE_CAP_FLAGS_HAS_YAW_FOLLOW.
  HAS_YAW_LOCK = 1024  % Based on GIMBAL_DEVICE_CAP_FLAGS_HAS_YAW_LOCK.
  SUPPORTS_INFINITE_YAW = 2048  % Based on GIMBAL_DEVICE_CAP_FLAGS_SUPPORTS_INFINITE_YAW.
  SUPPORTS_YAW_IN_EARTH_FRAME = 4096  % Based on GIMBAL_DEVICE_CAP_FLAGS_SUPPORTS_YAW_IN_EARTH_FRAME.
  HAS_RC_INPUTS = 8192  % Based on GIMBAL_DEVICE_CAP_FLAGS_HAS_RC_INPUTS.
  CAN_POINT_LOCATION_LOCAL = 65536  % Gimbal manager supports to point to a local position.
  CAN_POINT_LOCATION_GLOBAL = 131072  % Gimbal manager supports to point to a global latitude, longitude, altitude position.

MAV_GIMBAL_DEVICE_FLAGS_RETRACT = Simulink.Parameter(1, StorageClass="Const")  % Set to retracted safe position (no stabilization), takes precedence over all other flags.
MAV_GIMBAL_DEVICE_FLAGS_NEUTRAL = Simulink.Parameter(2, StorageClass="Const")  % Set to neutral/default position, taking precedence over all other flags except RETRACT. Neutral is commonly forward-facing and horizontal (roll=pitch=yaw=0) but may be any orientation.
MAV_GIMBAL_DEVICE_FLAGS_ROLL_LOCK = Simulink.Parameter(4, StorageClass="Const")  % Lock roll angle to absolute angle relative to horizon (not relative to vehicle). This is generally the default with a stabilizing gimbal.
MAV_GIMBAL_DEVICE_FLAGS_PITCH_LOCK = Simulink.Parameter(8, StorageClass="Const")  % Lock pitch angle to absolute angle relative to horizon (not relative to vehicle). This is generally the default with a stabilizing gimbal.
MAV_GIMBAL_DEVICE_FLAGS_YAW_LOCK = Simulink.Parameter(16, StorageClass="Const")  % Lock yaw angle to absolute angle relative to North (not relative to vehicle). If this flag is set, the yaw angle and z component of angular velocity are relative to North (earth frame, x-axis pointing North), else they are relative to the vehicle heading (vehicle frame, earth frame rotated so that the x-axis is pointing forward).
MAV_GIMBAL_DEVICE_FLAGS_YAW_IN_VEHICLE_FRAME = Simulink.Parameter(32, StorageClass="Const")  % Yaw angle and z component of angular velocity are relative to the vehicle heading (vehicle frame, earth frame rotated such that the x-axis is pointing forward).
MAV_GIMBAL_DEVICE_FLAGS_YAW_IN_EARTH_FRAME = Simulink.Parameter(64, StorageClass="Const")  % Yaw angle and z component of angular velocity are relative to North (earth frame, x-axis is pointing North).
MAV_GIMBAL_DEVICE_FLAGS_ACCEPTS_YAW_IN_EARTH_FRAME = Simulink.Parameter(128, StorageClass="Const")  % Gimbal device can accept yaw angle inputs relative to North (earth frame). This flag is only for reporting (attempts to set this flag are ignored).
MAV_GIMBAL_DEVICE_FLAGS_RC_EXCLUSIVE = Simulink.Parameter(256, StorageClass="Const")  % The gimbal orientation is set exclusively by the RC signals feed to the gimbal's radio control inputs. MAVLink messages for setting the gimbal orientation (GIMBAL_DEVICE_SET_ATTITUDE) are ignored.
MAV_GIMBAL_DEVICE_FLAGS_RC_MIXED = Simulink.Parameter(512, StorageClass="Const")  % The gimbal orientation is determined by combining/mixing the RC signals feed to the gimbal's radio control inputs and the MAVLink messages for setting the gimbal orientation (GIMBAL_DEVICE_SET_ATTITUDE). How these two controls are combined or mixed is not defined by the protocol but is up to the implementation.

MAV_GIMBAL_DEVICE_FLAGS = enum(AddClassNameToEnumNames=true)  % Flags for gimbal device (lower level) operation.
  RETRACT = 1  % Set to retracted safe position (no stabilization), takes precedence over all other flags.
  NEUTRAL = 2  % Set to neutral/default position, taking precedence over all other flags except RETRACT. Neutral is commonly forward-facing and horizontal (roll=pitch=yaw=0) but may be any orientation.
  ROLL_LOCK = 4  % Lock roll angle to absolute angle relative to horizon (not relative to vehicle). This is generally the default with a stabilizing gimbal.
  PITCH_LOCK = 8  % Lock pitch angle to absolute angle relative to horizon (not relative to vehicle). This is generally the default with a stabilizing gimbal.
  YAW_LOCK = 16  % Lock yaw angle to absolute angle relative to North (not relative to vehicle). If this flag is set, the yaw angle and z component of angular velocity are relative to North (earth frame, x-axis pointing North), else they are relative to the vehicle heading (vehicle frame, earth frame rotated so that the x-axis is pointing forward).
  YAW_IN_VEHICLE_FRAME = 32  % Yaw angle and z component of angular velocity are relative to the vehicle heading (vehicle frame, earth frame rotated such that the x-axis is pointing forward).
  YAW_IN_EARTH_FRAME = 64  % Yaw angle and z component of angular velocity are relative to North (earth frame, x-axis is pointing North).
  ACCEPTS_YAW_IN_EARTH_FRAME = 128  % Gimbal device can accept yaw angle inputs relative to North (earth frame). This flag is only for reporting (attempts to set this flag are ignored).
  RC_EXCLUSIVE = 256  % The gimbal orientation is set exclusively by the RC signals feed to the gimbal's radio control inputs. MAVLink messages for setting the gimbal orientation (GIMBAL_DEVICE_SET_ATTITUDE) are ignored.
  RC_MIXED = 512  % The gimbal orientation is determined by combining/mixing the RC signals feed to the gimbal's radio control inputs and the MAVLink messages for setting the gimbal orientation (GIMBAL_DEVICE_SET_ATTITUDE). How these two controls are combined or mixed is not defined by the protocol but is up to the implementation.

MAV_GIMBAL_MANAGER_FLAGS_RETRACT = Simulink.Parameter(1, StorageClass="Const")  % Based on GIMBAL_DEVICE_FLAGS_RETRACT.
MAV_GIMBAL_MANAGER_FLAGS_NEUTRAL = Simulink.Parameter(2, StorageClass="Const")  % Based on GIMBAL_DEVICE_FLAGS_NEUTRAL.
MAV_GIMBAL_MANAGER_FLAGS_ROLL_LOCK = Simulink.Parameter(4, StorageClass="Const")  % Based on GIMBAL_DEVICE_FLAGS_ROLL_LOCK.
MAV_GIMBAL_MANAGER_FLAGS_PITCH_LOCK = Simulink.Parameter(8, StorageClass="Const")  % Based on GIMBAL_DEVICE_FLAGS_PITCH_LOCK.
MAV_GIMBAL_MANAGER_FLAGS_YAW_LOCK = Simulink.Parameter(16, StorageClass="Const")  % Based on GIMBAL_DEVICE_FLAGS_YAW_LOCK.
MAV_GIMBAL_MANAGER_FLAGS_YAW_IN_VEHICLE_FRAME = Simulink.Parameter(32, StorageClass="Const")  % Based on GIMBAL_DEVICE_FLAGS_YAW_IN_VEHICLE_FRAME.
MAV_GIMBAL_MANAGER_FLAGS_YAW_IN_EARTH_FRAME = Simulink.Parameter(64, StorageClass="Const")  % Based on GIMBAL_DEVICE_FLAGS_YAW_IN_EARTH_FRAME.
MAV_GIMBAL_MANAGER_FLAGS_ACCEPTS_YAW_IN_EARTH_FRAME = Simulink.Parameter(128, StorageClass="Const")  % Based on GIMBAL_DEVICE_FLAGS_ACCEPTS_YAW_IN_EARTH_FRAME.
MAV_GIMBAL_MANAGER_FLAGS_RC_EXCLUSIVE = Simulink.Parameter(256, StorageClass="Const")  % Based on GIMBAL_DEVICE_FLAGS_RC_EXCLUSIVE.
MAV_GIMBAL_MANAGER_FLAGS_RC_MIXED = Simulink.Parameter(512, StorageClass="Const")  % Based on GIMBAL_DEVICE_FLAGS_RC_MIXED.

MAV_GIMBAL_MANAGER_FLAGS = enum(AddClassNameToEnumNames=true)  % Flags for high level gimbal manager operation The first 16 bits are identical to the GIMBAL_DEVICE_FLAGS.
  RETRACT = 1  % Based on GIMBAL_DEVICE_FLAGS_RETRACT.
  NEUTRAL = 2  % Based on GIMBAL_DEVICE_FLAGS_NEUTRAL.
  ROLL_LOCK = 4  % Based on GIMBAL_DEVICE_FLAGS_ROLL_LOCK.
  PITCH_LOCK = 8  % Based on GIMBAL_DEVICE_FLAGS_PITCH_LOCK.
  YAW_LOCK = 16  % Based on GIMBAL_DEVICE_FLAGS_YAW_LOCK.
  YAW_IN_VEHICLE_FRAME = 32  % Based on GIMBAL_DEVICE_FLAGS_YAW_IN_VEHICLE_FRAME.
  YAW_IN_EARTH_FRAME = 64  % Based on GIMBAL_DEVICE_FLAGS_YAW_IN_EARTH_FRAME.
  ACCEPTS_YAW_IN_EARTH_FRAME = 128  % Based on GIMBAL_DEVICE_FLAGS_ACCEPTS_YAW_IN_EARTH_FRAME.
  RC_EXCLUSIVE = 256  % Based on GIMBAL_DEVICE_FLAGS_RC_EXCLUSIVE.
  RC_MIXED = 512  % Based on GIMBAL_DEVICE_FLAGS_RC_MIXED.

MAV_GIMBAL_DEVICE_ERROR_FLAGS_AT_ROLL_LIMIT = Simulink.Parameter(1, StorageClass="Const")  % Gimbal device is limited by hardware roll limit.
MAV_GIMBAL_DEVICE_ERROR_FLAGS_AT_PITCH_LIMIT = Simulink.Parameter(2, StorageClass="Const")  % Gimbal device is limited by hardware pitch limit.
MAV_GIMBAL_DEVICE_ERROR_FLAGS_AT_YAW_LIMIT = Simulink.Parameter(4, StorageClass="Const")  % Gimbal device is limited by hardware yaw limit.
MAV_GIMBAL_DEVICE_ERROR_FLAGS_ENCODER_ERROR = Simulink.Parameter(8, StorageClass="Const")  % There is an error with the gimbal encoders.
MAV_GIMBAL_DEVICE_ERROR_FLAGS_POWER_ERROR = Simulink.Parameter(16, StorageClass="Const")  % There is an error with the gimbal power source.
MAV_GIMBAL_DEVICE_ERROR_FLAGS_MOTOR_ERROR = Simulink.Parameter(32, StorageClass="Const")  % There is an error with the gimbal motors.
MAV_GIMBAL_DEVICE_ERROR_FLAGS_SOFTWARE_ERROR = Simulink.Parameter(64, StorageClass="Const")  % There is an error with the gimbal's software.
MAV_GIMBAL_DEVICE_ERROR_FLAGS_COMMS_ERROR = Simulink.Parameter(128, StorageClass="Const")  % There is an error with the gimbal's communication.
MAV_GIMBAL_DEVICE_ERROR_FLAGS_CALIBRATION_RUNNING = Simulink.Parameter(256, StorageClass="Const")  % Gimbal device is currently calibrating.
MAV_GIMBAL_DEVICE_ERROR_FLAGS_NO_MANAGER = Simulink.Parameter(512, StorageClass="Const")  % Gimbal device is not assigned to a gimbal manager.

MAV_GIMBAL_DEVICE_ERROR_FLAGS = enum(AddClassNameToEnumNames=true)  % Gimbal device (low level) error flags (bitmap, 0 means no error)
  AT_ROLL_LIMIT = 1  % Gimbal device is limited by hardware roll limit.
  AT_PITCH_LIMIT = 2  % Gimbal device is limited by hardware pitch limit.
  AT_YAW_LIMIT = 4  % Gimbal device is limited by hardware yaw limit.
  ENCODER_ERROR = 8  % There is an error with the gimbal encoders.
  POWER_ERROR = 16  % There is an error with the gimbal power source.
  MOTOR_ERROR = 32  % There is an error with the gimbal motors.
  SOFTWARE_ERROR = 64  % There is an error with the gimbal's software.
  COMMS_ERROR = 128  % There is an error with the gimbal's communication.
  CALIBRATION_RUNNING = 256  % Gimbal device is currently calibrating.
  NO_MANAGER = 512  % Gimbal device is not assigned to a gimbal manager.

MAV_GRIPPER_ACTION_RELEASE = Simulink.Parameter(0, StorageClass="Const")  % Gripper release cargo.
MAV_GRIPPER_ACTION_GRAB = Simulink.Parameter(1, StorageClass="Const")  % Gripper grab onto cargo.

MAV_GRIPPER_ACTIONS = enum(AddClassNameToEnumNames=true)  % Gripper actions.
  GRIPPER_ACTION_RELEASE = 0  % Gripper release cargo.
  GRIPPER_ACTION_GRAB = 1  % Gripper grab onto cargo.

MAV_WINCH_RELAXED = Simulink.Parameter(0, StorageClass="Const")  % Allow motor to freewheel.
MAV_WINCH_RELATIVE_LENGTH_CONTROL = Simulink.Parameter(1, StorageClass="Const")  % Wind or unwind specified length of line, optionally using specified rate.
MAV_WINCH_RATE_CONTROL = Simulink.Parameter(2, StorageClass="Const")  % Wind or unwind line at specified rate.
MAV_WINCH_LOCK = Simulink.Parameter(3, StorageClass="Const")  % Perform the locking sequence to relieve motor while in the fully retracted position. Only action and instance command parameters are used, others are ignored.
MAV_WINCH_DELIVER = Simulink.Parameter(4, StorageClass="Const")  % Sequence of drop, slow down, touch down, reel up, lock. Only action and instance command parameters are used, others are ignored.
MAV_WINCH_HOLD = Simulink.Parameter(5, StorageClass="Const")  % Engage motor and hold current position. Only action and instance command parameters are used, others are ignored.
MAV_WINCH_RETRACT = Simulink.Parameter(6, StorageClass="Const")  % Return the reel to the fully retracted position. Only action and instance command parameters are used, others are ignored.
MAV_WINCH_LOAD_LINE = Simulink.Parameter(7, StorageClass="Const")  % Load the reel with line. The winch will calculate the total loaded length and stop when the tension exceeds a threshold. Only action and instance command parameters are used, others are ignored.
MAV_WINCH_ABANDON_LINE = Simulink.Parameter(8, StorageClass="Const")  % Spool out the entire length of the line. Only action and instance command parameters are used, others are ignored.
MAV_WINCH_LOAD_PAYLOAD = Simulink.Parameter(9, StorageClass="Const")  % Spools out just enough to present the hook to the user to load the payload. Only action and instance command parameters are used, others are ignored

MAV_WINCH_ACTIONS = enum(AddClassNameToEnumNames=true)  % Winch actions.
  WINCH_RELAXED = 0  % Allow motor to freewheel.
  WINCH_RELATIVE_LENGTH_CONTROL = 1  % Wind or unwind specified length of line, optionally using specified rate.
  WINCH_RATE_CONTROL = 2  % Wind or unwind line at specified rate.
  WINCH_LOCK = 3  % Perform the locking sequence to relieve motor while in the fully retracted position. Only action and instance command parameters are used, others are ignored.
  WINCH_DELIVER = 4  % Sequence of drop, slow down, touch down, reel up, lock. Only action and instance command parameters are used, others are ignored.
  WINCH_HOLD = 5  % Engage motor and hold current position. Only action and instance command parameters are used, others are ignored.
  WINCH_RETRACT = 6  % Return the reel to the fully retracted position. Only action and instance command parameters are used, others are ignored.
  WINCH_LOAD_LINE = 7  % Load the reel with line. The winch will calculate the total loaded length and stop when the tension exceeds a threshold. Only action and instance command parameters are used, others are ignored.
  WINCH_ABANDON_LINE = 8  % Spool out the entire length of the line. Only action and instance command parameters are used, others are ignored.
  WINCH_LOAD_PAYLOAD = 9  % Spools out just enough to present the hook to the user to load the payload. Only action and instance command parameters are used, others are ignored

MAV_UAVCAN_NODE_HEALTH_OK = Simulink.Parameter(0, StorageClass="Const")  % The node is functioning properly.
MAV_UAVCAN_NODE_HEALTH_WARNING = Simulink.Parameter(1, StorageClass="Const")  % A critical parameter went out of range or the node has encountered a minor failure.
MAV_UAVCAN_NODE_HEALTH_ERROR = Simulink.Parameter(2, StorageClass="Const")  % The node has encountered a major failure.
MAV_UAVCAN_NODE_HEALTH_CRITICAL = Simulink.Parameter(3, StorageClass="Const")  % The node has suffered a fatal malfunction.

MAV_UAVCAN_NODE_HEALTH = enum(AddClassNameToEnumNames=true)  % Generalized UAVCAN node health
  OK = 0  % The node is functioning properly.
  WARNING = 1  % A critical parameter went out of range or the node has encountered a minor failure.
  ERROR = 2  % The node has encountered a major failure.
  CRITICAL = 3  % The node has suffered a fatal malfunction.

MAV_UAVCAN_NODE_MODE_OPERATIONAL = Simulink.Parameter(0, StorageClass="Const")  % The node is performing its primary functions.
MAV_UAVCAN_NODE_MODE_INITIALIZATION = Simulink.Parameter(1, StorageClass="Const")  % The node is initializing; this mode is entered immediately after startup.
MAV_UAVCAN_NODE_MODE_MAINTENANCE = Simulink.Parameter(2, StorageClass="Const")  % The node is under maintenance.
MAV_UAVCAN_NODE_MODE_SOFTWARE_UPDATE = Simulink.Parameter(3, StorageClass="Const")  % The node is in the process of updating its software.
MAV_UAVCAN_NODE_MODE_OFFLINE = Simulink.Parameter(7, StorageClass="Const")  % The node is no longer available online.

MAV_UAVCAN_NODE_MODE = enum(AddClassNameToEnumNames=true)  % Generalized UAVCAN node mode
  OPERATIONAL = 0  % The node is performing its primary functions.
  INITIALIZATION = 1  % The node is initializing; this mode is entered immediately after startup.
  MAINTENANCE = 2  % The node is under maintenance.
  SOFTWARE_UPDATE = 3  % The node is in the process of updating its software.
  OFFLINE = 7  % The node is no longer available online.

MAV_ESC_CONNECTION_TYPE_PPM = Simulink.Parameter(0, StorageClass="Const")  % Traditional PPM ESC.
MAV_ESC_CONNECTION_TYPE_SERIAL = Simulink.Parameter(1, StorageClass="Const")  % Serial Bus connected ESC.
MAV_ESC_CONNECTION_TYPE_ONESHOT = Simulink.Parameter(2, StorageClass="Const")  % One Shot PPM ESC.
MAV_ESC_CONNECTION_TYPE_I2C = Simulink.Parameter(3, StorageClass="Const")  % I2C ESC.
MAV_ESC_CONNECTION_TYPE_CAN = Simulink.Parameter(4, StorageClass="Const")  % CAN-Bus ESC.
MAV_ESC_CONNECTION_TYPE_DSHOT = Simulink.Parameter(5, StorageClass="Const")  % DShot ESC.

MAV_ESC_CONNECTION_TYPE = enum(AddClassNameToEnumNames=true)  % Indicates the ESC connection type.
  PPM = 0  % Traditional PPM ESC.
  SERIAL = 1  % Serial Bus connected ESC.
  ONESHOT = 2  % One Shot PPM ESC.
  I2C = 3  % I2C ESC.
  CAN = 4  % CAN-Bus ESC.
  DSHOT = 5  % DShot ESC.

MAV_ESC_FAILURE_NONE = Simulink.Parameter(0, StorageClass="Const")  % No ESC failure.
MAV_ESC_FAILURE_OVER_CURRENT = Simulink.Parameter(1, StorageClass="Const")  % Over current failure.
MAV_ESC_FAILURE_OVER_VOLTAGE = Simulink.Parameter(2, StorageClass="Const")  % Over voltage failure.
MAV_ESC_FAILURE_OVER_TEMPERATURE = Simulink.Parameter(4, StorageClass="Const")  % Over temperature failure.
MAV_ESC_FAILURE_OVER_RPM = Simulink.Parameter(8, StorageClass="Const")  % Over RPM failure.
MAV_ESC_FAILURE_INCONSISTENT_CMD = Simulink.Parameter(16, StorageClass="Const")  % Inconsistent command failure i.e. out of bounds.
MAV_ESC_FAILURE_MOTOR_STUCK = Simulink.Parameter(32, StorageClass="Const")  % Motor stuck failure.
MAV_ESC_FAILURE_GENERIC = Simulink.Parameter(64, StorageClass="Const")  % Generic ESC failure.

MAV_ESC_FAILURE_FLAGS = enum(AddClassNameToEnumNames=true)  % Flags to report ESC failures.
  ESC_FAILURE_NONE = 0  % No ESC failure.
  ESC_FAILURE_OVER_CURRENT = 1  % Over current failure.
  ESC_FAILURE_OVER_VOLTAGE = 2  % Over voltage failure.
  ESC_FAILURE_OVER_TEMPERATURE = 4  % Over temperature failure.
  ESC_FAILURE_OVER_RPM = 8  % Over RPM failure.
  ESC_FAILURE_INCONSISTENT_CMD = 16  % Inconsistent command failure i.e. out of bounds.
  ESC_FAILURE_MOTOR_STUCK = 32  % Motor stuck failure.
  ESC_FAILURE_GENERIC = 64  % Generic ESC failure.

MAV_STORAGE_STATUS_EMPTY = Simulink.Parameter(0, StorageClass="Const")  % Storage is missing (no microSD card loaded for example.)
MAV_STORAGE_STATUS_UNFORMATTED = Simulink.Parameter(1, StorageClass="Const")  % Storage present but unformatted.
MAV_STORAGE_STATUS_READY = Simulink.Parameter(2, StorageClass="Const")  % Storage present and ready.
MAV_STORAGE_STATUS_NOT_SUPPORTED = Simulink.Parameter(3, StorageClass="Const")  % Camera does not supply storage status information. Capacity information in STORAGE_INFORMATION fields will be ignored.

MAV_STORAGE_STATUS = enum(AddClassNameToEnumNames=true)  % Flags to indicate the status of camera storage.
  EMPTY = 0  % Storage is missing (no microSD card loaded for example.)
  UNFORMATTED = 1  % Storage present but unformatted.
  READY = 2  % Storage present and ready.
  NOT_SUPPORTED = 3  % Camera does not supply storage status information. Capacity information in STORAGE_INFORMATION fields will be ignored.

MAV_STORAGE_TYPE_UNKNOWN = Simulink.Parameter(0, StorageClass="Const")  % Storage type is not known.
MAV_STORAGE_TYPE_USB_STICK = Simulink.Parameter(1, StorageClass="Const")  % Storage type is USB device.
MAV_STORAGE_TYPE_SD = Simulink.Parameter(2, StorageClass="Const")  % Storage type is SD card.
MAV_STORAGE_TYPE_MICROSD = Simulink.Parameter(3, StorageClass="Const")  % Storage type is microSD card.
MAV_STORAGE_TYPE_CF = Simulink.Parameter(4, StorageClass="Const")  % Storage type is CFast.
MAV_STORAGE_TYPE_CFE = Simulink.Parameter(5, StorageClass="Const")  % Storage type is CFexpress.
MAV_STORAGE_TYPE_XQD = Simulink.Parameter(6, StorageClass="Const")  % Storage type is XQD.
MAV_STORAGE_TYPE_HD = Simulink.Parameter(7, StorageClass="Const")  % Storage type is HD mass storage type.
MAV_STORAGE_TYPE_OTHER = Simulink.Parameter(254, StorageClass="Const")  % Storage type is other, not listed type.

MAV_STORAGE_TYPE = enum(AddClassNameToEnumNames=true)  % Flags to indicate the type of storage.
  UNKNOWN = 0  % Storage type is not known.
  USB_STICK = 1  % Storage type is USB device.
  SD = 2  % Storage type is SD card.
  MICROSD = 3  % Storage type is microSD card.
  CF = 4  % Storage type is CFast.
  CFE = 5  % Storage type is CFexpress.
  XQD = 6  % Storage type is XQD.
  HD = 7  % Storage type is HD mass storage type.
  OTHER = 254  % Storage type is other, not listed type.

MAV_STORAGE_USAGE_FLAG_SET = Simulink.Parameter(1, StorageClass="Const")  % Always set to 1 (indicates STORAGE_INFORMATION.storage_usage is supported).
MAV_STORAGE_USAGE_FLAG_PHOTO = Simulink.Parameter(2, StorageClass="Const")  % Storage for saving photos.
MAV_STORAGE_USAGE_FLAG_VIDEO = Simulink.Parameter(4, StorageClass="Const")  % Storage for saving videos.
MAV_STORAGE_USAGE_FLAG_LOGS = Simulink.Parameter(8, StorageClass="Const")  % Storage for saving logs.

MAV_STORAGE_USAGE_FLAG = enum(AddClassNameToEnumNames=true)  % Flags to indicate usage for a particular storage (see STORAGE_INFORMATION.storage_usage and MAV_CMD_SET_STORAGE_USAGE).
  SET = 1  % Always set to 1 (indicates STORAGE_INFORMATION.storage_usage is supported).
  PHOTO = 2  % Storage for saving photos.
  VIDEO = 4  % Storage for saving videos.
  LOGS = 8  % Storage for saving logs.

MAV_ORBIT_YAW_BEHAVIOUR_HOLD_FRONT_TO_CIRCLE_CENTER = Simulink.Parameter(0, StorageClass="Const")  % Vehicle front points to the center (default).
MAV_ORBIT_YAW_BEHAVIOUR_HOLD_INITIAL_HEADING = Simulink.Parameter(1, StorageClass="Const")  % Vehicle front holds heading when message received.
MAV_ORBIT_YAW_BEHAVIOUR_UNCONTROLLED = Simulink.Parameter(2, StorageClass="Const")  % Yaw uncontrolled.
MAV_ORBIT_YAW_BEHAVIOUR_HOLD_FRONT_TANGENT_TO_CIRCLE = Simulink.Parameter(3, StorageClass="Const")  % Vehicle front follows flight path (tangential to circle).
MAV_ORBIT_YAW_BEHAVIOUR_RC_CONTROLLED = Simulink.Parameter(4, StorageClass="Const")  % Yaw controlled by RC input.

MAV_ORBIT_YAW_BEHAVIOUR = enum(AddClassNameToEnumNames=true)  % Yaw behaviour during orbit flight.
  HOLD_FRONT_TO_CIRCLE_CENTER = 0  % Vehicle front points to the center (default).
  HOLD_INITIAL_HEADING = 1  % Vehicle front holds heading when message received.
  UNCONTROLLED = 2  % Yaw uncontrolled.
  HOLD_FRONT_TANGENT_TO_CIRCLE = 3  % Vehicle front follows flight path (tangential to circle).
  RC_CONTROLLED = 4  % Yaw controlled by RC input.

MAV_WIFI_CONFIG_AP_RESPONSE_UNDEFINED = Simulink.Parameter(0, StorageClass="Const")  % Undefined response. Likely an indicative of a system that doesn't support this request.
MAV_WIFI_CONFIG_AP_RESPONSE_ACCEPTED = Simulink.Parameter(1, StorageClass="Const")  % Changes accepted.
MAV_WIFI_CONFIG_AP_RESPONSE_REJECTED = Simulink.Parameter(2, StorageClass="Const")  % Changes rejected.
MAV_WIFI_CONFIG_AP_RESPONSE_MODE_ERROR = Simulink.Parameter(3, StorageClass="Const")  % Invalid Mode.
MAV_WIFI_CONFIG_AP_RESPONSE_SSID_ERROR = Simulink.Parameter(4, StorageClass="Const")  % Invalid SSID.
MAV_WIFI_CONFIG_AP_RESPONSE_PASSWORD_ERROR = Simulink.Parameter(5, StorageClass="Const")  % Invalid Password.

MAV_WIFI_CONFIG_AP_RESPONSE = enum(AddClassNameToEnumNames=true)  % Possible responses from a WIFI_CONFIG_AP message.
  UNDEFINED = 0  % Undefined response. Likely an indicative of a system that doesn't support this request.
  ACCEPTED = 1  % Changes accepted.
  REJECTED = 2  % Changes rejected.
  MODE_ERROR = 3  % Invalid Mode.
  SSID_ERROR = 4  % Invalid SSID.
  PASSWORD_ERROR = 5  % Invalid Password.

MAV_CELLULAR_CONFIG_RESPONSE_ACCEPTED = Simulink.Parameter(0, StorageClass="Const")  % Changes accepted.
MAV_CELLULAR_CONFIG_RESPONSE_APN_ERROR = Simulink.Parameter(1, StorageClass="Const")  % Invalid APN.
MAV_CELLULAR_CONFIG_RESPONSE_PIN_ERROR = Simulink.Parameter(2, StorageClass="Const")  % Invalid PIN.
MAV_CELLULAR_CONFIG_RESPONSE_REJECTED = Simulink.Parameter(3, StorageClass="Const")  % Changes rejected.
MAV_CELLULAR_CONFIG_BLOCKED_PUK_REQUIRED = Simulink.Parameter(4, StorageClass="Const")  % PUK is required to unblock SIM card.

MAV_CELLULAR_CONFIG_RESPONSE = enum(AddClassNameToEnumNames=true)  % Possible responses from a CELLULAR_CONFIG message.
  ACCEPTED = 0  % Changes accepted.
  APN_ERROR = 1  % Invalid APN.
  PIN_ERROR = 2  % Invalid PIN.
  REJECTED = 3  % Changes rejected.
  CELLULAR_CONFIG_BLOCKED_PUK_REQUIRED = 4  % PUK is required to unblock SIM card.

MAV_WIFI_CONFIG_AP_MODE_UNDEFINED = Simulink.Parameter(0, StorageClass="Const")  % WiFi mode is undefined.
MAV_WIFI_CONFIG_AP_MODE_AP = Simulink.Parameter(1, StorageClass="Const")  % WiFi configured as an access point.
MAV_WIFI_CONFIG_AP_MODE_STATION = Simulink.Parameter(2, StorageClass="Const")  % WiFi configured as a station connected to an existing local WiFi network.
MAV_WIFI_CONFIG_AP_MODE_DISABLED = Simulink.Parameter(3, StorageClass="Const")  % WiFi disabled.

MAV_WIFI_CONFIG_AP_MODE = enum(AddClassNameToEnumNames=true)  % WiFi Mode.
  UNDEFINED = 0  % WiFi mode is undefined.
  AP = 1  % WiFi configured as an access point.
  STATION = 2  % WiFi configured as a station connected to an existing local WiFi network.
  DISABLED = 3  % WiFi disabled.

MAV_COMP_METADATA_TYPE_GENERAL = Simulink.Parameter(0, StorageClass="Const")  % General information about the component. General metadata includes information about other metadata types supported by the component. Files of this type must be supported, and must be downloadable from vehicle using a MAVLink FTP URI.
MAV_COMP_METADATA_TYPE_PARAMETER = Simulink.Parameter(1, StorageClass="Const")  % Parameter meta data.
MAV_COMP_METADATA_TYPE_COMMANDS = Simulink.Parameter(2, StorageClass="Const")  % Meta data that specifies which commands and command parameters the vehicle supports. (WIP)
MAV_COMP_METADATA_TYPE_PERIPHERALS = Simulink.Parameter(3, StorageClass="Const")  % Meta data that specifies external non-MAVLink peripherals.
MAV_COMP_METADATA_TYPE_EVENTS = Simulink.Parameter(4, StorageClass="Const")  % Meta data for the events interface.
MAV_COMP_METADATA_TYPE_ACTUATORS = Simulink.Parameter(5, StorageClass="Const")  % Meta data for actuator configuration (motors, servos and vehicle geometry) and testing.

MAV_COMP_METADATA_TYPE = enum(AddClassNameToEnumNames=true)  % Supported component metadata types. These are used in the "general" metadata file returned by COMPONENT_METADATA to provide information about supported metadata types. The types are not used directly in MAVLink messages.
  GENERAL = 0  % General information about the component. General metadata includes information about other metadata types supported by the component. Files of this type must be supported, and must be downloadable from vehicle using a MAVLink FTP URI.
  PARAMETER = 1  % Parameter meta data.
  COMMANDS = 2  % Meta data that specifies which commands and command parameters the vehicle supports. (WIP)
  PERIPHERALS = 3  % Meta data that specifies external non-MAVLink peripherals.
  EVENTS = 4  % Meta data for the events interface.
  ACTUATORS = 5  % Meta data for actuator configuration (motors, servos and vehicle geometry) and testing.

MAV_ACTUATOR_CONFIGURATION_NONE = Simulink.Parameter(0, StorageClass="Const")  % Do nothing.
MAV_ACTUATOR_CONFIGURATION_BEEP = Simulink.Parameter(1, StorageClass="Const")  % Command the actuator to beep now.
MAV_ACTUATOR_CONFIGURATION_3D_MODE_ON = Simulink.Parameter(2, StorageClass="Const")  % Permanently set the actuator (ESC) to 3D mode (reversible thrust).
MAV_ACTUATOR_CONFIGURATION_3D_MODE_OFF = Simulink.Parameter(3, StorageClass="Const")  % Permanently set the actuator (ESC) to non 3D mode (non-reversible thrust).
MAV_ACTUATOR_CONFIGURATION_SPIN_DIRECTION1 = Simulink.Parameter(4, StorageClass="Const")  % Permanently set the actuator (ESC) to spin direction 1 (which can be clockwise or counter-clockwise).
MAV_ACTUATOR_CONFIGURATION_SPIN_DIRECTION2 = Simulink.Parameter(5, StorageClass="Const")  % Permanently set the actuator (ESC) to spin direction 2 (opposite of direction 1).

MAV_ACTUATOR_CONFIGURATION = enum(AddClassNameToEnumNames=true)  % Actuator configuration, used to change a setting on an actuator. Component information metadata can be used to know which outputs support which commands.
  NONE = 0  % Do nothing.
  BEEP = 1  % Command the actuator to beep now.
  x3D_MODE_ON = 2  % Permanently set the actuator (ESC) to 3D mode (reversible thrust).
  x3D_MODE_OFF = 3  % Permanently set the actuator (ESC) to non 3D mode (non-reversible thrust).
  SPIN_DIRECTION1 = 4  % Permanently set the actuator (ESC) to spin direction 1 (which can be clockwise or counter-clockwise).
  SPIN_DIRECTION2 = 5  % Permanently set the actuator (ESC) to spin direction 2 (opposite of direction 1).

MAV_ACTUATOR_OUTPUT_FUNCTION_NONE = Simulink.Parameter(0, StorageClass="Const")  % No function (disabled).
MAV_ACTUATOR_OUTPUT_FUNCTION_MOTOR1 = Simulink.Parameter(1, StorageClass="Const")  % Motor 1
MAV_ACTUATOR_OUTPUT_FUNCTION_MOTOR2 = Simulink.Parameter(2, StorageClass="Const")  % Motor 2
MAV_ACTUATOR_OUTPUT_FUNCTION_MOTOR3 = Simulink.Parameter(3, StorageClass="Const")  % Motor 3
MAV_ACTUATOR_OUTPUT_FUNCTION_MOTOR4 = Simulink.Parameter(4, StorageClass="Const")  % Motor 4
MAV_ACTUATOR_OUTPUT_FUNCTION_MOTOR5 = Simulink.Parameter(5, StorageClass="Const")  % Motor 5
MAV_ACTUATOR_OUTPUT_FUNCTION_MOTOR6 = Simulink.Parameter(6, StorageClass="Const")  % Motor 6
MAV_ACTUATOR_OUTPUT_FUNCTION_MOTOR7 = Simulink.Parameter(7, StorageClass="Const")  % Motor 7
MAV_ACTUATOR_OUTPUT_FUNCTION_MOTOR8 = Simulink.Parameter(8, StorageClass="Const")  % Motor 8
MAV_ACTUATOR_OUTPUT_FUNCTION_MOTOR9 = Simulink.Parameter(9, StorageClass="Const")  % Motor 9
MAV_ACTUATOR_OUTPUT_FUNCTION_MOTOR10 = Simulink.Parameter(10, StorageClass="Const")  % Motor 10
MAV_ACTUATOR_OUTPUT_FUNCTION_MOTOR11 = Simulink.Parameter(11, StorageClass="Const")  % Motor 11
MAV_ACTUATOR_OUTPUT_FUNCTION_MOTOR12 = Simulink.Parameter(12, StorageClass="Const")  % Motor 12
MAV_ACTUATOR_OUTPUT_FUNCTION_MOTOR13 = Simulink.Parameter(13, StorageClass="Const")  % Motor 13
MAV_ACTUATOR_OUTPUT_FUNCTION_MOTOR14 = Simulink.Parameter(14, StorageClass="Const")  % Motor 14
MAV_ACTUATOR_OUTPUT_FUNCTION_MOTOR15 = Simulink.Parameter(15, StorageClass="Const")  % Motor 15
MAV_ACTUATOR_OUTPUT_FUNCTION_MOTOR16 = Simulink.Parameter(16, StorageClass="Const")  % Motor 16
MAV_ACTUATOR_OUTPUT_FUNCTION_SERVO1 = Simulink.Parameter(33, StorageClass="Const")  % Servo 1
MAV_ACTUATOR_OUTPUT_FUNCTION_SERVO2 = Simulink.Parameter(34, StorageClass="Const")  % Servo 2
MAV_ACTUATOR_OUTPUT_FUNCTION_SERVO3 = Simulink.Parameter(35, StorageClass="Const")  % Servo 3
MAV_ACTUATOR_OUTPUT_FUNCTION_SERVO4 = Simulink.Parameter(36, StorageClass="Const")  % Servo 4
MAV_ACTUATOR_OUTPUT_FUNCTION_SERVO5 = Simulink.Parameter(37, StorageClass="Const")  % Servo 5
MAV_ACTUATOR_OUTPUT_FUNCTION_SERVO6 = Simulink.Parameter(38, StorageClass="Const")  % Servo 6
MAV_ACTUATOR_OUTPUT_FUNCTION_SERVO7 = Simulink.Parameter(39, StorageClass="Const")  % Servo 7
MAV_ACTUATOR_OUTPUT_FUNCTION_SERVO8 = Simulink.Parameter(40, StorageClass="Const")  % Servo 8
MAV_ACTUATOR_OUTPUT_FUNCTION_SERVO9 = Simulink.Parameter(41, StorageClass="Const")  % Servo 9
MAV_ACTUATOR_OUTPUT_FUNCTION_SERVO10 = Simulink.Parameter(42, StorageClass="Const")  % Servo 10
MAV_ACTUATOR_OUTPUT_FUNCTION_SERVO11 = Simulink.Parameter(43, StorageClass="Const")  % Servo 11
MAV_ACTUATOR_OUTPUT_FUNCTION_SERVO12 = Simulink.Parameter(44, StorageClass="Const")  % Servo 12
MAV_ACTUATOR_OUTPUT_FUNCTION_SERVO13 = Simulink.Parameter(45, StorageClass="Const")  % Servo 13
MAV_ACTUATOR_OUTPUT_FUNCTION_SERVO14 = Simulink.Parameter(46, StorageClass="Const")  % Servo 14
MAV_ACTUATOR_OUTPUT_FUNCTION_SERVO15 = Simulink.Parameter(47, StorageClass="Const")  % Servo 15
MAV_ACTUATOR_OUTPUT_FUNCTION_SERVO16 = Simulink.Parameter(48, StorageClass="Const")  % Servo 16

MAV_ACTUATOR_OUTPUT_FUNCTION = enum(AddClassNameToEnumNames=true)  % Actuator output function. Values greater or equal to 1000 are autopilot-specific.
  NONE = 0  % No function (disabled).
  MOTOR1 = 1  % Motor 1
  MOTOR2 = 2  % Motor 2
  MOTOR3 = 3  % Motor 3
  MOTOR4 = 4  % Motor 4
  MOTOR5 = 5  % Motor 5
  MOTOR6 = 6  % Motor 6
  MOTOR7 = 7  % Motor 7
  MOTOR8 = 8  % Motor 8
  MOTOR9 = 9  % Motor 9
  MOTOR10 = 10  % Motor 10
  MOTOR11 = 11  % Motor 11
  MOTOR12 = 12  % Motor 12
  MOTOR13 = 13  % Motor 13
  MOTOR14 = 14  % Motor 14
  MOTOR15 = 15  % Motor 15
  MOTOR16 = 16  % Motor 16
  SERVO1 = 33  % Servo 1
  SERVO2 = 34  % Servo 2
  SERVO3 = 35  % Servo 3
  SERVO4 = 36  % Servo 4
  SERVO5 = 37  % Servo 5
  SERVO6 = 38  % Servo 6
  SERVO7 = 39  % Servo 7
  SERVO8 = 40  % Servo 8
  SERVO9 = 41  % Servo 9
  SERVO10 = 42  % Servo 10
  SERVO11 = 43  % Servo 11
  SERVO12 = 44  % Servo 12
  SERVO13 = 45  % Servo 13
  SERVO14 = 46  % Servo 14
  SERVO15 = 47  % Servo 15
  SERVO16 = 48  % Servo 16

MAV_AUTOTUNE_AXIS_DEFAULT = Simulink.Parameter(0, StorageClass="Const")  % Flight stack tunes axis according to its default settings.
MAV_AUTOTUNE_AXIS_ROLL = Simulink.Parameter(1, StorageClass="Const")  % Autotune roll axis.
MAV_AUTOTUNE_AXIS_PITCH = Simulink.Parameter(2, StorageClass="Const")  % Autotune pitch axis.
MAV_AUTOTUNE_AXIS_YAW = Simulink.Parameter(4, StorageClass="Const")  % Autotune yaw axis.

MAV_AUTOTUNE_AXIS = enum(AddClassNameToEnumNames=true)  % Enable axes that will be tuned via autotuning. Used in MAV_CMD_DO_AUTOTUNE_ENABLE.
  DEFAULT = 0  % Flight stack tunes axis according to its default settings.
  ROLL = 1  % Autotune roll axis.
  PITCH = 2  % Autotune pitch axis.
  YAW = 4  % Autotune yaw axis.

MAV_PARAM_READ_PERSISTENT = Simulink.Parameter(0, StorageClass="Const")  % Read all parameters from persistent storage. Replaces values in volatile storage.
MAV_PARAM_WRITE_PERSISTENT = Simulink.Parameter(1, StorageClass="Const")  % Write all parameter values to persistent storage (flash/EEPROM)
MAV_PARAM_RESET_CONFIG_DEFAULT = Simulink.Parameter(2, StorageClass="Const")  % Reset all user configurable parameters to their default value (including airframe selection, sensor calibration data, safety settings, and so on). Does not reset values that contain operation counters and vehicle computed statistics.
MAV_PARAM_RESET_SENSOR_DEFAULT = Simulink.Parameter(3, StorageClass="Const")  % Reset only sensor calibration parameters to factory defaults (or firmware default if not available)
MAV_PARAM_RESET_ALL_DEFAULT = Simulink.Parameter(4, StorageClass="Const")  % Reset all parameters, including operation counters, to default values

MAV_PREFLIGHT_STORAGE_PARAMETER_ACTION = enum(AddClassNameToEnumNames=true)  % Actions for reading/writing parameters between persistent and volatile storage when using MAV_CMD_PREFLIGHT_STORAGE.
  % (Commonly parameters are loaded from persistent storage (flash/EEPROM) into volatile storage (RAM) on startup and written back when they are changed.)
  PARAM_READ_PERSISTENT = 0  % Read all parameters from persistent storage. Replaces values in volatile storage.
  PARAM_WRITE_PERSISTENT = 1  % Write all parameter values to persistent storage (flash/EEPROM)
  PARAM_RESET_CONFIG_DEFAULT = 2  % Reset all user configurable parameters to their default value (including airframe selection, sensor calibration data, safety settings, and so on). Does not reset values that contain operation counters and vehicle computed statistics.
  PARAM_RESET_SENSOR_DEFAULT = 3  % Reset only sensor calibration parameters to factory defaults (or firmware default if not available)
  PARAM_RESET_ALL_DEFAULT = 4  % Reset all parameters, including operation counters, to default values

MAV_MISSION_READ_PERSISTENT = Simulink.Parameter(0, StorageClass="Const")  % Read current mission data from persistent storage
MAV_MISSION_WRITE_PERSISTENT = Simulink.Parameter(1, StorageClass="Const")  % Write current mission data to persistent storage
MAV_MISSION_RESET_DEFAULT = Simulink.Parameter(2, StorageClass="Const")  % Erase all mission data stored on the vehicle (both persistent and volatile storage)

MAV_PREFLIGHT_STORAGE_MISSION_ACTION = enum(AddClassNameToEnumNames=true)  % Actions for reading and writing plan information (mission, rally points, geofence) between persistent and volatile storage when using MAV_CMD_PREFLIGHT_STORAGE.
  % (Commonly missions are loaded from persistent storage (flash/EEPROM) into volatile storage (RAM) on startup and written back when they are changed.)
  MISSION_READ_PERSISTENT = 0  % Read current mission data from persistent storage
  MISSION_WRITE_PERSISTENT = 1  % Write current mission data to persistent storage
  MISSION_RESET_DEFAULT = 2  % Erase all mission data stored on the vehicle (both persistent and volatile storage)

MAV_CMD_NAV_WAYPOINT = Simulink.Parameter(16, StorageClass="Const")  % Navigate to waypoint. This is intended for use in missions (for guided commands outside of missions use MAV_CMD_DO_REPOSITION).
MAV_CMD_NAV_LOITER_UNLIM = Simulink.Parameter(17, StorageClass="Const")  % Loiter around this waypoint an unlimited amount of time
MAV_CMD_NAV_LOITER_TURNS = Simulink.Parameter(18, StorageClass="Const")  % Loiter around this waypoint for X turns
MAV_CMD_NAV_LOITER_TIME = Simulink.Parameter(19, StorageClass="Const")  % Loiter at the specified latitude, longitude and altitude for a certain amount of time. Multicopter vehicles stop at the point (within a vehicle-specific acceptance radius). Forward-only moving vehicles (e.g. fixed-wing) circle the point with the specified radius/direction. If the Heading Required parameter (2) is non-zero forward moving aircraft will only leave the loiter circle once heading towards the next waypoint.
MAV_CMD_NAV_RETURN_TO_LAUNCH = Simulink.Parameter(20, StorageClass="Const")  % Return to launch location
MAV_CMD_NAV_LAND = Simulink.Parameter(21, StorageClass="Const")  % Land at location.
MAV_CMD_NAV_TAKEOFF = Simulink.Parameter(22, StorageClass="Const")  % Takeoff from ground / hand. Vehicles that support multiple takeoff modes (e.g. VTOL quadplane) should take off using the currently configured mode.
MAV_CMD_NAV_LAND_LOCAL = Simulink.Parameter(23, StorageClass="Const")  % Land at local position (local frame only)
MAV_CMD_NAV_TAKEOFF_LOCAL = Simulink.Parameter(24, StorageClass="Const")  % Takeoff from local position (local frame only)
MAV_CMD_NAV_FOLLOW = Simulink.Parameter(25, StorageClass="Const")  % Vehicle following, i.e. this waypoint represents the position of a moving vehicle
MAV_CMD_NAV_CONTINUE_AND_CHANGE_ALT = Simulink.Parameter(30, StorageClass="Const")  % Continue on the current course and climb/descend to specified altitude.  When the altitude is reached continue to the next command (i.e., don't proceed to the next command until the desired altitude is reached.
MAV_CMD_NAV_LOITER_TO_ALT = Simulink.Parameter(31, StorageClass="Const")  % Begin loiter at the specified Latitude and Longitude.  If Lat=Lon=0, then loiter at the current position.  Don't consider the navigation command complete (don't leave loiter) until the altitude has been reached. Additionally, if the Heading Required parameter is non-zero the aircraft will not leave the loiter until heading toward the next waypoint.
MAV_CMD_DO_FOLLOW = Simulink.Parameter(32, StorageClass="Const")  % Begin following a target
MAV_CMD_DO_FOLLOW_REPOSITION = Simulink.Parameter(33, StorageClass="Const")  % Reposition the MAV after a follow target command has been sent
MAV_CMD_DO_ORBIT = Simulink.Parameter(34, StorageClass="Const")  % Start orbiting on the circumference of a circle defined by the parameters. Setting values to NaN/INT32_MAX (as appropriate) results in using defaults.
MAV_CMD_NAV_ROI = Simulink.Parameter(80, StorageClass="Const")  % Sets the region of interest (ROI) for a sensor set or the vehicle itself. This can then be used by the vehicle's control system to control the vehicle attitude and the attitude of various sensors such as cameras.
MAV_CMD_NAV_PATHPLANNING = Simulink.Parameter(81, StorageClass="Const")  % Control autonomous path planning on the MAV.
MAV_CMD_NAV_SPLINE_WAYPOINT = Simulink.Parameter(82, StorageClass="Const")  % Navigate to waypoint using a spline path.
MAV_CMD_NAV_VTOL_TAKEOFF = Simulink.Parameter(84, StorageClass="Const")  % Takeoff from ground using VTOL mode, and transition to forward flight with specified heading. The command should be ignored by vehicles that dont support both VTOL and fixed-wing flight (multicopters, boats,etc.).
MAV_CMD_NAV_VTOL_LAND = Simulink.Parameter(85, StorageClass="Const")  % Land using VTOL mode
MAV_CMD_NAV_GUIDED_ENABLE = Simulink.Parameter(92, StorageClass="Const")  % hand control over to an external controller
MAV_CMD_NAV_DELAY = Simulink.Parameter(93, StorageClass="Const")  % Delay the next navigation command a number of seconds or until a specified time
MAV_CMD_NAV_PAYLOAD_PLACE = Simulink.Parameter(94, StorageClass="Const")  % Descend and place payload. Vehicle moves to specified location, descends until it detects a hanging payload has reached the ground, and then releases the payload. If ground is not detected before the reaching the maximum descent value (param1), the command will complete without releasing the payload.
MAV_CMD_NAV_LAST = Simulink.Parameter(95, StorageClass="Const")  % NOP - This command is only used to mark the upper limit of the NAV/ACTION commands in the enumeration
MAV_CMD_CONDITION_DELAY = Simulink.Parameter(112, StorageClass="Const")  % Delay mission state machine.
MAV_CMD_CONDITION_CHANGE_ALT = Simulink.Parameter(113, StorageClass="Const")  % Ascend/descend to target altitude at specified rate. Delay mission state machine until desired altitude reached.
MAV_CMD_CONDITION_DISTANCE = Simulink.Parameter(114, StorageClass="Const")  % Delay mission state machine until within desired distance of next NAV point.
MAV_CMD_CONDITION_YAW = Simulink.Parameter(115, StorageClass="Const")  % Reach a certain target angle.
MAV_CMD_CONDITION_LAST = Simulink.Parameter(159, StorageClass="Const")  % NOP - This command is only used to mark the upper limit of the CONDITION commands in the enumeration
MAV_CMD_DO_SET_MODE = Simulink.Parameter(176, StorageClass="Const")  % Set system mode.
MAV_CMD_DO_JUMP = Simulink.Parameter(177, StorageClass="Const")  % Jump to the desired command in the mission list.  Repeat this action only the specified number of times
MAV_CMD_DO_CHANGE_SPEED = Simulink.Parameter(178, StorageClass="Const")  % Change speed and/or throttle set points. The value persists until it is overridden or there is a mode change

MAV_CMD_DO_SET_HOME = Simulink.Parameter(179, StorageClass="Const")  % Sets the home position to either to the current position or a specified position.
  % The home position is the default position that the system will return to and land on.
  % The position is set automatically by the system during the takeoff (and may also be set using this command).
  % Note: the current home position may be emitted in a HOME_POSITION message on request (using MAV_CMD_REQUEST_MESSAGE with param1=242).

MAV_CMD_DO_SET_PARAMETER = Simulink.Parameter(180, StorageClass="Const")  % Set a system parameter.  Caution!  Use of this command requires knowledge of the numeric enumeration value of the parameter.
MAV_CMD_DO_SET_RELAY = Simulink.Parameter(181, StorageClass="Const")  % Set a relay to a condition.
MAV_CMD_DO_REPEAT_RELAY = Simulink.Parameter(182, StorageClass="Const")  % Cycle a relay on and off for a desired number of cycles with a desired period.
MAV_CMD_DO_SET_SERVO = Simulink.Parameter(183, StorageClass="Const")  % Set a servo to a desired PWM value.
MAV_CMD_DO_REPEAT_SERVO = Simulink.Parameter(184, StorageClass="Const")  % Cycle a between its nominal setting and a desired PWM for a desired number of cycles with a desired period.

MAV_CMD_DO_FLIGHTTERMINATION = Simulink.Parameter(185, StorageClass="Const")  % Terminate flight immediately.
  % Flight termination immediately and irreversibly terminates the current flight, returning the vehicle to ground.
  % The vehicle will ignore RC or other input until it has been power-cycled.
  % Termination may trigger safety measures, including: disabling motors and deployment of parachute on multicopters, and setting flight surfaces to initiate a landing pattern on fixed-wing).
  % On multicopters without a parachute it may trigger a crash landing.
  % Support for this command can be tested using the protocol bit: MAV_PROTOCOL_CAPABILITY_FLIGHT_TERMINATION.
  % Support for this command can also be tested by sending the command with param1=0 (< 0.5); the ACK should be either MAV_RESULT_FAILED or MAV_RESULT_UNSUPPORTED.

MAV_CMD_DO_CHANGE_ALTITUDE = Simulink.Parameter(186, StorageClass="Const")  % Change altitude set point.
MAV_CMD_DO_SET_ACTUATOR = Simulink.Parameter(187, StorageClass="Const")  % Sets actuators (e.g. servos) to a desired value. The actuator numbers are mapped to specific outputs (e.g. on any MAIN or AUX PWM or UAVCAN) using a flight-stack specific mechanism (i.e. a parameter).

MAV_CMD_DO_LAND_START = Simulink.Parameter(189, StorageClass="Const")  % Mission command to perform a landing. This is used as a marker in a mission to tell the autopilot where a sequence of mission items that represents a landing starts.
  % It may also be sent via a COMMAND_LONG to trigger a landing, in which case the nearest (geographically) landing sequence in the mission will be used.
  % The Latitude/Longitude/Altitude is optional, and may be set to 0 if not needed. If specified then it will be used to help find the closest landing sequence.

MAV_CMD_DO_RALLY_LAND = Simulink.Parameter(190, StorageClass="Const")  % Mission command to perform a landing from a rally point.
MAV_CMD_DO_GO_AROUND = Simulink.Parameter(191, StorageClass="Const")  % Mission command to safely abort an autonomous landing.
MAV_CMD_DO_REPOSITION = Simulink.Parameter(192, StorageClass="Const")  % Reposition the vehicle to a specific WGS84 global position. This command is intended for guided commands (for missions use MAV_CMD_NAV_WAYPOINT instead).
MAV_CMD_DO_PAUSE_CONTINUE = Simulink.Parameter(193, StorageClass="Const")  % If in a GPS controlled position mode, hold the current position or continue.
MAV_CMD_DO_SET_REVERSE = Simulink.Parameter(194, StorageClass="Const")  % Set moving direction to forward or reverse.
MAV_CMD_DO_SET_ROI_LOCATION = Simulink.Parameter(195, StorageClass="Const")  % Sets the region of interest (ROI) to a location. This can then be used by the vehicle's control system to control the vehicle attitude and the attitude of various sensors such as cameras. This command can be sent to a gimbal manager but not to a gimbal device. A gimbal is not to react to this message.
MAV_CMD_DO_SET_ROI_WPNEXT_OFFSET = Simulink.Parameter(196, StorageClass="Const")  % Sets the region of interest (ROI) to be toward next waypoint, with optional pitch/roll/yaw offset. This can then be used by the vehicle's control system to control the vehicle attitude and the attitude of various sensors such as cameras. This command can be sent to a gimbal manager but not to a gimbal device. A gimbal device is not to react to this message.
MAV_CMD_DO_SET_ROI_NONE = Simulink.Parameter(197, StorageClass="Const")  % Cancels any previous ROI command returning the vehicle/sensors to default flight characteristics. This can then be used by the vehicle's control system to control the vehicle attitude and the attitude of various sensors such as cameras. This command can be sent to a gimbal manager but not to a gimbal device. A gimbal device is not to react to this message. After this command the gimbal manager should go back to manual input if available, and otherwise assume a neutral position.
MAV_CMD_DO_SET_ROI_SYSID = Simulink.Parameter(198, StorageClass="Const")  % Mount tracks system with specified system ID. Determination of target vehicle position may be done with GLOBAL_POSITION_INT or any other means. This command can be sent to a gimbal manager but not to a gimbal device. A gimbal device is not to react to this message.
MAV_CMD_DO_CONTROL_VIDEO = Simulink.Parameter(200, StorageClass="Const")  % Control onboard camera system.
MAV_CMD_DO_SET_ROI = Simulink.Parameter(201, StorageClass="Const")  % Sets the region of interest (ROI) for a sensor set or the vehicle itself. This can then be used by the vehicle's control system to control the vehicle attitude and the attitude of various sensors such as cameras.
MAV_CMD_DO_DIGICAM_CONFIGURE = Simulink.Parameter(202, StorageClass="Const")  % Configure digital camera. This is a fallback message for systems that have not yet implemented PARAM_EXT_XXX messages and camera definition files (see https://mavlink.io/en/services/camera_def.html ).
MAV_CMD_DO_DIGICAM_CONTROL = Simulink.Parameter(203, StorageClass="Const")  % Control digital camera. This is a fallback message for systems that have not yet implemented PARAM_EXT_XXX messages and camera definition files (see https://mavlink.io/en/services/camera_def.html ).
MAV_CMD_DO_MOUNT_CONFIGURE = Simulink.Parameter(204, StorageClass="Const")  % Mission command to configure a camera or antenna mount
MAV_CMD_DO_MOUNT_CONTROL = Simulink.Parameter(205, StorageClass="Const")  % Mission command to control a camera or antenna mount
MAV_CMD_DO_SET_CAM_TRIGG_DIST = Simulink.Parameter(206, StorageClass="Const")  % Mission command to set camera trigger distance for this flight. The camera is triggered each time this distance is exceeded. This command can also be used to set the shutter integration time for the camera.
MAV_CMD_DO_FENCE_ENABLE = Simulink.Parameter(207, StorageClass="Const")  % Mission command to enable the geofence
MAV_CMD_DO_PARACHUTE = Simulink.Parameter(208, StorageClass="Const")  % Mission item/command to release a parachute or enable/disable auto release.
MAV_CMD_DO_MOTOR_TEST = Simulink.Parameter(209, StorageClass="Const")  % Command to perform motor test.
MAV_CMD_DO_INVERTED_FLIGHT = Simulink.Parameter(210, StorageClass="Const")  % Change to/from inverted flight.
MAV_CMD_DO_GRIPPER = Simulink.Parameter(211, StorageClass="Const")  % Mission command to operate a gripper.
MAV_CMD_DO_AUTOTUNE_ENABLE = Simulink.Parameter(212, StorageClass="Const")  % Enable/disable autotune.
MAV_CMD_NAV_SET_YAW_SPEED = Simulink.Parameter(213, StorageClass="Const")  % Sets a desired vehicle turn angle and speed change.
MAV_CMD_DO_SET_CAM_TRIGG_INTERVAL = Simulink.Parameter(214, StorageClass="Const")  % Mission command to set camera trigger interval for this flight. If triggering is enabled, the camera is triggered each time this interval expires. This command can also be used to set the shutter integration time for the camera.
MAV_CMD_DO_MOUNT_CONTROL_QUAT = Simulink.Parameter(220, StorageClass="Const")  % Mission command to control a camera or antenna mount, using a quaternion as reference.
MAV_CMD_DO_GUIDED_MASTER = Simulink.Parameter(221, StorageClass="Const")  % set id of master controller
MAV_CMD_DO_GUIDED_LIMITS = Simulink.Parameter(222, StorageClass="Const")  % Set limits for external control
MAV_CMD_DO_ENGINE_CONTROL = Simulink.Parameter(223, StorageClass="Const")  % Control vehicle engine. This is interpreted by the vehicles engine controller to change the target engine state. It is intended for vehicles with internal combustion engines

MAV_CMD_DO_SET_MISSION_CURRENT = Simulink.Parameter(224, StorageClass="Const")  % Set the mission item with sequence number seq as the current item and emit MISSION_CURRENT (whether or not the mission number changed).
  % If a mission is currently being executed, the system will continue to this new mission item on the shortest path, skipping any intermediate mission items.
  % Note that mission jump repeat counters are not reset unless param2 is set (see MAV_CMD_DO_JUMP param2).
  % This command may trigger a mission state-machine change on some systems: for example from MISSION_STATE_NOT_STARTED or MISSION_STATE_PAUSED to MISSION_STATE_ACTIVE.
  % If the system is in mission mode, on those systems this command might therefore start, restart or resume the mission.
  % If the system is not in mission mode this command must not trigger a switch to mission mode.
  % The mission may be "reset" using param2.
  % Resetting sets jump counters to initial values (to reset counters without changing the current mission item set the param1 to `-1`).
  % Resetting also explicitly changes a mission state of MISSION_STATE_COMPLETE to MISSION_STATE_PAUSED or MISSION_STATE_ACTIVE, potentially allowing it to resume when it is (next) in a mission mode.
  % The command will ACK with MAV_RESULT_FAILED if the sequence number is out of range (including if there is no mission item).

MAV_CMD_DO_LAST = Simulink.Parameter(240, StorageClass="Const")  % NOP - This command is only used to mark the upper limit of the DO commands in the enumeration
MAV_CMD_PREFLIGHT_CALIBRATION = Simulink.Parameter(241, StorageClass="Const")  % Trigger calibration. This command will be only accepted if in pre-flight mode. Except for Temperature Calibration, only one sensor should be set in a single message and all others should be zero.
MAV_CMD_PREFLIGHT_SET_SENSOR_OFFSETS = Simulink.Parameter(242, StorageClass="Const")  % Set sensor offsets. This command will be only accepted if in pre-flight mode.
MAV_CMD_PREFLIGHT_UAVCAN = Simulink.Parameter(243, StorageClass="Const")  % Trigger UAVCAN configuration (actuator ID assignment and direction mapping). Note that this maps to the legacy UAVCAN v0 function UAVCAN_ENUMERATE, which is intended to be executed just once during initial vehicle configuration (it is not a normal pre-flight command and has been poorly named).
MAV_CMD_PREFLIGHT_STORAGE = Simulink.Parameter(245, StorageClass="Const")  % Request storage of different parameter values and logs. This command will be only accepted if in pre-flight mode.
MAV_CMD_PREFLIGHT_REBOOT_SHUTDOWN = Simulink.Parameter(246, StorageClass="Const")  % Request the reboot or shutdown of system components.
MAV_CMD_OVERRIDE_GOTO = Simulink.Parameter(252, StorageClass="Const")  % Override current mission with command to pause mission, pause mission and move to position, continue/resume mission. When param 1 indicates that the mission is paused (MAV_GOTO_DO_HOLD), param 2 defines whether it holds in place or moves to another position.
MAV_CMD_OBLIQUE_SURVEY = Simulink.Parameter(260, StorageClass="Const")  % Mission command to set a Camera Auto Mount Pivoting Oblique Survey (Replaces CAM_TRIGG_DIST for this purpose). The camera is triggered each time this distance is exceeded, then the mount moves to the next position. Params 4~6 set-up the angle limits and number of positions for oblique survey, where mount-enabled vehicles automatically roll the camera between shots to emulate an oblique camera setup (providing an increased HFOV). This command can also be used to set the shutter integration time for the camera.
MAV_CMD_MISSION_START = Simulink.Parameter(300, StorageClass="Const")  % start running a mission
MAV_CMD_ACTUATOR_TEST = Simulink.Parameter(310, StorageClass="Const")  % Actuator testing command. This is similar to MAV_CMD_DO_MOTOR_TEST but operates on the level of output functions, i.e. it is possible to test Motor1 independent from which output it is configured on. Autopilots typically refuse this command while armed.
MAV_CMD_CONFIGURE_ACTUATOR = Simulink.Parameter(311, StorageClass="Const")  % Actuator configuration command.
MAV_CMD_COMPONENT_ARM_DISARM = Simulink.Parameter(400, StorageClass="Const")  % Arms / Disarms a component

MAV_CMD_RUN_PREARM_CHECKS = Simulink.Parameter(401, StorageClass="Const")  % Instructs a target system to run pre-arm checks.
  % This allows preflight checks to be run on demand, which may be useful on systems that normally run them at low rate, or which do not trigger checks when the armable state might have changed.
  % This command should return MAV_RESULT_ACCEPTED if it will run the checks.
  % The results of the checks are usually then reported in SYS_STATUS messages (this is system-specific).
  % The command should return MAV_RESULT_TEMPORARILY_REJECTED if the system is already armed.

MAV_CMD_ILLUMINATOR_ON_OFF = Simulink.Parameter(405, StorageClass="Const")  % Turns illuminators ON/OFF. An illuminator is a light source that is used for lighting up dark areas external to the system: e.g. a torch or searchlight (as opposed to a light source for illuminating the system itself, e.g. an indicator light).

MAV_CMD_GET_HOME_POSITION = Simulink.Parameter(410, StorageClass="Const")  % Request the home position from the vehicle.
  % The vehicle will ACK the command and then emit the HOME_POSITION message.

MAV_CMD_INJECT_FAILURE = Simulink.Parameter(420, StorageClass="Const")  % Inject artificial failure for testing purposes. Note that autopilots should implement an additional protection before accepting this command such as a specific param setting.
MAV_CMD_START_RX_PAIR = Simulink.Parameter(500, StorageClass="Const")  % Starts receiver pairing.

MAV_CMD_GET_MESSAGE_INTERVAL = Simulink.Parameter(510, StorageClass="Const")  % Request the interval between messages for a particular MAVLink message ID.
  % The receiver should ACK the command and then emit its response in a MESSAGE_INTERVAL message.

MAV_CMD_SET_MESSAGE_INTERVAL = Simulink.Parameter(511, StorageClass="Const")  % Set the interval between messages for a particular MAVLink message ID. This interface replaces REQUEST_DATA_STREAM.
MAV_CMD_REQUEST_MESSAGE = Simulink.Parameter(512, StorageClass="Const")  % Request the target system(s) emit a single instance of a specified message (i.e. a "one-shot" version of MAV_CMD_SET_MESSAGE_INTERVAL).
MAV_CMD_REQUEST_PROTOCOL_VERSION = Simulink.Parameter(519, StorageClass="Const")  % Request MAVLink protocol version compatibility. All receivers should ACK the command and then emit their capabilities in an PROTOCOL_VERSION message
MAV_CMD_REQUEST_AUTOPILOT_CAPABILITIES = Simulink.Parameter(520, StorageClass="Const")  % Request autopilot capabilities. The receiver should ACK the command and then emit its capabilities in an AUTOPILOT_VERSION message
MAV_CMD_REQUEST_CAMERA_INFORMATION = Simulink.Parameter(521, StorageClass="Const")  % Request camera information (CAMERA_INFORMATION).
MAV_CMD_REQUEST_CAMERA_SETTINGS = Simulink.Parameter(522, StorageClass="Const")  % Request camera settings (CAMERA_SETTINGS).
MAV_CMD_REQUEST_STORAGE_INFORMATION = Simulink.Parameter(525, StorageClass="Const")  % Request storage information (STORAGE_INFORMATION). Use the command's target_component to target a specific component's storage.
MAV_CMD_STORAGE_FORMAT = Simulink.Parameter(526, StorageClass="Const")  % Format a storage medium. Once format is complete, a STORAGE_INFORMATION message is sent. Use the command's target_component to target a specific component's storage.
MAV_CMD_REQUEST_CAMERA_CAPTURE_STATUS = Simulink.Parameter(527, StorageClass="Const")  % Request camera capture status (CAMERA_CAPTURE_STATUS)
MAV_CMD_REQUEST_FLIGHT_INFORMATION = Simulink.Parameter(528, StorageClass="Const")  % Request flight information (FLIGHT_INFORMATION)
MAV_CMD_RESET_CAMERA_SETTINGS = Simulink.Parameter(529, StorageClass="Const")  % Reset all camera settings to Factory Default
MAV_CMD_SET_CAMERA_MODE = Simulink.Parameter(530, StorageClass="Const")  % Set camera running mode. Use NaN for reserved values. GCS will send a MAV_CMD_REQUEST_VIDEO_STREAM_STATUS command after a mode change if the camera supports video streaming.
MAV_CMD_SET_CAMERA_ZOOM = Simulink.Parameter(531, StorageClass="Const")  % Set camera zoom. Camera must respond with a CAMERA_SETTINGS message (on success).
MAV_CMD_SET_CAMERA_FOCUS = Simulink.Parameter(532, StorageClass="Const")  % Set camera focus. Camera must respond with a CAMERA_SETTINGS message (on success).

MAV_CMD_SET_STORAGE_USAGE = Simulink.Parameter(533, StorageClass="Const")  % Set that a particular storage is the preferred location for saving photos, videos, and/or other media (e.g. to set that an SD card is used for storing videos).
  % There can only be one preferred save location for each particular media type: setting a media usage flag will clear/reset that same flag if set on any other storage.
  % If no flag is set the system should use its default storage.
  % A target system can choose to always use default storage, in which case it should ACK the command with MAV_RESULT_UNSUPPORTED.
  % A target system can choose to not allow a particular storage to be set as preferred storage, in which case it should ACK the command with MAV_RESULT_DENIED.

MAV_CMD_JUMP_TAG = Simulink.Parameter(600, StorageClass="Const")  % Tagged jump target. Can be jumped to with MAV_CMD_DO_JUMP_TAG.
MAV_CMD_DO_JUMP_TAG = Simulink.Parameter(601, StorageClass="Const")  % Jump to the matching tag in the mission list. Repeat this action for the specified number of times. A mission should contain a single matching tag for each jump. If this is not the case then a jump to a missing tag should complete the mission, and a jump where there are multiple matching tags should always select the one with the lowest mission sequence number.
MAV_CMD_DO_GIMBAL_MANAGER_PITCHYAW = Simulink.Parameter(1000, StorageClass="Const")  % Set gimbal manager pitch/yaw setpoints (low rate command). It is possible to set combinations of the values below. E.g. an angle as well as a desired angular rate can be used to get to this angle at a certain angular rate, or an angular rate only will result in continuous turning. NaN is to be used to signal unset. Note: only the gimbal manager will react to this command - it will be ignored by a gimbal device. Use GIMBAL_MANAGER_SET_PITCHYAW if you need to stream pitch/yaw setpoints at higher rate.
MAV_CMD_DO_GIMBAL_MANAGER_CONFIGURE = Simulink.Parameter(1001, StorageClass="Const")  % Gimbal configuration to set which sysid/compid is in primary and secondary control.

MAV_CMD_IMAGE_START_CAPTURE = Simulink.Parameter(2000, StorageClass="Const")  % Start image capture sequence. CAMERA_IMAGE_CAPTURED must be emitted after each capture.
  % Param1 (id) may be used to specify the target camera: 0: all cameras, 1 to 6: autopilot-connected cameras, 7-255: MAVLink camera component ID.
  % It is needed in order to target specific cameras connected to the autopilot, or specific sensors in a multi-sensor camera (neither of which have a distinct MAVLink component ID).
  % It is also needed to specify the target camera in missions.
  % When used in a mission, an autopilot should execute the MAV_CMD for a specified local camera (param1 = 1-6), or resend it as a command if it is intended for a MAVLink camera (param1 = 7 - 255), setting the command's target_component as the param1 value (and setting param1 in the command to zero).
  % If the param1 is 0 the autopilot should do both.
  % When sent in a command the target MAVLink address is set using target_component.
  % If addressed specifically to an autopilot: param1 should be used in the same way as it is for missions (though command should NACK with MAV_RESULT_DENIED if a specified local camera does not exist).
  % If addressed to a MAVLink camera, param 1 can be used to address all cameras (0), or to separately address 1 to 7 individual sensors. Other values should be NACKed with MAV_RESULT_DENIED.
  % If the command is broadcast (target_component is 0) then param 1 should be set to 0 (any other value should be NACKED with MAV_RESULT_DENIED). An autopilot would trigger any local cameras and forward the command to all channels.

MAV_CMD_IMAGE_STOP_CAPTURE = Simulink.Parameter(2001, StorageClass="Const")  % Stop image capture sequence.
  % Param1 (id) may be used to specify the target camera: 0: all cameras, 1 to 6: autopilot-connected cameras, 7-255: MAVLink camera component ID.
  % It is needed in order to target specific cameras connected to the autopilot, or specific sensors in a multi-sensor camera (neither of which have a distinct MAVLink component ID).
  % It is also needed to specify the target camera in missions.
  % When used in a mission, an autopilot should execute the MAV_CMD for a specified local camera (param1 = 1-6), or resend it as a command if it is intended for a MAVLink camera (param1 = 7 - 255), setting the command's target_component as the param1 value (and setting param1 in the command to zero).
  % If the param1 is 0 the autopilot should do both.
  % When sent in a command the target MAVLink address is set using target_component.
  % If addressed specifically to an autopilot: param1 should be used in the same way as it is for missions (though command should NACK with MAV_RESULT_DENIED if a specified local camera does not exist).
  % If addressed to a MAVLink camera, param1 can be used to address all cameras (0), or to separately address 1 to 7 individual sensors. Other values should be NACKed with MAV_RESULT_DENIED.
  % If the command is broadcast (target_component is 0) then param 1 should be set to 0 (any other value should be NACKED with MAV_RESULT_DENIED). An autopilot would trigger any local cameras and forward the command to all channels.

MAV_CMD_REQUEST_CAMERA_IMAGE_CAPTURE = Simulink.Parameter(2002, StorageClass="Const")  % Re-request a CAMERA_IMAGE_CAPTURED message.
MAV_CMD_DO_TRIGGER_CONTROL = Simulink.Parameter(2003, StorageClass="Const")  % Enable or disable on-board camera triggering system.
MAV_CMD_CAMERA_TRACK_POINT = Simulink.Parameter(2004, StorageClass="Const")  % If the camera supports point visual tracking (CAMERA_CAP_FLAGS_HAS_TRACKING_POINT is set), this command allows to initiate the tracking.
MAV_CMD_CAMERA_TRACK_RECTANGLE = Simulink.Parameter(2005, StorageClass="Const")  % If the camera supports rectangle visual tracking (CAMERA_CAP_FLAGS_HAS_TRACKING_RECTANGLE is set), this command allows to initiate the tracking.
MAV_CMD_CAMERA_STOP_TRACKING = Simulink.Parameter(2010, StorageClass="Const")  % Stops ongoing tracking.
MAV_CMD_VIDEO_START_CAPTURE = Simulink.Parameter(2500, StorageClass="Const")  % Starts video capture (recording).
MAV_CMD_VIDEO_STOP_CAPTURE = Simulink.Parameter(2501, StorageClass="Const")  % Stop the current video capture (recording).
MAV_CMD_VIDEO_START_STREAMING = Simulink.Parameter(2502, StorageClass="Const")  % Start video streaming
MAV_CMD_VIDEO_STOP_STREAMING = Simulink.Parameter(2503, StorageClass="Const")  % Stop the given video stream
MAV_CMD_REQUEST_VIDEO_STREAM_INFORMATION = Simulink.Parameter(2504, StorageClass="Const")  % Request video stream information (VIDEO_STREAM_INFORMATION)
MAV_CMD_REQUEST_VIDEO_STREAM_STATUS = Simulink.Parameter(2505, StorageClass="Const")  % Request video stream status (VIDEO_STREAM_STATUS)
MAV_CMD_LOGGING_START = Simulink.Parameter(2510, StorageClass="Const")  % Request to start streaming logging data over MAVLink (see also LOGGING_DATA message)
MAV_CMD_LOGGING_STOP = Simulink.Parameter(2511, StorageClass="Const")  % Request to stop streaming log data over MAVLink
MAV_CMD_AIRFRAME_CONFIGURATION = Simulink.Parameter(2520, StorageClass="Const")
MAV_CMD_CONTROL_HIGH_LATENCY = Simulink.Parameter(2600, StorageClass="Const")  % Request to start/stop transmitting over the high latency telemetry
MAV_CMD_PANORAMA_CREATE = Simulink.Parameter(2800, StorageClass="Const")  % Create a panorama at the current position
MAV_CMD_DO_VTOL_TRANSITION = Simulink.Parameter(3000, StorageClass="Const")  % Request VTOL transition

MAV_CMD_ARM_AUTHORIZATION_REQUEST = Simulink.Parameter(3001, StorageClass="Const")  % Request authorization to arm the vehicle to a external entity, the arm authorizer is responsible to request all data that is needs from the vehicle before authorize or deny the request.
  % If approved the COMMAND_ACK message progress field should be set with period of time that this authorization is valid in seconds.
  % If the authorization is denied COMMAND_ACK.result_param2 should be set with one of the reasons in ARM_AUTH_DENIED_REASON.

MAV_CMD_SET_GUIDED_SUBMODE_STANDARD = Simulink.Parameter(4000, StorageClass="Const")  % This command sets the submode to standard guided when vehicle is in guided mode. The vehicle holds position and altitude and the user can input the desired velocities along all three axes.
MAV_CMD_SET_GUIDED_SUBMODE_CIRCLE = Simulink.Parameter(4001, StorageClass="Const")  % This command sets submode circle when vehicle is in guided mode. Vehicle flies along a circle facing the center of the circle. The user can input the velocity along the circle and change the radius. If no input is given the vehicle will hold position.
MAV_CMD_CONDITION_GATE = Simulink.Parameter(4501, StorageClass="Const")  % Delay mission state machine until gate has been reached.
MAV_CMD_NAV_FENCE_RETURN_POINT = Simulink.Parameter(5000, StorageClass="Const")  % Fence return point (there can only be one such point in a geofence definition). If rally points are supported they should be used instead.
MAV_CMD_NAV_FENCE_POLYGON_VERTEX_INCLUSION = Simulink.Parameter(5001, StorageClass="Const")  % Fence vertex for an inclusion polygon (the polygon must not be self-intersecting). The vehicle must stay within this area. Minimum of 3 vertices required.
MAV_CMD_NAV_FENCE_POLYGON_VERTEX_EXCLUSION = Simulink.Parameter(5002, StorageClass="Const")  % Fence vertex for an exclusion polygon (the polygon must not be self-intersecting). The vehicle must stay outside this area. Minimum of 3 vertices required.
MAV_CMD_NAV_FENCE_CIRCLE_INCLUSION = Simulink.Parameter(5003, StorageClass="Const")  % Circular fence area. The vehicle must stay inside this area.
MAV_CMD_NAV_FENCE_CIRCLE_EXCLUSION = Simulink.Parameter(5004, StorageClass="Const")  % Circular fence area. The vehicle must stay outside this area.
MAV_CMD_NAV_RALLY_POINT = Simulink.Parameter(5100, StorageClass="Const")  % Rally point. You can have multiple rally points defined.
MAV_CMD_UAVCAN_GET_NODE_INFO = Simulink.Parameter(5200, StorageClass="Const")  % Commands the vehicle to respond with a sequence of messages UAVCAN_NODE_INFO, one message per every UAVCAN node that is online. Note that some of the response messages can be lost, which the receiver can detect easily by checking whether every received UAVCAN_NODE_STATUS has a matching message UAVCAN_NODE_INFO received earlier; if not, this command should be sent again in order to request re-transmission of the node information messages.
MAV_CMD_DO_ADSB_OUT_IDENT = Simulink.Parameter(10001, StorageClass="Const")  % Trigger the start of an ADSB-out IDENT. This should only be used when requested to do so by an Air Traffic Controller in controlled airspace. This starts the IDENT which is then typically held for 18 seconds by the hardware per the Mode A, C, and S transponder spec.
MAV_CMD_PAYLOAD_PREPARE_DEPLOY = Simulink.Parameter(30001, StorageClass="Const")  % Deploy payload on a Lat / Lon / Alt position. This includes the navigation to reach the required release position and velocity.
MAV_CMD_PAYLOAD_CONTROL_DEPLOY = Simulink.Parameter(30002, StorageClass="Const")  % Control the payload deployment.
MAV_CMD_FIXED_MAG_CAL_YAW = Simulink.Parameter(42006, StorageClass="Const")  % Magnetometer calibration based on provided known yaw. This allows for fast calibration using WMM field tables in the vehicle, given only the known yaw of the vehicle. If Latitude and longitude are both zero then use the current vehicle location.
MAV_CMD_DO_WINCH = Simulink.Parameter(42600, StorageClass="Const")  % Command to operate winch.
MAV_CMD_EXTERNAL_POSITION_ESTIMATE = Simulink.Parameter(43003, StorageClass="Const")  % Provide an external position estimate for use when dead-reckoning. This is meant to be used for occasional position resets that may be provided by a external system such as a remote pilot using landmarks over a video link.
MAV_CMD_WAYPOINT_USER_1 = Simulink.Parameter(31000, StorageClass="Const")  % User defined waypoint item. Ground Station will show the Vehicle as flying through this item.
MAV_CMD_WAYPOINT_USER_2 = Simulink.Parameter(31001, StorageClass="Const")  % User defined waypoint item. Ground Station will show the Vehicle as flying through this item.
MAV_CMD_WAYPOINT_USER_3 = Simulink.Parameter(31002, StorageClass="Const")  % User defined waypoint item. Ground Station will show the Vehicle as flying through this item.
MAV_CMD_WAYPOINT_USER_4 = Simulink.Parameter(31003, StorageClass="Const")  % User defined waypoint item. Ground Station will show the Vehicle as flying through this item.
MAV_CMD_WAYPOINT_USER_5 = Simulink.Parameter(31004, StorageClass="Const")  % User defined waypoint item. Ground Station will show the Vehicle as flying through this item.
MAV_CMD_SPATIAL_USER_1 = Simulink.Parameter(31005, StorageClass="Const")  % User defined spatial item. Ground Station will not show the Vehicle as flying through this item. Example: ROI item.
MAV_CMD_SPATIAL_USER_2 = Simulink.Parameter(31006, StorageClass="Const")  % User defined spatial item. Ground Station will not show the Vehicle as flying through this item. Example: ROI item.
MAV_CMD_SPATIAL_USER_3 = Simulink.Parameter(31007, StorageClass="Const")  % User defined spatial item. Ground Station will not show the Vehicle as flying through this item. Example: ROI item.
MAV_CMD_SPATIAL_USER_4 = Simulink.Parameter(31008, StorageClass="Const")  % User defined spatial item. Ground Station will not show the Vehicle as flying through this item. Example: ROI item.
MAV_CMD_SPATIAL_USER_5 = Simulink.Parameter(31009, StorageClass="Const")  % User defined spatial item. Ground Station will not show the Vehicle as flying through this item. Example: ROI item.
MAV_CMD_USER_1 = Simulink.Parameter(31010, StorageClass="Const")  % User defined command. Ground Station will not show the Vehicle as flying through this item. Example: MAV_CMD_DO_SET_PARAMETER item.
MAV_CMD_USER_2 = Simulink.Parameter(31011, StorageClass="Const")  % User defined command. Ground Station will not show the Vehicle as flying through this item. Example: MAV_CMD_DO_SET_PARAMETER item.
MAV_CMD_USER_3 = Simulink.Parameter(31012, StorageClass="Const")  % User defined command. Ground Station will not show the Vehicle as flying through this item. Example: MAV_CMD_DO_SET_PARAMETER item.
MAV_CMD_USER_4 = Simulink.Parameter(31013, StorageClass="Const")  % User defined command. Ground Station will not show the Vehicle as flying through this item. Example: MAV_CMD_DO_SET_PARAMETER item.
MAV_CMD_USER_5 = Simulink.Parameter(31014, StorageClass="Const")  % User defined command. Ground Station will not show the Vehicle as flying through this item. Example: MAV_CMD_DO_SET_PARAMETER item.
MAV_CMD_CAN_FORWARD = Simulink.Parameter(32000, StorageClass="Const")  % Request forwarding of CAN packets from the given CAN bus to this component. CAN Frames are sent using CAN_FRAME and CANFD_FRAME messages

MAV_CMD = enum(AddClassNameToEnumNames=true)  % Commands to be executed by the MAV. They can be executed on user request, or as part of a mission script. If the action is used in a mission, the parameter mapping to the waypoint/mission message is as follows: Param 1, Param 2, Param 3, Param 4, X: Param 5, Y:Param 6, Z:Param 7. This command list is similar what ARINC 424 is for commercial aircraft: A data format how to interpret waypoint/mission data. NaN and INT32_MAX may be used in float/integer params (respectively) to indicate optional/default values (e.g. to use the component's current yaw or latitude rather than a specific value). See https://mavlink.io/en/guide/xml_schema.html#MAV_CMD for information about the structure of the MAV_CMD entries
  NAV_WAYPOINT = 16  % Navigate to waypoint. This is intended for use in missions (for guided commands outside of missions use MAV_CMD_DO_REPOSITION).
  NAV_LOITER_UNLIM = 17  % Loiter around this waypoint an unlimited amount of time
  NAV_LOITER_TURNS = 18  % Loiter around this waypoint for X turns
  NAV_LOITER_TIME = 19  % Loiter at the specified latitude, longitude and altitude for a certain amount of time. Multicopter vehicles stop at the point (within a vehicle-specific acceptance radius). Forward-only moving vehicles (e.g. fixed-wing) circle the point with the specified radius/direction. If the Heading Required parameter (2) is non-zero forward moving aircraft will only leave the loiter circle once heading towards the next waypoint.
  NAV_RETURN_TO_LAUNCH = 20  % Return to launch location
  NAV_LAND = 21  % Land at location.
  NAV_TAKEOFF = 22  % Takeoff from ground / hand. Vehicles that support multiple takeoff modes (e.g. VTOL quadplane) should take off using the currently configured mode.
  NAV_LAND_LOCAL = 23  % Land at local position (local frame only)
  NAV_TAKEOFF_LOCAL = 24  % Takeoff from local position (local frame only)
  NAV_FOLLOW = 25  % Vehicle following, i.e. this waypoint represents the position of a moving vehicle
  NAV_CONTINUE_AND_CHANGE_ALT = 30  % Continue on the current course and climb/descend to specified altitude.  When the altitude is reached continue to the next command (i.e., don't proceed to the next command until the desired altitude is reached.
  NAV_LOITER_TO_ALT = 31  % Begin loiter at the specified Latitude and Longitude.  If Lat=Lon=0, then loiter at the current position.  Don't consider the navigation command complete (don't leave loiter) until the altitude has been reached. Additionally, if the Heading Required parameter is non-zero the aircraft will not leave the loiter until heading toward the next waypoint.
  DO_FOLLOW = 32  % Begin following a target
  DO_FOLLOW_REPOSITION = 33  % Reposition the MAV after a follow target command has been sent
  DO_ORBIT = 34  % Start orbiting on the circumference of a circle defined by the parameters. Setting values to NaN/INT32_MAX (as appropriate) results in using defaults.
  NAV_ROI = 80  % Sets the region of interest (ROI) for a sensor set or the vehicle itself. This can then be used by the vehicle's control system to control the vehicle attitude and the attitude of various sensors such as cameras.
  NAV_PATHPLANNING = 81  % Control autonomous path planning on the MAV.
  NAV_SPLINE_WAYPOINT = 82  % Navigate to waypoint using a spline path.
  NAV_VTOL_TAKEOFF = 84  % Takeoff from ground using VTOL mode, and transition to forward flight with specified heading. The command should be ignored by vehicles that dont support both VTOL and fixed-wing flight (multicopters, boats,etc.).
  NAV_VTOL_LAND = 85  % Land using VTOL mode
  NAV_GUIDED_ENABLE = 92  % hand control over to an external controller
  NAV_DELAY = 93  % Delay the next navigation command a number of seconds or until a specified time
  NAV_PAYLOAD_PLACE = 94  % Descend and place payload. Vehicle moves to specified location, descends until it detects a hanging payload has reached the ground, and then releases the payload. If ground is not detected before the reaching the maximum descent value (param1), the command will complete without releasing the payload.
  NAV_LAST = 95  % NOP - This command is only used to mark the upper limit of the NAV/ACTION commands in the enumeration
  CONDITION_DELAY = 112  % Delay mission state machine.
  CONDITION_CHANGE_ALT = 113  % Ascend/descend to target altitude at specified rate. Delay mission state machine until desired altitude reached.
  CONDITION_DISTANCE = 114  % Delay mission state machine until within desired distance of next NAV point.
  CONDITION_YAW = 115  % Reach a certain target angle.
  CONDITION_LAST = 159  % NOP - This command is only used to mark the upper limit of the CONDITION commands in the enumeration
  DO_SET_MODE = 176  % Set system mode.
  DO_JUMP = 177  % Jump to the desired command in the mission list.  Repeat this action only the specified number of times
  DO_CHANGE_SPEED = 178  % Change speed and/or throttle set points. The value persists until it is overridden or there is a mode change
  DO_SET_HOME = 179  % Sets the home position to either to the current position or a specified position.
    % The home position is the default position that the system will return to and land on.
    % The position is set automatically by the system during the takeoff (and may also be set using this command).
    % Note: the current home position may be emitted in a HOME_POSITION message on request (using MAV_CMD_REQUEST_MESSAGE with param1=242).
  DO_SET_PARAMETER = 180  % Set a system parameter.  Caution!  Use of this command requires knowledge of the numeric enumeration value of the parameter.
  DO_SET_RELAY = 181  % Set a relay to a condition.
  DO_REPEAT_RELAY = 182  % Cycle a relay on and off for a desired number of cycles with a desired period.
  DO_SET_SERVO = 183  % Set a servo to a desired PWM value.
  DO_REPEAT_SERVO = 184  % Cycle a between its nominal setting and a desired PWM for a desired number of cycles with a desired period.
  DO_FLIGHTTERMINATION = 185  % Terminate flight immediately.
    % Flight termination immediately and irreversibly terminates the current flight, returning the vehicle to ground.
    % The vehicle will ignore RC or other input until it has been power-cycled.
    % Termination may trigger safety measures, including: disabling motors and deployment of parachute on multicopters, and setting flight surfaces to initiate a landing pattern on fixed-wing).
    % On multicopters without a parachute it may trigger a crash landing.
    % Support for this command can be tested using the protocol bit: MAV_PROTOCOL_CAPABILITY_FLIGHT_TERMINATION.
    % Support for this command can also be tested by sending the command with param1=0 (< 0.5); the ACK should be either MAV_RESULT_FAILED or MAV_RESULT_UNSUPPORTED.
  DO_CHANGE_ALTITUDE = 186  % Change altitude set point.
  DO_SET_ACTUATOR = 187  % Sets actuators (e.g. servos) to a desired value. The actuator numbers are mapped to specific outputs (e.g. on any MAIN or AUX PWM or UAVCAN) using a flight-stack specific mechanism (i.e. a parameter).
  DO_LAND_START = 189  % Mission command to perform a landing. This is used as a marker in a mission to tell the autopilot where a sequence of mission items that represents a landing starts.
    % It may also be sent via a COMMAND_LONG to trigger a landing, in which case the nearest (geographically) landing sequence in the mission will be used.
    % The Latitude/Longitude/Altitude is optional, and may be set to 0 if not needed. If specified then it will be used to help find the closest landing sequence.
  DO_RALLY_LAND = 190  % Mission command to perform a landing from a rally point.
  DO_GO_AROUND = 191  % Mission command to safely abort an autonomous landing.
  DO_REPOSITION = 192  % Reposition the vehicle to a specific WGS84 global position. This command is intended for guided commands (for missions use MAV_CMD_NAV_WAYPOINT instead).
  DO_PAUSE_CONTINUE = 193  % If in a GPS controlled position mode, hold the current position or continue.
  DO_SET_REVERSE = 194  % Set moving direction to forward or reverse.
  DO_SET_ROI_LOCATION = 195  % Sets the region of interest (ROI) to a location. This can then be used by the vehicle's control system to control the vehicle attitude and the attitude of various sensors such as cameras. This command can be sent to a gimbal manager but not to a gimbal device. A gimbal is not to react to this message.
  DO_SET_ROI_WPNEXT_OFFSET = 196  % Sets the region of interest (ROI) to be toward next waypoint, with optional pitch/roll/yaw offset. This can then be used by the vehicle's control system to control the vehicle attitude and the attitude of various sensors such as cameras. This command can be sent to a gimbal manager but not to a gimbal device. A gimbal device is not to react to this message.
  DO_SET_ROI_NONE = 197  % Cancels any previous ROI command returning the vehicle/sensors to default flight characteristics. This can then be used by the vehicle's control system to control the vehicle attitude and the attitude of various sensors such as cameras. This command can be sent to a gimbal manager but not to a gimbal device. A gimbal device is not to react to this message. After this command the gimbal manager should go back to manual input if available, and otherwise assume a neutral position.
  DO_SET_ROI_SYSID = 198  % Mount tracks system with specified system ID. Determination of target vehicle position may be done with GLOBAL_POSITION_INT or any other means. This command can be sent to a gimbal manager but not to a gimbal device. A gimbal device is not to react to this message.
  DO_CONTROL_VIDEO = 200  % Control onboard camera system.
  DO_SET_ROI = 201  % Sets the region of interest (ROI) for a sensor set or the vehicle itself. This can then be used by the vehicle's control system to control the vehicle attitude and the attitude of various sensors such as cameras.
  DO_DIGICAM_CONFIGURE = 202  % Configure digital camera. This is a fallback message for systems that have not yet implemented PARAM_EXT_XXX messages and camera definition files (see https://mavlink.io/en/services/camera_def.html ).
  DO_DIGICAM_CONTROL = 203  % Control digital camera. This is a fallback message for systems that have not yet implemented PARAM_EXT_XXX messages and camera definition files (see https://mavlink.io/en/services/camera_def.html ).
  DO_MOUNT_CONFIGURE = 204  % Mission command to configure a camera or antenna mount
  DO_MOUNT_CONTROL = 205  % Mission command to control a camera or antenna mount
  DO_SET_CAM_TRIGG_DIST = 206  % Mission command to set camera trigger distance for this flight. The camera is triggered each time this distance is exceeded. This command can also be used to set the shutter integration time for the camera.
  DO_FENCE_ENABLE = 207  % Mission command to enable the geofence
  DO_PARACHUTE = 208  % Mission item/command to release a parachute or enable/disable auto release.
  DO_MOTOR_TEST = 209  % Command to perform motor test.
  DO_INVERTED_FLIGHT = 210  % Change to/from inverted flight.
  DO_GRIPPER = 211  % Mission command to operate a gripper.
  DO_AUTOTUNE_ENABLE = 212  % Enable/disable autotune.
  NAV_SET_YAW_SPEED = 213  % Sets a desired vehicle turn angle and speed change.
  DO_SET_CAM_TRIGG_INTERVAL = 214  % Mission command to set camera trigger interval for this flight. If triggering is enabled, the camera is triggered each time this interval expires. This command can also be used to set the shutter integration time for the camera.
  DO_MOUNT_CONTROL_QUAT = 220  % Mission command to control a camera or antenna mount, using a quaternion as reference.
  DO_GUIDED_MASTER = 221  % set id of master controller
  DO_GUIDED_LIMITS = 222  % Set limits for external control
  DO_ENGINE_CONTROL = 223  % Control vehicle engine. This is interpreted by the vehicles engine controller to change the target engine state. It is intended for vehicles with internal combustion engines
  DO_SET_MISSION_CURRENT = 224  % Set the mission item with sequence number seq as the current item and emit MISSION_CURRENT (whether or not the mission number changed).
    % If a mission is currently being executed, the system will continue to this new mission item on the shortest path, skipping any intermediate mission items.
    % Note that mission jump repeat counters are not reset unless param2 is set (see MAV_CMD_DO_JUMP param2).
    % This command may trigger a mission state-machine change on some systems: for example from MISSION_STATE_NOT_STARTED or MISSION_STATE_PAUSED to MISSION_STATE_ACTIVE.
    % If the system is in mission mode, on those systems this command might therefore start, restart or resume the mission.
    % If the system is not in mission mode this command must not trigger a switch to mission mode.
    % The mission may be "reset" using param2.
    % Resetting sets jump counters to initial values (to reset counters without changing the current mission item set the param1 to `-1`).
    % Resetting also explicitly changes a mission state of MISSION_STATE_COMPLETE to MISSION_STATE_PAUSED or MISSION_STATE_ACTIVE, potentially allowing it to resume when it is (next) in a mission mode.
    % The command will ACK with MAV_RESULT_FAILED if the sequence number is out of range (including if there is no mission item).
  DO_LAST = 240  % NOP - This command is only used to mark the upper limit of the DO commands in the enumeration
  PREFLIGHT_CALIBRATION = 241  % Trigger calibration. This command will be only accepted if in pre-flight mode. Except for Temperature Calibration, only one sensor should be set in a single message and all others should be zero.
  PREFLIGHT_SET_SENSOR_OFFSETS = 242  % Set sensor offsets. This command will be only accepted if in pre-flight mode.
  PREFLIGHT_UAVCAN = 243  % Trigger UAVCAN configuration (actuator ID assignment and direction mapping). Note that this maps to the legacy UAVCAN v0 function UAVCAN_ENUMERATE, which is intended to be executed just once during initial vehicle configuration (it is not a normal pre-flight command and has been poorly named).
  PREFLIGHT_STORAGE = 245  % Request storage of different parameter values and logs. This command will be only accepted if in pre-flight mode.
  PREFLIGHT_REBOOT_SHUTDOWN = 246  % Request the reboot or shutdown of system components.
  OVERRIDE_GOTO = 252  % Override current mission with command to pause mission, pause mission and move to position, continue/resume mission. When param 1 indicates that the mission is paused (MAV_GOTO_DO_HOLD), param 2 defines whether it holds in place or moves to another position.
  OBLIQUE_SURVEY = 260  % Mission command to set a Camera Auto Mount Pivoting Oblique Survey (Replaces CAM_TRIGG_DIST for this purpose). The camera is triggered each time this distance is exceeded, then the mount moves to the next position. Params 4~6 set-up the angle limits and number of positions for oblique survey, where mount-enabled vehicles automatically roll the camera between shots to emulate an oblique camera setup (providing an increased HFOV). This command can also be used to set the shutter integration time for the camera.
  MISSION_START = 300  % start running a mission
  ACTUATOR_TEST = 310  % Actuator testing command. This is similar to MAV_CMD_DO_MOTOR_TEST but operates on the level of output functions, i.e. it is possible to test Motor1 independent from which output it is configured on. Autopilots typically refuse this command while armed.
  CONFIGURE_ACTUATOR = 311  % Actuator configuration command.
  COMPONENT_ARM_DISARM = 400  % Arms / Disarms a component
  RUN_PREARM_CHECKS = 401  % Instructs a target system to run pre-arm checks.
    % This allows preflight checks to be run on demand, which may be useful on systems that normally run them at low rate, or which do not trigger checks when the armable state might have changed.
    % This command should return MAV_RESULT_ACCEPTED if it will run the checks.
    % The results of the checks are usually then reported in SYS_STATUS messages (this is system-specific).
    % The command should return MAV_RESULT_TEMPORARILY_REJECTED if the system is already armed.
  ILLUMINATOR_ON_OFF = 405  % Turns illuminators ON/OFF. An illuminator is a light source that is used for lighting up dark areas external to the system: e.g. a torch or searchlight (as opposed to a light source for illuminating the system itself, e.g. an indicator light).
  GET_HOME_POSITION = 410  % Request the home position from the vehicle.
    % The vehicle will ACK the command and then emit the HOME_POSITION message.
  INJECT_FAILURE = 420  % Inject artificial failure for testing purposes. Note that autopilots should implement an additional protection before accepting this command such as a specific param setting.
  START_RX_PAIR = 500  % Starts receiver pairing.
  GET_MESSAGE_INTERVAL = 510  % Request the interval between messages for a particular MAVLink message ID.
    % The receiver should ACK the command and then emit its response in a MESSAGE_INTERVAL message.
  SET_MESSAGE_INTERVAL = 511  % Set the interval between messages for a particular MAVLink message ID. This interface replaces REQUEST_DATA_STREAM.
  REQUEST_MESSAGE = 512  % Request the target system(s) emit a single instance of a specified message (i.e. a "one-shot" version of MAV_CMD_SET_MESSAGE_INTERVAL).
  REQUEST_PROTOCOL_VERSION = 519  % Request MAVLink protocol version compatibility. All receivers should ACK the command and then emit their capabilities in an PROTOCOL_VERSION message
  REQUEST_AUTOPILOT_CAPABILITIES = 520  % Request autopilot capabilities. The receiver should ACK the command and then emit its capabilities in an AUTOPILOT_VERSION message
  REQUEST_CAMERA_INFORMATION = 521  % Request camera information (CAMERA_INFORMATION).
  REQUEST_CAMERA_SETTINGS = 522  % Request camera settings (CAMERA_SETTINGS).
  REQUEST_STORAGE_INFORMATION = 525  % Request storage information (STORAGE_INFORMATION). Use the command's target_component to target a specific component's storage.
  STORAGE_FORMAT = 526  % Format a storage medium. Once format is complete, a STORAGE_INFORMATION message is sent. Use the command's target_component to target a specific component's storage.
  REQUEST_CAMERA_CAPTURE_STATUS = 527  % Request camera capture status (CAMERA_CAPTURE_STATUS)
  REQUEST_FLIGHT_INFORMATION = 528  % Request flight information (FLIGHT_INFORMATION)
  RESET_CAMERA_SETTINGS = 529  % Reset all camera settings to Factory Default
  SET_CAMERA_MODE = 530  % Set camera running mode. Use NaN for reserved values. GCS will send a MAV_CMD_REQUEST_VIDEO_STREAM_STATUS command after a mode change if the camera supports video streaming.
  SET_CAMERA_ZOOM = 531  % Set camera zoom. Camera must respond with a CAMERA_SETTINGS message (on success).
  SET_CAMERA_FOCUS = 532  % Set camera focus. Camera must respond with a CAMERA_SETTINGS message (on success).
  SET_STORAGE_USAGE = 533  % Set that a particular storage is the preferred location for saving photos, videos, and/or other media (e.g. to set that an SD card is used for storing videos).
    % There can only be one preferred save location for each particular media type: setting a media usage flag will clear/reset that same flag if set on any other storage.
    % If no flag is set the system should use its default storage.
    % A target system can choose to always use default storage, in which case it should ACK the command with MAV_RESULT_UNSUPPORTED.
    % A target system can choose to not allow a particular storage to be set as preferred storage, in which case it should ACK the command with MAV_RESULT_DENIED.
  JUMP_TAG = 600  % Tagged jump target. Can be jumped to with MAV_CMD_DO_JUMP_TAG.
  DO_JUMP_TAG = 601  % Jump to the matching tag in the mission list. Repeat this action for the specified number of times. A mission should contain a single matching tag for each jump. If this is not the case then a jump to a missing tag should complete the mission, and a jump where there are multiple matching tags should always select the one with the lowest mission sequence number.
  DO_GIMBAL_MANAGER_PITCHYAW = 1000  % Set gimbal manager pitch/yaw setpoints (low rate command). It is possible to set combinations of the values below. E.g. an angle as well as a desired angular rate can be used to get to this angle at a certain angular rate, or an angular rate only will result in continuous turning. NaN is to be used to signal unset. Note: only the gimbal manager will react to this command - it will be ignored by a gimbal device. Use GIMBAL_MANAGER_SET_PITCHYAW if you need to stream pitch/yaw setpoints at higher rate.
  DO_GIMBAL_MANAGER_CONFIGURE = 1001  % Gimbal configuration to set which sysid/compid is in primary and secondary control.
  IMAGE_START_CAPTURE = 2000  % Start image capture sequence. CAMERA_IMAGE_CAPTURED must be emitted after each capture.
    % Param1 (id) may be used to specify the target camera: 0: all cameras, 1 to 6: autopilot-connected cameras, 7-255: MAVLink camera component ID.
    % It is needed in order to target specific cameras connected to the autopilot, or specific sensors in a multi-sensor camera (neither of which have a distinct MAVLink component ID).
    % It is also needed to specify the target camera in missions.
    % When used in a mission, an autopilot should execute the MAV_CMD for a specified local camera (param1 = 1-6), or resend it as a command if it is intended for a MAVLink camera (param1 = 7 - 255), setting the command's target_component as the param1 value (and setting param1 in the command to zero).
    % If the param1 is 0 the autopilot should do both.
    % When sent in a command the target MAVLink address is set using target_component.
    % If addressed specifically to an autopilot: param1 should be used in the same way as it is for missions (though command should NACK with MAV_RESULT_DENIED if a specified local camera does not exist).
    % If addressed to a MAVLink camera, param 1 can be used to address all cameras (0), or to separately address 1 to 7 individual sensors. Other values should be NACKed with MAV_RESULT_DENIED.
    % If the command is broadcast (target_component is 0) then param 1 should be set to 0 (any other value should be NACKED with MAV_RESULT_DENIED). An autopilot would trigger any local cameras and forward the command to all channels.
  IMAGE_STOP_CAPTURE = 2001  % Stop image capture sequence.
    % Param1 (id) may be used to specify the target camera: 0: all cameras, 1 to 6: autopilot-connected cameras, 7-255: MAVLink camera component ID.
    % It is needed in order to target specific cameras connected to the autopilot, or specific sensors in a multi-sensor camera (neither of which have a distinct MAVLink component ID).
    % It is also needed to specify the target camera in missions.
    % When used in a mission, an autopilot should execute the MAV_CMD for a specified local camera (param1 = 1-6), or resend it as a command if it is intended for a MAVLink camera (param1 = 7 - 255), setting the command's target_component as the param1 value (and setting param1 in the command to zero).
    % If the param1 is 0 the autopilot should do both.
    % When sent in a command the target MAVLink address is set using target_component.
    % If addressed specifically to an autopilot: param1 should be used in the same way as it is for missions (though command should NACK with MAV_RESULT_DENIED if a specified local camera does not exist).
    % If addressed to a MAVLink camera, param1 can be used to address all cameras (0), or to separately address 1 to 7 individual sensors. Other values should be NACKed with MAV_RESULT_DENIED.
    % If the command is broadcast (target_component is 0) then param 1 should be set to 0 (any other value should be NACKED with MAV_RESULT_DENIED). An autopilot would trigger any local cameras and forward the command to all channels.
  REQUEST_CAMERA_IMAGE_CAPTURE = 2002  % Re-request a CAMERA_IMAGE_CAPTURED message.
  DO_TRIGGER_CONTROL = 2003  % Enable or disable on-board camera triggering system.
  CAMERA_TRACK_POINT = 2004  % If the camera supports point visual tracking (CAMERA_CAP_FLAGS_HAS_TRACKING_POINT is set), this command allows to initiate the tracking.
  CAMERA_TRACK_RECTANGLE = 2005  % If the camera supports rectangle visual tracking (CAMERA_CAP_FLAGS_HAS_TRACKING_RECTANGLE is set), this command allows to initiate the tracking.
  CAMERA_STOP_TRACKING = 2010  % Stops ongoing tracking.
  VIDEO_START_CAPTURE = 2500  % Starts video capture (recording).
  VIDEO_STOP_CAPTURE = 2501  % Stop the current video capture (recording).
  VIDEO_START_STREAMING = 2502  % Start video streaming
  VIDEO_STOP_STREAMING = 2503  % Stop the given video stream
  REQUEST_VIDEO_STREAM_INFORMATION = 2504  % Request video stream information (VIDEO_STREAM_INFORMATION)
  REQUEST_VIDEO_STREAM_STATUS = 2505  % Request video stream status (VIDEO_STREAM_STATUS)
  LOGGING_START = 2510  % Request to start streaming logging data over MAVLink (see also LOGGING_DATA message)
  LOGGING_STOP = 2511  % Request to stop streaming log data over MAVLink
  AIRFRAME_CONFIGURATION = 2520
  CONTROL_HIGH_LATENCY = 2600  % Request to start/stop transmitting over the high latency telemetry
  PANORAMA_CREATE = 2800  % Create a panorama at the current position
  DO_VTOL_TRANSITION = 3000  % Request VTOL transition
  ARM_AUTHORIZATION_REQUEST = 3001  % Request authorization to arm the vehicle to a external entity, the arm authorizer is responsible to request all data that is needs from the vehicle before authorize or deny the request.
    % If approved the COMMAND_ACK message progress field should be set with period of time that this authorization is valid in seconds.
    % If the authorization is denied COMMAND_ACK.result_param2 should be set with one of the reasons in ARM_AUTH_DENIED_REASON.
  SET_GUIDED_SUBMODE_STANDARD = 4000  % This command sets the submode to standard guided when vehicle is in guided mode. The vehicle holds position and altitude and the user can input the desired velocities along all three axes.
  SET_GUIDED_SUBMODE_CIRCLE = 4001  % This command sets submode circle when vehicle is in guided mode. Vehicle flies along a circle facing the center of the circle. The user can input the velocity along the circle and change the radius. If no input is given the vehicle will hold position.
  CONDITION_GATE = 4501  % Delay mission state machine until gate has been reached.
  NAV_FENCE_RETURN_POINT = 5000  % Fence return point (there can only be one such point in a geofence definition). If rally points are supported they should be used instead.
  NAV_FENCE_POLYGON_VERTEX_INCLUSION = 5001  % Fence vertex for an inclusion polygon (the polygon must not be self-intersecting). The vehicle must stay within this area. Minimum of 3 vertices required.
  NAV_FENCE_POLYGON_VERTEX_EXCLUSION = 5002  % Fence vertex for an exclusion polygon (the polygon must not be self-intersecting). The vehicle must stay outside this area. Minimum of 3 vertices required.
  NAV_FENCE_CIRCLE_INCLUSION = 5003  % Circular fence area. The vehicle must stay inside this area.
  NAV_FENCE_CIRCLE_EXCLUSION = 5004  % Circular fence area. The vehicle must stay outside this area.
  NAV_RALLY_POINT = 5100  % Rally point. You can have multiple rally points defined.
  UAVCAN_GET_NODE_INFO = 5200  % Commands the vehicle to respond with a sequence of messages UAVCAN_NODE_INFO, one message per every UAVCAN node that is online. Note that some of the response messages can be lost, which the receiver can detect easily by checking whether every received UAVCAN_NODE_STATUS has a matching message UAVCAN_NODE_INFO received earlier; if not, this command should be sent again in order to request re-transmission of the node information messages.
  DO_ADSB_OUT_IDENT = 10001  % Trigger the start of an ADSB-out IDENT. This should only be used when requested to do so by an Air Traffic Controller in controlled airspace. This starts the IDENT which is then typically held for 18 seconds by the hardware per the Mode A, C, and S transponder spec.
  PAYLOAD_PREPARE_DEPLOY = 30001  % Deploy payload on a Lat / Lon / Alt position. This includes the navigation to reach the required release position and velocity.
  PAYLOAD_CONTROL_DEPLOY = 30002  % Control the payload deployment.
  FIXED_MAG_CAL_YAW = 42006  % Magnetometer calibration based on provided known yaw. This allows for fast calibration using WMM field tables in the vehicle, given only the known yaw of the vehicle. If Latitude and longitude are both zero then use the current vehicle location.
  DO_WINCH = 42600  % Command to operate winch.
  EXTERNAL_POSITION_ESTIMATE = 43003  % Provide an external position estimate for use when dead-reckoning. This is meant to be used for occasional position resets that may be provided by a external system such as a remote pilot using landmarks over a video link.
  WAYPOINT_USER_1 = 31000  % User defined waypoint item. Ground Station will show the Vehicle as flying through this item.
  WAYPOINT_USER_2 = 31001  % User defined waypoint item. Ground Station will show the Vehicle as flying through this item.
  WAYPOINT_USER_3 = 31002  % User defined waypoint item. Ground Station will show the Vehicle as flying through this item.
  WAYPOINT_USER_4 = 31003  % User defined waypoint item. Ground Station will show the Vehicle as flying through this item.
  WAYPOINT_USER_5 = 31004  % User defined waypoint item. Ground Station will show the Vehicle as flying through this item.
  SPATIAL_USER_1 = 31005  % User defined spatial item. Ground Station will not show the Vehicle as flying through this item. Example: ROI item.
  SPATIAL_USER_2 = 31006  % User defined spatial item. Ground Station will not show the Vehicle as flying through this item. Example: ROI item.
  SPATIAL_USER_3 = 31007  % User defined spatial item. Ground Station will not show the Vehicle as flying through this item. Example: ROI item.
  SPATIAL_USER_4 = 31008  % User defined spatial item. Ground Station will not show the Vehicle as flying through this item. Example: ROI item.
  SPATIAL_USER_5 = 31009  % User defined spatial item. Ground Station will not show the Vehicle as flying through this item. Example: ROI item.
  USER_1 = 31010  % User defined command. Ground Station will not show the Vehicle as flying through this item. Example: MAV_CMD_DO_SET_PARAMETER item.
  USER_2 = 31011  % User defined command. Ground Station will not show the Vehicle as flying through this item. Example: MAV_CMD_DO_SET_PARAMETER item.
  USER_3 = 31012  % User defined command. Ground Station will not show the Vehicle as flying through this item. Example: MAV_CMD_DO_SET_PARAMETER item.
  USER_4 = 31013  % User defined command. Ground Station will not show the Vehicle as flying through this item. Example: MAV_CMD_DO_SET_PARAMETER item.
  USER_5 = 31014  % User defined command. Ground Station will not show the Vehicle as flying through this item. Example: MAV_CMD_DO_SET_PARAMETER item.
  CAN_FORWARD = 32000  % Request forwarding of CAN packets from the given CAN bus to this component. CAN Frames are sent using CAN_FRAME and CANFD_FRAME messages

MAV_DATA_STREAM_ALL = Simulink.Parameter(0, StorageClass="Const")  % Enable all data streams
MAV_DATA_STREAM_RAW_SENSORS = Simulink.Parameter(1, StorageClass="Const")  % Enable IMU_RAW, GPS_RAW, GPS_STATUS packets.
MAV_DATA_STREAM_EXTENDED_STATUS = Simulink.Parameter(2, StorageClass="Const")  % Enable GPS_STATUS, CONTROL_STATUS, AUX_STATUS
MAV_DATA_STREAM_RC_CHANNELS = Simulink.Parameter(3, StorageClass="Const")  % Enable RC_CHANNELS_SCALED, RC_CHANNELS_RAW, SERVO_OUTPUT_RAW
MAV_DATA_STREAM_RAW_CONTROLLER = Simulink.Parameter(4, StorageClass="Const")  % Enable ATTITUDE_CONTROLLER_OUTPUT, POSITION_CONTROLLER_OUTPUT, NAV_CONTROLLER_OUTPUT.
MAV_DATA_STREAM_POSITION = Simulink.Parameter(6, StorageClass="Const")  % Enable LOCAL_POSITION, GLOBAL_POSITION_INT messages.
MAV_DATA_STREAM_EXTRA1 = Simulink.Parameter(10, StorageClass="Const")  % Dependent on the autopilot
MAV_DATA_STREAM_EXTRA2 = Simulink.Parameter(11, StorageClass="Const")  % Dependent on the autopilot
MAV_DATA_STREAM_EXTRA3 = Simulink.Parameter(12, StorageClass="Const")  % Dependent on the autopilot

MAV_DATA_STREAM = enum(AddClassNameToEnumNames=true)  % A data stream is not a fixed set of messages, but rather a
  % recommendation to the autopilot software. Individual autopilots may or may not obey
  % the recommended messages.
  ALL = 0  % Enable all data streams
  RAW_SENSORS = 1  % Enable IMU_RAW, GPS_RAW, GPS_STATUS packets.
  EXTENDED_STATUS = 2  % Enable GPS_STATUS, CONTROL_STATUS, AUX_STATUS
  RC_CHANNELS = 3  % Enable RC_CHANNELS_SCALED, RC_CHANNELS_RAW, SERVO_OUTPUT_RAW
  RAW_CONTROLLER = 4  % Enable ATTITUDE_CONTROLLER_OUTPUT, POSITION_CONTROLLER_OUTPUT, NAV_CONTROLLER_OUTPUT.
  POSITION = 6  % Enable LOCAL_POSITION, GLOBAL_POSITION_INT messages.
  EXTRA1 = 10  % Dependent on the autopilot
  EXTRA2 = 11  % Dependent on the autopilot
  EXTRA3 = 12  % Dependent on the autopilot

MAV_ROI_NONE = Simulink.Parameter(0, StorageClass="Const")  % No region of interest.
MAV_ROI_WPNEXT = Simulink.Parameter(1, StorageClass="Const")  % Point toward next waypoint, with optional pitch/roll/yaw offset.
MAV_ROI_WPINDEX = Simulink.Parameter(2, StorageClass="Const")  % Point toward given waypoint.
MAV_ROI_LOCATION = Simulink.Parameter(3, StorageClass="Const")  % Point toward fixed location.
MAV_ROI_TARGET = Simulink.Parameter(4, StorageClass="Const")  % Point toward of given id.

MAV_ROI = enum(AddClassNameToEnumNames=true)  % The ROI (region of interest) for the vehicle. This can be
  % be used by the vehicle for camera/vehicle attitude alignment (see
  % MAV_CMD_NAV_ROI).
  NONE = 0  % No region of interest.
  WPNEXT = 1  % Point toward next waypoint, with optional pitch/roll/yaw offset.
  WPINDEX = 2  % Point toward given waypoint.
  LOCATION = 3  % Point toward fixed location.
  TARGET = 4  % Point toward of given id.

MAV_PARAM_TYPE_UINT8 = Simulink.Parameter(1, StorageClass="Const")  % 8-bit unsigned integer
MAV_PARAM_TYPE_INT8 = Simulink.Parameter(2, StorageClass="Const")  % 8-bit signed integer
MAV_PARAM_TYPE_UINT16 = Simulink.Parameter(3, StorageClass="Const")  % 16-bit unsigned integer
MAV_PARAM_TYPE_INT16 = Simulink.Parameter(4, StorageClass="Const")  % 16-bit signed integer
MAV_PARAM_TYPE_UINT32 = Simulink.Parameter(5, StorageClass="Const")  % 32-bit unsigned integer
MAV_PARAM_TYPE_INT32 = Simulink.Parameter(6, StorageClass="Const")  % 32-bit signed integer
MAV_PARAM_TYPE_UINT64 = Simulink.Parameter(7, StorageClass="Const")  % 64-bit unsigned integer
MAV_PARAM_TYPE_INT64 = Simulink.Parameter(8, StorageClass="Const")  % 64-bit signed integer
MAV_PARAM_TYPE_REAL32 = Simulink.Parameter(9, StorageClass="Const")  % 32-bit floating-point
MAV_PARAM_TYPE_REAL64 = Simulink.Parameter(10, StorageClass="Const")  % 64-bit floating-point

MAV_PARAM_TYPE = enum(AddClassNameToEnumNames=true)  % Specifies the datatype of a MAVLink parameter.
  UINT8 = 1  % 8-bit unsigned integer
  INT8 = 2  % 8-bit signed integer
  UINT16 = 3  % 16-bit unsigned integer
  INT16 = 4  % 16-bit signed integer
  UINT32 = 5  % 32-bit unsigned integer
  INT32 = 6  % 32-bit signed integer
  UINT64 = 7  % 64-bit unsigned integer
  INT64 = 8  % 64-bit signed integer
  REAL32 = 9  % 32-bit floating-point
  REAL64 = 10  % 64-bit floating-point

MAV_PARAM_EXT_TYPE_UINT8 = Simulink.Parameter(1, StorageClass="Const")  % 8-bit unsigned integer
MAV_PARAM_EXT_TYPE_INT8 = Simulink.Parameter(2, StorageClass="Const")  % 8-bit signed integer
MAV_PARAM_EXT_TYPE_UINT16 = Simulink.Parameter(3, StorageClass="Const")  % 16-bit unsigned integer
MAV_PARAM_EXT_TYPE_INT16 = Simulink.Parameter(4, StorageClass="Const")  % 16-bit signed integer
MAV_PARAM_EXT_TYPE_UINT32 = Simulink.Parameter(5, StorageClass="Const")  % 32-bit unsigned integer
MAV_PARAM_EXT_TYPE_INT32 = Simulink.Parameter(6, StorageClass="Const")  % 32-bit signed integer
MAV_PARAM_EXT_TYPE_UINT64 = Simulink.Parameter(7, StorageClass="Const")  % 64-bit unsigned integer
MAV_PARAM_EXT_TYPE_INT64 = Simulink.Parameter(8, StorageClass="Const")  % 64-bit signed integer
MAV_PARAM_EXT_TYPE_REAL32 = Simulink.Parameter(9, StorageClass="Const")  % 32-bit floating-point
MAV_PARAM_EXT_TYPE_REAL64 = Simulink.Parameter(10, StorageClass="Const")  % 64-bit floating-point
MAV_PARAM_EXT_TYPE_CUSTOM = Simulink.Parameter(11, StorageClass="Const")  % Custom Type

MAV_PARAM_EXT_TYPE = enum(AddClassNameToEnumNames=true)  % Specifies the datatype of a MAVLink extended parameter.
  UINT8 = 1  % 8-bit unsigned integer
  INT8 = 2  % 8-bit signed integer
  UINT16 = 3  % 16-bit unsigned integer
  INT16 = 4  % 16-bit signed integer
  UINT32 = 5  % 32-bit unsigned integer
  INT32 = 6  % 32-bit signed integer
  UINT64 = 7  % 64-bit unsigned integer
  INT64 = 8  % 64-bit signed integer
  REAL32 = 9  % 32-bit floating-point
  REAL64 = 10  % 64-bit floating-point
  CUSTOM = 11  % Custom Type

MAV_RESULT_ACCEPTED = Simulink.Parameter(0, StorageClass="Const")  % Command is valid (is supported and has valid parameters), and was executed.
MAV_RESULT_TEMPORARILY_REJECTED = Simulink.Parameter(1, StorageClass="Const")  % Command is valid, but cannot be executed at this time. This is used to indicate a problem that should be fixed just by waiting (e.g. a state machine is busy, can't arm because have not got GPS lock, etc.). Retrying later should work.
MAV_RESULT_DENIED = Simulink.Parameter(2, StorageClass="Const")  % Command is invalid (is supported but has invalid parameters). Retrying same command and parameters will not work.
MAV_RESULT_UNSUPPORTED = Simulink.Parameter(3, StorageClass="Const")  % Command is not supported (unknown).
MAV_RESULT_FAILED = Simulink.Parameter(4, StorageClass="Const")  % Command is valid, but execution has failed. This is used to indicate any non-temporary or unexpected problem, i.e. any problem that must be fixed before the command can succeed/be retried. For example, attempting to write a file when out of memory, attempting to arm when sensors are not calibrated, etc.
MAV_RESULT_IN_PROGRESS = Simulink.Parameter(5, StorageClass="Const")  % Command is valid and is being executed. This will be followed by further progress updates, i.e. the component may send further COMMAND_ACK messages with result MAV_RESULT_IN_PROGRESS (at a rate decided by the implementation), and must terminate by sending a COMMAND_ACK message with final result of the operation. The COMMAND_ACK.progress field can be used to indicate the progress of the operation.
MAV_RESULT_CANCELLED = Simulink.Parameter(6, StorageClass="Const")  % Command has been cancelled (as a result of receiving a COMMAND_CANCEL message).
MAV_RESULT_COMMAND_LONG_ONLY = Simulink.Parameter(7, StorageClass="Const")  % Command is only accepted when sent as a COMMAND_LONG.
MAV_RESULT_COMMAND_INT_ONLY = Simulink.Parameter(8, StorageClass="Const")  % Command is only accepted when sent as a COMMAND_INT.
MAV_RESULT_COMMAND_UNSUPPORTED_MAV_FRAME = Simulink.Parameter(9, StorageClass="Const")  % Command is invalid because a frame is required and the specified frame is not supported.

MAV_RESULT = enum(AddClassNameToEnumNames=true)  % Result from a MAVLink command (MAV_CMD)
  ACCEPTED = 0  % Command is valid (is supported and has valid parameters), and was executed.
  TEMPORARILY_REJECTED = 1  % Command is valid, but cannot be executed at this time. This is used to indicate a problem that should be fixed just by waiting (e.g. a state machine is busy, can't arm because have not got GPS lock, etc.). Retrying later should work.
  DENIED = 2  % Command is invalid (is supported but has invalid parameters). Retrying same command and parameters will not work.
  UNSUPPORTED = 3  % Command is not supported (unknown).
  FAILED = 4  % Command is valid, but execution has failed. This is used to indicate any non-temporary or unexpected problem, i.e. any problem that must be fixed before the command can succeed/be retried. For example, attempting to write a file when out of memory, attempting to arm when sensors are not calibrated, etc.
  IN_PROGRESS = 5  % Command is valid and is being executed. This will be followed by further progress updates, i.e. the component may send further COMMAND_ACK messages with result MAV_RESULT_IN_PROGRESS (at a rate decided by the implementation), and must terminate by sending a COMMAND_ACK message with final result of the operation. The COMMAND_ACK.progress field can be used to indicate the progress of the operation.
  CANCELLED = 6  % Command has been cancelled (as a result of receiving a COMMAND_CANCEL message).
  COMMAND_LONG_ONLY = 7  % Command is only accepted when sent as a COMMAND_LONG.
  COMMAND_INT_ONLY = 8  % Command is only accepted when sent as a COMMAND_INT.
  COMMAND_UNSUPPORTED_MAV_FRAME = 9  % Command is invalid because a frame is required and the specified frame is not supported.

MAV_MISSION_ACCEPTED = Simulink.Parameter(0, StorageClass="Const")  % mission accepted OK
MAV_MISSION_ERROR = Simulink.Parameter(1, StorageClass="Const")  % Generic error / not accepting mission commands at all right now.
MAV_MISSION_UNSUPPORTED_FRAME = Simulink.Parameter(2, StorageClass="Const")  % Coordinate frame is not supported.
MAV_MISSION_UNSUPPORTED = Simulink.Parameter(3, StorageClass="Const")  % Command is not supported.
MAV_MISSION_NO_SPACE = Simulink.Parameter(4, StorageClass="Const")  % Mission items exceed storage space.
MAV_MISSION_INVALID = Simulink.Parameter(5, StorageClass="Const")  % One of the parameters has an invalid value.
MAV_MISSION_INVALID_PARAM1 = Simulink.Parameter(6, StorageClass="Const")  % param1 has an invalid value.
MAV_MISSION_INVALID_PARAM2 = Simulink.Parameter(7, StorageClass="Const")  % param2 has an invalid value.
MAV_MISSION_INVALID_PARAM3 = Simulink.Parameter(8, StorageClass="Const")  % param3 has an invalid value.
MAV_MISSION_INVALID_PARAM4 = Simulink.Parameter(9, StorageClass="Const")  % param4 has an invalid value.
MAV_MISSION_INVALID_PARAM5_X = Simulink.Parameter(10, StorageClass="Const")  % x / param5 has an invalid value.
MAV_MISSION_INVALID_PARAM6_Y = Simulink.Parameter(11, StorageClass="Const")  % y / param6 has an invalid value.
MAV_MISSION_INVALID_PARAM7 = Simulink.Parameter(12, StorageClass="Const")  % z / param7 has an invalid value.
MAV_MISSION_INVALID_SEQUENCE = Simulink.Parameter(13, StorageClass="Const")  % Mission item received out of sequence
MAV_MISSION_DENIED = Simulink.Parameter(14, StorageClass="Const")  % Not accepting any mission commands from this communication partner.
MAV_MISSION_OPERATION_CANCELLED = Simulink.Parameter(15, StorageClass="Const")  % Current mission operation cancelled (e.g. mission upload, mission download).

MAV_MISSION_RESULT = enum(AddClassNameToEnumNames=true)  % Result of mission operation (in a MISSION_ACK message).
  MAV_MISSION_ACCEPTED = 0  % mission accepted OK
  MAV_MISSION_ERROR = 1  % Generic error / not accepting mission commands at all right now.
  MAV_MISSION_UNSUPPORTED_FRAME = 2  % Coordinate frame is not supported.
  MAV_MISSION_UNSUPPORTED = 3  % Command is not supported.
  MAV_MISSION_NO_SPACE = 4  % Mission items exceed storage space.
  MAV_MISSION_INVALID = 5  % One of the parameters has an invalid value.
  MAV_MISSION_INVALID_PARAM1 = 6  % param1 has an invalid value.
  MAV_MISSION_INVALID_PARAM2 = 7  % param2 has an invalid value.
  MAV_MISSION_INVALID_PARAM3 = 8  % param3 has an invalid value.
  MAV_MISSION_INVALID_PARAM4 = 9  % param4 has an invalid value.
  MAV_MISSION_INVALID_PARAM5_X = 10  % x / param5 has an invalid value.
  MAV_MISSION_INVALID_PARAM6_Y = 11  % y / param6 has an invalid value.
  MAV_MISSION_INVALID_PARAM7 = 12  % z / param7 has an invalid value.
  MAV_MISSION_INVALID_SEQUENCE = 13  % Mission item received out of sequence
  MAV_MISSION_DENIED = 14  % Not accepting any mission commands from this communication partner.
  MAV_MISSION_OPERATION_CANCELLED = 15  % Current mission operation cancelled (e.g. mission upload, mission download).

MAV_SEVERITY_EMERGENCY = Simulink.Parameter(0, StorageClass="Const")  % System is unusable. This is a "panic" condition.
MAV_SEVERITY_ALERT = Simulink.Parameter(1, StorageClass="Const")  % Action should be taken immediately. Indicates error in non-critical systems.
MAV_SEVERITY_CRITICAL = Simulink.Parameter(2, StorageClass="Const")  % Action must be taken immediately. Indicates failure in a primary system.
MAV_SEVERITY_ERROR = Simulink.Parameter(3, StorageClass="Const")  % Indicates an error in secondary/redundant systems.
MAV_SEVERITY_WARNING = Simulink.Parameter(4, StorageClass="Const")  % Indicates about a possible future error if this is not resolved within a given timeframe. Example would be a low battery warning.
MAV_SEVERITY_NOTICE = Simulink.Parameter(5, StorageClass="Const")  % An unusual event has occurred, though not an error condition. This should be investigated for the root cause.
MAV_SEVERITY_INFO = Simulink.Parameter(6, StorageClass="Const")  % Normal operational messages. Useful for logging. No action is required for these messages.
MAV_SEVERITY_DEBUG = Simulink.Parameter(7, StorageClass="Const")  % Useful non-operational messages that can assist in debugging. These should not occur during normal operation.

MAV_SEVERITY = enum(AddClassNameToEnumNames=true)  % Indicates the severity level, generally used for status messages to indicate their relative urgency. Based on RFC-5424 using expanded definitions at: http://www.kiwisyslog.com/kb/info:-syslog-message-levels/.
  EMERGENCY = 0  % System is unusable. This is a "panic" condition.
  ALERT = 1  % Action should be taken immediately. Indicates error in non-critical systems.
  CRITICAL = 2  % Action must be taken immediately. Indicates failure in a primary system.
  ERROR = 3  % Indicates an error in secondary/redundant systems.
  WARNING = 4  % Indicates about a possible future error if this is not resolved within a given timeframe. Example would be a low battery warning.
  NOTICE = 5  % An unusual event has occurred, though not an error condition. This should be investigated for the root cause.
  INFO = 6  % Normal operational messages. Useful for logging. No action is required for these messages.
  DEBUG = 7  % Useful non-operational messages that can assist in debugging. These should not occur during normal operation.

MAV_POWER_STATUS_BRICK_VALID = Simulink.Parameter(1, StorageClass="Const")  % main brick power supply valid
MAV_POWER_STATUS_SERVO_VALID = Simulink.Parameter(2, StorageClass="Const")  % main servo power supply valid for FMU
MAV_POWER_STATUS_USB_CONNECTED = Simulink.Parameter(4, StorageClass="Const")  % USB power is connected
MAV_POWER_STATUS_PERIPH_OVERCURRENT = Simulink.Parameter(8, StorageClass="Const")  % peripheral supply is in over-current state
MAV_POWER_STATUS_PERIPH_HIPOWER_OVERCURRENT = Simulink.Parameter(16, StorageClass="Const")  % hi-power peripheral supply is in over-current state
MAV_POWER_STATUS_CHANGED = Simulink.Parameter(32, StorageClass="Const")  % Power status has changed since boot

MAV_POWER_STATUS = enum(AddClassNameToEnumNames=true)  % Power supply status flags (bitmask)
  BRICK_VALID = 1  % main brick power supply valid
  SERVO_VALID = 2  % main servo power supply valid for FMU
  USB_CONNECTED = 4  % USB power is connected
  PERIPH_OVERCURRENT = 8  % peripheral supply is in over-current state
  PERIPH_HIPOWER_OVERCURRENT = 16  % hi-power peripheral supply is in over-current state
  CHANGED = 32  % Power status has changed since boot

MAV_SERIAL_CONTROL_DEV_TELEM1 = Simulink.Parameter(0, StorageClass="Const")  % First telemetry port
MAV_SERIAL_CONTROL_DEV_TELEM2 = Simulink.Parameter(1, StorageClass="Const")  % Second telemetry port
MAV_SERIAL_CONTROL_DEV_GPS1 = Simulink.Parameter(2, StorageClass="Const")  % First GPS port
MAV_SERIAL_CONTROL_DEV_GPS2 = Simulink.Parameter(3, StorageClass="Const")  % Second GPS port
MAV_SERIAL_CONTROL_DEV_SHELL = Simulink.Parameter(10, StorageClass="Const")  % system shell
MAV_SERIAL_CONTROL_SERIAL0 = Simulink.Parameter(100, StorageClass="Const")  % SERIAL0
MAV_SERIAL_CONTROL_SERIAL1 = Simulink.Parameter(101, StorageClass="Const")  % SERIAL1
MAV_SERIAL_CONTROL_SERIAL2 = Simulink.Parameter(102, StorageClass="Const")  % SERIAL2
MAV_SERIAL_CONTROL_SERIAL3 = Simulink.Parameter(103, StorageClass="Const")  % SERIAL3
MAV_SERIAL_CONTROL_SERIAL4 = Simulink.Parameter(104, StorageClass="Const")  % SERIAL4
MAV_SERIAL_CONTROL_SERIAL5 = Simulink.Parameter(105, StorageClass="Const")  % SERIAL5
MAV_SERIAL_CONTROL_SERIAL6 = Simulink.Parameter(106, StorageClass="Const")  % SERIAL6
MAV_SERIAL_CONTROL_SERIAL7 = Simulink.Parameter(107, StorageClass="Const")  % SERIAL7
MAV_SERIAL_CONTROL_SERIAL8 = Simulink.Parameter(108, StorageClass="Const")  % SERIAL8
MAV_SERIAL_CONTROL_SERIAL9 = Simulink.Parameter(109, StorageClass="Const")  % SERIAL9

MAV_SERIAL_CONTROL_DEV = enum(AddClassNameToEnumNames=true)  % SERIAL_CONTROL device types
  TELEM1 = 0  % First telemetry port
  TELEM2 = 1  % Second telemetry port
  GPS1 = 2  % First GPS port
  GPS2 = 3  % Second GPS port
  SHELL = 10  % system shell
  SERIAL_CONTROL_SERIAL0 = 100  % SERIAL0
  SERIAL_CONTROL_SERIAL1 = 101  % SERIAL1
  SERIAL_CONTROL_SERIAL2 = 102  % SERIAL2
  SERIAL_CONTROL_SERIAL3 = 103  % SERIAL3
  SERIAL_CONTROL_SERIAL4 = 104  % SERIAL4
  SERIAL_CONTROL_SERIAL5 = 105  % SERIAL5
  SERIAL_CONTROL_SERIAL6 = 106  % SERIAL6
  SERIAL_CONTROL_SERIAL7 = 107  % SERIAL7
  SERIAL_CONTROL_SERIAL8 = 108  % SERIAL8
  SERIAL_CONTROL_SERIAL9 = 109  % SERIAL9

MAV_SERIAL_CONTROL_FLAG_REPLY = Simulink.Parameter(1, StorageClass="Const")  % Set if this is a reply
MAV_SERIAL_CONTROL_FLAG_RESPOND = Simulink.Parameter(2, StorageClass="Const")  % Set if the sender wants the receiver to send a response as another SERIAL_CONTROL message
MAV_SERIAL_CONTROL_FLAG_EXCLUSIVE = Simulink.Parameter(4, StorageClass="Const")  % Set if access to the serial port should be removed from whatever driver is currently using it, giving exclusive access to the SERIAL_CONTROL protocol. The port can be handed back by sending a request without this flag set
MAV_SERIAL_CONTROL_FLAG_BLOCKING = Simulink.Parameter(8, StorageClass="Const")  % Block on writes to the serial port
MAV_SERIAL_CONTROL_FLAG_MULTI = Simulink.Parameter(16, StorageClass="Const")  % Send multiple replies until port is drained

MAV_SERIAL_CONTROL_FLAG = enum(AddClassNameToEnumNames=true)  % SERIAL_CONTROL flags (bitmask)
  REPLY = 1  % Set if this is a reply
  RESPOND = 2  % Set if the sender wants the receiver to send a response as another SERIAL_CONTROL message
  EXCLUSIVE = 4  % Set if access to the serial port should be removed from whatever driver is currently using it, giving exclusive access to the SERIAL_CONTROL protocol. The port can be handed back by sending a request without this flag set
  BLOCKING = 8  % Block on writes to the serial port
  MULTI = 16  % Send multiple replies until port is drained

MAV_DISTANCE_SENSOR_LASER = Simulink.Parameter(0, StorageClass="Const")  % Laser rangefinder, e.g. LightWare SF02/F or PulsedLight units
MAV_DISTANCE_SENSOR_ULTRASOUND = Simulink.Parameter(1, StorageClass="Const")  % Ultrasound rangefinder, e.g. MaxBotix units
MAV_DISTANCE_SENSOR_INFRARED = Simulink.Parameter(2, StorageClass="Const")  % Infrared rangefinder, e.g. Sharp units
MAV_DISTANCE_SENSOR_RADAR = Simulink.Parameter(3, StorageClass="Const")  % Radar type, e.g. uLanding units
MAV_DISTANCE_SENSOR_UNKNOWN = Simulink.Parameter(4, StorageClass="Const")  % Broken or unknown type, e.g. analog units

MAV_DISTANCE_SENSOR = enum(AddClassNameToEnumNames=true)  % Enumeration of distance sensor types
  LASER = 0  % Laser rangefinder, e.g. LightWare SF02/F or PulsedLight units
  ULTRASOUND = 1  % Ultrasound rangefinder, e.g. MaxBotix units
  INFRARED = 2  % Infrared rangefinder, e.g. Sharp units
  RADAR = 3  % Radar type, e.g. uLanding units
  UNKNOWN = 4  % Broken or unknown type, e.g. analog units

MAV_SENSOR_ROTATION_NONE = Simulink.Parameter(0, StorageClass="Const")  % Roll: 0, Pitch: 0, Yaw: 0
MAV_SENSOR_ROTATION_YAW_45 = Simulink.Parameter(1, StorageClass="Const")  % Roll: 0, Pitch: 0, Yaw: 45
MAV_SENSOR_ROTATION_YAW_90 = Simulink.Parameter(2, StorageClass="Const")  % Roll: 0, Pitch: 0, Yaw: 90
MAV_SENSOR_ROTATION_YAW_135 = Simulink.Parameter(3, StorageClass="Const")  % Roll: 0, Pitch: 0, Yaw: 135
MAV_SENSOR_ROTATION_YAW_180 = Simulink.Parameter(4, StorageClass="Const")  % Roll: 0, Pitch: 0, Yaw: 180
MAV_SENSOR_ROTATION_YAW_225 = Simulink.Parameter(5, StorageClass="Const")  % Roll: 0, Pitch: 0, Yaw: 225
MAV_SENSOR_ROTATION_YAW_270 = Simulink.Parameter(6, StorageClass="Const")  % Roll: 0, Pitch: 0, Yaw: 270
MAV_SENSOR_ROTATION_YAW_315 = Simulink.Parameter(7, StorageClass="Const")  % Roll: 0, Pitch: 0, Yaw: 315
MAV_SENSOR_ROTATION_ROLL_180 = Simulink.Parameter(8, StorageClass="Const")  % Roll: 180, Pitch: 0, Yaw: 0
MAV_SENSOR_ROTATION_ROLL_180_YAW_45 = Simulink.Parameter(9, StorageClass="Const")  % Roll: 180, Pitch: 0, Yaw: 45
MAV_SENSOR_ROTATION_ROLL_180_YAW_90 = Simulink.Parameter(10, StorageClass="Const")  % Roll: 180, Pitch: 0, Yaw: 90
MAV_SENSOR_ROTATION_ROLL_180_YAW_135 = Simulink.Parameter(11, StorageClass="Const")  % Roll: 180, Pitch: 0, Yaw: 135
MAV_SENSOR_ROTATION_PITCH_180 = Simulink.Parameter(12, StorageClass="Const")  % Roll: 0, Pitch: 180, Yaw: 0
MAV_SENSOR_ROTATION_ROLL_180_YAW_225 = Simulink.Parameter(13, StorageClass="Const")  % Roll: 180, Pitch: 0, Yaw: 225
MAV_SENSOR_ROTATION_ROLL_180_YAW_270 = Simulink.Parameter(14, StorageClass="Const")  % Roll: 180, Pitch: 0, Yaw: 270
MAV_SENSOR_ROTATION_ROLL_180_YAW_315 = Simulink.Parameter(15, StorageClass="Const")  % Roll: 180, Pitch: 0, Yaw: 315
MAV_SENSOR_ROTATION_ROLL_90 = Simulink.Parameter(16, StorageClass="Const")  % Roll: 90, Pitch: 0, Yaw: 0
MAV_SENSOR_ROTATION_ROLL_90_YAW_45 = Simulink.Parameter(17, StorageClass="Const")  % Roll: 90, Pitch: 0, Yaw: 45
MAV_SENSOR_ROTATION_ROLL_90_YAW_90 = Simulink.Parameter(18, StorageClass="Const")  % Roll: 90, Pitch: 0, Yaw: 90
MAV_SENSOR_ROTATION_ROLL_90_YAW_135 = Simulink.Parameter(19, StorageClass="Const")  % Roll: 90, Pitch: 0, Yaw: 135
MAV_SENSOR_ROTATION_ROLL_270 = Simulink.Parameter(20, StorageClass="Const")  % Roll: 270, Pitch: 0, Yaw: 0
MAV_SENSOR_ROTATION_ROLL_270_YAW_45 = Simulink.Parameter(21, StorageClass="Const")  % Roll: 270, Pitch: 0, Yaw: 45
MAV_SENSOR_ROTATION_ROLL_270_YAW_90 = Simulink.Parameter(22, StorageClass="Const")  % Roll: 270, Pitch: 0, Yaw: 90
MAV_SENSOR_ROTATION_ROLL_270_YAW_135 = Simulink.Parameter(23, StorageClass="Const")  % Roll: 270, Pitch: 0, Yaw: 135
MAV_SENSOR_ROTATION_PITCH_90 = Simulink.Parameter(24, StorageClass="Const")  % Roll: 0, Pitch: 90, Yaw: 0
MAV_SENSOR_ROTATION_PITCH_270 = Simulink.Parameter(25, StorageClass="Const")  % Roll: 0, Pitch: 270, Yaw: 0
MAV_SENSOR_ROTATION_PITCH_180_YAW_90 = Simulink.Parameter(26, StorageClass="Const")  % Roll: 0, Pitch: 180, Yaw: 90
MAV_SENSOR_ROTATION_PITCH_180_YAW_270 = Simulink.Parameter(27, StorageClass="Const")  % Roll: 0, Pitch: 180, Yaw: 270
MAV_SENSOR_ROTATION_ROLL_90_PITCH_90 = Simulink.Parameter(28, StorageClass="Const")  % Roll: 90, Pitch: 90, Yaw: 0
MAV_SENSOR_ROTATION_ROLL_180_PITCH_90 = Simulink.Parameter(29, StorageClass="Const")  % Roll: 180, Pitch: 90, Yaw: 0
MAV_SENSOR_ROTATION_ROLL_270_PITCH_90 = Simulink.Parameter(30, StorageClass="Const")  % Roll: 270, Pitch: 90, Yaw: 0
MAV_SENSOR_ROTATION_ROLL_90_PITCH_180 = Simulink.Parameter(31, StorageClass="Const")  % Roll: 90, Pitch: 180, Yaw: 0
MAV_SENSOR_ROTATION_ROLL_270_PITCH_180 = Simulink.Parameter(32, StorageClass="Const")  % Roll: 270, Pitch: 180, Yaw: 0
MAV_SENSOR_ROTATION_ROLL_90_PITCH_270 = Simulink.Parameter(33, StorageClass="Const")  % Roll: 90, Pitch: 270, Yaw: 0
MAV_SENSOR_ROTATION_ROLL_180_PITCH_270 = Simulink.Parameter(34, StorageClass="Const")  % Roll: 180, Pitch: 270, Yaw: 0
MAV_SENSOR_ROTATION_ROLL_270_PITCH_270 = Simulink.Parameter(35, StorageClass="Const")  % Roll: 270, Pitch: 270, Yaw: 0
MAV_SENSOR_ROTATION_ROLL_90_PITCH_180_YAW_90 = Simulink.Parameter(36, StorageClass="Const")  % Roll: 90, Pitch: 180, Yaw: 90
MAV_SENSOR_ROTATION_ROLL_90_YAW_270 = Simulink.Parameter(37, StorageClass="Const")  % Roll: 90, Pitch: 0, Yaw: 270
MAV_SENSOR_ROTATION_ROLL_90_PITCH_68_YAW_293 = Simulink.Parameter(38, StorageClass="Const")  % Roll: 90, Pitch: 68, Yaw: 293
MAV_SENSOR_ROTATION_PITCH_315 = Simulink.Parameter(39, StorageClass="Const")  % Pitch: 315
MAV_SENSOR_ROTATION_ROLL_90_PITCH_315 = Simulink.Parameter(40, StorageClass="Const")  % Roll: 90, Pitch: 315
MAV_SENSOR_ROTATION_CUSTOM = Simulink.Parameter(100, StorageClass="Const")  % Custom orientation

MAV_SENSOR_ORIENTATION = enum(AddClassNameToEnumNames=true)  % Enumeration of sensor orientation, according to its rotations
  MAV_SENSOR_ROTATION_NONE = 0  % Roll: 0, Pitch: 0, Yaw: 0
  MAV_SENSOR_ROTATION_YAW_45 = 1  % Roll: 0, Pitch: 0, Yaw: 45
  MAV_SENSOR_ROTATION_YAW_90 = 2  % Roll: 0, Pitch: 0, Yaw: 90
  MAV_SENSOR_ROTATION_YAW_135 = 3  % Roll: 0, Pitch: 0, Yaw: 135
  MAV_SENSOR_ROTATION_YAW_180 = 4  % Roll: 0, Pitch: 0, Yaw: 180
  MAV_SENSOR_ROTATION_YAW_225 = 5  % Roll: 0, Pitch: 0, Yaw: 225
  MAV_SENSOR_ROTATION_YAW_270 = 6  % Roll: 0, Pitch: 0, Yaw: 270
  MAV_SENSOR_ROTATION_YAW_315 = 7  % Roll: 0, Pitch: 0, Yaw: 315
  MAV_SENSOR_ROTATION_ROLL_180 = 8  % Roll: 180, Pitch: 0, Yaw: 0
  MAV_SENSOR_ROTATION_ROLL_180_YAW_45 = 9  % Roll: 180, Pitch: 0, Yaw: 45
  MAV_SENSOR_ROTATION_ROLL_180_YAW_90 = 10  % Roll: 180, Pitch: 0, Yaw: 90
  MAV_SENSOR_ROTATION_ROLL_180_YAW_135 = 11  % Roll: 180, Pitch: 0, Yaw: 135
  MAV_SENSOR_ROTATION_PITCH_180 = 12  % Roll: 0, Pitch: 180, Yaw: 0
  MAV_SENSOR_ROTATION_ROLL_180_YAW_225 = 13  % Roll: 180, Pitch: 0, Yaw: 225
  MAV_SENSOR_ROTATION_ROLL_180_YAW_270 = 14  % Roll: 180, Pitch: 0, Yaw: 270
  MAV_SENSOR_ROTATION_ROLL_180_YAW_315 = 15  % Roll: 180, Pitch: 0, Yaw: 315
  MAV_SENSOR_ROTATION_ROLL_90 = 16  % Roll: 90, Pitch: 0, Yaw: 0
  MAV_SENSOR_ROTATION_ROLL_90_YAW_45 = 17  % Roll: 90, Pitch: 0, Yaw: 45
  MAV_SENSOR_ROTATION_ROLL_90_YAW_90 = 18  % Roll: 90, Pitch: 0, Yaw: 90
  MAV_SENSOR_ROTATION_ROLL_90_YAW_135 = 19  % Roll: 90, Pitch: 0, Yaw: 135
  MAV_SENSOR_ROTATION_ROLL_270 = 20  % Roll: 270, Pitch: 0, Yaw: 0
  MAV_SENSOR_ROTATION_ROLL_270_YAW_45 = 21  % Roll: 270, Pitch: 0, Yaw: 45
  MAV_SENSOR_ROTATION_ROLL_270_YAW_90 = 22  % Roll: 270, Pitch: 0, Yaw: 90
  MAV_SENSOR_ROTATION_ROLL_270_YAW_135 = 23  % Roll: 270, Pitch: 0, Yaw: 135
  MAV_SENSOR_ROTATION_PITCH_90 = 24  % Roll: 0, Pitch: 90, Yaw: 0
  MAV_SENSOR_ROTATION_PITCH_270 = 25  % Roll: 0, Pitch: 270, Yaw: 0
  MAV_SENSOR_ROTATION_PITCH_180_YAW_90 = 26  % Roll: 0, Pitch: 180, Yaw: 90
  MAV_SENSOR_ROTATION_PITCH_180_YAW_270 = 27  % Roll: 0, Pitch: 180, Yaw: 270
  MAV_SENSOR_ROTATION_ROLL_90_PITCH_90 = 28  % Roll: 90, Pitch: 90, Yaw: 0
  MAV_SENSOR_ROTATION_ROLL_180_PITCH_90 = 29  % Roll: 180, Pitch: 90, Yaw: 0
  MAV_SENSOR_ROTATION_ROLL_270_PITCH_90 = 30  % Roll: 270, Pitch: 90, Yaw: 0
  MAV_SENSOR_ROTATION_ROLL_90_PITCH_180 = 31  % Roll: 90, Pitch: 180, Yaw: 0
  MAV_SENSOR_ROTATION_ROLL_270_PITCH_180 = 32  % Roll: 270, Pitch: 180, Yaw: 0
  MAV_SENSOR_ROTATION_ROLL_90_PITCH_270 = 33  % Roll: 90, Pitch: 270, Yaw: 0
  MAV_SENSOR_ROTATION_ROLL_180_PITCH_270 = 34  % Roll: 180, Pitch: 270, Yaw: 0
  MAV_SENSOR_ROTATION_ROLL_270_PITCH_270 = 35  % Roll: 270, Pitch: 270, Yaw: 0
  MAV_SENSOR_ROTATION_ROLL_90_PITCH_180_YAW_90 = 36  % Roll: 90, Pitch: 180, Yaw: 90
  MAV_SENSOR_ROTATION_ROLL_90_YAW_270 = 37  % Roll: 90, Pitch: 0, Yaw: 270
  MAV_SENSOR_ROTATION_ROLL_90_PITCH_68_YAW_293 = 38  % Roll: 90, Pitch: 68, Yaw: 293
  MAV_SENSOR_ROTATION_PITCH_315 = 39  % Pitch: 315
  MAV_SENSOR_ROTATION_ROLL_90_PITCH_315 = 40  % Roll: 90, Pitch: 315
  MAV_SENSOR_ROTATION_CUSTOM = 100  % Custom orientation

MAV_PROTOCOL_CAPABILITY_MISSION_FLOAT = Simulink.Parameter(1, StorageClass="Const")  % Autopilot supports the MISSION_ITEM float message type.
  % Note that MISSION_ITEM is deprecated, and autopilots should use MISSION_INT instead.

MAV_PROTOCOL_CAPABILITY_PARAM_FLOAT = Simulink.Parameter(2, StorageClass="Const")  % Autopilot supports the new param float message type.

MAV_PROTOCOL_CAPABILITY_MISSION_INT = Simulink.Parameter(4, StorageClass="Const")  % Autopilot supports MISSION_ITEM_INT scaled integer message type.
  % Note that this flag must always be set if missions are supported, because missions must always use MISSION_ITEM_INT (rather than MISSION_ITEM, which is deprecated).

MAV_PROTOCOL_CAPABILITY_COMMAND_INT = Simulink.Parameter(8, StorageClass="Const")  % Autopilot supports COMMAND_INT scaled integer message type.

MAV_PROTOCOL_CAPABILITY_PARAM_ENCODE_BYTEWISE = Simulink.Parameter(16, StorageClass="Const")  % Parameter protocol uses byte-wise encoding of parameter values into param_value (float) fields: https://mavlink.io/en/services/parameter.html#parameter-encoding.
  % Note that either this flag or MAV_PROTOCOL_CAPABILITY_PARAM_ENCODE_C_CAST should be set if the parameter protocol is supported.

MAV_PROTOCOL_CAPABILITY_FTP = Simulink.Parameter(32, StorageClass="Const")  % Autopilot supports the File Transfer Protocol v1: https://mavlink.io/en/services/ftp.html.
MAV_PROTOCOL_CAPABILITY_SET_ATTITUDE_TARGET = Simulink.Parameter(64, StorageClass="Const")  % Autopilot supports commanding attitude offboard.
MAV_PROTOCOL_CAPABILITY_SET_POSITION_TARGET_LOCAL_NED = Simulink.Parameter(128, StorageClass="Const")  % Autopilot supports commanding position and velocity targets in local NED frame.
MAV_PROTOCOL_CAPABILITY_SET_POSITION_TARGET_GLOBAL_INT = Simulink.Parameter(256, StorageClass="Const")  % Autopilot supports commanding position and velocity targets in global scaled integers.
MAV_PROTOCOL_CAPABILITY_TERRAIN = Simulink.Parameter(512, StorageClass="Const")  % Autopilot supports terrain protocol / data handling.
MAV_PROTOCOL_CAPABILITY_RESERVED3 = Simulink.Parameter(1024, StorageClass="Const")  % Reserved for future use.
MAV_PROTOCOL_CAPABILITY_FLIGHT_TERMINATION = Simulink.Parameter(2048, StorageClass="Const")  % Autopilot supports the MAV_CMD_DO_FLIGHTTERMINATION command (flight termination).
MAV_PROTOCOL_CAPABILITY_COMPASS_CALIBRATION = Simulink.Parameter(4096, StorageClass="Const")  % Autopilot supports onboard compass calibration.
MAV_PROTOCOL_CAPABILITY_MAVLINK2 = Simulink.Parameter(8192, StorageClass="Const")  % Autopilot supports MAVLink version 2.
MAV_PROTOCOL_CAPABILITY_MISSION_FENCE = Simulink.Parameter(16384, StorageClass="Const")  % Autopilot supports mission fence protocol.
MAV_PROTOCOL_CAPABILITY_MISSION_RALLY = Simulink.Parameter(32768, StorageClass="Const")  % Autopilot supports mission rally point protocol.
MAV_PROTOCOL_CAPABILITY_RESERVED2 = Simulink.Parameter(65536, StorageClass="Const")  % Reserved for future use.

MAV_PROTOCOL_CAPABILITY_PARAM_ENCODE_C_CAST = Simulink.Parameter(131072, StorageClass="Const")  % Parameter protocol uses C-cast of parameter values to set the param_value (float) fields: https://mavlink.io/en/services/parameter.html#parameter-encoding.
  % Note that either this flag or MAV_PROTOCOL_CAPABILITY_PARAM_ENCODE_BYTEWISE should be set if the parameter protocol is supported.

MAV_PROTOCOL_CAPABILITY = enum(AddClassNameToEnumNames=true)  % Bitmask of (optional) autopilot capabilities (64 bit). If a bit is set, the autopilot supports this capability.
  MISSION_FLOAT = 1  % Autopilot supports the MISSION_ITEM float message type.
    % Note that MISSION_ITEM is deprecated, and autopilots should use MISSION_INT instead.
  PARAM_FLOAT = 2  % Autopilot supports the new param float message type.
  MISSION_INT = 4  % Autopilot supports MISSION_ITEM_INT scaled integer message type.
    % Note that this flag must always be set if missions are supported, because missions must always use MISSION_ITEM_INT (rather than MISSION_ITEM, which is deprecated).
  COMMAND_INT = 8  % Autopilot supports COMMAND_INT scaled integer message type.
  PARAM_ENCODE_BYTEWISE = 16  % Parameter protocol uses byte-wise encoding of parameter values into param_value (float) fields: https://mavlink.io/en/services/parameter.html#parameter-encoding.
    % Note that either this flag or MAV_PROTOCOL_CAPABILITY_PARAM_ENCODE_C_CAST should be set if the parameter protocol is supported.
  FTP = 32  % Autopilot supports the File Transfer Protocol v1: https://mavlink.io/en/services/ftp.html.
  SET_ATTITUDE_TARGET = 64  % Autopilot supports commanding attitude offboard.
  SET_POSITION_TARGET_LOCAL_NED = 128  % Autopilot supports commanding position and velocity targets in local NED frame.
  SET_POSITION_TARGET_GLOBAL_INT = 256  % Autopilot supports commanding position and velocity targets in global scaled integers.
  TERRAIN = 512  % Autopilot supports terrain protocol / data handling.
  RESERVED3 = 1024  % Reserved for future use.
  FLIGHT_TERMINATION = 2048  % Autopilot supports the MAV_CMD_DO_FLIGHTTERMINATION command (flight termination).
  COMPASS_CALIBRATION = 4096  % Autopilot supports onboard compass calibration.
  MAVLINK2 = 8192  % Autopilot supports MAVLink version 2.
  MISSION_FENCE = 16384  % Autopilot supports mission fence protocol.
  MISSION_RALLY = 32768  % Autopilot supports mission rally point protocol.
  RESERVED2 = 65536  % Reserved for future use.
  PARAM_ENCODE_C_CAST = 131072  % Parameter protocol uses C-cast of parameter values to set the param_value (float) fields: https://mavlink.io/en/services/parameter.html#parameter-encoding.
    % Note that either this flag or MAV_PROTOCOL_CAPABILITY_PARAM_ENCODE_BYTEWISE should be set if the parameter protocol is supported.

MAV_MISSION_TYPE_MISSION = Simulink.Parameter(0, StorageClass="Const")  % Items are mission commands for main mission.
MAV_MISSION_TYPE_FENCE = Simulink.Parameter(1, StorageClass="Const")  % Specifies GeoFence area(s). Items are MAV_CMD_NAV_FENCE_ GeoFence items.
MAV_MISSION_TYPE_RALLY = Simulink.Parameter(2, StorageClass="Const")  % Specifies the rally points for the vehicle. Rally points are alternative RTL points. Items are MAV_CMD_NAV_RALLY_POINT rally point items.
MAV_MISSION_TYPE_ALL = Simulink.Parameter(255, StorageClass="Const")  % Only used in MISSION_CLEAR_ALL to clear all mission types.

MAV_MISSION_TYPE = enum(AddClassNameToEnumNames=true)  % Type of mission items being requested/sent in mission protocol.
  MISSION = 0  % Items are mission commands for main mission.
  FENCE = 1  % Specifies GeoFence area(s). Items are MAV_CMD_NAV_FENCE_ GeoFence items.
  RALLY = 2  % Specifies the rally points for the vehicle. Rally points are alternative RTL points. Items are MAV_CMD_NAV_RALLY_POINT rally point items.
  ALL = 255  % Only used in MISSION_CLEAR_ALL to clear all mission types.

MAV_ESTIMATOR_TYPE_UNKNOWN = Simulink.Parameter(0, StorageClass="Const")  % Unknown type of the estimator.
MAV_ESTIMATOR_TYPE_NAIVE = Simulink.Parameter(1, StorageClass="Const")  % This is a naive estimator without any real covariance feedback.
MAV_ESTIMATOR_TYPE_VISION = Simulink.Parameter(2, StorageClass="Const")  % Computer vision based estimate. Might be up to scale.
MAV_ESTIMATOR_TYPE_VIO = Simulink.Parameter(3, StorageClass="Const")  % Visual-inertial estimate.
MAV_ESTIMATOR_TYPE_GPS = Simulink.Parameter(4, StorageClass="Const")  % Plain GPS estimate.
MAV_ESTIMATOR_TYPE_GPS_INS = Simulink.Parameter(5, StorageClass="Const")  % Estimator integrating GPS and inertial sensing.
MAV_ESTIMATOR_TYPE_MOCAP = Simulink.Parameter(6, StorageClass="Const")  % Estimate from external motion capturing system.
MAV_ESTIMATOR_TYPE_LIDAR = Simulink.Parameter(7, StorageClass="Const")  % Estimator based on lidar sensor input.
MAV_ESTIMATOR_TYPE_AUTOPILOT = Simulink.Parameter(8, StorageClass="Const")  % Estimator on autopilot.

MAV_ESTIMATOR_TYPE = enum(AddClassNameToEnumNames=true)  % Enumeration of estimator types
  UNKNOWN = 0  % Unknown type of the estimator.
  NAIVE = 1  % This is a naive estimator without any real covariance feedback.
  VISION = 2  % Computer vision based estimate. Might be up to scale.
  VIO = 3  % Visual-inertial estimate.
  GPS = 4  % Plain GPS estimate.
  GPS_INS = 5  % Estimator integrating GPS and inertial sensing.
  MOCAP = 6  % Estimate from external motion capturing system.
  LIDAR = 7  % Estimator based on lidar sensor input.
  AUTOPILOT = 8  % Estimator on autopilot.

MAV_BATTERY_TYPE_UNKNOWN = Simulink.Parameter(0, StorageClass="Const")  % Not specified.
MAV_BATTERY_TYPE_LIPO = Simulink.Parameter(1, StorageClass="Const")  % Lithium polymer battery
MAV_BATTERY_TYPE_LIFE = Simulink.Parameter(2, StorageClass="Const")  % Lithium-iron-phosphate battery
MAV_BATTERY_TYPE_LION = Simulink.Parameter(3, StorageClass="Const")  % Lithium-ION battery
MAV_BATTERY_TYPE_NIMH = Simulink.Parameter(4, StorageClass="Const")  % Nickel metal hydride battery

MAV_BATTERY_TYPE = enum(AddClassNameToEnumNames=true)  % Enumeration of battery types
  UNKNOWN = 0  % Not specified.
  LIPO = 1  % Lithium polymer battery
  LIFE = 2  % Lithium-iron-phosphate battery
  LION = 3  % Lithium-ION battery
  NIMH = 4  % Nickel metal hydride battery

MAV_BATTERY_FUNCTION_UNKNOWN = Simulink.Parameter(0, StorageClass="Const")  % Battery function is unknown
MAV_BATTERY_FUNCTION_ALL = Simulink.Parameter(1, StorageClass="Const")  % Battery supports all flight systems
MAV_BATTERY_FUNCTION_PROPULSION = Simulink.Parameter(2, StorageClass="Const")  % Battery for the propulsion system
MAV_BATTERY_FUNCTION_AVIONICS = Simulink.Parameter(3, StorageClass="Const")  % Avionics battery
MAV_BATTERY_FUNCTION_PAYLOAD = Simulink.Parameter(4, StorageClass="Const")  % Payload battery

MAV_BATTERY_FUNCTION = enum(AddClassNameToEnumNames=true)  % Enumeration of battery functions
  UNKNOWN = 0  % Battery function is unknown
  ALL = 1  % Battery supports all flight systems
  PROPULSION = 2  % Battery for the propulsion system
  AVIONICS = 3  % Avionics battery
  PAYLOAD = 4  % Payload battery

MAV_BATTERY_CHARGE_STATE_UNDEFINED = Simulink.Parameter(0, StorageClass="Const")  % Low battery state is not provided
MAV_BATTERY_CHARGE_STATE_OK = Simulink.Parameter(1, StorageClass="Const")  % Battery is not in low state. Normal operation.
MAV_BATTERY_CHARGE_STATE_LOW = Simulink.Parameter(2, StorageClass="Const")  % Battery state is low, warn and monitor close.
MAV_BATTERY_CHARGE_STATE_CRITICAL = Simulink.Parameter(3, StorageClass="Const")  % Battery state is critical, return or abort immediately.
MAV_BATTERY_CHARGE_STATE_EMERGENCY = Simulink.Parameter(4, StorageClass="Const")  % Battery state is too low for ordinary abort sequence. Perform fastest possible emergency stop to prevent damage.
MAV_BATTERY_CHARGE_STATE_FAILED = Simulink.Parameter(5, StorageClass="Const")  % Battery failed, damage unavoidable. Possible causes (faults) are listed in MAV_BATTERY_FAULT.
MAV_BATTERY_CHARGE_STATE_UNHEALTHY = Simulink.Parameter(6, StorageClass="Const")  % Battery is diagnosed to be defective or an error occurred, usage is discouraged / prohibited. Possible causes (faults) are listed in MAV_BATTERY_FAULT.
MAV_BATTERY_CHARGE_STATE_CHARGING = Simulink.Parameter(7, StorageClass="Const")  % Battery is charging.

MAV_BATTERY_CHARGE_STATE = enum(AddClassNameToEnumNames=true)  % Enumeration for battery charge states.
  UNDEFINED = 0  % Low battery state is not provided
  OK = 1  % Battery is not in low state. Normal operation.
  LOW = 2  % Battery state is low, warn and monitor close.
  CRITICAL = 3  % Battery state is critical, return or abort immediately.
  EMERGENCY = 4  % Battery state is too low for ordinary abort sequence. Perform fastest possible emergency stop to prevent damage.
  FAILED = 5  % Battery failed, damage unavoidable. Possible causes (faults) are listed in MAV_BATTERY_FAULT.
  UNHEALTHY = 6  % Battery is diagnosed to be defective or an error occurred, usage is discouraged / prohibited. Possible causes (faults) are listed in MAV_BATTERY_FAULT.
  CHARGING = 7  % Battery is charging.

MAV_BATTERY_MODE_UNKNOWN = Simulink.Parameter(0, StorageClass="Const")  % Battery mode not supported/unknown battery mode/normal operation.
MAV_BATTERY_MODE_AUTO_DISCHARGING = Simulink.Parameter(1, StorageClass="Const")  % Battery is auto discharging (towards storage level).
MAV_BATTERY_MODE_HOT_SWAP = Simulink.Parameter(2, StorageClass="Const")  % Battery in hot-swap mode (current limited to prevent spikes that might damage sensitive electrical circuits).

MAV_BATTERY_MODE = enum(AddClassNameToEnumNames=true)  % Battery mode. Note, the normal operation mode (i.e. when flying) should be reported as MAV_BATTERY_MODE_UNKNOWN to allow message trimming in normal flight.
  UNKNOWN = 0  % Battery mode not supported/unknown battery mode/normal operation.
  AUTO_DISCHARGING = 1  % Battery is auto discharging (towards storage level).
  HOT_SWAP = 2  % Battery in hot-swap mode (current limited to prevent spikes that might damage sensitive electrical circuits).

MAV_BATTERY_FAULT_DEEP_DISCHARGE = Simulink.Parameter(1, StorageClass="Const")  % Battery has deep discharged.
MAV_BATTERY_FAULT_SPIKES = Simulink.Parameter(2, StorageClass="Const")  % Voltage spikes.
MAV_BATTERY_FAULT_CELL_FAIL = Simulink.Parameter(4, StorageClass="Const")  % One or more cells have failed. Battery should also report MAV_BATTERY_CHARGE_STATE_FAILE (and should not be used).
MAV_BATTERY_FAULT_OVER_CURRENT = Simulink.Parameter(8, StorageClass="Const")  % Over-current fault.
MAV_BATTERY_FAULT_OVER_TEMPERATURE = Simulink.Parameter(16, StorageClass="Const")  % Over-temperature fault.
MAV_BATTERY_FAULT_UNDER_TEMPERATURE = Simulink.Parameter(32, StorageClass="Const")  % Under-temperature fault.
MAV_BATTERY_FAULT_INCOMPATIBLE_VOLTAGE = Simulink.Parameter(64, StorageClass="Const")  % Vehicle voltage is not compatible with this battery (batteries on same power rail should have similar voltage).
MAV_BATTERY_FAULT_INCOMPATIBLE_FIRMWARE = Simulink.Parameter(128, StorageClass="Const")  % Battery firmware is not compatible with current autopilot firmware.
MAV_BATTERY_FAULT_INCOMPATIBLE_CELLS_CONFIGURATION = Simulink.Parameter(256, StorageClass="Const")  % Battery is not compatible due to cell configuration (e.g. 5s1p when vehicle requires 6s).

MAV_BATTERY_FAULT = enum(AddClassNameToEnumNames=true)  % Smart battery supply status/fault flags (bitmask) for health indication. The battery must also report either MAV_BATTERY_CHARGE_STATE_FAILED or MAV_BATTERY_CHARGE_STATE_UNHEALTHY if any of these are set.
  DEEP_DISCHARGE = 1  % Battery has deep discharged.
  SPIKES = 2  % Voltage spikes.
  CELL_FAIL = 4  % One or more cells have failed. Battery should also report MAV_BATTERY_CHARGE_STATE_FAILE (and should not be used).
  OVER_CURRENT = 8  % Over-current fault.
  OVER_TEMPERATURE = 16  % Over-temperature fault.
  UNDER_TEMPERATURE = 32  % Under-temperature fault.
  INCOMPATIBLE_VOLTAGE = 64  % Vehicle voltage is not compatible with this battery (batteries on same power rail should have similar voltage).
  INCOMPATIBLE_FIRMWARE = 128  % Battery firmware is not compatible with current autopilot firmware.
  BATTERY_FAULT_INCOMPATIBLE_CELLS_CONFIGURATION = 256  % Battery is not compatible due to cell configuration (e.g. 5s1p when vehicle requires 6s).

MAV_GENERATOR_STATUS_FLAG_OFF = Simulink.Parameter(1, StorageClass="Const")  % Generator is off.
MAV_GENERATOR_STATUS_FLAG_READY = Simulink.Parameter(2, StorageClass="Const")  % Generator is ready to start generating power.
MAV_GENERATOR_STATUS_FLAG_GENERATING = Simulink.Parameter(4, StorageClass="Const")  % Generator is generating power.
MAV_GENERATOR_STATUS_FLAG_CHARGING = Simulink.Parameter(8, StorageClass="Const")  % Generator is charging the batteries (generating enough power to charge and provide the load).
MAV_GENERATOR_STATUS_FLAG_REDUCED_POWER = Simulink.Parameter(16, StorageClass="Const")  % Generator is operating at a reduced maximum power.
MAV_GENERATOR_STATUS_FLAG_MAXPOWER = Simulink.Parameter(32, StorageClass="Const")  % Generator is providing the maximum output.
MAV_GENERATOR_STATUS_FLAG_OVERTEMP_WARNING = Simulink.Parameter(64, StorageClass="Const")  % Generator is near the maximum operating temperature, cooling is insufficient.
MAV_GENERATOR_STATUS_FLAG_OVERTEMP_FAULT = Simulink.Parameter(128, StorageClass="Const")  % Generator hit the maximum operating temperature and shutdown.
MAV_GENERATOR_STATUS_FLAG_ELECTRONICS_OVERTEMP_WARNING = Simulink.Parameter(256, StorageClass="Const")  % Power electronics are near the maximum operating temperature, cooling is insufficient.
MAV_GENERATOR_STATUS_FLAG_ELECTRONICS_OVERTEMP_FAULT = Simulink.Parameter(512, StorageClass="Const")  % Power electronics hit the maximum operating temperature and shutdown.
MAV_GENERATOR_STATUS_FLAG_ELECTRONICS_FAULT = Simulink.Parameter(1024, StorageClass="Const")  % Power electronics experienced a fault and shutdown.
MAV_GENERATOR_STATUS_FLAG_POWERSOURCE_FAULT = Simulink.Parameter(2048, StorageClass="Const")  % The power source supplying the generator failed e.g. mechanical generator stopped, tether is no longer providing power, solar cell is in shade, hydrogen reaction no longer happening.
MAV_GENERATOR_STATUS_FLAG_COMMUNICATION_WARNING = Simulink.Parameter(4096, StorageClass="Const")  % Generator controller having communication problems.
MAV_GENERATOR_STATUS_FLAG_COOLING_WARNING = Simulink.Parameter(8192, StorageClass="Const")  % Power electronic or generator cooling system error.
MAV_GENERATOR_STATUS_FLAG_POWER_RAIL_FAULT = Simulink.Parameter(16384, StorageClass="Const")  % Generator controller power rail experienced a fault.
MAV_GENERATOR_STATUS_FLAG_OVERCURRENT_FAULT = Simulink.Parameter(32768, StorageClass="Const")  % Generator controller exceeded the overcurrent threshold and shutdown to prevent damage.
MAV_GENERATOR_STATUS_FLAG_BATTERY_OVERCHARGE_CURRENT_FAULT = Simulink.Parameter(65536, StorageClass="Const")  % Generator controller detected a high current going into the batteries and shutdown to prevent battery damage.
MAV_GENERATOR_STATUS_FLAG_OVERVOLTAGE_FAULT = Simulink.Parameter(131072, StorageClass="Const")  % Generator controller exceeded it's overvoltage threshold and shutdown to prevent it exceeding the voltage rating.
MAV_GENERATOR_STATUS_FLAG_BATTERY_UNDERVOLT_FAULT = Simulink.Parameter(262144, StorageClass="Const")  % Batteries are under voltage (generator will not start).
MAV_GENERATOR_STATUS_FLAG_START_INHIBITED = Simulink.Parameter(524288, StorageClass="Const")  % Generator start is inhibited by e.g. a safety switch.
MAV_GENERATOR_STATUS_FLAG_MAINTENANCE_REQUIRED = Simulink.Parameter(1048576, StorageClass="Const")  % Generator requires maintenance.
MAV_GENERATOR_STATUS_FLAG_WARMING_UP = Simulink.Parameter(2097152, StorageClass="Const")  % Generator is not ready to generate yet.
MAV_GENERATOR_STATUS_FLAG_IDLE = Simulink.Parameter(4194304, StorageClass="Const")  % Generator is idle.

MAV_GENERATOR_STATUS_FLAG = enum(AddClassNameToEnumNames=true)  % Flags to report status/failure cases for a power generator (used in GENERATOR_STATUS). Note that FAULTS are conditions that cause the generator to fail. Warnings are conditions that require attention before the next use (they indicate the system is not operating properly).
  OFF = 1  % Generator is off.
  READY = 2  % Generator is ready to start generating power.
  GENERATING = 4  % Generator is generating power.
  CHARGING = 8  % Generator is charging the batteries (generating enough power to charge and provide the load).
  REDUCED_POWER = 16  % Generator is operating at a reduced maximum power.
  MAXPOWER = 32  % Generator is providing the maximum output.
  OVERTEMP_WARNING = 64  % Generator is near the maximum operating temperature, cooling is insufficient.
  OVERTEMP_FAULT = 128  % Generator hit the maximum operating temperature and shutdown.
  ELECTRONICS_OVERTEMP_WARNING = 256  % Power electronics are near the maximum operating temperature, cooling is insufficient.
  ELECTRONICS_OVERTEMP_FAULT = 512  % Power electronics hit the maximum operating temperature and shutdown.
  ELECTRONICS_FAULT = 1024  % Power electronics experienced a fault and shutdown.
  POWERSOURCE_FAULT = 2048  % The power source supplying the generator failed e.g. mechanical generator stopped, tether is no longer providing power, solar cell is in shade, hydrogen reaction no longer happening.
  COMMUNICATION_WARNING = 4096  % Generator controller having communication problems.
  COOLING_WARNING = 8192  % Power electronic or generator cooling system error.
  POWER_RAIL_FAULT = 16384  % Generator controller power rail experienced a fault.
  OVERCURRENT_FAULT = 32768  % Generator controller exceeded the overcurrent threshold and shutdown to prevent damage.
  BATTERY_OVERCHARGE_CURRENT_FAULT = 65536  % Generator controller detected a high current going into the batteries and shutdown to prevent battery damage.
  OVERVOLTAGE_FAULT = 131072  % Generator controller exceeded it's overvoltage threshold and shutdown to prevent it exceeding the voltage rating.
  BATTERY_UNDERVOLT_FAULT = 262144  % Batteries are under voltage (generator will not start).
  START_INHIBITED = 524288  % Generator start is inhibited by e.g. a safety switch.
  MAINTENANCE_REQUIRED = 1048576  % Generator requires maintenance.
  WARMING_UP = 2097152  % Generator is not ready to generate yet.
  IDLE = 4194304  % Generator is idle.

MAV_VTOL_STATE_UNDEFINED = Simulink.Parameter(0, StorageClass="Const")  % MAV is not configured as VTOL
MAV_VTOL_STATE_TRANSITION_TO_FW = Simulink.Parameter(1, StorageClass="Const")  % VTOL is in transition from multicopter to fixed-wing
MAV_VTOL_STATE_TRANSITION_TO_MC = Simulink.Parameter(2, StorageClass="Const")  % VTOL is in transition from fixed-wing to multicopter
MAV_VTOL_STATE_MC = Simulink.Parameter(3, StorageClass="Const")  % VTOL is in multicopter state
MAV_VTOL_STATE_FW = Simulink.Parameter(4, StorageClass="Const")  % VTOL is in fixed-wing state

MAV_VTOL_STATE = enum(AddClassNameToEnumNames=true)  % Enumeration of VTOL states
  UNDEFINED = 0  % MAV is not configured as VTOL
  TRANSITION_TO_FW = 1  % VTOL is in transition from multicopter to fixed-wing
  TRANSITION_TO_MC = 2  % VTOL is in transition from fixed-wing to multicopter
  MC = 3  % VTOL is in multicopter state
  FW = 4  % VTOL is in fixed-wing state

MAV_LANDED_STATE_UNDEFINED = Simulink.Parameter(0, StorageClass="Const")  % MAV landed state is unknown
MAV_LANDED_STATE_ON_GROUND = Simulink.Parameter(1, StorageClass="Const")  % MAV is landed (on ground)
MAV_LANDED_STATE_IN_AIR = Simulink.Parameter(2, StorageClass="Const")  % MAV is in air
MAV_LANDED_STATE_TAKEOFF = Simulink.Parameter(3, StorageClass="Const")  % MAV currently taking off
MAV_LANDED_STATE_LANDING = Simulink.Parameter(4, StorageClass="Const")  % MAV currently landing

MAV_LANDED_STATE = enum(AddClassNameToEnumNames=true)  % Enumeration of landed detector states
  UNDEFINED = 0  % MAV landed state is unknown
  ON_GROUND = 1  % MAV is landed (on ground)
  IN_AIR = 2  % MAV is in air
  TAKEOFF = 3  % MAV currently taking off
  LANDING = 4  % MAV currently landing

MAV_ADSB_ALTITUDE_TYPE_PRESSURE_QNH = Simulink.Parameter(0, StorageClass="Const")  % Altitude reported from a Baro source using QNH reference
MAV_ADSB_ALTITUDE_TYPE_GEOMETRIC = Simulink.Parameter(1, StorageClass="Const")  % Altitude reported from a GNSS source

MAV_ADSB_ALTITUDE_TYPE = enum(AddClassNameToEnumNames=true)  % Enumeration of the ADSB altimeter types
  PRESSURE_QNH = 0  % Altitude reported from a Baro source using QNH reference
  GEOMETRIC = 1  % Altitude reported from a GNSS source

MAV_ADSB_EMITTER_TYPE_NO_INFO = Simulink.Parameter(0, StorageClass="Const")
MAV_ADSB_EMITTER_TYPE_LIGHT = Simulink.Parameter(1, StorageClass="Const")
MAV_ADSB_EMITTER_TYPE_SMALL = Simulink.Parameter(2, StorageClass="Const")
MAV_ADSB_EMITTER_TYPE_LARGE = Simulink.Parameter(3, StorageClass="Const")
MAV_ADSB_EMITTER_TYPE_HIGH_VORTEX_LARGE = Simulink.Parameter(4, StorageClass="Const")
MAV_ADSB_EMITTER_TYPE_HEAVY = Simulink.Parameter(5, StorageClass="Const")
MAV_ADSB_EMITTER_TYPE_HIGHLY_MANUV = Simulink.Parameter(6, StorageClass="Const")
MAV_ADSB_EMITTER_TYPE_ROTOCRAFT = Simulink.Parameter(7, StorageClass="Const")
MAV_ADSB_EMITTER_TYPE_UNASSIGNED = Simulink.Parameter(8, StorageClass="Const")
MAV_ADSB_EMITTER_TYPE_GLIDER = Simulink.Parameter(9, StorageClass="Const")
MAV_ADSB_EMITTER_TYPE_LIGHTER_AIR = Simulink.Parameter(10, StorageClass="Const")
MAV_ADSB_EMITTER_TYPE_PARACHUTE = Simulink.Parameter(11, StorageClass="Const")
MAV_ADSB_EMITTER_TYPE_ULTRA_LIGHT = Simulink.Parameter(12, StorageClass="Const")
MAV_ADSB_EMITTER_TYPE_UNASSIGNED2 = Simulink.Parameter(13, StorageClass="Const")
MAV_ADSB_EMITTER_TYPE_UAV = Simulink.Parameter(14, StorageClass="Const")
MAV_ADSB_EMITTER_TYPE_SPACE = Simulink.Parameter(15, StorageClass="Const")
MAV_ADSB_EMITTER_TYPE_UNASSGINED3 = Simulink.Parameter(16, StorageClass="Const")
MAV_ADSB_EMITTER_TYPE_EMERGENCY_SURFACE = Simulink.Parameter(17, StorageClass="Const")
MAV_ADSB_EMITTER_TYPE_SERVICE_SURFACE = Simulink.Parameter(18, StorageClass="Const")
MAV_ADSB_EMITTER_TYPE_POINT_OBSTACLE = Simulink.Parameter(19, StorageClass="Const")

MAV_ADSB_EMITTER_TYPE = enum(AddClassNameToEnumNames=true)  % ADSB classification for the type of vehicle emitting the transponder signal
  NO_INFO = 0
  LIGHT = 1
  SMALL = 2
  LARGE = 3
  HIGH_VORTEX_LARGE = 4
  HEAVY = 5
  HIGHLY_MANUV = 6
  ROTOCRAFT = 7
  UNASSIGNED = 8
  GLIDER = 9
  LIGHTER_AIR = 10
  PARACHUTE = 11
  ULTRA_LIGHT = 12
  UNASSIGNED2 = 13
  UAV = 14
  SPACE = 15
  UNASSGINED3 = 16
  EMERGENCY_SURFACE = 17
  SERVICE_SURFACE = 18
  POINT_OBSTACLE = 19

MAV_ADSB_FLAGS_VALID_COORDS = Simulink.Parameter(1, StorageClass="Const")
MAV_ADSB_FLAGS_VALID_ALTITUDE = Simulink.Parameter(2, StorageClass="Const")
MAV_ADSB_FLAGS_VALID_HEADING = Simulink.Parameter(4, StorageClass="Const")
MAV_ADSB_FLAGS_VALID_VELOCITY = Simulink.Parameter(8, StorageClass="Const")
MAV_ADSB_FLAGS_VALID_CALLSIGN = Simulink.Parameter(16, StorageClass="Const")
MAV_ADSB_FLAGS_VALID_SQUAWK = Simulink.Parameter(32, StorageClass="Const")
MAV_ADSB_FLAGS_SIMULATED = Simulink.Parameter(64, StorageClass="Const")
MAV_ADSB_FLAGS_VERTICAL_VELOCITY_VALID = Simulink.Parameter(128, StorageClass="Const")
MAV_ADSB_FLAGS_BARO_VALID = Simulink.Parameter(256, StorageClass="Const")
MAV_ADSB_FLAGS_SOURCE_UAT = Simulink.Parameter(32768, StorageClass="Const")

MAV_ADSB_FLAGS = enum(AddClassNameToEnumNames=true)  % These flags indicate status such as data validity of each data source. Set = data valid
  VALID_COORDS = 1
  VALID_ALTITUDE = 2
  VALID_HEADING = 4
  VALID_VELOCITY = 8
  VALID_CALLSIGN = 16
  VALID_SQUAWK = 32
  SIMULATED = 64
  VERTICAL_VELOCITY_VALID = 128
  BARO_VALID = 256
  SOURCE_UAT = 32768

MAV_DO_REPOSITION_FLAGS_CHANGE_MODE = Simulink.Parameter(1, StorageClass="Const")  % The aircraft should immediately transition into guided. This should not be set for follow me applications

MAV_DO_REPOSITION_FLAGS = enum(AddClassNameToEnumNames=true)  % Bitmap of options for the MAV_CMD_DO_REPOSITION
  CHANGE_MODE = 1  % The aircraft should immediately transition into guided. This should not be set for follow me applications

MAV_SPEED_TYPE_AIRSPEED = Simulink.Parameter(0, StorageClass="Const")  % Airspeed
MAV_SPEED_TYPE_GROUNDSPEED = Simulink.Parameter(1, StorageClass="Const")  % Groundspeed
MAV_SPEED_TYPE_CLIMB_SPEED = Simulink.Parameter(2, StorageClass="Const")  % Climb speed
MAV_SPEED_TYPE_DESCENT_SPEED = Simulink.Parameter(3, StorageClass="Const")  % Descent speed

MAV_SPEED_TYPE = enum(AddClassNameToEnumNames=true)  % Speed setpoint types used in MAV_CMD_DO_CHANGE_SPEED
  AIRSPEED = 0  % Airspeed
  GROUNDSPEED = 1  % Groundspeed
  CLIMB_SPEED = 2  % Climb speed
  DESCENT_SPEED = 3  % Descent speed

MAV_ESTIMATOR_ATTITUDE = Simulink.Parameter(1, StorageClass="Const")  % True if the attitude estimate is good
MAV_ESTIMATOR_VELOCITY_HORIZ = Simulink.Parameter(2, StorageClass="Const")  % True if the horizontal velocity estimate is good
MAV_ESTIMATOR_VELOCITY_VERT = Simulink.Parameter(4, StorageClass="Const")  % True if the  vertical velocity estimate is good
MAV_ESTIMATOR_POS_HORIZ_REL = Simulink.Parameter(8, StorageClass="Const")  % True if the horizontal position (relative) estimate is good
MAV_ESTIMATOR_POS_HORIZ_ABS = Simulink.Parameter(16, StorageClass="Const")  % True if the horizontal position (absolute) estimate is good
MAV_ESTIMATOR_POS_VERT_ABS = Simulink.Parameter(32, StorageClass="Const")  % True if the vertical position (absolute) estimate is good
MAV_ESTIMATOR_POS_VERT_AGL = Simulink.Parameter(64, StorageClass="Const")  % True if the vertical position (above ground) estimate is good
MAV_ESTIMATOR_CONST_POS_MODE = Simulink.Parameter(128, StorageClass="Const")  % True if the EKF is in a constant position mode and is not using external measurements (eg GPS or optical flow)
MAV_ESTIMATOR_PRED_POS_HORIZ_REL = Simulink.Parameter(256, StorageClass="Const")  % True if the EKF has sufficient data to enter a mode that will provide a (relative) position estimate
MAV_ESTIMATOR_PRED_POS_HORIZ_ABS = Simulink.Parameter(512, StorageClass="Const")  % True if the EKF has sufficient data to enter a mode that will provide a (absolute) position estimate
MAV_ESTIMATOR_GPS_GLITCH = Simulink.Parameter(1024, StorageClass="Const")  % True if the EKF has detected a GPS glitch
MAV_ESTIMATOR_ACCEL_ERROR = Simulink.Parameter(2048, StorageClass="Const")  % True if the EKF has detected bad accelerometer data

MAV_ESTIMATOR_STATUS_FLAGS = enum(AddClassNameToEnumNames=true)  % Flags in ESTIMATOR_STATUS message
  ESTIMATOR_ATTITUDE = 1  % True if the attitude estimate is good
  ESTIMATOR_VELOCITY_HORIZ = 2  % True if the horizontal velocity estimate is good
  ESTIMATOR_VELOCITY_VERT = 4  % True if the  vertical velocity estimate is good
  ESTIMATOR_POS_HORIZ_REL = 8  % True if the horizontal position (relative) estimate is good
  ESTIMATOR_POS_HORIZ_ABS = 16  % True if the horizontal position (absolute) estimate is good
  ESTIMATOR_POS_VERT_ABS = 32  % True if the vertical position (absolute) estimate is good
  ESTIMATOR_POS_VERT_AGL = 64  % True if the vertical position (above ground) estimate is good
  ESTIMATOR_CONST_POS_MODE = 128  % True if the EKF is in a constant position mode and is not using external measurements (eg GPS or optical flow)
  ESTIMATOR_PRED_POS_HORIZ_REL = 256  % True if the EKF has sufficient data to enter a mode that will provide a (relative) position estimate
  ESTIMATOR_PRED_POS_HORIZ_ABS = 512  % True if the EKF has sufficient data to enter a mode that will provide a (absolute) position estimate
  ESTIMATOR_GPS_GLITCH = 1024  % True if the EKF has detected a GPS glitch
  ESTIMATOR_ACCEL_ERROR = 2048  % True if the EKF has detected bad accelerometer data

MAV_MOTOR_TEST_ORDER_DEFAULT = Simulink.Parameter(0, StorageClass="Const")  % Default autopilot motor test method.
MAV_MOTOR_TEST_ORDER_SEQUENCE = Simulink.Parameter(1, StorageClass="Const")  % Motor numbers are specified as their index in a predefined vehicle-specific sequence.
MAV_MOTOR_TEST_ORDER_BOARD = Simulink.Parameter(2, StorageClass="Const")  % Motor numbers are specified as the output as labeled on the board.

MAV_MOTOR_TEST_ORDER = enum(AddClassNameToEnumNames=true)  % Sequence that motors are tested when using MAV_CMD_DO_MOTOR_TEST.
  DEFAULT = 0  % Default autopilot motor test method.
  SEQUENCE = 1  % Motor numbers are specified as their index in a predefined vehicle-specific sequence.
  BOARD = 2  % Motor numbers are specified as the output as labeled on the board.

MAV_MOTOR_TEST_THROTTLE_PERCENT = Simulink.Parameter(0, StorageClass="Const")  % Throttle as a percentage (0 ~ 100)
MAV_MOTOR_TEST_THROTTLE_PWM = Simulink.Parameter(1, StorageClass="Const")  % Throttle as an absolute PWM value (normally in range of 1000~2000).
MAV_MOTOR_TEST_THROTTLE_PILOT = Simulink.Parameter(2, StorageClass="Const")  % Throttle pass-through from pilot's transmitter.
MAV_MOTOR_TEST_COMPASS_CAL = Simulink.Parameter(3, StorageClass="Const")  % Per-motor compass calibration test.

MAV_MOTOR_TEST_THROTTLE_TYPE = enum(AddClassNameToEnumNames=true)  % Defines how throttle value is represented in MAV_CMD_DO_MOTOR_TEST.
  MOTOR_TEST_THROTTLE_PERCENT = 0  % Throttle as a percentage (0 ~ 100)
  MOTOR_TEST_THROTTLE_PWM = 1  % Throttle as an absolute PWM value (normally in range of 1000~2000).
  MOTOR_TEST_THROTTLE_PILOT = 2  % Throttle pass-through from pilot's transmitter.
  MOTOR_TEST_COMPASS_CAL = 3  % Per-motor compass calibration test.

MAV_GPS_INPUT_IGNORE_FLAG_ALT = Simulink.Parameter(1, StorageClass="Const")  % ignore altitude field
MAV_GPS_INPUT_IGNORE_FLAG_HDOP = Simulink.Parameter(2, StorageClass="Const")  % ignore hdop field
MAV_GPS_INPUT_IGNORE_FLAG_VDOP = Simulink.Parameter(4, StorageClass="Const")  % ignore vdop field
MAV_GPS_INPUT_IGNORE_FLAG_VEL_HORIZ = Simulink.Parameter(8, StorageClass="Const")  % ignore horizontal velocity field (vn and ve)
MAV_GPS_INPUT_IGNORE_FLAG_VEL_VERT = Simulink.Parameter(16, StorageClass="Const")  % ignore vertical velocity field (vd)
MAV_GPS_INPUT_IGNORE_FLAG_SPEED_ACCURACY = Simulink.Parameter(32, StorageClass="Const")  % ignore speed accuracy field
MAV_GPS_INPUT_IGNORE_FLAG_HORIZONTAL_ACCURACY = Simulink.Parameter(64, StorageClass="Const")  % ignore horizontal accuracy field
MAV_GPS_INPUT_IGNORE_FLAG_VERTICAL_ACCURACY = Simulink.Parameter(128, StorageClass="Const")  % ignore vertical accuracy field

MAV_GPS_INPUT_IGNORE_FLAGS = enum(AddClassNameToEnumNames=true)
  GPS_INPUT_IGNORE_FLAG_ALT = 1  % ignore altitude field
  GPS_INPUT_IGNORE_FLAG_HDOP = 2  % ignore hdop field
  GPS_INPUT_IGNORE_FLAG_VDOP = 4  % ignore vdop field
  GPS_INPUT_IGNORE_FLAG_VEL_HORIZ = 8  % ignore horizontal velocity field (vn and ve)
  GPS_INPUT_IGNORE_FLAG_VEL_VERT = 16  % ignore vertical velocity field (vd)
  GPS_INPUT_IGNORE_FLAG_SPEED_ACCURACY = 32  % ignore speed accuracy field
  GPS_INPUT_IGNORE_FLAG_HORIZONTAL_ACCURACY = 64  % ignore horizontal accuracy field
  GPS_INPUT_IGNORE_FLAG_VERTICAL_ACCURACY = 128  % ignore vertical accuracy field

MAV_COLLISION_ACTION_NONE = Simulink.Parameter(0, StorageClass="Const")  % Ignore any potential collisions
MAV_COLLISION_ACTION_REPORT = Simulink.Parameter(1, StorageClass="Const")  % Report potential collision
MAV_COLLISION_ACTION_ASCEND_OR_DESCEND = Simulink.Parameter(2, StorageClass="Const")  % Ascend or Descend to avoid threat
MAV_COLLISION_ACTION_MOVE_HORIZONTALLY = Simulink.Parameter(3, StorageClass="Const")  % Move horizontally to avoid threat
MAV_COLLISION_ACTION_MOVE_PERPENDICULAR = Simulink.Parameter(4, StorageClass="Const")  % Aircraft to move perpendicular to the collision's velocity vector
MAV_COLLISION_ACTION_RTL = Simulink.Parameter(5, StorageClass="Const")  % Aircraft to fly directly back to its launch point
MAV_COLLISION_ACTION_HOVER = Simulink.Parameter(6, StorageClass="Const")  % Aircraft to stop in place

MAV_COLLISION_ACTION = enum(AddClassNameToEnumNames=true)  % Possible actions an aircraft can take to avoid a collision.
  NONE = 0  % Ignore any potential collisions
  REPORT = 1  % Report potential collision
  ASCEND_OR_DESCEND = 2  % Ascend or Descend to avoid threat
  MOVE_HORIZONTALLY = 3  % Move horizontally to avoid threat
  MOVE_PERPENDICULAR = 4  % Aircraft to move perpendicular to the collision's velocity vector
  RTL = 5  % Aircraft to fly directly back to its launch point
  HOVER = 6  % Aircraft to stop in place

MAV_COLLISION_THREAT_LEVEL_NONE = Simulink.Parameter(0, StorageClass="Const")  % Not a threat
MAV_COLLISION_THREAT_LEVEL_LOW = Simulink.Parameter(1, StorageClass="Const")  % Craft is mildly concerned about this threat
MAV_COLLISION_THREAT_LEVEL_HIGH = Simulink.Parameter(2, StorageClass="Const")  % Craft is panicking, and may take actions to avoid threat

MAV_COLLISION_THREAT_LEVEL = enum(AddClassNameToEnumNames=true)  % Aircraft-rated danger from this threat.
  NONE = 0  % Not a threat
  LOW = 1  % Craft is mildly concerned about this threat
  HIGH = 2  % Craft is panicking, and may take actions to avoid threat

MAV_COLLISION_SRC_ADSB = Simulink.Parameter(0, StorageClass="Const")  % ID field references ADSB_VEHICLE packets
MAV_COLLISION_SRC_MAVLINK_GPS_GLOBAL_INT = Simulink.Parameter(1, StorageClass="Const")  % ID field references MAVLink SRC ID

MAV_COLLISION_SRC = enum(AddClassNameToEnumNames=true)  % Source of information about this collision.
  ADSB = 0  % ID field references ADSB_VEHICLE packets
  MAVLINK_GPS_GLOBAL_INT = 1  % ID field references MAVLink SRC ID

MAV_GPS_FIX_TYPE_NO_GPS = Simulink.Parameter(0, StorageClass="Const")  % No GPS connected
MAV_GPS_FIX_TYPE_NO_FIX = Simulink.Parameter(1, StorageClass="Const")  % No position information, GPS is connected
MAV_GPS_FIX_TYPE_2D_FIX = Simulink.Parameter(2, StorageClass="Const")  % 2D position
MAV_GPS_FIX_TYPE_3D_FIX = Simulink.Parameter(3, StorageClass="Const")  % 3D position
MAV_GPS_FIX_TYPE_DGPS = Simulink.Parameter(4, StorageClass="Const")  % DGPS/SBAS aided 3D position
MAV_GPS_FIX_TYPE_RTK_FLOAT = Simulink.Parameter(5, StorageClass="Const")  % RTK float, 3D position
MAV_GPS_FIX_TYPE_RTK_FIXED = Simulink.Parameter(6, StorageClass="Const")  % RTK Fixed, 3D position
MAV_GPS_FIX_TYPE_STATIC = Simulink.Parameter(7, StorageClass="Const")  % Static fixed, typically used for base stations
MAV_GPS_FIX_TYPE_PPP = Simulink.Parameter(8, StorageClass="Const")  % PPP, 3D position.

MAV_GPS_FIX_TYPE = enum(AddClassNameToEnumNames=true)  % Type of GPS fix
  NO_GPS = 0  % No GPS connected
  NO_FIX = 1  % No position information, GPS is connected
  x2D_FIX = 2  % 2D position
  x3D_FIX = 3  % 3D position
  DGPS = 4  % DGPS/SBAS aided 3D position
  RTK_FLOAT = 5  % RTK float, 3D position
  RTK_FIXED = 6  % RTK Fixed, 3D position
  STATIC = 7  % Static fixed, typically used for base stations
  PPP = 8  % PPP, 3D position.

MAV_RTK_BASELINE_COORDINATE_SYSTEM_ECEF = Simulink.Parameter(0, StorageClass="Const")  % Earth-centered, Earth-fixed
MAV_RTK_BASELINE_COORDINATE_SYSTEM_NED = Simulink.Parameter(1, StorageClass="Const")  % RTK basestation centered, north, east, down

MAV_RTK_BASELINE_COORDINATE_SYSTEM = enum(AddClassNameToEnumNames=true)  % RTK GPS baseline coordinate system, used for RTK corrections
  ECEF = 0  % Earth-centered, Earth-fixed
  NED = 1  % RTK basestation centered, north, east, down

MAV_LANDING_TARGET_TYPE_LIGHT_BEACON = Simulink.Parameter(0, StorageClass="Const")  % Landing target signaled by light beacon (ex: IR-LOCK)
MAV_LANDING_TARGET_TYPE_RADIO_BEACON = Simulink.Parameter(1, StorageClass="Const")  % Landing target signaled by radio beacon (ex: ILS, NDB)
MAV_LANDING_TARGET_TYPE_VISION_FIDUCIAL = Simulink.Parameter(2, StorageClass="Const")  % Landing target represented by a fiducial marker (ex: ARTag)
MAV_LANDING_TARGET_TYPE_VISION_OTHER = Simulink.Parameter(3, StorageClass="Const")  % Landing target represented by a pre-defined visual shape/feature (ex: X-marker, H-marker, square)

MAV_LANDING_TARGET_TYPE = enum(AddClassNameToEnumNames=true)  % Type of landing target
  LIGHT_BEACON = 0  % Landing target signaled by light beacon (ex: IR-LOCK)
  RADIO_BEACON = 1  % Landing target signaled by radio beacon (ex: ILS, NDB)
  VISION_FIDUCIAL = 2  % Landing target represented by a fiducial marker (ex: ARTag)
  VISION_OTHER = 3  % Landing target represented by a pre-defined visual shape/feature (ex: X-marker, H-marker, square)

MAV_VTOL_TRANSITION_HEADING_VEHICLE_DEFAULT = Simulink.Parameter(0, StorageClass="Const")  % Respect the heading configuration of the vehicle.
MAV_VTOL_TRANSITION_HEADING_NEXT_WAYPOINT = Simulink.Parameter(1, StorageClass="Const")  % Use the heading pointing towards the next waypoint.
MAV_VTOL_TRANSITION_HEADING_TAKEOFF = Simulink.Parameter(2, StorageClass="Const")  % Use the heading on takeoff (while sitting on the ground).
MAV_VTOL_TRANSITION_HEADING_SPECIFIED = Simulink.Parameter(3, StorageClass="Const")  % Use the specified heading in parameter 4.
MAV_VTOL_TRANSITION_HEADING_ANY = Simulink.Parameter(4, StorageClass="Const")  % Use the current heading when reaching takeoff altitude (potentially facing the wind when weather-vaning is active).

MAV_VTOL_TRANSITION_HEADING = enum(AddClassNameToEnumNames=true)  % Direction of VTOL transition
  VEHICLE_DEFAULT = 0  % Respect the heading configuration of the vehicle.
  NEXT_WAYPOINT = 1  % Use the heading pointing towards the next waypoint.
  TAKEOFF = 2  % Use the heading on takeoff (while sitting on the ground).
  SPECIFIED = 3  % Use the specified heading in parameter 4.
  ANY = 4  % Use the current heading when reaching takeoff altitude (potentially facing the wind when weather-vaning is active).

MAV_CAMERA_CAP_FLAGS_CAPTURE_VIDEO = Simulink.Parameter(1, StorageClass="Const")  % Camera is able to record video
MAV_CAMERA_CAP_FLAGS_CAPTURE_IMAGE = Simulink.Parameter(2, StorageClass="Const")  % Camera is able to capture images
MAV_CAMERA_CAP_FLAGS_HAS_MODES = Simulink.Parameter(4, StorageClass="Const")  % Camera has separate Video and Image/Photo modes (MAV_CMD_SET_CAMERA_MODE)
MAV_CAMERA_CAP_FLAGS_CAN_CAPTURE_IMAGE_IN_VIDEO_MODE = Simulink.Parameter(8, StorageClass="Const")  % Camera can capture images while in video mode
MAV_CAMERA_CAP_FLAGS_CAN_CAPTURE_VIDEO_IN_IMAGE_MODE = Simulink.Parameter(16, StorageClass="Const")  % Camera can capture videos while in Photo/Image mode
MAV_CAMERA_CAP_FLAGS_HAS_IMAGE_SURVEY_MODE = Simulink.Parameter(32, StorageClass="Const")  % Camera has image survey mode (MAV_CMD_SET_CAMERA_MODE)
MAV_CAMERA_CAP_FLAGS_HAS_BASIC_ZOOM = Simulink.Parameter(64, StorageClass="Const")  % Camera has basic zoom control (MAV_CMD_SET_CAMERA_ZOOM)
MAV_CAMERA_CAP_FLAGS_HAS_BASIC_FOCUS = Simulink.Parameter(128, StorageClass="Const")  % Camera has basic focus control (MAV_CMD_SET_CAMERA_FOCUS)
MAV_CAMERA_CAP_FLAGS_HAS_VIDEO_STREAM = Simulink.Parameter(256, StorageClass="Const")  % Camera has video streaming capabilities (request VIDEO_STREAM_INFORMATION with MAV_CMD_REQUEST_MESSAGE for video streaming info)
MAV_CAMERA_CAP_FLAGS_HAS_TRACKING_POINT = Simulink.Parameter(512, StorageClass="Const")  % Camera supports tracking of a point on the camera view.
MAV_CAMERA_CAP_FLAGS_HAS_TRACKING_RECTANGLE = Simulink.Parameter(1024, StorageClass="Const")  % Camera supports tracking of a selection rectangle on the camera view.
MAV_CAMERA_CAP_FLAGS_HAS_TRACKING_GEO_STATUS = Simulink.Parameter(2048, StorageClass="Const")  % Camera supports tracking geo status (CAMERA_TRACKING_GEO_STATUS).

MAV_CAMERA_CAP_FLAGS = enum(AddClassNameToEnumNames=true)  % Camera capability flags (Bitmap)
  CAPTURE_VIDEO = 1  % Camera is able to record video
  CAPTURE_IMAGE = 2  % Camera is able to capture images
  HAS_MODES = 4  % Camera has separate Video and Image/Photo modes (MAV_CMD_SET_CAMERA_MODE)
  CAN_CAPTURE_IMAGE_IN_VIDEO_MODE = 8  % Camera can capture images while in video mode
  CAN_CAPTURE_VIDEO_IN_IMAGE_MODE = 16  % Camera can capture videos while in Photo/Image mode
  HAS_IMAGE_SURVEY_MODE = 32  % Camera has image survey mode (MAV_CMD_SET_CAMERA_MODE)
  HAS_BASIC_ZOOM = 64  % Camera has basic zoom control (MAV_CMD_SET_CAMERA_ZOOM)
  HAS_BASIC_FOCUS = 128  % Camera has basic focus control (MAV_CMD_SET_CAMERA_FOCUS)
  HAS_VIDEO_STREAM = 256  % Camera has video streaming capabilities (request VIDEO_STREAM_INFORMATION with MAV_CMD_REQUEST_MESSAGE for video streaming info)
  HAS_TRACKING_POINT = 512  % Camera supports tracking of a point on the camera view.
  HAS_TRACKING_RECTANGLE = 1024  % Camera supports tracking of a selection rectangle on the camera view.
  HAS_TRACKING_GEO_STATUS = 2048  % Camera supports tracking geo status (CAMERA_TRACKING_GEO_STATUS).

MAV_VIDEO_STREAM_STATUS_FLAGS_RUNNING = Simulink.Parameter(1, StorageClass="Const")  % Stream is active (running)
MAV_VIDEO_STREAM_STATUS_FLAGS_THERMAL = Simulink.Parameter(2, StorageClass="Const")  % Stream is thermal imaging

MAV_VIDEO_STREAM_STATUS_FLAGS = enum(AddClassNameToEnumNames=true)  % Stream status flags (Bitmap)
  RUNNING = 1  % Stream is active (running)
  THERMAL = 2  % Stream is thermal imaging

MAV_VIDEO_STREAM_TYPE_RTSP = Simulink.Parameter(0, StorageClass="Const")  % Stream is RTSP
MAV_VIDEO_STREAM_TYPE_RTPUDP = Simulink.Parameter(1, StorageClass="Const")  % Stream is RTP UDP (URI gives the port number)
MAV_VIDEO_STREAM_TYPE_TCP_MPEG = Simulink.Parameter(2, StorageClass="Const")  % Stream is MPEG on TCP
MAV_VIDEO_STREAM_TYPE_MPEG_TS_H264 = Simulink.Parameter(3, StorageClass="Const")  % Stream is h.264 on MPEG TS (URI gives the port number)

MAV_VIDEO_STREAM_TYPE = enum(AddClassNameToEnumNames=true)  % Video stream types
  RTSP = 0  % Stream is RTSP
  RTPUDP = 1  % Stream is RTP UDP (URI gives the port number)
  TCP_MPEG = 2  % Stream is MPEG on TCP
  MPEG_TS_H264 = 3  % Stream is h.264 on MPEG TS (URI gives the port number)

MAV_CAMERA_TRACKING_STATUS_FLAGS_IDLE = Simulink.Parameter(0, StorageClass="Const")  % Camera is not tracking
MAV_CAMERA_TRACKING_STATUS_FLAGS_ACTIVE = Simulink.Parameter(1, StorageClass="Const")  % Camera is tracking
MAV_CAMERA_TRACKING_STATUS_FLAGS_ERROR = Simulink.Parameter(2, StorageClass="Const")  % Camera tracking in error state

MAV_CAMERA_TRACKING_STATUS_FLAGS = enum(AddClassNameToEnumNames=true)  % Camera tracking status flags
  IDLE = 0  % Camera is not tracking
  ACTIVE = 1  % Camera is tracking
  ERROR = 2  % Camera tracking in error state

MAV_CAMERA_TRACKING_MODE_NONE = Simulink.Parameter(0, StorageClass="Const")  % Not tracking
MAV_CAMERA_TRACKING_MODE_POINT = Simulink.Parameter(1, StorageClass="Const")  % Target is a point
MAV_CAMERA_TRACKING_MODE_RECTANGLE = Simulink.Parameter(2, StorageClass="Const")  % Target is a rectangle

MAV_CAMERA_TRACKING_MODE = enum(AddClassNameToEnumNames=true)  % Camera tracking modes
  NONE = 0  % Not tracking
  POINT = 1  % Target is a point
  RECTANGLE = 2  % Target is a rectangle

MAV_CAMERA_TRACKING_TARGET_DATA_NONE = Simulink.Parameter(0, StorageClass="Const")  % No target data
MAV_CAMERA_TRACKING_TARGET_DATA_EMBEDDED = Simulink.Parameter(1, StorageClass="Const")  % Target data embedded in image data (proprietary)
MAV_CAMERA_TRACKING_TARGET_DATA_RENDERED = Simulink.Parameter(2, StorageClass="Const")  % Target data rendered in image
MAV_CAMERA_TRACKING_TARGET_DATA_IN_STATUS = Simulink.Parameter(4, StorageClass="Const")  % Target data within status message (Point or Rectangle)

MAV_CAMERA_TRACKING_TARGET_DATA = enum(AddClassNameToEnumNames=true)  % Camera tracking target data (shows where tracked target is within image)
  NONE = 0  % No target data
  EMBEDDED = 1  % Target data embedded in image data (proprietary)
  RENDERED = 2  % Target data rendered in image
  IN_STATUS = 4  % Target data within status message (Point or Rectangle)

MAV_ZOOM_TYPE_STEP = Simulink.Parameter(0, StorageClass="Const")  % Zoom one step increment (-1 for wide, 1 for tele)
MAV_ZOOM_TYPE_CONTINUOUS = Simulink.Parameter(1, StorageClass="Const")  % Continuous zoom up/down until stopped (-1 for wide, 1 for tele, 0 to stop zooming)
MAV_ZOOM_TYPE_RANGE = Simulink.Parameter(2, StorageClass="Const")  % Zoom value as proportion of full camera range (a percentage value between 0.0 and 100.0)
MAV_ZOOM_TYPE_FOCAL_LENGTH = Simulink.Parameter(3, StorageClass="Const")  % Zoom value/variable focal length in millimetres. Note that there is no message to get the valid zoom range of the camera, so this can type can only be used for cameras where the zoom range is known (implying that this cannot reliably be used in a GCS for an arbitrary camera)
MAV_ZOOM_TYPE_HORIZONTAL_FOV = Simulink.Parameter(4, StorageClass="Const")  % Zoom value as horizontal field of view in degrees.

MAV_CAMERA_ZOOM_TYPE = enum(AddClassNameToEnumNames=true)  % Zoom types for MAV_CMD_SET_CAMERA_ZOOM
  ZOOM_TYPE_STEP = 0  % Zoom one step increment (-1 for wide, 1 for tele)
  ZOOM_TYPE_CONTINUOUS = 1  % Continuous zoom up/down until stopped (-1 for wide, 1 for tele, 0 to stop zooming)
  ZOOM_TYPE_RANGE = 2  % Zoom value as proportion of full camera range (a percentage value between 0.0 and 100.0)
  ZOOM_TYPE_FOCAL_LENGTH = 3  % Zoom value/variable focal length in millimetres. Note that there is no message to get the valid zoom range of the camera, so this can type can only be used for cameras where the zoom range is known (implying that this cannot reliably be used in a GCS for an arbitrary camera)
  ZOOM_TYPE_HORIZONTAL_FOV = 4  % Zoom value as horizontal field of view in degrees.

MAV_FOCUS_TYPE_STEP = Simulink.Parameter(0, StorageClass="Const")  % Focus one step increment (-1 for focusing in, 1 for focusing out towards infinity).
MAV_FOCUS_TYPE_CONTINUOUS = Simulink.Parameter(1, StorageClass="Const")  % Continuous focus up/down until stopped (-1 for focusing in, 1 for focusing out towards infinity, 0 to stop focusing)
MAV_FOCUS_TYPE_RANGE = Simulink.Parameter(2, StorageClass="Const")  % Focus value as proportion of full camera focus range (a value between 0.0 and 100.0)
MAV_FOCUS_TYPE_METERS = Simulink.Parameter(3, StorageClass="Const")  % Focus value in metres. Note that there is no message to get the valid focus range of the camera, so this can type can only be used for cameras where the range is known (implying that this cannot reliably be used in a GCS for an arbitrary camera).
MAV_FOCUS_TYPE_AUTO = Simulink.Parameter(4, StorageClass="Const")  % Focus automatically.
MAV_FOCUS_TYPE_AUTO_SINGLE = Simulink.Parameter(5, StorageClass="Const")  % Single auto focus. Mainly used for still pictures. Usually abbreviated as AF-S.
MAV_FOCUS_TYPE_AUTO_CONTINUOUS = Simulink.Parameter(6, StorageClass="Const")  % Continuous auto focus. Mainly used for dynamic scenes. Abbreviated as AF-C.

MAV_SET_FOCUS_TYPE = enum(AddClassNameToEnumNames=true)  % Focus types for MAV_CMD_SET_CAMERA_FOCUS
  FOCUS_TYPE_STEP = 0  % Focus one step increment (-1 for focusing in, 1 for focusing out towards infinity).
  FOCUS_TYPE_CONTINUOUS = 1  % Continuous focus up/down until stopped (-1 for focusing in, 1 for focusing out towards infinity, 0 to stop focusing)
  FOCUS_TYPE_RANGE = 2  % Focus value as proportion of full camera focus range (a value between 0.0 and 100.0)
  FOCUS_TYPE_METERS = 3  % Focus value in metres. Note that there is no message to get the valid focus range of the camera, so this can type can only be used for cameras where the range is known (implying that this cannot reliably be used in a GCS for an arbitrary camera).
  FOCUS_TYPE_AUTO = 4  % Focus automatically.
  FOCUS_TYPE_AUTO_SINGLE = 5  % Single auto focus. Mainly used for still pictures. Usually abbreviated as AF-S.
  FOCUS_TYPE_AUTO_CONTINUOUS = 6  % Continuous auto focus. Mainly used for dynamic scenes. Abbreviated as AF-C.

MAV_PARAM_ACK_ACCEPTED = Simulink.Parameter(0, StorageClass="Const")  % Parameter value ACCEPTED and SET
MAV_PARAM_ACK_VALUE_UNSUPPORTED = Simulink.Parameter(1, StorageClass="Const")  % Parameter value UNKNOWN/UNSUPPORTED
MAV_PARAM_ACK_FAILED = Simulink.Parameter(2, StorageClass="Const")  % Parameter failed to set
MAV_PARAM_ACK_IN_PROGRESS = Simulink.Parameter(3, StorageClass="Const")  % Parameter value received but not yet set/accepted. A subsequent PARAM_ACK_TRANSACTION or PARAM_EXT_ACK with the final result will follow once operation is completed. This is returned immediately for parameters that take longer to set, indicating that the the parameter was received and does not need to be resent.

MAV_PARAM_ACK = enum(AddClassNameToEnumNames=true)  % Result from PARAM_EXT_SET message (or a PARAM_SET within a transaction).
  ACCEPTED = 0  % Parameter value ACCEPTED and SET
  VALUE_UNSUPPORTED = 1  % Parameter value UNKNOWN/UNSUPPORTED
  FAILED = 2  % Parameter failed to set
  IN_PROGRESS = 3  % Parameter value received but not yet set/accepted. A subsequent PARAM_ACK_TRANSACTION or PARAM_EXT_ACK with the final result will follow once operation is completed. This is returned immediately for parameters that take longer to set, indicating that the the parameter was received and does not need to be resent.

MAV_CAMERA_MODE_IMAGE = Simulink.Parameter(0, StorageClass="Const")  % Camera is in image/photo capture mode.
MAV_CAMERA_MODE_VIDEO = Simulink.Parameter(1, StorageClass="Const")  % Camera is in video capture mode.
MAV_CAMERA_MODE_IMAGE_SURVEY = Simulink.Parameter(2, StorageClass="Const")  % Camera is in image survey capture mode. It allows for camera controller to do specific settings for surveys.

MAV_CAMERA_MODE = enum(AddClassNameToEnumNames=true)  % Camera Modes.
  IMAGE = 0  % Camera is in image/photo capture mode.
  VIDEO = 1  % Camera is in video capture mode.
  IMAGE_SURVEY = 2  % Camera is in image survey capture mode. It allows for camera controller to do specific settings for surveys.

MAV_ARM_AUTH_DENIED_REASON_GENERIC = Simulink.Parameter(0, StorageClass="Const")  % Not a specific reason
MAV_ARM_AUTH_DENIED_REASON_NONE = Simulink.Parameter(1, StorageClass="Const")  % Authorizer will send the error as string to GCS
MAV_ARM_AUTH_DENIED_REASON_INVALID_WAYPOINT = Simulink.Parameter(2, StorageClass="Const")  % At least one waypoint have a invalid value
MAV_ARM_AUTH_DENIED_REASON_TIMEOUT = Simulink.Parameter(3, StorageClass="Const")  % Timeout in the authorizer process(in case it depends on network)
MAV_ARM_AUTH_DENIED_REASON_AIRSPACE_IN_USE = Simulink.Parameter(4, StorageClass="Const")  % Airspace of the mission in use by another vehicle, second result parameter can have the waypoint id that caused it to be denied.
MAV_ARM_AUTH_DENIED_REASON_BAD_WEATHER = Simulink.Parameter(5, StorageClass="Const")  % Weather is not good to fly

MAV_ARM_AUTH_DENIED_REASON = enum(AddClassNameToEnumNames=true)
  GENERIC = 0  % Not a specific reason
  NONE = 1  % Authorizer will send the error as string to GCS
  INVALID_WAYPOINT = 2  % At least one waypoint have a invalid value
  TIMEOUT = 3  % Timeout in the authorizer process(in case it depends on network)
  AIRSPACE_IN_USE = 4  % Airspace of the mission in use by another vehicle, second result parameter can have the waypoint id that caused it to be denied.
  BAD_WEATHER = 5  % Weather is not good to fly

MAV_RC_TYPE_SPEKTRUM_DSM2 = Simulink.Parameter(0, StorageClass="Const")  % Spektrum DSM2
MAV_RC_TYPE_SPEKTRUM_DSMX = Simulink.Parameter(1, StorageClass="Const")  % Spektrum DSMX

MAV_RC_TYPE = enum(AddClassNameToEnumNames=true)  % RC type
  SPEKTRUM_DSM2 = 0  % Spektrum DSM2
  SPEKTRUM_DSMX = 1  % Spektrum DSMX

MAV_POSITION_TARGET_TYPEMASK_X_IGNORE = Simulink.Parameter(1, StorageClass="Const")  % Ignore position x
MAV_POSITION_TARGET_TYPEMASK_Y_IGNORE = Simulink.Parameter(2, StorageClass="Const")  % Ignore position y
MAV_POSITION_TARGET_TYPEMASK_Z_IGNORE = Simulink.Parameter(4, StorageClass="Const")  % Ignore position z
MAV_POSITION_TARGET_TYPEMASK_VX_IGNORE = Simulink.Parameter(8, StorageClass="Const")  % Ignore velocity x
MAV_POSITION_TARGET_TYPEMASK_VY_IGNORE = Simulink.Parameter(16, StorageClass="Const")  % Ignore velocity y
MAV_POSITION_TARGET_TYPEMASK_VZ_IGNORE = Simulink.Parameter(32, StorageClass="Const")  % Ignore velocity z
MAV_POSITION_TARGET_TYPEMASK_AX_IGNORE = Simulink.Parameter(64, StorageClass="Const")  % Ignore acceleration x
MAV_POSITION_TARGET_TYPEMASK_AY_IGNORE = Simulink.Parameter(128, StorageClass="Const")  % Ignore acceleration y
MAV_POSITION_TARGET_TYPEMASK_AZ_IGNORE = Simulink.Parameter(256, StorageClass="Const")  % Ignore acceleration z
MAV_POSITION_TARGET_TYPEMASK_FORCE_SET = Simulink.Parameter(512, StorageClass="Const")  % Use force instead of acceleration
MAV_POSITION_TARGET_TYPEMASK_YAW_IGNORE = Simulink.Parameter(1024, StorageClass="Const")  % Ignore yaw
MAV_POSITION_TARGET_TYPEMASK_YAW_RATE_IGNORE = Simulink.Parameter(2048, StorageClass="Const")  % Ignore yaw rate

MAV_POSITION_TARGET_TYPEMASK = enum(AddClassNameToEnumNames=true)  % Bitmap to indicate which dimensions should be ignored by the vehicle: a value of 0b0000000000000000 or 0b0000001000000000 indicates that none of the setpoint dimensions should be ignored. If bit 9 is set the floats afx afy afz should be interpreted as force instead of acceleration.
  X_IGNORE = 1  % Ignore position x
  Y_IGNORE = 2  % Ignore position y
  Z_IGNORE = 4  % Ignore position z
  VX_IGNORE = 8  % Ignore velocity x
  VY_IGNORE = 16  % Ignore velocity y
  VZ_IGNORE = 32  % Ignore velocity z
  AX_IGNORE = 64  % Ignore acceleration x
  AY_IGNORE = 128  % Ignore acceleration y
  AZ_IGNORE = 256  % Ignore acceleration z
  FORCE_SET = 512  % Use force instead of acceleration
  YAW_IGNORE = 1024  % Ignore yaw
  YAW_RATE_IGNORE = 2048  % Ignore yaw rate

MAV_ATTITUDE_TARGET_TYPEMASK_BODY_ROLL_RATE_IGNORE = Simulink.Parameter(1, StorageClass="Const")  % Ignore body roll rate
MAV_ATTITUDE_TARGET_TYPEMASK_BODY_PITCH_RATE_IGNORE = Simulink.Parameter(2, StorageClass="Const")  % Ignore body pitch rate
MAV_ATTITUDE_TARGET_TYPEMASK_BODY_YAW_RATE_IGNORE = Simulink.Parameter(4, StorageClass="Const")  % Ignore body yaw rate
MAV_ATTITUDE_TARGET_TYPEMASK_THRUST_BODY_SET = Simulink.Parameter(32, StorageClass="Const")  % Use 3D body thrust setpoint instead of throttle
MAV_ATTITUDE_TARGET_TYPEMASK_THROTTLE_IGNORE = Simulink.Parameter(64, StorageClass="Const")  % Ignore throttle
MAV_ATTITUDE_TARGET_TYPEMASK_ATTITUDE_IGNORE = Simulink.Parameter(128, StorageClass="Const")  % Ignore attitude

MAV_ATTITUDE_TARGET_TYPEMASK = enum(AddClassNameToEnumNames=true)  % Bitmap to indicate which dimensions should be ignored by the vehicle: a value of 0b00000000 indicates that none of the setpoint dimensions should be ignored.
  BODY_ROLL_RATE_IGNORE = 1  % Ignore body roll rate
  BODY_PITCH_RATE_IGNORE = 2  % Ignore body pitch rate
  BODY_YAW_RATE_IGNORE = 4  % Ignore body yaw rate
  THRUST_BODY_SET = 32  % Use 3D body thrust setpoint instead of throttle
  THROTTLE_IGNORE = 64  % Ignore throttle
  ATTITUDE_IGNORE = 128  % Ignore attitude

MAV_UTM_FLIGHT_STATE_UNKNOWN = Simulink.Parameter(1, StorageClass="Const")  % The flight state can't be determined.
MAV_UTM_FLIGHT_STATE_GROUND = Simulink.Parameter(2, StorageClass="Const")  % UAS on ground.
MAV_UTM_FLIGHT_STATE_AIRBORNE = Simulink.Parameter(3, StorageClass="Const")  % UAS airborne.
MAV_UTM_FLIGHT_STATE_EMERGENCY = Simulink.Parameter(16, StorageClass="Const")  % UAS is in an emergency flight state.
MAV_UTM_FLIGHT_STATE_NOCTRL = Simulink.Parameter(32, StorageClass="Const")  % UAS has no active controls.

MAV_UTM_FLIGHT_STATE = enum(AddClassNameToEnumNames=true)  % Airborne status of UAS.
  UNKNOWN = 1  % The flight state can't be determined.
  GROUND = 2  % UAS on ground.
  AIRBORNE = 3  % UAS airborne.
  EMERGENCY = 16  % UAS is in an emergency flight state.
  NOCTRL = 32  % UAS has no active controls.

MAV_UTM_DATA_AVAIL_FLAGS_TIME_VALID = Simulink.Parameter(1, StorageClass="Const")  % The field time contains valid data.
MAV_UTM_DATA_AVAIL_FLAGS_UAS_ID_AVAILABLE = Simulink.Parameter(2, StorageClass="Const")  % The field uas_id contains valid data.
MAV_UTM_DATA_AVAIL_FLAGS_POSITION_AVAILABLE = Simulink.Parameter(4, StorageClass="Const")  % The fields lat, lon and h_acc contain valid data.
MAV_UTM_DATA_AVAIL_FLAGS_ALTITUDE_AVAILABLE = Simulink.Parameter(8, StorageClass="Const")  % The fields alt and v_acc contain valid data.
MAV_UTM_DATA_AVAIL_FLAGS_RELATIVE_ALTITUDE_AVAILABLE = Simulink.Parameter(16, StorageClass="Const")  % The field relative_alt contains valid data.
MAV_UTM_DATA_AVAIL_FLAGS_HORIZONTAL_VELO_AVAILABLE = Simulink.Parameter(32, StorageClass="Const")  % The fields vx and vy contain valid data.
MAV_UTM_DATA_AVAIL_FLAGS_VERTICAL_VELO_AVAILABLE = Simulink.Parameter(64, StorageClass="Const")  % The field vz contains valid data.
MAV_UTM_DATA_AVAIL_FLAGS_NEXT_WAYPOINT_AVAILABLE = Simulink.Parameter(128, StorageClass="Const")  % The fields next_lat, next_lon and next_alt contain valid data.

MAV_UTM_DATA_AVAIL_FLAGS = enum(AddClassNameToEnumNames=true)  % Flags for the global position report.
  TIME_VALID = 1  % The field time contains valid data.
  UAS_ID_AVAILABLE = 2  % The field uas_id contains valid data.
  POSITION_AVAILABLE = 4  % The fields lat, lon and h_acc contain valid data.
  ALTITUDE_AVAILABLE = 8  % The fields alt and v_acc contain valid data.
  RELATIVE_ALTITUDE_AVAILABLE = 16  % The field relative_alt contains valid data.
  HORIZONTAL_VELO_AVAILABLE = 32  % The fields vx and vy contain valid data.
  VERTICAL_VELO_AVAILABLE = 64  % The field vz contains valid data.
  NEXT_WAYPOINT_AVAILABLE = 128  % The fields next_lat, next_lon and next_alt contain valid data.

MAV_CELLULAR_STATUS_FLAG_UNKNOWN = Simulink.Parameter(0, StorageClass="Const")  % State unknown or not reportable.
MAV_CELLULAR_STATUS_FLAG_FAILED = Simulink.Parameter(1, StorageClass="Const")  % Modem is unusable
MAV_CELLULAR_STATUS_FLAG_INITIALIZING = Simulink.Parameter(2, StorageClass="Const")  % Modem is being initialized
MAV_CELLULAR_STATUS_FLAG_LOCKED = Simulink.Parameter(3, StorageClass="Const")  % Modem is locked
MAV_CELLULAR_STATUS_FLAG_DISABLED = Simulink.Parameter(4, StorageClass="Const")  % Modem is not enabled and is powered down
MAV_CELLULAR_STATUS_FLAG_DISABLING = Simulink.Parameter(5, StorageClass="Const")  % Modem is currently transitioning to the CELLULAR_STATUS_FLAG_DISABLED state
MAV_CELLULAR_STATUS_FLAG_ENABLING = Simulink.Parameter(6, StorageClass="Const")  % Modem is currently transitioning to the CELLULAR_STATUS_FLAG_ENABLED state
MAV_CELLULAR_STATUS_FLAG_ENABLED = Simulink.Parameter(7, StorageClass="Const")  % Modem is enabled and powered on but not registered with a network provider and not available for data connections
MAV_CELLULAR_STATUS_FLAG_SEARCHING = Simulink.Parameter(8, StorageClass="Const")  % Modem is searching for a network provider to register
MAV_CELLULAR_STATUS_FLAG_REGISTERED = Simulink.Parameter(9, StorageClass="Const")  % Modem is registered with a network provider, and data connections and messaging may be available for use
MAV_CELLULAR_STATUS_FLAG_DISCONNECTING = Simulink.Parameter(10, StorageClass="Const")  % Modem is disconnecting and deactivating the last active packet data bearer. This state will not be entered if more than one packet data bearer is active and one of the active bearers is deactivated
MAV_CELLULAR_STATUS_FLAG_CONNECTING = Simulink.Parameter(11, StorageClass="Const")  % Modem is activating and connecting the first packet data bearer. Subsequent bearer activations when another bearer is already active do not cause this state to be entered
MAV_CELLULAR_STATUS_FLAG_CONNECTED = Simulink.Parameter(12, StorageClass="Const")  % One or more packet data bearers is active and connected

MAV_CELLULAR_STATUS_FLAG = enum(AddClassNameToEnumNames=true)  % These flags encode the cellular network status
  UNKNOWN = 0  % State unknown or not reportable.
  FAILED = 1  % Modem is unusable
  INITIALIZING = 2  % Modem is being initialized
  LOCKED = 3  % Modem is locked
  DISABLED = 4  % Modem is not enabled and is powered down
  DISABLING = 5  % Modem is currently transitioning to the CELLULAR_STATUS_FLAG_DISABLED state
  ENABLING = 6  % Modem is currently transitioning to the CELLULAR_STATUS_FLAG_ENABLED state
  ENABLED = 7  % Modem is enabled and powered on but not registered with a network provider and not available for data connections
  SEARCHING = 8  % Modem is searching for a network provider to register
  REGISTERED = 9  % Modem is registered with a network provider, and data connections and messaging may be available for use
  DISCONNECTING = 10  % Modem is disconnecting and deactivating the last active packet data bearer. This state will not be entered if more than one packet data bearer is active and one of the active bearers is deactivated
  CONNECTING = 11  % Modem is activating and connecting the first packet data bearer. Subsequent bearer activations when another bearer is already active do not cause this state to be entered
  CONNECTED = 12  % One or more packet data bearers is active and connected

MAV_CELLULAR_NETWORK_FAILED_REASON_NONE = Simulink.Parameter(0, StorageClass="Const")  % No error
MAV_CELLULAR_NETWORK_FAILED_REASON_UNKNOWN = Simulink.Parameter(1, StorageClass="Const")  % Error state is unknown
MAV_CELLULAR_NETWORK_FAILED_REASON_SIM_MISSING = Simulink.Parameter(2, StorageClass="Const")  % SIM is required for the modem but missing
MAV_CELLULAR_NETWORK_FAILED_REASON_SIM_ERROR = Simulink.Parameter(3, StorageClass="Const")  % SIM is available, but not usable for connection

MAV_CELLULAR_NETWORK_FAILED_REASON = enum(AddClassNameToEnumNames=true)  % These flags are used to diagnose the failure state of CELLULAR_STATUS
  NONE = 0  % No error
  UNKNOWN = 1  % Error state is unknown
  SIM_MISSING = 2  % SIM is required for the modem but missing
  SIM_ERROR = 3  % SIM is available, but not usable for connection

MAV_CELLULAR_NETWORK_RADIO_TYPE_NONE = Simulink.Parameter(0, StorageClass="Const")
MAV_CELLULAR_NETWORK_RADIO_TYPE_GSM = Simulink.Parameter(1, StorageClass="Const")
MAV_CELLULAR_NETWORK_RADIO_TYPE_CDMA = Simulink.Parameter(2, StorageClass="Const")
MAV_CELLULAR_NETWORK_RADIO_TYPE_WCDMA = Simulink.Parameter(3, StorageClass="Const")
MAV_CELLULAR_NETWORK_RADIO_TYPE_LTE = Simulink.Parameter(4, StorageClass="Const")

MAV_CELLULAR_NETWORK_RADIO_TYPE = enum(AddClassNameToEnumNames=true)  % Cellular network radio type
  NONE = 0
  GSM = 1
  CDMA = 2
  WCDMA = 3
  LTE = 4

MAV_PRECISION_LAND_MODE_DISABLED = Simulink.Parameter(0, StorageClass="Const")  % Normal (non-precision) landing.
MAV_PRECISION_LAND_MODE_OPPORTUNISTIC = Simulink.Parameter(1, StorageClass="Const")  % Use precision landing if beacon detected when land command accepted, otherwise land normally.
MAV_PRECISION_LAND_MODE_REQUIRED = Simulink.Parameter(2, StorageClass="Const")  % Use precision landing, searching for beacon if not found when land command accepted (land normally if beacon cannot be found).

MAV_PRECISION_LAND_MODE = enum(AddClassNameToEnumNames=true)  % Precision land modes (used in MAV_CMD_NAV_LAND).
  DISABLED = 0  % Normal (non-precision) landing.
  OPPORTUNISTIC = 1  % Use precision landing if beacon detected when land command accepted, otherwise land normally.
  REQUIRED = 2  % Use precision landing, searching for beacon if not found when land command accepted (land normally if beacon cannot be found).

MAV_PARACHUTE_DISABLE = Simulink.Parameter(0, StorageClass="Const")  % Disable auto-release of parachute (i.e. release triggered by crash detectors).
MAV_PARACHUTE_ENABLE = Simulink.Parameter(1, StorageClass="Const")  % Enable auto-release of parachute.
MAV_PARACHUTE_RELEASE = Simulink.Parameter(2, StorageClass="Const")  % Release parachute and kill motors.

MAV_PARACHUTE_ACTION = enum(AddClassNameToEnumNames=true)  % Parachute actions. Trigger release and enable/disable auto-release.
  PARACHUTE_DISABLE = 0  % Disable auto-release of parachute (i.e. release triggered by crash detectors).
  PARACHUTE_ENABLE = 1  % Enable auto-release of parachute.
  PARACHUTE_RELEASE = 2  % Release parachute and kill motors.

MAV_TUNNEL_PAYLOAD_TYPE_UNKNOWN = Simulink.Parameter(0, StorageClass="Const")  % Encoding of payload unknown.
MAV_TUNNEL_PAYLOAD_TYPE_STORM32_RESERVED0 = Simulink.Parameter(200, StorageClass="Const")  % Registered for STorM32 gimbal controller.
MAV_TUNNEL_PAYLOAD_TYPE_STORM32_RESERVED1 = Simulink.Parameter(201, StorageClass="Const")  % Registered for STorM32 gimbal controller.
MAV_TUNNEL_PAYLOAD_TYPE_STORM32_RESERVED2 = Simulink.Parameter(202, StorageClass="Const")  % Registered for STorM32 gimbal controller.
MAV_TUNNEL_PAYLOAD_TYPE_STORM32_RESERVED3 = Simulink.Parameter(203, StorageClass="Const")  % Registered for STorM32 gimbal controller.
MAV_TUNNEL_PAYLOAD_TYPE_STORM32_RESERVED4 = Simulink.Parameter(204, StorageClass="Const")  % Registered for STorM32 gimbal controller.
MAV_TUNNEL_PAYLOAD_TYPE_STORM32_RESERVED5 = Simulink.Parameter(205, StorageClass="Const")  % Registered for STorM32 gimbal controller.
MAV_TUNNEL_PAYLOAD_TYPE_STORM32_RESERVED6 = Simulink.Parameter(206, StorageClass="Const")  % Registered for STorM32 gimbal controller.
MAV_TUNNEL_PAYLOAD_TYPE_STORM32_RESERVED7 = Simulink.Parameter(207, StorageClass="Const")  % Registered for STorM32 gimbal controller.
MAV_TUNNEL_PAYLOAD_TYPE_STORM32_RESERVED8 = Simulink.Parameter(208, StorageClass="Const")  % Registered for STorM32 gimbal controller.
MAV_TUNNEL_PAYLOAD_TYPE_STORM32_RESERVED9 = Simulink.Parameter(209, StorageClass="Const")  % Registered for STorM32 gimbal controller.

MAV_TUNNEL_PAYLOAD_TYPE = enum(AddClassNameToEnumNames=true)
  UNKNOWN = 0  % Encoding of payload unknown.
  STORM32_RESERVED0 = 200  % Registered for STorM32 gimbal controller.
  STORM32_RESERVED1 = 201  % Registered for STorM32 gimbal controller.
  STORM32_RESERVED2 = 202  % Registered for STorM32 gimbal controller.
  STORM32_RESERVED3 = 203  % Registered for STorM32 gimbal controller.
  STORM32_RESERVED4 = 204  % Registered for STorM32 gimbal controller.
  STORM32_RESERVED5 = 205  % Registered for STorM32 gimbal controller.
  STORM32_RESERVED6 = 206  % Registered for STorM32 gimbal controller.
  STORM32_RESERVED7 = 207  % Registered for STorM32 gimbal controller.
  STORM32_RESERVED8 = 208  % Registered for STorM32 gimbal controller.
  STORM32_RESERVED9 = 209  % Registered for STorM32 gimbal controller.

MAV_ODID_ID_TYPE_NONE = Simulink.Parameter(0, StorageClass="Const")  % No type defined.
MAV_ODID_ID_TYPE_SERIAL_NUMBER = Simulink.Parameter(1, StorageClass="Const")  % Manufacturer Serial Number (ANSI/CTA-2063 format).
MAV_ODID_ID_TYPE_CAA_REGISTRATION_ID = Simulink.Parameter(2, StorageClass="Const")  % CAA (Civil Aviation Authority) registered ID. Format: [ICAO Country Code].[CAA Assigned ID].
MAV_ODID_ID_TYPE_UTM_ASSIGNED_UUID = Simulink.Parameter(3, StorageClass="Const")  % UTM (Unmanned Traffic Management) assigned UUID (RFC4122).
MAV_ODID_ID_TYPE_SPECIFIC_SESSION_ID = Simulink.Parameter(4, StorageClass="Const")  % A 20 byte ID for a specific flight/session. The exact ID type is indicated by the first byte of uas_id and these type values are managed by ICAO.

MAV_ODID_ID_TYPE = enum(AddClassNameToEnumNames=true)
  NONE = 0  % No type defined.
  SERIAL_NUMBER = 1  % Manufacturer Serial Number (ANSI/CTA-2063 format).
  CAA_REGISTRATION_ID = 2  % CAA (Civil Aviation Authority) registered ID. Format: [ICAO Country Code].[CAA Assigned ID].
  UTM_ASSIGNED_UUID = 3  % UTM (Unmanned Traffic Management) assigned UUID (RFC4122).
  SPECIFIC_SESSION_ID = 4  % A 20 byte ID for a specific flight/session. The exact ID type is indicated by the first byte of uas_id and these type values are managed by ICAO.

MAV_ODID_UA_TYPE_NONE = Simulink.Parameter(0, StorageClass="Const")  % No UA (Unmanned Aircraft) type defined.
MAV_ODID_UA_TYPE_AEROPLANE = Simulink.Parameter(1, StorageClass="Const")  % Aeroplane/Airplane. Fixed wing.
MAV_ODID_UA_TYPE_HELICOPTER_OR_MULTIROTOR = Simulink.Parameter(2, StorageClass="Const")  % Helicopter or multirotor.
MAV_ODID_UA_TYPE_GYROPLANE = Simulink.Parameter(3, StorageClass="Const")  % Gyroplane.
MAV_ODID_UA_TYPE_HYBRID_LIFT = Simulink.Parameter(4, StorageClass="Const")  % VTOL (Vertical Take-Off and Landing). Fixed wing aircraft that can take off vertically.
MAV_ODID_UA_TYPE_ORNITHOPTER = Simulink.Parameter(5, StorageClass="Const")  % Ornithopter.
MAV_ODID_UA_TYPE_GLIDER = Simulink.Parameter(6, StorageClass="Const")  % Glider.
MAV_ODID_UA_TYPE_KITE = Simulink.Parameter(7, StorageClass="Const")  % Kite.
MAV_ODID_UA_TYPE_FREE_BALLOON = Simulink.Parameter(8, StorageClass="Const")  % Free Balloon.
MAV_ODID_UA_TYPE_CAPTIVE_BALLOON = Simulink.Parameter(9, StorageClass="Const")  % Captive Balloon.
MAV_ODID_UA_TYPE_AIRSHIP = Simulink.Parameter(10, StorageClass="Const")  % Airship. E.g. a blimp.
MAV_ODID_UA_TYPE_FREE_FALL_PARACHUTE = Simulink.Parameter(11, StorageClass="Const")  % Free Fall/Parachute (unpowered).
MAV_ODID_UA_TYPE_ROCKET = Simulink.Parameter(12, StorageClass="Const")  % Rocket.
MAV_ODID_UA_TYPE_TETHERED_POWERED_AIRCRAFT = Simulink.Parameter(13, StorageClass="Const")  % Tethered powered aircraft.
MAV_ODID_UA_TYPE_GROUND_OBSTACLE = Simulink.Parameter(14, StorageClass="Const")  % Ground Obstacle.
MAV_ODID_UA_TYPE_OTHER = Simulink.Parameter(15, StorageClass="Const")  % Other type of aircraft not listed earlier.

MAV_ODID_UA_TYPE = enum(AddClassNameToEnumNames=true)
  NONE = 0  % No UA (Unmanned Aircraft) type defined.
  AEROPLANE = 1  % Aeroplane/Airplane. Fixed wing.
  HELICOPTER_OR_MULTIROTOR = 2  % Helicopter or multirotor.
  GYROPLANE = 3  % Gyroplane.
  HYBRID_LIFT = 4  % VTOL (Vertical Take-Off and Landing). Fixed wing aircraft that can take off vertically.
  ORNITHOPTER = 5  % Ornithopter.
  GLIDER = 6  % Glider.
  KITE = 7  % Kite.
  FREE_BALLOON = 8  % Free Balloon.
  CAPTIVE_BALLOON = 9  % Captive Balloon.
  AIRSHIP = 10  % Airship. E.g. a blimp.
  FREE_FALL_PARACHUTE = 11  % Free Fall/Parachute (unpowered).
  ROCKET = 12  % Rocket.
  TETHERED_POWERED_AIRCRAFT = 13  % Tethered powered aircraft.
  GROUND_OBSTACLE = 14  % Ground Obstacle.
  OTHER = 15  % Other type of aircraft not listed earlier.

MAV_ODID_STATUS_UNDECLARED = Simulink.Parameter(0, StorageClass="Const")  % The status of the (UA) Unmanned Aircraft is undefined.
MAV_ODID_STATUS_GROUND = Simulink.Parameter(1, StorageClass="Const")  % The UA is on the ground.
MAV_ODID_STATUS_AIRBORNE = Simulink.Parameter(2, StorageClass="Const")  % The UA is in the air.
MAV_ODID_STATUS_EMERGENCY = Simulink.Parameter(3, StorageClass="Const")  % The UA is having an emergency.
MAV_ODID_STATUS_REMOTE_ID_SYSTEM_FAILURE = Simulink.Parameter(4, StorageClass="Const")  % The remote ID system is failing or unreliable in some way.

MAV_ODID_STATUS = enum(AddClassNameToEnumNames=true)
  UNDECLARED = 0  % The status of the (UA) Unmanned Aircraft is undefined.
  GROUND = 1  % The UA is on the ground.
  AIRBORNE = 2  % The UA is in the air.
  EMERGENCY = 3  % The UA is having an emergency.
  REMOTE_ID_SYSTEM_FAILURE = 4  % The remote ID system is failing or unreliable in some way.

MAV_ODID_HEIGHT_REF_OVER_TAKEOFF = Simulink.Parameter(0, StorageClass="Const")  % The height field is relative to the take-off location.
MAV_ODID_HEIGHT_REF_OVER_GROUND = Simulink.Parameter(1, StorageClass="Const")  % The height field is relative to ground.

MAV_ODID_HEIGHT_REF = enum(AddClassNameToEnumNames=true)
  OVER_TAKEOFF = 0  % The height field is relative to the take-off location.
  OVER_GROUND = 1  % The height field is relative to ground.

MAV_ODID_HOR_ACC_UNKNOWN = Simulink.Parameter(0, StorageClass="Const")  % The horizontal accuracy is unknown.
MAV_ODID_HOR_ACC_10NM = Simulink.Parameter(1, StorageClass="Const")  % The horizontal accuracy is smaller than 10 Nautical Miles. 18.52 km.
MAV_ODID_HOR_ACC_4NM = Simulink.Parameter(2, StorageClass="Const")  % The horizontal accuracy is smaller than 4 Nautical Miles. 7.408 km.
MAV_ODID_HOR_ACC_2NM = Simulink.Parameter(3, StorageClass="Const")  % The horizontal accuracy is smaller than 2 Nautical Miles. 3.704 km.
MAV_ODID_HOR_ACC_1NM = Simulink.Parameter(4, StorageClass="Const")  % The horizontal accuracy is smaller than 1 Nautical Miles. 1.852 km.
MAV_ODID_HOR_ACC_0_5NM = Simulink.Parameter(5, StorageClass="Const")  % The horizontal accuracy is smaller than 0.5 Nautical Miles. 926 m.
MAV_ODID_HOR_ACC_0_3NM = Simulink.Parameter(6, StorageClass="Const")  % The horizontal accuracy is smaller than 0.3 Nautical Miles. 555.6 m.
MAV_ODID_HOR_ACC_0_1NM = Simulink.Parameter(7, StorageClass="Const")  % The horizontal accuracy is smaller than 0.1 Nautical Miles. 185.2 m.
MAV_ODID_HOR_ACC_0_05NM = Simulink.Parameter(8, StorageClass="Const")  % The horizontal accuracy is smaller than 0.05 Nautical Miles. 92.6 m.
MAV_ODID_HOR_ACC_30_METER = Simulink.Parameter(9, StorageClass="Const")  % The horizontal accuracy is smaller than 30 meter.
MAV_ODID_HOR_ACC_10_METER = Simulink.Parameter(10, StorageClass="Const")  % The horizontal accuracy is smaller than 10 meter.
MAV_ODID_HOR_ACC_3_METER = Simulink.Parameter(11, StorageClass="Const")  % The horizontal accuracy is smaller than 3 meter.
MAV_ODID_HOR_ACC_1_METER = Simulink.Parameter(12, StorageClass="Const")  % The horizontal accuracy is smaller than 1 meter.

MAV_ODID_HOR_ACC = enum(AddClassNameToEnumNames=true)
  UNKNOWN = 0  % The horizontal accuracy is unknown.
  x10NM = 1  % The horizontal accuracy is smaller than 10 Nautical Miles. 18.52 km.
  x4NM = 2  % The horizontal accuracy is smaller than 4 Nautical Miles. 7.408 km.
  x2NM = 3  % The horizontal accuracy is smaller than 2 Nautical Miles. 3.704 km.
  x1NM = 4  % The horizontal accuracy is smaller than 1 Nautical Miles. 1.852 km.
  x0_5NM = 5  % The horizontal accuracy is smaller than 0.5 Nautical Miles. 926 m.
  x0_3NM = 6  % The horizontal accuracy is smaller than 0.3 Nautical Miles. 555.6 m.
  x0_1NM = 7  % The horizontal accuracy is smaller than 0.1 Nautical Miles. 185.2 m.
  x0_05NM = 8  % The horizontal accuracy is smaller than 0.05 Nautical Miles. 92.6 m.
  x30_METER = 9  % The horizontal accuracy is smaller than 30 meter.
  x10_METER = 10  % The horizontal accuracy is smaller than 10 meter.
  x3_METER = 11  % The horizontal accuracy is smaller than 3 meter.
  x1_METER = 12  % The horizontal accuracy is smaller than 1 meter.

MAV_ODID_VER_ACC_UNKNOWN = Simulink.Parameter(0, StorageClass="Const")  % The vertical accuracy is unknown.
MAV_ODID_VER_ACC_150_METER = Simulink.Parameter(1, StorageClass="Const")  % The vertical accuracy is smaller than 150 meter.
MAV_ODID_VER_ACC_45_METER = Simulink.Parameter(2, StorageClass="Const")  % The vertical accuracy is smaller than 45 meter.
MAV_ODID_VER_ACC_25_METER = Simulink.Parameter(3, StorageClass="Const")  % The vertical accuracy is smaller than 25 meter.
MAV_ODID_VER_ACC_10_METER = Simulink.Parameter(4, StorageClass="Const")  % The vertical accuracy is smaller than 10 meter.
MAV_ODID_VER_ACC_3_METER = Simulink.Parameter(5, StorageClass="Const")  % The vertical accuracy is smaller than 3 meter.
MAV_ODID_VER_ACC_1_METER = Simulink.Parameter(6, StorageClass="Const")  % The vertical accuracy is smaller than 1 meter.

MAV_ODID_VER_ACC = enum(AddClassNameToEnumNames=true)
  UNKNOWN = 0  % The vertical accuracy is unknown.
  x150_METER = 1  % The vertical accuracy is smaller than 150 meter.
  x45_METER = 2  % The vertical accuracy is smaller than 45 meter.
  x25_METER = 3  % The vertical accuracy is smaller than 25 meter.
  x10_METER = 4  % The vertical accuracy is smaller than 10 meter.
  x3_METER = 5  % The vertical accuracy is smaller than 3 meter.
  x1_METER = 6  % The vertical accuracy is smaller than 1 meter.

MAV_ODID_SPEED_ACC_UNKNOWN = Simulink.Parameter(0, StorageClass="Const")  % The speed accuracy is unknown.
MAV_ODID_SPEED_ACC_10_METERS_PER_SECOND = Simulink.Parameter(1, StorageClass="Const")  % The speed accuracy is smaller than 10 meters per second.
MAV_ODID_SPEED_ACC_3_METERS_PER_SECOND = Simulink.Parameter(2, StorageClass="Const")  % The speed accuracy is smaller than 3 meters per second.
MAV_ODID_SPEED_ACC_1_METERS_PER_SECOND = Simulink.Parameter(3, StorageClass="Const")  % The speed accuracy is smaller than 1 meters per second.
MAV_ODID_SPEED_ACC_0_3_METERS_PER_SECOND = Simulink.Parameter(4, StorageClass="Const")  % The speed accuracy is smaller than 0.3 meters per second.

MAV_ODID_SPEED_ACC = enum(AddClassNameToEnumNames=true)
  UNKNOWN = 0  % The speed accuracy is unknown.
  x10_METERS_PER_SECOND = 1  % The speed accuracy is smaller than 10 meters per second.
  x3_METERS_PER_SECOND = 2  % The speed accuracy is smaller than 3 meters per second.
  x1_METERS_PER_SECOND = 3  % The speed accuracy is smaller than 1 meters per second.
  x0_3_METERS_PER_SECOND = 4  % The speed accuracy is smaller than 0.3 meters per second.

MAV_ODID_TIME_ACC_UNKNOWN = Simulink.Parameter(0, StorageClass="Const")  % The timestamp accuracy is unknown.
MAV_ODID_TIME_ACC_0_1_SECOND = Simulink.Parameter(1, StorageClass="Const")  % The timestamp accuracy is smaller than or equal to 0.1 second.
MAV_ODID_TIME_ACC_0_2_SECOND = Simulink.Parameter(2, StorageClass="Const")  % The timestamp accuracy is smaller than or equal to 0.2 second.
MAV_ODID_TIME_ACC_0_3_SECOND = Simulink.Parameter(3, StorageClass="Const")  % The timestamp accuracy is smaller than or equal to 0.3 second.
MAV_ODID_TIME_ACC_0_4_SECOND = Simulink.Parameter(4, StorageClass="Const")  % The timestamp accuracy is smaller than or equal to 0.4 second.
MAV_ODID_TIME_ACC_0_5_SECOND = Simulink.Parameter(5, StorageClass="Const")  % The timestamp accuracy is smaller than or equal to 0.5 second.
MAV_ODID_TIME_ACC_0_6_SECOND = Simulink.Parameter(6, StorageClass="Const")  % The timestamp accuracy is smaller than or equal to 0.6 second.
MAV_ODID_TIME_ACC_0_7_SECOND = Simulink.Parameter(7, StorageClass="Const")  % The timestamp accuracy is smaller than or equal to 0.7 second.
MAV_ODID_TIME_ACC_0_8_SECOND = Simulink.Parameter(8, StorageClass="Const")  % The timestamp accuracy is smaller than or equal to 0.8 second.
MAV_ODID_TIME_ACC_0_9_SECOND = Simulink.Parameter(9, StorageClass="Const")  % The timestamp accuracy is smaller than or equal to 0.9 second.
MAV_ODID_TIME_ACC_1_0_SECOND = Simulink.Parameter(10, StorageClass="Const")  % The timestamp accuracy is smaller than or equal to 1.0 second.
MAV_ODID_TIME_ACC_1_1_SECOND = Simulink.Parameter(11, StorageClass="Const")  % The timestamp accuracy is smaller than or equal to 1.1 second.
MAV_ODID_TIME_ACC_1_2_SECOND = Simulink.Parameter(12, StorageClass="Const")  % The timestamp accuracy is smaller than or equal to 1.2 second.
MAV_ODID_TIME_ACC_1_3_SECOND = Simulink.Parameter(13, StorageClass="Const")  % The timestamp accuracy is smaller than or equal to 1.3 second.
MAV_ODID_TIME_ACC_1_4_SECOND = Simulink.Parameter(14, StorageClass="Const")  % The timestamp accuracy is smaller than or equal to 1.4 second.
MAV_ODID_TIME_ACC_1_5_SECOND = Simulink.Parameter(15, StorageClass="Const")  % The timestamp accuracy is smaller than or equal to 1.5 second.

MAV_ODID_TIME_ACC = enum(AddClassNameToEnumNames=true)
  UNKNOWN = 0  % The timestamp accuracy is unknown.
  x0_1_SECOND = 1  % The timestamp accuracy is smaller than or equal to 0.1 second.
  x0_2_SECOND = 2  % The timestamp accuracy is smaller than or equal to 0.2 second.
  x0_3_SECOND = 3  % The timestamp accuracy is smaller than or equal to 0.3 second.
  x0_4_SECOND = 4  % The timestamp accuracy is smaller than or equal to 0.4 second.
  x0_5_SECOND = 5  % The timestamp accuracy is smaller than or equal to 0.5 second.
  x0_6_SECOND = 6  % The timestamp accuracy is smaller than or equal to 0.6 second.
  x0_7_SECOND = 7  % The timestamp accuracy is smaller than or equal to 0.7 second.
  x0_8_SECOND = 8  % The timestamp accuracy is smaller than or equal to 0.8 second.
  x0_9_SECOND = 9  % The timestamp accuracy is smaller than or equal to 0.9 second.
  x1_0_SECOND = 10  % The timestamp accuracy is smaller than or equal to 1.0 second.
  x1_1_SECOND = 11  % The timestamp accuracy is smaller than or equal to 1.1 second.
  x1_2_SECOND = 12  % The timestamp accuracy is smaller than or equal to 1.2 second.
  x1_3_SECOND = 13  % The timestamp accuracy is smaller than or equal to 1.3 second.
  x1_4_SECOND = 14  % The timestamp accuracy is smaller than or equal to 1.4 second.
  x1_5_SECOND = 15  % The timestamp accuracy is smaller than or equal to 1.5 second.

MAV_ODID_AUTH_TYPE_NONE = Simulink.Parameter(0, StorageClass="Const")  % No authentication type is specified.
MAV_ODID_AUTH_TYPE_UAS_ID_SIGNATURE = Simulink.Parameter(1, StorageClass="Const")  % Signature for the UAS (Unmanned Aircraft System) ID.
MAV_ODID_AUTH_TYPE_OPERATOR_ID_SIGNATURE = Simulink.Parameter(2, StorageClass="Const")  % Signature for the Operator ID.
MAV_ODID_AUTH_TYPE_MESSAGE_SET_SIGNATURE = Simulink.Parameter(3, StorageClass="Const")  % Signature for the entire message set.
MAV_ODID_AUTH_TYPE_NETWORK_REMOTE_ID = Simulink.Parameter(4, StorageClass="Const")  % Authentication is provided by Network Remote ID.
MAV_ODID_AUTH_TYPE_SPECIFIC_AUTHENTICATION = Simulink.Parameter(5, StorageClass="Const")  % The exact authentication type is indicated by the first byte of authentication_data and these type values are managed by ICAO.

MAV_ODID_AUTH_TYPE = enum(AddClassNameToEnumNames=true)
  NONE = 0  % No authentication type is specified.
  UAS_ID_SIGNATURE = 1  % Signature for the UAS (Unmanned Aircraft System) ID.
  OPERATOR_ID_SIGNATURE = 2  % Signature for the Operator ID.
  MESSAGE_SET_SIGNATURE = 3  % Signature for the entire message set.
  NETWORK_REMOTE_ID = 4  % Authentication is provided by Network Remote ID.
  SPECIFIC_AUTHENTICATION = 5  % The exact authentication type is indicated by the first byte of authentication_data and these type values are managed by ICAO.

MAV_ODID_DESC_TYPE_TEXT = Simulink.Parameter(0, StorageClass="Const")  % Optional free-form text description of the purpose of the flight.
MAV_ODID_DESC_TYPE_EMERGENCY = Simulink.Parameter(1, StorageClass="Const")  % Optional additional clarification when status == MAV_ODID_STATUS_EMERGENCY.
MAV_ODID_DESC_TYPE_EXTENDED_STATUS = Simulink.Parameter(2, StorageClass="Const")  % Optional additional clarification when status != MAV_ODID_STATUS_EMERGENCY.

MAV_ODID_DESC_TYPE = enum(AddClassNameToEnumNames=true)
  TEXT = 0  % Optional free-form text description of the purpose of the flight.
  EMERGENCY = 1  % Optional additional clarification when status == MAV_ODID_STATUS_EMERGENCY.
  EXTENDED_STATUS = 2  % Optional additional clarification when status != MAV_ODID_STATUS_EMERGENCY.

MAV_ODID_OPERATOR_LOCATION_TYPE_TAKEOFF = Simulink.Parameter(0, StorageClass="Const")  % The location/altitude of the operator is the same as the take-off location.
MAV_ODID_OPERATOR_LOCATION_TYPE_LIVE_GNSS = Simulink.Parameter(1, StorageClass="Const")  % The location/altitude of the operator is dynamic. E.g. based on live GNSS data.
MAV_ODID_OPERATOR_LOCATION_TYPE_FIXED = Simulink.Parameter(2, StorageClass="Const")  % The location/altitude of the operator are fixed values.

MAV_ODID_OPERATOR_LOCATION_TYPE = enum(AddClassNameToEnumNames=true)
  TAKEOFF = 0  % The location/altitude of the operator is the same as the take-off location.
  LIVE_GNSS = 1  % The location/altitude of the operator is dynamic. E.g. based on live GNSS data.
  FIXED = 2  % The location/altitude of the operator are fixed values.

MAV_ODID_CLASSIFICATION_TYPE_UNDECLARED = Simulink.Parameter(0, StorageClass="Const")  % The classification type for the UA is undeclared.
MAV_ODID_CLASSIFICATION_TYPE_EU = Simulink.Parameter(1, StorageClass="Const")  % The classification type for the UA follows EU (European Union) specifications.

MAV_ODID_CLASSIFICATION_TYPE = enum(AddClassNameToEnumNames=true)
  UNDECLARED = 0  % The classification type for the UA is undeclared.
  EU = 1  % The classification type for the UA follows EU (European Union) specifications.

MAV_ODID_CATEGORY_EU_UNDECLARED = Simulink.Parameter(0, StorageClass="Const")  % The category for the UA, according to the EU specification, is undeclared.
MAV_ODID_CATEGORY_EU_OPEN = Simulink.Parameter(1, StorageClass="Const")  % The category for the UA, according to the EU specification, is the Open category.
MAV_ODID_CATEGORY_EU_SPECIFIC = Simulink.Parameter(2, StorageClass="Const")  % The category for the UA, according to the EU specification, is the Specific category.
MAV_ODID_CATEGORY_EU_CERTIFIED = Simulink.Parameter(3, StorageClass="Const")  % The category for the UA, according to the EU specification, is the Certified category.

MAV_ODID_CATEGORY_EU = enum(AddClassNameToEnumNames=true)
  UNDECLARED = 0  % The category for the UA, according to the EU specification, is undeclared.
  OPEN = 1  % The category for the UA, according to the EU specification, is the Open category.
  SPECIFIC = 2  % The category for the UA, according to the EU specification, is the Specific category.
  CERTIFIED = 3  % The category for the UA, according to the EU specification, is the Certified category.

MAV_ODID_CLASS_EU_UNDECLARED = Simulink.Parameter(0, StorageClass="Const")  % The class for the UA, according to the EU specification, is undeclared.
MAV_ODID_CLASS_EU_CLASS_0 = Simulink.Parameter(1, StorageClass="Const")  % The class for the UA, according to the EU specification, is Class 0.
MAV_ODID_CLASS_EU_CLASS_1 = Simulink.Parameter(2, StorageClass="Const")  % The class for the UA, according to the EU specification, is Class 1.
MAV_ODID_CLASS_EU_CLASS_2 = Simulink.Parameter(3, StorageClass="Const")  % The class for the UA, according to the EU specification, is Class 2.
MAV_ODID_CLASS_EU_CLASS_3 = Simulink.Parameter(4, StorageClass="Const")  % The class for the UA, according to the EU specification, is Class 3.
MAV_ODID_CLASS_EU_CLASS_4 = Simulink.Parameter(5, StorageClass="Const")  % The class for the UA, according to the EU specification, is Class 4.
MAV_ODID_CLASS_EU_CLASS_5 = Simulink.Parameter(6, StorageClass="Const")  % The class for the UA, according to the EU specification, is Class 5.
MAV_ODID_CLASS_EU_CLASS_6 = Simulink.Parameter(7, StorageClass="Const")  % The class for the UA, according to the EU specification, is Class 6.

MAV_ODID_CLASS_EU = enum(AddClassNameToEnumNames=true)
  UNDECLARED = 0  % The class for the UA, according to the EU specification, is undeclared.
  CLASS_0 = 1  % The class for the UA, according to the EU specification, is Class 0.
  CLASS_1 = 2  % The class for the UA, according to the EU specification, is Class 1.
  CLASS_2 = 3  % The class for the UA, according to the EU specification, is Class 2.
  CLASS_3 = 4  % The class for the UA, according to the EU specification, is Class 3.
  CLASS_4 = 5  % The class for the UA, according to the EU specification, is Class 4.
  CLASS_5 = 6  % The class for the UA, according to the EU specification, is Class 5.
  CLASS_6 = 7  % The class for the UA, according to the EU specification, is Class 6.

MAV_ODID_OPERATOR_ID_TYPE_CAA = Simulink.Parameter(0, StorageClass="Const")  % CAA (Civil Aviation Authority) registered operator ID.

MAV_ODID_OPERATOR_ID_TYPE = enum(AddClassNameToEnumNames=true)
  CAA = 0  % CAA (Civil Aviation Authority) registered operator ID.

MAV_ODID_ARM_STATUS_GOOD_TO_ARM = Simulink.Parameter(0, StorageClass="Const")  % Passing arming checks.
MAV_ODID_ARM_STATUS_PRE_ARM_FAIL_GENERIC = Simulink.Parameter(1, StorageClass="Const")  % Generic arming failure, see error string for details.

MAV_ODID_ARM_STATUS = enum(AddClassNameToEnumNames=true)
  GOOD_TO_ARM = 0  % Passing arming checks.
  PRE_ARM_FAIL_GENERIC = 1  % Generic arming failure, see error string for details.

MAV_TUNE_FORMAT_QBASIC1_1 = Simulink.Parameter(1, StorageClass="Const")  % Format is QBasic 1.1 Play: https://www.qbasic.net/en/reference/qb11/Statement/PLAY-006.htm.
MAV_TUNE_FORMAT_MML_MODERN = Simulink.Parameter(2, StorageClass="Const")  % Format is Modern Music Markup Language (MML): https://en.wikipedia.org/wiki/Music_Macro_Language#Modern_MML.

MAV_TUNE_FORMAT = enum(AddClassNameToEnumNames=true)  % Tune formats (used for vehicle buzzer/tone generation).
  QBASIC1_1 = 1  % Format is QBasic 1.1 Play: https://www.qbasic.net/en/reference/qb11/Statement/PLAY-006.htm.
  MML_MODERN = 2  % Format is Modern Music Markup Language (MML): https://en.wikipedia.org/wiki/Music_Macro_Language#Modern_MML.

MAV_AIS_TYPE_UNKNOWN = Simulink.Parameter(0, StorageClass="Const")  % Not available (default).
MAV_AIS_TYPE_RESERVED_1 = Simulink.Parameter(1, StorageClass="Const")
MAV_AIS_TYPE_RESERVED_2 = Simulink.Parameter(2, StorageClass="Const")
MAV_AIS_TYPE_RESERVED_3 = Simulink.Parameter(3, StorageClass="Const")
MAV_AIS_TYPE_RESERVED_4 = Simulink.Parameter(4, StorageClass="Const")
MAV_AIS_TYPE_RESERVED_5 = Simulink.Parameter(5, StorageClass="Const")
MAV_AIS_TYPE_RESERVED_6 = Simulink.Parameter(6, StorageClass="Const")
MAV_AIS_TYPE_RESERVED_7 = Simulink.Parameter(7, StorageClass="Const")
MAV_AIS_TYPE_RESERVED_8 = Simulink.Parameter(8, StorageClass="Const")
MAV_AIS_TYPE_RESERVED_9 = Simulink.Parameter(9, StorageClass="Const")
MAV_AIS_TYPE_RESERVED_10 = Simulink.Parameter(10, StorageClass="Const")
MAV_AIS_TYPE_RESERVED_11 = Simulink.Parameter(11, StorageClass="Const")
MAV_AIS_TYPE_RESERVED_12 = Simulink.Parameter(12, StorageClass="Const")
MAV_AIS_TYPE_RESERVED_13 = Simulink.Parameter(13, StorageClass="Const")
MAV_AIS_TYPE_RESERVED_14 = Simulink.Parameter(14, StorageClass="Const")
MAV_AIS_TYPE_RESERVED_15 = Simulink.Parameter(15, StorageClass="Const")
MAV_AIS_TYPE_RESERVED_16 = Simulink.Parameter(16, StorageClass="Const")
MAV_AIS_TYPE_RESERVED_17 = Simulink.Parameter(17, StorageClass="Const")
MAV_AIS_TYPE_RESERVED_18 = Simulink.Parameter(18, StorageClass="Const")
MAV_AIS_TYPE_RESERVED_19 = Simulink.Parameter(19, StorageClass="Const")
MAV_AIS_TYPE_WIG = Simulink.Parameter(20, StorageClass="Const")  % Wing In Ground effect.
MAV_AIS_TYPE_WIG_HAZARDOUS_A = Simulink.Parameter(21, StorageClass="Const")
MAV_AIS_TYPE_WIG_HAZARDOUS_B = Simulink.Parameter(22, StorageClass="Const")
MAV_AIS_TYPE_WIG_HAZARDOUS_C = Simulink.Parameter(23, StorageClass="Const")
MAV_AIS_TYPE_WIG_HAZARDOUS_D = Simulink.Parameter(24, StorageClass="Const")
MAV_AIS_TYPE_WIG_RESERVED_1 = Simulink.Parameter(25, StorageClass="Const")
MAV_AIS_TYPE_WIG_RESERVED_2 = Simulink.Parameter(26, StorageClass="Const")
MAV_AIS_TYPE_WIG_RESERVED_3 = Simulink.Parameter(27, StorageClass="Const")
MAV_AIS_TYPE_WIG_RESERVED_4 = Simulink.Parameter(28, StorageClass="Const")
MAV_AIS_TYPE_WIG_RESERVED_5 = Simulink.Parameter(29, StorageClass="Const")
MAV_AIS_TYPE_FISHING = Simulink.Parameter(30, StorageClass="Const")
MAV_AIS_TYPE_TOWING = Simulink.Parameter(31, StorageClass="Const")
MAV_AIS_TYPE_TOWING_LARGE = Simulink.Parameter(32, StorageClass="Const")  % Towing: length exceeds 200m or breadth exceeds 25m.
MAV_AIS_TYPE_DREDGING = Simulink.Parameter(33, StorageClass="Const")  % Dredging or other underwater ops.
MAV_AIS_TYPE_DIVING = Simulink.Parameter(34, StorageClass="Const")
MAV_AIS_TYPE_MILITARY = Simulink.Parameter(35, StorageClass="Const")
MAV_AIS_TYPE_SAILING = Simulink.Parameter(36, StorageClass="Const")
MAV_AIS_TYPE_PLEASURE = Simulink.Parameter(37, StorageClass="Const")
MAV_AIS_TYPE_RESERVED_20 = Simulink.Parameter(38, StorageClass="Const")
MAV_AIS_TYPE_RESERVED_21 = Simulink.Parameter(39, StorageClass="Const")
MAV_AIS_TYPE_HSC = Simulink.Parameter(40, StorageClass="Const")  % High Speed Craft.
MAV_AIS_TYPE_HSC_HAZARDOUS_A = Simulink.Parameter(41, StorageClass="Const")
MAV_AIS_TYPE_HSC_HAZARDOUS_B = Simulink.Parameter(42, StorageClass="Const")
MAV_AIS_TYPE_HSC_HAZARDOUS_C = Simulink.Parameter(43, StorageClass="Const")
MAV_AIS_TYPE_HSC_HAZARDOUS_D = Simulink.Parameter(44, StorageClass="Const")
MAV_AIS_TYPE_HSC_RESERVED_1 = Simulink.Parameter(45, StorageClass="Const")
MAV_AIS_TYPE_HSC_RESERVED_2 = Simulink.Parameter(46, StorageClass="Const")
MAV_AIS_TYPE_HSC_RESERVED_3 = Simulink.Parameter(47, StorageClass="Const")
MAV_AIS_TYPE_HSC_RESERVED_4 = Simulink.Parameter(48, StorageClass="Const")
MAV_AIS_TYPE_HSC_UNKNOWN = Simulink.Parameter(49, StorageClass="Const")
MAV_AIS_TYPE_PILOT = Simulink.Parameter(50, StorageClass="Const")
MAV_AIS_TYPE_SAR = Simulink.Parameter(51, StorageClass="Const")  % Search And Rescue vessel.
MAV_AIS_TYPE_TUG = Simulink.Parameter(52, StorageClass="Const")
MAV_AIS_TYPE_PORT_TENDER = Simulink.Parameter(53, StorageClass="Const")
MAV_AIS_TYPE_ANTI_POLLUTION = Simulink.Parameter(54, StorageClass="Const")  % Anti-pollution equipment.
MAV_AIS_TYPE_LAW_ENFORCEMENT = Simulink.Parameter(55, StorageClass="Const")
MAV_AIS_TYPE_SPARE_LOCAL_1 = Simulink.Parameter(56, StorageClass="Const")
MAV_AIS_TYPE_SPARE_LOCAL_2 = Simulink.Parameter(57, StorageClass="Const")
MAV_AIS_TYPE_MEDICAL_TRANSPORT = Simulink.Parameter(58, StorageClass="Const")
MAV_AIS_TYPE_NONECOMBATANT = Simulink.Parameter(59, StorageClass="Const")  % Noncombatant ship according to RR Resolution No. 18.
MAV_AIS_TYPE_PASSENGER = Simulink.Parameter(60, StorageClass="Const")
MAV_AIS_TYPE_PASSENGER_HAZARDOUS_A = Simulink.Parameter(61, StorageClass="Const")
MAV_AIS_TYPE_PASSENGER_HAZARDOUS_B = Simulink.Parameter(62, StorageClass="Const")
MAV_AIS_TYPE_PASSENGER_HAZARDOUS_C = Simulink.Parameter(63, StorageClass="Const")
MAV_AIS_TYPE_PASSENGER_HAZARDOUS_D = Simulink.Parameter(64, StorageClass="Const")
MAV_AIS_TYPE_PASSENGER_RESERVED_1 = Simulink.Parameter(65, StorageClass="Const")
MAV_AIS_TYPE_PASSENGER_RESERVED_2 = Simulink.Parameter(66, StorageClass="Const")
MAV_AIS_TYPE_PASSENGER_RESERVED_3 = Simulink.Parameter(67, StorageClass="Const")
MAV_AIS_TYPE_PASSENGER_RESERVED_4 = Simulink.Parameter(68, StorageClass="Const")
MAV_AIS_TYPE_PASSENGER_UNKNOWN = Simulink.Parameter(69, StorageClass="Const")
MAV_AIS_TYPE_CARGO = Simulink.Parameter(70, StorageClass="Const")
MAV_AIS_TYPE_CARGO_HAZARDOUS_A = Simulink.Parameter(71, StorageClass="Const")
MAV_AIS_TYPE_CARGO_HAZARDOUS_B = Simulink.Parameter(72, StorageClass="Const")
MAV_AIS_TYPE_CARGO_HAZARDOUS_C = Simulink.Parameter(73, StorageClass="Const")
MAV_AIS_TYPE_CARGO_HAZARDOUS_D = Simulink.Parameter(74, StorageClass="Const")
MAV_AIS_TYPE_CARGO_RESERVED_1 = Simulink.Parameter(75, StorageClass="Const")
MAV_AIS_TYPE_CARGO_RESERVED_2 = Simulink.Parameter(76, StorageClass="Const")
MAV_AIS_TYPE_CARGO_RESERVED_3 = Simulink.Parameter(77, StorageClass="Const")
MAV_AIS_TYPE_CARGO_RESERVED_4 = Simulink.Parameter(78, StorageClass="Const")
MAV_AIS_TYPE_CARGO_UNKNOWN = Simulink.Parameter(79, StorageClass="Const")
MAV_AIS_TYPE_TANKER = Simulink.Parameter(80, StorageClass="Const")
MAV_AIS_TYPE_TANKER_HAZARDOUS_A = Simulink.Parameter(81, StorageClass="Const")
MAV_AIS_TYPE_TANKER_HAZARDOUS_B = Simulink.Parameter(82, StorageClass="Const")
MAV_AIS_TYPE_TANKER_HAZARDOUS_C = Simulink.Parameter(83, StorageClass="Const")
MAV_AIS_TYPE_TANKER_HAZARDOUS_D = Simulink.Parameter(84, StorageClass="Const")
MAV_AIS_TYPE_TANKER_RESERVED_1 = Simulink.Parameter(85, StorageClass="Const")
MAV_AIS_TYPE_TANKER_RESERVED_2 = Simulink.Parameter(86, StorageClass="Const")
MAV_AIS_TYPE_TANKER_RESERVED_3 = Simulink.Parameter(87, StorageClass="Const")
MAV_AIS_TYPE_TANKER_RESERVED_4 = Simulink.Parameter(88, StorageClass="Const")
MAV_AIS_TYPE_TANKER_UNKNOWN = Simulink.Parameter(89, StorageClass="Const")
MAV_AIS_TYPE_OTHER = Simulink.Parameter(90, StorageClass="Const")
MAV_AIS_TYPE_OTHER_HAZARDOUS_A = Simulink.Parameter(91, StorageClass="Const")
MAV_AIS_TYPE_OTHER_HAZARDOUS_B = Simulink.Parameter(92, StorageClass="Const")
MAV_AIS_TYPE_OTHER_HAZARDOUS_C = Simulink.Parameter(93, StorageClass="Const")
MAV_AIS_TYPE_OTHER_HAZARDOUS_D = Simulink.Parameter(94, StorageClass="Const")
MAV_AIS_TYPE_OTHER_RESERVED_1 = Simulink.Parameter(95, StorageClass="Const")
MAV_AIS_TYPE_OTHER_RESERVED_2 = Simulink.Parameter(96, StorageClass="Const")
MAV_AIS_TYPE_OTHER_RESERVED_3 = Simulink.Parameter(97, StorageClass="Const")
MAV_AIS_TYPE_OTHER_RESERVED_4 = Simulink.Parameter(98, StorageClass="Const")
MAV_AIS_TYPE_OTHER_UNKNOWN = Simulink.Parameter(99, StorageClass="Const")

MAV_AIS_TYPE = enum(AddClassNameToEnumNames=true)  % Type of AIS vessel, enum duplicated from AIS standard, https://gpsd.gitlab.io/gpsd/AIVDM.html
  UNKNOWN = 0  % Not available (default).
  RESERVED_1 = 1
  RESERVED_2 = 2
  RESERVED_3 = 3
  RESERVED_4 = 4
  RESERVED_5 = 5
  RESERVED_6 = 6
  RESERVED_7 = 7
  RESERVED_8 = 8
  RESERVED_9 = 9
  RESERVED_10 = 10
  RESERVED_11 = 11
  RESERVED_12 = 12
  RESERVED_13 = 13
  RESERVED_14 = 14
  RESERVED_15 = 15
  RESERVED_16 = 16
  RESERVED_17 = 17
  RESERVED_18 = 18
  RESERVED_19 = 19
  WIG = 20  % Wing In Ground effect.
  WIG_HAZARDOUS_A = 21
  WIG_HAZARDOUS_B = 22
  WIG_HAZARDOUS_C = 23
  WIG_HAZARDOUS_D = 24
  WIG_RESERVED_1 = 25
  WIG_RESERVED_2 = 26
  WIG_RESERVED_3 = 27
  WIG_RESERVED_4 = 28
  WIG_RESERVED_5 = 29
  FISHING = 30
  TOWING = 31
  TOWING_LARGE = 32  % Towing: length exceeds 200m or breadth exceeds 25m.
  DREDGING = 33  % Dredging or other underwater ops.
  DIVING = 34
  MILITARY = 35
  SAILING = 36
  PLEASURE = 37
  RESERVED_20 = 38
  RESERVED_21 = 39
  HSC = 40  % High Speed Craft.
  HSC_HAZARDOUS_A = 41
  HSC_HAZARDOUS_B = 42
  HSC_HAZARDOUS_C = 43
  HSC_HAZARDOUS_D = 44
  HSC_RESERVED_1 = 45
  HSC_RESERVED_2 = 46
  HSC_RESERVED_3 = 47
  HSC_RESERVED_4 = 48
  HSC_UNKNOWN = 49
  PILOT = 50
  SAR = 51  % Search And Rescue vessel.
  TUG = 52
  PORT_TENDER = 53
  ANTI_POLLUTION = 54  % Anti-pollution equipment.
  LAW_ENFORCEMENT = 55
  SPARE_LOCAL_1 = 56
  SPARE_LOCAL_2 = 57
  MEDICAL_TRANSPORT = 58
  NONECOMBATANT = 59  % Noncombatant ship according to RR Resolution No. 18.
  PASSENGER = 60
  PASSENGER_HAZARDOUS_A = 61
  PASSENGER_HAZARDOUS_B = 62
  PASSENGER_HAZARDOUS_C = 63
  PASSENGER_HAZARDOUS_D = 64
  PASSENGER_RESERVED_1 = 65
  PASSENGER_RESERVED_2 = 66
  PASSENGER_RESERVED_3 = 67
  PASSENGER_RESERVED_4 = 68
  PASSENGER_UNKNOWN = 69
  CARGO = 70
  CARGO_HAZARDOUS_A = 71
  CARGO_HAZARDOUS_B = 72
  CARGO_HAZARDOUS_C = 73
  CARGO_HAZARDOUS_D = 74
  CARGO_RESERVED_1 = 75
  CARGO_RESERVED_2 = 76
  CARGO_RESERVED_3 = 77
  CARGO_RESERVED_4 = 78
  CARGO_UNKNOWN = 79
  TANKER = 80
  TANKER_HAZARDOUS_A = 81
  TANKER_HAZARDOUS_B = 82
  TANKER_HAZARDOUS_C = 83
  TANKER_HAZARDOUS_D = 84
  TANKER_RESERVED_1 = 85
  TANKER_RESERVED_2 = 86
  TANKER_RESERVED_3 = 87
  TANKER_RESERVED_4 = 88
  TANKER_UNKNOWN = 89
  OTHER = 90
  OTHER_HAZARDOUS_A = 91
  OTHER_HAZARDOUS_B = 92
  OTHER_HAZARDOUS_C = 93
  OTHER_HAZARDOUS_D = 94
  OTHER_RESERVED_1 = 95
  OTHER_RESERVED_2 = 96
  OTHER_RESERVED_3 = 97
  OTHER_RESERVED_4 = 98
  OTHER_UNKNOWN = 99

MAV_UNDER_WAY = Simulink.Parameter(0, StorageClass="Const")  % Under way using engine.
MAV_AIS_NAV_ANCHORED = Simulink.Parameter(1, StorageClass="Const")
MAV_AIS_NAV_UN_COMMANDED = Simulink.Parameter(2, StorageClass="Const")
MAV_AIS_NAV_RESTRICTED_MANOEUVERABILITY = Simulink.Parameter(3, StorageClass="Const")
MAV_AIS_NAV_DRAUGHT_CONSTRAINED = Simulink.Parameter(4, StorageClass="Const")
MAV_AIS_NAV_MOORED = Simulink.Parameter(5, StorageClass="Const")
MAV_AIS_NAV_AGROUND = Simulink.Parameter(6, StorageClass="Const")
MAV_AIS_NAV_FISHING = Simulink.Parameter(7, StorageClass="Const")
MAV_AIS_NAV_SAILING = Simulink.Parameter(8, StorageClass="Const")
MAV_AIS_NAV_RESERVED_HSC = Simulink.Parameter(9, StorageClass="Const")
MAV_AIS_NAV_RESERVED_WIG = Simulink.Parameter(10, StorageClass="Const")
MAV_AIS_NAV_RESERVED_1 = Simulink.Parameter(11, StorageClass="Const")
MAV_AIS_NAV_RESERVED_2 = Simulink.Parameter(12, StorageClass="Const")
MAV_AIS_NAV_RESERVED_3 = Simulink.Parameter(13, StorageClass="Const")
MAV_AIS_NAV_AIS_SART = Simulink.Parameter(14, StorageClass="Const")  % Search And Rescue Transponder.
MAV_AIS_NAV_UNKNOWN = Simulink.Parameter(15, StorageClass="Const")  % Not available (default).

MAV_AIS_NAV_STATUS = enum(AddClassNameToEnumNames=true)  % Navigational status of AIS vessel, enum duplicated from AIS standard, https://gpsd.gitlab.io/gpsd/AIVDM.html
  UNDER_WAY = 0  % Under way using engine.
  AIS_NAV_ANCHORED = 1
  AIS_NAV_UN_COMMANDED = 2
  AIS_NAV_RESTRICTED_MANOEUVERABILITY = 3
  AIS_NAV_DRAUGHT_CONSTRAINED = 4
  AIS_NAV_MOORED = 5
  AIS_NAV_AGROUND = 6
  AIS_NAV_FISHING = 7
  AIS_NAV_SAILING = 8
  AIS_NAV_RESERVED_HSC = 9
  AIS_NAV_RESERVED_WIG = 10
  AIS_NAV_RESERVED_1 = 11
  AIS_NAV_RESERVED_2 = 12
  AIS_NAV_RESERVED_3 = 13
  AIS_NAV_AIS_SART = 14  % Search And Rescue Transponder.
  AIS_NAV_UNKNOWN = 15  % Not available (default).

MAV_AIS_FLAGS_POSITION_ACCURACY = Simulink.Parameter(1, StorageClass="Const")  % 1 = Position accuracy less than 10m, 0 = position accuracy greater than 10m.
MAV_AIS_FLAGS_VALID_COG = Simulink.Parameter(2, StorageClass="Const")
MAV_AIS_FLAGS_VALID_VELOCITY = Simulink.Parameter(4, StorageClass="Const")
MAV_AIS_FLAGS_HIGH_VELOCITY = Simulink.Parameter(8, StorageClass="Const")  % 1 = Velocity over 52.5765m/s (102.2 knots)
MAV_AIS_FLAGS_VALID_TURN_RATE = Simulink.Parameter(16, StorageClass="Const")
MAV_AIS_FLAGS_TURN_RATE_SIGN_ONLY = Simulink.Parameter(32, StorageClass="Const")  % Only the sign of the returned turn rate value is valid, either greater than 5deg/30s or less than -5deg/30s
MAV_AIS_FLAGS_VALID_DIMENSIONS = Simulink.Parameter(64, StorageClass="Const")
MAV_AIS_FLAGS_LARGE_BOW_DIMENSION = Simulink.Parameter(128, StorageClass="Const")  % Distance to bow is larger than 511m
MAV_AIS_FLAGS_LARGE_STERN_DIMENSION = Simulink.Parameter(256, StorageClass="Const")  % Distance to stern is larger than 511m
MAV_AIS_FLAGS_LARGE_PORT_DIMENSION = Simulink.Parameter(512, StorageClass="Const")  % Distance to port side is larger than 63m
MAV_AIS_FLAGS_LARGE_STARBOARD_DIMENSION = Simulink.Parameter(1024, StorageClass="Const")  % Distance to starboard side is larger than 63m
MAV_AIS_FLAGS_VALID_CALLSIGN = Simulink.Parameter(2048, StorageClass="Const")
MAV_AIS_FLAGS_VALID_NAME = Simulink.Parameter(4096, StorageClass="Const")

MAV_AIS_FLAGS = enum(AddClassNameToEnumNames=true)  % These flags are used in the AIS_VESSEL.fields bitmask to indicate validity of data in the other message fields. When set, the data is valid.
  POSITION_ACCURACY = 1  % 1 = Position accuracy less than 10m, 0 = position accuracy greater than 10m.
  VALID_COG = 2
  VALID_VELOCITY = 4
  HIGH_VELOCITY = 8  % 1 = Velocity over 52.5765m/s (102.2 knots)
  VALID_TURN_RATE = 16
  TURN_RATE_SIGN_ONLY = 32  % Only the sign of the returned turn rate value is valid, either greater than 5deg/30s or less than -5deg/30s
  VALID_DIMENSIONS = 64
  LARGE_BOW_DIMENSION = 128  % Distance to bow is larger than 511m
  LARGE_STERN_DIMENSION = 256  % Distance to stern is larger than 511m
  LARGE_PORT_DIMENSION = 512  % Distance to port side is larger than 63m
  LARGE_STARBOARD_DIMENSION = 1024  % Distance to starboard side is larger than 63m
  VALID_CALLSIGN = 2048
  VALID_NAME = 4096

MAV_FAILURE_UNIT_SENSOR_GYRO = Simulink.Parameter(0, StorageClass="Const")
MAV_FAILURE_UNIT_SENSOR_ACCEL = Simulink.Parameter(1, StorageClass="Const")
MAV_FAILURE_UNIT_SENSOR_MAG = Simulink.Parameter(2, StorageClass="Const")
MAV_FAILURE_UNIT_SENSOR_BARO = Simulink.Parameter(3, StorageClass="Const")
MAV_FAILURE_UNIT_SENSOR_GPS = Simulink.Parameter(4, StorageClass="Const")
MAV_FAILURE_UNIT_SENSOR_OPTICAL_FLOW = Simulink.Parameter(5, StorageClass="Const")
MAV_FAILURE_UNIT_SENSOR_VIO = Simulink.Parameter(6, StorageClass="Const")
MAV_FAILURE_UNIT_SENSOR_DISTANCE_SENSOR = Simulink.Parameter(7, StorageClass="Const")
MAV_FAILURE_UNIT_SENSOR_AIRSPEED = Simulink.Parameter(8, StorageClass="Const")
MAV_FAILURE_UNIT_SYSTEM_BATTERY = Simulink.Parameter(100, StorageClass="Const")
MAV_FAILURE_UNIT_SYSTEM_MOTOR = Simulink.Parameter(101, StorageClass="Const")
MAV_FAILURE_UNIT_SYSTEM_SERVO = Simulink.Parameter(102, StorageClass="Const")
MAV_FAILURE_UNIT_SYSTEM_AVOIDANCE = Simulink.Parameter(103, StorageClass="Const")
MAV_FAILURE_UNIT_SYSTEM_RC_SIGNAL = Simulink.Parameter(104, StorageClass="Const")
MAV_FAILURE_UNIT_SYSTEM_MAVLINK_SIGNAL = Simulink.Parameter(105, StorageClass="Const")

MAV_FAILURE_UNIT = enum(AddClassNameToEnumNames=true)  % List of possible units where failures can be injected.
  SENSOR_GYRO = 0
  SENSOR_ACCEL = 1
  SENSOR_MAG = 2
  SENSOR_BARO = 3
  SENSOR_GPS = 4
  SENSOR_OPTICAL_FLOW = 5
  SENSOR_VIO = 6
  SENSOR_DISTANCE_SENSOR = 7
  SENSOR_AIRSPEED = 8
  SYSTEM_BATTERY = 100
  SYSTEM_MOTOR = 101
  SYSTEM_SERVO = 102
  SYSTEM_AVOIDANCE = 103
  SYSTEM_RC_SIGNAL = 104
  SYSTEM_MAVLINK_SIGNAL = 105

MAV_FAILURE_TYPE_OK = Simulink.Parameter(0, StorageClass="Const")  % No failure injected, used to reset a previous failure.
MAV_FAILURE_TYPE_OFF = Simulink.Parameter(1, StorageClass="Const")  % Sets unit off, so completely non-responsive.
MAV_FAILURE_TYPE_STUCK = Simulink.Parameter(2, StorageClass="Const")  % Unit is stuck e.g. keeps reporting the same value.
MAV_FAILURE_TYPE_GARBAGE = Simulink.Parameter(3, StorageClass="Const")  % Unit is reporting complete garbage.
MAV_FAILURE_TYPE_WRONG = Simulink.Parameter(4, StorageClass="Const")  % Unit is consistently wrong.
MAV_FAILURE_TYPE_SLOW = Simulink.Parameter(5, StorageClass="Const")  % Unit is slow, so e.g. reporting at slower than expected rate.
MAV_FAILURE_TYPE_DELAYED = Simulink.Parameter(6, StorageClass="Const")  % Data of unit is delayed in time.
MAV_FAILURE_TYPE_INTERMITTENT = Simulink.Parameter(7, StorageClass="Const")  % Unit is sometimes working, sometimes not.

MAV_FAILURE_TYPE = enum(AddClassNameToEnumNames=true)  % List of possible failure type to inject.
  OK = 0  % No failure injected, used to reset a previous failure.
  OFF = 1  % Sets unit off, so completely non-responsive.
  STUCK = 2  % Unit is stuck e.g. keeps reporting the same value.
  GARBAGE = 3  % Unit is reporting complete garbage.
  WRONG = 4  % Unit is consistently wrong.
  SLOW = 5  % Unit is slow, so e.g. reporting at slower than expected rate.
  DELAYED = 6  % Data of unit is delayed in time.
  INTERMITTENT = 7  % Unit is sometimes working, sometimes not.

MAV_NAV_VTOL_LAND_OPTIONS_DEFAULT = Simulink.Parameter(0, StorageClass="Const")  % Default autopilot landing behaviour.

MAV_NAV_VTOL_LAND_OPTIONS_FW_DESCENT = Simulink.Parameter(1, StorageClass="Const")  % Descend in fixed wing mode, transitioning to multicopter mode for vertical landing when close to the ground.
  % The fixed wing descent pattern is at the discretion of the vehicle (e.g. transition altitude, loiter direction, radius, and speed, etc.).

MAV_NAV_VTOL_LAND_OPTIONS_HOVER_DESCENT = Simulink.Parameter(2, StorageClass="Const")  % Land in multicopter mode on reaching the landing coordinates (the whole landing is by "hover descent").

MAV_NAV_VTOL_LAND_OPTIONS = enum(AddClassNameToEnumNames=true)
  DEFAULT = 0  % Default autopilot landing behaviour.
  FW_DESCENT = 1  % Descend in fixed wing mode, transitioning to multicopter mode for vertical landing when close to the ground.
    % The fixed wing descent pattern is at the discretion of the vehicle (e.g. transition altitude, loiter direction, radius, and speed, etc.).
  HOVER_DESCENT = 2  % Land in multicopter mode on reaching the landing coordinates (the whole landing is by "hover descent").

MAV_WINCH_STATUS_HEALTHY = Simulink.Parameter(1, StorageClass="Const")  % Winch is healthy
MAV_WINCH_STATUS_FULLY_RETRACTED = Simulink.Parameter(2, StorageClass="Const")  % Winch line is fully retracted
MAV_WINCH_STATUS_MOVING = Simulink.Parameter(4, StorageClass="Const")  % Winch motor is moving
MAV_WINCH_STATUS_CLUTCH_ENGAGED = Simulink.Parameter(8, StorageClass="Const")  % Winch clutch is engaged allowing motor to move freely.
MAV_WINCH_STATUS_LOCKED = Simulink.Parameter(16, StorageClass="Const")  % Winch is locked by locking mechanism.
MAV_WINCH_STATUS_DROPPING = Simulink.Parameter(32, StorageClass="Const")  % Winch is gravity dropping payload.
MAV_WINCH_STATUS_ARRESTING = Simulink.Parameter(64, StorageClass="Const")  % Winch is arresting payload descent.
MAV_WINCH_STATUS_GROUND_SENSE = Simulink.Parameter(128, StorageClass="Const")  % Winch is using torque measurements to sense the ground.
MAV_WINCH_STATUS_RETRACTING = Simulink.Parameter(256, StorageClass="Const")  % Winch is returning to the fully retracted position.
MAV_WINCH_STATUS_REDELIVER = Simulink.Parameter(512, StorageClass="Const")  % Winch is redelivering the payload. This is a failover state if the line tension goes above a threshold during RETRACTING.
MAV_WINCH_STATUS_ABANDON_LINE = Simulink.Parameter(1024, StorageClass="Const")  % Winch is abandoning the line and possibly payload. Winch unspools the entire calculated line length. This is a failover state from REDELIVER if the number of attempts exceeds a threshold.
MAV_WINCH_STATUS_LOCKING = Simulink.Parameter(2048, StorageClass="Const")  % Winch is engaging the locking mechanism.
MAV_WINCH_STATUS_LOAD_LINE = Simulink.Parameter(4096, StorageClass="Const")  % Winch is spooling on line.
MAV_WINCH_STATUS_LOAD_PAYLOAD = Simulink.Parameter(8192, StorageClass="Const")  % Winch is loading a payload.

MAV_WINCH_STATUS_FLAG = enum(AddClassNameToEnumNames=true)  % Winch status flags used in WINCH_STATUS
  MAV_WINCH_STATUS_HEALTHY = 1  % Winch is healthy
  MAV_WINCH_STATUS_FULLY_RETRACTED = 2  % Winch line is fully retracted
  MAV_WINCH_STATUS_MOVING = 4  % Winch motor is moving
  MAV_WINCH_STATUS_CLUTCH_ENGAGED = 8  % Winch clutch is engaged allowing motor to move freely.
  MAV_WINCH_STATUS_LOCKED = 16  % Winch is locked by locking mechanism.
  MAV_WINCH_STATUS_DROPPING = 32  % Winch is gravity dropping payload.
  MAV_WINCH_STATUS_ARRESTING = 64  % Winch is arresting payload descent.
  MAV_WINCH_STATUS_GROUND_SENSE = 128  % Winch is using torque measurements to sense the ground.
  MAV_WINCH_STATUS_RETRACTING = 256  % Winch is returning to the fully retracted position.
  MAV_WINCH_STATUS_REDELIVER = 512  % Winch is redelivering the payload. This is a failover state if the line tension goes above a threshold during RETRACTING.
  MAV_WINCH_STATUS_ABANDON_LINE = 1024  % Winch is abandoning the line and possibly payload. Winch unspools the entire calculated line length. This is a failover state from REDELIVER if the number of attempts exceeds a threshold.
  MAV_WINCH_STATUS_LOCKING = 2048  % Winch is engaging the locking mechanism.
  MAV_WINCH_STATUS_LOAD_LINE = 4096  % Winch is spooling on line.
  MAV_WINCH_STATUS_LOAD_PAYLOAD = 8192  % Winch is loading a payload.

MAV_MAG_CAL_NOT_STARTED = Simulink.Parameter(0, StorageClass="Const")
MAV_MAG_CAL_WAITING_TO_START = Simulink.Parameter(1, StorageClass="Const")
MAV_MAG_CAL_RUNNING_STEP_ONE = Simulink.Parameter(2, StorageClass="Const")
MAV_MAG_CAL_RUNNING_STEP_TWO = Simulink.Parameter(3, StorageClass="Const")
MAV_MAG_CAL_SUCCESS = Simulink.Parameter(4, StorageClass="Const")
MAV_MAG_CAL_FAILED = Simulink.Parameter(5, StorageClass="Const")
MAV_MAG_CAL_BAD_ORIENTATION = Simulink.Parameter(6, StorageClass="Const")
MAV_MAG_CAL_BAD_RADIUS = Simulink.Parameter(7, StorageClass="Const")

MAV_MAG_CAL_STATUS = enum(AddClassNameToEnumNames=true)
  MAG_CAL_NOT_STARTED = 0
  MAG_CAL_WAITING_TO_START = 1
  MAG_CAL_RUNNING_STEP_ONE = 2
  MAG_CAL_RUNNING_STEP_TWO = 3
  MAG_CAL_SUCCESS = 4
  MAG_CAL_FAILED = 5
  MAG_CAL_BAD_ORIENTATION = 6
  MAG_CAL_BAD_RADIUS = 7

MAV_EVENT_ERROR_REASON_UNAVAILABLE = Simulink.Parameter(0, StorageClass="Const")  % The requested event is not available (anymore).

MAV_EVENT_ERROR_REASON = enum(AddClassNameToEnumNames=true)  % Reason for an event error response.
  UNAVAILABLE = 0  % The requested event is not available (anymore).

MAV_EVENT_CURRENT_SEQUENCE_FLAGS_RESET = Simulink.Parameter(1, StorageClass="Const")  % A sequence reset has happened (e.g. vehicle reboot).

MAV_EVENT_CURRENT_SEQUENCE_FLAGS = enum(AddClassNameToEnumNames=true)  % Flags for CURRENT_EVENT_SEQUENCE.
  RESET = 1  % A sequence reset has happened (e.g. vehicle reboot).

MAV_HIL_SENSOR_UPDATED_NONE = Simulink.Parameter(0, StorageClass="Const")  % None of the fields in HIL_SENSOR have been updated
MAV_HIL_SENSOR_UPDATED_XACC = Simulink.Parameter(1, StorageClass="Const")  % The value in the xacc field has been updated
MAV_HIL_SENSOR_UPDATED_YACC = Simulink.Parameter(2, StorageClass="Const")  % The value in the yacc field has been updated
MAV_HIL_SENSOR_UPDATED_ZACC = Simulink.Parameter(4, StorageClass="Const")  % The value in the zacc field has been updated
MAV_HIL_SENSOR_UPDATED_XGYRO = Simulink.Parameter(8, StorageClass="Const")  % The value in the xgyro field has been updated
MAV_HIL_SENSOR_UPDATED_YGYRO = Simulink.Parameter(16, StorageClass="Const")  % The value in the ygyro field has been updated
MAV_HIL_SENSOR_UPDATED_ZGYRO = Simulink.Parameter(32, StorageClass="Const")  % The value in the zgyro field has been updated
MAV_HIL_SENSOR_UPDATED_XMAG = Simulink.Parameter(64, StorageClass="Const")  % The value in the xmag field has been updated
MAV_HIL_SENSOR_UPDATED_YMAG = Simulink.Parameter(128, StorageClass="Const")  % The value in the ymag field has been updated
MAV_HIL_SENSOR_UPDATED_ZMAG = Simulink.Parameter(256, StorageClass="Const")  % The value in the zmag field has been updated
MAV_HIL_SENSOR_UPDATED_ABS_PRESSURE = Simulink.Parameter(512, StorageClass="Const")  % The value in the abs_pressure field has been updated
MAV_HIL_SENSOR_UPDATED_DIFF_PRESSURE = Simulink.Parameter(1024, StorageClass="Const")  % The value in the diff_pressure field has been updated
MAV_HIL_SENSOR_UPDATED_PRESSURE_ALT = Simulink.Parameter(2048, StorageClass="Const")  % The value in the pressure_alt field has been updated
MAV_HIL_SENSOR_UPDATED_TEMPERATURE = Simulink.Parameter(4096, StorageClass="Const")  % The value in the temperature field has been updated
MAV_HIL_SENSOR_UPDATED_RESET = Simulink.Parameter(2147483648, StorageClass="Const")  % Full reset of attitude/position/velocities/etc was performed in sim (Bit 31).

MAV_HIL_SENSOR_UPDATED_FLAGS = enum(AddClassNameToEnumNames=true)  % Flags in the HIL_SENSOR message indicate which fields have updated since the last message
  HIL_SENSOR_UPDATED_NONE = 0  % None of the fields in HIL_SENSOR have been updated
  HIL_SENSOR_UPDATED_XACC = 1  % The value in the xacc field has been updated
  HIL_SENSOR_UPDATED_YACC = 2  % The value in the yacc field has been updated
  HIL_SENSOR_UPDATED_ZACC = 4  % The value in the zacc field has been updated
  HIL_SENSOR_UPDATED_XGYRO = 8  % The value in the xgyro field has been updated
  HIL_SENSOR_UPDATED_YGYRO = 16  % The value in the ygyro field has been updated
  HIL_SENSOR_UPDATED_ZGYRO = 32  % The value in the zgyro field has been updated
  HIL_SENSOR_UPDATED_XMAG = 64  % The value in the xmag field has been updated
  HIL_SENSOR_UPDATED_YMAG = 128  % The value in the ymag field has been updated
  HIL_SENSOR_UPDATED_ZMAG = 256  % The value in the zmag field has been updated
  HIL_SENSOR_UPDATED_ABS_PRESSURE = 512  % The value in the abs_pressure field has been updated
  HIL_SENSOR_UPDATED_DIFF_PRESSURE = 1024  % The value in the diff_pressure field has been updated
  HIL_SENSOR_UPDATED_PRESSURE_ALT = 2048  % The value in the pressure_alt field has been updated
  HIL_SENSOR_UPDATED_TEMPERATURE = 4096  % The value in the temperature field has been updated

MAV_HIGHRES_IMU_UPDATED_NONE = Simulink.Parameter(0, StorageClass="Const")  % None of the fields in HIGHRES_IMU have been updated
MAV_HIGHRES_IMU_UPDATED_XACC = Simulink.Parameter(1, StorageClass="Const")  % The value in the xacc field has been updated
MAV_HIGHRES_IMU_UPDATED_YACC = Simulink.Parameter(2, StorageClass="Const")  % The value in the yacc field has been updated
MAV_HIGHRES_IMU_UPDATED_ZACC = Simulink.Parameter(4, StorageClass="Const")  % The value in the zacc field has been updated since
MAV_HIGHRES_IMU_UPDATED_XGYRO = Simulink.Parameter(8, StorageClass="Const")  % The value in the xgyro field has been updated
MAV_HIGHRES_IMU_UPDATED_YGYRO = Simulink.Parameter(16, StorageClass="Const")  % The value in the ygyro field has been updated
MAV_HIGHRES_IMU_UPDATED_ZGYRO = Simulink.Parameter(32, StorageClass="Const")  % The value in the zgyro field has been updated
MAV_HIGHRES_IMU_UPDATED_XMAG = Simulink.Parameter(64, StorageClass="Const")  % The value in the xmag field has been updated
MAV_HIGHRES_IMU_UPDATED_YMAG = Simulink.Parameter(128, StorageClass="Const")  % The value in the ymag field has been updated
MAV_HIGHRES_IMU_UPDATED_ZMAG = Simulink.Parameter(256, StorageClass="Const")  % The value in the zmag field has been updated
MAV_HIGHRES_IMU_UPDATED_ABS_PRESSURE = Simulink.Parameter(512, StorageClass="Const")  % The value in the abs_pressure field has been updated
MAV_HIGHRES_IMU_UPDATED_DIFF_PRESSURE = Simulink.Parameter(1024, StorageClass="Const")  % The value in the diff_pressure field has been updated
MAV_HIGHRES_IMU_UPDATED_PRESSURE_ALT = Simulink.Parameter(2048, StorageClass="Const")  % The value in the pressure_alt field has been updated
MAV_HIGHRES_IMU_UPDATED_TEMPERATURE = Simulink.Parameter(4096, StorageClass="Const")  % The value in the temperature field has been updated
MAV_HIGHRES_IMU_UPDATED_ALL = Simulink.Parameter(65535, StorageClass="Const")  % All fields in HIGHRES_IMU have been updated.

MAV_HIGHRES_IMU_UPDATED_FLAGS = enum(AddClassNameToEnumNames=true)  % Flags in the HIGHRES_IMU message indicate which fields have updated since the last message
  HIGHRES_IMU_UPDATED_NONE = 0  % None of the fields in HIGHRES_IMU have been updated
  HIGHRES_IMU_UPDATED_XACC = 1  % The value in the xacc field has been updated
  HIGHRES_IMU_UPDATED_YACC = 2  % The value in the yacc field has been updated
  HIGHRES_IMU_UPDATED_ZACC = 4  % The value in the zacc field has been updated since
  HIGHRES_IMU_UPDATED_XGYRO = 8  % The value in the xgyro field has been updated
  HIGHRES_IMU_UPDATED_YGYRO = 16  % The value in the ygyro field has been updated
  HIGHRES_IMU_UPDATED_ZGYRO = 32  % The value in the zgyro field has been updated
  HIGHRES_IMU_UPDATED_XMAG = 64  % The value in the xmag field has been updated
  HIGHRES_IMU_UPDATED_YMAG = 128  % The value in the ymag field has been updated
  HIGHRES_IMU_UPDATED_ZMAG = 256  % The value in the zmag field has been updated
  HIGHRES_IMU_UPDATED_ABS_PRESSURE = 512  % The value in the abs_pressure field has been updated
  HIGHRES_IMU_UPDATED_DIFF_PRESSURE = 1024  % The value in the diff_pressure field has been updated
  HIGHRES_IMU_UPDATED_PRESSURE_ALT = 2048  % The value in the pressure_alt field has been updated
  HIGHRES_IMU_UPDATED_TEMPERATURE = 4096  % The value in the temperature field has been updated
  HIGHRES_IMU_UPDATED_ALL = 65535  % All fields in HIGHRES_IMU have been updated.

MAV_CAN_FILTER_REPLACE = Simulink.Parameter(0, StorageClass="Const")
MAV_CAN_FILTER_ADD = Simulink.Parameter(1, StorageClass="Const")
MAV_CAN_FILTER_REMOVE = Simulink.Parameter(2, StorageClass="Const")

MAV_CAN_FILTER_OP = enum(AddClassNameToEnumNames=true)
  CAN_FILTER_REPLACE = 0
  CAN_FILTER_ADD = 1
  CAN_FILTER_REMOVE = 2

MAV_FTP_ERR_NONE = Simulink.Parameter(0, StorageClass="Const")  % None: No error
MAV_FTP_ERR_FAIL = Simulink.Parameter(1, StorageClass="Const")  % Fail: Unknown failure

MAV_FTP_ERR_FAILERRNO = Simulink.Parameter(2, StorageClass="Const")  % FailErrno: Command failed, Err number sent back in PayloadHeader.data[1].
  % This is a file-system error number understood by the server operating system.

MAV_FTP_ERR_INVALIDDATASIZE = Simulink.Parameter(3, StorageClass="Const")  % InvalidDataSize: Payload size is invalid
MAV_FTP_ERR_INVALIDSESSION = Simulink.Parameter(4, StorageClass="Const")  % InvalidSession: Session is not currently open
MAV_FTP_ERR_NOSESSIONSAVAILABLE = Simulink.Parameter(5, StorageClass="Const")  % NoSessionsAvailable: All available sessions are already in use
MAV_FTP_ERR_EOF = Simulink.Parameter(6, StorageClass="Const")  % EOF: Offset past end of file for ListDirectory and ReadFile commands
MAV_FTP_ERR_UNKNOWNCOMMAND = Simulink.Parameter(7, StorageClass="Const")  % UnknownCommand: Unknown command / opcode
MAV_FTP_ERR_FILEEXISTS = Simulink.Parameter(8, StorageClass="Const")  % FileExists: File/directory already exists
MAV_FTP_ERR_FILEPROTECTED = Simulink.Parameter(9, StorageClass="Const")  % FileProtected: File/directory is write protected
MAV_FTP_ERR_FILENOTFOUND = Simulink.Parameter(10, StorageClass="Const")  % FileNotFound: File/directory not found

MAV_FTP_ERR = enum(AddClassNameToEnumNames=true)  % MAV FTP error codes (https://mavlink.io/en/services/ftp.html)
  NONE = 0  % None: No error
  FAIL = 1  % Fail: Unknown failure
  FAILERRNO = 2  % FailErrno: Command failed, Err number sent back in PayloadHeader.data[1].
    % This is a file-system error number understood by the server operating system.
  INVALIDDATASIZE = 3  % InvalidDataSize: Payload size is invalid
  INVALIDSESSION = 4  % InvalidSession: Session is not currently open
  NOSESSIONSAVAILABLE = 5  % NoSessionsAvailable: All available sessions are already in use
  EOF = 6  % EOF: Offset past end of file for ListDirectory and ReadFile commands
  UNKNOWNCOMMAND = 7  % UnknownCommand: Unknown command / opcode
  FILEEXISTS = 8  % FileExists: File/directory already exists
  FILEPROTECTED = 9  % FileProtected: File/directory is write protected
  FILENOTFOUND = 10  % FileNotFound: File/directory not found

MAV_FTP_OPCODE_NONE = Simulink.Parameter(0, StorageClass="Const")  % None. Ignored, always ACKed
MAV_FTP_OPCODE_TERMINATESESSION = Simulink.Parameter(1, StorageClass="Const")  % TerminateSession: Terminates open Read session
MAV_FTP_OPCODE_RESETSESSION = Simulink.Parameter(2, StorageClass="Const")  % ResetSessions: Terminates all open read sessions
MAV_FTP_OPCODE_LISTDIRECTORY = Simulink.Parameter(3, StorageClass="Const")  % ListDirectory. List files and directories in path from offset
MAV_FTP_OPCODE_OPENFILERO = Simulink.Parameter(4, StorageClass="Const")  % OpenFileRO: Opens file at path for reading, returns session
MAV_FTP_OPCODE_READFILE = Simulink.Parameter(5, StorageClass="Const")  % ReadFile: Reads size bytes from offset in session
MAV_FTP_OPCODE_CREATEFILE = Simulink.Parameter(6, StorageClass="Const")  % CreateFile: Creates file at path for writing, returns session
MAV_FTP_OPCODE_WRITEFILE = Simulink.Parameter(7, StorageClass="Const")  % WriteFile: Writes size bytes to offset in session
MAV_FTP_OPCODE_REMOVEFILE = Simulink.Parameter(8, StorageClass="Const")  % RemoveFile: Remove file at path
MAV_FTP_OPCODE_CREATEDIRECTORY = Simulink.Parameter(9, StorageClass="Const")  % CreateDirectory: Creates directory at path
MAV_FTP_OPCODE_REMOVEDIRECTORY = Simulink.Parameter(10, StorageClass="Const")  % RemoveDirectory: Removes directory at path. The directory must be empty.
MAV_FTP_OPCODE_OPENFILEWO = Simulink.Parameter(11, StorageClass="Const")  % OpenFileWO: Opens file at path for writing, returns session
MAV_FTP_OPCODE_TRUNCATEFILE = Simulink.Parameter(12, StorageClass="Const")  % TruncateFile: Truncate file at path to offset length
MAV_FTP_OPCODE_RENAME = Simulink.Parameter(13, StorageClass="Const")  % Rename: Rename path1 to path2
MAV_FTP_OPCODE_CALCFILECRC = Simulink.Parameter(14, StorageClass="Const")  % CalcFileCRC32: Calculate CRC32 for file at path
MAV_FTP_OPCODE_BURSTREADFILE = Simulink.Parameter(15, StorageClass="Const")  % BurstReadFile: Burst download session file
MAV_FTP_OPCODE_ACK = Simulink.Parameter(128, StorageClass="Const")  % ACK: ACK response
MAV_FTP_OPCODE_NAK = Simulink.Parameter(129, StorageClass="Const")  % NAK: NAK response

MAV_FTP_OPCODE = enum(AddClassNameToEnumNames=true)  % MAV FTP opcodes: https://mavlink.io/en/services/ftp.html
  NONE = 0  % None. Ignored, always ACKed
  TERMINATESESSION = 1  % TerminateSession: Terminates open Read session
  RESETSESSION = 2  % ResetSessions: Terminates all open read sessions
  LISTDIRECTORY = 3  % ListDirectory. List files and directories in path from offset
  OPENFILERO = 4  % OpenFileRO: Opens file at path for reading, returns session
  READFILE = 5  % ReadFile: Reads size bytes from offset in session
  CREATEFILE = 6  % CreateFile: Creates file at path for writing, returns session
  WRITEFILE = 7  % WriteFile: Writes size bytes to offset in session
  REMOVEFILE = 8  % RemoveFile: Remove file at path
  CREATEDIRECTORY = 9  % CreateDirectory: Creates directory at path
  REMOVEDIRECTORY = 10  % RemoveDirectory: Removes directory at path. The directory must be empty.
  OPENFILEWO = 11  % OpenFileWO: Opens file at path for writing, returns session
  TRUNCATEFILE = 12  % TruncateFile: Truncate file at path to offset length
  RENAME = 13  % Rename: Rename path1 to path2
  CALCFILECRC = 14  % CalcFileCRC32: Calculate CRC32 for file at path
  BURSTREADFILE = 15  % BurstReadFile: Burst download session file
  ACK = 128  % ACK: ACK response
  NAK = 129  % NAK: NAK response

MAV_MISSION_STATE_UNKNOWN = Simulink.Parameter(0, StorageClass="Const")  % The mission status reporting is not supported.
MAV_MISSION_STATE_NO_MISSION = Simulink.Parameter(1, StorageClass="Const")  % No mission on the vehicle.
MAV_MISSION_STATE_NOT_STARTED = Simulink.Parameter(2, StorageClass="Const")  % Mission has not started. This is the case after a mission has uploaded but not yet started executing.
MAV_MISSION_STATE_ACTIVE = Simulink.Parameter(3, StorageClass="Const")  % Mission is active, and will execute mission items when in auto mode.
MAV_MISSION_STATE_PAUSED = Simulink.Parameter(4, StorageClass="Const")  % Mission is paused when in auto mode.
MAV_MISSION_STATE_COMPLETE = Simulink.Parameter(5, StorageClass="Const")  % Mission has executed all mission items.

MAV_MISSION_STATE = enum(AddClassNameToEnumNames=true)  % States of the mission state machine.
  % Note that these states are independent of whether the mission is in a mode that can execute mission items or not (is suspended).
  % They may not all be relevant on all vehicles.
  UNKNOWN = 0  % The mission status reporting is not supported.
  NO_MISSION = 1  % No mission on the vehicle.
  NOT_STARTED = 2  % Mission has not started. This is the case after a mission has uploaded but not yet started executing.
  ACTIVE = 3  % Mission is active, and will execute mission items when in auto mode.
  PAUSED = 4  % Mission is paused when in auto mode.
  COMPLETE = 5  % Mission has executed all mission items.

mav_sys_status_s = Simulink.Bus()  % The general system state. If the system is following the MAVLink standard, the system state is mainly defined by three orthogonal states/modes: The system mode, which is either LOCKED (motors shut down and locked), MANUAL (system under RC control), GUIDED (system with autonomous position control, position setpoint controlled manually) or AUTO (system guided by path/waypoint planner). The NAV_MODE defined the current flight state: LIFTOFF (often an open-loop maneuver), LANDING, WAYPOINTS or VECTOR. This represents the internal navigation state machine. The system status shows whether the system is currently active or not and if an emergency occurred. During the CRITICAL and EMERGENCY states the MAV is still considered to be active, but should start emergency procedures autonomously. After a failure occurred it should first move from active to critical to allow manual intervention and then move to emergency after a certain timeout.
  onboard_control_sensors_present: uint32  % Bitmap showing which onboard controllers and sensors are present. Value of 0: not present. Value of 1: present.
  onboard_control_sensors_enabled: uint32  % Bitmap showing which onboard controllers and sensors are enabled:  Value of 0: not enabled. Value of 1: enabled.
  onboard_control_sensors_health: uint32  % Bitmap showing which onboard controllers and sensors have an error (or are operational). Value of 0: error. Value of 1: healthy.
  load: uint16  % Maximum usage in percent of the mainloop time. Values: [0-1000] - should always be below 1000
  voltage_battery: uint16  % Battery voltage, UINT16_MAX: Voltage not sent by autopilot
  current_battery: int16  % Battery current, -1: Current not sent by autopilot
  battery_remaining: int8_t  % Battery energy remaining, -1: Battery remaining energy not sent by autopilot
  drop_rate_comm: uint16  % Communication drop rate, (UART, I2C, SPI, CAN), dropped packets on all links (packets that were corrupted on reception on the MAV)
  errors_comm: uint16  % Communication errors (UART, I2C, SPI, CAN), dropped packets on all links (packets that were corrupted on reception on the MAV)
  errors_count1: uint16  % Autopilot-specific errors
  errors_count2: uint16  % Autopilot-specific errors
  errors_count3: uint16  % Autopilot-specific errors
  errors_count4: uint16  % Autopilot-specific errors
  onboard_control_sensors_present_extended: uint32  % Bitmap showing which onboard controllers and sensors are present. Value of 0: not present. Value of 1: present.
  onboard_control_sensors_enabled_extended: uint32  % Bitmap showing which onboard controllers and sensors are enabled:  Value of 0: not enabled. Value of 1: enabled.
  onboard_control_sensors_health_extended: uint32  % Bitmap showing which onboard controllers and sensors have an error (or are operational). Value of 0: error. Value of 1: healthy.

mav_system_time_s = Simulink.Bus()  % The system time is the time of the master clock, typically the computer clock of the main onboard computer.
  time_unix_usec: fixdt(0,64,0)  % Timestamp (UNIX epoch time).
  time_boot_ms: uint32  % Timestamp (time since system boot).

mav_ping_s = Simulink.Bus()  % A ping message either requesting or responding to a ping. This allows to measure the system latencies, including serial port, radio modem and UDP connections. The ping microservice is documented at https://mavlink.io/en/services/ping.html
  time_usec: fixdt(0,64,0)  % Timestamp (UNIX Epoch time or time since system boot). The receiving end can infer timestamp format (since 1.1.1970 or since system boot) by checking for the magnitude of the number.
  seq: uint32  % PING sequence
  target_system: uint8  % 0: request ping from all receiving systems. If greater than 0: message is a ping response and number is the system id of the requesting system
  target_component: uint8  % 0: request ping from all receiving components. If greater than 0: message is a ping response and number is the component id of the requesting component.

mav_change_operator_control_s = Simulink.Bus()  % Request to control this MAV
  target_system: uint8  % System the GCS requests control for
  control_request: uint8  % 0: request control of this MAV, 1: Release control of this MAV
  version: uint8  % 0: key as plaintext, 1-255: future, different hashing/encryption variants. The GCS should in general use the safest mode possible initially and then gradually move down the encryption level if it gets a NACK message indicating an encryption mismatch.
  passkey: int8[25]  % Password / Key, depending on version plaintext or encrypted. 25 or less characters, NULL terminated. The characters may involve A-Z, a-z, 0-9, and "!?,.-"

mav_change_operator_control_ack_s = Simulink.Bus()  % Accept / deny control of this MAV
  gcs_system_id: uint8  % ID of the GCS this message
  control_request: uint8  % 0: request control of this MAV, 1: Release control of this MAV
  ack: uint8  % 0: ACK, 1: NACK: Wrong passkey, 2: NACK: Unsupported passkey encryption method, 3: NACK: Already under control

mav_auth_key_s = Simulink.Bus()  % Emit an encrypted signature / key identifying this system. PLEASE NOTE: This protocol has been kept simple, so transmitting the key requires an encrypted channel for true safety.
  key: int8[32]  % key

mav_link_node_status_s = Simulink.Bus()  % Status generated in each node in the communication chain and injected into MAVLink stream.
  timestamp: fixdt(0,64,0)  % Timestamp (time since system boot).
  tx_buf: uint8  % Remaining free transmit buffer space
  rx_buf: uint8  % Remaining free receive buffer space
  tx_rate: uint32  % Transmit rate
  rx_rate: uint32  % Receive rate
  rx_parse_err: uint16  % Number of bytes that could not be parsed correctly.
  tx_overflows: uint16  % Transmit buffer overflows. This number wraps around as it reaches UINT16_MAX
  rx_overflows: uint16  % Receive buffer overflows. This number wraps around as it reaches UINT16_MAX
  messages_sent: uint32  % Messages sent
  messages_received: uint32  % Messages received (estimated from counting seq)
  messages_lost: uint32  % Messages lost (estimated from counting seq)

mav_set_mode_s = Simulink.Bus()  % Set the system mode, as defined by enum MAV_MODE. There is no target component id as the mode is by definition for the overall aircraft, not only for one component.
  target_system: uint8  % The system setting the mode
  base_mode: uint8  % The new base mode.
  custom_mode: uint32  % The new autopilot-specific mode. This field can be ignored by an autopilot.

mav_param_request_read_s = Simulink.Bus()  % Request to read the onboard parameter with the param_id string id. Onboard parameters are stored as key[const char*] -> value[float]. This allows to send a parameter to any other component (such as the GCS) without the need of previous knowledge of possible parameter names. Thus the same GCS can store different parameters for different autopilots. See also https://mavlink.io/en/services/parameter.html for a full documentation of QGroundControl and IMU code.
  target_system: uint8  % System ID
  target_component: uint8  % Component ID
  param_id: int8[16]  % Onboard parameter id, terminated by NULL if the length is less than 16 human-readable chars and WITHOUT null termination (NULL) byte if the length is exactly 16 chars - applications have to provide 16+1 bytes storage if the ID is stored as string
  param_index: int16  % Parameter index. Send -1 to use the param ID field as identifier (else the param id will be ignored)

mav_param_request_list_s = Simulink.Bus()  % Request all parameters of this component. After this request, all parameters are emitted. The parameter microservice is documented at https://mavlink.io/en/services/parameter.html
  target_system: uint8  % System ID
  target_component: uint8  % Component ID

mav_param_value_s = Simulink.Bus()  % Emit the value of a onboard parameter. The inclusion of param_count and param_index in the message allows the recipient to keep track of received parameters and allows him to re-request missing parameters after a loss or timeout. The parameter microservice is documented at https://mavlink.io/en/services/parameter.html
  param_id: int8[16]  % Onboard parameter id, terminated by NULL if the length is less than 16 human-readable chars and WITHOUT null termination (NULL) byte if the length is exactly 16 chars - applications have to provide 16+1 bytes storage if the ID is stored as string
  param_value: single  % Onboard parameter value
  param_type: uint8  % Onboard parameter type.
  param_count: uint16  % Total number of onboard parameters
  param_index: uint16  % Index of this onboard parameter

mav_param_set_s = Simulink.Bus()  % Set a parameter value (write new value to permanent storage).
  % The receiving component should acknowledge the new parameter value by broadcasting a PARAM_VALUE message (broadcasting ensures that multiple GCS all have an up-to-date list of all parameters). If the sending GCS did not receive a PARAM_VALUE within its timeout time, it should re-send the PARAM_SET message. The parameter microservice is documented at https://mavlink.io/en/services/parameter.html.
  % PARAM_SET may also be called within the context of a transaction (started with MAV_CMD_PARAM_TRANSACTION). Within a transaction the receiving component should respond with PARAM_ACK_TRANSACTION to the setter component (instead of broadcasting PARAM_VALUE), and PARAM_SET should be re-sent if this is ACK not received.
  target_system: uint8  % System ID
  target_component: uint8  % Component ID
  param_id: int8[16]  % Onboard parameter id, terminated by NULL if the length is less than 16 human-readable chars and WITHOUT null termination (NULL) byte if the length is exactly 16 chars - applications have to provide 16+1 bytes storage if the ID is stored as string
  param_value: single  % Onboard parameter value
  param_type: uint8  % Onboard parameter type.

mav_gps_raw_int_s = Simulink.Bus()  % The global position, as returned by the Global Positioning System (GPS). This is
  % NOT the global position estimate of the system, but rather a RAW sensor value. See message GLOBAL_POSITION_INT for the global position estimate.
  time_usec: fixdt(0,64,0)  % Timestamp (UNIX Epoch time or time since system boot). The receiving end can infer timestamp format (since 1.1.1970 or since system boot) by checking for the magnitude of the number.
  fix_type: uint8  % GPS fix type.
  lat: int32  % Latitude (WGS84, EGM96 ellipsoid)
  lon: int32  % Longitude (WGS84, EGM96 ellipsoid)
  alt: int32  % Altitude (MSL). Positive for up. Note that virtually all GPS modules provide the MSL altitude in addition to the WGS84 altitude.
  eph: uint16  % GPS HDOP horizontal dilution of position (unitless * 100). If unknown, set to: UINT16_MAX
  epv: uint16  % GPS VDOP vertical dilution of position (unitless * 100). If unknown, set to: UINT16_MAX
  vel: uint16  % GPS ground speed. If unknown, set to: UINT16_MAX
  cog: uint16  % Course over ground (NOT heading, but direction of movement) in degrees * 100, 0.0..359.99 degrees. If unknown, set to: UINT16_MAX
  satellites_visible: uint8  % Number of satellites visible. If unknown, set to UINT8_MAX
  alt_ellipsoid: int32  % Altitude (above WGS84, EGM96 ellipsoid). Positive for up.
  h_acc: uint32  % Position uncertainty.
  v_acc: uint32  % Altitude uncertainty.
  vel_acc: uint32  % Speed uncertainty.
  hdg_acc: uint32  % Heading / track uncertainty
  yaw: uint16  % Yaw in earth frame from north. Use 0 if this GPS does not provide yaw. Use UINT16_MAX if this GPS is configured to provide yaw and is currently unable to provide it. Use 36000 for north.

mav_gps_status_s = Simulink.Bus()  % The positioning status, as reported by GPS. This message is intended to display status information about each satellite visible to the receiver. See message GLOBAL_POSITION_INT for the global position estimate. This message can contain information for up to 20 satellites.
  satellites_visible: uint8  % Number of satellites visible
  satellite_prn: uint8[20]  % Global satellite ID
  satellite_used: uint8[20]  % 0: Satellite not used, 1: used for localization
  satellite_elevation: uint8[20]  % Elevation (0: right on top of receiver, 90: on the horizon) of satellite
  satellite_azimuth: uint8[20]  % Direction of satellite, 0: 0 deg, 255: 360 deg.
  satellite_snr: uint8[20]  % Signal to noise ratio of satellite

mav_scaled_imu_s = Simulink.Bus()  % The RAW IMU readings for the usual 9DOF sensor setup. This message should contain the scaled values to the described units
  time_boot_ms: uint32  % Timestamp (time since system boot).
  xacc: int16  % X acceleration
  yacc: int16  % Y acceleration
  zacc: int16  % Z acceleration
  xgyro: int16  % Angular speed around X axis
  ygyro: int16  % Angular speed around Y axis
  zgyro: int16  % Angular speed around Z axis
  xmag: int16  % X Magnetic field
  ymag: int16  % Y Magnetic field
  zmag: int16  % Z Magnetic field
  temperature: int16  % Temperature, 0: IMU does not provide temperature values. If the IMU is at 0C it must send 1 (0.01C).

mav_raw_imu_s = Simulink.Bus()  % The RAW IMU readings for a 9DOF sensor, which is identified by the id (default IMU1). This message should always contain the true raw values without any scaling to allow data capture and system debugging.
  time_usec: fixdt(0,64,0)  % Timestamp (UNIX Epoch time or time since system boot). The receiving end can infer timestamp format (since 1.1.1970 or since system boot) by checking for the magnitude of the number.
  xacc: int16  % X acceleration (raw)
  yacc: int16  % Y acceleration (raw)
  zacc: int16  % Z acceleration (raw)
  xgyro: int16  % Angular speed around X axis (raw)
  ygyro: int16  % Angular speed around Y axis (raw)
  zgyro: int16  % Angular speed around Z axis (raw)
  xmag: int16  % X Magnetic field (raw)
  ymag: int16  % Y Magnetic field (raw)
  zmag: int16  % Z Magnetic field (raw)
  id: uint8  % Id. Ids are numbered from 0 and map to IMUs numbered from 1 (e.g. IMU1 will have a message with id=0)
  temperature: int16  % Temperature, 0: IMU does not provide temperature values. If the IMU is at 0C it must send 1 (0.01C).

mav_raw_pressure_s = Simulink.Bus()  % The RAW pressure readings for the typical setup of one absolute pressure and one differential pressure sensor. The sensor values should be the raw, UNSCALED ADC values.
  time_usec: fixdt(0,64,0)  % Timestamp (UNIX Epoch time or time since system boot). The receiving end can infer timestamp format (since 1.1.1970 or since system boot) by checking for the magnitude of the number.
  press_abs: int16  % Absolute pressure (raw)
  press_diff1: int16  % Differential pressure 1 (raw, 0 if nonexistent)
  press_diff2: int16  % Differential pressure 2 (raw, 0 if nonexistent)
  temperature: int16  % Raw Temperature measurement (raw)

mav_scaled_pressure_s = Simulink.Bus()  % The pressure readings for the typical setup of one absolute and differential pressure sensor. The units are as specified in each field.
  time_boot_ms: uint32  % Timestamp (time since system boot).
  press_abs: single  % Absolute pressure
  press_diff: single  % Differential pressure 1
  temperature: int16  % Absolute pressure temperature
  temperature_press_diff: int16  % Differential pressure temperature (0, if not available). Report values of 0 (or 1) as 1 cdegC.

mav_attitude_s = Simulink.Bus()  % The attitude in the aeronautical frame (right-handed, Z-down, Y-right, X-front, ZYX, intrinsic).
  time_boot_ms: uint32  % Timestamp (time since system boot).
  roll: single  % Roll angle (-pi..+pi)
  pitch: single  % Pitch angle (-pi..+pi)
  yaw: single  % Yaw angle (-pi..+pi)
  rollspeed: single  % Roll angular speed
  pitchspeed: single  % Pitch angular speed
  yawspeed: single  % Yaw angular speed

mav_attitude_quaternion_s = Simulink.Bus()  % The attitude in the aeronautical frame (right-handed, Z-down, X-front, Y-right), expressed as quaternion. Quaternion order is w, x, y, z and a zero rotation would be expressed as (1 0 0 0).
  time_boot_ms: uint32  % Timestamp (time since system boot).
  q1: single  % Quaternion component 1, w (1 in null-rotation)
  q2: single  % Quaternion component 2, x (0 in null-rotation)
  q3: single  % Quaternion component 3, y (0 in null-rotation)
  q4: single  % Quaternion component 4, z (0 in null-rotation)
  rollspeed: single  % Roll angular speed
  pitchspeed: single  % Pitch angular speed
  yawspeed: single  % Yaw angular speed
  repr_offset_q: single[4]  % Rotation offset by which the attitude quaternion and angular speed vector should be rotated for user display (quaternion with [w, x, y, z] order, zero-rotation is [1, 0, 0, 0], send [0, 0, 0, 0] if field not supported). This field is intended for systems in which the reference attitude may change during flight. For example, tailsitters VTOLs rotate their reference attitude by 90 degrees between hover mode and fixed wing mode, thus repr_offset_q is equal to [1, 0, 0, 0] in hover mode and equal to [0.7071, 0, 0.7071, 0] in fixed wing mode.

mav_local_position_ned_s = Simulink.Bus()  % The filtered local position (e.g. fused computer vision and accelerometers). Coordinate frame is right-handed, Z-axis down (aeronautical frame, NED / north-east-down convention)
  time_boot_ms: uint32  % Timestamp (time since system boot).
  x: single  % X Position
  y: single  % Y Position
  z: single  % Z Position
  vx: single  % X Speed
  vy: single  % Y Speed
  vz: single  % Z Speed

mav_global_position_int_s = Simulink.Bus()  % The filtered global position (e.g. fused GPS and accelerometers). The position is in GPS-frame (right-handed, Z-up). It
  % is designed as scaled integer message since the resolution of float is not sufficient.
  time_boot_ms: uint32  % Timestamp (time since system boot).
  lat: int32  % Latitude, expressed
  lon: int32  % Longitude, expressed
  alt: int32  % Altitude (MSL). Note that virtually all GPS modules provide both WGS84 and MSL.
  relative_alt: int32  % Altitude above ground
  vx: int16  % Ground X Speed (Latitude, positive north)
  vy: int16  % Ground Y Speed (Longitude, positive east)
  vz: int16  % Ground Z Speed (Altitude, positive down)
  hdg: uint16  % Vehicle heading (yaw angle), 0.0..359.99 degrees. If unknown, set to: UINT16_MAX

mav_rc_channels_scaled_s = Simulink.Bus()  % The scaled values of the RC channels received: (-100%) -10000, (0%) 0, (100%) 10000. Channels that are inactive should be set to INT16_MAX.
  time_boot_ms: uint32  % Timestamp (time since system boot).
  port: uint8  % Servo output port (set of 8 outputs = 1 port). Flight stacks running on Pixhawk should use: 0 = MAIN, 1 = AUX.
  chan1_scaled: int16  % RC channel 1 value scaled.
  chan2_scaled: int16  % RC channel 2 value scaled.
  chan3_scaled: int16  % RC channel 3 value scaled.
  chan4_scaled: int16  % RC channel 4 value scaled.
  chan5_scaled: int16  % RC channel 5 value scaled.
  chan6_scaled: int16  % RC channel 6 value scaled.
  chan7_scaled: int16  % RC channel 7 value scaled.
  chan8_scaled: int16  % RC channel 8 value scaled.
  rssi: uint8  % Receive signal strength indicator in device-dependent units/scale. Values: [0-254], UINT8_MAX: invalid/unknown.

mav_rc_channels_raw_s = Simulink.Bus()  % The RAW values of the RC channels received. The standard PPM modulation is as follows: 1000 microseconds: 0%, 2000 microseconds: 100%. A value of UINT16_MAX implies the channel is unused. Individual receivers/transmitters might violate this specification.
  time_boot_ms: uint32  % Timestamp (time since system boot).
  port: uint8  % Servo output port (set of 8 outputs = 1 port). Flight stacks running on Pixhawk should use: 0 = MAIN, 1 = AUX.
  chan1_raw: uint16  % RC channel 1 value.
  chan2_raw: uint16  % RC channel 2 value.
  chan3_raw: uint16  % RC channel 3 value.
  chan4_raw: uint16  % RC channel 4 value.
  chan5_raw: uint16  % RC channel 5 value.
  chan6_raw: uint16  % RC channel 6 value.
  chan7_raw: uint16  % RC channel 7 value.
  chan8_raw: uint16  % RC channel 8 value.
  rssi: uint8  % Receive signal strength indicator in device-dependent units/scale. Values: [0-254], UINT8_MAX: invalid/unknown.

mav_servo_output_raw_s = Simulink.Bus()  % Superseded by ACTUATOR_OUTPUT_STATUS. The RAW values of the servo outputs (for RC input from the remote, use the RC_CHANNELS messages). The standard PPM modulation is as follows: 1000 microseconds: 0%, 2000 microseconds: 100%.
  time_usec: uint32  % Timestamp (UNIX Epoch time or time since system boot). The receiving end can infer timestamp format (since 1.1.1970 or since system boot) by checking for the magnitude of the number.
  port: uint8  % Servo output port (set of 8 outputs = 1 port). Flight stacks running on Pixhawk should use: 0 = MAIN, 1 = AUX.
  servo1_raw: uint16  % Servo output 1 value
  servo2_raw: uint16  % Servo output 2 value
  servo3_raw: uint16  % Servo output 3 value
  servo4_raw: uint16  % Servo output 4 value
  servo5_raw: uint16  % Servo output 5 value
  servo6_raw: uint16  % Servo output 6 value
  servo7_raw: uint16  % Servo output 7 value
  servo8_raw: uint16  % Servo output 8 value
  servo9_raw: uint16  % Servo output 9 value
  servo10_raw: uint16  % Servo output 10 value
  servo11_raw: uint16  % Servo output 11 value
  servo12_raw: uint16  % Servo output 12 value
  servo13_raw: uint16  % Servo output 13 value
  servo14_raw: uint16  % Servo output 14 value
  servo15_raw: uint16  % Servo output 15 value
  servo16_raw: uint16  % Servo output 16 value

mav_mission_request_partial_list_s = Simulink.Bus()  % Request a partial list of mission items from the system/component. https://mavlink.io/en/services/mission.html. If start and end index are the same, just send one waypoint.
  target_system: uint8  % System ID
  target_component: uint8  % Component ID
  start_index: int16  % Start index
  end_index: int16  % End index, -1 by default (-1: send list to end). Else a valid index of the list
  mission_type: uint8  % Mission type.

mav_mission_write_partial_list_s = Simulink.Bus()  % This message is sent to the MAV to write a partial list. If start index == end index, only one item will be transmitted / updated. If the start index is NOT 0 and above the current list size, this request should be REJECTED!
  target_system: uint8  % System ID
  target_component: uint8  % Component ID
  start_index: int16  % Start index. Must be smaller / equal to the largest index of the current onboard list.
  end_index: int16  % End index, equal or greater than start index.
  mission_type: uint8  % Mission type.

mav_mission_item_s = Simulink.Bus()  % Message encoding a mission item. This message is emitted to announce
  % the presence of a mission item and to set a mission item on the system. The mission item can be either in x, y, z meters (type: LOCAL) or x:lat, y:lon, z:altitude. Local frame is Z-down, right handed (NED), global frame is Z-up, right handed (ENU). NaN may be used to indicate an optional/default value (e.g. to use the system's current latitude or yaw rather than a specific value). See also https://mavlink.io/en/services/mission.html.
  target_system: uint8  % System ID
  target_component: uint8  % Component ID
  seq: uint16  % Sequence
  frame: uint8  % The coordinate system of the waypoint.
  command: uint16  % The scheduled action for the waypoint.
  current: uint8  % false:0, true:1
  autocontinue: uint8  % Autocontinue to next waypoint. 0: false, 1: true. Set false to pause mission after the item completes.
  param1: single  % PARAM1, see MAV_CMD enum
  param2: single  % PARAM2, see MAV_CMD enum
  param3: single  % PARAM3, see MAV_CMD enum
  param4: single  % PARAM4, see MAV_CMD enum
  x: single  % PARAM5 / local: X coordinate, global: latitude
  y: single  % PARAM6 / local: Y coordinate, global: longitude
  z: single  % PARAM7 / local: Z coordinate, global: altitude (relative or absolute, depending on frame).
  mission_type: uint8  % Mission type.

mav_mission_request_s = Simulink.Bus()  % Request the information of the mission item with the sequence number seq. The response of the system to this message should be a MISSION_ITEM message. https://mavlink.io/en/services/mission.html
  target_system: uint8  % System ID
  target_component: uint8  % Component ID
  seq: uint16  % Sequence
  mission_type: uint8  % Mission type.

mav_mission_set_current_s = Simulink.Bus()  % Set the mission item with sequence number seq as the current item and emit MISSION_CURRENT (whether or not the mission number changed).
  % If a mission is currently being executed, the system will continue to this new mission item on the shortest path, skipping any intermediate mission items.
  % Note that mission jump repeat counters are not reset (see MAV_CMD_DO_JUMP param2).
  % This message may trigger a mission state-machine change on some systems: for example from MISSION_STATE_NOT_STARTED or MISSION_STATE_PAUSED to MISSION_STATE_ACTIVE.
  % If the system is in mission mode, on those systems this command might therefore start, restart or resume the mission.
  % If the system is not in mission mode this message must not trigger a switch to mission mode.
  target_system: uint8  % System ID
  target_component: uint8  % Component ID
  seq: uint16  % Sequence

mav_mission_current_s = Simulink.Bus()  % Message that announces the sequence number of the current target mission item (that the system will fly towards/execute when the mission is running).
  % This message should be streamed all the time (nominally at 1Hz).
  % This message should be emitted following a call to MAV_CMD_DO_SET_MISSION_CURRENT or SET_MISSION_CURRENT.
  seq: uint16  % Sequence
  total: uint16  % Total number of mission items on vehicle (on last item, sequence == total). If the autopilot stores its home location as part of the mission this will be excluded from the total. 0: Not supported, UINT16_MAX if no mission is present on the vehicle.
  mission_state: uint8  % Mission state machine state. MISSION_STATE_UNKNOWN if state reporting not supported.
  mission_mode: uint8  % Vehicle is in a mode that can execute mission items or suspended. 0: Unknown, 1: In mission mode, 2: Suspended (not in mission mode).
  mission_id: uint32  % Id of current on-vehicle mission plan, or 0 if IDs are not supported or there is no mission loaded. GCS can use this to track changes to the mission plan type. The same value is returned on mission upload (in the MISSION_ACK).
  fence_id: uint32  % Id of current on-vehicle fence plan, or 0 if IDs are not supported or there is no fence loaded. GCS can use this to track changes to the fence plan type. The same value is returned on fence upload (in the MISSION_ACK).
  rally_points_id: uint32  % Id of current on-vehicle rally point plan, or 0 if IDs are not supported or there are no rally points loaded. GCS can use this to track changes to the rally point plan type. The same value is returned on rally point upload (in the MISSION_ACK).

mav_mission_request_list_s = Simulink.Bus()  % Request the overall list of mission items from the system/component.
  target_system: uint8  % System ID
  target_component: uint8  % Component ID
  mission_type: uint8  % Mission type.

mav_mission_count_s = Simulink.Bus()  % This message is emitted as response to MISSION_REQUEST_LIST by the MAV and to initiate a write transaction. The GCS can then request the individual mission item based on the knowledge of the total number of waypoints.
  target_system: uint8  % System ID
  target_component: uint8  % Component ID
  count: uint16  % Number of mission items in the sequence
  mission_type: uint8  % Mission type.
  opaque_id: uint32  % Id of current on-vehicle mission, fence, or rally point plan (on download from vehicle).
    % This field is used when downloading a plan from a vehicle to a GCS.
    % 0 on upload to the vehicle from GCS.
    % 0 if plan ids are not supported.
    % The current on-vehicle plan ids are streamed in `MISSION_CURRENT`, allowing a GCS to determine if any part of the plan has changed and needs to be re-uploaded.
    % The ids are recalculated by the vehicle when any part of the on-vehicle plan changes (when a new plan is uploaded, the vehicle returns the new id to the GCS in MISSION_ACK).

mav_mission_clear_all_s = Simulink.Bus()  % Delete all mission items at once.
  target_system: uint8  % System ID
  target_component: uint8  % Component ID
  mission_type: uint8  % Mission type.

mav_mission_item_reached_s = Simulink.Bus()  % A certain mission item has been reached. The system will either hold this position (or circle on the orbit) or (if the autocontinue on the WP was set) continue to the next waypoint.
  seq: uint16  % Sequence

mav_mission_ack_s = Simulink.Bus()  % Acknowledgment message during waypoint handling. The type field states if this message is a positive ack (type=0) or if an error happened (type=non-zero).
  target_system: uint8  % System ID
  target_component: uint8  % Component ID
  type: uint8  % Mission result.
  mission_type: uint8  % Mission type.
  opaque_id: uint32  % Id of new on-vehicle mission, fence, or rally point plan (on upload to vehicle).
    % The id is calculated and returned by a vehicle when a new plan is uploaded by a GCS.
    % The only requirement on the id is that it must change when there is any change to the on-vehicle plan type (there is no requirement that the id be globally unique).
    % 0 on download from the vehicle to the GCS (on download the ID is set in MISSION_COUNT).
    % 0 if plan ids are not supported.
    % The current on-vehicle plan ids are streamed in `MISSION_CURRENT`, allowing a GCS to determine if any part of the plan has changed and needs to be re-uploaded.

mav_set_gps_global_origin_s = Simulink.Bus()  % Sets the GPS coordinates of the vehicle local origin (0,0,0) position. Vehicle should emit GPS_GLOBAL_ORIGIN irrespective of whether the origin is changed. This enables transform between the local coordinate frame and the global (GPS) coordinate frame, which may be necessary when (for example) indoor and outdoor settings are connected and the MAV should move from in- to outdoor.
  target_system: uint8  % System ID
  latitude: int32  % Latitude (WGS84)
  longitude: int32  % Longitude (WGS84)
  altitude: int32  % Altitude (MSL). Positive for up.
  time_usec: fixdt(0,64,0)  % Timestamp (UNIX Epoch time or time since system boot). The receiving end can infer timestamp format (since 1.1.1970 or since system boot) by checking for the magnitude of the number.

mav_gps_global_origin_s = Simulink.Bus()  % Publishes the GPS coordinates of the vehicle local origin (0,0,0) position. Emitted whenever a new GPS-Local position mapping is requested or set - e.g. following SET_GPS_GLOBAL_ORIGIN message.
  latitude: int32  % Latitude (WGS84)
  longitude: int32  % Longitude (WGS84)
  altitude: int32  % Altitude (MSL). Positive for up.
  time_usec: fixdt(0,64,0)  % Timestamp (UNIX Epoch time or time since system boot). The receiving end can infer timestamp format (since 1.1.1970 or since system boot) by checking for the magnitude of the number.

mav_param_map_rc_s = Simulink.Bus()  % Bind a RC channel to a parameter. The parameter should change according to the RC channel value.
  target_system: uint8  % System ID
  target_component: uint8  % Component ID
  param_id: int8[16]  % Onboard parameter id, terminated by NULL if the length is less than 16 human-readable chars and WITHOUT null termination (NULL) byte if the length is exactly 16 chars - applications have to provide 16+1 bytes storage if the ID is stored as string
  param_index: int16  % Parameter index. Send -1 to use the param ID field as identifier (else the param id will be ignored), send -2 to disable any existing map for this rc_channel_index.
  parameter_rc_channel_index: uint8  % Index of parameter RC channel. Not equal to the RC channel id. Typically corresponds to a potentiometer-knob on the RC.
  param_value0: single  % Initial parameter value
  scale: single  % Scale, maps the RC range [-1, 1] to a parameter value
  param_value_min: single  % Minimum param value. The protocol does not define if this overwrites an onboard minimum value. (Depends on implementation)
  param_value_max: single  % Maximum param value. The protocol does not define if this overwrites an onboard maximum value. (Depends on implementation)

mav_mission_request_int_s = Simulink.Bus()  % Request the information of the mission item with the sequence number seq. The response of the system to this message should be a MISSION_ITEM_INT message. https://mavlink.io/en/services/mission.html
  target_system: uint8  % System ID
  target_component: uint8  % Component ID
  seq: uint16  % Sequence
  mission_type: uint8  % Mission type.

mav_safety_set_allowed_area_s = Simulink.Bus()  % Set a safety zone (volume), which is defined by two corners of a cube. This message can be used to tell the MAV which setpoints/waypoints to accept and which to reject. Safety areas are often enforced by national or competition regulations.
  target_system: uint8  % System ID
  target_component: uint8  % Component ID
  frame: uint8  % Coordinate frame. Can be either global, GPS, right-handed with Z axis up or local, right handed, Z axis down.
  p1x: single  % x position 1 / Latitude 1
  p1y: single  % y position 1 / Longitude 1
  p1z: single  % z position 1 / Altitude 1
  p2x: single  % x position 2 / Latitude 2
  p2y: single  % y position 2 / Longitude 2
  p2z: single  % z position 2 / Altitude 2

mav_safety_allowed_area_s = Simulink.Bus()  % Read out the safety zone the MAV currently assumes.
  frame: uint8  % Coordinate frame. Can be either global, GPS, right-handed with Z axis up or local, right handed, Z axis down.
  p1x: single  % x position 1 / Latitude 1
  p1y: single  % y position 1 / Longitude 1
  p1z: single  % z position 1 / Altitude 1
  p2x: single  % x position 2 / Latitude 2
  p2y: single  % y position 2 / Longitude 2
  p2z: single  % z position 2 / Altitude 2

mav_attitude_quaternion_cov_s = Simulink.Bus()  % The attitude in the aeronautical frame (right-handed, Z-down, X-front, Y-right), expressed as quaternion. Quaternion order is w, x, y, z and a zero rotation would be expressed as (1 0 0 0).
  time_usec: fixdt(0,64,0)  % Timestamp (UNIX Epoch time or time since system boot). The receiving end can infer timestamp format (since 1.1.1970 or since system boot) by checking for the magnitude of the number.
  q: single[4]  % Quaternion components, w, x, y, z (1 0 0 0 is the null-rotation)
  rollspeed: single  % Roll angular speed
  pitchspeed: single  % Pitch angular speed
  yawspeed: single  % Yaw angular speed
  covariance: single[9]  % Row-major representation of a 3x3 attitude covariance matrix (states: roll, pitch, yaw; first three entries are the first ROW, next three entries are the second row, etc.). If unknown, assign NaN value to first element in the array.

mav_nav_controller_output_s = Simulink.Bus()  % The state of the navigation and position controller.
  nav_roll: single  % Current desired roll
  nav_pitch: single  % Current desired pitch
  nav_bearing: int16  % Current desired heading
  target_bearing: int16  % Bearing to current waypoint/target
  wp_dist: uint16  % Distance to active waypoint
  alt_error: single  % Current altitude error
  aspd_error: single  % Current airspeed error
  xtrack_error: single  % Current crosstrack error on x-y plane

mav_global_position_int_cov_s = Simulink.Bus()  % The filtered global position (e.g. fused GPS and accelerometers). The position is in GPS-frame (right-handed, Z-up). It  is designed as scaled integer message since the resolution of float is not sufficient. NOTE: This message is intended for onboard networks / companion computers and higher-bandwidth links and optimized for accuracy and completeness. Please use the GLOBAL_POSITION_INT message for a minimal subset.
  time_usec: fixdt(0,64,0)  % Timestamp (UNIX Epoch time or time since system boot). The receiving end can infer timestamp format (since 1.1.1970 or since system boot) by checking for the magnitude of the number.
  estimator_type: uint8  % Class id of the estimator this estimate originated from.
  lat: int32  % Latitude
  lon: int32  % Longitude
  alt: int32  % Altitude in meters above MSL
  relative_alt: int32  % Altitude above ground
  vx: single  % Ground X Speed (Latitude)
  vy: single  % Ground Y Speed (Longitude)
  vz: single  % Ground Z Speed (Altitude)
  covariance: single[36]  % Row-major representation of a 6x6 position and velocity 6x6 cross-covariance matrix (states: lat, lon, alt, vx, vy, vz; first six entries are the first ROW, next six entries are the second row, etc.). If unknown, assign NaN value to first element in the array.

mav_local_position_ned_cov_s = Simulink.Bus()  % The filtered local position (e.g. fused computer vision and accelerometers). Coordinate frame is right-handed, Z-axis down (aeronautical frame, NED / north-east-down convention)
  time_usec: fixdt(0,64,0)  % Timestamp (UNIX Epoch time or time since system boot). The receiving end can infer timestamp format (since 1.1.1970 or since system boot) by checking for the magnitude of the number.
  estimator_type: uint8  % Class id of the estimator this estimate originated from.
  x: single  % X Position
  y: single  % Y Position
  z: single  % Z Position
  vx: single  % X Speed
  vy: single  % Y Speed
  vz: single  % Z Speed
  ax: single  % X Acceleration
  ay: single  % Y Acceleration
  az: single  % Z Acceleration
  covariance: single[45]  % Row-major representation of position, velocity and acceleration 9x9 cross-covariance matrix upper right triangle (states: x, y, z, vx, vy, vz, ax, ay, az; first nine entries are the first ROW, next eight entries are the second row, etc.). If unknown, assign NaN value to first element in the array.

mav_rc_channels_s = Simulink.Bus()  % The PPM values of the RC channels received. The standard PPM modulation is as follows: 1000 microseconds: 0%, 2000 microseconds: 100%.  A value of UINT16_MAX implies the channel is unused. Individual receivers/transmitters might violate this specification.
  time_boot_ms: uint32  % Timestamp (time since system boot).
  chancount: uint8  % Total number of RC channels being received. This can be larger than 18, indicating that more channels are available but not given in this message. This value should be 0 when no RC channels are available.
  chan1_raw: uint16  % RC channel 1 value.
  chan2_raw: uint16  % RC channel 2 value.
  chan3_raw: uint16  % RC channel 3 value.
  chan4_raw: uint16  % RC channel 4 value.
  chan5_raw: uint16  % RC channel 5 value.
  chan6_raw: uint16  % RC channel 6 value.
  chan7_raw: uint16  % RC channel 7 value.
  chan8_raw: uint16  % RC channel 8 value.
  chan9_raw: uint16  % RC channel 9 value.
  chan10_raw: uint16  % RC channel 10 value.
  chan11_raw: uint16  % RC channel 11 value.
  chan12_raw: uint16  % RC channel 12 value.
  chan13_raw: uint16  % RC channel 13 value.
  chan14_raw: uint16  % RC channel 14 value.
  chan15_raw: uint16  % RC channel 15 value.
  chan16_raw: uint16  % RC channel 16 value.
  chan17_raw: uint16  % RC channel 17 value.
  chan18_raw: uint16  % RC channel 18 value.
  rssi: uint8  % Receive signal strength indicator in device-dependent units/scale. Values: [0-254], UINT8_MAX: invalid/unknown.

mav_request_data_stream_s = Simulink.Bus()  % Request a data stream.
  target_system: uint8  % The target requested to send the message stream.
  target_component: uint8  % The target requested to send the message stream.
  req_stream_id: uint8  % The ID of the requested data stream
  req_message_rate: uint16  % The requested message rate
  start_stop: uint8  % 1 to start sending, 0 to stop sending.

mav_data_stream_s = Simulink.Bus()  % Data stream status information.
  stream_id: uint8  % The ID of the requested data stream
  message_rate: uint16  % The message rate
  on_off: uint8  % 1 stream is enabled, 0 stream is stopped.

mav_manual_control_s = Simulink.Bus()  % This message provides an API for manually controlling the vehicle using standard joystick axes nomenclature, along with a joystick-like input device. Unused axes can be disabled and buttons states are transmitted as individual on/off bits of a bitmask
  target: uint8  % The system to be controlled.
  x: int16  % X-axis, normalized to the range [-1000,1000]. A value of INT16_MAX indicates that this axis is invalid. Generally corresponds to forward(1000)-backward(-1000) movement on a joystick and the pitch of a vehicle.
  y: int16  % Y-axis, normalized to the range [-1000,1000]. A value of INT16_MAX indicates that this axis is invalid. Generally corresponds to left(-1000)-right(1000) movement on a joystick and the roll of a vehicle.
  z: int16  % Z-axis, normalized to the range [-1000,1000]. A value of INT16_MAX indicates that this axis is invalid. Generally corresponds to a separate slider movement with maximum being 1000 and minimum being -1000 on a joystick and the thrust of a vehicle. Positive values are positive thrust, negative values are negative thrust.
  r: int16  % R-axis, normalized to the range [-1000,1000]. A value of INT16_MAX indicates that this axis is invalid. Generally corresponds to a twisting of the joystick, with counter-clockwise being 1000 and clockwise being -1000, and the yaw of a vehicle.
  buttons: uint16  % A bitfield corresponding to the joystick buttons' 0-15 current state, 1 for pressed, 0 for released. The lowest bit corresponds to Button 1.
  buttons2: uint16  % A bitfield corresponding to the joystick buttons' 16-31 current state, 1 for pressed, 0 for released. The lowest bit corresponds to Button 16.
  enabled_extensions: uint8  % Set bits to 1 to indicate which of the following extension fields contain valid data: bit 0: pitch, bit 1: roll, bit 2: aux1, bit 3: aux2, bit 4: aux3, bit 5: aux4, bit 6: aux5, bit 7: aux6
  s: int16  % Pitch-only-axis, normalized to the range [-1000,1000]. Generally corresponds to pitch on vehicles with additional degrees of freedom. Valid if bit 0 of enabled_extensions field is set. Set to 0 if invalid.
  t: int16  % Roll-only-axis, normalized to the range [-1000,1000]. Generally corresponds to roll on vehicles with additional degrees of freedom. Valid if bit 1 of enabled_extensions field is set. Set to 0 if invalid.
  aux1: int16  % Aux continuous input field 1. Normalized in the range [-1000,1000]. Purpose defined by recipient. Valid data if bit 2 of enabled_extensions field is set. 0 if bit 2 is unset.
  aux2: int16  % Aux continuous input field 2. Normalized in the range [-1000,1000]. Purpose defined by recipient. Valid data if bit 3 of enabled_extensions field is set. 0 if bit 3 is unset.
  aux3: int16  % Aux continuous input field 3. Normalized in the range [-1000,1000]. Purpose defined by recipient. Valid data if bit 4 of enabled_extensions field is set. 0 if bit 4 is unset.
  aux4: int16  % Aux continuous input field 4. Normalized in the range [-1000,1000]. Purpose defined by recipient. Valid data if bit 5 of enabled_extensions field is set. 0 if bit 5 is unset.
  aux5: int16  % Aux continuous input field 5. Normalized in the range [-1000,1000]. Purpose defined by recipient. Valid data if bit 6 of enabled_extensions field is set. 0 if bit 6 is unset.
  aux6: int16  % Aux continuous input field 6. Normalized in the range [-1000,1000]. Purpose defined by recipient. Valid data if bit 7 of enabled_extensions field is set. 0 if bit 7 is unset.

mav_rc_channels_override_s = Simulink.Bus()  % The RAW values of the RC channels sent to the MAV to override info received from the RC radio. The standard PPM modulation is as follows: 1000 microseconds: 0%, 2000 microseconds: 100%. Individual receivers/transmitters might violate this specification.  Note carefully the semantic differences between the first 8 channels and the subsequent channels
  target_system: uint8  % System ID
  target_component: uint8  % Component ID
  chan1_raw: uint16  % RC channel 1 value. A value of UINT16_MAX means to ignore this field. A value of 0 means to release this channel back to the RC radio.
  chan2_raw: uint16  % RC channel 2 value. A value of UINT16_MAX means to ignore this field. A value of 0 means to release this channel back to the RC radio.
  chan3_raw: uint16  % RC channel 3 value. A value of UINT16_MAX means to ignore this field. A value of 0 means to release this channel back to the RC radio.
  chan4_raw: uint16  % RC channel 4 value. A value of UINT16_MAX means to ignore this field. A value of 0 means to release this channel back to the RC radio.
  chan5_raw: uint16  % RC channel 5 value. A value of UINT16_MAX means to ignore this field. A value of 0 means to release this channel back to the RC radio.
  chan6_raw: uint16  % RC channel 6 value. A value of UINT16_MAX means to ignore this field. A value of 0 means to release this channel back to the RC radio.
  chan7_raw: uint16  % RC channel 7 value. A value of UINT16_MAX means to ignore this field. A value of 0 means to release this channel back to the RC radio.
  chan8_raw: uint16  % RC channel 8 value. A value of UINT16_MAX means to ignore this field. A value of 0 means to release this channel back to the RC radio.
  chan9_raw: uint16  % RC channel 9 value. A value of 0 or UINT16_MAX means to ignore this field. A value of UINT16_MAX-1 means to release this channel back to the RC radio.
  chan10_raw: uint16  % RC channel 10 value. A value of 0 or UINT16_MAX means to ignore this field. A value of UINT16_MAX-1 means to release this channel back to the RC radio.
  chan11_raw: uint16  % RC channel 11 value. A value of 0 or UINT16_MAX means to ignore this field. A value of UINT16_MAX-1 means to release this channel back to the RC radio.
  chan12_raw: uint16  % RC channel 12 value. A value of 0 or UINT16_MAX means to ignore this field. A value of UINT16_MAX-1 means to release this channel back to the RC radio.
  chan13_raw: uint16  % RC channel 13 value. A value of 0 or UINT16_MAX means to ignore this field. A value of UINT16_MAX-1 means to release this channel back to the RC radio.
  chan14_raw: uint16  % RC channel 14 value. A value of 0 or UINT16_MAX means to ignore this field. A value of UINT16_MAX-1 means to release this channel back to the RC radio.
  chan15_raw: uint16  % RC channel 15 value. A value of 0 or UINT16_MAX means to ignore this field. A value of UINT16_MAX-1 means to release this channel back to the RC radio.
  chan16_raw: uint16  % RC channel 16 value. A value of 0 or UINT16_MAX means to ignore this field. A value of UINT16_MAX-1 means to release this channel back to the RC radio.
  chan17_raw: uint16  % RC channel 17 value. A value of 0 or UINT16_MAX means to ignore this field. A value of UINT16_MAX-1 means to release this channel back to the RC radio.
  chan18_raw: uint16  % RC channel 18 value. A value of 0 or UINT16_MAX means to ignore this field. A value of UINT16_MAX-1 means to release this channel back to the RC radio.

mav_mission_item_int_s = Simulink.Bus()  % Message encoding a mission item. This message is emitted to announce
  % the presence of a mission item and to set a mission item on the system. The mission item can be either in x, y, z meters (type: LOCAL) or x:lat, y:lon, z:altitude. Local frame is Z-down, right handed (NED), global frame is Z-up, right handed (ENU). NaN or INT32_MAX may be used in float/integer params (respectively) to indicate optional/default values (e.g. to use the component's current latitude, yaw rather than a specific value). See also https://mavlink.io/en/services/mission.html.
  target_system: uint8  % System ID
  target_component: uint8  % Component ID
  seq: uint16  % Waypoint ID (sequence number). Starts at zero. Increases monotonically for each waypoint, no gaps in the sequence (0,1,2,3,4).
  frame: uint8  % The coordinate system of the waypoint.
  command: uint16  % The scheduled action for the waypoint.
  current: uint8  % false:0, true:1
  autocontinue: uint8  % Autocontinue to next waypoint. 0: false, 1: true. Set false to pause mission after the item completes.
  param1: single  % PARAM1, see MAV_CMD enum
  param2: single  % PARAM2, see MAV_CMD enum
  param3: single  % PARAM3, see MAV_CMD enum
  param4: single  % PARAM4, see MAV_CMD enum
  x: int32  % PARAM5 / local: x position in meters * 1e4, global: latitude in degrees * 10^7
  y: int32  % PARAM6 / y position: local: x position in meters * 1e4, global: longitude in degrees *10^7
  z: single  % PARAM7 / z position: global: altitude in meters (relative or absolute, depending on frame.
  mission_type: uint8  % Mission type.

mav_vfr_hud_s = Simulink.Bus()  % Metrics typically displayed on a HUD for fixed wing aircraft.
  airspeed: single  % Vehicle speed in form appropriate for vehicle type. For standard aircraft this is typically calibrated airspeed (CAS) or indicated airspeed (IAS) - either of which can be used by a pilot to estimate stall speed.
  groundspeed: single  % Current ground speed.
  heading: int16  % Current heading in compass units (0-360, 0=north).
  throttle: uint16  % Current throttle setting (0 to 100).
  alt: single  % Current altitude (MSL).
  climb: single  % Current climb rate.

mav_command_int_s = Simulink.Bus()  % Send a command with up to seven parameters to the MAV, where params 5 and 6 are integers and the other values are floats. This is preferred over COMMAND_LONG as it allows the MAV_FRAME to be specified for interpreting positional information, such as altitude. COMMAND_INT is also preferred when sending latitude and longitude data in params 5 and 6, as it allows for greater precision. Param 5 and 6 encode positional data as scaled integers, where the scaling depends on the actual command value. NaN or INT32_MAX may be used in float/integer params (respectively) to indicate optional/default values (e.g. to use the component's current latitude, yaw rather than a specific value). The command microservice is documented at https://mavlink.io/en/services/command.html
  target_system: uint8  % System ID
  target_component: uint8  % Component ID
  frame: uint8  % The coordinate system of the COMMAND.
  command: uint16  % The scheduled action for the mission item.
  current: uint8  % Not used.
  autocontinue: uint8  % Not used (set 0).
  param1: single  % PARAM1, see MAV_CMD enum
  param2: single  % PARAM2, see MAV_CMD enum
  param3: single  % PARAM3, see MAV_CMD enum
  param4: single  % PARAM4, see MAV_CMD enum
  x: int32  % PARAM5 / local: x position in meters * 1e4, global: latitude in degrees * 10^7
  y: int32  % PARAM6 / local: y position in meters * 1e4, global: longitude in degrees * 10^7
  z: single  % PARAM7 / z position: global: altitude in meters (relative or absolute, depending on frame).

mav_command_long_s = Simulink.Bus()  % Send a command with up to seven parameters to the MAV. COMMAND_INT is generally preferred when sending MAV_CMD commands that include positional information; it offers higher precision and allows the MAV_FRAME to be specified (which may otherwise be ambiguous, particularly for altitude). The command microservice is documented at https://mavlink.io/en/services/command.html
  target_system: uint8  % System which should execute the command
  target_component: uint8  % Component which should execute the command, 0 for all components
  command: uint16  % Command ID (of command to send).
  confirmation: uint8  % 0: First transmission of this command. 1-255: Confirmation transmissions (e.g. for kill command)
  param1: single  % Parameter 1 (for the specific command).
  param2: single  % Parameter 2 (for the specific command).
  param3: single  % Parameter 3 (for the specific command).
  param4: single  % Parameter 4 (for the specific command).
  param5: single  % Parameter 5 (for the specific command).
  param6: single  % Parameter 6 (for the specific command).
  param7: single  % Parameter 7 (for the specific command).

mav_command_ack_s = Simulink.Bus()  % Report status of a command. Includes feedback whether the command was executed. The command microservice is documented at https://mavlink.io/en/services/command.html
  command: uint16  % Command ID (of acknowledged command).
  result: uint8  % Result of command.
  progress: uint8  % The progress percentage when result is MAV_RESULT_IN_PROGRESS. Values: [0-100], or UINT8_MAX if the progress is unknown.
  result_param2: int32  % Additional result information. Can be set with a command-specific enum containing command-specific error reasons for why the command might be denied. If used, the associated enum must be documented in the corresponding MAV_CMD (this enum should have a 0 value to indicate "unused" or "unknown").
  target_system: uint8  % System ID of the target recipient. This is the ID of the system that sent the command for which this COMMAND_ACK is an acknowledgement.
  target_component: uint8  % Component ID of the target recipient. This is the ID of the system that sent the command for which this COMMAND_ACK is an acknowledgement.

mav_command_cancel_s = Simulink.Bus()  % Cancel a long running command. The target system should respond with a COMMAND_ACK to the original command with result=MAV_RESULT_CANCELLED if the long running process was cancelled. If it has already completed, the cancel action can be ignored. The cancel action can be retried until some sort of acknowledgement to the original command has been received. The command microservice is documented at https://mavlink.io/en/services/command.html
  target_system: uint8  % System executing long running command. Should not be broadcast (0).
  target_component: uint8  % Component executing long running command.
  command: uint16  % Command ID (of command to cancel).

mav_manual_setpoint_s = Simulink.Bus()  % Setpoint in roll, pitch, yaw and thrust from the operator
  time_boot_ms: uint32  % Timestamp (time since system boot).
  roll: single  % Desired roll rate
  pitch: single  % Desired pitch rate
  yaw: single  % Desired yaw rate
  thrust: single  % Collective thrust, normalized to 0 .. 1
  mode_switch: uint8  % Flight mode switch position, 0.. 255
  manual_override_switch: uint8  % Override mode switch position, 0.. 255

mav_set_attitude_target_s = Simulink.Bus()  % Sets a desired vehicle attitude. Used by an external controller to command the vehicle (manual controller or other system).
  time_boot_ms: uint32  % Timestamp (time since system boot).
  target_system: uint8  % System ID
  target_component: uint8  % Component ID
  type_mask: uint8  % Bitmap to indicate which dimensions should be ignored by the vehicle.
  q: single[4]  % Attitude quaternion (w, x, y, z order, zero-rotation is 1, 0, 0, 0) from MAV_FRAME_LOCAL_NED to MAV_FRAME_BODY_FRD
  body_roll_rate: single  % Body roll rate
  body_pitch_rate: single  % Body pitch rate
  body_yaw_rate: single  % Body yaw rate
  thrust: single  % Collective thrust, normalized to 0 .. 1 (-1 .. 1 for vehicles capable of reverse trust)
  thrust_body: single[3]  % 3D thrust setpoint in the body NED frame, normalized to -1 .. 1

mav_attitude_target_s = Simulink.Bus()  % Reports the current commanded attitude of the vehicle as specified by the autopilot. This should match the commands sent in a SET_ATTITUDE_TARGET message if the vehicle is being controlled this way.
  time_boot_ms: uint32  % Timestamp (time since system boot).
  type_mask: uint8  % Bitmap to indicate which dimensions should be ignored by the vehicle.
  q: single[4]  % Attitude quaternion (w, x, y, z order, zero-rotation is 1, 0, 0, 0)
  body_roll_rate: single  % Body roll rate
  body_pitch_rate: single  % Body pitch rate
  body_yaw_rate: single  % Body yaw rate
  thrust: single  % Collective thrust, normalized to 0 .. 1 (-1 .. 1 for vehicles capable of reverse trust)

mav_set_position_target_local_ned_s = Simulink.Bus()  % Sets a desired vehicle position in a local north-east-down coordinate frame. Used by an external controller to command the vehicle (manual controller or other system).
  time_boot_ms: uint32  % Timestamp (time since system boot).
  target_system: uint8  % System ID
  target_component: uint8  % Component ID
  coordinate_frame: uint8  % Valid options are: MAV_FRAME_LOCAL_NED = 1, MAV_FRAME_LOCAL_OFFSET_NED = 7, MAV_FRAME_BODY_NED = 8, MAV_FRAME_BODY_OFFSET_NED = 9
  type_mask: uint16  % Bitmap to indicate which dimensions should be ignored by the vehicle.
  x: single  % X Position in NED frame
  y: single  % Y Position in NED frame
  z: single  % Z Position in NED frame (note, altitude is negative in NED)
  vx: single  % X velocity in NED frame
  vy: single  % Y velocity in NED frame
  vz: single  % Z velocity in NED frame
  afx: single  % X acceleration or force (if bit 10 of type_mask is set) in NED frame in meter / s^2 or N
  afy: single  % Y acceleration or force (if bit 10 of type_mask is set) in NED frame in meter / s^2 or N
  afz: single  % Z acceleration or force (if bit 10 of type_mask is set) in NED frame in meter / s^2 or N
  yaw: single  % yaw setpoint
  yaw_rate: single  % yaw rate setpoint

mav_position_target_local_ned_s = Simulink.Bus()  % Reports the current commanded vehicle position, velocity, and acceleration as specified by the autopilot. This should match the commands sent in SET_POSITION_TARGET_LOCAL_NED if the vehicle is being controlled this way.
  time_boot_ms: uint32  % Timestamp (time since system boot).
  coordinate_frame: uint8  % Valid options are: MAV_FRAME_LOCAL_NED = 1, MAV_FRAME_LOCAL_OFFSET_NED = 7, MAV_FRAME_BODY_NED = 8, MAV_FRAME_BODY_OFFSET_NED = 9
  type_mask: uint16  % Bitmap to indicate which dimensions should be ignored by the vehicle.
  x: single  % X Position in NED frame
  y: single  % Y Position in NED frame
  z: single  % Z Position in NED frame (note, altitude is negative in NED)
  vx: single  % X velocity in NED frame
  vy: single  % Y velocity in NED frame
  vz: single  % Z velocity in NED frame
  afx: single  % X acceleration or force (if bit 10 of type_mask is set) in NED frame in meter / s^2 or N
  afy: single  % Y acceleration or force (if bit 10 of type_mask is set) in NED frame in meter / s^2 or N
  afz: single  % Z acceleration or force (if bit 10 of type_mask is set) in NED frame in meter / s^2 or N
  yaw: single  % yaw setpoint
  yaw_rate: single  % yaw rate setpoint

mav_set_position_target_global_int_s = Simulink.Bus()  % Sets a desired vehicle position, velocity, and/or acceleration in a global coordinate system (WGS84). Used by an external controller to command the vehicle (manual controller or other system).
  time_boot_ms: uint32  % Timestamp (time since system boot). The rationale for the timestamp in the setpoint is to allow the system to compensate for the transport delay of the setpoint. This allows the system to compensate processing latency.
  target_system: uint8  % System ID
  target_component: uint8  % Component ID
  coordinate_frame: uint8  % Valid options are: MAV_FRAME_GLOBAL_INT = 5, MAV_FRAME_GLOBAL_RELATIVE_ALT_INT = 6, MAV_FRAME_GLOBAL_TERRAIN_ALT_INT = 11
  type_mask: uint16  % Bitmap to indicate which dimensions should be ignored by the vehicle.
  lat_int: int32  % X Position in WGS84 frame
  lon_int: int32  % Y Position in WGS84 frame
  alt: single  % Altitude (MSL, Relative to home, or AGL - depending on frame)
  vx: single  % X velocity in NED frame
  vy: single  % Y velocity in NED frame
  vz: single  % Z velocity in NED frame
  afx: single  % X acceleration or force (if bit 10 of type_mask is set) in NED frame in meter / s^2 or N
  afy: single  % Y acceleration or force (if bit 10 of type_mask is set) in NED frame in meter / s^2 or N
  afz: single  % Z acceleration or force (if bit 10 of type_mask is set) in NED frame in meter / s^2 or N
  yaw: single  % yaw setpoint
  yaw_rate: single  % yaw rate setpoint

mav_position_target_global_int_s = Simulink.Bus()  % Reports the current commanded vehicle position, velocity, and acceleration as specified by the autopilot. This should match the commands sent in SET_POSITION_TARGET_GLOBAL_INT if the vehicle is being controlled this way.
  time_boot_ms: uint32  % Timestamp (time since system boot). The rationale for the timestamp in the setpoint is to allow the system to compensate for the transport delay of the setpoint. This allows the system to compensate processing latency.
  coordinate_frame: uint8  % Valid options are: MAV_FRAME_GLOBAL_INT = 5, MAV_FRAME_GLOBAL_RELATIVE_ALT_INT = 6, MAV_FRAME_GLOBAL_TERRAIN_ALT_INT = 11
  type_mask: uint16  % Bitmap to indicate which dimensions should be ignored by the vehicle.
  lat_int: int32  % X Position in WGS84 frame
  lon_int: int32  % Y Position in WGS84 frame
  alt: single  % Altitude (MSL, AGL or relative to home altitude, depending on frame)
  vx: single  % X velocity in NED frame
  vy: single  % Y velocity in NED frame
  vz: single  % Z velocity in NED frame
  afx: single  % X acceleration or force (if bit 10 of type_mask is set) in NED frame in meter / s^2 or N
  afy: single  % Y acceleration or force (if bit 10 of type_mask is set) in NED frame in meter / s^2 or N
  afz: single  % Z acceleration or force (if bit 10 of type_mask is set) in NED frame in meter / s^2 or N
  yaw: single  % yaw setpoint
  yaw_rate: single  % yaw rate setpoint

mav_local_position_ned_system_global_offset_s = Simulink.Bus()  % The offset in X, Y, Z and yaw between the LOCAL_POSITION_NED messages of MAV X and the global coordinate frame in NED coordinates. Coordinate frame is right-handed, Z-axis down (aeronautical frame, NED / north-east-down convention)
  time_boot_ms: uint32  % Timestamp (time since system boot).
  x: single  % X Position
  y: single  % Y Position
  z: single  % Z Position
  roll: single  % Roll
  pitch: single  % Pitch
  yaw: single  % Yaw

mav_hil_state_s = Simulink.Bus()  % Sent from simulation to autopilot. This packet is useful for high throughput applications such as hardware in the loop simulations.
  time_usec: fixdt(0,64,0)  % Timestamp (UNIX Epoch time or time since system boot). The receiving end can infer timestamp format (since 1.1.1970 or since system boot) by checking for the magnitude of the number.
  roll: single  % Roll angle
  pitch: single  % Pitch angle
  yaw: single  % Yaw angle
  rollspeed: single  % Body frame roll / phi angular speed
  pitchspeed: single  % Body frame pitch / theta angular speed
  yawspeed: single  % Body frame yaw / psi angular speed
  lat: int32  % Latitude
  lon: int32  % Longitude
  alt: int32  % Altitude
  vx: int16  % Ground X Speed (Latitude)
  vy: int16  % Ground Y Speed (Longitude)
  vz: int16  % Ground Z Speed (Altitude)
  xacc: int16  % X acceleration
  yacc: int16  % Y acceleration
  zacc: int16  % Z acceleration

mav_hil_controls_s = Simulink.Bus()  % Sent from autopilot to simulation. Hardware in the loop control outputs
  time_usec: fixdt(0,64,0)  % Timestamp (UNIX Epoch time or time since system boot). The receiving end can infer timestamp format (since 1.1.1970 or since system boot) by checking for the magnitude of the number.
  roll_ailerons: single  % Control output -1 .. 1
  pitch_elevator: single  % Control output -1 .. 1
  yaw_rudder: single  % Control output -1 .. 1
  throttle: single  % Throttle 0 .. 1
  aux1: single  % Aux 1, -1 .. 1
  aux2: single  % Aux 2, -1 .. 1
  aux3: single  % Aux 3, -1 .. 1
  aux4: single  % Aux 4, -1 .. 1
  mode: uint8  % System mode.
  nav_mode: uint8  % Navigation mode (MAV_NAV_MODE)

mav_hil_rc_inputs_raw_s = Simulink.Bus()  % Sent from simulation to autopilot. The RAW values of the RC channels received. The standard PPM modulation is as follows: 1000 microseconds: 0%, 2000 microseconds: 100%. Individual receivers/transmitters might violate this specification.
  time_usec: fixdt(0,64,0)  % Timestamp (UNIX Epoch time or time since system boot). The receiving end can infer timestamp format (since 1.1.1970 or since system boot) by checking for the magnitude of the number.
  chan1_raw: uint16  % RC channel 1 value
  chan2_raw: uint16  % RC channel 2 value
  chan3_raw: uint16  % RC channel 3 value
  chan4_raw: uint16  % RC channel 4 value
  chan5_raw: uint16  % RC channel 5 value
  chan6_raw: uint16  % RC channel 6 value
  chan7_raw: uint16  % RC channel 7 value
  chan8_raw: uint16  % RC channel 8 value
  chan9_raw: uint16  % RC channel 9 value
  chan10_raw: uint16  % RC channel 10 value
  chan11_raw: uint16  % RC channel 11 value
  chan12_raw: uint16  % RC channel 12 value
  rssi: uint8  % Receive signal strength indicator in device-dependent units/scale. Values: [0-254], UINT8_MAX: invalid/unknown.

mav_hil_actuator_controls_s = Simulink.Bus()  % Sent from autopilot to simulation. Hardware in the loop control outputs (replacement for HIL_CONTROLS)
  time_usec: fixdt(0,64,0)  % Timestamp (UNIX Epoch time or time since system boot). The receiving end can infer timestamp format (since 1.1.1970 or since system boot) by checking for the magnitude of the number.
  controls: single[16]  % Control outputs -1 .. 1. Channel assignment depends on the simulated hardware.
  mode: uint8  % System mode. Includes arming state.
  flags: fixdt(0,64,0)  % Flags as bitfield, 1: indicate simulation using lockstep.

mav_optical_flow_s = Simulink.Bus()  % Optical flow from a flow sensor (e.g. optical mouse sensor)
  time_usec: fixdt(0,64,0)  % Timestamp (UNIX Epoch time or time since system boot). The receiving end can infer timestamp format (since 1.1.1970 or since system boot) by checking for the magnitude of the number.
  sensor_id: uint8  % Sensor ID
  flow_x: int16  % Flow in x-sensor direction
  flow_y: int16  % Flow in y-sensor direction
  flow_comp_m_x: single  % Flow in x-sensor direction, angular-speed compensated
  flow_comp_m_y: single  % Flow in y-sensor direction, angular-speed compensated
  quality: uint8  % Optical flow quality / confidence. 0: bad, 255: maximum quality
  ground_distance: single  % Ground distance. Positive value: distance known. Negative value: Unknown distance
  flow_rate_x: single  % Flow rate about X axis
  flow_rate_y: single  % Flow rate about Y axis

mav_global_vision_position_estimate_s = Simulink.Bus()  % Global position/attitude estimate from a vision source.
  usec: fixdt(0,64,0)  % Timestamp (UNIX time or since system boot)
  x: single  % Global X position
  y: single  % Global Y position
  z: single  % Global Z position
  roll: single  % Roll angle
  pitch: single  % Pitch angle
  yaw: single  % Yaw angle
  covariance: single[21]  % Row-major representation of pose 6x6 cross-covariance matrix upper right triangle (states: x_global, y_global, z_global, roll, pitch, yaw; first six entries are the first ROW, next five entries are the second ROW, etc.). If unknown, assign NaN value to first element in the array.
  reset_counter: uint8  % Estimate reset counter. This should be incremented when the estimate resets in any of the dimensions (position, velocity, attitude, angular speed). This is designed to be used when e.g an external SLAM system detects a loop-closure and the estimate jumps.

mav_vision_position_estimate_s = Simulink.Bus()  % Local position/attitude estimate from a vision source.
  usec: fixdt(0,64,0)  % Timestamp (UNIX time or time since system boot)
  x: single  % Local X position
  y: single  % Local Y position
  z: single  % Local Z position
  roll: single  % Roll angle
  pitch: single  % Pitch angle
  yaw: single  % Yaw angle
  covariance: single[21]  % Row-major representation of pose 6x6 cross-covariance matrix upper right triangle (states: x, y, z, roll, pitch, yaw; first six entries are the first ROW, next five entries are the second ROW, etc.). If unknown, assign NaN value to first element in the array.
  reset_counter: uint8  % Estimate reset counter. This should be incremented when the estimate resets in any of the dimensions (position, velocity, attitude, angular speed). This is designed to be used when e.g an external SLAM system detects a loop-closure and the estimate jumps.

mav_vision_speed_estimate_s = Simulink.Bus()  % Speed estimate from a vision source.
  usec: fixdt(0,64,0)  % Timestamp (UNIX time or time since system boot)
  x: single  % Global X speed
  y: single  % Global Y speed
  z: single  % Global Z speed
  covariance: single[9]  % Row-major representation of 3x3 linear velocity covariance matrix (states: vx, vy, vz; 1st three entries - 1st row, etc.). If unknown, assign NaN value to first element in the array.
  reset_counter: uint8  % Estimate reset counter. This should be incremented when the estimate resets in any of the dimensions (position, velocity, attitude, angular speed). This is designed to be used when e.g an external SLAM system detects a loop-closure and the estimate jumps.

mav_vicon_position_estimate_s = Simulink.Bus()  % Global position estimate from a Vicon motion system source.
  usec: fixdt(0,64,0)  % Timestamp (UNIX time or time since system boot)
  x: single  % Global X position
  y: single  % Global Y position
  z: single  % Global Z position
  roll: single  % Roll angle
  pitch: single  % Pitch angle
  yaw: single  % Yaw angle
  covariance: single[21]  % Row-major representation of 6x6 pose cross-covariance matrix upper right triangle (states: x, y, z, roll, pitch, yaw; first six entries are the first ROW, next five entries are the second ROW, etc.). If unknown, assign NaN value to first element in the array.

mav_highres_imu_s = Simulink.Bus()  % The IMU readings in SI units in NED body frame
  time_usec: fixdt(0,64,0)  % Timestamp (UNIX Epoch time or time since system boot). The receiving end can infer timestamp format (since 1.1.1970 or since system boot) by checking for the magnitude of the number.
  xacc: single  % X acceleration
  yacc: single  % Y acceleration
  zacc: single  % Z acceleration
  xgyro: single  % Angular speed around X axis
  ygyro: single  % Angular speed around Y axis
  zgyro: single  % Angular speed around Z axis
  xmag: single  % X Magnetic field
  ymag: single  % Y Magnetic field
  zmag: single  % Z Magnetic field
  abs_pressure: single  % Absolute pressure
  diff_pressure: single  % Differential pressure
  pressure_alt: single  % Altitude calculated from pressure
  temperature: single  % Temperature
  fields_updated: uint16  % Bitmap for fields that have updated since last message
  id: uint8  % Id. Ids are numbered from 0 and map to IMUs numbered from 1 (e.g. IMU1 will have a message with id=0)

mav_optical_flow_rad_s = Simulink.Bus()  % Optical flow from an angular rate flow sensor (e.g. PX4FLOW or mouse sensor)
  time_usec: fixdt(0,64,0)  % Timestamp (UNIX Epoch time or time since system boot). The receiving end can infer timestamp format (since 1.1.1970 or since system boot) by checking for the magnitude of the number.
  sensor_id: uint8  % Sensor ID
  integration_time_us: uint32  % Integration time. Divide integrated_x and integrated_y by the integration time to obtain average flow. The integration time also indicates the.
  integrated_x: single  % Flow around X axis (Sensor RH rotation about the X axis induces a positive flow. Sensor linear motion along the positive Y axis induces a negative flow.)
  integrated_y: single  % Flow around Y axis (Sensor RH rotation about the Y axis induces a positive flow. Sensor linear motion along the positive X axis induces a positive flow.)
  integrated_xgyro: single  % RH rotation around X axis
  integrated_ygyro: single  % RH rotation around Y axis
  integrated_zgyro: single  % RH rotation around Z axis
  temperature: int16  % Temperature
  quality: uint8  % Optical flow quality / confidence. 0: no valid flow, 255: maximum quality
  time_delta_distance_us: uint32  % Time since the distance was sampled.
  distance: single  % Distance to the center of the flow field. Positive value (including zero): distance known. Negative value: Unknown distance.

mav_hil_sensor_s = Simulink.Bus()  % The IMU readings in SI units in NED body frame
  time_usec: fixdt(0,64,0)  % Timestamp (UNIX Epoch time or time since system boot). The receiving end can infer timestamp format (since 1.1.1970 or since system boot) by checking for the magnitude of the number.
  xacc: single  % X acceleration
  yacc: single  % Y acceleration
  zacc: single  % Z acceleration
  xgyro: single  % Angular speed around X axis in body frame
  ygyro: single  % Angular speed around Y axis in body frame
  zgyro: single  % Angular speed around Z axis in body frame
  xmag: single  % X Magnetic field
  ymag: single  % Y Magnetic field
  zmag: single  % Z Magnetic field
  abs_pressure: single  % Absolute pressure
  diff_pressure: single  % Differential pressure (airspeed)
  pressure_alt: single  % Altitude calculated from pressure
  temperature: single  % Temperature
  fields_updated: uint32  % Bitmap for fields that have updated since last message
  id: uint8  % Sensor ID (zero indexed). Used for multiple sensor inputs

mav_sim_state_s = Simulink.Bus()  % Status of simulation environment, if used
  q1: single  % True attitude quaternion component 1, w (1 in null-rotation)
  q2: single  % True attitude quaternion component 2, x (0 in null-rotation)
  q3: single  % True attitude quaternion component 3, y (0 in null-rotation)
  q4: single  % True attitude quaternion component 4, z (0 in null-rotation)
  roll: single  % Attitude roll expressed as Euler angles, not recommended except for human-readable outputs
  pitch: single  % Attitude pitch expressed as Euler angles, not recommended except for human-readable outputs
  yaw: single  % Attitude yaw expressed as Euler angles, not recommended except for human-readable outputs
  xacc: single  % X acceleration
  yacc: single  % Y acceleration
  zacc: single  % Z acceleration
  xgyro: single  % Angular speed around X axis
  ygyro: single  % Angular speed around Y axis
  zgyro: single  % Angular speed around Z axis
  lat: single  % Latitude (lower precision). Both this and the lat_int field should be set.
  lon: single  % Longitude (lower precision). Both this and the lon_int field should be set.
  alt: single  % Altitude
  std_dev_horz: single  % Horizontal position standard deviation
  std_dev_vert: single  % Vertical position standard deviation
  vn: single  % True velocity in north direction in earth-fixed NED frame
  ve: single  % True velocity in east direction in earth-fixed NED frame
  vd: single  % True velocity in down direction in earth-fixed NED frame
  lat_int: int32  % Latitude (higher precision). If 0, recipients should use the lat field value (otherwise this field is preferred).
  lon_int: int32  % Longitude (higher precision). If 0, recipients should use the lon field value (otherwise this field is preferred).

mav_radio_status_s = Simulink.Bus()  % Status generated by radio and injected into MAVLink stream.
  rssi: uint8  % Local (message sender) received signal strength indication in device-dependent units/scale. Values: [0-254], UINT8_MAX: invalid/unknown.
  remrssi: uint8  % Remote (message receiver) signal strength indication in device-dependent units/scale. Values: [0-254], UINT8_MAX: invalid/unknown.
  txbuf: uint8  % Remaining free transmitter buffer space.
  noise: uint8  % Local background noise level. These are device dependent RSSI values (scale as approx 2x dB on SiK radios). Values: [0-254], UINT8_MAX: invalid/unknown.
  remnoise: uint8  % Remote background noise level. These are device dependent RSSI values (scale as approx 2x dB on SiK radios). Values: [0-254], UINT8_MAX: invalid/unknown.
  rxerrors: uint16  % Count of radio packet receive errors (since boot).
  fixed: uint16  % Count of error corrected radio packets (since boot).

mav_file_transfer_protocol_s = Simulink.Bus()  % File transfer protocol message: https://mavlink.io/en/services/ftp.html.
  target_network: uint8  % Network ID (0 for broadcast)
  target_system: uint8  % System ID (0 for broadcast)
  target_component: uint8  % Component ID (0 for broadcast)
  payload: uint8[251]  % Variable length payload. The length is defined by the remaining message length when subtracting the header and other fields. The content/format of this block is defined in https://mavlink.io/en/services/ftp.html.

mav_timesync_s = Simulink.Bus()  % Time synchronization message.
  % The message is used for both timesync requests and responses.
  % The request is sent with `ts1=syncing component timestamp` and `tc1=0`, and may be broadcast or targeted to a specific system/component.
  % The response is sent with `ts1=syncing component timestamp` (mirror back unchanged), and `tc1=responding component timestamp`, with the `target_system` and `target_component` set to ids of the original request.
  % Systems can determine if they are receiving a request or response based on the value of `tc`.
  % If the response has `target_system==target_component==0` the remote system has not been updated to use the component IDs and cannot reliably timesync; the requestor may report an error.
  % Timestamps are UNIX Epoch time or time since system boot in nanoseconds (the timestamp format can be inferred by checking for the magnitude of the number; generally it doesn't matter as only the offset is used).
  % The message sequence is repeated numerous times with results being filtered/averaged to estimate the offset.
  tc1: fixdt(1,64,0)  % Time sync timestamp 1. Syncing: 0. Responding: Timestamp of responding component.
  ts1: fixdt(1,64,0)  % Time sync timestamp 2. Timestamp of syncing component (mirrored in response).
  target_system: uint8  % Target system id. Request: 0 (broadcast) or id of specific system. Response must contain system id of the requesting component.
  target_component: uint8  % Target component id. Request: 0 (broadcast) or id of specific component. Response must contain component id of the requesting component.

mav_camera_trigger_s = Simulink.Bus()  % Camera-IMU triggering and synchronisation message.
  time_usec: fixdt(0,64,0)  % Timestamp for image frame (UNIX Epoch time or time since system boot). The receiving end can infer timestamp format (since 1.1.1970 or since system boot) by checking for the magnitude of the number.
  seq: uint32  % Image frame sequence

mav_hil_gps_s = Simulink.Bus()  % The global position, as returned by the Global Positioning System (GPS). This is
  % NOT the global position estimate of the system, but rather a RAW sensor value. See message GLOBAL_POSITION_INT for the global position estimate.
  time_usec: fixdt(0,64,0)  % Timestamp (UNIX Epoch time or time since system boot). The receiving end can infer timestamp format (since 1.1.1970 or since system boot) by checking for the magnitude of the number.
  fix_type: uint8  % 0-1: no fix, 2: 2D fix, 3: 3D fix. Some applications will not use the value of this field unless it is at least two, so always correctly fill in the fix.
  lat: int32  % Latitude (WGS84)
  lon: int32  % Longitude (WGS84)
  alt: int32  % Altitude (MSL). Positive for up.
  eph: uint16  % GPS HDOP horizontal dilution of position (unitless * 100). If unknown, set to: UINT16_MAX
  epv: uint16  % GPS VDOP vertical dilution of position (unitless * 100). If unknown, set to: UINT16_MAX
  vel: uint16  % GPS ground speed. If unknown, set to: UINT16_MAX
  vn: int16  % GPS velocity in north direction in earth-fixed NED frame
  ve: int16  % GPS velocity in east direction in earth-fixed NED frame
  vd: int16  % GPS velocity in down direction in earth-fixed NED frame
  cog: uint16  % Course over ground (NOT heading, but direction of movement), 0.0..359.99 degrees. If unknown, set to: UINT16_MAX
  satellites_visible: uint8  % Number of satellites visible. If unknown, set to UINT8_MAX
  id: uint8  % GPS ID (zero indexed). Used for multiple GPS inputs
  yaw: uint16  % Yaw of vehicle relative to Earth's North, zero means not available, use 36000 for north

mav_hil_optical_flow_s = Simulink.Bus()  % Simulated optical flow from a flow sensor (e.g. PX4FLOW or optical mouse sensor)
  time_usec: fixdt(0,64,0)  % Timestamp (UNIX Epoch time or time since system boot). The receiving end can infer timestamp format (since 1.1.1970 or since system boot) by checking for the magnitude of the number.
  sensor_id: uint8  % Sensor ID
  integration_time_us: uint32  % Integration time. Divide integrated_x and integrated_y by the integration time to obtain average flow. The integration time also indicates the.
  integrated_x: single  % Flow in radians around X axis (Sensor RH rotation about the X axis induces a positive flow. Sensor linear motion along the positive Y axis induces a negative flow.)
  integrated_y: single  % Flow in radians around Y axis (Sensor RH rotation about the Y axis induces a positive flow. Sensor linear motion along the positive X axis induces a positive flow.)
  integrated_xgyro: single  % RH rotation around X axis
  integrated_ygyro: single  % RH rotation around Y axis
  integrated_zgyro: single  % RH rotation around Z axis
  temperature: int16  % Temperature
  quality: uint8  % Optical flow quality / confidence. 0: no valid flow, 255: maximum quality
  time_delta_distance_us: uint32  % Time since the distance was sampled.
  distance: single  % Distance to the center of the flow field. Positive value (including zero): distance known. Negative value: Unknown distance.

mav_hil_state_quaternion_s = Simulink.Bus()  % Sent from simulation to autopilot, avoids in contrast to HIL_STATE singularities. This packet is useful for high throughput applications such as hardware in the loop simulations.
  time_usec: fixdt(0,64,0)  % Timestamp (UNIX Epoch time or time since system boot). The receiving end can infer timestamp format (since 1.1.1970 or since system boot) by checking for the magnitude of the number.
  attitude_quaternion: single[4]  % Vehicle attitude expressed as normalized quaternion in w, x, y, z order (with 1 0 0 0 being the null-rotation)
  rollspeed: single  % Body frame roll / phi angular speed
  pitchspeed: single  % Body frame pitch / theta angular speed
  yawspeed: single  % Body frame yaw / psi angular speed
  lat: int32  % Latitude
  lon: int32  % Longitude
  alt: int32  % Altitude
  vx: int16  % Ground X Speed (Latitude)
  vy: int16  % Ground Y Speed (Longitude)
  vz: int16  % Ground Z Speed (Altitude)
  ind_airspeed: uint16  % Indicated airspeed
  true_airspeed: uint16  % True airspeed
  xacc: int16  % X acceleration
  yacc: int16  % Y acceleration
  zacc: int16  % Z acceleration

mav_scaled_imu2_s = Simulink.Bus()  % The RAW IMU readings for secondary 9DOF sensor setup. This message should contain the scaled values to the described units
  time_boot_ms: uint32  % Timestamp (time since system boot).
  xacc: int16  % X acceleration
  yacc: int16  % Y acceleration
  zacc: int16  % Z acceleration
  xgyro: int16  % Angular speed around X axis
  ygyro: int16  % Angular speed around Y axis
  zgyro: int16  % Angular speed around Z axis
  xmag: int16  % X Magnetic field
  ymag: int16  % Y Magnetic field
  zmag: int16  % Z Magnetic field
  temperature: int16  % Temperature, 0: IMU does not provide temperature values. If the IMU is at 0C it must send 1 (0.01C).

mav_log_request_list_s = Simulink.Bus()  % Request a list of available logs. On some systems calling this may stop on-board logging until LOG_REQUEST_END is called. If there are no log files available this request shall be answered with one LOG_ENTRY message with id = 0 and num_logs = 0.
  target_system: uint8  % System ID
  target_component: uint8  % Component ID
  start: uint16  % First log id (0 for first available)
  end: uint16  % Last log id (0xffff for last available)

mav_log_entry_s = Simulink.Bus()  % Reply to LOG_REQUEST_LIST
  id: uint16  % Log id
  num_logs: uint16  % Total number of logs
  last_log_num: uint16  % High log number
  time_utc: uint32  % UTC timestamp of log since 1970, or 0 if not available
  size: uint32  % Size of the log (may be approximate)

mav_log_request_data_s = Simulink.Bus()  % Request a chunk of a log
  target_system: uint8  % System ID
  target_component: uint8  % Component ID
  id: uint16  % Log id (from LOG_ENTRY reply)
  ofs: uint32  % Offset into the log
  count: uint32  % Number of bytes

mav_log_data_s = Simulink.Bus()  % Reply to LOG_REQUEST_DATA
  id: uint16  % Log id (from LOG_ENTRY reply)
  ofs: uint32  % Offset into the log
  count: uint8  % Number of bytes (zero for end of log)
  data: uint8[90]  % log data

mav_log_erase_s = Simulink.Bus()  % Erase all logs
  target_system: uint8  % System ID
  target_component: uint8  % Component ID

mav_log_request_end_s = Simulink.Bus()  % Stop log transfer and resume normal logging
  target_system: uint8  % System ID
  target_component: uint8  % Component ID

mav_gps_inject_data_s = Simulink.Bus()  % Data for injecting into the onboard GPS (used for DGPS)
  target_system: uint8  % System ID
  target_component: uint8  % Component ID
  len: uint8  % Data length
  data: uint8[110]  % Raw data (110 is enough for 12 satellites of RTCMv2)

mav_gps2_raw_s = Simulink.Bus()  % Second GPS data.
  time_usec: fixdt(0,64,0)  % Timestamp (UNIX Epoch time or time since system boot). The receiving end can infer timestamp format (since 1.1.1970 or since system boot) by checking for the magnitude of the number.
  fix_type: uint8  % GPS fix type.
  lat: int32  % Latitude (WGS84)
  lon: int32  % Longitude (WGS84)
  alt: int32  % Altitude (MSL). Positive for up.
  eph: uint16  % GPS HDOP horizontal dilution of position (unitless * 100). If unknown, set to: UINT16_MAX
  epv: uint16  % GPS VDOP vertical dilution of position (unitless * 100). If unknown, set to: UINT16_MAX
  vel: uint16  % GPS ground speed. If unknown, set to: UINT16_MAX
  cog: uint16  % Course over ground (NOT heading, but direction of movement): 0.0..359.99 degrees. If unknown, set to: UINT16_MAX
  satellites_visible: uint8  % Number of satellites visible. If unknown, set to UINT8_MAX
  dgps_numch: uint8  % Number of DGPS satellites
  dgps_age: uint32  % Age of DGPS info
  yaw: uint16  % Yaw in earth frame from north. Use 0 if this GPS does not provide yaw. Use UINT16_MAX if this GPS is configured to provide yaw and is currently unable to provide it. Use 36000 for north.
  alt_ellipsoid: int32  % Altitude (above WGS84, EGM96 ellipsoid). Positive for up.
  h_acc: uint32  % Position uncertainty.
  v_acc: uint32  % Altitude uncertainty.
  vel_acc: uint32  % Speed uncertainty.
  hdg_acc: uint32  % Heading / track uncertainty

mav_power_status_s = Simulink.Bus()  % Power supply status
  Vcc: uint16  % 5V rail voltage.
  Vservo: uint16  % Servo rail voltage.
  flags: uint16  % Bitmap of power supply status flags.

mav_serial_control_s = Simulink.Bus()  % Control a serial port. This can be used for raw access to an onboard serial peripheral such as a GPS or telemetry radio. It is designed to make it possible to update the devices firmware via MAVLink messages or change the devices settings. A message with zero bytes can be used to change just the baudrate.
  device: uint8  % Serial control device type.
  flags: uint8  % Bitmap of serial control flags.
  timeout: uint16  % Timeout for reply data
  baudrate: uint32  % Baudrate of transfer. Zero means no change.
  count: uint8  % how many bytes in this transfer
  data: uint8[70]  % serial data
  target_system: uint8  % System ID
  target_component: uint8  % Component ID

mav_gps_rtk_s = Simulink.Bus()  % RTK GPS data. Gives information on the relative baseline calculation the GPS is reporting
  time_last_baseline_ms: uint32  % Time since boot of last baseline message received.
  rtk_receiver_id: uint8  % Identification of connected RTK receiver.
  wn: uint16  % GPS Week Number of last baseline
  tow: uint32  % GPS Time of Week of last baseline
  rtk_health: uint8  % GPS-specific health report for RTK data.
  rtk_rate: uint8  % Rate of baseline messages being received by GPS
  nsats: uint8  % Current number of sats used for RTK calculation.
  baseline_coords_type: uint8  % Coordinate system of baseline
  baseline_a_mm: int32  % Current baseline in ECEF x or NED north component.
  baseline_b_mm: int32  % Current baseline in ECEF y or NED east component.
  baseline_c_mm: int32  % Current baseline in ECEF z or NED down component.
  accuracy: uint32  % Current estimate of baseline accuracy.
  iar_num_hypotheses: int32  % Current number of integer ambiguity hypotheses.

mav_gps2_rtk_s = Simulink.Bus()  % RTK GPS data. Gives information on the relative baseline calculation the GPS is reporting
  time_last_baseline_ms: uint32  % Time since boot of last baseline message received.
  rtk_receiver_id: uint8  % Identification of connected RTK receiver.
  wn: uint16  % GPS Week Number of last baseline
  tow: uint32  % GPS Time of Week of last baseline
  rtk_health: uint8  % GPS-specific health report for RTK data.
  rtk_rate: uint8  % Rate of baseline messages being received by GPS
  nsats: uint8  % Current number of sats used for RTK calculation.
  baseline_coords_type: uint8  % Coordinate system of baseline
  baseline_a_mm: int32  % Current baseline in ECEF x or NED north component.
  baseline_b_mm: int32  % Current baseline in ECEF y or NED east component.
  baseline_c_mm: int32  % Current baseline in ECEF z or NED down component.
  accuracy: uint32  % Current estimate of baseline accuracy.
  iar_num_hypotheses: int32  % Current number of integer ambiguity hypotheses.

mav_scaled_imu3_s = Simulink.Bus()  % The RAW IMU readings for 3rd 9DOF sensor setup. This message should contain the scaled values to the described units
  time_boot_ms: uint32  % Timestamp (time since system boot).
  xacc: int16  % X acceleration
  yacc: int16  % Y acceleration
  zacc: int16  % Z acceleration
  xgyro: int16  % Angular speed around X axis
  ygyro: int16  % Angular speed around Y axis
  zgyro: int16  % Angular speed around Z axis
  xmag: int16  % X Magnetic field
  ymag: int16  % Y Magnetic field
  zmag: int16  % Z Magnetic field
  temperature: int16  % Temperature, 0: IMU does not provide temperature values. If the IMU is at 0C it must send 1 (0.01C).

mav_data_transmission_handshake_s = Simulink.Bus()  % Handshake message to initiate, control and stop image streaming when using the Image Transmission Protocol: https://mavlink.io/en/services/image_transmission.html.
  type: uint8  % Type of requested/acknowledged data.
  size: uint32  % total data size (set on ACK only).
  width: uint16  % Width of a matrix or image.
  height: uint16  % Height of a matrix or image.
  packets: uint16  % Number of packets being sent (set on ACK only).
  payload: uint8  % Payload size per packet (normally 253 byte, see DATA field size in message ENCAPSULATED_DATA) (set on ACK only).
  jpg_quality: uint8  % JPEG quality. Values: [1-100].

mav_encapsulated_data_s = Simulink.Bus()  % Data packet for images sent using the Image Transmission Protocol: https://mavlink.io/en/services/image_transmission.html.
  seqnr: uint16  % sequence number (starting with 0 on every transmission)
  data: uint8[253]  % image data bytes

mav_distance_sensor_s = Simulink.Bus()  % Distance sensor information for an onboard rangefinder.
  time_boot_ms: uint32  % Timestamp (time since system boot).
  min_distance: uint16  % Minimum distance the sensor can measure
  max_distance: uint16  % Maximum distance the sensor can measure
  current_distance: uint16  % Current distance reading
  type: uint8  % Type of distance sensor.
  id: uint8  % Onboard ID of the sensor
  orientation: uint8  % Direction the sensor faces. downward-facing: ROTATION_PITCH_270, upward-facing: ROTATION_PITCH_90, backward-facing: ROTATION_PITCH_180, forward-facing: ROTATION_NONE, left-facing: ROTATION_YAW_90, right-facing: ROTATION_YAW_270
  covariance: uint8  % Measurement variance. Max standard deviation is 6cm. UINT8_MAX if unknown.
  horizontal_fov: single  % Horizontal Field of View (angle) where the distance measurement is valid and the field of view is known. Otherwise this is set to 0.
  vertical_fov: single  % Vertical Field of View (angle) where the distance measurement is valid and the field of view is known. Otherwise this is set to 0.
  quaternion: single[4]  % Quaternion of the sensor orientation in vehicle body frame (w, x, y, z order, zero-rotation is 1, 0, 0, 0). Zero-rotation is along the vehicle body x-axis. This field is required if the orientation is set to MAV_SENSOR_ROTATION_CUSTOM. Set it to 0 if invalid."
  signal_quality: uint8  % Signal quality of the sensor. Specific to each sensor type, representing the relation of the signal strength with the target reflectivity, distance, size or aspect, but normalised as a percentage. 0 = unknown/unset signal quality, 1 = invalid signal, 100 = perfect signal.

mav_terrain_request_s = Simulink.Bus()  % Request for terrain data and terrain status. See terrain protocol docs: https://mavlink.io/en/services/terrain.html
  lat: int32  % Latitude of SW corner of first grid
  lon: int32  % Longitude of SW corner of first grid
  grid_spacing: uint16  % Grid spacing
  mask: fixdt(0,64,0)  % Bitmask of requested 4x4 grids (row major 8x7 array of grids, 56 bits)

mav_terrain_data_s = Simulink.Bus()  % Terrain data sent from GCS. The lat/lon and grid_spacing must be the same as a lat/lon from a TERRAIN_REQUEST. See terrain protocol docs: https://mavlink.io/en/services/terrain.html
  lat: int32  % Latitude of SW corner of first grid
  lon: int32  % Longitude of SW corner of first grid
  grid_spacing: uint16  % Grid spacing
  gridbit: uint8  % bit within the terrain request mask
  data: int16[16]  % Terrain data MSL

mav_terrain_check_s = Simulink.Bus()  % Request that the vehicle report terrain height at the given location (expected response is a TERRAIN_REPORT). Used by GCS to check if vehicle has all terrain data needed for a mission.
  lat: int32  % Latitude
  lon: int32  % Longitude

mav_terrain_report_s = Simulink.Bus()  % Streamed from drone to report progress of terrain map download (initiated by TERRAIN_REQUEST), or sent as a response to a TERRAIN_CHECK request. See terrain protocol docs: https://mavlink.io/en/services/terrain.html
  lat: int32  % Latitude
  lon: int32  % Longitude
  spacing: uint16  % grid spacing (zero if terrain at this location unavailable)
  terrain_height: single  % Terrain height MSL
  current_height: single  % Current vehicle height above lat/lon terrain height
  pending: uint16  % Number of 4x4 terrain blocks waiting to be received or read from disk
  loaded: uint16  % Number of 4x4 terrain blocks in memory

mav_scaled_pressure2_s = Simulink.Bus()  % Barometer readings for 2nd barometer
  time_boot_ms: uint32  % Timestamp (time since system boot).
  press_abs: single  % Absolute pressure
  press_diff: single  % Differential pressure
  temperature: int16  % Absolute pressure temperature
  temperature_press_diff: int16  % Differential pressure temperature (0, if not available). Report values of 0 (or 1) as 1 cdegC.

mav_att_pos_mocap_s = Simulink.Bus()  % Motion capture attitude and position
  time_usec: fixdt(0,64,0)  % Timestamp (UNIX Epoch time or time since system boot). The receiving end can infer timestamp format (since 1.1.1970 or since system boot) by checking for the magnitude of the number.
  q: single[4]  % Attitude quaternion (w, x, y, z order, zero-rotation is 1, 0, 0, 0)
  x: single  % X position (NED)
  y: single  % Y position (NED)
  z: single  % Z position (NED)
  covariance: single[21]  % Row-major representation of a pose 6x6 cross-covariance matrix upper right triangle (states: x, y, z, roll, pitch, yaw; first six entries are the first ROW, next five entries are the second ROW, etc.). If unknown, assign NaN value to first element in the array.

mav_set_actuator_control_target_s = Simulink.Bus()  % Set the vehicle attitude and body angular rates.
  time_usec: fixdt(0,64,0)  % Timestamp (UNIX Epoch time or time since system boot). The receiving end can infer timestamp format (since 1.1.1970 or since system boot) by checking for the magnitude of the number.
  group_mlx: uint8  % Actuator group. The "_mlx" indicates this is a multi-instance message and a MAVLink parser should use this field to difference between instances.
  target_system: uint8  % System ID
  target_component: uint8  % Component ID
  controls: single[8]  % Actuator controls. Normed to -1..+1 where 0 is neutral position. Throttle for single rotation direction motors is 0..1, negative range for reverse direction. Standard mapping for attitude controls (group 0): (index 0-7): roll, pitch, yaw, throttle, flaps, spoilers, airbrakes, landing gear. Load a pass-through mixer to repurpose them as generic outputs.

mav_actuator_control_target_s = Simulink.Bus()  % Set the vehicle attitude and body angular rates.
  time_usec: fixdt(0,64,0)  % Timestamp (UNIX Epoch time or time since system boot). The receiving end can infer timestamp format (since 1.1.1970 or since system boot) by checking for the magnitude of the number.
  group_mlx: uint8  % Actuator group. The "_mlx" indicates this is a multi-instance message and a MAVLink parser should use this field to difference between instances.
  controls: single[8]  % Actuator controls. Normed to -1..+1 where 0 is neutral position. Throttle for single rotation direction motors is 0..1, negative range for reverse direction. Standard mapping for attitude controls (group 0): (index 0-7): roll, pitch, yaw, throttle, flaps, spoilers, airbrakes, landing gear. Load a pass-through mixer to repurpose them as generic outputs.

mav_altitude_s = Simulink.Bus()  % The current system altitude.
  time_usec: fixdt(0,64,0)  % Timestamp (UNIX Epoch time or time since system boot). The receiving end can infer timestamp format (since 1.1.1970 or since system boot) by checking for the magnitude of the number.
  altitude_monotonic: single  % This altitude measure is initialized on system boot and monotonic (it is never reset, but represents the local altitude change). The only guarantee on this field is that it will never be reset and is consistent within a flight. The recommended value for this field is the uncorrected barometric altitude at boot time. This altitude will also drift and vary between flights.
  altitude_amsl: single  % This altitude measure is strictly above mean sea level and might be non-monotonic (it might reset on events like GPS lock or when a new QNH value is set). It should be the altitude to which global altitude waypoints are compared to. Note that it is *not* the GPS altitude, however, most GPS modules already output MSL by default and not the WGS84 altitude.
  altitude_local: single  % This is the local altitude in the local coordinate frame. It is not the altitude above home, but in reference to the coordinate origin (0, 0, 0). It is up-positive.
  altitude_relative: single  % This is the altitude above the home position. It resets on each change of the current home position.
  altitude_terrain: single  % This is the altitude above terrain. It might be fed by a terrain database or an altimeter. Values smaller than -1000 should be interpreted as unknown.
  bottom_clearance: single  % This is not the altitude, but the clear space below the system according to the fused clearance estimate. It generally should max out at the maximum range of e.g. the laser altimeter. It is generally a moving target. A negative value indicates no measurement available.

mav_resource_request_s = Simulink.Bus()  % The autopilot is requesting a resource (file, binary, other type of data)
  request_id: uint8  % Request ID. This ID should be re-used when sending back URI contents
  uri_type: uint8  % The type of requested URI. 0 = a file via URL. 1 = a UAVCAN binary
  uri: uint8[120]  % The requested unique resource identifier (URI). It is not necessarily a straight domain name (depends on the URI type enum)
  transfer_type: uint8  % The way the autopilot wants to receive the URI. 0 = MAVLink FTP. 1 = binary stream.
  storage: uint8[120]  % The storage path the autopilot wants the URI to be stored in. Will only be valid if the transfer_type has a storage associated (e.g. MAVLink FTP).

mav_scaled_pressure3_s = Simulink.Bus()  % Barometer readings for 3rd barometer
  time_boot_ms: uint32  % Timestamp (time since system boot).
  press_abs: single  % Absolute pressure
  press_diff: single  % Differential pressure
  temperature: int16  % Absolute pressure temperature
  temperature_press_diff: int16  % Differential pressure temperature (0, if not available). Report values of 0 (or 1) as 1 cdegC.

mav_follow_target_s = Simulink.Bus()  % Current motion information from a designated system
  timestamp: fixdt(0,64,0)  % Timestamp (time since system boot).
  est_capabilities: uint8  % bit positions for tracker reporting capabilities (POS = 0, VEL = 1, ACCEL = 2, ATT + RATES = 3)
  lat: int32  % Latitude (WGS84)
  lon: int32  % Longitude (WGS84)
  alt: single  % Altitude (MSL)
  vel: single[3]  % target velocity (0,0,0) for unknown
  acc: single[3]  % linear target acceleration (0,0,0) for unknown
  attitude_q: single[4]  % (0 0 0 0 for unknown)
  rates: single[3]  % (0 0 0 for unknown)
  position_cov: single[3]  % eph epv
  custom_state: fixdt(0,64,0)  % button states or switches of a tracker device

mav_control_system_state_s = Simulink.Bus()  % The smoothed, monotonic system state used to feed the control loops of the system.
  time_usec: fixdt(0,64,0)  % Timestamp (UNIX Epoch time or time since system boot). The receiving end can infer timestamp format (since 1.1.1970 or since system boot) by checking for the magnitude of the number.
  x_acc: single  % X acceleration in body frame
  y_acc: single  % Y acceleration in body frame
  z_acc: single  % Z acceleration in body frame
  x_vel: single  % X velocity in body frame
  y_vel: single  % Y velocity in body frame
  z_vel: single  % Z velocity in body frame
  x_pos: single  % X position in local frame
  y_pos: single  % Y position in local frame
  z_pos: single  % Z position in local frame
  airspeed: single  % Airspeed, set to -1 if unknown
  vel_variance: single[3]  % Variance of body velocity estimate
  pos_variance: single[3]  % Variance in local position
  q: single[4]  % The attitude, represented as Quaternion
  roll_rate: single  % Angular rate in roll axis
  pitch_rate: single  % Angular rate in pitch axis
  yaw_rate: single  % Angular rate in yaw axis

mav_battery_status_s = Simulink.Bus()  % Battery information. Updates GCS with flight controller battery status. Smart batteries also use this message, but may additionally send SMART_BATTERY_INFO.
  id: uint8  % Battery ID
  battery_function: uint8  % Function of the battery
  type: uint8  % Type (chemistry) of the battery
  temperature: int16  % Temperature of the battery. INT16_MAX for unknown temperature.
  voltages: uint16[10]  % Battery voltage of cells 1 to 10 (see voltages_ext for cells 11-14). Cells in this field above the valid cell count for this battery should have the UINT16_MAX value. If individual cell voltages are unknown or not measured for this battery, then the overall battery voltage should be filled in cell 0, with all others set to UINT16_MAX. If the voltage of the battery is greater than (UINT16_MAX - 1), then cell 0 should be set to (UINT16_MAX - 1), and cell 1 to the remaining voltage. This can be extended to multiple cells if the total voltage is greater than 2 * (UINT16_MAX - 1).
  current_battery: int16  % Battery current, -1: autopilot does not measure the current
  current_consumed: int32  % Consumed charge, -1: autopilot does not provide consumption estimate
  energy_consumed: int32  % Consumed energy, -1: autopilot does not provide energy consumption estimate
  battery_remaining: int8_t  % Remaining battery energy. Values: [0-100], -1: autopilot does not estimate the remaining battery.
  time_remaining: int32  % Remaining battery time, 0: autopilot does not provide remaining battery time estimate
  charge_state: uint8  % State for extent of discharge, provided by autopilot for warning or external reactions
  voltages_ext: uint16[4]  % Battery voltages for cells 11 to 14. Cells above the valid cell count for this battery should have a value of 0, where zero indicates not supported (note, this is different than for the voltages field and allows empty byte truncation). If the measured value is 0 then 1 should be sent instead.
  mode: uint8  % Battery mode. Default (0) is that battery mode reporting is not supported or battery is in normal-use mode.
  fault_bitmask: uint32  % Fault/health indications. These should be set when charge_state is MAV_BATTERY_CHARGE_STATE_FAILED or MAV_BATTERY_CHARGE_STATE_UNHEALTHY (if not, fault reporting is not supported).

mav_autopilot_version_s = Simulink.Bus()  % Version and capability of autopilot software. This should be emitted in response to a request with MAV_CMD_REQUEST_MESSAGE.
  capabilities: fixdt(0,64,0)  % Bitmap of capabilities
  flight_sw_version: uint32  % Firmware version number
  middleware_sw_version: uint32  % Middleware version number
  os_sw_version: uint32  % Operating system version number
  board_version: uint32  % HW / board version (last 8 bits should be silicon ID, if any). The first 16 bits of this field specify https://github.com/PX4/PX4-Bootloader/blob/master/board_types.txt
  flight_custom_version: uint8[8]  % Custom version field, commonly the first 8 bytes of the git hash. This is not an unique identifier, but should allow to identify the commit using the main version number even for very large code bases.
  middleware_custom_version: uint8[8]  % Custom version field, commonly the first 8 bytes of the git hash. This is not an unique identifier, but should allow to identify the commit using the main version number even for very large code bases.
  os_custom_version: uint8[8]  % Custom version field, commonly the first 8 bytes of the git hash. This is not an unique identifier, but should allow to identify the commit using the main version number even for very large code bases.
  vendor_id: uint16  % ID of the board vendor
  product_id: uint16  % ID of the product
  uid: fixdt(0,64,0)  % UID if provided by hardware (see uid2)
  uid2: uint8[18]  % UID if provided by hardware (supersedes the uid field. If this is non-zero, use this field, otherwise use uid)

mav_landing_target_s = Simulink.Bus()  % The location of a landing target. See: https://mavlink.io/en/services/landing_target.html
  time_usec: fixdt(0,64,0)  % Timestamp (UNIX Epoch time or time since system boot). The receiving end can infer timestamp format (since 1.1.1970 or since system boot) by checking for the magnitude of the number.
  target_num: uint8  % The ID of the target if multiple targets are present
  frame: uint8  % Coordinate frame used for following fields.
  angle_x: single  % X-axis angular offset of the target from the center of the image
  angle_y: single  % Y-axis angular offset of the target from the center of the image
  distance: single  % Distance to the target from the vehicle
  size_x: single  % Size of target along x-axis
  size_y: single  % Size of target along y-axis
  x: single  % X Position of the landing target in MAV_FRAME
  y: single  % Y Position of the landing target in MAV_FRAME
  z: single  % Z Position of the landing target in MAV_FRAME
  q: single[4]  % Quaternion of landing target orientation (w, x, y, z order, zero-rotation is 1, 0, 0, 0)
  type: uint8  % Type of landing target
  position_valid: uint8  % Boolean indicating whether the position fields (x, y, z, q, type) contain valid target position information (valid: 1, invalid: 0). Default is 0 (invalid).

mav_fence_status_s = Simulink.Bus()  % Status of geo-fencing. Sent in extended status stream when fencing enabled.
  breach_status: uint8  % Breach status (0 if currently inside fence, 1 if outside).
  breach_count: uint16  % Number of fence breaches.
  breach_type: uint8  % Last breach type.
  breach_time: uint32  % Time (since boot) of last breach.
  breach_mitigation: uint8  % Active action to prevent fence breach

mav_mag_cal_report_s = Simulink.Bus()  % Reports results of completed compass calibration. Sent until MAG_CAL_ACK received.
  compass_id: uint8  % Compass being calibrated.
  cal_mask: uint8  % Bitmask of compasses being calibrated.
  cal_status: uint8  % Calibration Status.
  autosaved: uint8  % 0=requires a MAV_CMD_DO_ACCEPT_MAG_CAL, 1=saved to parameters.
  fitness: single  % RMS milligauss residuals.
  ofs_x: single  % X offset.
  ofs_y: single  % Y offset.
  ofs_z: single  % Z offset.
  diag_x: single  % X diagonal (matrix 11).
  diag_y: single  % Y diagonal (matrix 22).
  diag_z: single  % Z diagonal (matrix 33).
  offdiag_x: single  % X off-diagonal (matrix 12 and 21).
  offdiag_y: single  % Y off-diagonal (matrix 13 and 31).
  offdiag_z: single  % Z off-diagonal (matrix 32 and 23).
  orientation_confidence: single  % Confidence in orientation (higher is better).
  old_orientation: uint8  % orientation before calibration.
  new_orientation: uint8  % orientation after calibration.
  scale_factor: single  % field radius correction factor

mav_efi_status_s = Simulink.Bus()  % EFI status output
  health: uint8  % EFI health status
  ecu_index: single  % ECU index
  rpm: single  % RPM
  fuel_consumed: single  % Fuel consumed
  fuel_flow: single  % Fuel flow rate
  engine_load: single  % Engine load
  throttle_position: single  % Throttle position
  spark_dwell_time: single  % Spark dwell time
  barometric_pressure: single  % Barometric pressure
  intake_manifold_pressure: single  % Intake manifold pressure(
  intake_manifold_temperature: single  % Intake manifold temperature
  cylinder_head_temperature: single  % Cylinder head temperature
  ignition_timing: single  % Ignition timing (Crank angle degrees)
  injection_time: single  % Injection time
  exhaust_gas_temperature: single  % Exhaust gas temperature
  throttle_out: single  % Output throttle
  pt_compensation: single  % Pressure/temperature compensation
  ignition_voltage: single  % Supply voltage to EFI sparking system.  Zero in this value means "unknown", so if the supply voltage really is zero volts use 0.0001 instead.
  fuel_pressure: single  % Fuel pressure. Zero in this value means "unknown", so if the fuel pressure really is zero kPa use 0.0001 instead.

mav_estimator_status_s = Simulink.Bus()  % Estimator status message including flags, innovation test ratios and estimated accuracies. The flags message is an integer bitmask containing information on which EKF outputs are valid. See the ESTIMATOR_STATUS_FLAGS enum definition for further information. The innovation test ratios show the magnitude of the sensor innovation divided by the innovation check threshold. Under normal operation the innovation test ratios should be below 0.5 with occasional values up to 1.0. Values greater than 1.0 should be rare under normal operation and indicate that a measurement has been rejected by the filter. The user should be notified if an innovation test ratio greater than 1.0 is recorded. Notifications for values in the range between 0.5 and 1.0 should be optional and controllable by the user.
  time_usec: fixdt(0,64,0)  % Timestamp (UNIX Epoch time or time since system boot). The receiving end can infer timestamp format (since 1.1.1970 or since system boot) by checking for the magnitude of the number.
  flags: uint16  % Bitmap indicating which EKF outputs are valid.
  vel_ratio: single  % Velocity innovation test ratio
  pos_horiz_ratio: single  % Horizontal position innovation test ratio
  pos_vert_ratio: single  % Vertical position innovation test ratio
  mag_ratio: single  % Magnetometer innovation test ratio
  hagl_ratio: single  % Height above terrain innovation test ratio
  tas_ratio: single  % True airspeed innovation test ratio
  pos_horiz_accuracy: single  % Horizontal position 1-STD accuracy relative to the EKF local origin
  pos_vert_accuracy: single  % Vertical position 1-STD accuracy relative to the EKF local origin

mav_wind_cov_s = Simulink.Bus()  % Wind estimate from vehicle. Note that despite the name, this message does not actually contain any covariances but instead variability and accuracy fields in terms of standard deviation (1-STD).
  time_usec: fixdt(0,64,0)  % Timestamp (UNIX Epoch time or time since system boot). The receiving end can infer timestamp format (since 1.1.1970 or since system boot) by checking for the magnitude of the number.
  wind_x: single  % Wind in North (NED) direction (NAN if unknown)
  wind_y: single  % Wind in East (NED) direction (NAN if unknown)
  wind_z: single  % Wind in down (NED) direction (NAN if unknown)
  var_horiz: single  % Variability of wind in XY, 1-STD estimated from a 1 Hz lowpassed wind estimate (NAN if unknown)
  var_vert: single  % Variability of wind in Z, 1-STD estimated from a 1 Hz lowpassed wind estimate (NAN if unknown)
  wind_alt: single  % Altitude (MSL) that this measurement was taken at (NAN if unknown)
  horiz_accuracy: single  % Horizontal speed 1-STD accuracy (0 if unknown)
  vert_accuracy: single  % Vertical speed 1-STD accuracy (0 if unknown)

mav_gps_input_s = Simulink.Bus()  % GPS sensor input message.  This is a raw sensor value sent by the GPS. This is NOT the global position estimate of the system.
  time_usec: fixdt(0,64,0)  % Timestamp (UNIX Epoch time or time since system boot). The receiving end can infer timestamp format (since 1.1.1970 or since system boot) by checking for the magnitude of the number.
  gps_id: uint8  % ID of the GPS for multiple GPS inputs
  ignore_flags: uint16  % Bitmap indicating which GPS input flags fields to ignore.  All other fields must be provided.
  time_week_ms: uint32  % GPS time (from start of GPS week)
  time_week: uint16  % GPS week number
  fix_type: uint8  % 0-1: no fix, 2: 2D fix, 3: 3D fix. 4: 3D with DGPS. 5: 3D with RTK
  lat: int32  % Latitude (WGS84)
  lon: int32  % Longitude (WGS84)
  alt: single  % Altitude (MSL). Positive for up.
  hdop: single  % GPS HDOP horizontal dilution of position (unitless). If unknown, set to: UINT16_MAX
  vdop: single  % GPS VDOP vertical dilution of position (unitless). If unknown, set to: UINT16_MAX
  vn: single  % GPS velocity in north direction in earth-fixed NED frame
  ve: single  % GPS velocity in east direction in earth-fixed NED frame
  vd: single  % GPS velocity in down direction in earth-fixed NED frame
  speed_accuracy: single  % GPS speed accuracy
  horiz_accuracy: single  % GPS horizontal accuracy
  vert_accuracy: single  % GPS vertical accuracy
  satellites_visible: uint8  % Number of satellites visible.
  yaw: uint16  % Yaw of vehicle relative to Earth's North, zero means not available, use 36000 for north

mav_gps_rtcm_data_s = Simulink.Bus()  % RTCM message for injecting into the onboard GPS (used for DGPS)
  flags: uint8  % LSB: 1 means message is fragmented, next 2 bits are the fragment ID, the remaining 5 bits are used for the sequence ID. Messages are only to be flushed to the GPS when the entire message has been reconstructed on the autopilot. The fragment ID specifies which order the fragments should be assembled into a buffer, while the sequence ID is used to detect a mismatch between different buffers. The buffer is considered fully reconstructed when either all 4 fragments are present, or all the fragments before the first fragment with a non full payload is received. This management is used to ensure that normal GPS operation doesn't corrupt RTCM data, and to recover from a unreliable transport delivery order.
  len: uint8  % data length
  data: uint8[180]  % RTCM message (may be fragmented)

mav_high_latency_s = Simulink.Bus()  % Message appropriate for high latency connections like Iridium
  base_mode: uint8  % Bitmap of enabled system modes.
  custom_mode: uint32  % A bitfield for use for autopilot-specific flags.
  landed_state: uint8  % The landed state. Is set to MAV_LANDED_STATE_UNDEFINED if landed state is unknown.
  roll: int16  % roll
  pitch: int16  % pitch
  heading: uint16  % heading
  throttle: int8_t  % throttle (percentage)
  heading_sp: int16  % heading setpoint
  latitude: int32  % Latitude
  longitude: int32  % Longitude
  altitude_amsl: int16  % Altitude above mean sea level
  altitude_sp: int16  % Altitude setpoint relative to the home position
  airspeed: uint8  % airspeed
  airspeed_sp: uint8  % airspeed setpoint
  groundspeed: uint8  % groundspeed
  climb_rate: int8_t  % climb rate
  gps_nsat: uint8  % Number of satellites visible. If unknown, set to UINT8_MAX
  gps_fix_type: uint8  % GPS Fix type.
  battery_remaining: uint8  % Remaining battery (percentage)
  temperature: int8_t  % Autopilot temperature (degrees C)
  temperature_air: int8_t  % Air temperature (degrees C) from airspeed sensor
  failsafe: uint8  % failsafe (each bit represents a failsafe where 0=ok, 1=failsafe active (bit0:RC, bit1:batt, bit2:GPS, bit3:GCS, bit4:fence)
  wp_num: uint8  % current waypoint number
  wp_distance: uint16  % distance to target

mav_high_latency2_s = Simulink.Bus()  % Message appropriate for high latency connections like Iridium (version 2)
  timestamp: uint32  % Timestamp (milliseconds since boot or Unix epoch)
  type: uint8  % Type of the MAV (quadrotor, helicopter, etc.)
  autopilot: uint8  % Autopilot type / class. Use MAV_AUTOPILOT_INVALID for components that are not flight controllers.
  custom_mode: uint16  % A bitfield for use for autopilot-specific flags (2 byte version).
  latitude: int32  % Latitude
  longitude: int32  % Longitude
  altitude: int16  % Altitude above mean sea level
  target_altitude: int16  % Altitude setpoint
  heading: uint8  % Heading
  target_heading: uint8  % Heading setpoint
  target_distance: uint16  % Distance to target waypoint or position
  throttle: uint8  % Throttle
  airspeed: uint8  % Airspeed
  airspeed_sp: uint8  % Airspeed setpoint
  groundspeed: uint8  % Groundspeed
  windspeed: uint8  % Windspeed
  wind_heading: uint8  % Wind heading
  eph: uint8  % Maximum error horizontal position since last message
  epv: uint8  % Maximum error vertical position since last message
  temperature_air: int8_t  % Air temperature from airspeed sensor
  climb_rate: int8_t  % Maximum climb rate magnitude since last message
  battery: int8_t  % Battery level (-1 if field not provided).
  wp_num: uint16  % Current waypoint number
  failure_flags: uint16  % Bitmap of failure flags.
  custom0: int8_t  % Field for custom payload.
  custom1: int8_t  % Field for custom payload.
  custom2: int8_t  % Field for custom payload.

mav_vibration_s = Simulink.Bus()  % Vibration levels and accelerometer clipping
  time_usec: fixdt(0,64,0)  % Timestamp (UNIX Epoch time or time since system boot). The receiving end can infer timestamp format (since 1.1.1970 or since system boot) by checking for the magnitude of the number.
  vibration_x: single  % Vibration levels on X-axis
  vibration_y: single  % Vibration levels on Y-axis
  vibration_z: single  % Vibration levels on Z-axis
  clipping_0: uint32  % first accelerometer clipping count
  clipping_1: uint32  % second accelerometer clipping count
  clipping_2: uint32  % third accelerometer clipping count

mav_home_position_s = Simulink.Bus()  % Contains the home position.
  % The home position is the default position that the system will return to and land on.
  % The position must be set automatically by the system during the takeoff, and may also be explicitly set using MAV_CMD_DO_SET_HOME.
  % The global and local positions encode the position in the respective coordinate frames, while the q parameter encodes the orientation of the surface.
  % Under normal conditions it describes the heading and terrain slope, which can be used by the aircraft to adjust the approach.
  % The approach 3D vector describes the point to which the system should fly in normal flight mode and then perform a landing sequence along the vector.
  % Note: this message can be requested by sending the MAV_CMD_REQUEST_MESSAGE with param1=242 (or the deprecated MAV_CMD_GET_HOME_POSITION command).
  latitude: int32  % Latitude (WGS84)
  longitude: int32  % Longitude (WGS84)
  altitude: int32  % Altitude (MSL). Positive for up.
  x: single  % Local X position of this position in the local coordinate frame (NED)
  y: single  % Local Y position of this position in the local coordinate frame (NED)
  z: single  % Local Z position of this position in the local coordinate frame (NED: positive "down")
  q: single[4]  % Quaternion indicating world-to-surface-normal and heading transformation of the takeoff position.
    % Used to indicate the heading and slope of the ground.
    % All fields should be set to NaN if an accurate quaternion for both heading and surface slope cannot be supplied.
  approach_x: single  % Local X position of the end of the approach vector. Multicopters should set this position based on their takeoff path. Grass-landing fixed wing aircraft should set it the same way as multicopters. Runway-landing fixed wing aircraft should set it to the opposite direction of the takeoff, assuming the takeoff happened from the threshold / touchdown zone.
  approach_y: single  % Local Y position of the end of the approach vector. Multicopters should set this position based on their takeoff path. Grass-landing fixed wing aircraft should set it the same way as multicopters. Runway-landing fixed wing aircraft should set it to the opposite direction of the takeoff, assuming the takeoff happened from the threshold / touchdown zone.
  approach_z: single  % Local Z position of the end of the approach vector. Multicopters should set this position based on their takeoff path. Grass-landing fixed wing aircraft should set it the same way as multicopters. Runway-landing fixed wing aircraft should set it to the opposite direction of the takeoff, assuming the takeoff happened from the threshold / touchdown zone.
  time_usec: fixdt(0,64,0)  % Timestamp (UNIX Epoch time or time since system boot). The receiving end can infer timestamp format (since 1.1.1970 or since system boot) by checking for the magnitude of the number.

mav_set_home_position_s = Simulink.Bus()  % Sets the home position.
  % The home position is the default position that the system will return to and land on.
  % The position is set automatically by the system during the takeoff (and may also be set using this message).
  % The global and local positions encode the position in the respective coordinate frames, while the q parameter encodes the orientation of the surface.
  % Under normal conditions it describes the heading and terrain slope, which can be used by the aircraft to adjust the approach.
  % The approach 3D vector describes the point to which the system should fly in normal flight mode and then perform a landing sequence along the vector.
  % Note: the current home position may be emitted in a HOME_POSITION message on request (using MAV_CMD_REQUEST_MESSAGE with param1=242).
  target_system: uint8  % System ID.
  latitude: int32  % Latitude (WGS84)
  longitude: int32  % Longitude (WGS84)
  altitude: int32  % Altitude (MSL). Positive for up.
  x: single  % Local X position of this position in the local coordinate frame (NED)
  y: single  % Local Y position of this position in the local coordinate frame (NED)
  z: single  % Local Z position of this position in the local coordinate frame (NED: positive "down")
  q: single[4]  % World to surface normal and heading transformation of the takeoff position. Used to indicate the heading and slope of the ground
  approach_x: single  % Local X position of the end of the approach vector. Multicopters should set this position based on their takeoff path. Grass-landing fixed wing aircraft should set it the same way as multicopters. Runway-landing fixed wing aircraft should set it to the opposite direction of the takeoff, assuming the takeoff happened from the threshold / touchdown zone.
  approach_y: single  % Local Y position of the end of the approach vector. Multicopters should set this position based on their takeoff path. Grass-landing fixed wing aircraft should set it the same way as multicopters. Runway-landing fixed wing aircraft should set it to the opposite direction of the takeoff, assuming the takeoff happened from the threshold / touchdown zone.
  approach_z: single  % Local Z position of the end of the approach vector. Multicopters should set this position based on their takeoff path. Grass-landing fixed wing aircraft should set it the same way as multicopters. Runway-landing fixed wing aircraft should set it to the opposite direction of the takeoff, assuming the takeoff happened from the threshold / touchdown zone.
  time_usec: fixdt(0,64,0)  % Timestamp (UNIX Epoch time or time since system boot). The receiving end can infer timestamp format (since 1.1.1970 or since system boot) by checking for the magnitude of the number.

mav_message_interval_s = Simulink.Bus()  % The interval between messages for a particular MAVLink message ID.
  % This message is sent in response to the MAV_CMD_REQUEST_MESSAGE command with param1=244 (this message) and param2=message_id (the id of the message for which the interval is required).
  % It may also be sent in response to MAV_CMD_GET_MESSAGE_INTERVAL.
  % This interface replaces DATA_STREAM.
  message_id: uint16  % The ID of the requested MAVLink message. v1.0 is limited to 254 messages.
  interval_us: int32  % The interval between two messages. A value of -1 indicates this stream is disabled, 0 indicates it is not available, > 0 indicates the interval at which it is sent.

mav_extended_sys_state_s = Simulink.Bus()  % Provides state for additional features
  vtol_state: uint8  % The VTOL state if applicable. Is set to MAV_VTOL_STATE_UNDEFINED if UAV is not in VTOL configuration.
  landed_state: uint8  % The landed state. Is set to MAV_LANDED_STATE_UNDEFINED if landed state is unknown.

mav_adsb_vehicle_s = Simulink.Bus()  % The location and information of an ADSB vehicle
  ICAO_address: uint32  % ICAO address
  lat: int32  % Latitude
  lon: int32  % Longitude
  altitude_type: uint8  % ADSB altitude type.
  altitude: int32  % Altitude(ASL)
  heading: uint16  % Course over ground
  hor_velocity: uint16  % The horizontal velocity
  ver_velocity: int16  % The vertical velocity. Positive is up
  callsign: int8[9]  % The callsign, 8+null
  emitter_type: uint8  % ADSB emitter type.
  tslc: uint8  % Time since last communication in seconds
  flags: uint16  % Bitmap to indicate various statuses including valid data fields
  squawk: uint16  % Squawk code

mav_collision_s = Simulink.Bus()  % Information about a potential collision
  src: uint8  % Collision data source
  id: uint32  % Unique identifier, domain based on src field
  action: uint8  % Action that is being taken to avoid this collision
  threat_level: uint8  % How concerned the aircraft is about this collision
  time_to_minimum_delta: single  % Estimated time until collision occurs
  altitude_minimum_delta: single  % Closest vertical distance between vehicle and object
  horizontal_minimum_delta: single  % Closest horizontal distance between vehicle and object

mav_v2_extension_s = Simulink.Bus()  % Message implementing parts of the V2 payload specs in V1 frames for transitional support.
  target_network: uint8  % Network ID (0 for broadcast)
  target_system: uint8  % System ID (0 for broadcast)
  target_component: uint8  % Component ID (0 for broadcast)
  message_type: uint16  % A code that identifies the software component that understands this message (analogous to USB device classes or mime type strings). If this code is less than 32768, it is considered a 'registered' protocol extension and the corresponding entry should be added to https://github.com/mavlink/mavlink/definition_files/extension_message_ids.xml. Software creators can register blocks of message IDs as needed (useful for GCS specific metadata, etc...). Message_types greater than 32767 are considered local experiments and should not be checked in to any widely distributed codebase.
  payload: uint8[249]  % Variable length payload. The length must be encoded in the payload as part of the message_type protocol, e.g. by including the length as payload data, or by terminating the payload data with a non-zero marker. This is required in order to reconstruct zero-terminated payloads that are (or otherwise would be) trimmed by MAVLink 2 empty-byte truncation. The entire content of the payload block is opaque unless you understand the encoding message_type. The particular encoding used can be extension specific and might not always be documented as part of the MAVLink specification.

mav_memory_vect_s = Simulink.Bus()  % Send raw controller memory. The use of this message is discouraged for normal packets, but a quite efficient way for testing new messages and getting experimental debug output.
  address: uint16  % Starting address of the debug variables
  ver: uint8  % Version code of the type variable. 0=unknown, type ignored and assumed int16_t. 1=as below
  type: uint8  % Type code of the memory variables. for ver = 1: 0=16 x int16_t, 1=16 x uint16_t, 2=16 x Q15, 3=16 x 1Q14
  value: int8_t[32]  % Memory contents at specified address

mav_debug_vect_s = Simulink.Bus()  % To debug something using a named 3D vector.
  name: int8[10]  % Name
  time_usec: fixdt(0,64,0)  % Timestamp (UNIX Epoch time or time since system boot). The receiving end can infer timestamp format (since 1.1.1970 or since system boot) by checking for the magnitude of the number.
  x: single  % x
  y: single  % y
  z: single  % z

mav_named_value_float_s = Simulink.Bus()  % Send a key-value pair as float. The use of this message is discouraged for normal packets, but a quite efficient way for testing new messages and getting experimental debug output.
  time_boot_ms: uint32  % Timestamp (time since system boot).
  name: int8[10]  % Name of the debug variable
  value: single  % Floating point value

mav_named_value_int_s = Simulink.Bus()  % Send a key-value pair as integer. The use of this message is discouraged for normal packets, but a quite efficient way for testing new messages and getting experimental debug output.
  time_boot_ms: uint32  % Timestamp (time since system boot).
  name: int8[10]  % Name of the debug variable
  value: int32  % Signed integer value

mav_statustext_s = Simulink.Bus()  % Status text message. These messages are printed in yellow in the COMM console of QGroundControl. WARNING: They consume quite some bandwidth, so use only for important status and error messages. If implemented wisely, these messages are buffered on the MCU and sent only at a limited rate (e.g. 10 Hz).
  severity: uint8  % Severity of status. Relies on the definitions within RFC-5424.
  text: int8[50]  % Status text message, without null termination character
  id: uint16  % Unique (opaque) identifier for this statustext message.  May be used to reassemble a logical long-statustext message from a sequence of chunks.  A value of zero indicates this is the only chunk in the sequence and the message can be emitted immediately.
  chunk_seq: uint8  % This chunk's sequence number; indexing is from zero.  Any null character in the text field is taken to mean this was the last chunk.

mav_debug_s = Simulink.Bus()  % Send a debug value. The index is used to discriminate between values. These values show up in the plot of QGroundControl as DEBUG N.
  time_boot_ms: uint32  % Timestamp (time since system boot).
  ind: uint8  % index of debug variable
  value: single  % DEBUG value

mav_setup_signing_s = Simulink.Bus()  % Setup a MAVLink2 signing key. If called with secret_key of all zero and zero initial_timestamp will disable signing
  target_system: uint8  % system id of the target
  target_component: uint8  % component ID of the target
  secret_key: uint8[32]  % signing key
  initial_timestamp: fixdt(0,64,0)  % initial timestamp

mav_button_change_s = Simulink.Bus()  % Report button state change.
  time_boot_ms: uint32  % Timestamp (time since system boot).
  last_change_ms: uint32  % Time of last change of button state.
  state: uint8  % Bitmap for state of buttons.

mav_play_tune_s = Simulink.Bus()  % Control vehicle tone generation (buzzer).
  target_system: uint8  % System ID
  target_component: uint8  % Component ID
  tune: int8[30]  % tune in board specific format
  tune2: int8[200]  % tune extension (appended to tune)

mav_camera_information_s = Simulink.Bus()  % Information about a camera. Can be requested with a MAV_CMD_REQUEST_MESSAGE command.
  time_boot_ms: uint32  % Timestamp (time since system boot).
  vendor_name: uint8[32]  % Name of the camera vendor
  model_name: uint8[32]  % Name of the camera model
  firmware_version: uint32  % Version of the camera firmware, encoded as: (Dev & 0xff) << 24 | (Patch & 0xff) << 16 | (Minor & 0xff) << 8 | (Major & 0xff). Use 0 if not known.
  focal_length: single  % Focal length. Use NaN if not known.
  sensor_size_h: single  % Image sensor size horizontal. Use NaN if not known.
  sensor_size_v: single  % Image sensor size vertical. Use NaN if not known.
  resolution_h: uint16  % Horizontal image resolution. Use 0 if not known.
  resolution_v: uint16  % Vertical image resolution. Use 0 if not known.
  lens_id: uint8  % Reserved for a lens ID.  Use 0 if not known.
  flags: uint32  % Bitmap of camera capability flags.
  cam_definition_version: uint16  % Camera definition version (iteration).  Use 0 if not known.
  cam_definition_uri: int8[140]  % Camera definition URI (if any, otherwise only basic functions will be available). HTTP- (http://) and MAVLink FTP- (mavlinkftp://) formatted URIs are allowed (and both must be supported by any GCS that implements the Camera Protocol). The definition file may be xz compressed, which will be indicated by the file extension .xml.xz (a GCS that implements the protocol must support decompressing the file). The string needs to be zero terminated.  Use a zero-length string if not known.
  gimbal_device_id: uint8  % Gimbal id of a gimbal associated with this camera. This is the component id of the gimbal device, or 1-6 for non mavlink gimbals. Use 0 if no gimbal is associated with the camera.

mav_camera_settings_s = Simulink.Bus()  % Settings of a camera. Can be requested with a MAV_CMD_REQUEST_MESSAGE command.
  time_boot_ms: uint32  % Timestamp (time since system boot).
  mode_id: uint8  % Camera mode
  zoomLevel: single  % Current zoom level as a percentage of the full range (0.0 to 100.0, NaN if not known)
  focusLevel: single  % Current focus level as a percentage of the full range (0.0 to 100.0, NaN if not known)

mav_storage_information_s = Simulink.Bus()  % Information about a storage medium. This message is sent in response to a request with MAV_CMD_REQUEST_MESSAGE and whenever the status of the storage changes (STORAGE_STATUS). Use MAV_CMD_REQUEST_MESSAGE.param2 to indicate the index/id of requested storage: 0 for all, 1 for first, 2 for second, etc.
  time_boot_ms: uint32  % Timestamp (time since system boot).
  storage_id: uint8  % Storage ID (1 for first, 2 for second, etc.)
  storage_count: uint8  % Number of storage devices
  status: uint8  % Status of storage
  total_capacity: single  % Total capacity. If storage is not ready (STORAGE_STATUS_READY) value will be ignored.
  used_capacity: single  % Used capacity. If storage is not ready (STORAGE_STATUS_READY) value will be ignored.
  available_capacity: single  % Available storage capacity. If storage is not ready (STORAGE_STATUS_READY) value will be ignored.
  read_speed: single  % Read speed.
  write_speed: single  % Write speed.
  type: uint8  % Type of storage
  name: int8[32]  % Textual storage name to be used in UI (microSD 1, Internal Memory, etc.) This is a NULL terminated string. If it is exactly 32 characters long, add a terminating NULL. If this string is empty, the generic type is shown to the user.
  storage_usage: uint8  % Flags indicating whether this instance is preferred storage for photos, videos, etc.
    % Note: Implementations should initially set the flags on the system-default storage id used for saving media (if possible/supported).
    % This setting can then be overridden using MAV_CMD_SET_STORAGE_USAGE.
    % If the media usage flags are not set, a GCS may assume storage ID 1 is the default storage for all media types.

mav_camera_capture_status_s = Simulink.Bus()  % Information about the status of a capture. Can be requested with a MAV_CMD_REQUEST_MESSAGE command.
  time_boot_ms: uint32  % Timestamp (time since system boot).
  image_status: uint8  % Current status of image capturing (0: idle, 1: capture in progress, 2: interval set but idle, 3: interval set and capture in progress)
  video_status: uint8  % Current status of video capturing (0: idle, 1: capture in progress)
  image_interval: single  % Image capture interval
  recording_time_ms: uint32  % Elapsed time since recording started (0: Not supported/available). A GCS should compute recording time and use non-zero values of this field to correct any discrepancy.
  available_capacity: single  % Available storage capacity.
  image_count: int32  % Total number of images captured ('forever', or until reset using MAV_CMD_STORAGE_FORMAT).

mav_camera_image_captured_s = Simulink.Bus()  % Information about a captured image. This is emitted every time a message is captured.
  % MAV_CMD_REQUEST_MESSAGE can be used to (re)request this message for a specific sequence number or range of sequence numbers:
  % MAV_CMD_REQUEST_MESSAGE.param2 indicates the sequence number the first image to send, or set to -1 to send the message for all sequence numbers.
  % MAV_CMD_REQUEST_MESSAGE.param3 is used to specify a range of messages to send:
  % set to 0 (default) to send just the the message for the sequence number in param 2,
  % set to -1 to send the message for the sequence number in param 2 and all the following sequence numbers,
  % set to the sequence number of the final message in the range.
  time_boot_ms: uint32  % Timestamp (time since system boot).
  time_utc: fixdt(0,64,0)  % Timestamp (time since UNIX epoch) in UTC. 0 for unknown.
  camera_id: uint8  % Deprecated/unused. Component IDs are used to differentiate multiple cameras.
  lat: int32  % Latitude where image was taken
  lon: int32  % Longitude where capture was taken
  alt: int32  % Altitude (MSL) where image was taken
  relative_alt: int32  % Altitude above ground
  q: single[4]  % Quaternion of camera orientation (w, x, y, z order, zero-rotation is 1, 0, 0, 0)
  image_index: int32  % Zero based index of this image (i.e. a new image will have index CAMERA_CAPTURE_STATUS.image count -1)
  capture_result: int8_t  % Boolean indicating success (1) or failure (0) while capturing this image.
  file_url: int8[205]  % URL of image taken. Either local storage or http://foo.jpg if camera provides an HTTP interface.

mav_flight_information_s = Simulink.Bus()  % Information about flight since last arming.
  % This can be requested using MAV_CMD_REQUEST_MESSAGE.
  time_boot_ms: uint32  % Timestamp (time since system boot).
  arming_time_utc: fixdt(0,64,0)  % Timestamp at arming (time since UNIX epoch) in UTC, 0 for unknown
  takeoff_time_utc: fixdt(0,64,0)  % Timestamp at takeoff (time since UNIX epoch) in UTC, 0 for unknown
  flight_uuid: fixdt(0,64,0)  % Universally unique identifier (UUID) of flight, should correspond to name of log files

mav_mount_orientation_s = Simulink.Bus()  % Orientation of a mount
  time_boot_ms: uint32  % Timestamp (time since system boot).
  roll: single  % Roll in global frame (set to NaN for invalid).
  pitch: single  % Pitch in global frame (set to NaN for invalid).
  yaw: single  % Yaw relative to vehicle (set to NaN for invalid).
  yaw_absolute: single  % Yaw in absolute frame relative to Earth's North, north is 0 (set to NaN for invalid).

mav_logging_data_s = Simulink.Bus()  % A message containing logged data (see also MAV_CMD_LOGGING_START)
  target_system: uint8  % system ID of the target
  target_component: uint8  % component ID of the target
  sequence: uint16  % sequence number (can wrap)
  length: uint8  % data length
  first_message_offset: uint8  % offset into data where first message starts. This can be used for recovery, when a previous message got lost (set to UINT8_MAX if no start exists).
  data: uint8[249]  % logged data

mav_logging_data_acked_s = Simulink.Bus()  % A message containing logged data which requires a LOGGING_ACK to be sent back
  target_system: uint8  % system ID of the target
  target_component: uint8  % component ID of the target
  sequence: uint16  % sequence number (can wrap)
  length: uint8  % data length
  first_message_offset: uint8  % offset into data where first message starts. This can be used for recovery, when a previous message got lost (set to UINT8_MAX if no start exists).
  data: uint8[249]  % logged data

mav_logging_ack_s = Simulink.Bus()  % An ack for a LOGGING_DATA_ACKED message
  target_system: uint8  % system ID of the target
  target_component: uint8  % component ID of the target
  sequence: uint16  % sequence number (must match the one in LOGGING_DATA_ACKED)

mav_video_stream_information_s = Simulink.Bus()  % Information about video stream. It may be requested using MAV_CMD_REQUEST_MESSAGE, where param2 indicates the video stream id: 0 for all streams, 1 for first, 2 for second, etc.
  stream_id: uint8  % Video Stream ID (1 for first, 2 for second, etc.)
  count: uint8  % Number of streams available.
  type: uint8  % Type of stream.
  flags: uint16  % Bitmap of stream status flags.
  framerate: single  % Frame rate.
  resolution_h: uint16  % Horizontal resolution.
  resolution_v: uint16  % Vertical resolution.
  bitrate: uint32  % Bit rate.
  rotation: uint16  % Video image rotation clockwise.
  hfov: uint16  % Horizontal Field of view.
  name: int8[32]  % Stream name.
  uri: int8[160]  % Video stream URI (TCP or RTSP URI ground station should connect to) or port number (UDP port ground station should listen to).

mav_video_stream_status_s = Simulink.Bus()  % Information about the status of a video stream. It may be requested using MAV_CMD_REQUEST_MESSAGE.
  stream_id: uint8  % Video Stream ID (1 for first, 2 for second, etc.)
  flags: uint16  % Bitmap of stream status flags
  framerate: single  % Frame rate
  resolution_h: uint16  % Horizontal resolution
  resolution_v: uint16  % Vertical resolution
  bitrate: uint32  % Bit rate
  rotation: uint16  % Video image rotation clockwise
  hfov: uint16  % Horizontal Field of view

mav_camera_fov_status_s = Simulink.Bus()  % Information about the field of view of a camera. Can be requested with a MAV_CMD_REQUEST_MESSAGE command.
  time_boot_ms: uint32  % Timestamp (time since system boot).
  lat_camera: int32  % Latitude of camera (INT32_MAX if unknown).
  lon_camera: int32  % Longitude of camera (INT32_MAX if unknown).
  alt_camera: int32  % Altitude (MSL) of camera (INT32_MAX if unknown).
  lat_image: int32  % Latitude of center of image (INT32_MAX if unknown, INT32_MIN if at infinity, not intersecting with horizon).
  lon_image: int32  % Longitude of center of image (INT32_MAX if unknown, INT32_MIN if at infinity, not intersecting with horizon).
  alt_image: int32  % Altitude (MSL) of center of image (INT32_MAX if unknown, INT32_MIN if at infinity, not intersecting with horizon).
  q: single[4]  % Quaternion of camera orientation (w, x, y, z order, zero-rotation is 1, 0, 0, 0)
  hfov: single  % Horizontal field of view (NaN if unknown).
  vfov: single  % Vertical field of view (NaN if unknown).

mav_camera_tracking_image_status_s = Simulink.Bus()  % Camera tracking status, sent while in active tracking. Use MAV_CMD_SET_MESSAGE_INTERVAL to define message interval.
  tracking_status: uint8  % Current tracking status
  tracking_mode: uint8  % Current tracking mode
  target_data: uint8  % Defines location of target data
  point_x: single  % Current tracked point x value if CAMERA_TRACKING_MODE_POINT (normalized 0..1, 0 is left, 1 is right), NAN if unknown
  point_y: single  % Current tracked point y value if CAMERA_TRACKING_MODE_POINT (normalized 0..1, 0 is top, 1 is bottom), NAN if unknown
  radius: single  % Current tracked radius if CAMERA_TRACKING_MODE_POINT (normalized 0..1, 0 is image left, 1 is image right), NAN if unknown
  rec_top_x: single  % Current tracked rectangle top x value if CAMERA_TRACKING_MODE_RECTANGLE (normalized 0..1, 0 is left, 1 is right), NAN if unknown
  rec_top_y: single  % Current tracked rectangle top y value if CAMERA_TRACKING_MODE_RECTANGLE (normalized 0..1, 0 is top, 1 is bottom), NAN if unknown
  rec_bottom_x: single  % Current tracked rectangle bottom x value if CAMERA_TRACKING_MODE_RECTANGLE (normalized 0..1, 0 is left, 1 is right), NAN if unknown
  rec_bottom_y: single  % Current tracked rectangle bottom y value if CAMERA_TRACKING_MODE_RECTANGLE (normalized 0..1, 0 is top, 1 is bottom), NAN if unknown

mav_camera_tracking_geo_status_s = Simulink.Bus()  % Camera tracking status, sent while in active tracking. Use MAV_CMD_SET_MESSAGE_INTERVAL to define message interval.
  tracking_status: uint8  % Current tracking status
  lat: int32  % Latitude of tracked object
  lon: int32  % Longitude of tracked object
  alt: single  % Altitude of tracked object(AMSL, WGS84)
  h_acc: single  % Horizontal accuracy. NAN if unknown
  v_acc: single  % Vertical accuracy. NAN if unknown
  vel_n: single  % North velocity of tracked object. NAN if unknown
  vel_e: single  % East velocity of tracked object. NAN if unknown
  vel_d: single  % Down velocity of tracked object. NAN if unknown
  vel_acc: single  % Velocity accuracy. NAN if unknown
  dist: single  % Distance between camera and tracked object. NAN if unknown
  hdg: single  % Heading in radians, in NED. NAN if unknown
  hdg_acc: single  % Accuracy of heading, in NED. NAN if unknown

mav_gimbal_manager_information_s = Simulink.Bus()  % Information about a high level gimbal manager. This message should be requested by a ground station using MAV_CMD_REQUEST_MESSAGE.
  time_boot_ms: uint32  % Timestamp (time since system boot).
  cap_flags: uint32  % Bitmap of gimbal capability flags.
  gimbal_device_id: uint8  % Gimbal device ID that this gimbal manager is responsible for. Component ID of gimbal device (or 1-6 for non-MAVLink gimbal).
  roll_min: single  % Minimum hardware roll angle (positive: rolling to the right, negative: rolling to the left)
  roll_max: single  % Maximum hardware roll angle (positive: rolling to the right, negative: rolling to the left)
  pitch_min: single  % Minimum pitch angle (positive: up, negative: down)
  pitch_max: single  % Maximum pitch angle (positive: up, negative: down)
  yaw_min: single  % Minimum yaw angle (positive: to the right, negative: to the left)
  yaw_max: single  % Maximum yaw angle (positive: to the right, negative: to the left)

mav_gimbal_manager_status_s = Simulink.Bus()  % Current status about a high level gimbal manager. This message should be broadcast at a low regular rate (e.g. 5Hz).
  time_boot_ms: uint32  % Timestamp (time since system boot).
  flags: uint32  % High level gimbal manager flags currently applied.
  gimbal_device_id: uint8  % Gimbal device ID that this gimbal manager is responsible for. Component ID of gimbal device (or 1-6 for non-MAVLink gimbal).
  primary_control_sysid: uint8  % System ID of MAVLink component with primary control, 0 for none.
  primary_control_compid: uint8  % Component ID of MAVLink component with primary control, 0 for none.
  secondary_control_sysid: uint8  % System ID of MAVLink component with secondary control, 0 for none.
  secondary_control_compid: uint8  % Component ID of MAVLink component with secondary control, 0 for none.

mav_gimbal_manager_set_attitude_s = Simulink.Bus()  % High level message to control a gimbal's attitude. This message is to be sent to the gimbal manager (e.g. from a ground station). Angles and rates can be set to NaN according to use case.
  target_system: uint8  % System ID
  target_component: uint8  % Component ID
  flags: uint32  % High level gimbal manager flags to use.
  gimbal_device_id: uint8  % Component ID of gimbal device to address (or 1-6 for non-MAVLink gimbal), 0 for all gimbal device components. Send command multiple times for more than one gimbal (but not all gimbals).
  q: single[4]  % Quaternion components, w, x, y, z (1 0 0 0 is the null-rotation, the frame is depends on whether the flag GIMBAL_MANAGER_FLAGS_YAW_LOCK is set)
  angular_velocity_x: single  % X component of angular velocity, positive is rolling to the right, NaN to be ignored.
  angular_velocity_y: single  % Y component of angular velocity, positive is pitching up, NaN to be ignored.
  angular_velocity_z: single  % Z component of angular velocity, positive is yawing to the right, NaN to be ignored.

mav_gimbal_device_information_s = Simulink.Bus()  % Information about a low level gimbal. This message should be requested by the gimbal manager or a ground station using MAV_CMD_REQUEST_MESSAGE. The maximum angles and rates are the limits by hardware. However, the limits by software used are likely different/smaller and dependent on mode/settings/etc..
  time_boot_ms: uint32  % Timestamp (time since system boot).
  vendor_name: int8[32]  % Name of the gimbal vendor.
  model_name: int8[32]  % Name of the gimbal model.
  custom_name: int8[32]  % Custom name of the gimbal given to it by the user.
  firmware_version: uint32  % Version of the gimbal firmware, encoded as: (Dev & 0xff) << 24 | (Patch & 0xff) << 16 | (Minor & 0xff) << 8 | (Major & 0xff).
  hardware_version: uint32  % Version of the gimbal hardware, encoded as: (Dev & 0xff) << 24 | (Patch & 0xff) << 16 | (Minor & 0xff) << 8 | (Major & 0xff).
  uid: fixdt(0,64,0)  % UID of gimbal hardware (0 if unknown).
  cap_flags: uint16  % Bitmap of gimbal capability flags.
  custom_cap_flags: uint16  % Bitmap for use for gimbal-specific capability flags.
  roll_min: single  % Minimum hardware roll angle (positive: rolling to the right, negative: rolling to the left). NAN if unknown.
  roll_max: single  % Maximum hardware roll angle (positive: rolling to the right, negative: rolling to the left). NAN if unknown.
  pitch_min: single  % Minimum hardware pitch angle (positive: up, negative: down). NAN if unknown.
  pitch_max: single  % Maximum hardware pitch angle (positive: up, negative: down). NAN if unknown.
  yaw_min: single  % Minimum hardware yaw angle (positive: to the right, negative: to the left). NAN if unknown.
  yaw_max: single  % Maximum hardware yaw angle (positive: to the right, negative: to the left). NAN if unknown.
  gimbal_device_id: uint8  % This field is to be used if the gimbal manager and the gimbal device are the same component and hence have the same component ID. This field is then set to a number between 1-6. If the component ID is separate, this field is not required and must be set to 0.

mav_gimbal_device_set_attitude_s = Simulink.Bus()  % Low level message to control a gimbal device's attitude.
  % This message is to be sent from the gimbal manager to the gimbal device component.
  % The quaternion and angular velocities can be set to NaN according to use case.
  % For the angles encoded in the quaternion and the angular velocities holds:
  % If the flag GIMBAL_DEVICE_FLAGS_YAW_IN_VEHICLE_FRAME is set, then they are relative to the vehicle heading (vehicle frame).
  % If the flag GIMBAL_DEVICE_FLAGS_YAW_IN_EARTH_FRAME is set, then they are relative to absolute North (earth frame).
  % If neither of these flags are set, then (for backwards compatibility) it holds:
  % If the flag GIMBAL_DEVICE_FLAGS_YAW_LOCK is set, then they are relative to absolute North (earth frame),
  % else they are relative to the vehicle heading (vehicle frame).
  % Setting both GIMBAL_DEVICE_FLAGS_YAW_IN_VEHICLE_FRAME and GIMBAL_DEVICE_FLAGS_YAW_IN_EARTH_FRAME is not allowed.
  % These rules are to ensure backwards compatibility.
  % New implementations should always set either GIMBAL_DEVICE_FLAGS_YAW_IN_VEHICLE_FRAME or GIMBAL_DEVICE_FLAGS_YAW_IN_EARTH_FRAME.
  target_system: uint8  % System ID
  target_component: uint8  % Component ID
  flags: uint16  % Low level gimbal flags.
  q: single[4]  % Quaternion components, w, x, y, z (1 0 0 0 is the null-rotation). The frame is described in the message description. Set fields to NaN to be ignored.
  angular_velocity_x: single  % X component of angular velocity (positive: rolling to the right). The frame is described in the message description. NaN to be ignored.
  angular_velocity_y: single  % Y component of angular velocity (positive: pitching up). The frame is described in the message description. NaN to be ignored.
  angular_velocity_z: single  % Z component of angular velocity (positive: yawing to the right). The frame is described in the message description. NaN to be ignored.

mav_gimbal_device_attitude_status_s = Simulink.Bus()  % Message reporting the status of a gimbal device.
  % This message should be broadcast by a gimbal device component at a low regular rate (e.g. 5 Hz).
  % For the angles encoded in the quaternion and the angular velocities holds:
  % If the flag GIMBAL_DEVICE_FLAGS_YAW_IN_VEHICLE_FRAME is set, then they are relative to the vehicle heading (vehicle frame).
  % If the flag GIMBAL_DEVICE_FLAGS_YAW_IN_EARTH_FRAME is set, then they are relative to absolute North (earth frame).
  % If neither of these flags are set, then (for backwards compatibility) it holds:
  % If the flag GIMBAL_DEVICE_FLAGS_YAW_LOCK is set, then they are relative to absolute North (earth frame),
  % else they are relative to the vehicle heading (vehicle frame).
  % Other conditions of the flags are not allowed.
  % The quaternion and angular velocities in the other frame can be calculated from delta_yaw and delta_yaw_velocity as
  % q_earth = q_delta_yaw * q_vehicle and w_earth = w_delta_yaw_velocity + w_vehicle (if not NaN).
  % If neither the GIMBAL_DEVICE_FLAGS_YAW_IN_VEHICLE_FRAME nor the GIMBAL_DEVICE_FLAGS_YAW_IN_EARTH_FRAME flag is set,
  % then (for backwards compatibility) the data in the delta_yaw and delta_yaw_velocity fields are to be ignored.
  % New implementations should always set either GIMBAL_DEVICE_FLAGS_YAW_IN_VEHICLE_FRAME or GIMBAL_DEVICE_FLAGS_YAW_IN_EARTH_FRAME,
  % and always should set delta_yaw and delta_yaw_velocity either to the proper value or NaN.
  target_system: uint8  % System ID
  target_component: uint8  % Component ID
  time_boot_ms: uint32  % Timestamp (time since system boot).
  flags: uint16  % Current gimbal flags set.
  q: single[4]  % Quaternion components, w, x, y, z (1 0 0 0 is the null-rotation). The frame is described in the message description.
  angular_velocity_x: single  % X component of angular velocity (positive: rolling to the right). The frame is described in the message description. NaN if unknown.
  angular_velocity_y: single  % Y component of angular velocity (positive: pitching up). The frame is described in the message description. NaN if unknown.
  angular_velocity_z: single  % Z component of angular velocity (positive: yawing to the right). The frame is described in the message description. NaN if unknown.
  failure_flags: uint32  % Failure flags (0 for no failure)
  delta_yaw: single  % Yaw angle relating the quaternions in earth and body frames (see message description). NaN if unknown.
  delta_yaw_velocity: single  % Yaw angular velocity relating the angular velocities in earth and body frames (see message description). NaN if unknown.
  gimbal_device_id: uint8  % This field is to be used if the gimbal manager and the gimbal device are the same component and hence have the same component ID. This field is then set a number between 1-6. If the component ID is separate, this field is not required and must be set to 0.

mav_autopilot_state_for_gimbal_device_s = Simulink.Bus()  % Low level message containing autopilot state relevant for a gimbal device. This message is to be sent from the autopilot to the gimbal device component. The data of this message are for the gimbal device's estimator corrections, in particular horizon compensation, as well as indicates autopilot control intentions, e.g. feed forward angular control in the z-axis.
  target_system: uint8  % System ID
  target_component: uint8  % Component ID
  time_boot_us: fixdt(0,64,0)  % Timestamp (time since system boot).
  q: single[4]  % Quaternion components of autopilot attitude: w, x, y, z (1 0 0 0 is the null-rotation, Hamilton convention).
  q_estimated_delay_us: uint32  % Estimated delay of the attitude data. 0 if unknown.
  vx: single  % X Speed in NED (North, East, Down). NAN if unknown.
  vy: single  % Y Speed in NED (North, East, Down). NAN if unknown.
  vz: single  % Z Speed in NED (North, East, Down). NAN if unknown.
  v_estimated_delay_us: uint32  % Estimated delay of the speed data. 0 if unknown.
  feed_forward_angular_velocity_z: single  % Feed forward Z component of angular velocity (positive: yawing to the right). NaN to be ignored. This is to indicate if the autopilot is actively yawing.
  estimator_status: uint16  % Bitmap indicating which estimator outputs are valid.
  landed_state: uint8  % The landed state. Is set to MAV_LANDED_STATE_UNDEFINED if landed state is unknown.
  angular_velocity_z: single  % Z component of angular velocity in NED (North, East, Down). NaN if unknown.

mav_gimbal_manager_set_pitchyaw_s = Simulink.Bus()  % Set gimbal manager pitch and yaw angles (high rate message). This message is to be sent to the gimbal manager (e.g. from a ground station) and will be ignored by gimbal devices. Angles and rates can be set to NaN according to use case. Use MAV_CMD_DO_GIMBAL_MANAGER_PITCHYAW for low-rate adjustments that require confirmation.
  target_system: uint8  % System ID
  target_component: uint8  % Component ID
  flags: uint32  % High level gimbal manager flags to use.
  gimbal_device_id: uint8  % Component ID of gimbal device to address (or 1-6 for non-MAVLink gimbal), 0 for all gimbal device components. Send command multiple times for more than one gimbal (but not all gimbals).
  pitch: single  % Pitch angle (positive: up, negative: down, NaN to be ignored).
  yaw: single  % Yaw angle (positive: to the right, negative: to the left, NaN to be ignored).
  pitch_rate: single  % Pitch angular rate (positive: up, negative: down, NaN to be ignored).
  yaw_rate: single  % Yaw angular rate (positive: to the right, negative: to the left, NaN to be ignored).

mav_gimbal_manager_set_manual_control_s = Simulink.Bus()  % High level message to control a gimbal manually. The angles or angular rates are unitless; the actual rates will depend on internal gimbal manager settings/configuration (e.g. set by parameters). This message is to be sent to the gimbal manager (e.g. from a ground station). Angles and rates can be set to NaN according to use case.
  target_system: uint8  % System ID
  target_component: uint8  % Component ID
  flags: uint32  % High level gimbal manager flags.
  gimbal_device_id: uint8  % Component ID of gimbal device to address (or 1-6 for non-MAVLink gimbal), 0 for all gimbal device components. Send command multiple times for more than one gimbal (but not all gimbals).
  pitch: single  % Pitch angle unitless (-1..1, positive: up, negative: down, NaN to be ignored).
  yaw: single  % Yaw angle unitless (-1..1, positive: to the right, negative: to the left, NaN to be ignored).
  pitch_rate: single  % Pitch angular rate unitless (-1..1, positive: up, negative: down, NaN to be ignored).
  yaw_rate: single  % Yaw angular rate unitless (-1..1, positive: to the right, negative: to the left, NaN to be ignored).

mav_esc_info_s = Simulink.Bus()  % ESC information for lower rate streaming. Recommended streaming rate 1Hz. See ESC_STATUS for higher-rate ESC data.
  index: uint8  % Index of the first ESC in this message. minValue = 0, maxValue = 60, increment = 4.
  time_usec: fixdt(0,64,0)  % Timestamp (UNIX Epoch time or time since system boot). The receiving end can infer timestamp format (since 1.1.1970 or since system boot) by checking for the magnitude the number.
  counter: uint16  % Counter of data packets received.
  count: uint8  % Total number of ESCs in all messages of this type. Message fields with an index higher than this should be ignored because they contain invalid data.
  connection_type: uint8  % Connection type protocol for all ESC.
  info: uint8  % Information regarding online/offline status of each ESC.
  failure_flags: uint16[4]  % Bitmap of ESC failure flags.
  error_count: uint32[4]  % Number of reported errors by each ESC since boot.
  temperature: int16[4]  % Temperature of each ESC. INT16_MAX: if data not supplied by ESC.

mav_esc_status_s = Simulink.Bus()  % ESC information for higher rate streaming. Recommended streaming rate is ~10 Hz. Information that changes more slowly is sent in ESC_INFO. It should typically only be streamed on high-bandwidth links (i.e. to a companion computer).
  index: uint8  % Index of the first ESC in this message. minValue = 0, maxValue = 60, increment = 4.
  time_usec: fixdt(0,64,0)  % Timestamp (UNIX Epoch time or time since system boot). The receiving end can infer timestamp format (since 1.1.1970 or since system boot) by checking for the magnitude the number.
  rpm: int32[4]  % Reported motor RPM from each ESC (negative for reverse rotation).
  voltage: single[4]  % Voltage measured from each ESC.
  current: single[4]  % Current measured from each ESC.

mav_wifi_config_ap_s = Simulink.Bus()  % Configure WiFi AP SSID, password, and mode. This message is re-emitted as an acknowledgement by the AP. The message may also be explicitly requested using MAV_CMD_REQUEST_MESSAGE
  ssid: int8[32]  % Name of Wi-Fi network (SSID). Blank to leave it unchanged when setting. Current SSID when sent back as a response.
  password: int8[64]  % Password. Blank for an open AP. MD5 hash when message is sent back as a response.
  mode: int8_t  % WiFi Mode.
  response: int8_t  % Message acceptance response (sent back to GS).

mav_ais_vessel_s = Simulink.Bus()  % The location and information of an AIS vessel
  MMSI: uint32  % Mobile Marine Service Identifier, 9 decimal digits
  lat: int32  % Latitude
  lon: int32  % Longitude
  COG: uint16  % Course over ground
  heading: uint16  % True heading
  velocity: uint16  % Speed over ground
  turn_rate: int8_t  % Turn rate
  navigational_status: uint8  % Navigational status
  type: uint8  % Type of vessels
  dimension_bow: uint16  % Distance from lat/lon location to bow
  dimension_stern: uint16  % Distance from lat/lon location to stern
  dimension_port: uint8  % Distance from lat/lon location to port side
  dimension_starboard: uint8  % Distance from lat/lon location to starboard side
  callsign: int8[7]  % The vessel callsign
  name: int8[20]  % The vessel name
  tslc: uint16  % Time since last communication in seconds
  flags: uint16  % Bitmask to indicate various statuses including valid data fields

mav_uavcan_node_status_s = Simulink.Bus()  % General status information of an UAVCAN node. Please refer to the definition of the UAVCAN message "uavcan.protocol.NodeStatus" for the background information. The UAVCAN specification is available at http://uavcan.org.
  time_usec: fixdt(0,64,0)  % Timestamp (UNIX Epoch time or time since system boot). The receiving end can infer timestamp format (since 1.1.1970 or since system boot) by checking for the magnitude of the number.
  uptime_sec: uint32  % Time since the start-up of the node.
  health: uint8  % Generalized node health status.
  mode: uint8  % Generalized operating mode.
  sub_mode: uint8  % Not used currently.
  vendor_specific_status_code: uint16  % Vendor-specific status information.

mav_uavcan_node_info_s = Simulink.Bus()  % General information describing a particular UAVCAN node. Please refer to the definition of the UAVCAN service "uavcan.protocol.GetNodeInfo" for the background information. This message should be emitted by the system whenever a new node appears online, or an existing node reboots. Additionally, it can be emitted upon request from the other end of the MAVLink channel (see MAV_CMD_UAVCAN_GET_NODE_INFO). It is also not prohibited to emit this message unconditionally at a low frequency. The UAVCAN specification is available at http://uavcan.org.
  time_usec: fixdt(0,64,0)  % Timestamp (UNIX Epoch time or time since system boot). The receiving end can infer timestamp format (since 1.1.1970 or since system boot) by checking for the magnitude of the number.
  uptime_sec: uint32  % Time since the start-up of the node.
  name: int8[80]  % Node name string. For example, "sapog.px4.io".
  hw_version_major: uint8  % Hardware major version number.
  hw_version_minor: uint8  % Hardware minor version number.
  hw_unique_id: uint8[16]  % Hardware unique 128-bit ID.
  sw_version_major: uint8  % Software major version number.
  sw_version_minor: uint8  % Software minor version number.
  sw_vcs_commit: uint32  % Version control system (VCS) revision identifier (e.g. git short commit hash). 0 if unknown.

mav_param_ext_request_read_s = Simulink.Bus()  % Request to read the value of a parameter with either the param_id string id or param_index. PARAM_EXT_VALUE should be emitted in response.
  target_system: uint8  % System ID
  target_component: uint8  % Component ID
  param_id: int8[16]  % Parameter id, terminated by NULL if the length is less than 16 human-readable chars and WITHOUT null termination (NULL) byte if the length is exactly 16 chars - applications have to provide 16+1 bytes storage if the ID is stored as string
  param_index: int16  % Parameter index. Set to -1 to use the Parameter ID field as identifier (else param_id will be ignored)

mav_param_ext_request_list_s = Simulink.Bus()  % Request all parameters of this component. All parameters should be emitted in response as PARAM_EXT_VALUE.
  target_system: uint8  % System ID
  target_component: uint8  % Component ID

mav_param_ext_value_s = Simulink.Bus()  % Emit the value of a parameter. The inclusion of param_count and param_index in the message allows the recipient to keep track of received parameters and allows them to re-request missing parameters after a loss or timeout.
  param_id: int8[16]  % Parameter id, terminated by NULL if the length is less than 16 human-readable chars and WITHOUT null termination (NULL) byte if the length is exactly 16 chars - applications have to provide 16+1 bytes storage if the ID is stored as string
  param_value: int8[128]  % Parameter value
  param_type: uint8  % Parameter type.
  param_count: uint16  % Total number of parameters
  param_index: uint16  % Index of this parameter

mav_param_ext_set_s = Simulink.Bus()  % Set a parameter value. In order to deal with message loss (and retransmission of PARAM_EXT_SET), when setting a parameter value and the new value is the same as the current value, you will immediately get a PARAM_ACK_ACCEPTED response. If the current state is PARAM_ACK_IN_PROGRESS, you will accordingly receive a PARAM_ACK_IN_PROGRESS in response.
  target_system: uint8  % System ID
  target_component: uint8  % Component ID
  param_id: int8[16]  % Parameter id, terminated by NULL if the length is less than 16 human-readable chars and WITHOUT null termination (NULL) byte if the length is exactly 16 chars - applications have to provide 16+1 bytes storage if the ID is stored as string
  param_value: int8[128]  % Parameter value
  param_type: uint8  % Parameter type.

mav_param_ext_ack_s = Simulink.Bus()  % Response from a PARAM_EXT_SET message.
  param_id: int8[16]  % Parameter id, terminated by NULL if the length is less than 16 human-readable chars and WITHOUT null termination (NULL) byte if the length is exactly 16 chars - applications have to provide 16+1 bytes storage if the ID is stored as string
  param_value: int8[128]  % Parameter value (new value if PARAM_ACK_ACCEPTED, current value otherwise)
  param_type: uint8  % Parameter type.
  param_result: uint8  % Result code.

mav_obstacle_distance_s = Simulink.Bus()  % Obstacle distances in front of the sensor, starting from the left in increment degrees to the right
  time_usec: fixdt(0,64,0)  % Timestamp (UNIX Epoch time or time since system boot). The receiving end can infer timestamp format (since 1.1.1970 or since system boot) by checking for the magnitude of the number.
  sensor_type: uint8  % Class id of the distance sensor type.
  distances: uint16[72]  % Distance of obstacles around the vehicle with index 0 corresponding to north + angle_offset, unless otherwise specified in the frame. A value of 0 is valid and means that the obstacle is practically touching the sensor. A value of max_distance +1 means no obstacle is present. A value of UINT16_MAX for unknown/not used. In a array element, one unit corresponds to 1cm.
  increment: uint8  % Angular width in degrees of each array element. Increment direction is clockwise. This field is ignored if increment_f is non-zero.
  min_distance: uint16  % Minimum distance the sensor can measure.
  max_distance: uint16  % Maximum distance the sensor can measure.
  increment_f: single  % Angular width in degrees of each array element as a float. If non-zero then this value is used instead of the uint8_t increment field. Positive is clockwise direction, negative is counter-clockwise.
  angle_offset: single  % Relative angle offset of the 0-index element in the distances array. Value of 0 corresponds to forward. Positive is clockwise direction, negative is counter-clockwise.
  frame: uint8  % Coordinate frame of reference for the yaw rotation and offset of the sensor data. Defaults to MAV_FRAME_GLOBAL, which is north aligned. For body-mounted sensors use MAV_FRAME_BODY_FRD, which is vehicle front aligned.

mav_odometry_s = Simulink.Bus()  % Odometry message to communicate odometry information with an external interface. Fits ROS REP 147 standard for aerial vehicles (http://www.ros.org/reps/rep-0147.html).
  time_usec: fixdt(0,64,0)  % Timestamp (UNIX Epoch time or time since system boot). The receiving end can infer timestamp format (since 1.1.1970 or since system boot) by checking for the magnitude of the number.
  frame_id: uint8  % Coordinate frame of reference for the pose data.
  child_frame_id: uint8  % Coordinate frame of reference for the velocity in free space (twist) data.
  x: single  % X Position
  y: single  % Y Position
  z: single  % Z Position
  q: single[4]  % Quaternion components, w, x, y, z (1 0 0 0 is the null-rotation)
  vx: single  % X linear speed
  vy: single  % Y linear speed
  vz: single  % Z linear speed
  rollspeed: single  % Roll angular speed
  pitchspeed: single  % Pitch angular speed
  yawspeed: single  % Yaw angular speed
  pose_covariance: single[21]  % Row-major representation of a 6x6 pose cross-covariance matrix upper right triangle (states: x, y, z, roll, pitch, yaw; first six entries are the first ROW, next five entries are the second ROW, etc.). If unknown, assign NaN value to first element in the array.
  velocity_covariance: single[21]  % Row-major representation of a 6x6 velocity cross-covariance matrix upper right triangle (states: vx, vy, vz, rollspeed, pitchspeed, yawspeed; first six entries are the first ROW, next five entries are the second ROW, etc.). If unknown, assign NaN value to first element in the array.
  reset_counter: uint8  % Estimate reset counter. This should be incremented when the estimate resets in any of the dimensions (position, velocity, attitude, angular speed). This is designed to be used when e.g an external SLAM system detects a loop-closure and the estimate jumps.
  estimator_type: uint8  % Type of estimator that is providing the odometry.
  quality: int8_t  % Optional odometry quality metric as a percentage. -1 = odometry has failed, 0 = unknown/unset quality, 1 = worst quality, 100 = best quality

mav_trajectory_representation_waypoints_s = Simulink.Bus()  % Describe a trajectory using an array of up-to 5 waypoints in the local frame (MAV_FRAME_LOCAL_NED).
  time_usec: fixdt(0,64,0)  % Timestamp (UNIX Epoch time or time since system boot). The receiving end can infer timestamp format (since 1.1.1970 or since system boot) by checking for the magnitude of the number.
  valid_points: uint8  % Number of valid points (up-to 5 waypoints are possible)
  pos_x: single[5]  % X-coordinate of waypoint, set to NaN if not being used
  pos_y: single[5]  % Y-coordinate of waypoint, set to NaN if not being used
  pos_z: single[5]  % Z-coordinate of waypoint, set to NaN if not being used
  vel_x: single[5]  % X-velocity of waypoint, set to NaN if not being used
  vel_y: single[5]  % Y-velocity of waypoint, set to NaN if not being used
  vel_z: single[5]  % Z-velocity of waypoint, set to NaN if not being used
  acc_x: single[5]  % X-acceleration of waypoint, set to NaN if not being used
  acc_y: single[5]  % Y-acceleration of waypoint, set to NaN if not being used
  acc_z: single[5]  % Z-acceleration of waypoint, set to NaN if not being used
  pos_yaw: single[5]  % Yaw angle, set to NaN if not being used
  vel_yaw: single[5]  % Yaw rate, set to NaN if not being used
  command: uint16[5]  % MAV_CMD command id of waypoint, set to UINT16_MAX if not being used.

mav_trajectory_representation_bezier_s = Simulink.Bus()  % Describe a trajectory using an array of up-to 5 bezier control points in the local frame (MAV_FRAME_LOCAL_NED).
  time_usec: fixdt(0,64,0)  % Timestamp (UNIX Epoch time or time since system boot). The receiving end can infer timestamp format (since 1.1.1970 or since system boot) by checking for the magnitude of the number.
  valid_points: uint8  % Number of valid control points (up-to 5 points are possible)
  pos_x: single[5]  % X-coordinate of bezier control points. Set to NaN if not being used
  pos_y: single[5]  % Y-coordinate of bezier control points. Set to NaN if not being used
  pos_z: single[5]  % Z-coordinate of bezier control points. Set to NaN if not being used
  delta: single[5]  % Bezier time horizon. Set to NaN if velocity/acceleration should not be incorporated
  pos_yaw: single[5]  % Yaw. Set to NaN for unchanged

mav_cellular_status_s = Simulink.Bus()  % Report current used cellular network status
  status: uint8  % Cellular modem status
  failure_reason: uint8  % Failure reason when status in in CELLULAR_STATUS_FLAG_FAILED
  type: uint8  % Cellular network radio type: gsm, cdma, lte...
  quality: uint8  % Signal quality in percent. If unknown, set to UINT8_MAX
  mcc: uint16  % Mobile country code. If unknown, set to UINT16_MAX
  mnc: uint16  % Mobile network code. If unknown, set to UINT16_MAX
  lac: uint16  % Location area code. If unknown, set to 0

mav_isbd_link_status_s = Simulink.Bus()  % Status of the Iridium SBD link.
  timestamp: fixdt(0,64,0)  % Timestamp (UNIX Epoch time or time since system boot). The receiving end can infer timestamp format (since 1.1.1970 or since system boot) by checking for the magnitude of the number.
  last_heartbeat: fixdt(0,64,0)  % Timestamp of the last successful sbd session. The receiving end can infer timestamp format (since 1.1.1970 or since system boot) by checking for the magnitude of the number.
  failed_sessions: uint16  % Number of failed SBD sessions.
  successful_sessions: uint16  % Number of successful SBD sessions.
  signal_quality: uint8  % Signal quality equal to the number of bars displayed on the ISU signal strength indicator. Range is 0 to 5, where 0 indicates no signal and 5 indicates maximum signal strength.
  ring_pending: uint8  % 1: Ring call pending, 0: No call pending.
  tx_session_pending: uint8  % 1: Transmission session pending, 0: No transmission session pending.
  rx_session_pending: uint8  % 1: Receiving session pending, 0: No receiving session pending.

mav_cellular_config_s = Simulink.Bus()  % Configure cellular modems.
  % This message is re-emitted as an acknowledgement by the modem.
  % The message may also be explicitly requested using MAV_CMD_REQUEST_MESSAGE.
  enable_lte: uint8  % Enable/disable LTE. 0: setting unchanged, 1: disabled, 2: enabled. Current setting when sent back as a response.
  enable_pin: uint8  % Enable/disable PIN on the SIM card. 0: setting unchanged, 1: disabled, 2: enabled. Current setting when sent back as a response.
  pin: int8[16]  % PIN sent to the SIM card. Blank when PIN is disabled. Empty when message is sent back as a response.
  new_pin: int8[16]  % New PIN when changing the PIN. Blank to leave it unchanged. Empty when message is sent back as a response.
  apn: int8[32]  % Name of the cellular APN. Blank to leave it unchanged. Current APN when sent back as a response.
  puk: int8[16]  % Required PUK code in case the user failed to authenticate 3 times with the PIN. Empty when message is sent back as a response.
  roaming: uint8  % Enable/disable roaming. 0: setting unchanged, 1: disabled, 2: enabled. Current setting when sent back as a response.
  response: uint8  % Message acceptance response (sent back to GS).

mav_raw_rpm_s = Simulink.Bus()  % RPM sensor data message.
  index: uint8  % Index of this RPM sensor (0-indexed)
  frequency: single  % Indicated rate

mav_utm_global_position_s = Simulink.Bus()  % The global position resulting from GPS and sensor fusion.
  time: fixdt(0,64,0)  % Time of applicability of position (microseconds since UNIX epoch).
  uas_id: uint8[18]  % Unique UAS ID.
  lat: int32  % Latitude (WGS84)
  lon: int32  % Longitude (WGS84)
  alt: int32  % Altitude (WGS84)
  relative_alt: int32  % Altitude above ground
  vx: int16  % Ground X speed (latitude, positive north)
  vy: int16  % Ground Y speed (longitude, positive east)
  vz: int16  % Ground Z speed (altitude, positive down)
  h_acc: uint16  % Horizontal position uncertainty (standard deviation)
  v_acc: uint16  % Altitude uncertainty (standard deviation)
  vel_acc: uint16  % Speed uncertainty (standard deviation)
  next_lat: int32  % Next waypoint, latitude (WGS84)
  next_lon: int32  % Next waypoint, longitude (WGS84)
  next_alt: int32  % Next waypoint, altitude (WGS84)
  update_rate: uint16  % Time until next update. Set to 0 if unknown or in data driven mode.
  flight_state: uint8  % Flight state
  flags: uint8  % Bitwise OR combination of the data available flags.

mav_debug_float_array_s = Simulink.Bus()  % Large debug/prototyping array. The message uses the maximum available payload for data. The array_id and name fields are used to discriminate between messages in code and in user interfaces (respectively). Do not use in production code.
  time_usec: fixdt(0,64,0)  % Timestamp (UNIX Epoch time or time since system boot). The receiving end can infer timestamp format (since 1.1.1970 or since system boot) by checking for the magnitude of the number.
  name: int8[10]  % Name, for human-friendly display in a Ground Control Station
  array_id: uint16  % Unique ID used to discriminate between arrays
  data: single[58]  % data

mav_orbit_execution_status_s = Simulink.Bus()  % Vehicle status report that is sent out while orbit execution is in progress (see MAV_CMD_DO_ORBIT).
  time_usec: fixdt(0,64,0)  % Timestamp (UNIX Epoch time or time since system boot). The receiving end can infer timestamp format (since 1.1.1970 or since system boot) by checking for the magnitude of the number.
  radius: single  % Radius of the orbit circle. Positive values orbit clockwise, negative values orbit counter-clockwise.
  frame: uint8  % The coordinate system of the fields: x, y, z.
  x: int32  % X coordinate of center point. Coordinate system depends on frame field: local = x position in meters * 1e4, global = latitude in degrees * 1e7.
  y: int32  % Y coordinate of center point.  Coordinate system depends on frame field: local = x position in meters * 1e4, global = latitude in degrees * 1e7.
  z: single  % Altitude of center point. Coordinate system depends on frame field.

mav_smart_battery_info_s = Simulink.Bus()  % Smart Battery information (static/infrequent update). Use for updates from: smart battery to flight stack, flight stack to GCS. Use BATTERY_STATUS for smart battery frequent updates.
  id: uint8  % Battery ID
  battery_function: uint8  % Function of the battery
  type: uint8  % Type (chemistry) of the battery
  capacity_full_specification: int32  % Capacity when full according to manufacturer, -1: field not provided.
  capacity_full: int32  % Capacity when full (accounting for battery degradation), -1: field not provided.
  cycle_count: uint16  % Charge/discharge cycle count. UINT16_MAX: field not provided.
  serial_number: int8[16]  % Serial number in ASCII characters, 0 terminated. All 0: field not provided.
  device_name: int8[50]  % Static device name in ASCII characters, 0 terminated. All 0: field not provided. Encode as manufacturer name then product name separated using an underscore.
  weight: uint16  % Battery weight. 0: field not provided.
  discharge_minimum_voltage: uint16  % Minimum per-cell voltage when discharging. If not supplied set to UINT16_MAX value.
  charging_minimum_voltage: uint16  % Minimum per-cell voltage when charging. If not supplied set to UINT16_MAX value.
  resting_minimum_voltage: uint16  % Minimum per-cell voltage when resting. If not supplied set to UINT16_MAX value.
  charging_maximum_voltage: uint16  % Maximum per-cell voltage when charged. 0: field not provided.
  cells_in_series: uint8  % Number of battery cells in series. 0: field not provided.
  discharge_maximum_current: uint32  % Maximum pack discharge current. 0: field not provided.
  discharge_maximum_burst_current: uint32  % Maximum pack discharge burst current. 0: field not provided.
  manufacture_date: int8[11]  % Manufacture date (DD/MM/YYYY) in ASCII characters, 0 terminated. All 0: field not provided.

mav_generator_status_s = Simulink.Bus()  % Telemetry of power generation system. Alternator or mechanical generator.
  status: fixdt(0,64,0)  % Status flags.
  generator_speed: uint16  % Speed of electrical generator or alternator. UINT16_MAX: field not provided.
  battery_current: single  % Current into/out of battery. Positive for out. Negative for in. NaN: field not provided.
  load_current: single  % Current going to the UAV. If battery current not available this is the DC current from the generator. Positive for out. Negative for in. NaN: field not provided
  power_generated: single  % The power being generated. NaN: field not provided
  bus_voltage: single  % Voltage of the bus seen at the generator, or battery bus if battery bus is controlled by generator and at a different voltage to main bus.
  rectifier_temperature: int16  % The temperature of the rectifier or power converter. INT16_MAX: field not provided.
  bat_current_setpoint: single  % The target battery current. Positive for out. Negative for in. NaN: field not provided
  generator_temperature: int16  % The temperature of the mechanical motor, fuel cell core or generator. INT16_MAX: field not provided.
  runtime: uint32  % Seconds this generator has run since it was rebooted. UINT32_MAX: field not provided.
  time_until_maintenance: int32  % Seconds until this generator requires maintenance.  A negative value indicates maintenance is past-due. INT32_MAX: field not provided.

mav_actuator_output_status_s = Simulink.Bus()  % The raw values of the actuator outputs (e.g. on Pixhawk, from MAIN, AUX ports). This message supersedes SERVO_OUTPUT_RAW.
  time_usec: fixdt(0,64,0)  % Timestamp (since system boot).
  active: uint32  % Active outputs
  actuator: single[32]  % Servo / motor output array values. Zero values indicate unused channels.

mav_time_estimate_to_target_s = Simulink.Bus()  % Time/duration estimates for various events and actions given the current vehicle state and position.
  safe_return: int32  % Estimated time to complete the vehicle's configured "safe return" action from its current position (e.g. RTL, Smart RTL, etc.). -1 indicates that the vehicle is landed, or that no time estimate available.
  land: int32  % Estimated time for vehicle to complete the LAND action from its current position. -1 indicates that the vehicle is landed, or that no time estimate available.
  mission_next_item: int32  % Estimated time for reaching/completing the currently active mission item. -1 means no time estimate available.
  mission_end: int32  % Estimated time for completing the current mission. -1 means no mission active and/or no estimate available.
  commanded_action: int32  % Estimated time for completing the current commanded action (i.e. Go To, Takeoff, Land, etc.). -1 means no action active and/or no estimate available.

mav_tunnel_s = Simulink.Bus()  % Message for transporting "arbitrary" variable-length data from one component to another (broadcast is not forbidden, but discouraged). The encoding of the data is usually extension specific, i.e. determined by the source, and is usually not documented as part of the MAVLink specification.
  target_system: uint8  % System ID (can be 0 for broadcast, but this is discouraged)
  target_component: uint8  % Component ID (can be 0 for broadcast, but this is discouraged)
  payload_type: uint16  % A code that identifies the content of the payload (0 for unknown, which is the default). If this code is less than 32768, it is a 'registered' payload type and the corresponding code should be added to the MAV_TUNNEL_PAYLOAD_TYPE enum. Software creators can register blocks of types as needed. Codes greater than 32767 are considered local experiments and should not be checked in to any widely distributed codebase.
  payload_length: uint8  % Length of the data transported in payload
  payload: uint8[128]  % Variable length payload. The payload length is defined by payload_length. The entire content of this block is opaque unless you understand the encoding specified by payload_type.

mav_can_frame_s = Simulink.Bus()  % A forwarded CAN frame as requested by MAV_CMD_CAN_FORWARD.
  target_system: uint8  % System ID.
  target_component: uint8  % Component ID.
  bus: uint8  % Bus number
  len: uint8  % Frame length
  id: uint32  % Frame ID
  data: uint8[8]  % Frame data

mav_onboard_computer_status_s = Simulink.Bus()  % Hardware status sent by an onboard computer.
  time_usec: fixdt(0,64,0)  % Timestamp (UNIX Epoch time or time since system boot). The receiving end can infer timestamp format (since 1.1.1970 or since system boot) by checking for the magnitude of the number.
  uptime: uint32  % Time since system boot.
  type: uint8  % Type of the onboard computer: 0: Mission computer primary, 1: Mission computer backup 1, 2: Mission computer backup 2, 3: Compute node, 4-5: Compute spares, 6-9: Payload computers.
  cpu_cores: uint8[8]  % CPU usage on the component in percent (100 - idle). A value of UINT8_MAX implies the field is unused.
  cpu_combined: uint8[10]  % Combined CPU usage as the last 10 slices of 100 MS (a histogram). This allows to identify spikes in load that max out the system, but only for a short amount of time. A value of UINT8_MAX implies the field is unused.
  gpu_cores: uint8[4]  % GPU usage on the component in percent (100 - idle). A value of UINT8_MAX implies the field is unused.
  gpu_combined: uint8[10]  % Combined GPU usage as the last 10 slices of 100 MS (a histogram). This allows to identify spikes in load that max out the system, but only for a short amount of time. A value of UINT8_MAX implies the field is unused.
  temperature_board: int8_t  % Temperature of the board. A value of INT8_MAX implies the field is unused.
  temperature_core: int8_t[8]  % Temperature of the CPU core. A value of INT8_MAX implies the field is unused.
  fan_speed: int16[4]  % Fan speeds. A value of INT16_MAX implies the field is unused.
  ram_usage: uint32  % Amount of used RAM on the component system. A value of UINT32_MAX implies the field is unused.
  ram_total: uint32  % Total amount of RAM on the component system. A value of UINT32_MAX implies the field is unused.
  storage_type: uint32[4]  % Storage type: 0: HDD, 1: SSD, 2: EMMC, 3: SD card (non-removable), 4: SD card (removable). A value of UINT32_MAX implies the field is unused.
  storage_usage: uint32[4]  % Amount of used storage space on the component system. A value of UINT32_MAX implies the field is unused.
  storage_total: uint32[4]  % Total amount of storage space on the component system. A value of UINT32_MAX implies the field is unused.
  link_type: uint32[6]  % Link type: 0-9: UART, 10-19: Wired network, 20-29: Wifi, 30-39: Point-to-point proprietary, 40-49: Mesh proprietary
  link_tx_rate: uint32[6]  % Network traffic from the component system. A value of UINT32_MAX implies the field is unused.
  link_rx_rate: uint32[6]  % Network traffic to the component system. A value of UINT32_MAX implies the field is unused.
  link_tx_max: uint32[6]  % Network capacity from the component system. A value of UINT32_MAX implies the field is unused.
  link_rx_max: uint32[6]  % Network capacity to the component system. A value of UINT32_MAX implies the field is unused.

mav_component_information_s = Simulink.Bus()  % Component information message, which may be requested using MAV_CMD_REQUEST_MESSAGE.
  time_boot_ms: uint32  % Timestamp (time since system boot).
  general_metadata_file_crc: uint32  % CRC32 of the general metadata file (general_metadata_uri).
  general_metadata_uri: int8[100]  % MAVLink FTP URI for the general metadata file (COMP_METADATA_TYPE_GENERAL), which may be compressed with xz. The file contains general component metadata, and may contain URI links for additional metadata (see COMP_METADATA_TYPE). The information is static from boot, and may be generated at compile time. The string needs to be zero terminated.
  peripherals_metadata_file_crc: uint32  % CRC32 of peripherals metadata file (peripherals_metadata_uri).
  peripherals_metadata_uri: int8[100]  % (Optional) MAVLink FTP URI for the peripherals metadata file (COMP_METADATA_TYPE_PERIPHERALS), which may be compressed with xz. This contains data about "attached components" such as UAVCAN nodes. The peripherals are in a separate file because the information must be generated dynamically at runtime. The string needs to be zero terminated.

mav_component_metadata_s = Simulink.Bus()  % Component metadata message, which may be requested using MAV_CMD_REQUEST_MESSAGE.
  % This contains the MAVLink FTP URI and CRC for the component's general metadata file.
  % The file must be hosted on the component, and may be xz compressed.
  % The file CRC can be used for file caching.
  % The general metadata file can be read to get the locations of other metadata files (COMP_METADATA_TYPE) and translations, which may be hosted either on the vehicle or the internet.
  % For more information see: https://mavlink.io/en/services/component_information.html.
  % Note: Camera components should use CAMERA_INFORMATION instead, and autopilots may use both this message and AUTOPILOT_VERSION.
  time_boot_ms: uint32  % Timestamp (time since system boot).
  file_crc: uint32  % CRC32 of the general metadata file.
  uri: int8[100]  % MAVLink FTP URI for the general metadata file (COMP_METADATA_TYPE_GENERAL), which may be compressed with xz. The file contains general component metadata, and may contain URI links for additional metadata (see COMP_METADATA_TYPE). The information is static from boot, and may be generated at compile time. The string needs to be zero terminated.

mav_play_tune_v2_s = Simulink.Bus()  % Play vehicle tone/tune (buzzer). Supersedes message PLAY_TUNE.
  target_system: uint8  % System ID
  target_component: uint8  % Component ID
  format: uint32  % Tune format
  tune: int8[248]  % Tune definition as a NULL-terminated string.

mav_supported_tunes_s = Simulink.Bus()  % Tune formats supported by vehicle. This should be emitted as response to MAV_CMD_REQUEST_MESSAGE.
  target_system: uint8  % System ID
  target_component: uint8  % Component ID
  format: uint32  % Bitfield of supported tune formats.

mav_event_s = Simulink.Bus()  % Event message. Each new event from a particular component gets a new sequence number. The same message might be sent multiple times if (re-)requested. Most events are broadcast, some can be specific to a target component (as receivers keep track of the sequence for missed events, all events need to be broadcast. Thus we use destination_component instead of target_component).
  destination_component: uint8  % Component ID
  destination_system: uint8  % System ID
  id: uint32  % Event ID (as defined in the component metadata)
  event_time_boot_ms: uint32  % Timestamp (time since system boot when the event happened).
  sequence: uint16  % Sequence number.
  log_levels: uint8  % Log levels: 4 bits MSB: internal (for logging purposes), 4 bits LSB: external. Levels: Emergency = 0, Alert = 1, Critical = 2, Error = 3, Warning = 4, Notice = 5, Info = 6, Debug = 7, Protocol = 8, Disabled = 9
  arguments: uint8[40]  % Arguments (depend on event ID).

mav_current_event_sequence_s = Simulink.Bus()  % Regular broadcast for the current latest event sequence number for a component. This is used to check for dropped events.
  sequence: uint16  % Sequence number.
  flags: uint8  % Flag bitset.

mav_request_event_s = Simulink.Bus()  % Request one or more events to be (re-)sent. If first_sequence==last_sequence, only a single event is requested. Note that first_sequence can be larger than last_sequence (because the sequence number can wrap). Each sequence will trigger an EVENT or EVENT_ERROR response.
  target_system: uint8  % System ID
  target_component: uint8  % Component ID
  first_sequence: uint16  % First sequence number of the requested event.
  last_sequence: uint16  % Last sequence number of the requested event.

mav_response_event_error_s = Simulink.Bus()  % Response to a REQUEST_EVENT in case of an error (e.g. the event is not available anymore).
  target_system: uint8  % System ID
  target_component: uint8  % Component ID
  sequence: uint16  % Sequence number.
  sequence_oldest_available: uint16  % Oldest Sequence number that is still available after the sequence set in REQUEST_EVENT.
  reason: uint8  % Error reason.

mav_canfd_frame_s = Simulink.Bus()  % A forwarded CANFD frame as requested by MAV_CMD_CAN_FORWARD. These are separated from CAN_FRAME as they need different handling (eg. TAO handling)
  target_system: uint8  % System ID.
  target_component: uint8  % Component ID.
  bus: uint8  % bus number
  len: uint8  % Frame length
  id: uint32  % Frame ID
  data: uint8[64]  % Frame data

mav_can_filter_modify_s = Simulink.Bus()  % Modify the filter of what CAN messages to forward over the mavlink. This can be used to make CAN forwarding work well on low bandwidth links. The filtering is applied on bits 8 to 24 of the CAN id (2nd and 3rd bytes) which corresponds to the DroneCAN message ID for DroneCAN. Filters with more than 16 IDs can be constructed by sending multiple CAN_FILTER_MODIFY messages.
  target_system: uint8  % System ID.
  target_component: uint8  % Component ID.
  bus: uint8  % bus number
  operation: uint8  % what operation to perform on the filter list. See CAN_FILTER_OP enum.
  num_ids: uint8  % number of IDs in filter list
  ids: uint16[16]  % filter IDs, length num_ids

mav_wheel_distance_s = Simulink.Bus()  % Cumulative distance traveled for each reported wheel.
  time_usec: fixdt(0,64,0)  % Timestamp (synced to UNIX time or since system boot).
  count: uint8  % Number of wheels reported.
  distance: double[16]  % Distance reported by individual wheel encoders. Forward rotations increase values, reverse rotations decrease them. Not all wheels will necessarily have wheel encoders; the mapping of encoders to wheel positions must be agreed/understood by the endpoints.

mav_winch_status_s = Simulink.Bus()  % Winch status.
  time_usec: fixdt(0,64,0)  % Timestamp (synced to UNIX time or since system boot).
  line_length: single  % Length of line released. NaN if unknown
  speed: single  % Speed line is being released or retracted. Positive values if being released, negative values if being retracted, NaN if unknown
  tension: single  % Tension on the line. NaN if unknown
  voltage: single  % Voltage of the battery supplying the winch. NaN if unknown
  current: single  % Current draw from the winch. NaN if unknown
  temperature: int16  % Temperature of the motor. INT16_MAX if unknown
  status: uint32  % Status flags

mav_open_drone_id_basic_id_s = Simulink.Bus()  % Data for filling the OpenDroneID Basic ID message. This and the below messages are primarily meant for feeding data to/from an OpenDroneID implementation. E.g. https://github.com/opendroneid/opendroneid-core-c. These messages are compatible with the ASTM F3411 Remote ID standard and the ASD-STAN prEN 4709-002 Direct Remote ID standard. Additional information and usage of these messages is documented at https://mavlink.io/en/services/opendroneid.html.
  target_system: uint8  % System ID (0 for broadcast).
  target_component: uint8  % Component ID (0 for broadcast).
  id_or_mac: uint8[20]  % Only used for drone ID data received from other UAs. See detailed description at https://mavlink.io/en/services/opendroneid.html.
  id_type: uint8  % Indicates the format for the uas_id field of this message.
  ua_type: uint8  % Indicates the type of UA (Unmanned Aircraft).
  uas_id: uint8[20]  % UAS (Unmanned Aircraft System) ID following the format specified by id_type. Shall be filled with nulls in the unused portion of the field.

mav_open_drone_id_location_s = Simulink.Bus()  % Data for filling the OpenDroneID Location message. The float data types are 32-bit IEEE 754. The Location message provides the location, altitude, direction and speed of the aircraft.
  target_system: uint8  % System ID (0 for broadcast).
  target_component: uint8  % Component ID (0 for broadcast).
  id_or_mac: uint8[20]  % Only used for drone ID data received from other UAs. See detailed description at https://mavlink.io/en/services/opendroneid.html.
  status: uint8  % Indicates whether the unmanned aircraft is on the ground or in the air.
  direction: uint16  % Direction over ground (not heading, but direction of movement) measured clockwise from true North: 0 - 35999 centi-degrees. If unknown: 36100 centi-degrees.
  speed_horizontal: uint16  % Ground speed. Positive only. If unknown: 25500 cm/s. If speed is larger than 25425 cm/s, use 25425 cm/s.
  speed_vertical: int16  % The vertical speed. Up is positive. If unknown: 6300 cm/s. If speed is larger than 6200 cm/s, use 6200 cm/s. If lower than -6200 cm/s, use -6200 cm/s.
  latitude: int32  % Current latitude of the unmanned aircraft. If unknown: 0 (both Lat/Lon).
  longitude: int32  % Current longitude of the unmanned aircraft. If unknown: 0 (both Lat/Lon).
  altitude_barometric: single  % The altitude calculated from the barometric pressue. Reference is against 29.92inHg or 1013.2mb. If unknown: -1000 m.
  altitude_geodetic: single  % The geodetic altitude as defined by WGS84. If unknown: -1000 m.
  height_reference: uint8  % Indicates the reference point for the height field.
  height: single  % The current height of the unmanned aircraft above the take-off location or the ground as indicated by height_reference. If unknown: -1000 m.
  horizontal_accuracy: uint8  % The accuracy of the horizontal position.
  vertical_accuracy: uint8  % The accuracy of the vertical position.
  barometer_accuracy: uint8  % The accuracy of the barometric altitude.
  speed_accuracy: uint8  % The accuracy of the horizontal and vertical speed.
  timestamp: single  % Seconds after the full hour with reference to UTC time. Typically the GPS outputs a time-of-week value in milliseconds. First convert that to UTC and then convert for this field using ((float) (time_week_ms % (60*60*1000))) / 1000. If unknown: 0xFFFF.
  timestamp_accuracy: uint8  % The accuracy of the timestamps.

mav_open_drone_id_authentication_s = Simulink.Bus()  % Data for filling the OpenDroneID Authentication message. The Authentication Message defines a field that can provide a means of authenticity for the identity of the UAS (Unmanned Aircraft System). The Authentication message can have two different formats. For data page 0, the fields PageCount, Length and TimeStamp are present and AuthData is only 17 bytes. For data page 1 through 15, PageCount, Length and TimeStamp are not present and the size of AuthData is 23 bytes.
  target_system: uint8  % System ID (0 for broadcast).
  target_component: uint8  % Component ID (0 for broadcast).
  id_or_mac: uint8[20]  % Only used for drone ID data received from other UAs. See detailed description at https://mavlink.io/en/services/opendroneid.html.
  authentication_type: uint8  % Indicates the type of authentication.
  data_page: uint8  % Allowed range is 0 - 15.
  last_page_index: uint8  % This field is only present for page 0. Allowed range is 0 - 15. See the description of struct ODID_Auth_data at https://github.com/opendroneid/opendroneid-core-c/blob/master/libopendroneid/opendroneid.h.
  length: uint8  % This field is only present for page 0. Total bytes of authentication_data from all data pages. See the description of struct ODID_Auth_data at https://github.com/opendroneid/opendroneid-core-c/blob/master/libopendroneid/opendroneid.h.
  timestamp: uint32  % This field is only present for page 0. 32 bit Unix Timestamp in seconds since 00:00:00 01/01/2019.
  authentication_data: uint8[23]  % Opaque authentication data. For page 0, the size is only 17 bytes. For other pages, the size is 23 bytes. Shall be filled with nulls in the unused portion of the field.

mav_open_drone_id_self_id_s = Simulink.Bus()  % Data for filling the OpenDroneID Self ID message. The Self ID Message is an opportunity for the operator to (optionally) declare their identity and purpose of the flight. This message can provide additional information that could reduce the threat profile of a UA (Unmanned Aircraft) flying in a particular area or manner. This message can also be used to provide optional additional clarification in an emergency/remote ID system failure situation.
  target_system: uint8  % System ID (0 for broadcast).
  target_component: uint8  % Component ID (0 for broadcast).
  id_or_mac: uint8[20]  % Only used for drone ID data received from other UAs. See detailed description at https://mavlink.io/en/services/opendroneid.html.
  description_type: uint8  % Indicates the type of the description field.
  description: int8[23]  % Text description or numeric value expressed as ASCII characters. Shall be filled with nulls in the unused portion of the field.

mav_open_drone_id_system_s = Simulink.Bus()  % Data for filling the OpenDroneID System message. The System Message contains general system information including the operator location/altitude and possible aircraft group and/or category/class information.
  target_system: uint8  % System ID (0 for broadcast).
  target_component: uint8  % Component ID (0 for broadcast).
  id_or_mac: uint8[20]  % Only used for drone ID data received from other UAs. See detailed description at https://mavlink.io/en/services/opendroneid.html.
  operator_location_type: uint8  % Specifies the operator location type.
  classification_type: uint8  % Specifies the classification type of the UA.
  operator_latitude: int32  % Latitude of the operator. If unknown: 0 (both Lat/Lon).
  operator_longitude: int32  % Longitude of the operator. If unknown: 0 (both Lat/Lon).
  area_count: uint16  % Number of aircraft in the area, group or formation (default 1). Used only for swarms/multiple UA.
  area_radius: uint16  % Radius of the cylindrical area of the group or formation (default 0). Used only for swarms/multiple UA.
  area_ceiling: single  % Area Operations Ceiling relative to WGS84. If unknown: -1000 m. Used only for swarms/multiple UA.
  area_floor: single  % Area Operations Floor relative to WGS84. If unknown: -1000 m. Used only for swarms/multiple UA.
  category_eu: uint8  % When classification_type is MAV_ODID_CLASSIFICATION_TYPE_EU, specifies the category of the UA.
  class_eu: uint8  % When classification_type is MAV_ODID_CLASSIFICATION_TYPE_EU, specifies the class of the UA.
  operator_altitude_geo: single  % Geodetic altitude of the operator relative to WGS84. If unknown: -1000 m.
  timestamp: uint32  % 32 bit Unix Timestamp in seconds since 00:00:00 01/01/2019.

mav_open_drone_id_operator_id_s = Simulink.Bus()  % Data for filling the OpenDroneID Operator ID message, which contains the CAA (Civil Aviation Authority) issued operator ID.
  target_system: uint8  % System ID (0 for broadcast).
  target_component: uint8  % Component ID (0 for broadcast).
  id_or_mac: uint8[20]  % Only used for drone ID data received from other UAs. See detailed description at https://mavlink.io/en/services/opendroneid.html.
  operator_id_type: uint8  % Indicates the type of the operator_id field.
  operator_id: int8[20]  % Text description or numeric value expressed as ASCII characters. Shall be filled with nulls in the unused portion of the field.

mav_open_drone_id_message_pack_s = Simulink.Bus()  % An OpenDroneID message pack is a container for multiple encoded OpenDroneID messages (i.e. not in the format given for the above message descriptions but after encoding into the compressed OpenDroneID byte format). Used e.g. when transmitting on Bluetooth 5.0 Long Range/Extended Advertising or on WiFi Neighbor Aware Networking or on WiFi Beacon.
  target_system: uint8  % System ID (0 for broadcast).
  target_component: uint8  % Component ID (0 for broadcast).
  id_or_mac: uint8[20]  % Only used for drone ID data received from other UAs. See detailed description at https://mavlink.io/en/services/opendroneid.html.
  single_message_size: uint8  % This field must currently always be equal to 25 (bytes), since all encoded OpenDroneID messages are specified to have this length.
  msg_pack_size: uint8  % Number of encoded messages in the pack (not the number of bytes). Allowed range is 1 - 9.
  messages: uint8[225]  % Concatenation of encoded OpenDroneID messages. Shall be filled with nulls in the unused portion of the field.

mav_open_drone_id_arm_status_s = Simulink.Bus()  % Transmitter (remote ID system) is enabled and ready to start sending location and other required information. This is streamed by transmitter. A flight controller uses it as a condition to arm.
  status: uint8  % Status level indicating if arming is allowed.
  error: int8[50]  % Text error message, should be empty if status is good to arm. Fill with nulls in unused portion.

mav_open_drone_id_system_update_s = Simulink.Bus()  % Update the data in the OPEN_DRONE_ID_SYSTEM message with new location information. This can be sent to update the location information for the operator when no other information in the SYSTEM message has changed. This message allows for efficient operation on radio links which have limited uplink bandwidth while meeting requirements for update frequency of the operator location.
  target_system: uint8  % System ID (0 for broadcast).
  target_component: uint8  % Component ID (0 for broadcast).
  operator_latitude: int32  % Latitude of the operator. If unknown: 0 (both Lat/Lon).
  operator_longitude: int32  % Longitude of the operator. If unknown: 0 (both Lat/Lon).
  operator_altitude_geo: single  % Geodetic altitude of the operator relative to WGS84. If unknown: -1000 m.
  timestamp: uint32  % 32 bit Unix Timestamp in seconds since 00:00:00 01/01/2019.

mav_hygrometer_sensor_s = Simulink.Bus()  % Temperature and humidity from hygrometer.
  id: uint8  % Hygrometer ID
  temperature: int16  % Temperature
  humidity: uint16  % Humidity