% Simulink data dictionary px4_dict.sldd
% references px4_msgs.sldd
% references px4_param.sldd

FW_FLAPS_TO_SCL = single(0)
ALTHOLD_EPV_RESET_THRESH = Simulink.Parameter(5)
MIN_TAKEOFF_THRUST = 0.2
dt = single(0.001)

px4_pwm_output_values = Simulink.Bus()
  channel_count: uint32
  values: uint16[1 16]

CONSTANTS_ONE_G = Simulink.Parameter(single(9.80665))
MPC_JERK_AUTO = Simulink.Parameter(single(4), Min=1, Max=80)
MPC_LAND_RC_HELP = Simulink.Parameter(single(0), Min=0, Max=1)
MPC_MAN_Y_TAU = Simulink.Parameter(single(0.08), Min=0, Max=5)
MPC_POS_MODE = Simulink.Parameter(int32(4))
MPC_XY_VEL_D_ACC = Simulink.Parameter(single(0.2), Min=0.1, Max=2)
MPC_XY_ERR_MAX = Simulink.Parameter(single(2), Min=0.1, Max=10)
MPC_XY_TRAJ_P = Simulink.Parameter(single(0.5), Min=0.1, Max=1)
CBRK_VTOLARMING = Simulink.Parameter(int32(0))