% Simulink data dictionary px4_msgs.sldd

px4_time_offset = Simulink.Bus()
  timestamp: fixdt(0,64,0)
  offset_ns: fixdt(0,64,0)

PX4_ACTUATOR_DIRECT = enum(AddClassNameToEnumNames=true)
  NUM_ACTUATORS_DIRECT = 16

PX4_QSHELL_REQ = enum(AddClassNameToEnumNames=true)
  MAX_STRLEN = 100

px4_sensor_bias = Simulink.Bus()
  timestamp: fixdt(0,64,0)
  accel_x: single  % # Bias corrected acceleration in body X axis (in m/s^2)
  accel_y: single  % # Bias corrected acceleration in body Y axis (in m/s^2)
  accel_z: single  % # Bias corrected acceleration in body Z axis (in m/s^2)
  gyro_x_bias: single  % # X gyroscope in-run bias in body frame (rad/s, x forward)
  gyro_y_bias: single  % # Y gyroscope in-run bias in body frame (rad/s, y right)
  gyro_z_bias: single  % # Z gyroscope in-run bias in body frame (rad/s, z down)
  accel_x_bias: single  % # X accelerometer in-run bias in body frame (m/s^2, x forward)
  accel_y_bias: single  % # Y accelerometer in-run bias in body frame (m/s^2, y right)
  accel_z_bias: single  % # Z accelerometer in-run bias in body frame (m/s^2, z down)
  mag_x_bias: single  % # X magnetometer in-run bias in body frame (Gauss, x forward)
  mag_y_bias: single  % # Y magnetometer in-run bias in body frame (Gauss, y right)
  mag_z_bias: single  % # Z magnetometer in-run bias in body frame (Gauss, z down)

px4_sensor_preflight = Simulink.Bus()
  timestamp: fixdt(0,64,0)
  accel_inconsistency_m_s_s: single  % # magnitude of maximum acceleration difference between IMU instances in (m/s/s).
  gyro_inconsistency_rad_s: single  % # magnitude of maximum angular rate difference between IMU instances in (rad/s).
  mag_inconsistency_ga: single  % # magnitude of maximum difference between Mag instances in (Gauss).

px4_servorail_status = Simulink.Bus()
  timestamp: fixdt(0,64,0)
  voltage_v: single  % # Servo rail voltage in volts
  rssi_v: single  % # RSSI pin voltage in volts

px4_subsystem_info = Simulink.Bus()
  timestamp: fixdt(0,64,0)
  present: boolean
  enabled: boolean
  ok: boolean
  subsystem_type: fixdt(0,64,0)

PX4_SUBSYSTEM_INFO = enum(AddClassNameToEnumNames=true)
  SUBSYSTEM_TYPE_GYRO = 1
  SUBSYSTEM_TYPE_ACC = 2
  SUBSYSTEM_TYPE_MAG = 4
  SUBSYSTEM_TYPE_ABSPRESSURE = 8
  SUBSYSTEM_TYPE_DIFFPRESSURE = 16
  SUBSYSTEM_TYPE_GPS = 32
  SUBSYSTEM_TYPE_OPTICALFLOW = 64
  SUBSYSTEM_TYPE_CVPOSITION = 128
  SUBSYSTEM_TYPE_LASERPOSITION = 256
  SUBSYSTEM_TYPE_EXTERNALGROUNDTRUTH = 512
  SUBSYSTEM_TYPE_ANGULARRATECONTROL = 1024
  SUBSYSTEM_TYPE_ATTITUDESTABILIZATION = 2048
  SUBSYSTEM_TYPE_YAWPOSITION = 4096
  SUBSYSTEM_TYPE_ALTITUDECONTROL = 8192
  SUBSYSTEM_TYPE_POSITIONCONTROL = 16384
  SUBSYSTEM_TYPE_MOTORCONTROL = 32768
  SUBSYSTEM_TYPE_RCRECEIVER = 65536
  SUBSYSTEM_TYPE_GYRO2 = 131072
  SUBSYSTEM_TYPE_ACC2 = 262144
  SUBSYSTEM_TYPE_MAG2 = 524288
  SUBSYSTEM_TYPE_GEOFENCE = 1048576
  SUBSYSTEM_TYPE_AHRS = 2097152
  SUBSYSTEM_TYPE_TERRAIN = 4194304
  SUBSYSTEM_TYPE_REVERSEMOTOR = 8388608
  SUBSYSTEM_TYPE_LOGGING = 16777216
  SUBSYSTEM_TYPE_SENSORBATTERY = 33554432
  SUBSYSTEM_TYPE_SENSORPROXIMITY = 67108864
  SUBSYSTEM_TYPE_MISSION = 134217728
  ORB_QUEUE_LENGTH = 5

px4_wind_estimate = Simulink.Bus()
  timestamp: fixdt(0,64,0)
  windspeed_north: single  % # Wind component in north / X direction (m/sec)
  windspeed_east: single  % # Wind component in east / Y direction (m/sec)
  variance_north: single  % # Wind estimate error variance in north / X direction (m/sec)**2 - set to zero (no uncertainty) if not estimated
  variance_east: single  % # Wind estimate error variance in east / Y direction (m/sec)**2 - set to zero (no uncertainty) if not estimated
  tas_innov: single  % # True airspeed innovation
  tas_innov_var: single  % # True airspeed innovation variance
  tas_scale: single  % # Estimated true airspeed scale factor
  beta_innov: single  % # Sideslip measurement innovation
  beta_innov_var: single  % # Sideslip measurement innovation variance

px4_actuator_armed = Simulink.Bus()
  timestamp: fixdt(0,64,0)  % # time since system start (microseconds)
  armed: boolean  % # Set to true if system is armed
  prearmed: boolean  % # Set to true if the actuator safety is disabled but motors are not armed
  ready_to_arm: boolean  % # Set to true if system is ready to be armed
  lockdown: boolean  % # Set to true if actuators are forced to being disabled (due to emergency or HIL)
  manual_lockdown: boolean  % # Set to true if manual throttle kill switch is engaged
  force_failsafe: boolean  % # Set to true if the actuators are forced to the failsafe position
  in_esc_calibration_mode: boolean  % # IO/FMU should ignore messages from the actuator controls topics
  soft_stop: boolean  % # Set to true if we need to ESCs to remove the idle constraint

px4_actuator_controls = Simulink.Bus()
  timestamp: fixdt(0,64,0)  % # time since system start (microseconds)
  timestamp_sample: fixdt(0,64,0)  % # the timestamp the data this control response is based on was sampled
  control: single[8]

px4_actuator_outputs = Simulink.Bus()
  timestamp: fixdt(0,64,0)  % # time since system start (microseconds)
  noutputs: uint32  % # valid outputs
  output: single[16]  % # output data, in natural output units

PX4_ACTUATOR_OUTPUTS = enum(AddClassNameToEnumNames=true)
  NUM_ACTUATOR_OUTPUTS = 16
  NUM_ACTUATOR_OUTPUT_GROUPS = 4  % # for sanity checking

px4_adc_report = Simulink.Bus()
  timestamp: fixdt(0,64,0)  % # time since system start (microseconds)
  device_id: uint32  % # unique device ID for the sensor that does not change between power cycles
  channel_id: int16[12]  % # ADC channel IDs, negative for non-existent, TODO: should be kept same as array index
  raw_data: int32[12]  % # ADC channel raw value, accept negative value, valid if channel ID is positive
  resolution: uint32  % # ADC channel resolution
  v_ref: single  % # ADC channel voltage reference, use to calculate LSB voltage(lsb=scale/resolution)

px4_airspeed = Simulink.Bus()
  timestamp: fixdt(0,64,0)  % # time since system start (microseconds)
  indicated_airspeed_m_s: single  % # indicated airspeed in m/s
  true_airspeed_m_s: single  % # true filtered airspeed in m/s
  air_temperature_celsius: single  % # air temperature in degrees celsius, -1000 if unknown
  confidence: single  % # confidence value from 0 to 1 for this sensor

px4_airspeed_validated = Simulink.Bus()
  timestamp: fixdt(0,64,0)  % # time since system start (microseconds)
  indicated_airspeed_m_s: single  % # indicated airspeed in m/s (IAS), set to NAN if invalid
  calibrated_airspeed_m_s: single  % # calibrated airspeed in m/s (CAS, accounts for instrumentation errors), set to NAN if invalid
  true_airspeed_m_s: single  % # true filtered airspeed in m/s (TAS), set to NAN if invalid
  calibrated_ground_minus_wind_m_s: single  % # CAS calculated from groundspeed - windspeed, where windspeed is estimated based on a zero-sideslip assumption, set to NAN if invalid
  true_ground_minus_wind_m_s: single  % # TAS calculated from groundspeed - windspeed, where windspeed is estimated based on a zero-sideslip assumption, set to NAN if invalid
  airspeed_sensor_measurement_valid: boolean  % # True if data from at least one airspeed sensor is declared valid.
  selected_airspeed_index: int8  % # 1-3: airspeed sensor index, 0: groundspeed-windspeed, -1: airspeed invalid

px4_airspeed_wind = Simulink.Bus()
  timestamp: fixdt(0,64,0)  % # time since system start (microseconds)
  timestamp_sample: fixdt(0,64,0)  % # the timestamp of the raw data (microseconds)
  windspeed_north: single  % # Wind component in north / X direction (m/sec)
  windspeed_east: single  % # Wind component in east / Y direction (m/sec)
  variance_north: single  % # Wind estimate error variance in north / X direction (m/sec)**2 - set to zero (no uncertainty) if not estimated
  variance_east: single  % # Wind estimate error variance in east / Y direction (m/sec)**2 - set to zero (no uncertainty) if not estimated
  tas_innov: single  % # True airspeed innovation
  tas_innov_var: single  % # True airspeed innovation variance
  tas_scale: single  % # Estimated true airspeed scale factor
  beta_innov: single  % # Sideslip measurement innovation
  beta_innov_var: single  % # Sideslip measurement innovation variance
  source: uint8  % # source of wind estimate

PX4_AIRSPEED_WIND = enum(AddClassNameToEnumNames=true)
  SOURCE_AS_BETA_ONLY = 0  % # wind estimate only based on synthetic sideslip fusion
  SOURCE_AS_SENSOR_1 = 1  % # combined synthetic sideslip and airspeed fusion (data from first airspeed sensor)
  SOURCE_AS_SENSOR_2 = 2  % # combined synthetic sideslip and airspeed fusion (data from second airspeed sensor)
  SOURCE_AS_SENSOR_3 = 3  % # combined synthetic sideslip and airspeed fusion (data from third airspeed sensor)

px4_battery_status = Simulink.Bus()
  timestamp: fixdt(0,64,0)  % # time since system start (microseconds)
  connected: boolean  % # Whether or not a battery is connected, based on a voltage threshold
  voltage_v: single  % # Battery voltage in volts, 0 if unknown
  voltage_filtered_v: single  % # Battery voltage in volts, filtered, 0 if unknown
  current_a: single  % # Battery current in amperes, -1 if unknown
  current_filtered_a: single  % # Battery current in amperes, filtered, 0 if unknown
  current_average_a: single  % # Battery current average in amperes, -1 if unknown
  discharged_mah: single  % # Discharged amount in mAh, -1 if unknown
  remaining: single  % # From 1 to 0, -1 if unknown
  scale: single  % # Power scaling factor, >= 1, or -1 if unknown
  temperature: single  % # temperature of the battery. NaN if unknown
  cell_count: int32  % # Number of cells
  source: uint8  % # Battery source
  priority: uint8  % # Zero based priority is the connection on the Power Controller V1..Vn AKA BrickN-1
  capacity: uint16  % # actual capacity of the battery
  cycle_count: uint16  % # number of discharge cycles the battery has experienced
  run_time_to_empty: uint16  % # predicted remaining battery capacity based on the present rate of discharge in min
  average_time_to_empty: uint16  % # predicted remaining battery capacity based on the average rate of discharge in min
  serial_number: uint16  % # serial number of the battery pack
  manufacture_date: uint16  % # manufacture date, part of serial number of the battery pack. formated as: Day + Month×32 + (Year–1980)×512
  state_of_health: uint16  % # state of health. FullChargeCapacity/DesignCapacity.
  max_error: uint16  % # max error, expected margin of error in % in the state-of-charge calculation with a range of 1 to 100%
  id: uint8  % # ID number of a battery. Should be unique and consistent for the lifetime of a vehicle. 1-indexed.
  interface_error: uint16  % # interface error counter
  voltage_cell_v: single[14]  % # Battery individual cell voltages
  max_cell_voltage_delta: single  % # Max difference between individual cell voltages
  is_powering_off: boolean  % # Power off event imminent indication, false if unknown
  warning: uint8  % # current battery warning
  average_power: single  % # The average power of the current discharge
  available_energy: single  % # The predicted charge or energy remaining in the battery
  remaining_capacity: single  % # The compensated battery capacity remaining
  design_capacity: single  % # The design capacity of the battery
  average_time_to_full: uint16  % # The predicted remaining time until the battery reaches full charge, in minutes
  over_discharge_count: uint16  % # Number of battery overdischarge
  nominal_voltage: single  % # Nominal voltage of the battery pack

PX4_BATTERY_STATUS = enum(AddClassNameToEnumNames=true)
  BATTERY_SOURCE_POWER_MODULE = 0
  BATTERY_SOURCE_EXTERNAL = 1
  BATTERY_SOURCE_ESCS = 2
  BATTERY_WARNING_NONE = 0  % # no battery low voltage warning active
  BATTERY_WARNING_LOW = 1  % # warning of low voltage
  BATTERY_WARNING_CRITICAL = 2  % # critical voltage, return / abort immediately
  BATTERY_WARNING_EMERGENCY = 3  % # immediate landing required
  BATTERY_WARNING_FAILED = 4  % # the battery has failed completely
  MAX_INSTANCES = 4

px4_camera_capture = Simulink.Bus()
  timestamp: fixdt(0,64,0)  % # time since system start (microseconds)
  timestamp_utc: fixdt(0,64,0)  % # Capture time in UTC / GPS time
  seq: uint32  % # Image sequence number
  lat: double  % # Latitude in degrees (WGS84)
  lon: double  % # Longitude in degrees (WGS84)
  alt: single  % # Altitude (AMSL)
  ground_distance: single  % # Altitude above ground (meters)
  q: single[4]  % # Attitude of the camera, zero rotation is facing towards front of vehicle
  result: int8  % # 1 for success, 0 for failure, -1 if camera does not provide feedback

px4_camera_status = Simulink.Bus()
  timestamp: fixdt(0,64,0)  % # time since system start (microseconds)
  active_sys_id: uint8  % # mavlink system id of the currently active camera
  active_comp_id: uint8  % # mavlink component id of currently active camera

px4_camera_trigger = Simulink.Bus()
  timestamp: fixdt(0,64,0)  % # time since system start (microseconds)
  timestamp_utc: fixdt(0,64,0)  % # UTC timestamp
  seq: uint32  % # Image sequence number
  feedback: boolean  % # Trigger feedback from camera

px4_cellular_status = Simulink.Bus()
  timestamp: fixdt(0,64,0)  % # time since system start (microseconds)
  status: uint16  % # Status bitmap 1: Roaming is active
  failure_reason: uint8  % #Failure reason when status in in CELLUAR_STATUS_FAILED
  type: uint8  % # Cellular network radio type 0: none 1: gsm 2: cdma 3: wcdma 4: lte
  quality: uint8  % # Cellular network RSSI/RSRP in dBm, absolute value
  mcc: uint16  % # Mobile country code. If unknown, set to: UINT16_MAX
  mnc: uint16  % # Mobile network code. If unknown, set to: UINT16_MAX
  lac: uint16  % # Location area code. If unknown, set to: 0

PX4_CELLULAR_STATUS = enum(AddClassNameToEnumNames=true)
  FLAG_UNKNOWN = 0  % # State unknown or not reportable
  FLAG_FAILED = 1  % # velocity setpoint
  FLAG_INITIALIZING = 2  % # Modem is being initialized
  FLAG_LOCKED = 3  % # Modem is locked
  FLAG_DISABLED = 4  % # Modem is not enabled and is powered down
  FLAG_DISABLING = 5  % # Modem is currently transitioning to the CELLULAR_STATUS_FLAG_DISABLED state
  FLAG_ENABLING = 6  % # Modem is currently transitioning to the CELLULAR_STATUS_FLAG_ENABLED state
  FLAG_ENABLED = 7  % # Modem is enabled and powered on but not registered with a network provider and not available for data connections
  FLAG_SEARCHING = 8  % # Modem is searching for a network provider to register
  FLAG_REGISTERED = 9  % # Modem is registered with a network provider, and data connections and messaging may be available for use
  FLAG_DISCONNECTING = 10  % # Modem is disconnecting and deactivating the last active packet data bearer. This state will not be entered if more than one packet data bearer is active and one of the active bearers is deactivated
  FLAG_CONNECTING = 11  % # Modem is activating and connecting the first packet data bearer. Subsequent bearer activations when another bearer is already active do not cause this state to be entered
  FLAG_CONNECTED = 12  % # One or more packet data bearers is active and connected
  CELLULAR_NETWORK_FAILED_REASON_NONE = 0  % # No error
  CELLULAR_NETWORK_FAILED_REASON_UNKNOWN = 1  % # Error state is unknown
  CELLULAR_NETWORK_FAILED_REASON_SIM_MISSING = 2  % # SIM is required for the modem but missing
  CELLULAR_NETWORK_FAILED_REASON_SIM_ERROR = 3  % # SIM is available, but not usuable for connection

px4_collision_constraints = Simulink.Bus()
  timestamp: fixdt(0,64,0)  % # time since system start (microseconds)
  original_setpoint: single[2]  % # velocities demanded
  adapted_setpoint: single[2]  % # velocities allowed

px4_collision_report = Simulink.Bus()
  timestamp: fixdt(0,64,0)  % # time since system start (microseconds)
  src: uint8
  id: uint32
  action: uint8
  threat_level: uint8
  time_to_minimum_delta: single
  altitude_minimum_delta: single
  horizontal_minimum_delta: single

px4_commander_state = Simulink.Bus()
  timestamp: fixdt(0,64,0)  % # time since system start (microseconds)
  main_state: uint8  % # main state machine
  main_state_changes: uint16

PX4_COMMANDER_STATE = enum(AddClassNameToEnumNames=true)
  MAIN_STATE_MANUAL = 0
  MAIN_STATE_ALTCTL = 1
  MAIN_STATE_POSCTL = 2
  MAIN_STATE_AUTO_MISSION = 3
  MAIN_STATE_AUTO_LOITER = 4
  MAIN_STATE_AUTO_RTL = 5
  MAIN_STATE_ACRO = 6
  MAIN_STATE_OFFBOARD = 7
  MAIN_STATE_STAB = 8
  MAIN_STATE_AUTO_TAKEOFF = 10
  MAIN_STATE_AUTO_LAND = 11
  MAIN_STATE_AUTO_FOLLOW_TARGET = 12
  MAIN_STATE_AUTO_PRECLAND = 13
  MAIN_STATE_ORBIT = 14
  MAIN_STATE_MAX = 15

px4_control_allocator_status = Simulink.Bus()
  timestamp: fixdt(0,64,0)  % # time since system start (microseconds)
  torque_setpoint_achieved: boolean  % # Boolean indicating whether the 3D torque setpoint was correctly allocated to actuators. 0 if not achieved, 1 if achieved.
  allocated_torque: single[3]  % # Torque allocated to actuators. Equal to `vehicle_torque_setpoint_s::xyz` if the setpoint was achieved.
  unallocated_torque: single[3]  % # Unallocated torque. Equal to 0 if the setpoint was achieved.
  thrust_setpoint_achieved: boolean  % # Boolean indicating whether the 3D thrust setpoint was correctly allocated to actuators. 0 if not achieved, 1 if achieved.
  allocated_thrust: single[3]  % # Thrust allocated to actuators. Equal to `vehicle_thrust_setpoint_s::xyz` if the setpoint was achieved.
  unallocated_thrust: single[3]  % # Unallocated thrust. Equal to 0 if the setpoint was achieved.
  actuator_saturation: int8[16]  % # Indicates actuator saturation status.

PX4_CONTROL_ALLOCATOR_STATUS = enum(AddClassNameToEnumNames=true)
  ACTUATOR_SATURATION_OK = 0  % # The actuator is not saturated
  ACTUATOR_SATURATION_UPPER_DYN = 1  % # The actuator is saturated (with a value <= the desired value) because it cannot increase its value faster
  ACTUATOR_SATURATION_UPPER = 2  % # The actuator is saturated (with a value <= the desired value) because it has reached its maximum value
  ACTUATOR_SATURATION_LOWER_DYN = -1  % # The actuator is saturated (with a value >= the desired value) because it cannot decrease its value faster
  ACTUATOR_SATURATION_LOWER = -2  % # The actuator is saturated (with a value >= the desired value) because it has reached its minimum value

px4_cpuload = Simulink.Bus()
  timestamp: fixdt(0,64,0)  % # time since system start (microseconds)
  load: single  % # processor load from 0 to 1
  ram_usage: single  % # RAM usage from 0 to 1

px4_debug_array = Simulink.Bus()
  timestamp: fixdt(0,64,0)  % # time since system start (microseconds)
  id: uint16  % # unique ID of debug array, used to discriminate between arrays
  name: int8[10]  % # name of the debug array (max. 10 characters)
  data: single[58]  % # data

PX4_DEBUG_ARRAY = enum(AddClassNameToEnumNames=true)
  ARRAY_SIZE = 58

px4_debug_key_value = Simulink.Bus()
  timestamp: fixdt(0,64,0)  % # time since system start (microseconds)
  key: int8[10]  % # max. 10 characters as key / name
  value: single  % # the value to send as debug output

px4_debug_value = Simulink.Bus()
  timestamp: fixdt(0,64,0)  % # time since system start (microseconds)
  ind: int8  % # index of debug variable
  value: single  % # the value to send as debug output

px4_debug_vect = Simulink.Bus()
  timestamp: fixdt(0,64,0)  % # time since system start (microseconds)
  name: int8[10]  % # max. 10 characters as key / name
  x: single  % # x value
  y: single  % # y value
  z: single  % # z value

px4_differential_pressure = Simulink.Bus()
  timestamp: fixdt(0,64,0)  % # time since system start (microseconds)
  error_count: fixdt(0,64,0)  % # Number of errors detected by driver
  differential_pressure_raw_pa: single  % # Raw differential pressure reading (may be negative)
  differential_pressure_filtered_pa: single  % # Low pass filtered differential pressure reading
  temperature: single  % # Temperature provided by sensor, -1000.0f if unknown
  device_id: uint32  % # unique device ID for the sensor that does not change between power cycles

px4_distance_sensor = Simulink.Bus()
  timestamp: fixdt(0,64,0)  % # time since system start (microseconds)
  device_id: uint32  % # unique device ID for the sensor that does not change between power cycles
  min_distance: single  % # Minimum distance the sensor can measure (in m)
  max_distance: single  % # Maximum distance the sensor can measure (in m)
  current_distance: single  % # Current distance reading (in m)
  variance: single  % # Measurement variance (in m^2), 0 for unknown / invalid readings
  signal_quality: int8  % # Signal quality in percent (0...100%), where 0 = invalid signal, 100 = perfect signal, and -1 = unknown signal quality.
  type: uint8  % # Type from MAV_DISTANCE_SENSOR enum
  h_fov: single  % # Sensor horizontal field of view (rad)
  v_fov: single  % # Sensor vertical field of view (rad)
  q: single[4]  % # Quaterion sensor orientation with respect to the vehicle body frame to specify the orientation ROTATION_CUSTOM
  orientation: uint8  % # Direction the sensor faces from MAV_SENSOR_ORIENTATION enum

PX4_DISTANCE_SENSOR = enum(AddClassNameToEnumNames=true)
  MAV_LASER = 0
  MAV_ULTRASOUND = 1
  MAV_INFRARED = 2
  MAV_RADAR = 3
  ROTATION_YAW_0 = 0  % # MAV_SENSOR_ROTATION_NONE
  ROTATION_YAW_45 = 1  % # MAV_SENSOR_ROTATION_YAW_45
  ROTATION_YAW_90 = 2  % # MAV_SENSOR_ROTATION_YAW_90
  ROTATION_YAW_135 = 3  % # MAV_SENSOR_ROTATION_YAW_135
  ROTATION_YAW_180 = 4  % # MAV_SENSOR_ROTATION_YAW_180
  ROTATION_YAW_225 = 5  % # MAV_SENSOR_ROTATION_YAW_225
  ROTATION_YAW_270 = 6  % # MAV_SENSOR_ROTATION_YAW_270
  ROTATION_YAW_315 = 7  % # MAV_SENSOR_ROTATION_YAW_315
  ROTATION_FORWARD_FACING = 0  % # MAV_SENSOR_ROTATION_NONE
  ROTATION_RIGHT_FACING = 2  % # MAV_SENSOR_ROTATION_YAW_90
  ROTATION_BACKWARD_FACING = 4  % # MAV_SENSOR_ROTATION_YAW_180
  ROTATION_LEFT_FACING = 6  % # MAV_SENSOR_ROTATION_YAW_270
  ROTATION_UPWARD_FACING = 24  % # MAV_SENSOR_ROTATION_PITCH_90
  ROTATION_DOWNWARD_FACING = 25  % # MAV_SENSOR_ROTATION_PITCH_270
  ROTATION_CUSTOM = 100  % # MAV_SENSOR_ROTATION_CUSTOM

px4_ekf2_timestamps = Simulink.Bus()
  timestamp: fixdt(0,64,0)  % # time since system start (microseconds)
  airspeed_timestamp_rel: int16
  distance_sensor_timestamp_rel: int16
  optical_flow_timestamp_rel: int16
  vehicle_air_data_timestamp_rel: int16
  vehicle_magnetometer_timestamp_rel: int16
  visual_odometry_timestamp_rel: int16

PX4_EKF2_TIMESTAMPS = enum(AddClassNameToEnumNames=true)
  RELATIVE_TIMESTAMP_INVALID = 32767  % # (0x7fff) If one of the relative timestamps

px4_ekf_gps_drift = Simulink.Bus()
  timestamp: fixdt(0,64,0)  % # time since system start (microseconds)
  hpos_drift_rate: single  % # Horizontal position rate magnitude checked using EKF2_REQ_HDRIFT (m/s)
  vpos_drift_rate: single  % # Vertical position rate magnitude checked using EKF2_REQ_VDRIFT (m/s)
  hspd: single  % # Filtered horizontal velocity magnitude checked using EKF2_REQ_HDRIFT (m/s)
  blocked: boolean  % # true when drift calculation is blocked due to IMU movement check controlled by EKF2_MOVE_TEST

px4_esc_report = Simulink.Bus()
  timestamp: fixdt(0,64,0)  % # time since system start (microseconds)
  esc_errorcount: uint32  % # Number of reported errors by ESC - if supported
  esc_rpm: int32  % # Motor RPM, negative for reverse rotation [RPM] - if supported
  esc_voltage: single  % # Voltage measured from current ESC [V] - if supported
  esc_current: single  % # Current measured from current ESC [A] - if supported
  esc_temperature: single  % # Temperature measured from current ESC [degC] - if supported
  esc_address: uint8  % # Address of current ESC (in most cases 1-8 / must be set by driver)
  esc_state: uint8  % # State of ESC - depend on Vendor
  failures: uint8  % # Bitmask to indicate the internal ESC faults

PX4_ESC_REPORT = enum(AddClassNameToEnumNames=true)
  FAILURE_NONE = 0
  FAILURE_OVER_CURRENT_MASK = 1  % # (1 << 0)
  FAILURE_OVER_VOLTAGE_MASK = 2  % # (1 << 1)
  FAILURE_OVER_TEMPERATURE_MASK = 4  % # (1 << 2)
  FAILURE_OVER_RPM_MASK = 8  % # (1 << 3)
  FAILURE_INCONSISTENT_CMD_MASK = 16  % # (1 << 4)  Set if ESC received an inconsistent command (i.e out of boundaries)
  FAILURE_MOTOR_STUCK_MASK = 32  % # (1 << 5)
  FAILURE_GENERIC_MASK = 64  % # (1 << 6)

px4_esc_status = Simulink.Bus()
  timestamp: fixdt(0,64,0)  % # time since system start (microseconds)
  counter: uint16  % # incremented by the writing thread everytime new data is stored
  esc_count: uint8  % # number of connected ESCs
  esc_connectiontype: uint8  % # how ESCs connected to the system
  esc_online_flags: uint8  % # Bitmask indicating which ESC is online/offline
  esc_armed_flags: uint8  % # Bitmask indicating which ESC is armed. For ESC's where the arming state is not known (returned by the ESC), the arming bits should always be set.
  esc: esc_report[8]

PX4_ESC_STATUS = enum(AddClassNameToEnumNames=true)
  CONNECTED_ESC_MAX = 8  % # The number of ESCs supported. Current (Q2/2013) we support 8 ESCs
  ESC_CONNECTION_TYPE_PPM = 0  % # Traditional PPM ESC
  ESC_CONNECTION_TYPE_SERIAL = 1  % # Serial Bus connected ESC
  ESC_CONNECTION_TYPE_ONESHOT = 2  % # One Shot PPM
  ESC_CONNECTION_TYPE_I2C = 3  % # I2C
  ESC_CONNECTION_TYPE_CAN = 4  % # CAN-Bus
  ESC_CONNECTION_TYPE_DSHOT = 5  % # DShot

px4_estimator_baro_bias = Simulink.Bus()
  timestamp: fixdt(0,64,0)  % # time since system start (microseconds)
  timestamp_sample: fixdt(0,64,0)  % # the timestamp of the raw data (microseconds)
  baro_device_id: uint32  % # unique device ID for the sensor that does not change between power cycles
  bias: single  % # estimated barometric altitude bias (m)
  bias_var: single  % # estimated barometric altitude bias variance (m^2)
  innov: single  % # innovation of the last measurement fusion (m)
  innov_var: single  % # innovation variance of the last measurement fusion (m^2)
  innov_test_ratio: single  % # normalized innovation squared test ratio

px4_estimator_event_flags = Simulink.Bus()
  timestamp: fixdt(0,64,0)  % # time since system start (microseconds)
  timestamp_sample: fixdt(0,64,0)  % # the timestamp of the raw data (microseconds)
  information_event_changes: uint32  % # number of information event changes
  gps_checks_passed: boolean  % #  0 - true when gps quality checks are passing passed
  reset_vel_to_gps: boolean  % #  1 - true when the velocity states are reset to the gps measurement
  reset_vel_to_flow: boolean  % #  2 - true when the velocity states are reset using the optical flow measurement
  reset_vel_to_vision: boolean  % #  3 - true when the velocity states are reset to the vision system measurement
  reset_vel_to_zero: boolean  % #  4 - true when the velocity states are reset to zero
  reset_pos_to_last_known: boolean  % #  5 - true when the position states are reset to the last known position
  reset_pos_to_gps: boolean  % #  6 - true when the position states are reset to the gps measurement
  reset_pos_to_vision: boolean  % #  7 - true when the position states are reset to the vision system measurement
  starting_gps_fusion: boolean  % #  8 - true when the filter starts using gps measurements to correct the state estimates
  starting_vision_pos_fusion: boolean  % #  9 - true when the filter starts using vision system position measurements to correct the state estimates
  starting_vision_vel_fusion: boolean  % # 10 - true when the filter starts using vision system velocity measurements to correct the state estimates
  starting_vision_yaw_fusion: boolean  % # 11 - true when the filter starts using vision system yaw  measurements to correct the state estimates
  yaw_aligned_to_imu_gps: boolean  % # 12 - true when the filter resets the yaw to an estimate derived from IMU and GPS data
  warning_event_changes: uint32  % # number of warning event changes
  gps_quality_poor: boolean  % #  0 - true when the gps is failing quality checks
  gps_fusion_timout: boolean  % #  1 - true when the gps data has not been used to correct the state estimates for a significant time period
  gps_data_stopped: boolean  % #  2 - true when the gps data has stopped for a significant time period
  gps_data_stopped_using_alternate: boolean  % #  3 - true when the gps data has stopped for a significant time period but the filter is able to use other sources of data to maintain navigation
  height_sensor_timeout: boolean  % #  4 - true when the height sensor has not been used to correct the state estimates for a significant time period
  stopping_navigation: boolean  % #  5 - true when the filter has insufficient data to estimate velocity and position and is falling back to an attitude, height and height rate mode of operation
  invalid_accel_bias_cov_reset: boolean  % #  6 - true when the filter has detected bad acceerometer bias state esitmstes and has reset the corresponding covariance matrix elements
  bad_yaw_using_gps_course: boolean  % #  7 - true when the fiter has detected an invalid yaw esitmate and has reset the yaw angle to the GPS ground course
  stopping_mag_use: boolean  % #  8 - true when the filter has detected bad magnetometer data and is stopping further use of the magnetomer data
  vision_data_stopped: boolean  % #  9 - true when the vision system data has stopped for a significant time period
  emergency_yaw_reset_mag_stopped: boolean  % # 10 - true when the filter has detected bad magnetometer data, has reset the yaw to anothter source of data and has stopped further use of the magnetomer data
  emergency_yaw_reset_gps_yaw_stopped: boolean  % # 11 - true when the filter has detected bad GNSS yaw data, has reset the yaw to anothter source of data and has stopped further use of the GNSS yaw data

px4_estimator_innovations = Simulink.Bus()
  timestamp: fixdt(0,64,0)  % # time since system start (microseconds)
  timestamp_sample: fixdt(0,64,0)  % # the timestamp of the raw data (microseconds)
  gps_hvel: single[2]  % # horizontal GPS velocity innovation (m/sec) and innovation variance ((m/sec)**2)
  gps_vvel: single  % # vertical GPS velocity innovation (m/sec) and innovation variance ((m/sec)**2)
  gps_hpos: single[2]  % # horizontal GPS position innovation (m) and innovation variance (m**2)
  gps_vpos: single  % # vertical GPS position innovation (m) and innovation variance (m**2)
  ev_hvel: single[2]  % # horizontal external vision velocity innovation (m/sec) and innovation variance ((m/sec)**2)
  ev_vvel: single  % # vertical external vision velocity innovation (m/sec) and innovation variance ((m/sec)**2)
  ev_hpos: single[2]  % # horizontal external vision position innovation (m) and innovation variance (m**2)
  ev_vpos: single  % # vertical external vision position innovation (m) and innovation variance (m**2)
  rng_vpos: single  % # range sensor height innovation (m) and innovation variance (m**2)
  baro_vpos: single  % # barometer height innovation (m) and innovation variance (m**2)
  aux_hvel: single[2]  % # horizontal auxiliar velocity innovation from landing target measurement (m/sec) and innovation variance ((m/sec)**2)
  aux_vvel: single  % # vertical auxiliar velocity innovation from landing target measurement (m/sec) and innovation variance ((m/sec)**2)
  flow: single[2]  % # flow innvoation (rad/sec) and innovation variance ((rad/sec)**2)
  heading: single  % # heading innovation (rad) and innovation variance (rad**2)
  mag_field: single[3]  % # earth magnetic field innovation (Gauss) and innovation variance (Gauss**2)
  drag: single[2]  % # drag specific force innovation (m/sec**2) and innovation variance ((m/sec)**2)
  airspeed: single  % # airspeed innovation (m/sec) and innovation variance ((m/sec)**2)
  beta: single  % # synthetic sideslip innovation (rad) and innovation variance (rad**2)
  hagl: single  % # height of ground innovation (m) and innovation variance (m**2)

px4_estimator_optical_flow_vel = Simulink.Bus()
  timestamp: fixdt(0,64,0)  % # time since system start (microseconds)
  timestamp_sample: fixdt(0,64,0)  % # the timestamp of the raw data (microseconds)
  vel_body: single[2]  % # velocity obtained from gyro-compensated and distance-scaled optical flow raw measurements in body frame(m/s)
  vel_ne: single[2]  % # same as vel_body but in local frame (m/s)
  flow_uncompensated_integral: single[2]  % # integrated optical flow measurement (rad)
  flow_compensated_integral: single[2]  % # integrated optical flow measurement compensated for angular motion (rad)
  gyro_rate_integral: single[3]  % # gyro measurement integrated to flow rate and synchronized with flow measurements (rad)

px4_estimator_selector_status = Simulink.Bus()
  timestamp: fixdt(0,64,0)  % # time since system start (microseconds)
  primary_instance: uint8
  instances_available: uint8
  instance_changed_count: uint32
  last_instance_change: fixdt(0,64,0)
  accel_device_id: uint32
  baro_device_id: uint32
  gyro_device_id: uint32
  mag_device_id: uint32
  combined_test_ratio: single[9]
  relative_test_ratio: single[9]
  healthy: boolean[9]
  accumulated_gyro_error: single[4]
  accumulated_accel_error: single[4]
  gyro_fault_detected: boolean
  accel_fault_detected: boolean

px4_estimator_sensor_bias = Simulink.Bus()
  timestamp: fixdt(0,64,0)  % # time since system start (microseconds)
  timestamp_sample: fixdt(0,64,0)  % # the timestamp of the raw data (microseconds)
  gyro_device_id: uint32  % # unique device ID for the sensor that does not change between power cycles
  gyro_bias: single[3]  % # gyroscope in-run bias in body frame (rad/s)
  gyro_bias_limit: single  % # magnitude of maximum gyroscope in-run bias in body frame (rad/s)
  gyro_bias_variance: single[3]
  gyro_bias_valid: boolean
  accel_device_id: uint32  % # unique device ID for the sensor that does not change between power cycles
  accel_bias: single[3]  % # accelerometer in-run bias in body frame (m/s^2)
  accel_bias_limit: single  % # magnitude of maximum accelerometer in-run bias in body frame (m/s^2)
  accel_bias_variance: single[3]
  accel_bias_valid: boolean
  mag_device_id: uint32  % # unique device ID for the sensor that does not change between power cycles
  mag_bias: single[3]  % # magnetometer in-run bias in body frame (Gauss)
  mag_bias_limit: single  % # magnitude of maximum magnetometer in-run bias in body frame (Gauss)
  mag_bias_variance: single[3]
  mag_bias_valid: boolean

px4_estimator_states = Simulink.Bus()
  timestamp: fixdt(0,64,0)  % # time since system start (microseconds)
  timestamp_sample: fixdt(0,64,0)  % # the timestamp of the raw data (microseconds)
  states: single[24]  % # Internal filter states
  n_states: uint8  % # Number of states effectively used
  covariances: single[24]  % # Diagonal Elements of Covariance Matrix

px4_estimator_status = Simulink.Bus()
  timestamp: fixdt(0,64,0)  % # time since system start (microseconds)
  timestamp_sample: fixdt(0,64,0)  % # the timestamp of the raw data (microseconds)
  vibe: single[3]  % # IMU vibration metrics in the following array locations
  output_tracking_error: single[3]  % # return a vector containing the output predictor angular, velocity and position tracking error magnitudes (rad), (m/s), (m)
  gps_check_fail_flags: uint16  % # Bitmask to indicate status of GPS checks - see definition below
  control_mode_flags: uint32  % # Bitmask to indicate EKF logic state
  filter_fault_flags: uint32  % # Bitmask to indicate EKF internal faults
  pos_horiz_accuracy: single  % # 1-Sigma estimated horizontal position accuracy relative to the estimators origin (m)
  pos_vert_accuracy: single  % # 1-Sigma estimated vertical position accuracy relative to the estimators origin (m)
  innovation_check_flags: uint16  % # Bitmask to indicate pass/fail status of innovation consistency checks
  mag_test_ratio: single  % # ratio of the largest magnetometer innovation component to the innovation test limit
  vel_test_ratio: single  % # ratio of the largest velocity innovation component to the innovation test limit
  pos_test_ratio: single  % # ratio of the largest horizontal position innovation component to the innovation test limit
  hgt_test_ratio: single  % # ratio of the vertical position innovation to the innovation test limit
  tas_test_ratio: single  % # ratio of the true airspeed innovation to the innovation test limit
  hagl_test_ratio: single  % # ratio of the height above ground innovation to the innovation test limit
  beta_test_ratio: single  % # ratio of the synthetic sideslip innovation to the innovation test limit
  solution_status_flags: uint16  % # Bitmask indicating which filter kinematic state outputs are valid for flight control use.
  reset_count_vel_ne: uint8  % # number of horizontal position reset events (allow to wrap if count exceeds 255)
  reset_count_vel_d: uint8  % # number of vertical velocity reset events (allow to wrap if count exceeds 255)
  reset_count_pos_ne: uint8  % # number of horizontal position reset events (allow to wrap if count exceeds 255)
  reset_count_pod_d: uint8  % # number of vertical position reset events (allow to wrap if count exceeds 255)
  reset_count_quat: uint8  % # number of quaternion reset events (allow to wrap if count exceeds 255)
  time_slip: single  % # cumulative amount of time in seconds that the EKF inertial calculation has slipped relative to system time
  pre_flt_fail_innov_heading: boolean
  pre_flt_fail_innov_vel_horiz: boolean
  pre_flt_fail_innov_vel_vert: boolean
  pre_flt_fail_innov_height: boolean
  pre_flt_fail_mag_field_disturbed: boolean
  accel_device_id: uint32
  gyro_device_id: uint32
  baro_device_id: uint32
  mag_device_id: uint32
  health_flags: uint8  % # Bitmask to indicate sensor health states (vel, pos, hgt)
  timeout_flags: uint8  % # Bitmask to indicate timeout flags (vel, pos, hgt)

PX4_ESTIMATOR_STATUS = enum(AddClassNameToEnumNames=true)
  GPS_CHECK_FAIL_GPS_FIX = 0  % # 0 : insufficient fix type (no 3D solution)
  GPS_CHECK_FAIL_MIN_SAT_COUNT = 1  % # 1 : minimum required sat count fail
  GPS_CHECK_FAIL_MAX_PDOP = 2  % # 2 : maximum allowed PDOP fail
  GPS_CHECK_FAIL_MAX_HORZ_ERR = 3  % # 3 : maximum allowed horizontal position error fail
  GPS_CHECK_FAIL_MAX_VERT_ERR = 4  % # 4 : maximum allowed vertical position error fail
  GPS_CHECK_FAIL_MAX_SPD_ERR = 5  % # 5 : maximum allowed speed error fail
  GPS_CHECK_FAIL_MAX_HORZ_DRIFT = 6  % # 6 : maximum allowed horizontal position drift fail - requires stationary vehicle
  GPS_CHECK_FAIL_MAX_VERT_DRIFT = 7  % # 7 : maximum allowed vertical position drift fail - requires stationary vehicle
  GPS_CHECK_FAIL_MAX_HORZ_SPD_ERR = 8  % # 8 : maximum allowed horizontal speed fail - requires stationary vehicle
  GPS_CHECK_FAIL_MAX_VERT_SPD_ERR = 9  % # 9 : maximum allowed vertical velocity discrepancy fail
  CS_TILT_ALIGN = 0  % # 0 - true if the filter tilt alignment is complete
  CS_YAW_ALIGN = 1  % # 1 - true if the filter yaw alignment is complete
  CS_GPS = 2  % # 2 - true if GPS measurements are being fused
  CS_OPT_FLOW = 3  % # 3 - true if optical flow measurements are being fused
  CS_MAG_HDG = 4  % # 4 - true if a simple magnetic yaw heading is being fused
  CS_MAG_3D = 5  % # 5 - true if 3-axis magnetometer measurement are being fused
  CS_MAG_DEC = 6  % # 6 - true if synthetic magnetic declination measurements are being fused
  CS_IN_AIR = 7  % # 7 - true when thought to be airborne
  CS_WIND = 8  % # 8 - true when wind velocity is being estimated
  CS_BARO_HGT = 9  % # 9 - true when baro height is being fused as a primary height reference
  CS_RNG_HGT = 10  % # 10 - true when range finder height is being fused as a primary height reference
  CS_GPS_HGT = 11  % # 11 - true when GPS height is being fused as a primary height reference
  CS_EV_POS = 12  % # 12 - true when local position data from external vision is being fused
  CS_EV_YAW = 13  % # 13 - true when yaw data from external vision measurements is being fused
  CS_EV_HGT = 14  % # 14 - true when height data from external vision measurements is being fused
  CS_BETA = 15  % # 15 - true when synthetic sideslip measurements are being fused
  CS_MAG_FIELD = 16  % # 16 - true when only the magnetic field states are updated by the magnetometer
  CS_FIXED_WING = 17  % # 17 - true when thought to be operating as a fixed wing vehicle with constrained sideslip
  CS_MAG_FAULT = 18  % # 18 - true when the magnetomer has been declared faulty and is no longer being used
  CS_ASPD = 19  % # 19 - true when airspeed measurements are being fused
  CS_GND_EFFECT = 20  % # 20 - true when when protection from ground effect induced static pressure rise is active
  CS_RNG_STUCK = 21  % # 21 - true when a stuck range finder sensor has been detected
  CS_GPS_YAW = 22  % # 22 - true when yaw (not ground course) data from a GPS receiver is being fused
  CS_MAG_ALIGNED = 23  % # 23 - true when the in-flight mag field alignment has been completed
  CS_EV_VEL = 24  % # 24 - true when local frame velocity data fusion from external vision measurements is intended
  CS_SYNTHETIC_MAG_Z = 25  % # 25 - true when we are using a synthesized measurement for the magnetometer Z component
  CS_VEHICLE_AT_REST = 26  % # 26 - true when the vehicle is at rest
  CS_GPS_YAW_FAULT = 27  % # 27 - true when the GNSS heading has been declared faulty and is no longer being used

px4_estimator_status_flags = Simulink.Bus()
  timestamp: fixdt(0,64,0)  % # time since system start (microseconds)
  timestamp_sample: fixdt(0,64,0)  % # the timestamp of the raw data (microseconds)
  control_status_changes: uint32  % # number of filter control status (cs) changes
  cs_tilt_align: boolean  % #  0 - true if the filter tilt alignment is complete
  cs_yaw_align: boolean  % #  1 - true if the filter yaw alignment is complete
  cs_gps: boolean  % #  2 - true if GPS measurement fusion is intended
  cs_opt_flow: boolean  % #  3 - true if optical flow measurements fusion is intended
  cs_mag_hdg: boolean  % #  4 - true if a simple magnetic yaw heading fusion is intended
  cs_mag_3d: boolean  % #  5 - true if 3-axis magnetometer measurement fusion is inteded
  cs_mag_dec: boolean  % #  6 - true if synthetic magnetic declination measurements fusion is intended
  cs_in_air: boolean  % #  7 - true when the vehicle is airborne
  cs_wind: boolean  % #  8 - true when wind velocity is being estimated
  cs_baro_hgt: boolean  % #  9 - true when baro height is being fused as a primary height reference
  cs_rng_hgt: boolean  % # 10 - true when range finder height is being fused as a primary height reference
  cs_gps_hgt: boolean  % # 11 - true when GPS height is being fused as a primary height reference
  cs_ev_pos: boolean  % # 12 - true when local position data fusion from external vision is intended
  cs_ev_yaw: boolean  % # 13 - true when yaw data from external vision measurements fusion is intended
  cs_ev_hgt: boolean  % # 14 - true when height data from external vision measurements is being fused
  cs_fuse_beta: boolean  % # 15 - true when synthetic sideslip measurements are being fused
  cs_mag_field_disturbed: boolean  % # 16 - true when the mag field does not match the expected strength
  cs_fixed_wing: boolean  % # 17 - true when the vehicle is operating as a fixed wing vehicle
  cs_mag_fault: boolean  % # 18 - true when the magnetometer has been declared faulty and is no longer being used
  cs_fuse_aspd: boolean  % # 19 - true when airspeed measurements are being fused
  cs_gnd_effect: boolean  % # 20 - true when protection from ground effect induced static pressure rise is active
  cs_rng_stuck: boolean  % # 21 - true when rng data wasn't ready for more than 10s and new rng values haven't changed enough
  cs_gps_yaw: boolean  % # 22 - true when yaw (not ground course) data fusion from a GPS receiver is intended
  cs_mag_aligned_in_flight: boolean  % # 23 - true when the in-flight mag field alignment has been completed
  cs_ev_vel: boolean  % # 24 - true when local frame velocity data fusion from external vision measurements is intended
  cs_synthetic_mag_z: boolean  % # 25 - true when we are using a synthesized measurement for the magnetometer Z component
  cs_vehicle_at_rest: boolean  % # 26 - true when the vehicle is at rest
  cs_gps_yaw_fault: boolean  % # 27 - true when the GNSS heading has been declared faulty and is no longer being used
  fault_status_changes: uint32  % # number of filter fault status (fs) changes
  fs_bad_mag_x: boolean  % #  0 - true if the fusion of the magnetometer X-axis has encountered a numerical error
  fs_bad_mag_y: boolean  % #  1 - true if the fusion of the magnetometer Y-axis has encountered a numerical error
  fs_bad_mag_z: boolean  % #  2 - true if the fusion of the magnetometer Z-axis has encountered a numerical error
  fs_bad_hdg: boolean  % #  3 - true if the fusion of the heading angle has encountered a numerical error
  fs_bad_mag_decl: boolean  % #  4 - true if the fusion of the magnetic declination has encountered a numerical error
  fs_bad_airspeed: boolean  % #  5 - true if fusion of the airspeed has encountered a numerical error
  fs_bad_sideslip: boolean  % #  6 - true if fusion of the synthetic sideslip constraint has encountered a numerical error
  fs_bad_optflow_x: boolean  % #  7 - true if fusion of the optical flow X axis has encountered a numerical error
  fs_bad_optflow_y: boolean  % #  8 - true if fusion of the optical flow Y axis has encountered a numerical error
  fs_bad_vel_n: boolean  % #  9 - true if fusion of the North velocity has encountered a numerical error
  fs_bad_vel_e: boolean  % # 10 - true if fusion of the East velocity has encountered a numerical error
  fs_bad_vel_d: boolean  % # 11 - true if fusion of the Down velocity has encountered a numerical error
  fs_bad_pos_n: boolean  % # 12 - true if fusion of the North position has encountered a numerical error
  fs_bad_pos_e: boolean  % # 13 - true if fusion of the East position has encountered a numerical error
  fs_bad_pos_d: boolean  % # 14 - true if fusion of the Down position has encountered a numerical error
  fs_bad_acc_bias: boolean  % # 15 - true if bad delta velocity bias estimates have been detected
  fs_bad_acc_vertical: boolean  % # 16 - true if bad vertical accelerometer data has been detected
  fs_bad_acc_clipping: boolean  % # 17 - true if delta velocity data contains clipping (asymmetric railing)
  innovation_fault_status_changes: uint32  % # number of innovation fault status (reject) changes
  reject_hor_vel: boolean  % #  0 - true if horizontal velocity observations have been rejected
  reject_ver_vel: boolean  % #  1 - true if vertical velocity observations have been rejected
  reject_hor_pos: boolean  % #  2 - true if horizontal position observations have been rejected
  reject_ver_pos: boolean  % #  3 - true if vertical position observations have been rejected
  reject_mag_x: boolean  % #  4 - true if the X magnetometer observation has been rejected
  reject_mag_y: boolean  % #  5 - true if the Y magnetometer observation has been rejected
  reject_mag_z: boolean  % #  6 - true if the Z magnetometer observation has been rejected
  reject_yaw: boolean  % #  7 - true if the yaw observation has been rejected
  reject_airspeed: boolean  % #  8 - true if the airspeed observation has been rejected
  reject_sideslip: boolean  % #  9 - true if the synthetic sideslip observation has been rejected
  reject_hagl: boolean  % # 10 - true if the height above ground observation has been rejected
  reject_optflow_x: boolean  % # 11 - true if the X optical flow observation has been rejected
  reject_optflow_y: boolean  % # 12 - true if the Y optical flow observation has been rejected

px4_event = Simulink.Bus()
  timestamp: fixdt(0,64,0)  % # time since system start (microseconds)
  id: uint32  % # Event ID
  event_sequence: uint16  % # Event sequence number
  arguments: uint8[25]  % # (optional) arguments, depend on event id
  log_levels: uint8  % # Log levels: 4 bits MSB: internal, 4 bits LSB: external

PX4_EVENT = enum(AddClassNameToEnumNames=true)
  ORB_QUEUE_LENGTH = 8

px4_follow_target = Simulink.Bus()
  timestamp: fixdt(0,64,0)  % # time since system start (microseconds)
  lat: double  % # target position (deg * 1e7)
  lon: double  % # target position (deg * 1e7)
  alt: single  % # target position
  vy: single  % # target vel in y
  vx: single  % # target vel in x
  vz: single  % # target vel in z
  est_cap: uint8  % # target reporting capabilities

px4_generator_status = Simulink.Bus()
  timestamp: fixdt(0,64,0)  % # time since system start (microseconds)
  status: fixdt(0,64,0)  % # Status flags
  battery_current: single  % # [A] Current into/out of battery. Positive for out. Negative for in. NaN: field not provided.
  load_current: single  % # [A] Current going to the UAV. If battery current not available this is the DC current from the generator. Positive for out. Negative for in. NaN: field not provided
  power_generated: single  % # [W] The power being generated. NaN: field not provided
  bus_voltage: single  % # [V] Voltage of the bus seen at the generator, or battery bus if battery bus is controlled by generator and at a different voltage to main bus.
  bat_current_setpoint: single  % # [A] The target battery current. Positive for out. Negative for in. NaN: field not provided
  runtime: uint32  % # [s] Seconds this generator has run since it was rebooted. UINT32_MAX: field not provided.
  time_until_maintenance: int32  % # [s] Seconds until this generator requires maintenance.  A negative value indicates maintenance is past-due. INT32_MAX: field not provided.
  generator_speed: uint16  % # [rpm] Speed of electrical generator or alternator. UINT16_MAX: field not provided.
  rectifier_temperature: int16  % # [degC] The temperature of the rectifier or power converter. INT16_MAX: field not provided.
  generator_temperature: int16  % # [degC] The temperature of the mechanical motor, fuel cell core or generator. INT16_MAX: field not provided.

PX4_GENERATOR_STATUS = enum(AddClassNameToEnumNames=true)
  STATUS_FLAG_OFF = 1  % # Generator is off.
  STATUS_FLAG_READY = 2  % # Generator is ready to start generating power.
  STATUS_FLAG_GENERATING = 4  % # Generator is generating power.
  STATUS_FLAG_CHARGING = 8  % # Generator is charging the batteries (generating enough power to charge and provide the load).
  STATUS_FLAG_REDUCED_POWER = 16  % # Generator is operating at a reduced maximum power.
  STATUS_FLAG_MAXPOWER = 32  % # Generator is providing the maximum output.
  STATUS_FLAG_OVERTEMP_WARNING = 64  % # Generator is near the maximum operating temperature, cooling is insufficient.
  STATUS_FLAG_OVERTEMP_FAULT = 128  % # Generator hit the maximum operating temperature and shutdown.
  STATUS_FLAG_ELECTRONICS_OVERTEMP_WARNING = 256  % # Power electronics are near the maximum operating temperature, cooling is insufficient.
  STATUS_FLAG_ELECTRONICS_OVERTEMP_FAULT = 512  % # Power electronics hit the maximum operating temperature and shutdown.
  STATUS_FLAG_ELECTRONICS_FAULT = 1024  % # Power electronics experienced a fault and shutdown.
  STATUS_FLAG_POWERSOURCE_FAULT = 2048  % # The power source supplying the generator failed e.g. mechanical generator stopped, tether is no longer providing power, solar cell is in shade, hydrogen reaction no longer happening.
  STATUS_FLAG_COMMUNICATION_WARNING = 4096  % # Generator controller having communication problems.
  STATUS_FLAG_COOLING_WARNING = 8192  % # Power electronic or generator cooling system error.
  STATUS_FLAG_POWER_RAIL_FAULT = 16384  % # Generator controller power rail experienced a fault.
  STATUS_FLAG_OVERCURRENT_FAULT = 32768  % # Generator controller exceeded the overcurrent threshold and shutdown to prevent damage.
  STATUS_FLAG_BATTERY_OVERCHARGE_CURRENT_FAULT = 65536  % # Generator controller detected a high current going into the batteries and shutdown to prevent battery damage. |
  STATUS_FLAG_OVERVOLTAGE_FAULT = 131072  % # Generator controller exceeded it's overvoltage threshold and shutdown to prevent it exceeding the voltage rating.
  STATUS_FLAG_BATTERY_UNDERVOLT_FAULT = 262144  % # Batteries are under voltage (generator will not start).
  STATUS_FLAG_START_INHIBITED = 524288  % # Generator start is inhibited by e.g. a safety switch.
  STATUS_FLAG_MAINTENANCE_REQUIRED = 1048576  % # Generator requires maintenance.
  STATUS_FLAG_WARMING_UP = 2097152  % # Generator is not ready to generate yet.
  STATUS_FLAG_IDLE = 4194304  % # Generator is idle.

px4_geofence_result = Simulink.Bus()
  timestamp: fixdt(0,64,0)  % # time since system start (microseconds)
  geofence_violated: boolean  % # true if the geofence is violated
  geofence_action: uint8  % # action to take when geofence is violated
  home_required: boolean  % # true if the geofence requires a valid home position

PX4_GEOFENCE_RESULT = enum(AddClassNameToEnumNames=true)
  GF_ACTION_NONE = 0  % # no action on geofence violation
  GF_ACTION_WARN = 1  % # critical mavlink message
  GF_ACTION_LOITER = 2  % # switch to AUTO|LOITER
  GF_ACTION_RTL = 3  % # switch to AUTO|RTL
  GF_ACTION_TERMINATE = 4  % # flight termination
  GF_ACTION_LAND = 5  % # switch to AUTO|LAND

px4_gimbal_device_attitude_status = Simulink.Bus()
  timestamp: fixdt(0,64,0)  % # time since system start (microseconds)
  target_system: uint8
  target_component: uint8
  device_flags: uint16
  q: single[4]
  angular_velocity_x: single
  angular_velocity_y: single
  angular_velocity_z: single
  failure_flags: uint32

PX4_GIMBAL_DEVICE_ATTITUDE_STATUS = enum(AddClassNameToEnumNames=true)
  DEVICE_FLAGS_RETRACT = 1
  DEVICE_FLAGS_NEUTRAL = 2
  DEVICE_FLAGS_ROLL_LOCK = 4
  DEVICE_FLAGS_PITCH_LOCK = 8
  DEVICE_FLAGS_YAW_LOCK = 16

px4_gimbal_device_information = Simulink.Bus()
  timestamp: fixdt(0,64,0)  % # time since system start (microseconds)
  vendor_name: uint8[32]
  model_name: uint8[32]
  custom_name: uint8[32]
  firmware_version: uint32
  hardware_version: uint32
  uid: fixdt(0,64,0)
  cap_flags: uint16
  custom_cap_flags: uint16
  roll_min: single  % # [rad]
  roll_max: single  % # [rad]
  pitch_min: single  % # [rad]
  pitch_max: single  % # [rad]
  yaw_min: single  % # [rad]
  yaw_max: single  % # [rad]
  gimbal_device_compid: uint8

PX4_GIMBAL_DEVICE_INFORMATION = enum(AddClassNameToEnumNames=true)
  GIMBAL_DEVICE_CAP_FLAGS_HAS_RETRACT = 1
  GIMBAL_DEVICE_CAP_FLAGS_HAS_NEUTRAL = 2
  GIMBAL_DEVICE_CAP_FLAGS_HAS_ROLL_AXIS = 4
  GIMBAL_DEVICE_CAP_FLAGS_HAS_ROLL_FOLLOW = 8
  GIMBAL_DEVICE_CAP_FLAGS_HAS_ROLL_LOCK = 16
  GIMBAL_DEVICE_CAP_FLAGS_HAS_PITCH_AXIS = 32
  GIMBAL_DEVICE_CAP_FLAGS_HAS_PITCH_FOLLOW = 64
  GIMBAL_DEVICE_CAP_FLAGS_HAS_PITCH_LOCK = 128
  GIMBAL_DEVICE_CAP_FLAGS_HAS_YAW_AXIS = 256
  GIMBAL_DEVICE_CAP_FLAGS_HAS_YAW_FOLLOW = 512
  GIMBAL_DEVICE_CAP_FLAGS_HAS_YAW_LOCK = 1024
  GIMBAL_DEVICE_CAP_FLAGS_SUPPORTS_INFINITE_YAW = 2048

px4_gimbal_device_set_attitude = Simulink.Bus()
  timestamp: fixdt(0,64,0)  % # time since system start (microseconds)
  target_system: uint8
  target_component: uint8
  flags: uint16
  q: single[4]
  angular_velocity_x: single
  angular_velocity_y: single
  angular_velocity_z: single

PX4_GIMBAL_DEVICE_SET_ATTITUDE = enum(AddClassNameToEnumNames=true)
  GIMBAL_DEVICE_FLAGS_RETRACT = 1
  GIMBAL_DEVICE_FLAGS_NEUTRAL = 2
  GIMBAL_DEVICE_FLAGS_ROLL_LOCK = 4
  GIMBAL_DEVICE_FLAGS_PITCH_LOCK = 8
  GIMBAL_DEVICE_FLAGS_YAW_LOCK = 16

px4_gimbal_manager_information = Simulink.Bus()
  timestamp: fixdt(0,64,0)  % # time since system start (microseconds)
  cap_flags: uint32
  gimbal_device_id: uint8
  roll_min: single  % # [rad]
  roll_max: single  % # [rad]
  pitch_min: single  % # [rad]
  pitch_max: single  % # [rad]
  yaw_min: single  % # [rad]
  yaw_max: single  % # [rad]

PX4_GIMBAL_MANAGER_INFORMATION = enum(AddClassNameToEnumNames=true)
  GIMBAL_MANAGER_CAP_FLAGS_HAS_RETRACT = 1
  GIMBAL_MANAGER_CAP_FLAGS_HAS_NEUTRAL = 2
  GIMBAL_MANAGER_CAP_FLAGS_HAS_ROLL_AXIS = 4
  GIMBAL_MANAGER_CAP_FLAGS_HAS_ROLL_FOLLOW = 8
  GIMBAL_MANAGER_CAP_FLAGS_HAS_ROLL_LOCK = 16
  GIMBAL_MANAGER_CAP_FLAGS_HAS_PITCH_AXIS = 32
  GIMBAL_MANAGER_CAP_FLAGS_HAS_PITCH_FOLLOW = 64
  GIMBAL_MANAGER_CAP_FLAGS_HAS_PITCH_LOCK = 128
  GIMBAL_MANAGER_CAP_FLAGS_HAS_YAW_AXIS = 256
  GIMBAL_MANAGER_CAP_FLAGS_HAS_YAW_FOLLOW = 512
  GIMBAL_MANAGER_CAP_FLAGS_HAS_YAW_LOCK = 1024
  GIMBAL_MANAGER_CAP_FLAGS_SUPPORTS_INFINITE_YAW = 2048
  GIMBAL_MANAGER_CAP_FLAGS_CAN_POINT_LOCATION_LOCAL = 65536
  GIMBAL_MANAGER_CAP_FLAGS_CAN_POINT_LOCATION_GLOBAL = 131072

px4_gimbal_manager_set_attitude = Simulink.Bus()
  timestamp: fixdt(0,64,0)  % # time since system start (microseconds)
  origin_sysid: uint8
  origin_compid: uint8
  target_system: uint8
  target_component: uint8
  flags: uint32
  gimbal_device_id: uint8
  q: single[4]
  angular_velocity_x: single
  angular_velocity_y: single
  angular_velocity_z: single

PX4_GIMBAL_MANAGER_SET_ATTITUDE = enum(AddClassNameToEnumNames=true)
  GIMBAL_MANAGER_FLAGS_RETRACT = 1
  GIMBAL_MANAGER_FLAGS_NEUTRAL = 2
  GIMBAL_MANAGER_FLAGS_ROLL_LOCK = 4
  GIMBAL_MANAGER_FLAGS_PITCH_LOCK = 8
  GIMBAL_MANAGER_FLAGS_YAW_LOCK = 16

px4_gimbal_manager_set_manual_control = Simulink.Bus()
  timestamp: fixdt(0,64,0)  % # time since system start (microseconds)
  origin_sysid: uint8
  origin_compid: uint8
  target_system: uint8
  target_component: uint8
  flags: uint32
  gimbal_device_id: uint8
  pitch: single  % # unitless -1..1, can be NAN
  yaw: single  % # unitless -1..1, can be NAN
  pitch_rate: single  % # unitless -1..1, can be NAN
  yaw_rate: single  % # unitless -1..1, can be NAN

PX4_GIMBAL_MANAGER_SET_MANUAL_CONTROL = enum(AddClassNameToEnumNames=true)
  GIMBAL_MANAGER_FLAGS_RETRACT = 1
  GIMBAL_MANAGER_FLAGS_NEUTRAL = 2
  GIMBAL_MANAGER_FLAGS_ROLL_LOCK = 4
  GIMBAL_MANAGER_FLAGS_PITCH_LOCK = 8
  GIMBAL_MANAGER_FLAGS_YAW_LOCK = 16

px4_gimbal_manager_status = Simulink.Bus()
  timestamp: fixdt(0,64,0)  % # time since system start (microseconds)
  flags: uint32
  gimbal_device_id: uint8
  primary_control_sysid: uint8
  primary_control_compid: uint8
  secondary_control_sysid: uint8
  secondary_control_compid: uint8

px4_gps_dump = Simulink.Bus()
  timestamp: fixdt(0,64,0)  % # time since system start (microseconds)
  instance: uint8  % # Instance of GNSS reciever
  len: uint8  % # length of data, MSB bit set = message to the gps device,
  data: uint8[79]  % # data to write to the log

PX4_GPS_DUMP = enum(AddClassNameToEnumNames=true)
  ORB_QUEUE_LENGTH = 8

px4_gps_inject_data = Simulink.Bus()
  timestamp: fixdt(0,64,0)  % # time since system start (microseconds)
  len: uint8  % # length of data
  flags: uint8  % # LSB: 1=fragmented
  data: uint8[182]  % # data to write to GPS device (RTCM message)

PX4_GPS_INJECT_DATA = enum(AddClassNameToEnumNames=true)
  ORB_QUEUE_LENGTH = 8

px4_heater_status = Simulink.Bus()
  timestamp: fixdt(0,64,0)  % # time since system start (microseconds)
  device_id: uint32
  heater_on: boolean
  temperature_target_met: boolean
  temperature_sensor: single
  temperature_target: single
  controller_period_usec: uint32
  controller_time_on_usec: uint32
  proportional_value: single
  integrator_value: single
  feed_forward_value: single
  mode: uint8

PX4_HEATER_STATUS = enum(AddClassNameToEnumNames=true)
  MODE_GPIO = 1
  MODE_PX4IO = 2

px4_home_position = Simulink.Bus()
  timestamp: fixdt(0,64,0)  % # time since system start (microseconds)
  lat: double  % # Latitude in degrees
  lon: double  % # Longitude in degrees
  alt: single  % # Altitude in meters (AMSL)
  x: single  % # X coordinate in meters
  y: single  % # Y coordinate in meters
  z: single  % # Z coordinate in meters
  yaw: single  % # Yaw angle in radians
  valid_alt: boolean  % # true when the altitude has been set
  valid_hpos: boolean  % # true when the latitude and longitude have been set
  valid_lpos: boolean  % # true when the local position (xyz) has been set
  manual_home: boolean  % # true when home position was set manually

px4_hover_thrust_estimate = Simulink.Bus()
  timestamp: fixdt(0,64,0)  % # time since system start (microseconds)
  timestamp_sample: fixdt(0,64,0)  % # time of corresponding sensor data last used for this estimate
  hover_thrust: single  % # estimated hover thrust [0.1, 0.9]
  hover_thrust_var: single  % # estimated hover thrust variance
  accel_innov: single  % # innovation of the last acceleration fusion
  accel_innov_var: single  % # innovation variance of the last acceleration fusion
  accel_innov_test_ratio: single  % # normalized innovation squared test ratio
  accel_noise_var: single  % # vertical acceleration noise variance estimated form innovation residual
  valid: boolean

px4_input_rc = Simulink.Bus()
  timestamp: fixdt(0,64,0)  % # time since system start (microseconds)
  timestamp_last_signal: fixdt(0,64,0)  % # last valid reception time
  channel_count: uint8  % # number of channels actually being seen
  rssi: int32  % # receive signal strength indicator (RSSI): < 0: Undefined, 0: no signal, 100: full reception
  rc_failsafe: boolean  % # explicit failsafe flag: true on TX failure or TX out of range , false otherwise. Only the true state is reliable, as there are some (PPM) receivers on the market going into failsafe without telling us explicitly.
  rc_lost: boolean  % # RC receiver connection status: True,if no frame has arrived in the expected time, false otherwise. True usually means that the receiver has been disconnected, but can also indicate a radio link loss on "stupid" systems. Will remain false, if a RX with failsafe option continues to transmit frames after a link loss.
  rc_lost_frame_count: uint16  % # Number of lost RC frames. Note: intended purpose: observe the radio link quality if RSSI is not available. This value must not be used to trigger any failsafe-alike funtionality.
  rc_total_frame_count: uint16  % # Number of total RC frames. Note: intended purpose: observe the radio link quality if RSSI is not available. This value must not be used to trigger any failsafe-alike funtionality.
  rc_ppm_frame_length: uint16  % # Length of a single PPM frame. Zero for non-PPM systems
  input_source: uint8  % # Input source
  values: uint16[18]  % # measured pulse widths for each of the supported channels

PX4_INPUT_RC = enum(AddClassNameToEnumNames=true)
  RC_INPUT_SOURCE_UNKNOWN = 0
  RC_INPUT_SOURCE_PX4FMU_PPM = 1
  RC_INPUT_SOURCE_PX4IO_PPM = 2
  RC_INPUT_SOURCE_PX4IO_SPEKTRUM = 3
  RC_INPUT_SOURCE_PX4IO_SBUS = 4
  RC_INPUT_SOURCE_PX4IO_ST24 = 5
  RC_INPUT_SOURCE_MAVLINK = 6
  RC_INPUT_SOURCE_QURT = 7
  RC_INPUT_SOURCE_PX4FMU_SPEKTRUM = 8
  RC_INPUT_SOURCE_PX4FMU_SBUS = 9
  RC_INPUT_SOURCE_PX4FMU_ST24 = 10
  RC_INPUT_SOURCE_PX4FMU_SUMD = 11
  RC_INPUT_SOURCE_PX4FMU_DSM = 12
  RC_INPUT_SOURCE_PX4IO_SUMD = 13
  RC_INPUT_SOURCE_PX4FMU_CRSF = 14
  RC_INPUT_SOURCE_PX4FMU_GHST = 15
  RC_INPUT_MAX_CHANNELS = 18  % # Maximum number of R/C input channels in the system. S.Bus has up to 18 channels.

px4_internal_combustion_engine_status = Simulink.Bus()
  timestamp: fixdt(0,64,0)  % # time since system start (microseconds)
  state: uint8
  flags: uint32
  engine_load_percent: uint8  % # Engine load estimate, percent, [0, 127]
  engine_speed_rpm: uint32  % # Engine speed, revolutions per minute
  spark_dwell_time_ms: single  % # Spark dwell time, millisecond
  atmospheric_pressure_kpa: single  % # Atmospheric (barometric) pressure, kilopascal
  intake_manifold_pressure_kpa: single  % # Engine intake manifold pressure, kilopascal
  intake_manifold_temperature: single  % # Engine intake manifold temperature, kelvin
  coolant_temperature: single  % # Engine coolant temperature, kelvin
  oil_pressure: single  % # Oil pressure, kilopascal
  oil_temperature: single  % # Oil temperature, kelvin
  fuel_pressure: single  % # Fuel pressure, kilopascal
  fuel_consumption_rate_cm3pm: single  % # Instant fuel consumption estimate, (centimeter^3)/minute
  estimated_consumed_fuel_volume_cm3: single  % # Estimate of the consumed fuel since the start of the engine, centimeter^3
  throttle_position_percent: uint8  % # Throttle position, percent
  ecu_index: uint8  % # The index of the publishing ECU
  spark_plug_usage: uint8  % # Spark plug activity report.
  ignition_timing_deg: single  % # Cylinder ignition timing, angular degrees of the crankshaft
  injection_time_ms: single  % # Fuel injection time, millisecond
  cylinder_head_temperature: single  % # Cylinder head temperature (CHT), kelvin
  exhaust_gas_temperature: single  % # Exhaust gas temperature (EGT), kelvin
  lambda_coefficient: single  % # Estimated lambda coefficient, dimensionless ratio

PX4_INTERNAL_COMBUSTION_ENGINE_STATUS = enum(AddClassNameToEnumNames=true)
  STATE_STOPPED = 0  % # The engine is not running. This is the default state.
  STATE_STARTING = 1  % # The engine is starting. This is a transient state.
  STATE_RUNNING = 2  % # The engine is running normally.
  STATE_FAULT = 3  % # The engine can no longer function.
  FLAG_GENERAL_ERROR = 1  % # General error.
  FLAG_CRANKSHAFT_SENSOR_ERROR_SUPPORTED = 2  % # Error of the crankshaft sensor. This flag is optional.
  FLAG_CRANKSHAFT_SENSOR_ERROR = 4
  FLAG_TEMPERATURE_SUPPORTED = 8  % # Temperature levels. These flags are optional
  FLAG_TEMPERATURE_BELOW_NOMINAL = 16  % # Under-temperature warning
  FLAG_TEMPERATURE_ABOVE_NOMINAL = 32  % # Over-temperature warning
  FLAG_TEMPERATURE_OVERHEATING = 64  % # Critical overheating
  FLAG_TEMPERATURE_EGT_ABOVE_NOMINAL = 128  % # Exhaust gas over-temperature warning
  FLAG_FUEL_PRESSURE_SUPPORTED = 256  % # Fuel pressure. These flags are optional
  FLAG_FUEL_PRESSURE_BELOW_NOMINAL = 512  % # Under-pressure warning
  FLAG_FUEL_PRESSURE_ABOVE_NOMINAL = 1024  % # Over-pressure warning
  FLAG_DETONATION_SUPPORTED = 2048  % # Detonation warning. This flag is optional.
  FLAG_DETONATION_OBSERVED = 4096  % # Detonation condition observed warning
  FLAG_MISFIRE_SUPPORTED = 8192  % # Misfire warning. This flag is optional.
  FLAG_MISFIRE_OBSERVED = 16384  % # Misfire condition observed warning
  FLAG_OIL_PRESSURE_SUPPORTED = 32768  % # Oil pressure. These flags are optional
  FLAG_OIL_PRESSURE_BELOW_NOMINAL = 65536  % # Under-pressure warning
  FLAG_OIL_PRESSURE_ABOVE_NOMINAL = 131072  % # Over-pressure warning
  FLAG_DEBRIS_SUPPORTED = 262144  % # Debris warning. This flag is optional
  FLAG_DEBRIS_DETECTED = 524288  % # Detection of debris warning
  SPARK_PLUG_SINGLE = 0
  SPARK_PLUG_FIRST_ACTIVE = 1
  SPARK_PLUG_SECOND_ACTIVE = 2
  SPARK_PLUG_BOTH_ACTIVE = 3

px4_iridiumsbd_status = Simulink.Bus()
  timestamp: fixdt(0,64,0)  % # time since system start (microseconds)
  last_heartbeat: fixdt(0,64,0)  % # timestamp of the last successful sbd session
  tx_buf_write_index: uint16  % # current size of the tx buffer
  rx_buf_read_index: uint16  % # the rx buffer is parsed up to that index
  rx_buf_end_index: uint16  % # current size of the rx buffer
  failed_sbd_sessions: uint16  % # number of failed sbd sessions
  successful_sbd_sessions: uint16  % # number of successfull sbd sessions
  num_tx_buf_reset: uint16  % # number of times the tx buffer was reset
  signal_quality: uint8  % # current signal quality, 0 is no signal, 5 the best
  state: uint8  % # current state of the driver, see the satcom_state of IridiumSBD.h for the definition
  ring_pending: boolean  % # indicates if a ring call is pending
  tx_buf_write_pending: boolean  % # indicates if a tx buffer write is pending
  tx_session_pending: boolean  % # indicates if a tx session is pending
  rx_read_pending: boolean  % # indicates if a rx read is pending
  rx_session_pending: boolean  % # indicates if a rx session is pending

px4_irlock_report = Simulink.Bus()
  timestamp: fixdt(0,64,0)  % # time since system start (microseconds)
  signature: uint16
  pos_x: single  % # tan(theta), where theta is the angle between the target and the camera center of projection in camera x-axis
  pos_y: single  % # tan(theta), where theta is the angle between the target and the camera center of projection in camera y-axis
  size_x: single  % #/** size of target along camera x-axis in units of tan(theta) **/
  size_y: single  % #/** size of target along camera y-axis in units of tan(theta) **/

px4_landing_gear = Simulink.Bus()
  timestamp: fixdt(0,64,0)  % # time since system start (microseconds)
  landing_gear: int8

PX4_LANDING_GEAR = enum(AddClassNameToEnumNames=true)
  GEAR_UP = 1  % # landing gear up
  GEAR_DOWN = -1  % # landing gear down
  GEAR_KEEP = 0  % # keep the current state

px4_landing_target_innovations = Simulink.Bus()
  timestamp: fixdt(0,64,0)  % # time since system start (microseconds)
  innov_x: single
  innov_y: single
  innov_cov_x: single
  innov_cov_y: single

px4_landing_target_pose = Simulink.Bus()
  timestamp: fixdt(0,64,0)  % # time since system start (microseconds)
  is_static: boolean  % # Flag indicating whether the landing target is static or moving with respect to the ground
  rel_pos_valid: boolean  % # Flag showing whether relative position is valid
  rel_vel_valid: boolean  % # Flag showing whether relative velocity is valid
  x_rel: single  % # X/north position of target, relative to vehicle (navigation frame) [meters]
  y_rel: single  % # Y/east position of target, relative to vehicle (navigation frame) [meters]
  z_rel: single  % # Z/down position of target, relative to vehicle (navigation frame) [meters]
  vx_rel: single  % # X/north velocity  of target, relative to vehicle (navigation frame) [meters/second]
  vy_rel: single  % # Y/east velocity of target, relative to vehicle (navigation frame) [meters/second]
  cov_x_rel: single  % # X/north position variance [meters^2]
  cov_y_rel: single  % # Y/east position variance [meters^2]
  cov_vx_rel: single  % # X/north velocity variance [(meters/second)^2]
  cov_vy_rel: single  % # Y/east velocity variance [(meters/second)^2]
  abs_pos_valid: boolean  % # Flag showing whether absolute position is valid
  x_abs: single  % # X/north position of target, relative to origin (navigation frame) [meters]
  y_abs: single  % # Y/east position of target, relative to origin (navigation frame) [meters]
  z_abs: single  % # Z/down position of target, relative to origin (navigation frame) [meters]

px4_led_control = Simulink.Bus()
  timestamp: fixdt(0,64,0)  % # time since system start (microseconds)
  led_mask: uint8  % # bitmask which LED(s) to control, set to 0xff for all
  color: uint8  % # see COLOR_*
  mode: uint8  % # see MODE_*
  num_blinks: uint8  % # how many times to blink (number of on-off cycles if mode is one of MODE_BLINK_*) . Set to 0 for infinite
  priority: uint8  % # priority: higher priority events will override current lower priority events (see MAX_PRIORITY)

PX4_LED_CONTROL = enum(AddClassNameToEnumNames=true)
  COLOR_OFF = 0  % # this is only used in the drivers
  COLOR_RED = 1
  COLOR_GREEN = 2
  COLOR_BLUE = 3
  COLOR_YELLOW = 4
  COLOR_PURPLE = 5
  COLOR_AMBER = 6
  COLOR_CYAN = 7
  COLOR_WHITE = 8
  MODE_OFF = 0  % # turn LED off
  MODE_ON = 1  % # turn LED on
  MODE_DISABLED = 2  % # disable this priority (switch to lower priority setting)
  MODE_BLINK_SLOW = 3
  MODE_BLINK_NORMAL = 4
  MODE_BLINK_FAST = 5
  MODE_BREATHE = 6  % # continuously increase & decrease brightness (solid color if driver does not support it)
  MODE_FLASH = 7  % # two fast blinks (on/off) with timing as in MODE_BLINK_FAST and then off for a while
  MAX_PRIORITY = 2  % # maxium priority (minimum is 0)
  ORB_QUEUE_LENGTH = 8  % # needs to match BOARD_MAX_LEDS

px4_logger_status = Simulink.Bus()
  timestamp: fixdt(0,64,0)  % # time since system start (microseconds)
  type: uint8
  backend: uint8
  total_written_kb: single  % # total written to log in kiloBytes
  write_rate_kb_s: single  % # write rate in kiloBytes/s
  dropouts: uint32  % # number of failed buffer writes due to buffer overflow
  message_gaps: uint32  % # messages misssed
  buffer_used_bytes: uint32  % # current buffer fill in Bytes
  buffer_size_bytes: uint32  % # total buffer size in Bytes
  num_messages: uint8

PX4_LOGGER_STATUS = enum(AddClassNameToEnumNames=true)
  LOGGER_TYPE_FULL = 0  % # Normal, full size log
  LOGGER_TYPE_MISSION = 1  % # reduced mission log (e.g. for geotagging)
  BACKEND_FILE = 1
  BACKEND_MAVLINK = 2
  BACKEND_ALL = 3

px4_log_message = Simulink.Bus()
  timestamp: fixdt(0,64,0)  % # time since system start (microseconds)
  severity: uint8  % # log level (same as in the linux kernel, starting with 0)
  text: int8[127]

PX4_LOG_MESSAGE = enum(AddClassNameToEnumNames=true)
  ORB_QUEUE_LENGTH = 4

px4_mag_worker_data = Simulink.Bus()
  timestamp: fixdt(0,64,0)  % # time since system start (microseconds)
  timestamp_sample: fixdt(0,64,0)
  done_count: uint32
  calibration_points_perside: uint32
  calibration_interval_perside_us: fixdt(0,64,0)
  calibration_counter_total: uint32[4]
  side_data_collected: boolean[4]
  x: single[4]
  y: single[4]
  z: single[4]

PX4_MAG_WORKER_DATA = enum(AddClassNameToEnumNames=true)
  MAX_MAGS = 4

px4_manual_control_setpoint = Simulink.Bus()
  timestamp: fixdt(0,64,0)  % # time since system start (microseconds)
  timestamp_sample: fixdt(0,64,0)  % # the timestamp of the raw data (microseconds)
  data_source: uint8  % # where this input is coming from
  x: single  % # stick position in x direction -1..1
  y: single  % # stick position in y direction -1..1
  z: single  % # throttle stick position 0..1
  r: single  % # yaw stick/twist position, -1..1
  flaps: single  % # flap position
  aux1: single  % # default function: camera yaw / azimuth
  aux2: single  % # default function: camera pitch / tilt
  aux3: single  % # default function: camera trigger
  aux4: single  % # default function: camera roll
  aux5: single  % # default function: payload drop
  aux6: single

PX4_MANUAL_CONTROL_SETPOINT = enum(AddClassNameToEnumNames=true)
  SOURCE_RC = 1  % # radio control
  SOURCE_MAVLINK_0 = 2  % # mavlink instance 0
  SOURCE_MAVLINK_1 = 3  % # mavlink instance 1
  SOURCE_MAVLINK_2 = 4  % # mavlink instance 2
  SOURCE_MAVLINK_3 = 5  % # mavlink instance 4

px4_manual_control_switches = Simulink.Bus()
  timestamp: fixdt(0,64,0)  % # time since system start (microseconds)
  timestamp_sample: fixdt(0,64,0)  % # the timestamp of the raw data (microseconds)
  mode_slot: uint8  % # the slot a specific model selector is in
  arm_switch: uint8  % # arm/disarm switch: _DISARMED_, ARMED
  return_switch: uint8  % # return to launch 2 position switch (mandatory): _NORMAL_, RTL
  loiter_switch: uint8  % # loiter 2 position switch (optional): _MISSION_, LOITER
  offboard_switch: uint8  % # offboard 2 position switch (optional): _NORMAL_, OFFBOARD
  kill_switch: uint8  % # throttle kill: _NORMAL_, KILL
  gear_switch: uint8  % # landing gear switch: _DOWN_, UP
  transition_switch: uint8  % # VTOL transition switch: _HOVER, FORWARD_FLIGHT
  mode_switch: uint8  % # main mode 3 position switch (mandatory): _MANUAL_, ASSIST, AUTO
  man_switch: uint8  % # manual switch (only relevant for fixed wings, optional): _STABILIZED_, MANUAL
  acro_switch: uint8  % # acro 2 position switch (optional): _MANUAL_, ACRO
  stab_switch: uint8  % # stabilize switch (only relevant for fixed wings, optional): _MANUAL, STABILIZED
  posctl_switch: uint8  % # position control 2 position switch (optional): _ALTCTL_, POSCTL
  switch_changes: uint32  % # number of switch changes

PX4_MANUAL_CONTROL_SWITCHES = enum(AddClassNameToEnumNames=true)
  SWITCH_POS_NONE = 0  % # switch is not mapped
  SWITCH_POS_ON = 1  % # switch activated (value = 1)
  SWITCH_POS_MIDDLE = 2  % # middle position (value = 0)
  SWITCH_POS_OFF = 3  % # switch not activated (value = -1)
  MODE_SLOT_NONE = 0  % # no mode slot assigned
  MODE_SLOT_1 = 1  % # mode slot 1 selected
  MODE_SLOT_2 = 2  % # mode slot 2 selected
  MODE_SLOT_3 = 3  % # mode slot 3 selected
  MODE_SLOT_4 = 4  % # mode slot 4 selected
  MODE_SLOT_5 = 5  % # mode slot 5 selected
  MODE_SLOT_6 = 6  % # mode slot 6 selected
  MODE_SLOT_NUM = 6  % # number of slots

px4_mavlink_log = Simulink.Bus()
  timestamp: fixdt(0,64,0)  % # time since system start (microseconds)
  text: int8[127]
  severity: uint8  % # log level (same as in the linux kernel, starting with 0)

PX4_MAVLINK_LOG = enum(AddClassNameToEnumNames=true)
  ORB_QUEUE_LENGTH = 8

px4_mission = Simulink.Bus()
  timestamp: fixdt(0,64,0)  % # time since system start (microseconds)
  dataman_id: uint8  % # default 0, there are two offboard storage places in the dataman: 0 or 1
  count: uint16  % # count of the missions stored in the dataman
  current_seq: int32  % # default -1, start at the one changed latest

px4_mission_result = Simulink.Bus()
  timestamp: fixdt(0,64,0)  % # time since system start (microseconds)
  instance_count: uint32  % # Instance count of this mission. Increments monotonically whenever the mission is modified
  seq_reached: int32  % # Sequence of the mission item which has been reached, default -1
  seq_current: uint16  % # Sequence of the current mission item
  seq_total: uint16  % # Total number of mission items
  valid: boolean  % # true if mission is valid
  warning: boolean  % # true if mission is valid, but has potentially problematic items leading to safety warnings
  finished: boolean  % # true if mission has been completed
  failure: boolean  % # true if the mission cannot continue or be completed for some reason
  stay_in_failsafe: boolean  % # true if the commander should not switch out of the failsafe mode
  flight_termination: boolean  % # true if the navigator demands a flight termination from the commander app
  item_do_jump_changed: boolean  % # true if the number of do jumps remaining has changed
  item_changed_index: uint16  % # indicate which item has changed
  item_do_jump_remaining: uint16  % # set to the number of do jumps remaining for that item
  execution_mode: uint8  % # indicates the mode in which the mission is executed

PX4_MISSION_RESULT = enum(AddClassNameToEnumNames=true)
  MISSION_EXECUTION_MODE_NORMAL = 0  % # Execute the mission according to the planned items
  MISSION_EXECUTION_MODE_REVERSE = 1  % # Execute the mission in reverse order, ignoring commands and converting all waypoints to normal ones
  MISSION_EXECUTION_MODE_FAST_FORWARD = 2  % # Execute the mission as fast as possible, for example converting loiter waypoints to normal ones

px4_mount_orientation = Simulink.Bus()
  timestamp: fixdt(0,64,0)  % # time since system start (microseconds)
  attitude_euler_angle: single[3]  % # Attitude/direction of the mount as euler angles in rad

px4_multirotor_motor_limits = Simulink.Bus()
  timestamp: fixdt(0,64,0)  % # time since system start (microseconds)
  saturation_status: uint16  % # Integer bit mask indicating which axes in the control mixer are saturated

px4_obstacle_distance = Simulink.Bus()
  timestamp: fixdt(0,64,0)  % # time since system start (microseconds)
  frame: uint8  % #Coordinate frame of reference for the yaw rotation and offset of the sensor data. Defaults to MAV_FRAME_GLOBAL, which is North aligned. For body-mounted sensors use MAV_FRAME_BODY_FRD, which is vehicle front aligned.
  sensor_type: uint8  % # Type from MAV_DISTANCE_SENSOR enum.
  distances: uint16[72]  % # Distance of obstacles around the UAV with index 0 corresponding to local North. A value of 0 means that the obstacle is right in front of the sensor. A value of max_distance +1 means no obstacle is present. A value of UINT16_MAX for unknown/not used. In a array element, one unit corresponds to 1cm.
  increment: single  % # Angular width in degrees of each array element.
  min_distance: uint16  % # Minimum distance the sensor can measure in centimeters.
  max_distance: uint16  % # Maximum distance the sensor can measure in centimeters.
  angle_offset: single  % # Relative angle offset of the 0-index element in the distances array. Value of 0 corresponds to forward. Positive values are offsets to the right.

PX4_OBSTACLE_DISTANCE = enum(AddClassNameToEnumNames=true)
  MAV_FRAME_GLOBAL = 0
  MAV_FRAME_LOCAL_NED = 1
  MAV_FRAME_BODY_FRD = 12
  MAV_DISTANCE_SENSOR_LASER = 0
  MAV_DISTANCE_SENSOR_ULTRASOUND = 1
  MAV_DISTANCE_SENSOR_INFRARED = 2
  MAV_DISTANCE_SENSOR_RADAR = 3

px4_offboard_control_mode = Simulink.Bus()
  timestamp: fixdt(0,64,0)  % # time since system start (microseconds)
  position: boolean
  velocity: boolean
  acceleration: boolean
  attitude: boolean
  body_rate: boolean

px4_onboard_computer_status = Simulink.Bus()
  timestamp: fixdt(0,64,0)  % # [us] time since system start (microseconds)
  uptime: uint32  % # [ms] time since system boot of the companion (milliseconds)
  type: uint8  % # type of onboard computer 0: Mission computer primary, 1: Mission computer backup 1, 2: Mission computer backup 2, 3: Compute node, 4-5: Compute spares, 6-9: Payload computers.
  cpu_cores: uint8[8]  % # CPU usage on the component in percent
  cpu_combined: uint8[10]  % # Combined CPU usage as the last 10 slices of 100 MS
  gpu_cores: uint8[4]  % # GPU usage on the component in percent
  gpu_combined: uint8[10]  % # Combined GPU usage as the last 10 slices of 100 MS
  temperature_board: int8  % # [degC] Temperature of the board
  temperature_core: int8[8]  % # [degC] Temperature of the CPU core
  fan_speed: int16[4]  % # [rpm] Fan speeds
  ram_usage: uint32  % # [MB] Amount of used RAM on the component system
  ram_total: uint32  % # [MB] Total amount of RAM on the component system
  storage_type: uint32[4]  % # Storage type: 0: HDD, 1: SSD, 2: EMMC, 3: SD card (non-removable), 4: SD card (removable)
  storage_usage: uint32[4]  % # [MB] Amount of used storage space on the component system
  storage_total: uint32[4]  % # [MB] Total amount of storage space on the component system
  link_type: uint32[6]  % # [Kb/s] Link type: 0-9: UART, 10-19: Wired network, 20-29: Wifi, 30-39: Point-to-point proprietary, 40-49: Mesh proprietary
  link_tx_rate: uint32[6]  % # [Kb/s] Network traffic from the component system
  link_rx_rate: uint32[6]  % # [Kb/s] Network traffic to the component system
  link_tx_max: uint32[6]  % # [Kb/s] Network capacity from the component system
  link_rx_max: uint32[6]  % # [Kb/s] Network capacity to the component system

px4_optical_flow = Simulink.Bus()
  timestamp: fixdt(0,64,0)  % # time since system start (microseconds)
  sensor_id: uint8  % # id of the sensor emitting the flow value
  pixel_flow_x_integral: single  % # accumulated optical flow in radians where a positive value is produced by a RH rotation about the X body axis
  pixel_flow_y_integral: single  % # accumulated optical flow in radians where a positive value is produced by a RH rotation about the Y body axis
  gyro_x_rate_integral: single  % # accumulated gyro value in radians where a positive value is produced by a RH rotation about the X body axis. Set to NaN if flow sensor does not have 3-axis gyro data.
  gyro_y_rate_integral: single  % # accumulated gyro value in radians where a positive value is produced by a RH rotation about the Y body axis. Set to NaN if flow sensor does not have 3-axis gyro data.
  gyro_z_rate_integral: single  % # accumulated gyro value in radians where a positive value is produced by a RH rotation about the Z body axis. Set to NaN if flow sensor does not have 3-axis gyro data.
  ground_distance_m: single  % # Altitude / distance to ground in meters
  integration_timespan: uint32  % # accumulation timespan in microseconds
  time_since_last_sonar_update: uint32  % # time since last sonar update in microseconds
  frame_count_since_last_readout: uint16  % # number of accumulated frames in timespan
  gyro_temperature: int16  % # Temperature * 100 in centi-degrees Celsius
  quality: uint8  % # Average of quality of accumulated frames, 0: bad quality, 255: maximum quality
  max_flow_rate: single  % # Magnitude of maximum angular which the optical flow sensor can measure reliably
  min_ground_distance: single  % # Minimum distance from ground at which the optical flow sensor operates reliably
  max_ground_distance: single  % # Maximum distance from ground at which the optical flow sensor operates reliably
  mode: uint8

PX4_OPTICAL_FLOW = enum(AddClassNameToEnumNames=true)
  MODE_UNKNOWN = 0
  MODE_BRIGHT = 1
  MODE_LOWLIGHT = 2
  MODE_SUPER_LOWLIGHT = 3

px4_orbit_status = Simulink.Bus()
  timestamp: fixdt(0,64,0)  % # time since system start (microseconds)
  radius: single  % # Radius of the orbit circle. Positive values orbit clockwise, negative values orbit counter-clockwise. [m]
  frame: uint8  % # The coordinate system of the fields: x, y, z.
  x: double  % # X coordinate of center point. Coordinate system depends on frame field: local = x position in meters * 1e4, global = latitude in degrees * 1e7.
  y: double  % # Y coordinate of center point. Coordinate system depends on frame field: local = y position in meters * 1e4, global = latitude in degrees * 1e7.
  z: single  % # Altitude of center point. Coordinate system depends on frame field.
  yaw_behaviour: uint8

PX4_ORBIT_STATUS = enum(AddClassNameToEnumNames=true)
  ORBIT_YAW_BEHAVIOUR_HOLD_FRONT_TO_CIRCLE_CENTER = 0
  ORBIT_YAW_BEHAVIOUR_HOLD_INITIAL_HEADING = 1
  ORBIT_YAW_BEHAVIOUR_UNCONTROLLED = 2
  ORBIT_YAW_BEHAVIOUR_HOLD_FRONT_TANGENT_TO_CIRCLE = 3
  ORBIT_YAW_BEHAVIOUR_RC_CONTROLLED = 4

px4_orb_test = Simulink.Bus()
  timestamp: fixdt(0,64,0)  % # time since system start (microseconds)
  val: int32

px4_orb_test_large = Simulink.Bus()
  timestamp: fixdt(0,64,0)  % # time since system start (microseconds)
  val: int32
  junk: uint8[512]

px4_orb_test_medium = Simulink.Bus()
  timestamp: fixdt(0,64,0)  % # time since system start (microseconds)
  val: int32
  junk: uint8[64]

px4_parameter_update = Simulink.Bus()
  timestamp: fixdt(0,64,0)  % # time since system start (microseconds)
  instance: uint32  % # Instance count - constantly incrementing
  get_count: uint32
  set_count: uint32
  find_count: uint32
  export_count: uint32
  active: uint16
  changed: uint16
  custom_default: uint16

px4_ping = Simulink.Bus()
  timestamp: fixdt(0,64,0)  % # time since system start (microseconds)
  ping_time: fixdt(0,64,0)  % # Timestamp of the ping packet
  ping_sequence: uint32  % # Sequence number of the ping packet
  dropped_packets: uint32  % # Number of dropped ping packets
  rtt_ms: single  % # Round trip time (in ms)
  system_id: uint8  % # System ID of the remote system
  component_id: uint8  % # Component ID of the remote system

px4_position_controller_landing_status = Simulink.Bus()
  timestamp: fixdt(0,64,0)  % # time since system start (microseconds)
  horizontal_slope_displacement: single
  slope_angle_rad: single
  flare_length: single
  abort_landing: boolean  % # true if landing should be aborted

PX4_POSITION_SETPOINT = enum(AddClassNameToEnumNames=true)
  SETPOINT_TYPE_POSITION = 0  % # position setpoint
  SETPOINT_TYPE_VELOCITY = 1  % # velocity setpoint
  SETPOINT_TYPE_LOITER = 2  % # loiter setpoint
  SETPOINT_TYPE_TAKEOFF = 3  % # takeoff setpoint
  SETPOINT_TYPE_LAND = 4  % # land setpoint, altitude must be ignored, descend until landing
  SETPOINT_TYPE_IDLE = 5  % # do nothing, switch off motors or keep at idle speed (MC)
  SETPOINT_TYPE_FOLLOW_TARGET = 6  % # setpoint in NED frame (x, y, z, vx, vy, vz) set by follow target
  VELOCITY_FRAME_LOCAL_NED = 1  % # MAV_FRAME_LOCAL_NED
  VELOCITY_FRAME_BODY_NED = 8  % # MAV_FRAME_BODY_NED

px4_power_button_state = Simulink.Bus()
  timestamp: fixdt(0,64,0)  % # time since system start (microseconds)
  event: uint8  % # one of PWR_BUTTON_STATE_*

PX4_POWER_BUTTON_STATE = enum(AddClassNameToEnumNames=true)
  PWR_BUTTON_STATE_IDEL = 0  % # Button went up without meeting shutdown button down time (delete event)
  PWR_BUTTON_STATE_DOWN = 1  % # Button went Down
  PWR_BUTTON_STATE_UP = 2  % # Button went Up
  PWR_BUTTON_STATE_REQUEST_SHUTDOWN = 3  % # Button went Up after meeting shutdown button down time

px4_power_monitor = Simulink.Bus()
  timestamp: fixdt(0,64,0)  % # Time since system start (microseconds)
  voltage_v: single  % # Voltage in volts, 0 if unknown
  current_a: single  % # Current in amperes, -1 if unknown
  power_w: single  % # power in watts, -1 if unknown
  rconf: int16
  rsv: int16
  rbv: int16
  rp: int16
  rc: int16
  rcal: int16
  me: int16
  al: int16

px4_pwm_input = Simulink.Bus()
  timestamp: fixdt(0,64,0)  % # Time since system start (microseconds)
  error_count: fixdt(0,64,0)  % # Timer overcapture error flag (AUX5 or MAIN5)
  pulse_width: uint32  % # Pulse width, timer counts
  period: uint32  % # Period, timer counts

px4_px4io_status = Simulink.Bus()
  timestamp: fixdt(0,64,0)  % # time since system start (microseconds)
  free_memory_bytes: uint16
  voltage_v: single  % # Servo rail voltage in volts
  rssi_v: single  % # RSSI pin voltage in volts
  status_outputs_armed: boolean
  status_override: boolean
  status_rc_ok: boolean
  status_rc_ppm: boolean
  status_rc_dsm: boolean
  status_rc_sbus: boolean
  status_fmu_ok: boolean
  status_raw_pwm: boolean
  status_mixer_ok: boolean
  status_arm_sync: boolean
  status_init_ok: boolean
  status_failsafe: boolean
  status_safety_off: boolean
  status_fmu_initialized: boolean
  status_rc_st24: boolean
  status_rc_sumd: boolean
  alarm_vbatt_low: boolean
  alarm_temperature: boolean
  alarm_servo_current: boolean
  alarm_acc_current: boolean
  alarm_fmu_lost: boolean
  alarm_rc_lost: boolean
  alarm_pwm_error: boolean
  alarm_vservo_fault: boolean
  arming_io_arm_ok: boolean
  arming_fmu_armed: boolean
  arming_fmu_prearmed: boolean
  arming_manual_override_ok: boolean
  arming_failsafe_custom: boolean
  arming_inair_restart_ok: boolean
  arming_always_pwm_enable: boolean
  arming_rc_handling_disabled: boolean
  arming_lockdown: boolean
  arming_force_failsafe: boolean
  arming_termination_failsafe: boolean
  arming_override_immediate: boolean
  actuators: int16[8]
  servos: uint16[8]
  raw_inputs: uint16[18]

px4_radio_status = Simulink.Bus()
  timestamp: fixdt(0,64,0)  % # time since system start (microseconds)
  rssi: uint8  % # local signal strength
  remote_rssi: uint8  % # remote signal strength
  txbuf: uint8  % # how full the tx buffer is as a percentage
  noise: uint8  % # background noise level
  remote_noise: uint8  % # remote background noise level
  rxerrors: uint16  % # receive errors
  fix: uint16  % # count of error corrected packets

px4_rate_ctrl_status = Simulink.Bus()
  timestamp: fixdt(0,64,0)  % # time since system start (microseconds)
  rollspeed_integ: single
  pitchspeed_integ: single
  yawspeed_integ: single
  additional_integ1: single  % # FW: wheel rate integrator (optional)

px4_rc_channels = Simulink.Bus()
  timestamp: fixdt(0,64,0)  % # time since system start (microseconds)
  timestamp_last_valid: fixdt(0,64,0)  % # Timestamp of last valid RC signal
  channels: single[18]  % # Scaled to -1..1 (throttle: 0..1)
  channel_count: uint8  % # Number of valid channels
  function: int8[32]  % # Functions mapping
  rssi: uint8  % # Receive signal strength index
  signal_lost: boolean  % # Control signal lost, should be checked together with topic timeout
  frame_drop_count: uint32  % # Number of dropped frames

px4_rc_parameter_map = Simulink.Bus()
  timestamp: fixdt(0,64,0)  % # time since system start (microseconds)
  valid: boolean[3]  % #true for RC-Param channels which are mapped to a param
  param_index: int32[3]  % # corresponding param index, this field is ignored if set to -1, in this case param_id will be used
  param_id: int8[51]  % # MAP_NCHAN * (ID_LEN + 1) chars, corresponding param id, null terminated
  scale: single[3]  % # scale to map the RC input [-1, 1] to a parameter value
  value0: single[3]  % # initial value around which the parameter value is changed
  value_min: single[3]  % # minimal parameter value
  value_max: single[3]  % # minimal parameter value

PX4_RC_PARAMETER_MAP = enum(AddClassNameToEnumNames=true)
  RC_PARAM_MAP_NCHAN = 3  % # This limit is also hardcoded in the enum RC_CHANNELS_FUNCTION in rc_channels.h
  PARAM_ID_LEN = 16  % # corresponds to MAVLINK_MSG_PARAM_VALUE_FIELD_PARAM_ID_LEN

px4_rpm = Simulink.Bus()
  timestamp: fixdt(0,64,0)  % # time since system start (microseconds)
  indicated_frequency_rpm: single  % # indicated rotor Frequency in Revolution per minute
  estimated_accurancy_rpm: single  % # estimated accurancy in Revolution per minute

px4_rtl_flight_time = Simulink.Bus()
  timestamp: fixdt(0,64,0)  % # time since system start (microseconds)
  rtl_time_s: single  % # how long in seconds will the RTL take
  rtl_limit_fraction: single  % # what fraction of the allowable RTL time would be taken

px4_safety = Simulink.Bus()
  timestamp: fixdt(0,64,0)  % # time since system start (microseconds)
  safety_switch_available: boolean  % # Set to true if a safety switch is connected
  safety_off: boolean  % # Set to true if safety is off
  override_available: boolean  % # Set to true if external override system is connected
  override_enabled: boolean  % # Set to true if override is engaged

px4_satellite_info = Simulink.Bus()
  timestamp: fixdt(0,64,0)  % # time since system start (microseconds)
  count: uint8  % # Number of satellites visible to the receiver
  svid: uint8[20]  % # Space vehicle ID [1..255], see scheme below
  used: uint8[20]  % # 0: Satellite not used, 1: used for navigation
  elevation: uint8[20]  % # Elevation (0: right on top of receiver, 90: on the horizon) of satellite
  azimuth: uint8[20]  % # Direction of satellite, 0: 0 deg, 255: 360 deg.
  snr: uint8[20]  % # dBHz, Signal to noise ratio of satellite C/N0, range 0..99, zero when not tracking this satellite.
  prn: uint8[20]  % # Satellite PRN code assignment, (psuedorandom number SBAS, valid codes are 120-144)

PX4_SATELLITE_INFO = enum(AddClassNameToEnumNames=true)
  SAT_INFO_MAX_SATELLITES = 20

px4_sensors_status_imu = Simulink.Bus()
  timestamp: fixdt(0,64,0)  % # time since system start (microseconds)
  accel_device_id_primary: uint32  % # current primary accel device id for reference
  accel_device_ids: uint32[4]
  accel_inconsistency_m_s_s: single[4]  % # magnitude of acceleration difference between IMU instance and mean in m/s^2.
  accel_healthy: boolean[4]
  accel_priority: uint8[4]
  gyro_device_id_primary: uint32  % # current primary gyro device id for reference
  gyro_device_ids: uint32[4]
  gyro_inconsistency_rad_s: single[4]  % # magnitude of angular rate difference between IMU instance and mean in (rad/s).
  gyro_healthy: boolean[4]
  gyro_priority: uint8[4]

px4_sensor_accel = Simulink.Bus()
  timestamp: fixdt(0,64,0)  % # time since system start (microseconds)
  timestamp_sample: fixdt(0,64,0)
  device_id: uint32  % # unique device ID for the sensor that does not change between power cycles
  x: single  % # acceleration in the FRD board frame X-axis in m/s^2
  y: single  % # acceleration in the FRD board frame Y-axis in m/s^2
  z: single  % # acceleration in the FRD board frame Z-axis in m/s^2
  temperature: single  % # temperature in degrees Celsius
  error_count: uint32
  clip_counter: uint8[3]  % # clip count per axis in the sample period
  samples: uint8  % # number of raw samples that went into this message

PX4_SENSOR_ACCEL = enum(AddClassNameToEnumNames=true)
  ORB_QUEUE_LENGTH = 8

px4_sensor_baro = Simulink.Bus()
  timestamp: fixdt(0,64,0)  % # time since system start (microseconds)
  timestamp_sample: fixdt(0,64,0)
  device_id: uint32  % # unique device ID for the sensor that does not change between power cycles
  error_count: uint32
  pressure: single  % # static pressure measurement in millibar
  temperature: single  % # static temperature measurement in deg Celsius

px4_sensor_combined = Simulink.Bus()
  timestamp: fixdt(0,64,0)  % # time since system start (microseconds)
  gyro_rad: single[3]  % # average angular rate measured in the FRD body frame XYZ-axis in rad/s over the last gyro sampling period
  gyro_integral_dt: uint32  % # gyro measurement sampling period in microseconds
  accelerometer_timestamp_relative: int32  % # timestamp + accelerometer_timestamp_relative = Accelerometer timestamp
  accelerometer_m_s2: single[3]  % # average value acceleration measured in the FRD body frame XYZ-axis in m/s^2 over the last accelerometer sampling period
  accelerometer_integral_dt: uint32  % # accelerometer measurement sampling period in microseconds
  accelerometer_clipping: uint8  % # bitfield indicating if there was any accelerometer clipping (per axis) during the sampling period

PX4_SENSOR_COMBINED = enum(AddClassNameToEnumNames=true)
  RELATIVE_TIMESTAMP_INVALID = 2147483647  % # (0x7fffffff) If one of the relative timestamps is set to this value, it means the associated sensor values are invalid
  CLIPPING_X = 1
  CLIPPING_Y = 2
  CLIPPING_Z = 4

px4_sensor_correction = Simulink.Bus()
  timestamp: fixdt(0,64,0)  % # time since system start (microseconds)
  gyro_device_ids: uint32[4]
  gyro_temperature: single[4]
  gyro_offset_0: single[3]  % # gyro 0 XYZ offsets in the sensor frame in rad/s
  gyro_offset_1: single[3]  % # gyro 1 XYZ offsets in the sensor frame in rad/s
  gyro_offset_2: single[3]  % # gyro 2 XYZ offsets in the sensor frame in rad/s
  gyro_offset_3: single[3]  % # gyro 3 XYZ offsets in the sensor frame in rad/s
  accel_device_ids: uint32[4]
  accel_temperature: single[4]
  accel_offset_0: single[3]  % # accelerometer 0 offsets in the FRD board frame XYZ-axis in m/s^s
  accel_offset_1: single[3]  % # accelerometer 1 offsets in the FRD board frame XYZ-axis in m/s^s
  accel_offset_2: single[3]  % # accelerometer 2 offsets in the FRD board frame XYZ-axis in m/s^s
  accel_offset_3: single[3]  % # accelerometer 3 offsets in the FRD board frame XYZ-axis in m/s^s
  baro_device_ids: uint32[4]
  baro_temperature: single[4]
  baro_offset_0: single  % # barometric pressure 0 offsets in the sensor frame in Pascals
  baro_offset_1: single  % # barometric pressure 1 offsets in the sensor frame in Pascals
  baro_offset_2: single  % # barometric pressure 2 offsets in the sensor frame in Pascals
  baro_offset_3: single  % # barometric pressure 3 offsets in the sensor frame in Pascals

px4_sensor_gps = Simulink.Bus()
  timestamp: fixdt(0,64,0)  % # time since system start (microseconds)
  device_id: uint32  % # unique device ID for the sensor that does not change between power cycles
  lat: int32  % # Latitude in 1E-7 degrees
  lon: int32  % # Longitude in 1E-7 degrees
  alt: int32  % # Altitude in 1E-3 meters above MSL, (millimetres)
  alt_ellipsoid: int32  % # Altitude in 1E-3 meters bove Ellipsoid, (millimetres)
  s_variance_m_s: single  % # GPS speed accuracy estimate, (metres/sec)
  c_variance_rad: single  % # GPS course accuracy estimate, (radians)
  fix_type: uint8  % # 0-1: no fix, 2: 2D fix, 3: 3D fix, 4: RTCM code differential, 5: Real-Time Kinematic, float, 6: Real-Time Kinematic, fixed, 8: Extrapolated. Some applications will not use the value of this field unless it is at least two, so always correctly fill in the fix.
  eph: single  % # GPS horizontal position accuracy (metres)
  epv: single  % # GPS vertical position accuracy (metres)
  hdop: single  % # Horizontal dilution of precision
  vdop: single  % # Vertical dilution of precision
  noise_per_ms: int32  % # GPS noise per millisecond
  automatic_gain_control: uint16  % # Automatic gain control monitor
  jamming_indicator: int32  % # indicates jamming is occurring
  jamming_state: uint8  % # indicates whether jamming has been detected or suspected by the receivers. O: Unknown, 1: OK, 2: Warning, 3: Critical
  vel_m_s: single  % # GPS ground speed, (metres/sec)
  vel_n_m_s: single  % # GPS North velocity, (metres/sec)
  vel_e_m_s: single  % # GPS East velocity, (metres/sec)
  vel_d_m_s: single  % # GPS Down velocity, (metres/sec)
  cog_rad: single  % # Course over ground (NOT heading, but direction of movement), -PI..PI, (radians)
  vel_ned_valid: boolean  % # True if NED velocity is valid
  timestamp_time_relative: int32  % # timestamp + timestamp_time_relative = Time of the UTC timestamp since system start, (microseconds)
  time_utc_usec: fixdt(0,64,0)  % # Timestamp (microseconds, UTC), this is the timestamp which comes from the gps module. It might be unavailable right after cold start, indicated by a value of 0
  satellites_used: uint8  % # Number of satellites used
  heading: single  % # heading angle of XYZ body frame rel to NED. Set to NaN if not available and updated (used for dual antenna GPS), (rad, [-PI, PI])
  heading_offset: single  % # heading offset of dual antenna array in body frame. Set to NaN if not applicable. (rad, [-PI, PI])

px4_sensor_gyro = Simulink.Bus()
  timestamp: fixdt(0,64,0)  % # time since system start (microseconds)
  timestamp_sample: fixdt(0,64,0)
  device_id: uint32  % # unique device ID for the sensor that does not change between power cycles
  x: single  % # angular velocity in the FRD board frame X-axis in rad/s
  y: single  % # angular velocity in the FRD board frame Y-axis in rad/s
  z: single  % # angular velocity in the FRD board frame Z-axis in rad/s
  temperature: single  % # temperature in degrees Celsius
  error_count: uint32
  samples: uint8  % # number of raw samples that went into this message

PX4_SENSOR_GYRO = enum(AddClassNameToEnumNames=true)
  ORB_QUEUE_LENGTH = 8

px4_sensor_gyro_fft = Simulink.Bus()
  timestamp: fixdt(0,64,0)  % # time since system start (microseconds)
  timestamp_sample: fixdt(0,64,0)
  device_id: uint32  % # unique device ID for the sensor that does not change between power cycles
  sensor_sample_rate_hz: single
  resolution_hz: single
  peak_frequencies_x: single[3]  % # x axis peak frequencies
  peak_frequencies_y: single[3]  % # y axis peak frequencies
  peak_frequencies_z: single[3]  % # z axis peak frequencies
  peak_snr_x: single[3]  % # x axis peak SNR
  peak_snr_y: single[3]  % # y axis peak SNR
  peak_snr_z: single[3]  % # z axis peak SNR

PX4_SENSOR_GYRO_FIFO = enum(AddClassNameToEnumNames=true)
  ORB_QUEUE_LENGTH = 4

px4_sensor_mag = Simulink.Bus()
  timestamp: fixdt(0,64,0)  % # time since system start (microseconds)
  timestamp_sample: fixdt(0,64,0)
  device_id: uint32  % # unique device ID for the sensor that does not change between power cycles
  x: single  % # magnetic field in the FRD board frame X-axis in Gauss
  y: single  % # magnetic field in the FRD board frame Y-axis in Gauss
  z: single  % # magnetic field in the FRD board frame Z-axis in Gauss
  temperature: single  % # temperature in degrees Celsius
  error_count: uint32
  is_external: boolean  % # if true the mag is external (i.e. not built into the board)

PX4_SENSOR_MAG = enum(AddClassNameToEnumNames=true)
  ORB_QUEUE_LENGTH = 4

px4_sensor_preflight_mag = Simulink.Bus()
  timestamp: fixdt(0,64,0)  % # time since system start (microseconds)
  mag_inconsistency_angle: single  % # maximum angle between magnetometer instance field vectors in radians.

px4_sensor_selection = Simulink.Bus()
  timestamp: fixdt(0,64,0)  % # time since system start (microseconds)
  accel_device_id: uint32  % # unique device ID for the selected accelerometers
  gyro_device_id: uint32  % # unique device ID for the selected rate gyros

px4_system_power = Simulink.Bus()
  timestamp: fixdt(0,64,0)  % # time since system start (microseconds)
  voltage5v_v: single  % # peripheral 5V rail voltage
  sensors3v3: single[4]  % # Sensors 3V3 rail voltage
  sensors3v3_valid: uint8  % # Sensors 3V3 rail voltage was read (bitfield).
  usb_connected: uint8  % # USB is connected when 1
  brick_valid: uint8  % # brick bits power is good when bit 1
  usb_valid: uint8  % # USB is valid when 1
  servo_valid: uint8  % # servo power is good when 1
  periph_5v_oc: uint8  % # peripheral overcurrent when 1
  hipower_5v_oc: uint8  % # high power peripheral overcurrent when 1
  comp_5v_valid: uint8  % # 5V to companion valid
  can1_gps1_5v_valid: uint8  % # 5V for CAN1/GPS1 valid

PX4_SYSTEM_POWER = enum(AddClassNameToEnumNames=true)
  BRICK1_VALID_SHIFTS = 0
  BRICK1_VALID_MASK = 1
  BRICK2_VALID_SHIFTS = 1
  BRICK2_VALID_MASK = 2
  BRICK3_VALID_SHIFTS = 2
  BRICK3_VALID_MASK = 4
  BRICK4_VALID_SHIFTS = 3
  BRICK4_VALID_MASK = 8

px4_takeoff_status = Simulink.Bus()
  timestamp: fixdt(0,64,0)  % # time since system start (microseconds)
  takeoff_state: uint8
  tilt_limit: single  % # limited tilt feasability during takeoff, contains maximum tilt otherwise

PX4_TAKEOFF_STATUS = enum(AddClassNameToEnumNames=true)
  TAKEOFF_STATE_UNINITIALIZED = 0
  TAKEOFF_STATE_DISARMED = 1
  TAKEOFF_STATE_SPOOLUP = 2
  TAKEOFF_STATE_READY_FOR_TAKEOFF = 3
  TAKEOFF_STATE_RAMPUP = 4
  TAKEOFF_STATE_FLIGHT = 5

px4_task_stack_info = Simulink.Bus()
  timestamp: fixdt(0,64,0)  % # time since system start (microseconds)
  stack_free: uint16
  task_name: int8[24]

PX4_TASK_STACK_INFO = enum(AddClassNameToEnumNames=true)
  ORB_QUEUE_LENGTH = 2

px4_tecs_status = Simulink.Bus()
  timestamp: fixdt(0,64,0)  % # time since system start (microseconds)
  altitude_sp: single
  altitude_filtered: single
  height_rate_setpoint: single
  height_rate: single
  equivalent_airspeed_sp: single
  true_airspeed_sp: single
  true_airspeed_filtered: single
  true_airspeed_derivative_sp: single
  true_airspeed_derivative: single
  true_airspeed_derivative_raw: single
  true_airspeed_innovation: single
  total_energy_error: single
  energy_distribution_error: single
  total_energy_rate_error: single
  energy_distribution_rate_error: single
  total_energy: single
  total_energy_rate: single
  total_energy_balance: single
  total_energy_balance_rate: single
  total_energy_sp: single
  total_energy_rate_sp: single
  total_energy_balance_sp: single
  total_energy_balance_rate_sp: single
  throttle_integ: single
  pitch_integ: single
  throttle_sp: single
  pitch_sp_rad: single
  mode: uint8

PX4_TECS_STATUS = enum(AddClassNameToEnumNames=true)
  TECS_MODE_NORMAL = 0
  TECS_MODE_UNDERSPEED = 1
  TECS_MODE_TAKEOFF = 2
  TECS_MODE_LAND = 3
  TECS_MODE_LAND_THROTTLELIM = 4
  TECS_MODE_BAD_DESCENT = 5
  TECS_MODE_CLIMBOUT = 6

px4_telemetry_status = Simulink.Bus()
  timestamp: fixdt(0,64,0)  % # time since system start (microseconds)
  type: uint8  % #  type of the radio hardware (LINK_TYPE_*)
  mode: uint8
  flow_control: boolean
  forwarding: boolean
  mavlink_v2: boolean
  ftp: boolean
  streams: uint8
  data_rate: single  % # configured maximum data rate (Bytes/s)
  rate_multiplier: single
  tx_rate_avg: single  % # transmit rate average (Bytes/s)
  tx_error_rate_avg: single  % # transmit error rate average (Bytes/s)
  tx_message_count: uint32  % # total message sent count
  tx_buffer_overruns: uint32  % # number of TX buffer overruns
  rx_rate_avg: single  % # transmit rate average (Bytes/s)
  rx_message_count: uint32  % # count of total messages received
  rx_message_lost_count: uint32
  rx_buffer_overruns: uint32  % # number of RX buffer overruns
  rx_parse_errors: uint32  % # number of parse errors
  rx_packet_drop_count: uint32  % # number of packet drops
  rx_message_lost_rate: single
  heartbeat_type_antenna_tracker: boolean  % # MAV_TYPE_ANTENNA_TRACKER
  heartbeat_type_gcs: boolean  % # MAV_TYPE_GCS
  heartbeat_type_onboard_controller: boolean  % # MAV_TYPE_ONBOARD_CONTROLLER
  heartbeat_type_gimbal: boolean  % # MAV_TYPE_GIMBAL
  heartbeat_type_adsb: boolean  % # MAV_TYPE_ADSB
  heartbeat_type_camera: boolean  % # MAV_TYPE_CAMERA
  heartbeat_component_telemetry_radio: boolean  % # MAV_COMP_ID_TELEMETRY_RADIO
  heartbeat_component_log: boolean  % # MAV_COMP_ID_LOG
  heartbeat_component_osd: boolean  % # MAV_COMP_ID_OSD
  heartbeat_component_obstacle_avoidance: boolean  % # MAV_COMP_ID_OBSTACLE_AVOIDANCE
  heartbeat_component_vio: boolean  % # MAV_COMP_ID_VISUAL_INERTIAL_ODOMETRY
  heartbeat_component_pairing_manager: boolean  % # MAV_COMP_ID_PAIRING_MANAGER
  heartbeat_component_udp_bridge: boolean  % # MAV_COMP_ID_UDP_BRIDGE
  heartbeat_component_uart_bridge: boolean  % # MAV_COMP_ID_UART_BRIDGE
  avoidance_system_healthy: boolean

PX4_TELEMETRY_STATUS = enum(AddClassNameToEnumNames=true)
  LINK_TYPE_GENERIC = 0
  LINK_TYPE_UBIQUITY_BULLET = 1
  LINK_TYPE_WIRE = 2
  LINK_TYPE_USB = 3
  LINK_TYPE_IRIDIUM = 4
  HEARTBEAT_TIMEOUT_US = 1500000  % # Heartbeat timeout 1.5 seconds

px4_test_motor = Simulink.Bus()
  timestamp: fixdt(0,64,0)  % # time since system start (microseconds)
  action: uint8  % # one of ACTION_* (applies to all motors)
  motor_number: uint32  % # number of motor to spin [0..N-1]
  value: single  % # output power, range [0..1], -1 to stop individual motor
  timeout_ms: uint32  % # timeout in ms after which to exit test mode (if 0, do not time out)
  driver_instance: uint8  % # select output driver (for boards with multiple outputs, like IO+FMU)

PX4_TEST_MOTOR = enum(AddClassNameToEnumNames=true)
  NUM_MOTOR_OUTPUTS = 8
  ACTION_STOP = 0  % # stop all motors (disable motor test mode)
  ACTION_RUN = 1  % # run motor(s) (enable motor test mode)
  ORB_QUEUE_LENGTH = 4

px4_timesync = Simulink.Bus()
  timestamp: fixdt(0,64,0)  % # time since system start (microseconds)
  seq: uint8  % # timesync msg sequence
  tc1: fixdt(1,64,0)  % # time sync timestamp 1
  ts1: fixdt(1,64,0)  % # time sync timestamp 2

px4_timesync_status = Simulink.Bus()
  timestamp: fixdt(0,64,0)  % # time since system start (microseconds)
  source_protocol: uint8  % # timesync source. Source can be MAVLink or the microRTPS bridge
  remote_timestamp: fixdt(0,64,0)  % # remote system timestamp (microseconds)
  observed_offset: fixdt(1,64,0)  % # raw time offset directly observed from this timesync packet (microseconds)
  estimated_offset: fixdt(1,64,0)  % # smoothed time offset between companion system and PX4 (microseconds)
  round_trip_time: uint32  % # round trip time of this timesync packet (microseconds)

PX4_TIMESYNC_STATUS = enum(AddClassNameToEnumNames=true)
  SOURCE_PROTOCOL_MAVLINK = 0
  SOURCE_PROTOCOL_RTPS = 1

px4_trajectory_bezier = Simulink.Bus()
  timestamp: fixdt(0,64,0)  % # time since system start (microseconds)
  position: single[3]  % # local position x,y,z (metres)
  yaw: single  % # yaw angle (rad)
  delta: single  % # time it should take to get to this waypoint, if this is the final waypoint (seconds)

px4_trajectory_waypoint = Simulink.Bus()
  timestamp: fixdt(0,64,0)  % # time since system start (microseconds)
  position: single[3]
  velocity: single[3]
  acceleration: single[3]
  yaw: single
  yaw_speed: single
  point_valid: boolean
  type: uint8

px4_transponder_report = Simulink.Bus()
  timestamp: fixdt(0,64,0)  % # time since system start (microseconds)
  icao_address: uint32  % # ICAO address
  lat: double  % # Latitude, expressed as degrees
  lon: double  % # Longitude, expressed as degrees
  altitude_type: uint8  % # Type from ADSB_ALTITUDE_TYPE enum
  altitude: single  % # Altitude(ASL) in meters
  heading: single  % # Course over ground in radians, -pi to +pi, 0 is north
  hor_velocity: single  % # The horizontal velocity in m/s
  ver_velocity: single  % # The vertical velocity in m/s, positive is up
  callsign: int8[9]  % # The callsign, 8+null
  emitter_type: uint8  % # Type from ADSB_EMITTER_TYPE enum
  tslc: uint8  % # Time since last communication in seconds
  flags: uint16  % # Flags to indicate various statuses including valid data fields
  squawk: uint16  % # Squawk code
  uas_id: uint8[18]  % # Unique UAS ID

PX4_TRANSPONDER_REPORT = enum(AddClassNameToEnumNames=true)
  PX4_ADSB_FLAGS_VALID_COORDS = 1
  PX4_ADSB_FLAGS_VALID_ALTITUDE = 2
  PX4_ADSB_FLAGS_VALID_HEADING = 4
  PX4_ADSB_FLAGS_VALID_VELOCITY = 8
  PX4_ADSB_FLAGS_VALID_CALLSIGN = 16
  PX4_ADSB_FLAGS_VALID_SQUAWK = 32
  PX4_ADSB_FLAGS_RETRANSLATE = 256
  ADSB_EMITTER_TYPE_NO_INFO = 0
  ADSB_EMITTER_TYPE_LIGHT = 1
  ADSB_EMITTER_TYPE_SMALL = 2
  ADSB_EMITTER_TYPE_LARGE = 3
  ADSB_EMITTER_TYPE_HIGH_VORTEX_LARGE = 4
  ADSB_EMITTER_TYPE_HEAVY = 5
  ADSB_EMITTER_TYPE_HIGHLY_MANUV = 6
  ADSB_EMITTER_TYPE_ROTOCRAFT = 7
  ADSB_EMITTER_TYPE_UNASSIGNED = 8
  ADSB_EMITTER_TYPE_GLIDER = 9
  ADSB_EMITTER_TYPE_LIGHTER_AIR = 10
  ADSB_EMITTER_TYPE_PARACHUTE = 11
  ADSB_EMITTER_TYPE_ULTRA_LIGHT = 12
  ADSB_EMITTER_TYPE_UNASSIGNED2 = 13
  ADSB_EMITTER_TYPE_UAV = 14
  ADSB_EMITTER_TYPE_SPACE = 15
  ADSB_EMITTER_TYPE_UNASSGINED3 = 16
  ADSB_EMITTER_TYPE_EMERGENCY_SURFACE = 17
  ADSB_EMITTER_TYPE_SERVICE_SURFACE = 18
  ADSB_EMITTER_TYPE_POINT_OBSTACLE = 19
  ADSB_EMITTER_TYPE_ENUM_END = 20
  ORB_QUEUE_LENGTH = 8

px4_tune_control = Simulink.Bus()
  timestamp: fixdt(0,64,0)  % # time since system start (microseconds)
  tune_id: uint8  % # tune_id corresponding to TuneID::* from the tune_defaults.h in the tunes library
  tune_override: boolean  % # if true the tune which is playing will be stopped and the new started
  frequency: uint16  % # in Hz
  duration: uint32  % # in us
  silence: uint32  % # in us
  volume: uint8  % # value between 0-100 if supported by backend

PX4_TUNE_CONTROL = enum(AddClassNameToEnumNames=true)
  TUNE_ID_STOP = 0
  TUNE_ID_STARTUP = 1
  TUNE_ID_ERROR = 2
  TUNE_ID_NOTIFY_POSITIVE = 3
  TUNE_ID_NOTIFY_NEUTRAL = 4
  TUNE_ID_NOTIFY_NEGATIVE = 5
  TUNE_ID_ARMING_WARNING = 6
  TUNE_ID_BATTERY_WARNING_SLOW = 7
  TUNE_ID_BATTERY_WARNING_FAST = 8
  TUNE_ID_GPS_WARNING = 9
  TUNE_ID_ARMING_FAILURE = 10
  TUNE_ID_PARACHUTE_RELEASE = 11
  TUNE_ID_SINGLE_BEEP = 12
  TUNE_ID_HOME_SET = 13
  TUNE_ID_SD_INIT = 14
  TUNE_ID_SD_ERROR = 15
  TUNE_ID_PROG_PX4IO = 16
  TUNE_ID_PROG_PX4IO_OK = 17
  TUNE_ID_PROG_PX4IO_ERR = 18
  NUMBER_OF_TUNES = 19
  VOLUME_LEVEL_MIN = 0
  VOLUME_LEVEL_DEFAULT = 40
  VOLUME_LEVEL_MAX = 100
  ORB_QUEUE_LENGTH = 4

px4_uavcan_parameter_request = Simulink.Bus()
  timestamp: fixdt(0,64,0)  % # time since system start (microseconds)
  message_type: uint8  % # MAVLink message type: PARAM_REQUEST_READ, PARAM_REQUEST_LIST, PARAM_SET
  node_id: uint8  % # UAVCAN node ID mapped from MAVLink component ID
  param_id: int8[17]  % # MAVLink/UAVCAN parameter name
  param_index: int16  % # -1 if the param_id field should be used as identifier
  param_type: uint8  % # MAVLink parameter type
  int_value: fixdt(1,64,0)  % # current value if param_type is int-like
  real_value: single  % # current value if param_type is float-like

PX4_UAVCAN_PARAMETER_REQUEST = enum(AddClassNameToEnumNames=true)
  MESSAGE_TYPE_PARAM_REQUEST_READ = 20  % # MAVLINK_MSG_ID_PARAM_REQUEST_READ
  MESSAGE_TYPE_PARAM_REQUEST_LIST = 21  % # MAVLINK_MSG_ID_PARAM_REQUEST_LIST
  MESSAGE_TYPE_PARAM_SET = 23  % # MAVLINK_MSG_ID_PARAM_SET
  NODE_ID_ALL = 0  % # MAV_COMP_ID_ALL
  PARAM_TYPE_UINT8 = 1  % # MAV_PARAM_TYPE_UINT8
  PARAM_TYPE_INT64 = 8  % # MAV_PARAM_TYPE_INT64
  PARAM_TYPE_REAL32 = 9  % # MAV_PARAM_TYPE_REAL32
  ORB_QUEUE_LENGTH = 4

px4_uavcan_parameter_value = Simulink.Bus()
  timestamp: fixdt(0,64,0)  % # time since system start (microseconds)
  node_id: uint8  % # UAVCAN node ID mapped from MAVLink component ID
  param_id: int8[17]  % # MAVLink/UAVCAN parameter name
  param_index: int16  % # parameter index, if known
  param_count: uint16  % # number of parameters exposed by the node
  param_type: uint8  % # MAVLink parameter type
  int_value: fixdt(1,64,0)  % # current value if param_type is int-like
  real_value: single  % # current value if param_type is float-like

px4_ulog_stream = Simulink.Bus()
  timestamp: fixdt(0,64,0)  % # time since system start (microseconds)
  length: uint8  % # length of data
  first_message_offset: uint8  % # offset into data where first message starts. This
  msg_sequence: uint16  % # allows determine drops
  flags: uint8  % # see FLAGS_*
  data: uint8[249]  % # ulog data

PX4_ULOG_STREAM = enum(AddClassNameToEnumNames=true)
  FLAGS_NEED_ACK = 1  % # if set, this message requires to be acked.
  ORB_QUEUE_LENGTH = 16  % # TODO: we might be able to reduce this if mavlink polled on the topic

px4_ulog_stream_ack = Simulink.Bus()
  timestamp: fixdt(0,64,0)  % # time since system start (microseconds)
  msg_sequence: uint16

PX4_ULOG_STREAM_ACK = enum(AddClassNameToEnumNames=true)
  ACK_TIMEOUT = 50  % # timeout waiting for an ack until we retry to send the message [ms]
  ACK_MAX_TRIES = 50  % # maximum amount of tries to (re-)send a message, each time waiting ACK_TIMEOUT ms

px4_vehicle_acceleration = Simulink.Bus()
  timestamp: fixdt(0,64,0)  % # time since system start (microseconds)
  timestamp_sample: fixdt(0,64,0)  % # the timestamp of the raw data (microseconds)
  xyz: single[3]  % # Bias corrected acceleration (including gravity) in the FRD body frame XYZ-axis in m/s^2

px4_vehicle_actuator_setpoint = Simulink.Bus()
  timestamp: fixdt(0,64,0)  % # time since system start (microseconds)
  timestamp_sample: fixdt(0,64,0)  % # the timestamp the data this control response is based on was sampled
  actuator: single[16]

PX4_VEHICLE_ACTUATOR_SETPOINT = enum(AddClassNameToEnumNames=true)
  NUM_ACTUATOR_SETPOINT = 16

px4_vehicle_air_data = Simulink.Bus()
  timestamp: fixdt(0,64,0)  % # time since system start (microseconds)
  timestamp_sample: fixdt(0,64,0)  % # the timestamp of the raw data (microseconds)
  baro_device_id: uint32  % # unique device ID for the selected barometer
  baro_alt_meter: single  % # Altitude above MSL calculated from temperature compensated baro sensor data using an ISA corrected for sea level pressure SENS_BARO_QNH.
  baro_temp_celcius: single  % # Temperature in degrees Celsius
  baro_pressure_pa: single  % # Absolute pressure in Pascals
  rho: single  % # air density

px4_vehicle_angular_acceleration = Simulink.Bus()
  timestamp: fixdt(0,64,0)  % # time since system start (microseconds)
  timestamp_sample: fixdt(0,64,0)  % # timestamp of the data sample on which this message is based (microseconds)
  xyz: single[3]  % # angular acceleration about the FRD body frame XYZ-axis in rad/s^2

px4_vehicle_angular_acceleration_setpoint = Simulink.Bus()
  timestamp: fixdt(0,64,0)  % # time since system start (microseconds)
  timestamp_sample: fixdt(0,64,0)  % # timestamp of the data sample on which this message is based (microseconds)
  xyz: single[3]  % # angular acceleration about X, Y, Z body axis in rad/s^2

px4_vehicle_angular_velocity = Simulink.Bus()
  timestamp: fixdt(0,64,0)  % # time since system start (microseconds)
  timestamp_sample: fixdt(0,64,0)  % # timestamp of the data sample on which this message is based (microseconds)
  xyz: single[3]  % # Bias corrected angular velocity about the FRD body frame XYZ-axis in rad/s

px4_vehicle_attitude = Simulink.Bus()
  timestamp: fixdt(0,64,0)  % # time since system start (microseconds)
  timestamp_sample: fixdt(0,64,0)  % # the timestamp of the raw data (microseconds)
  q: single[4]  % # Quaternion rotation from the FRD body frame to the NED earth frame
  delta_q_reset: single[4]  % # Amount by which quaternion has changed during last reset
  quat_reset_counter: uint8  % # Quaternion reset counter

PX4_VEHICLE_ATTITUDE_SETPOINT = enum(AddClassNameToEnumNames=true)
  FLAPS_OFF = 0  % # no flaps
  FLAPS_LAND = 1  % # landing config flaps
  FLAPS_TAKEOFF = 2  % # take-off config flaps

px4_vehicle_command = Simulink.Bus()
  timestamp: fixdt(0,64,0)  % # time since system start (microseconds)
  param1: single  % # Parameter 1, as defined by MAVLink uint16 VEHICLE_CMD enum.
  param2: single  % # Parameter 2, as defined by MAVLink uint16 VEHICLE_CMD enum.
  param3: single  % # Parameter 3, as defined by MAVLink uint16 VEHICLE_CMD enum.
  param4: single  % # Parameter 4, as defined by MAVLink uint16 VEHICLE_CMD enum.
  param5: double  % # Parameter 5, as defined by MAVLink uint16 VEHICLE_CMD enum.
  param6: double  % # Parameter 6, as defined by MAVLink uint16 VEHICLE_CMD enum.
  param7: single  % # Parameter 7, as defined by MAVLink uint16 VEHICLE_CMD enum.
  command: uint32  % # Command ID
  target_system: uint8  % # System which should execute the command
  target_component: uint8  % # Component which should execute the command, 0 for all components
  source_system: uint8  % # System sending the command
  source_component: uint8  % # Component sending the command
  confirmation: uint8  % # 0: First transmission of this command. 1-255: Confirmation transmissions (e.g. for kill command)
  from_external: boolean

PX4_VEHICLE_COMMAND = enum(AddClassNameToEnumNames=true)
  VEHICLE_CMD_CUSTOM_0 = 0  % # test command
  VEHICLE_CMD_CUSTOM_1 = 1  % # test command
  VEHICLE_CMD_CUSTOM_2 = 2  % # test command
  VEHICLE_CMD_NAV_WAYPOINT = 16  % # Navigate to MISSION. |Hold time in decimal seconds. (ignored by fixed wing, time to stay at MISSION for rotary wing)| Acceptance radius in meters (if the sphere with this radius is hit, the MISSION counts as reached)| 0 to pass through the WP, if > 0 radius in meters to pass by WP. Positive value for clockwise orbit, negative value for counter-clockwise orbit. Allows trajectory control.| Desired yaw angle at MISSION (rotary wing)| Latitude| Longitude| Altitude|
  VEHICLE_CMD_NAV_LOITER_UNLIM = 17  % # Loiter around this MISSION an unlimited amount of time |Empty| Empty| Radius around MISSION, in meters. If positive loiter clockwise, else counter-clockwise| Desired yaw angle.| Latitude| Longitude| Altitude|
  VEHICLE_CMD_NAV_LOITER_TURNS = 18  % # Loiter around this MISSION for X turns |Turns| Empty| Radius around MISSION, in meters. If positive loiter clockwise, else counter-clockwise| Desired yaw angle.| Latitude| Longitude| Altitude|
  VEHICLE_CMD_NAV_LOITER_TIME = 19  % # Loiter around this MISSION for X seconds |Seconds (decimal)| Empty| Radius around MISSION, in meters. If positive loiter clockwise, else counter-clockwise| Desired yaw angle.| Latitude| Longitude| Altitude|
  VEHICLE_CMD_NAV_RETURN_TO_LAUNCH = 20  % # Return to launch location |Empty| Empty| Empty| Empty| Empty| Empty| Empty|
  VEHICLE_CMD_NAV_LAND = 21  % # Land at location |Empty| Empty| Empty| Desired yaw angle.| Latitude| Longitude| Altitude|
  VEHICLE_CMD_NAV_TAKEOFF = 22  % # Takeoff from ground / hand |Minimum pitch (if airspeed sensor present), desired pitch without sensor| Empty| Empty| Yaw angle (if magnetometer present), ignored without magnetometer| Latitude| Longitude| Altitude|
  VEHICLE_CMD_NAV_PRECLAND = 23  % # Attempt a precision landing
  VEHICLE_CMD_DO_ORBIT = 34  % # Start orbiting on the circumference of a circle defined by the parameters. |Radius [m] |Velocity [m/s] |Yaw behaviour |Empty |Latitude/X |Longitude/Y |Altitude/Z |
  VEHICLE_CMD_NAV_ROI = 80  % # Sets the region of interest (ROI) for a sensor set or the vehicle itself. This can then be used by the vehicles control system to control the vehicle attitude and the attitude of various sensors such as cameras. |Region of interest mode. (see MAV_ROI enum)| MISSION index/ target ID. (see MAV_ROI enum)| ROI index (allows a vehicle to manage multiple ROI's)| Empty| x the location of the fixed ROI (see MAV_FRAME)| y| z|
  VEHICLE_CMD_NAV_PATHPLANNING = 81  % # Control autonomous path planning on the MAV. |0: Disable local obstacle avoidance / local path planning (without resetting map), 1: Enable local path planning, 2: Enable and reset local path planning| 0: Disable full path planning (without resetting map), 1: Enable, 2: Enable and reset map/occupancy grid, 3: Enable and reset planned route, but not occupancy grid| Empty| Yaw angle at goal, in compass degrees, [0..360]| Latitude/X of goal| Longitude/Y of goal| Altitude/Z of goal|
  VEHICLE_CMD_NAV_VTOL_TAKEOFF = 84  % # Takeoff from ground / hand and transition to fixed wing |Minimum pitch (if airspeed sensor present), desired pitch without sensor| Empty| Empty| Yaw angle (if magnetometer present), ignored without magnetometer| Latitude| Longitude| Altitude|
  VEHICLE_CMD_NAV_VTOL_LAND = 85  % # Transition to MC and land at location |Empty| Empty| Empty| Desired yaw angle.| Latitude| Longitude| Altitude|
  VEHICLE_CMD_NAV_GUIDED_LIMITS = 90  % # set limits for external control |timeout - maximum time (in seconds) that external controller will be allowed to control vehicle. 0 means no timeout| absolute altitude min (in meters, AMSL) - if vehicle moves below this alt, the command will be aborted and the mission will continue.  0 means no lower altitude limit| absolute altitude max (in meters)- if vehicle moves above this alt, the command will be aborted and the mission will continue.  0 means no upper altitude limit| horizontal move limit (in meters, AMSL) - if vehicle moves more than this distance from it's location at the moment the command was executed, the command will be aborted and the mission will continue. 0 means no horizontal altitude limit| Empty| Empty| Empty|
  VEHICLE_CMD_NAV_GUIDED_MASTER = 91  % # set id of master controller |System ID| Component ID| Empty| Empty| Empty| Empty| Empty|
  VEHICLE_CMD_NAV_DELAY = 93  % # Delay the next navigation command a number of seconds or until a specified time |Delay in seconds (decimal, -1 to enable time-of-day fields)| hour (24h format, UTC, -1 to ignore)| minute (24h format, UTC, -1 to ignore)| second (24h format, UTC)| Empty| Empty| Empty|
  VEHICLE_CMD_NAV_LAST = 95  % # NOP - This command is only used to mark the upper limit of the NAV/ACTION commands in the enumeration |Empty| Empty| Empty| Empty| Empty| Empty| Empty|
  VEHICLE_CMD_CONDITION_DELAY = 112  % # Delay mission state machine. |Delay in seconds (decimal)| Empty| Empty| Empty| Empty| Empty| Empty|
  VEHICLE_CMD_CONDITION_CHANGE_ALT = 113  % # Ascend/descend at rate.  Delay mission state machine until desired altitude reached. |Descent / Ascend rate (m/s)| Empty| Empty| Empty| Empty| Empty| Finish Altitude|
  VEHICLE_CMD_CONDITION_DISTANCE = 114  % # Delay mission state machine until within desired distance of next NAV point. |Distance (meters)| Empty| Empty| Empty| Empty| Empty| Empty|
  VEHICLE_CMD_CONDITION_YAW = 115  % # Reach a certain target angle. |target angle: [0-360], 0 is north| speed during yaw change:[deg per second]| direction: negative: counter clockwise, positive: clockwise [-1,1]| relative offset or absolute angle: [ 1,0]| Empty| Empty| Empty|
  VEHICLE_CMD_CONDITION_LAST = 159  % # NOP - This command is only used to mark the upper limit of the CONDITION commands in the enumeration |Empty| Empty| Empty| Empty| Empty| Empty| Empty|
  VEHICLE_CMD_CONDITION_GATE = 4501  % # Wait until passing a threshold |2D coord mode: 0: Orthogonal to planned route | Altitude mode: 0: Ignore altitude| Empty| Empty| Lat| Lon| Alt|
  VEHICLE_CMD_DO_SET_MODE = 176  % # Set system mode. |Mode, as defined by ENUM MAV_MODE| Empty| Empty| Empty| Empty| Empty| Empty|
  VEHICLE_CMD_DO_JUMP = 177  % # Jump to the desired command in the mission list.  Repeat this action only the specified number of times |Sequence number| Repeat count| Empty| Empty| Empty| Empty| Empty|
  VEHICLE_CMD_DO_CHANGE_SPEED = 178  % # Change speed and/or throttle set points. |Speed type (0=Airspeed, 1=Ground Speed)| Speed  (m/s, -1 indicates no change)| Throttle  ( Percent, -1 indicates no change)| Empty| Empty| Empty| Empty|
  VEHICLE_CMD_DO_SET_HOME = 179  % # Changes the home location either to the current location or a specified location. |Use current (1=use current location, 0=use specified location)| Empty| Empty| Empty| Latitude| Longitude| Altitude|
  VEHICLE_CMD_DO_SET_PARAMETER = 180  % # Set a system parameter.  Caution!  Use of this command requires knowledge of the numeric enumeration value of the parameter. |Parameter number| Parameter value| Empty| Empty| Empty| Empty| Empty|
  VEHICLE_CMD_DO_SET_RELAY = 181  % # Set a relay to a condition. |Relay number| Setting (1=on, 0=off, others possible depending on system hardware)| Empty| Empty| Empty| Empty| Empty|
  VEHICLE_CMD_DO_REPEAT_RELAY = 182  % # Cycle a relay on and off for a desired number of cyles with a desired period. |Relay number| Cycle count| Cycle time (seconds, decimal)| Empty| Empty| Empty| Empty|
  VEHICLE_CMD_DO_SET_SERVO = 183  % # Set a servo to a desired PWM value. |Servo number| PWM (microseconds, 1000 to 2000 typical)| Empty| Empty| Empty| Empty| Empty|
  VEHICLE_CMD_DO_REPEAT_SERVO = 184  % # Cycle a between its nominal setting and a desired PWM for a desired number of cycles with a desired period. |Servo number| PWM (microseconds, 1000 to 2000 typical)| Cycle count| Cycle time (seconds)| Empty| Empty| Empty|
  VEHICLE_CMD_DO_FLIGHTTERMINATION = 185  % # Terminate flight immediately |Flight termination activated if > 0.5| Empty| Empty| Empty| Empty| Empty| Empty|
  VEHICLE_CMD_DO_LAND_START = 189  % # Mission command to perform a landing. This is used as a marker in a mission to tell the autopilot where a sequence of mission items that represents a landing starts. It may also be sent via a COMMAND_LONG to trigger a landing, in which case the nearest (geographically) landing sequence in the mission will be used. The Latitude/Longitude is optional, and may be set to 0/0 if not needed. If specified then it will be used to help find the closest landing sequence. |Empty| Empty| Empty| Empty| Latitude| Longitude| Empty|  */
  VEHICLE_CMD_DO_GO_AROUND = 191  % # Mission command to safely abort an autonmous landing. |Altitude (meters)| Empty| Empty| Empty| Empty| Empty| Empty|  */
  VEHICLE_CMD_DO_REPOSITION = 192
  VEHICLE_CMD_DO_PAUSE_CONTINUE = 193
  VEHICLE_CMD_DO_SET_ROI_LOCATION = 195  % # Sets the region of interest (ROI) to a location. This can then be used by the vehicles control system to control the vehicle attitude and the attitude of various sensors such as cameras. |Empty| Empty| Empty| Empty| Latitude| Longitude| Altitude|
  VEHICLE_CMD_DO_SET_ROI_WPNEXT_OFFSET = 196  % # Sets the region of interest (ROI) to be toward next waypoint, with optional pitch/roll/yaw offset. This can then be used by the vehicles control system to control the vehicle attitude and the attitude of various sensors such as cameras. |Empty| Empty| Empty| Empty| pitch offset from next waypoint| roll offset from next waypoint| yaw offset from next waypoint|
  VEHICLE_CMD_DO_SET_ROI_NONE = 197  % # Cancels any previous ROI command returning the vehicle/sensors to default flight characteristics. This can then be used by the vehicles control system to control the vehicle attitude and the attitude of various sensors such as cameras. |Empty| Empty| Empty| Empty| Empty| Empty| Empty|
  VEHICLE_CMD_DO_CONTROL_VIDEO = 200  % # Control onboard camera system. |Camera ID (-1 for all)| Transmission: 0: disabled, 1: enabled compressed, 2: enabled raw| Transmission mode: 0: video stream, >0: single images every n seconds (decimal)| Recording: 0: disabled, 1: enabled compressed, 2: enabled raw| Empty| Empty| Empty|
  VEHICLE_CMD_DO_SET_ROI = 201  % # Sets the region of interest (ROI) for a sensor set or the vehicle itself. This can then be used by the vehicles control system to control the vehicle attitude and the attitude of various sensors such as cameras. |Region of interest mode. (see MAV_ROI enum)| MISSION index/ target ID. (see MAV_ROI enum)| ROI index (allows a vehicle to manage multiple ROI's)| Empty| x the location of the fixed ROI (see MAV_FRAME)| y| z|
  VEHICLE_CMD_DO_DIGICAM_CONTROL = 203
  VEHICLE_CMD_DO_MOUNT_CONFIGURE = 204  % # Mission command to configure a camera or antenna mount |Mount operation mode (see MAV_MOUNT_MODE enum)| stabilize roll? (1 = yes, 0 = no)| stabilize pitch? (1 = yes, 0 = no)| stabilize yaw? (1 = yes, 0 = no)| Empty| Empty| Empty|
  VEHICLE_CMD_DO_MOUNT_CONTROL = 205  % # Mission command to control a camera or antenna mount |pitch or lat in degrees, depending on mount mode.| roll or lon in degrees depending on mount mode| yaw or alt (in meters) depending on mount mode| reserved| reserved| reserved| MAV_MOUNT_MODE enum value|
  VEHICLE_CMD_DO_SET_CAM_TRIGG_DIST = 206  % # Mission command to set TRIG_DIST for this flight |Camera trigger distance (meters)| Shutter integration time (ms)| Empty| Empty| Empty| Empty| Empty|
  VEHICLE_CMD_DO_FENCE_ENABLE = 207  % # Mission command to enable the geofence |enable? (0=disable, 1=enable)| Empty| Empty| Empty| Empty| Empty| Empty|
  VEHICLE_CMD_DO_PARACHUTE = 208  % # Mission command to trigger a parachute |action (0=disable, 1=enable, 2=release, for some systems see PARACHUTE_ACTION enum, not in general message set.)| Empty| Empty| Empty| Empty| Empty| Empty|
  VEHICLE_CMD_DO_MOTOR_TEST = 209  % # motor test command |Instance (1, ...)| throttle type| throttle| timeout [s]| Motor count | Test order| Empty|
  VEHICLE_CMD_DO_INVERTED_FLIGHT = 210  % # Change to/from inverted flight |inverted (0=normal, 1=inverted)| Empty| Empty| Empty| Empty| Empty| Empty|
  VEHICLE_CMD_DO_SET_CAM_TRIGG_INTERVAL = 214  % # Mission command to set TRIG_INTERVAL for this flight |Camera trigger distance (meters)| Shutter integration time (ms)| Empty| Empty| Empty| Empty| Empty|
  VEHICLE_CMD_DO_MOUNT_CONTROL_QUAT = 220  % # Mission command to control a camera or antenna mount, using a quaternion as reference. |q1 - quaternion param #1, w (1 in null-rotation)| q2 - quaternion param #2, x (0 in null-rotation)| q3 - quaternion param #3, y (0 in null-rotation)| q4 - quaternion param #4, z (0 in null-rotation)| Empty| Empty| Empty|
  VEHICLE_CMD_DO_GUIDED_MASTER = 221  % # set id of master controller |System ID| Component ID| Empty| Empty| Empty| Empty| Empty|
  VEHICLE_CMD_DO_GUIDED_LIMITS = 222  % # set limits for external control |timeout - maximum time (in seconds) that external controller will be allowed to control vehicle. 0 means no timeout| absolute altitude min (in meters, AMSL) - if vehicle moves below this alt, the command will be aborted and the mission will continue.  0 means no lower altitude limit| absolute altitude max (in meters)- if vehicle moves above this alt, the command will be aborted and the mission will continue.  0 means no upper altitude limit| horizontal move limit (in meters, AMSL) - if vehicle moves more than this distance from it's location at the moment the command was executed, the command will be aborted and the mission will continue. 0 means no horizontal altitude limit| Empty| Empty| Empty|
  VEHICLE_CMD_DO_LAST = 240  % # NOP - This command is only used to mark the upper limit of the DO commands in the enumeration |Empty| Empty| Empty| Empty| Empty| Empty| Empty|
  VEHICLE_CMD_PREFLIGHT_CALIBRATION = 241  % # Trigger calibration. This command will be only accepted if in pre-flight mode. See mavlink spec MAV_CMD_PREFLIGHT_CALIBRATION
  PREFLIGHT_CALIBRATION_TEMPERATURE_CALIBRATION = 3  % # param value for VEHICLE_CMD_PREFLIGHT_CALIBRATION to start temperature calibration
  VEHICLE_CMD_PREFLIGHT_SET_SENSOR_OFFSETS = 242  % # Set sensor offsets. This command will be only accepted if in pre-flight mode. |Sensor to adjust the offsets for: 0: gyros, 1: accelerometer, 2: magnetometer, 3: barometer, 4: optical flow| X axis offset (or generic dimension 1), in the sensor's raw units| Y axis offset (or generic dimension 2), in the sensor's raw units| Z axis offset (or generic dimension 3), in the sensor's raw units| Generic dimension 4, in the sensor's raw units| Generic dimension 5, in the sensor's raw units| Generic dimension 6, in the sensor's raw units|
  VEHICLE_CMD_PREFLIGHT_UAVCAN = 243  % # UAVCAN configuration. If param 1 == 1 actuator mapping and direction assignment should be started
  VEHICLE_CMD_PREFLIGHT_STORAGE = 245  % # Request storage of different parameter values and logs. This command will be only accepted if in pre-flight mode. |Parameter storage: 0: READ FROM FLASH/EEPROM, 1: WRITE CURRENT TO FLASH/EEPROM| Mission storage: 0: READ FROM FLASH/EEPROM, 1: WRITE CURRENT TO FLASH/EEPROM| Reserved| Reserved| Empty| Empty| Empty|
  VEHICLE_CMD_PREFLIGHT_REBOOT_SHUTDOWN = 246  % # Request the reboot or shutdown of system components. |0: Do nothing for autopilot, 1: Reboot autopilot, 2: Shutdown autopilot.| 0: Do nothing for onboard computer, 1: Reboot onboard computer, 2: Shutdown onboard computer.| Reserved| Reserved| Empty| Empty| Empty|
  VEHICLE_CMD_OBLIQUE_SURVEY = 260  % # Mission command to set a Camera Auto Mount Pivoting Oblique Survey for this flight|Camera trigger distance (meters)| Shutter integration time (ms)| Camera minimum trigger interval| Number of positions| Roll| Pitch| Empty|
  VEHICLE_CMD_GIMBAL_DEVICE_INFORMATION = 283  % # Command to ask information about a low level gimbal
  VEHICLE_CMD_MISSION_START = 300  % # start running a mission |first_item: the first mission item to run| last_item:  the last mission item to run (after this item is run, the mission ends)|
  VEHICLE_CMD_COMPONENT_ARM_DISARM = 400  % # Arms / Disarms a component |1 to arm, 0 to disarm|
  VEHICLE_CMD_INJECT_FAILURE = 420  % # Inject artificial failure for testing purposes
  VEHICLE_CMD_START_RX_PAIR = 500  % # Starts receiver pairing |0:Spektrum| 0:Spektrum DSM2, 1:Spektrum DSMX|
  VEHICLE_CMD_REQUEST_MESSAGE = 512  % # Request to send a single instance of the specified message
  VEHICLE_CMD_SET_CAMERA_MODE = 530  % # Set camera capture mode (photo, video, etc.)
  VEHICLE_CMD_SET_CAMERA_ZOOM = 531  % # Set camera zoom
  VEHICLE_CMD_SET_CAMERA_FOCUS = 532
  VEHICLE_CMD_DO_GIMBAL_MANAGER_PITCHYAW = 1000  % # Setpoint to be sent to a gimbal manager to set a gimbal pitch and yaw
  VEHICLE_CMD_DO_GIMBAL_MANAGER_CONFIGURE = 1001  % # Gimbal configuration to set which sysid/compid is in primary and secondary control
  VEHICLE_CMD_DO_TRIGGER_CONTROL = 2003  % # Enable or disable on-board camera triggering system
  VEHICLE_CMD_LOGGING_START = 2510  % # start streaming ULog data
  VEHICLE_CMD_LOGGING_STOP = 2511  % # stop streaming ULog data
  VEHICLE_CMD_CONTROL_HIGH_LATENCY = 2600  % # control starting/stopping transmitting data over the high latency link
  VEHICLE_CMD_DO_VTOL_TRANSITION = 3000  % # Command VTOL transition
  VEHICLE_CMD_ARM_AUTHORIZATION_REQUEST = 3001  % # Request arm authorization
  VEHICLE_CMD_PAYLOAD_PREPARE_DEPLOY = 30001  % # Prepare a payload deployment in the flight plan
  VEHICLE_CMD_PAYLOAD_CONTROL_DEPLOY = 30002  % # Control a pre-programmed payload deployment
  VEHICLE_CMD_FIXED_MAG_CAL_YAW = 42006  % # Magnetometer calibration based on provided known yaw. This allows for fast calibration using WMM field tables in the vehicle, given only the known yaw of the vehicle. If Latitude and longitude are both zero then use the current vehicle location.
  VEHICLE_CMD_PX4_INTERNAL_START = 65537  % # start of PX4 internal only vehicle commands (> UINT16_MAX)
  VEHICLE_CMD_SET_GPS_GLOBAL_ORIGIN = 100000  % # Sets the GPS co-ordinates of the vehicle local origin (0,0,0) position. |Empty|Empty|Empty|Empty|Latitude|Longitude|Altitude|
  VEHICLE_CMD_RESULT_ACCEPTED = 0  % # Command ACCEPTED and EXECUTED |
  VEHICLE_CMD_RESULT_TEMPORARILY_REJECTED = 1  % # Command TEMPORARY REJECTED/DENIED |
  VEHICLE_CMD_RESULT_DENIED = 2  % # Command PERMANENTLY DENIED |
  VEHICLE_CMD_RESULT_UNSUPPORTED = 3  % # Command UNKNOWN/UNSUPPORTED |
  VEHICLE_CMD_RESULT_FAILED = 4  % # Command executed, but failed |
  VEHICLE_CMD_RESULT_IN_PROGRESS = 5  % # Command being executed |
  VEHICLE_CMD_RESULT_ENUM_END = 6  % #
  VEHICLE_MOUNT_MODE_RETRACT = 0  % # Load and keep safe position (Roll,Pitch,Yaw) from permanent memory and stop stabilization |
  VEHICLE_MOUNT_MODE_NEUTRAL = 1  % # Load and keep neutral position (Roll,Pitch,Yaw) from permanent memory. |
  VEHICLE_MOUNT_MODE_MAVLINK_TARGETING = 2  % # Load neutral position and start MAVLink Roll,Pitch,Yaw control with stabilization |
  VEHICLE_MOUNT_MODE_RC_TARGETING = 3  % # Load neutral position and start RC Roll,Pitch,Yaw control with stabilization |
  VEHICLE_MOUNT_MODE_GPS_POINT = 4  % # Load neutral position and start to point to Lat,Lon,Alt |
  VEHICLE_MOUNT_MODE_ENUM_END = 5  % #
  VEHICLE_ROI_NONE = 0  % # No region of interest |
  VEHICLE_ROI_WPNEXT = 1  % # Point toward next MISSION |
  VEHICLE_ROI_WPINDEX = 2  % # Point toward given MISSION |
  VEHICLE_ROI_LOCATION = 3  % # Point toward fixed location |
  VEHICLE_ROI_TARGET = 4  % # Point toward target
  VEHICLE_ROI_ENUM_END = 5
  VEHICLE_CAMERA_ZOOM_TYPE_STEP = 0  % # Zoom one step increment
  VEHICLE_CAMERA_ZOOM_TYPE_CONTINUOUS = 1  % # Continuous zoom up/down until stopped
  VEHICLE_CAMERA_ZOOM_TYPE_RANGE = 2  % # Zoom value as proportion of full camera range
  VEHICLE_CAMERA_ZOOM_TYPE_FOCAL_LENGTH = 3  % # Zoom to a focal length
  PARACHUTE_ACTION_DISABLE = 0
  PARACHUTE_ACTION_ENABLE = 1
  PARACHUTE_ACTION_RELEASE = 2
  FAILURE_UNIT_SENSOR_GYRO = 0
  FAILURE_UNIT_SENSOR_ACCEL = 1
  FAILURE_UNIT_SENSOR_MAG = 2
  FAILURE_UNIT_SENSOR_BARO = 3
  FAILURE_UNIT_SENSOR_GPS = 4
  FAILURE_UNIT_SENSOR_OPTICAL_FLOW = 5
  FAILURE_UNIT_SENSOR_VIO = 6
  FAILURE_UNIT_SENSOR_DISTANCE_SENSOR = 7
  FAILURE_UNIT_SENSOR_AIRSPEED = 8
  FAILURE_UNIT_SYSTEM_BATTERY = 100
  FAILURE_UNIT_SYSTEM_MOTOR = 101
  FAILURE_UNIT_SYSTEM_SERVO = 102
  FAILURE_UNIT_SYSTEM_AVOIDANCE = 103
  FAILURE_UNIT_SYSTEM_RC_SIGNAL = 104
  FAILURE_UNIT_SYSTEM_MAVLINK_SIGNAL = 105
  FAILURE_TYPE_OK = 0
  FAILURE_TYPE_OFF = 1
  FAILURE_TYPE_STUCK = 2
  FAILURE_TYPE_GARBAGE = 3
  FAILURE_TYPE_WRONG = 4
  FAILURE_TYPE_SLOW = 5
  FAILURE_TYPE_DELAYED = 6
  FAILURE_TYPE_INTERMITTENT = 7
  ORB_QUEUE_LENGTH = 8

px4_vehicle_command_ack = Simulink.Bus()
  timestamp: fixdt(0,64,0)  % # time since system start (microseconds)
  command: uint32
  result: uint8
  from_external: boolean
  result_param1: uint8
  result_param2: int32
  target_system: uint8
  target_component: uint8

px4_vehicle_constraints = Simulink.Bus()
  timestamp: fixdt(0,64,0)  % # time since system start (microseconds)
  speed_xy: single  % # in meters/sec
  speed_up: single  % # in meters/sec
  speed_down: single  % # in meters/sec
  want_takeoff: boolean  % # tell the controller to initiate takeoff when idling (ignored during flight)

px4_vehicle_control_mode = Simulink.Bus()
  timestamp: fixdt(0,64,0)  % # time since system start (microseconds)
  flag_armed: boolean  % # synonym for actuator_armed.armed
  flag_external_manual_override_ok: boolean  % # external override non-fatal for system. Only true for fixed wing
  flag_multicopter_position_control_enabled: boolean
  flag_control_manual_enabled: boolean  % # true if manual input is mixed in
  flag_control_auto_enabled: boolean  % # true if onboard autopilot should act
  flag_control_offboard_enabled: boolean  % # true if offboard control should be used
  flag_control_rates_enabled: boolean  % # true if rates are stabilized
  flag_control_attitude_enabled: boolean  % # true if attitude stabilization is mixed in
  flag_control_acceleration_enabled: boolean  % # true if acceleration is controlled
  flag_control_velocity_enabled: boolean  % # true if horizontal velocity (implies direction) is controlled
  flag_control_position_enabled: boolean  % # true if position is controlled
  flag_control_altitude_enabled: boolean  % # true if altitude is controlled
  flag_control_climb_rate_enabled: boolean  % # true if climb rate is controlled
  flag_control_termination_enabled: boolean  % # true if flighttermination is enabled

px4_vehicle_global_position = Simulink.Bus()
  timestamp: fixdt(0,64,0)  % # time since system start (microseconds)
  timestamp_sample: fixdt(0,64,0)  % # the timestamp of the raw data (microseconds)
  lat: double  % # Latitude, (degrees)
  lon: double  % # Longitude, (degrees)
  alt: single  % # Altitude AMSL, (meters)
  alt_ellipsoid: single  % # Altitude above ellipsoid, (meters)
  delta_alt: single  % # Reset delta for altitude
  lat_lon_reset_counter: uint8  % # Counter for reset events on horizontal position coordinates
  alt_reset_counter: uint8  % # Counter for reset events on altitude
  eph: single  % # Standard deviation of horizontal position error, (metres)
  epv: single  % # Standard deviation of vertical position error, (metres)
  terrain_alt: single  % # Terrain altitude WGS84, (metres)
  terrain_alt_valid: boolean  % # Terrain altitude estimate is valid
  dead_reckoning: boolean  % # True if this position is estimated through dead-reckoning

px4_vehicle_gps_position = Simulink.Bus()
  timestamp: fixdt(0,64,0)  % # time since system start (microseconds)
  lat: int32  % # Latitude in 1E-7 degrees
  lon: int32  % # Longitude in 1E-7 degrees
  alt: int32  % # Altitude in 1E-3 meters above MSL, (millimetres)
  alt_ellipsoid: int32  % # Altitude in 1E-3 meters bove Ellipsoid, (millimetres)
  s_variance_m_s: single  % # GPS speed accuracy estimate, (metres/sec)
  c_variance_rad: single  % # GPS course accuracy estimate, (radians)
  fix_type: uint8  % # 0-1: no fix, 2: 2D fix, 3: 3D fix, 4: RTCM code differential, 5: Real-Time Kinematic, float, 6: Real-Time Kinematic, fixed, 8: Extrapolated. Some applications will not use the value of this field unless it is at least two, so always correctly fill in the fix.
  eph: single  % # GPS horizontal position accuracy (metres)
  epv: single  % # GPS vertical position accuracy (metres)
  hdop: single  % # Horizontal dilution of precision
  vdop: single  % # Vertical dilution of precision
  noise_per_ms: int32  % # GPS noise per millisecond
  jamming_indicator: int32  % # indicates jamming is occurring
  jamming_state: uint8  % # indicates whether jamming has been detected or suspected by the receivers. O: Unknown, 1: OK, 2: Warning, 3: Critical
  vel_m_s: single  % # GPS ground speed, (metres/sec)
  vel_n_m_s: single  % # GPS North velocity, (metres/sec)
  vel_e_m_s: single  % # GPS East velocity, (metres/sec)
  vel_d_m_s: single  % # GPS Down velocity, (metres/sec)
  cog_rad: single  % # Course over ground (NOT heading, but direction of movement), -PI..PI, (radians)
  vel_ned_valid: boolean  % # True if NED velocity is valid
  timestamp_time_relative: int32  % # timestamp + timestamp_time_relative = Time of the UTC timestamp since system start, (microseconds)
  time_utc_usec: fixdt(0,64,0)  % # Timestamp (microseconds, UTC), this is the timestamp which comes from the gps module. It might be unavailable right after cold start, indicated by a value of 0
  satellites_used: uint8  % # Number of satellites used
  heading: single  % # heading angle of XYZ body frame rel to NED. Set to NaN if not available and updated (used for dual antenna GPS), (rad, [-PI, PI])
  heading_offset: single  % # heading offset of dual antenna array in body frame. Set to NaN if not applicable. (rad, [-PI, PI])
  selected: uint8  % # GPS selection: 0: GPS1, 1: GPS2. 2: GPS3. 3. Blending multiple receivers

px4_vehicle_imu = Simulink.Bus()
  timestamp: fixdt(0,64,0)  % # time since system start (microseconds)
  timestamp_sample: fixdt(0,64,0)
  accel_device_id: uint32  % # Accelerometer unique device ID for the sensor that does not change between power cycles
  gyro_device_id: uint32  % # Gyroscope unique device ID for the sensor that does not change between power cycles
  delta_angle: single[3]  % # delta angle about the FRD body frame XYZ-axis in rad over the integration time frame (delta_angle_dt)
  delta_velocity: single[3]  % # delta velocity in the FRD body frame XYZ-axis in m/s over the integration time frame (delta_velocity_dt)
  delta_angle_dt: uint16  % # integration period in microseconds
  delta_velocity_dt: uint16  % # integration period in microseconds
  delta_velocity_clipping: uint8  % # bitfield indicating if there was any accelerometer clipping (per axis) during the integration time frame
  calibration_count: uint8  % # Calibration changed counter. Monotonically increases whenever calibration changes.

PX4_VEHICLE_IMU = enum(AddClassNameToEnumNames=true)
  CLIPPING_X = 1
  CLIPPING_Y = 2
  CLIPPING_Z = 4

px4_vehicle_imu_status = Simulink.Bus()
  timestamp: fixdt(0,64,0)  % # time since system start (microseconds)
  accel_device_id: uint32  % # unique device ID for the sensor that does not change between power cycles
  gyro_device_id: uint32  % # unique device ID for the sensor that does not change between power cycles
  accel_clipping: uint32[3]  % # total clipping per axis
  accel_error_count: uint32
  gyro_error_count: uint32
  accel_rate_hz: single
  gyro_rate_hz: single
  accel_raw_rate_hz: single  % # full raw sensor sample rate (Hz)
  gyro_raw_rate_hz: single  % # full raw sensor sample rate (Hz)
  accel_vibration_metric: single  % # high frequency vibration level in the IMU delta velocity data (m/s)
  gyro_vibration_metric: single  % # high frequency vibration level in the IMU delta velocity data (m/s)
  gyro_coning_vibration: single  % # Level of coning vibration in the IMU delta angles (rad^2)
  mean_accel: single[3]  % # average accelerometer readings since last publication
  mean_gyro: single[3]  % # average gyroscope readings since last publication
  temperature_accel: single
  temperature_gyro: single

px4_vehicle_land_detected = Simulink.Bus()
  timestamp: fixdt(0,64,0)  % # time since system start (microseconds)
  alt_max: single  % # maximum altitude in [m] that can be reached
  freefall: boolean  % # true if vehicle is currently in free-fall
  ground_contact: boolean  % # true if vehicle has ground contact but is not landed (1. stage)
  maybe_landed: boolean  % # true if the vehicle might have landed (2. stage)
  landed: boolean  % # true if vehicle is currently landed on the ground (3. stage)
  in_ground_effect: boolean  % # indicates if from the perspective of the landing detector the vehicle might be in ground effect (baro). This flag will become true if the vehicle is not moving horizontally and is descending (crude assumption that user is landing).
  in_descend: boolean
  has_low_throttle: boolean
  vertical_movement: boolean
  horizontal_movement: boolean
  close_to_ground_or_skipped_check: boolean

px4_vehicle_local_position = Simulink.Bus()
  timestamp: fixdt(0,64,0)  % # time since system start (microseconds)
  timestamp_sample: fixdt(0,64,0)  % # the timestamp of the raw data (microseconds)
  xy_valid: boolean  % # true if x and y are valid
  z_valid: boolean  % # true if z is valid
  v_xy_valid: boolean  % # true if vy and vy are valid
  v_z_valid: boolean  % # true if vz is valid
  x: single  % # North position in NED earth-fixed frame, (metres)
  y: single  % # East position in NED earth-fixed frame, (metres)
  z: single  % # Down position (negative altitude) in NED earth-fixed frame, (metres)
  delta_xy: single[2]
  xy_reset_counter: uint8
  delta_z: single
  z_reset_counter: uint8
  vx: single  % # North velocity in NED earth-fixed frame, (metres/sec)
  vy: single  % # East velocity in NED earth-fixed frame, (metres/sec)
  vz: single  % # Down velocity in NED earth-fixed frame, (metres/sec)
  z_deriv: single  % # Down position time derivative in NED earth-fixed frame, (metres/sec)
  delta_vxy: single[2]
  vxy_reset_counter: uint8
  delta_vz: single
  vz_reset_counter: uint8
  ax: single  % # North velocity derivative in NED earth-fixed frame, (metres/sec^2)
  ay: single  % # East velocity derivative in NED earth-fixed frame, (metres/sec^2)
  az: single  % # Down velocity derivative in NED earth-fixed frame, (metres/sec^2)
  heading: single  % # Euler yaw angle transforming the tangent plane relative to NED earth-fixed frame, -PI..+PI,  (radians)
  delta_heading: single
  heading_reset_counter: uint8
  xy_global: boolean  % # true if position (x, y) has a valid global reference (ref_lat, ref_lon)
  z_global: boolean  % # true if z has a valid global reference (ref_alt)
  ref_timestamp: fixdt(0,64,0)  % # Time when reference position was set since system start, (microseconds)
  ref_lat: double  % # Reference point latitude, (degrees)
  ref_lon: double  % # Reference point longitude, (degrees)
  ref_alt: single  % # Reference altitude AMSL, (metres)
  dist_bottom: single  % # Distance from from bottom surface to ground, (metres)
  dist_bottom_valid: boolean  % # true if distance to bottom surface is valid
  dist_bottom_sensor_bitfield: uint8  % # bitfield indicating what type of sensor is used to estimate dist_bottom
  eph: single  % # Standard deviation of horizontal position error, (metres)
  epv: single  % # Standard deviation of vertical position error, (metres)
  evh: single  % # Standard deviation of horizontal velocity error, (metres/sec)
  evv: single  % # Standard deviation of horizontal velocity error, (metres/sec)
  vxy_max: single  % # maximum horizontal speed - set to 0 when limiting not required (meters/sec)
  vz_max: single  % # maximum vertical speed - set to 0 when limiting not required (meters/sec)
  hagl_min: single  % # minimum height above ground level - set to 0 when limiting not required (meters)
  hagl_max: single  % # maximum height above ground level - set to 0 when limiting not required (meters)

PX4_VEHICLE_LOCAL_POSITION = enum(AddClassNameToEnumNames=true)
  DIST_BOTTOM_SENSOR_NONE = 0
  DIST_BOTTOM_SENSOR_RANGE = 1  % # (1 << 0) a range sensor is used to estimate dist_bottom field
  DIST_BOTTOM_SENSOR_FLOW = 2  % # (1 << 1) a flow sensor is used to estimate dist_bottom field (mostly fixed-wing use case)

px4_vehicle_local_position_setpoint = Simulink.Bus()
  timestamp: fixdt(0,64,0)  % # time since system start (microseconds)
  x: single  % # in meters NED
  y: single  % # in meters NED
  z: single  % # in meters NED
  yaw: single  % # in radians NED -PI..+PI
  yawspeed: single  % # in radians/sec
  vx: single  % # in meters/sec
  vy: single  % # in meters/sec
  vz: single  % # in meters/sec
  acceleration: single[3]  % # in meters/sec^2
  jerk: single[3]  % # in meters/sec^3
  thrust: single[3]  % # normalized thrust vector in NED

px4_vehicle_magnetometer = Simulink.Bus()
  timestamp: fixdt(0,64,0)  % # time since system start (microseconds)
  timestamp_sample: fixdt(0,64,0)  % # the timestamp of the raw data (microseconds)
  device_id: uint32  % # unique device ID for the selected magnetometer
  magnetometer_ga: single[3]  % # Magnetic field in the FRD body frame XYZ-axis in Gauss
  calibration_count: uint8  % # Calibration changed counter. Monotonically increases whenever calibration changes.

px4_vehicle_odometry = Simulink.Bus()
  timestamp: fixdt(0,64,0)  % # time since system start (microseconds)
  timestamp_sample: fixdt(0,64,0)
  local_frame: uint8
  x: single  % # North position
  y: single  % # East position
  z: single  % # Down position
  q: single[4]  % # Quaternion rotation from FRD body frame to refernce frame
  q_offset: single[4]  % # Quaternion rotation from odometry reference frame to navigation frame
  pose_covariance: single[21]
  velocity_frame: uint8
  vx: single  % # North velocity
  vy: single  % # East velocity
  vz: single  % # Down velocity
  rollspeed: single  % # Angular velocity about X body axis
  pitchspeed: single  % # Angular velocity about Y body axis
  yawspeed: single  % # Angular velocity about Z body axis
  velocity_covariance: single[21]

PX4_VEHICLE_ODOMETRY = enum(AddClassNameToEnumNames=true)
  COVARIANCE_MATRIX_X_VARIANCE = 0
  COVARIANCE_MATRIX_Y_VARIANCE = 6
  COVARIANCE_MATRIX_Z_VARIANCE = 11
  COVARIANCE_MATRIX_ROLL_VARIANCE = 15
  COVARIANCE_MATRIX_PITCH_VARIANCE = 18
  COVARIANCE_MATRIX_YAW_VARIANCE = 20
  COVARIANCE_MATRIX_VX_VARIANCE = 0
  COVARIANCE_MATRIX_VY_VARIANCE = 6
  COVARIANCE_MATRIX_VZ_VARIANCE = 11
  COVARIANCE_MATRIX_ROLLRATE_VARIANCE = 15
  COVARIANCE_MATRIX_PITCHRATE_VARIANCE = 18
  COVARIANCE_MATRIX_YAWRATE_VARIANCE = 20
  LOCAL_FRAME_NED = 0  % # NED earth-fixed frame
  LOCAL_FRAME_FRD = 1  % # FRD earth-fixed frame, arbitrary heading reference
  LOCAL_FRAME_OTHER = 2  % # Not aligned with the std frames of reference
  BODY_FRAME_FRD = 3  % # FRD body-fixed frame

px4_vehicle_rates_setpoint = Simulink.Bus()
  timestamp: fixdt(0,64,0)  % # time since system start (microseconds)
  roll: single  % # body angular rates in NED frame
  pitch: single  % # body angular rates in NED frame
  yaw: single  % # body angular rates in NED frame
  thrust_body: single[3]  % # Normalized thrust command in body NED frame [-1,1]

px4_vehicle_roi = Simulink.Bus()
  timestamp: fixdt(0,64,0)  % # time since system start (microseconds)
  mode: uint8  % # ROI mode (see above)
  lat: double  % # Latitude to point to
  lon: double  % # Longitude to point to
  alt: single  % # Altitude to point to
  roll_offset: single  % # angle offset in rad
  pitch_offset: single  % # angle offset in rad
  yaw_offset: single  % # angle offset in rad

PX4_VEHICLE_ROI = enum(AddClassNameToEnumNames=true)
  ROI_NONE = 0  % # No region of interest
  ROI_WPNEXT = 1  % # Point toward next MISSION with optional offset
  ROI_WPINDEX = 2  % # Point toward given MISSION
  ROI_LOCATION = 3  % # Point toward fixed location
  ROI_TARGET = 4  % # Point toward target
  ROI_ENUM_END = 5

px4_vehicle_status = Simulink.Bus()
  timestamp: fixdt(0,64,0)  % # time since system start (microseconds)
  nav_state: uint8  % # set navigation state machine to specified value
  nav_state_timestamp: fixdt(0,64,0)  % # time when current nav_state activated
  arming_state: uint8  % # current arming state
  hil_state: uint8  % # current hil state
  failsafe: boolean  % # true if system is in failsafe state (e.g.:RTL, Hover, Terminate, ...)
  failsafe_timestamp: fixdt(0,64,0)  % # time when failsafe was activated
  system_type: uint8  % # system type, contains mavlink MAV_TYPE
  system_id: uint8  % # system id, contains MAVLink's system ID field
  component_id: uint8  % # subsystem / component id, contains MAVLink's component ID field
  vehicle_type: uint8  % # Type of vehicle (fixed-wing, rotary wing, ground)
  is_vtol: boolean  % # True if the system is VTOL capable
  is_vtol_tailsitter: boolean  % # True if the system performs a 90° pitch down rotation during transition from MC to FW
  vtol_fw_permanent_stab: boolean  % # True if VTOL should stabilize attitude for fw in manual mode
  in_transition_mode: boolean  % # True if VTOL is doing a transition
  in_transition_to_fw: boolean  % # True if VTOL is doing a transition from MC to FW
  rc_signal_lost: boolean  % # true if RC reception lost
  rc_input_mode: uint8  % # set to 1 to disable the RC input, 2 to enable manual control to RC in mapping.
  data_link_lost: boolean  % # datalink to GCS lost
  data_link_lost_counter: uint8  % # counts unique data link lost events
  high_latency_data_link_lost: boolean  % # Set to true if the high latency data link (eg. RockBlock Iridium 9603 telemetry module) is lost
  engine_failure: boolean  % # Set to true if an engine failure is detected
  mission_failure: boolean  % # Set to true if mission could not continue/finish
  geofence_violated: boolean
  failure_detector_status: uint8  % # Bitmask containing FailureDetector status [0, 0, 0, 0, 0, FAILURE_ALT, FAILURE_PITCH, FAILURE_ROLL]
  onboard_control_sensors_present: uint32
  onboard_control_sensors_enabled: uint32
  onboard_control_sensors_health: uint32
  latest_arming_reason: uint8
  latest_disarming_reason: uint8
  armed_time: fixdt(0,64,0)  % # Arming timestamp (microseconds)
  takeoff_time: fixdt(0,64,0)  % # Takeoff timestamp (microseconds)

PX4_VEHICLE_STATUS = enum(AddClassNameToEnumNames=true)
  ARMING_STATE_INIT = 0
  ARMING_STATE_STANDBY = 1
  ARMING_STATE_ARMED = 2
  ARMING_STATE_STANDBY_ERROR = 3
  ARMING_STATE_SHUTDOWN = 4
  ARMING_STATE_IN_AIR_RESTORE = 5
  ARMING_STATE_MAX = 6
  FAILURE_NONE = 0
  FAILURE_ROLL = 1  % # (1 << 0)
  FAILURE_PITCH = 2  % # (1 << 1)
  FAILURE_ALT = 4  % # (1 << 2)
  FAILURE_EXT = 8  % # (1 << 3)
  FAILURE_ARM_ESC = 16  % # (1 << 4)
  HIL_STATE_OFF = 0
  HIL_STATE_ON = 1
  NAVIGATION_STATE_MANUAL = 0  % # Manual mode
  NAVIGATION_STATE_ALTCTL = 1  % # Altitude control mode
  NAVIGATION_STATE_POSCTL = 2  % # Position control mode
  NAVIGATION_STATE_AUTO_MISSION = 3  % # Auto mission mode
  NAVIGATION_STATE_AUTO_LOITER = 4  % # Auto loiter mode
  NAVIGATION_STATE_AUTO_RTL = 5  % # Auto return to launch mode
  NAVIGATION_STATE_AUTO_LANDENGFAIL = 8  % # Auto land on engine failure
  NAVIGATION_STATE_AUTO_LANDGPSFAIL = 9  % # Auto land on gps failure (e.g. open loop loiter down)
  NAVIGATION_STATE_ACRO = 10  % # Acro mode
  NAVIGATION_STATE_UNUSED = 11  % # Free slot
  NAVIGATION_STATE_DESCEND = 12  % # Descend mode (no position control)
  NAVIGATION_STATE_TERMINATION = 13  % # Termination mode
  NAVIGATION_STATE_OFFBOARD = 14
  NAVIGATION_STATE_STAB = 15  % # Stabilized mode
  NAVIGATION_STATE_UNUSED2 = 16  % # Free slot
  NAVIGATION_STATE_AUTO_TAKEOFF = 17  % # Takeoff
  NAVIGATION_STATE_AUTO_LAND = 18  % # Land
  NAVIGATION_STATE_AUTO_FOLLOW_TARGET = 19  % # Auto Follow
  NAVIGATION_STATE_AUTO_PRECLAND = 20  % # Precision land with landing target
  NAVIGATION_STATE_ORBIT = 21  % # Orbit in a circle
  NAVIGATION_STATE_MAX = 22
  RC_IN_MODE_DEFAULT = 0
  RC_IN_MODE_OFF = 1
  RC_IN_MODE_GENERATED = 2
  VEHICLE_TYPE_UNKNOWN = 0
  VEHICLE_TYPE_ROTARY_WING = 1
  VEHICLE_TYPE_FIXED_WING = 2
  VEHICLE_TYPE_ROVER = 3
  VEHICLE_TYPE_AIRSHIP = 4
  ARM_DISARM_REASON_TRANSITION_TO_STANDBY = 0
  ARM_DISARM_REASON_RC_STICK = 1
  ARM_DISARM_REASON_RC_SWITCH = 2
  ARM_DISARM_REASON_COMMAND_INTERNAL = 3
  ARM_DISARM_REASON_COMMAND_EXTERNAL = 4
  ARM_DISARM_REASON_MISSION_START = 5
  ARM_DISARM_REASON_SAFETY_BUTTON = 6
  ARM_DISARM_REASON_AUTO_DISARM_LAND = 7
  ARM_DISARM_REASON_AUTO_DISARM_PREFLIGHT = 8
  ARM_DISARM_REASON_KILL_SWITCH = 9
  ARM_DISARM_REASON_LOCKDOWN = 10
  ARM_DISARM_REASON_FAILURE_DETECTOR = 11
  ARM_DISARM_REASON_SHUTDOWN = 12
  ARM_DISARM_REASON_UNIT_TEST = 13

px4_vehicle_status_flags = Simulink.Bus()
  timestamp: fixdt(0,64,0)  % # time since system start (microseconds)
  condition_calibration_enabled: boolean
  condition_system_sensors_initialized: boolean
  condition_system_hotplug_timeout: boolean  % # true if the hotplug sensor search is over
  condition_system_returned_to_home: boolean
  condition_auto_mission_available: boolean
  condition_angular_velocity_valid: boolean
  condition_attitude_valid: boolean
  condition_local_altitude_valid: boolean
  condition_local_position_valid: boolean  % # set to true by the commander app if the quality of the local position estimate is good enough to use for navigation
  condition_local_velocity_valid: boolean  % # set to true by the commander app if the quality of the local horizontal velocity data is good enough to use for navigation
  condition_global_position_valid: boolean  % # set to true by the commander app if the quality of the global position estimate is good enough to use for navigation
  condition_home_position_valid: boolean  % # indicates a valid home position (a valid home position is not always a valid launch)
  condition_power_input_valid: boolean  % # set if input power is valid
  condition_battery_healthy: boolean  % # set if battery is available and not low
  condition_escs_error: boolean  % # set to true if one or more ESCs reporting esc_status are offline
  condition_escs_failure: boolean  % # set to true if one or more ESCs reporting esc_status has a failure
  circuit_breaker_engaged_power_check: boolean
  circuit_breaker_engaged_airspd_check: boolean
  circuit_breaker_engaged_enginefailure_check: boolean
  circuit_breaker_flight_termination_disabled: boolean
  circuit_breaker_engaged_usb_check: boolean
  circuit_breaker_engaged_posfailure_check: boolean  % # set to true when the position valid checks have been disabled
  circuit_breaker_vtol_fw_arming_check: boolean  % # set to true if for VTOLs arming in fixed-wing mode should be allowed
  offboard_control_signal_found_once: boolean
  offboard_control_signal_lost: boolean
  rc_signal_found_once: boolean
  rc_input_blocked: boolean  % # set if RC input should be ignored temporarily
  rc_calibration_valid: boolean  % # set if RC calibration is valid
  vtol_transition_failure: boolean  % # Set to true if vtol transition failed
  usb_connected: boolean  % # status of the USB power supply
  sd_card_detected_once: boolean  % # set to true if the SD card was detected
  avoidance_system_required: boolean  % # Set to true if avoidance system is enabled via COM_OBS_AVOID parameter
  avoidance_system_valid: boolean  % # Status of the obstacle avoidance system

px4_vehicle_thrust_setpoint = Simulink.Bus()
  timestamp: fixdt(0,64,0)  % # time since system start (microseconds)
  timestamp_sample: fixdt(0,64,0)  % # timestamp of the data sample on which this message is based (microseconds)
  xyz: single[3]  % # thrust setpoint along X, Y, Z body axis (in N)

px4_vehicle_torque_setpoint = Simulink.Bus()
  timestamp: fixdt(0,64,0)  % # time since system start (microseconds)
  timestamp_sample: fixdt(0,64,0)  % # timestamp of the data sample on which this message is based (microseconds)
  xyz: single[3]  % # torque setpoint about X, Y, Z body axis (in N.m)

px4_vehicle_trajectory_bezier = Simulink.Bus()
  timestamp: fixdt(0,64,0)  % # time since system start (microseconds)
  control_points: trajectory_bezier[5]
  bezier_order: uint8

PX4_VEHICLE_TRAJECTORY_BEZIER = enum(AddClassNameToEnumNames=true)
  POINT_0 = 0
  POINT_1 = 1
  POINT_2 = 2
  POINT_3 = 3
  POINT_4 = 4
  NUMBER_POINTS = 5

px4_vehicle_trajectory_waypoint = Simulink.Bus()
  timestamp: fixdt(0,64,0)  % # time since system start (microseconds)
  type: uint8  % # Type from MAV_TRAJECTORY_REPRESENTATION enum.
  waypoints: trajectory_waypoint[5]

PX4_VEHICLE_TRAJECTORY_WAYPOINT = enum(AddClassNameToEnumNames=true)
  MAV_TRAJECTORY_REPRESENTATION_WAYPOINTS = 0
  POINT_0 = 0
  POINT_1 = 1
  POINT_2 = 2
  POINT_3 = 3
  POINT_4 = 4
  NUMBER_POINTS = 5

px4_vtol_vehicle_status = Simulink.Bus()
  timestamp: fixdt(0,64,0)  % # time since system start (microseconds)
  vtol_in_rw_mode: boolean  % # true: vtol vehicle is in rotating wing mode
  vtol_in_trans_mode: boolean
  in_transition_to_fw: boolean  % # True if VTOL is doing a transition from MC to FW
  vtol_transition_failsafe: boolean  % # vtol in transition failsafe mode
  fw_permanent_stab: boolean  % # In fw mode stabilize attitude even if in manual mode

PX4_VTOL_VEHICLE_STATUS = enum(AddClassNameToEnumNames=true)
  VEHICLE_VTOL_STATE_UNDEFINED = 0
  VEHICLE_VTOL_STATE_TRANSITION_TO_FW = 1
  VEHICLE_VTOL_STATE_TRANSITION_TO_MC = 2
  VEHICLE_VTOL_STATE_MC = 3
  VEHICLE_VTOL_STATE_FW = 4

px4_wheel_encoders = Simulink.Bus()
  timestamp: fixdt(0,64,0)  % # time since system start (microseconds)
  encoder_position: fixdt(1,64,0)  % # The wheel position, in encoder counts since boot. Positive is forward rotation, negative is reverse rotation
  speed: int32  % # Speed of each wheel, in encoder counts per second. Positive is forward, negative is reverse
  pulses_per_rev: uint32  % # Number of pulses per revolution for each wheel

px4_wind = Simulink.Bus()
  timestamp: fixdt(0,64,0)  % # time since system start (microseconds)
  timestamp_sample: fixdt(0,64,0)  % # the timestamp of the raw data (microseconds)
  windspeed_north: single  % # Wind component in north / X direction (m/sec)
  windspeed_east: single  % # Wind component in east / Y direction (m/sec)
  variance_north: single  % # Wind estimate error variance in north / X direction (m/sec)**2 - set to zero (no uncertainty) if not estimated
  variance_east: single  % # Wind estimate error variance in east / Y direction (m/sec)**2 - set to zero (no uncertainty) if not estimated
  tas_innov: single  % # True airspeed innovation
  tas_innov_var: single  % # True airspeed innovation variance
  beta_innov: single  % # Sideslip measurement innovation
  beta_innov_var: single  % # Sideslip measurement innovation variance

px4_yaw_estimator_status = Simulink.Bus()
  timestamp: fixdt(0,64,0)  % # time since system start (microseconds)
  timestamp_sample: fixdt(0,64,0)  % # the timestamp of the raw data (microseconds)
  yaw_composite: single  % # composite yaw from GSF (rad)
  yaw_variance: single  % # composite yaw variance from GSF (rad^2)
  yaw: single[5]  % # yaw estimate for each model in the filter bank (rad)
  innov_vn: single[5]  % # North velocity innovation for each model in the filter bank (m/s)
  innov_ve: single[5]  % # East velocity innovation for each model in the filter bank (m/s)
  weight: single[5]  % # weighting for each model in the filter bank

px4_position_setpoint_triplet = Simulink.Bus()
  timestamp: fixdt(0,64,0)  % # time since system start (microseconds)
  previous: Bus: px4_position_setpoint
  current: Bus: px4_position_setpoint
  next: Bus: px4_position_setpoint

px4_sensor_gyro_fifo = Simulink.Bus()
  timestamp: fixdt(0,64,0)  % # time since system start (microseconds)
  timestamp_sample: fixdt(0,64,0)
  device_id: uint32  % # unique device ID for the sensor that does not change between power cycles
  dt: single  % # delta time between samples (microseconds)
  scale: single
  samples: uint8  % # number of valid samples
  x: int16[32]  % # angular velocity in the FRD board frame X-axis in rad/s
  y: int16[32]  % # angular velocity in the FRD board frame Y-axis in rad/s
  z: int16[32]  % # angular velocity in the FRD board frame Z-axis in rad/s

px4_position_setpoint = Simulink.Bus()
  timestamp: fixdt(0,64,0)  % # time since system start (microseconds)
  valid: boolean  % # true if setpoint is valid
  type: uint8  % # setpoint type to adjust behavior of position controller
  vx: single  % # local velocity setpoint in m/s in NED
  vy: single  % # local velocity setpoint in m/s in NED
  vz: single  % # local velocity setpoint in m/s in NED
  velocity_valid: boolean  % # true if local velocity setpoint valid
  velocity_frame: uint8  % # to set velocity setpoints in NED or body
  alt_valid: boolean  % # do not set for 3D position control. Set to true if you want z-position control while doing vx,vy velocity control.
  lat: double  % # latitude, in deg
  lon: double  % # longitude, in deg
  alt: single  % # altitude AMSL, in m
  yaw: single  % # yaw (only for multirotors), in rad [-PI..PI), NaN = hold current yaw
  yaw_valid: boolean  % # true if yaw setpoint valid
  yawspeed: single  % # yawspeed (only for multirotors, in rad/s)
  yawspeed_valid: boolean  % # true if yawspeed setpoint valid
  landing_gear: int8  % # landing gear: see definition of the states in landing_gear.msg
  loiter_radius: single  % # loiter radius (only for fixed wing), in m
  loiter_direction: int8  % # loiter direction: 1 = CW, -1 = CCW
  acceptance_radius: single  % # navigation acceptance_radius if we're doing waypoint navigation
  cruising_speed: single  % # the generally desired cruising speed (not a hard constraint)
  cruising_throttle: single  % # the generally desired cruising throttle (not a hard constraint)
  disable_weather_vane: boolean  % # VTOL: disable (in auto mode) the weather vane feature that turns the nose into the wind

NAVIGATION_MODE = enum(DefaultValue="mission")
  mission = 0
  loiter = 1
  takeoff = 2
  land = 3
  precland = 4
  rtl = 5
  engineFailure = 6
  gpsFailure = 7
  follow_target = 8

PX4_ACTUATOR_CONTROLS = enum(DefaultValue="NUM_ACTUATOR_CONTROLS", AddClassNameToEnumNames=true)
  NUM_ACTUATOR_CONTROLS = 8
  NUM_ACTUATOR_CONTROL_GROUPS = 6
  INDEX_ROLL = 1
  INDEX_PITCH = 2
  INDEX_YAW = 3
  INDEX_THROTTLE = 4
  INDEX_FLAPS = 5
  INDEX_SPOILERS = 6
  INDEX_AIRBRAKES = 7
  INDEX_LANDING_GEAR = 8
  INDEX_GIMBAL_SHUTTER = 3
  INDEX_CAMERA_ZOOM = 4
  GROUP_INDEX_ATTITUDE = 0
  GROUP_INDEX_ATTITUDE_ALTERNATE = 1
  GROUP_INDEX_GIMBAL = 2
  GROUP_INDEX_MANUAL_PASSTHROUGH = 3
  GROUP_INDEX_ALLOCATED_PART1 = 4
  GROUP_INDEX_ALLOCATED_PART2 = 5
  GROUP_INDEX_PAYLOAD = 6

PX4_MISSION_ORIGIN = enum(DefaultValue="ONBOARD")
  MAVLINK = 0
  ONBOARD = 1

PX4_RC_CHANNELS = enum(AddClassNameToEnumNames=true)
  FUNCTION_THROTTLE = 0
  FUNCTION_ROLL = 1
  FUNCTION_PITCH = 2
  FUNCTION_YAW = 3
  FUNCTION_MODE = 4
  FUNCTION_RETURN = 5
  FUNCTION_POSCTL = 6
  FUNCTION_LOITER = 7
  FUNCTION_OFFBOARD = 8
  FUNCTION_ACRO = 9
  FUNCTION_FLAPS = 10
  FUNCTION_AUX_1 = 11
  FUNCTION_AUX_2 = 12
  FUNCTION_AUX_3 = 13
  FUNCTION_AUX_4 = 14
  FUNCTION_AUX_5 = 15
  FUNCTION_PARAM_1 = 16
  FUNCTION_PARAM_2 = 17
  FUNCTION_PARAM_3_5 = 18
  FUNCTION_KILLSWITCH = 19
  FUNCTION_TRANSITION = 20
  FUNCTION_GEAR = 21
  FUNCTION_ARMSWITCH = 22
  FUNCTION_STAB = 23
  FUNCTION_AUX_6 = 24
  FUNCTION_MAN = 25
  FUNCTION_FLTBTN_SLOT_1 = 26
  FUNCTION_FLTBTN_SLOT_2 = 27
  FUNCTION_FLTBTN_SLOT_3 = 28
  FUNCTION_FLTBTN_SLOT_4 = 39
  FUNCTION_FLTBTN_SLOT_5 = 30
  FUNCTION_FLTBTN_SLOT_6 = 31
  FUNCTION_FLTBTN_SLOT_COUNT = 6

PX4_RTL_DESTINATION_TYPE = enum(DefaultValue="HOME")
  HOME = 0
  MISSION_LANDING = 1
  SAFE_POINT = 2

PX4_RTL_STATE = enum(DefaultValue="NONE")
  NONE = 0
  CLIMB = 1
  RETURN = 2
  DESCEND = 3
  LOITER = 4
  TRANSITION_TO_MC = 5
  MOVE_TO_LAND_HOVER_VTOL = 6
  LANDING = 7
  LANDED = 8
  HEAD_TO_CENTER = 9

PX4_RTL_TYPE = enum(DefaultValue="HOME")
  HOME = 0
  LAND = 1
  MISSION = 2
  CLOSEST = 3

PX4_VEHICLE_COMMAND_ACK = enum(DefaultValue="VEHICLE_RESULT_ACCEPTED", AddClassNameToEnumNames=true)
  VEHICLE_RESULT_ACCEPTED = 0
  VEHICLE_RESULT_TEMPORARILY_REJECTED = 1
  VEHICLE_RESULT_DENIED = 2
  VEHICLE_RESULT_UNSUPPORTED = 3
  VEHICLE_RESULT_FAILED = 4
  VEHICLE_RESULT_IN_PROGRESS = 5
  ARM_AUTH_DENIED_REASON_GENERIC = 0
  ARM_AUTH_DENIED_REASON_NONE = 1
  ARM_AUTH_DENIED_REASON_INVALID_WAYPOINT = 2
  ARM_AUTH_DENIED_REASON_TIMEOUT = 3
  ARM_AUTH_DENIED_REASON_AIRSPACE_IN_USE = 4
  ARM_AUTH_DENIED_REASON_BAD_WEATHER = 5
  ORB_QUEUE_LENGTH = 4

px4_mc_pos_limit = Simulink.Bus()
  lim_tilt: single
  lim_thr_min: single
  lim_thr_max: single
  lim_vel_up: single
  lim_vel_down: single
  lim_vel_horizontal: single

px4_mc_pos_traj = Simulink.Bus()
  vel_sp: single
  direction: int32
  local_time: single
  max_vel: single
  max_accel: single
  max_jerk: single
  T3: single
  T2: single
  T1: single
  state_x: single
  state_v: single
  state_a: single
  state_j: single
  state_init_x: single
  state_init_v: single
  state_init_a: single
  state_init_j: single

px4_navigator_mission_item = Simulink.Bus()
  timestamp: fixdt(0,64,0)  % # time since system start (microseconds)
  instance_count: uint32  % # Instance count of this mission. Increments monotonically whenever the mission is modified
  sequence_current: uint16  % # Sequence of the current mission item
  nav_cmd: uint16
  lat: double
  lon: double
  time_inside: single  % # time that the MAV should stay inside the radius before advancing in seconds
  acceptance_radius: single  % # default radius in which the mission is accepted as reached in meters
  loiter_radius: single  % # loiter radius in meters, 0 for a VTOL to hover, negative for counter-clockwise
  yaw: single  % # in radians NED -PI..+PI, NAN means don't change yaw
  altitude: single  % # altitude in meters (AMSL)
  frame: uint8  % # mission frame
  origin: uint8  % # mission item origin (onboard or mavlink)
  loiter_exit_xtrack: boolean  % # exit xtrack location: 0 for center of loiter wp, 1 for exit location
  force_heading: boolean  % # heading needs to be reached
  altitude_is_relative: boolean  % # true if altitude is relative from start point
  autocontinue: boolean  % # true if next waypoint should follow after this one
  vtol_back_transition: boolean  % # part of the vtol back transition sequence

px4_position_controller_status = Simulink.Bus()
  timestamp: fixdt(0,64,0)  % # time since system start (microseconds)
  nav_roll: single
  nav_pitch: single
  nav_bearing: single  % # set to NAN if not valid
  target_bearing: single  % # set to NAN if not valid
  xtrack_error: single  % # set to NAN if not valid
  wp_dist: single
  acceptance_radius: single  % # the optimal distance to a waypoint to switch to the next
  yaw_acceptance: single  % # NaN if not set
  altitude_acceptance: single  % # the optimal vertical distance to a waypoint to switch to the next
  type: uint8

px4_reference_position = Simulink.Bus()
  lat_rad: double
  lon_rad: double
  sin_lat: double
  cos_lat: double
  init_done: boolean
  timestamp: uint64

px4_rtl_position = Simulink.Bus()
  lat: double
  lon: double
  alt: single
  yaw: single
  safe_point_index: uint8
  type: uint8

px4_sensor_accel_fifo = Simulink.Bus()
  timestamp: fixdt(0,64,0)  % # time since system start (microseconds)
  timestamp_sample: fixdt(0,64,0)
  device_id: uint32  % # unique device ID for the sensor that does not change between power cycles
  dt: single  % # delta time between samples (microseconds)
  scale: single
  samples: uint8  % # number of valid samples
  x: int16[32]  % # acceleration in the FRD board frame X-axis in m/s^2
  y: int16[32]  % # acceleration in the FRD board frame Y-axis in m/s^2
  z: int16[32]  % # acceleration in the FRD board frame Z-axis in m/s^2

px4_vehicle_attitude_setpoint = Simulink.Bus()
  timestamp: fixdt(0,64,0)  % # time since system start (microseconds)
  roll_body: single  % # body angle in NED frame (can be NaN for FW)
  pitch_body: single  % # body angle in NED frame (can be NaN for FW)
  yaw_body: single  % # body angle in NED frame (can be NaN for FW)
  yaw_sp_move_rate: single  % # rad/s (commanded by user)
  q_d: single[4]  % # Desired quaternion for quaternion control
  thrust_body: single[3]  % # Normalized thrust command in body NED frame [-1,1]
  roll_reset_integral: boolean  % # Reset roll integral part (navigation logic change)
  pitch_reset_integral: boolean  % # Reset pitch integral part (navigation logic change)
  yaw_reset_integral: boolean  % # Reset yaw integral part (navigation logic change)
  fw_control_yaw: boolean  % # control heading with rudder (used for auto takeoff on runway)
  apply_flaps: uint8  % # flap config specifier

px4_weather_vane = Simulink.Bus()
  is_active: boolean
  yaw: single
  dcm_z_sp_prev: single[3]

PX4_FLIGHT_TASK_INTERNAL_STATE = enum(DefaultValue="OFF_TRACK")
  OFF_TRACK = 0
  TARGET_BEHIND = 1
  PREVIOUS_IN_FRONT = 2
  NONE = 3

PX4_VTOL_MODETYPE = enum(DefaultValue="TRANSITION_TO_FW", AddClassNameToEnumNames=true)
  TRANSITION_TO_FW = 1
  TRANSITION_TO_MC = 2
  ROTARY_WING = 3
  FIXED_WING = 4

PX4_VTOL_MODE = enum(DefaultValue="TRANSITION_TO_FW", AddClassNameToEnumNames=true)
  MC_MODE = 0
  TRANSITION_TO_FW = 1
  TRANSITION_TO_MC = 2
  FW_MODE = 3

PX4_TAKEOFF_STAGE = enum(DefaultValue="THROTTLE_UP")
  THROTTLE_UP = 0
  CLAMPED_TO_RUN_WAY = 1
  TAKEOFF = 2
  CLIMBOUT = 3
  FLY = 4
  NONE = 5

PX4_NAVIGATION_CMD = enum(DefaultValue="NAV_CMD_IDLE")
  NAV_CMD_IDLE = 0
  NAV_CMD_WAYPOINT = 16
  NAV_CMD_LOITER_UNLIMITED = 17
  NAV_CMD_LOITER_TIME_LIMIT = 19
  NAV_CMD_RETURN_TO_LAUNCH = 20
  NAV_CMD_LAND = 21
  NAV_CMD_TAKEOFF = 22
  NAV_CMD_LOITER_TO_ALT = 31
  NAV_CMD_DO_FOLLOW_REPOSITION = 33
  NAV_CMD_VTOL_TAKEOFF = 84
  NAV_CMD_VTOL_LAND = 85
  NAV_CMD_DELAY = 93
  NAV_CMD_DO_JUMP = 177
  NAV_CMD_DO_CHANGE_SPEED = 178
  NAV_CMD_DO_SET_HOME = 179
  NAV_CMD_DO_SET_SERVO = 183
  NAV_CMD_DO_LAND_START = 189
  NAV_CMD_DO_SET_ROI_LOCATION = 195
  NAV_CMD_DO_SET_ROI_WPNEXT_OFFSET = 196
  NAV_CMD_DO_SET_ROI_NONE = 197
  NAV_CMD_DO_CONTROL_VIDEO = 200
  NAV_CMD_DO_SET_ROI = 201
  NAV_CMD_DO_DIGICAM_CONTROL = 203
  NAV_CMD_DO_MOUNT_CONFIGURE = 204
  NAV_CMD_DO_MOUNT_CONTROL = 205
  NAV_CMD_DO_SET_CAM_TRIGG_INTERVAL = 214
  NAV_CMD_DO_SET_CAM_TRIGG_DIST = 206
  NAV_CMD_OBLIQUE_SURVEY = 260
  NAV_CMD_SET_CAMERA_MODE = 530
  NAV_CMD_SET_CAMERA_ZOOM = 531
  NAV_CMD_SET_CAMERA_FOCUS = 532
  NAV_CMD_DO_GIMBAL_MANAGER_PITCHYAW = 1000
  NAV_CMD_DO_GIMBAL_MANAGER_CONFIGURE = 1001
  NAV_CMD_IMAGE_START_CAPTURE = 2000
  NAV_CMD_IMAGE_STOP_CAPTURE = 2001
  NAV_CMD_DO_TRIGGER_CONTROL = 2003
  NAV_CMD_VIDEO_START_CAPTURE = 2500
  NAV_CMD_VIDEO_STOP_CAPTURE = 2501
  NAV_CMD_DO_VTOL_TRANSITION = 3000
  NAV_CMD_FENCE_RETURN_POINT = 5000
  NAV_CMD_FENCE_POLYGON_VERTEX_INCLUSION = 5001
  NAV_CMD_FENCE_POLYGON_VERTEX_EXCLUSION = 5002
  NAV_CMD_FENCE_CIRCLE_INCLUSION = 5003
  NAV_CMD_FENCE_CIRCLE_EXCLUSION = 5004
  NAV_CMD_CONDITION_GATE = 4501
  NAV_CMD_INVALID = 65535

PX4_MOTOR_STATE = enum(DefaultValue="ENABLED")
  ENABLED = 0  % # motor max pwm will be set to the standard max pwm value
  DISABLED = 1  % # motor max pwm will be set to a value that shuts the motor off
  IDLE = 2  % # motor max pwm will be set to VT_IDLE_PWM_MC
  VALUE = 3  % # motor max pwm will be set to a specific value provided, see set_motor_state()

PX4_LOITER_TYPE = enum(DefaultValue="NEXT_WP_LAND")
  NEXT_WP_LAND = 0
  IN_TAKEOFF_SITUATION = 1
  LAND_ABORT = 2
  DEFAULT = 3

PX4_LAUNCH_DETECTION_RESULT = enum(DefaultValue="LAUNCHDETECTION_RES_NONE")
  LAUNCHDETECTION_RES_NONE = 0
  LAUNCHDETECTION_RES_DETECTED_ENABLECONTROL = 1
  LAUNCHDETECTION_RES_DETECTED_ENABLEMOTORS = 2

PX4_GPSFSTATE = enum(DefaultValue="GPSF_STATE_NONE")
  GPSF_STATE_NONE = 0
  GPSF_STATE_LOITER = 1
  GPSF_STATE_TERMINATE = 2
  GPSF_STATE_END = 3

PX4_FW_CONTROL = enum(DefaultValue="AUTO_MODE")
  AUTO_MODE = 0
  POS_MODE = 1
  ALT_MODE = 2
  OTHER_MODE = 3

PX4_FLIGHT_TASK_ERROR = enum(DefaultValue="NO_ERROR")
  NO_ERROR = 0
  INVALID_TASK = -1
  ACTIVATION_FAILED = -2

PX4_FLIGHT_TASK = enum(DefaultValue="NONE")
  NONE = -1
  AUTO_FOLLOW_ME = 0
  AUTO_LINE_SMOOTH_VEL = 1
  DESCEND = 2
  FAILSAFE = 3
  MANUAL_ACCELERATION = 4
  MANUAL_ALTITUDE = 5
  MANUAL_ALTITUDE_SMOOTH_VEL = 6
  MANUAL_POSITION = 7
  MANUAL_POSITION_SMOOTH_VEL = 8
  TRANSITION = 9
  ORBIT = 10

PX4_EFSTATE = enum(DefaultValue="EF_STATE_NONE", AddClassNameToEnumNames=true)
  EF_STATE_NONE = 0
  EF_STATE_LOITERDOWN = 1

PX4_CONTROL_MODE_CURRENT = enum(DefaultValue="FW_POSCTRL_MODE_AUTO")
  FW_POSCTRL_MODE_AUTO = 0
  FW_POSCTRL_MODE_POSITION = 1
  FW_POSCTRL_MODE_ALTITUDE = 2
  FW_POSCTRL_MODE_OTHER = 3

PX4_ARM_AUTH_METHODS = enum(DefaultValue="ARM_AUTH_METHOD_ARM_REQ", AddClassNameToEnumNames=true)
  ARM_AUTH_METHOD_ARM_REQ = 0
  ARM_AUTH_METHOD_TWO_ARM_REQ = 1
  ARM_AUTH_METHOD_LAST = 2

px4_vtol_schedule = Simulink.Bus()
  flight_mode: uint8  % # Log levels: 4 bits MSB: internal, 4 bits LSB: external
  transition_start: uint64

px4_tecs_input = Simulink.Bus()
  mode: uint8
  in_air: boolean
  euler: single[1 3]
  body_vel: single[1 3]
  baro_altitude: single
  hgt_setpoint: single
  EAS_setpoint: single
  equivalent_airspeed: single
  eas_to_tas: single
  climb_out_setpoint: boolean
  pitch_min_climbout: single
  throttle_min: single
  throttle_max: single
  throttle_cruise: single
  pitch_limit_min: single
  pitch_limit_max: single
  target_climbrate: single
  target_sinkrate: single
  hgt_rate_sp: single
  height_error_gain: single
  local_pos_vz: single
  pitch_speed_weight: single
  speed_deriv_forward: single
  tas_rate_filtered: single

px4_arm_requqirements = Simulink.Bus()
  arm_authorization: boolean
  esc_check: boolean
  global_position: boolean
  mission: boolean
  geofence: boolean

px4_map_projection_reference = Simulink.Bus()
  timestamp: fixdt(0,64,0)
  lat_rad: double
  lon_rad: double
  sin_lat: double
  cos_lat: double
  init_done: boolean

PX4_ARM_DISARM_REASON = enum(DefaultValue="TRANSITION_TO_STANDBY")
  TRANSITION_TO_STANDBY = 0
  RC_STICK = 1
  RC_SWITCH = 2
  COMMAND_INTERNAL = 3
  COMMAND_EXTERNAL = 4
  MISSION_START = 5
  SAFETY_BUTTON = 6
  AUTO_DISARM_LAND = 7
  AUTO_DISARM_PREFLIGHT = 8
  KILL_SWITCH = 9
  LOCKDOWN = 10
  FAILURE_DETECTOR = 11
  SHUTDOWN = 12
  UNIT_TEST = 13